# Dynamo graph ApplicationInfo.dyn (Dynamo 2.16.1.2727)
# packages: Orchid 216.3.0.8438

# group: DateTime
now = DateTime.Now()
code_block = CodeBlock { "da-DK"; "en-GB"; "es-ES"; "fr-FR"; "de-DE"; "zh-Hant"; "ja-JP"; "en-US"; }
byName = Orchid.Common.Global.Culture.ByName(name=code_block.out0)
now_2 = Orchid.Common.Global.DateTime.Now(culture=byName)
byName_2 = Orchid.Common.Global.Culture.ByName(name=code_block.out5)
setDateTime = Orchid.Common.Global.Culture.SetDateTime(culture=byName_2)
now_3 = Orchid.Common.Global.DateTime.Now(culture=setDateTime)
byName_3 = Orchid.Common.Global.Culture.ByName(name=code_block.out7)
edit = Orchid.Common.Global.Culture.Edit(culture=byName_3)
string = StringInput("\"%a, %d %b %Y %H:%M:%S\"")
setDateTime_2 = Orchid.Common.Global.Culture.SetDateTime(culture=edit, full=string)
now_4 = Orchid.Common.Global.DateTime.Now(culture=setDateTime_2)
list_create = List.Create(item0=now, item1=now_2, item2=now_3, item3=now_4)
culture = Culture("da-DK")
culture_2 = Culture("en-US")

watch = Watch(list_create)

# group: Revit info
username = Orchid.AdeskApp.Revit.Username()
applicationFolder = Orchid.AdeskApp.Revit.ApplicationFolder()
format = Orchid.AdeskApp.Revit.Format()
version = Orchid.AdeskApp.Revit.Version()
versionBuild = Orchid.AdeskApp.Revit.VersionBuild()
language = Orchid.AdeskApp.Revit.Language()
list_create_2 = List.Create(item0=username, item1=applicationFolder, item2=format, item3=version, item4=versionBuild, item5=language)

# group: Dynamo info
graphPath = Orchid.AdeskApp.Dynamo.GraphPath()
graphGuid = Orchid.AdeskApp.Dynamo.GraphGuid()
version_2 = Orchid.AdeskApp.Dynamo.Version()
versionBuild_2 = Orchid.AdeskApp.Dynamo.VersionBuild()
applicationFolder_2 = Orchid.AdeskApp.Dynamo.ApplicationFolder()
packagesPath = Orchid.AdeskApp.Dynamo.PackagesPath()
definitionsPath = Orchid.AdeskApp.Dynamo.DefinitionsPath()
list_create_3 = List.Create(item0=graphPath, item1=graphGuid, item2=version_2, item3=versionBuild_2, item4=applicationFolder_2, item5=packagesPath, item6=definitionsPath)

# group: Document info
info = Orchid.RevitProject.Common.Document.Info()
unit = Orchid.RevitProject.Common.Document.Unit()
name = Orchid.RevitProject.Common.Document.Name()
path = Orchid.RevitProject.Common.Document.Path()
directory = Orchid.RevitProject.Common.Document.Directory()
list_create_4 = List.Create(item0=info, item1=unit, item2=name, item3=path, item4=directory)

list_create_5 = List.Create(item0=list_create_2, item1=list_create_3, item2=list_create_4)
watch_2 = Watch(list_create_5)
