# Dynamo graph Revit Application.dyn (Dynamo 2.16.1.2727)
# packages: Orchid 216.3.0.8438

username = Orchid.AdeskApp.Revit.Username()
watch = Watch(username)
format = Orchid.AdeskApp.Revit.Format()
watch_2 = Watch(format)
versionBuild = Orchid.AdeskApp.Revit.VersionBuild()
watch_3 = Watch(versionBuild)
version = Orchid.AdeskApp.Revit.Version()
watch_4 = Watch(version)
