# Dynamo graph Culture.dyn (Dynamo 2.16.1.2727)
# packages: Orchid 216.3.0.8441

# group: Culture name, by name, and display name
culture = Culture("da-DK")
byName = Orchid.Common.Global.Culture.ByName(name=culture)
displayName = Orchid.Common.Global.Culture.DisplayName(culture=byName)
watch = Watch(displayName)
name = Orchid.Common.Global.Culture.Name(culture=byName)
watch_2 = Watch(name)
watch_3 = Watch(byName)

# group: Current culture Current revit culture
current = Orchid.Common.Global.Culture.Current()
culture_2 = Orchid.AdeskApp.Revit.Culture()
edit = Orchid.Common.Global.Culture.Edit(culture=culture_2)

# group: All Cultures
all = Orchid.Common.Global.Culture.All()
watch_4 = Watch(all)

# group: All Languages
all_2 = Orchid.AdeskApp.Language.All()
watch_5 = Watch(all_2)

# group: Language name and by name
revit_language = Language("English_USA")
byName_2 = Orchid.AdeskApp.Language.ByName(name=revit_language)
watch_6 = Watch(byName_2)
language = Orchid.AdeskApp.Revit.Language()
watch_7 = Watch(language)
culture_3 = Orchid.AdeskApp.Language.Culture(language=language)
watch_8 = Watch(culture_3)

# group: Modify number
code_block = CodeBlock { 4; ","; }
setNumber = Orchid.Common.Global.Culture.SetNumber(culture=edit, digit=code_block.out0, decimal=code_block.out1)
setNumberSymbol = Orchid.Common.Global.Culture.SetNumberSymbol(culture=setNumber)

# group: Modify percentage
code_block_2 = CodeBlock { 4; ",,"; }
setPercentage = Orchid.Common.Global.Culture.SetPercentage(culture=edit, digit=code_block_2.out0, decimal=code_block_2.out1)
setPercentageSymbol = Orchid.Common.Global.Culture.SetPercentageSymbol(culture=setPercentage)

# group: Modify currency
code_block_3 = CodeBlock { 4; ".."; "#"; }
setCurrency = Orchid.Common.Global.Culture.SetCurrency(culture=edit, digit=code_block_3.out0, decimal=code_block_3.out1)
setCurrencySymbol = Orchid.Common.Global.Culture.SetCurrencySymbol(culture=setCurrency, symbol=code_block_3.out2)

# group: Modify calendar, time and date
code_block_4 = CodeBlock { "Tuesday"; }
setCalendar = Orchid.Common.Global.Culture.SetCalendar(culture=edit, firstDay=code_block_4)
setDateTime = Orchid.Common.Global.Culture.SetDateTime(culture=setCalendar)
setDate = Orchid.Common.Global.Culture.SetDate(culture=setDateTime)
setTime = Orchid.Common.Global.Culture.SetTime(culture=setDate)

# group: DateTime
today = DateTime.Today()
format = DateTime.Format(dateTime=today)
watch_9 = Watch(format)
dayOfWeek = DateTime.DayOfWeek(dateTime=today)
watch_10 = Watch(dayOfWeek)
