# Dynamo graph Info-Clipboard.dyn (Dynamo 2.16.1.2727)
# packages: Orchid 216.3.0.8442

# group: Clipboard --> copy element
elementHasMaterial = Orchid.RevitProject.Elements.Selection.ElementHasMaterial()
watch = Watch(elementHasMaterial.Element)
copyTo = Orchid.Common.Clipboard.CopyTo(object=elementHasMaterial.Element)  # frozen

# group: Clipboard --> copy int
code_block = CodeBlock { 1..5; }
copyTo_2 = Orchid.Common.Clipboard.CopyTo(object=code_block)  # frozen
watch_2 = Watch(code_block)

# group: Current document Info and copy to clipboard
info = Orchid.RevitProject.Common.Document.Info()
copyTo_3 = Orchid.Common.Clipboard.CopyTo(object=info)

watch_3 = Watch(copyTo_3)
watch_4 = Watch(info)

# group: File Info and copy to clipboard
directory_path = StringInput("%userprofile%\Programming\Testing\Data\testSet\")  # graph input
contents = Orchid.Common.Directory.Contents(directory=directory_path)
info_2 = Orchid.Common.File.Info(file=contents)
copyTo_4 = Orchid.Common.Clipboard.CopyTo(object=info_2)

watch_5 = Watch(info_2)
watch_6 = Watch(copyTo_4)
