# Dynamo graph List Index_R23.dyn "List Index" (Dynamo 2.16.1.2727)
# packages: Orchid 216.3.0.5794

# group: Input
code_block = CodeBlock()
# ---------- code_block.designscript (7 lines) ----------
def element() {
	t1 = "b";
	t2 = 9;
	t3 = dataSet()[3][1];

	return = t1;
};
# ----------------------------------------
code_block_2 = CodeBlock()
# ---------- code_block_2.designscript (7 lines) ----------
def replace() {
	t1 = "c";
	t2 = 5;
	t3 = dataSet()[3][0];

	return = t1;
};
# ----------------------------------------
code_block_3 = CodeBlock { dataSet(); element(); replace(); }
code_block_4 = CodeBlock()
# ---------- code_block_4.designscript (52 lines) ----------
def dataSet() {
	// Char data sets
	// 1D list
	c1 = ["a", "a", "a", "a", "b"];

	// 2D list
	c2 = [["a", "a", "a", "a", "b"],
	["a", "b", "a"],
	["a", "a", "a", "b", "b", "a"]];

	// nD list
	c3 = ["a", "a", "b",
	["a", "a", "a", "a", "b"],
	["a", "b", "a",
	["a", "a", "b", "b", "a", "a"]]];

	// nD list
	c4 = ["a", "b", ["a", ["a", "b",
	["a", "b"]], "a", "b"],
	["a", "b", "a",
	["a", "a", "b", "b", "a"]]];

	// Integer data sets
	// 1D list
	i1 = [1, 1, 9, 1, 1];

	// 2D list
	i2 = [[1, 1, 9, 1, 1],
	[9, 1, 1],
	[1, 1, 9, 9, 1, 1]];

	// nD list
	i3 = [1, 9, 1,
	[1, 1, 1, 9, 1],
	[1, 1, 9,
	[1, 1, 1, 9, 9, 1]]];

	// nD list
	i4 = [1, 9, [1, [9, 1,
	[1, 9]], 1, 9],
	[9, 9, 1,
	[1, 9, 9, 1, 1]]];

	// element data set
	e1 = List.FirstItem(
	Orchid.RevitProject.Elements
	.Element.HasMaterial(null))
	.ElementType;

	// return data set
	return = c3;
};
# ----------------------------------------

watch = Watch(code_block_3.out0)

# group: Item index
indexOf = List.IndexOf(list=code_block_3.out0, element=code_block_3.out1)
indexOf_2 = Orchid.Common.List.IndexOf(list=code_block_3.out0, item=code_block_3.out1)
watch_2 = Watch(indexOf_2)
watch_3 = Watch(indexOf)

# group: Get items
getItemAtIndex = List.GetItemAtIndex(list=code_block_3.out0, index=indexOf)
watch_4 = Watch(getItemAtIndex)
getItemAtIndex_2 = Orchid.Common.List.GetItemAtIndex(list=code_block_3.out0, index=indexOf_2)
watch_5 = Watch(getItemAtIndex_2)

# group: Replace items
replaceItemAtIndex = List.ReplaceItemAtIndex(list=code_block_3.out0, index=indexOf, item=code_block_3.out2)
watch_6 = Watch(replaceItemAtIndex)
replaceItemAtIndex_2 = Orchid.Common.List.ReplaceItemAtIndex(list=code_block_3.out0, index=indexOf_2, item=code_block_3.out2)
watch_7 = Watch(replaceItemAtIndex_2)

# group: Get items by code block
code_block_5 = CodeBlock(t=code_block_3.out0) { t[4][3][3]; }
watch_8 = Watch(code_block_5)
