# Dynamo graph List.Clean.dyn (Dynamo 2.16.1.2727)
# packages: Orchid 216.3.0.8442

searchfor_values = CodeBlock()
# ---------- searchfor_values.designscript (8 lines) ----------
//default values
[[], null, ""];

//various test values
[[]];
"something";
["something", []];
[[], null, 0, "", "whatever"];
# ----------------------------------------
list_values = CodeBlock()
# ---------- list_values.designscript (6 lines) ----------
[
"a","a", 0,
[],null,"",
"something",
"whatever"
];
# ----------------------------------------
clean = Orchid.Common.List.Clean(list=list_values)
watch = Watch(clean)
list_values_2 = CodeBlock()
# ---------- list_values_2.designscript (9 lines) ----------
[
"a","a", 0,
[],null,"",
"something",
[[["in",[]],
"several",null],
"depths","",0],
"whatever"
];
# ----------------------------------------
clean_2 = Orchid.Common.List.Clean(list=list_values_2)
watch_2 = Watch(clean_2)
watch_3 = Watch(list_values_2)
code_block = CodeBlock(list=list_values) { Orchid.Common.List.Clean(list,searchFor); }  # unwired: searchFor
watch_4 = Watch(code_block)
