# Dynamo graph List.IncrementalCount.dyn (Dynamo 2.16.1.2727)
# packages: Orchid 216.3.0.8442

searchfor_values = CodeBlock()
# ---------- searchfor_values.designscript (8 lines) ----------
//default values
[[], null, ""];

//various test values
[[]];
"something";
["something", []];
[[], null, 0, "", "whatever"];
# ----------------------------------------
list_values = CodeBlock()
# ---------- list_values.designscript (9 lines) ----------
[
"a","a", 0,
[],null,"",
"something",
[[["in",[]],
"several",null],
"depths","",0],
"whatever"
];
# ----------------------------------------
watch = Watch(list_values)
list_values_2 = CodeBlock()
# ---------- list_values_2.designscript (6 lines) ----------
[
"a","a", 0,
[],null,"",
"something",
"whatever"
];
# ----------------------------------------
incrementalCount = Orchid.Common.List.IncrementalCount(list=list_values_2)
watch_2 = Watch(incrementalCount)
incrementalCount_2 = Orchid.Common.List.IncrementalCount(list=list_values)
watch_3 = Watch(incrementalCount_2)
code_block = CodeBlock(list=list_values_2) { Orchid.Common.List.IncrementalCount(list); }
watch_4 = Watch(code_block)
