# Dynamo graph List.Replace.dyn (Dynamo 2.16.1.2727)
# packages: Orchid 216.3.0.5794

searchfor_values = CodeBlock()
# ---------- searchfor_values.designscript (8 lines) ----------
//default values
[[], null, ""];

//various test values
[[]];
"something";
["something", []];
[[], null, 0, "", "whatever"];
# ----------------------------------------
list_values = CodeBlock()
# ---------- list_values.designscript (9 lines) ----------
[
"a","a", 0,
[],null,"",
"something",
[[["in",[]],
"several",null],
"depths","",0],
"whatever"
];
# ----------------------------------------
watch = Watch(list_values)
list_values_2 = CodeBlock()
# ---------- list_values_2.designscript (6 lines) ----------
[
"a","a", 0,
[],null,"",
"something",
"whatever"
];
# ----------------------------------------
replacewith_value = CodeBlock { "x"; }
replace = Orchid.Common.List.Replace(list=list_values_2, replaceWith=replacewith_value)
watch_2 = Watch(replace)
replace_2 = Orchid.Common.List.Replace(list=list_values, replaceWith=replacewith_value)
watch_3 = Watch(replace_2)
code_block = CodeBlock()
# ---------- code_block.designscript (10 lines) ----------
//list values
[
[0,0,0],
["","",""],
[2,2,2]
];
//searchFor
"";
//replaceWith value
1;
# ----------------------------------------
replace_3 = Orchid.Common.List.Replace(list=code_block.out0, searchFor=code_block.out1, replaceWith=code_block.out2)
watch_4 = Watch(replace_3)
code_block_2 = CodeBlock(list=list_values_2, replaceWith=replacewith_value) { Orchid.Common.List.Replace(list, searchFor, replaceWith); }  # unwired: searchFor
watch_5 = Watch(code_block_2)
