# Dynamo graph PDFexport.dyn (Dynamo 2.16.1.2727)
# packages: Orchid 216.3.0.8442

string = StringInput("testSetting")  # graph input
createSetting = Orchid.Common.PDFexport.CreateSetting(name=string)
pdfexport_papersizes = PaperSize("ISO A3 : 297x420 mm")
print_pageorientation = PageOrientation("Portrait")  # graph input
print_paperplacement = PaperPlacement("Lower Left")  # graph input
print_margintype = MarginType("User defined")  # graph input
code_block = CodeBlock { [10,10]; }
print_zoomtype = ZoomType("Zoom")  # graph input
code_block_2 = CodeBlock { 100; }
changeSetting = Orchid.Common.PDFexport.ChangeSetting(exportSetting=createSetting, paperZize=pdfexport_papersizes, pageOrientation=print_pageorientation, paperPlacement=print_paperplacement, marginType=print_margintype, margin=code_block, zoomType=print_zoomtype, zoom=code_block_2)

# group: Merge PDF files
code_block_3 = CodeBlock()
# ---------- code_block_3.designscript (6 lines) ----------
//input documents
["%userprofile%\\Downloads\\PDF\\pdf1.pdf",
"%userprofile%\\Downloads\\PDF\\pdf2.pdf"];

//output file path
"%userprofile%\\Downloads\\PDF\\result.pdf";
# ----------------------------------------
mergePDF = Orchid.Common.File.MergePDF(documents=code_block_3.out0, filePath=code_block_3.out1)  # frozen

# group: Print current view (center and fit to page)
string_2 = StringInput("testSetting")  # graph input
pdfexport_papersizes_2 = PaperSize("<Use Sheet Size>")
print_paperplacement_2 = PaperPlacement("Center")  # graph input
print_zoomtype_2 = ZoomType("Fit To Page")  # graph input
createSetting_2 = Orchid.Common.PDFexport.CreateSetting(name=string_2, paperZize=pdfexport_papersizes_2, paperPlacement=print_paperplacement_2, zoomType=print_zoomtype_2)
activeView = Orchid.RevitProject.Common.Document.ActiveView()
# note: if export options there are rarely set need to be included, then connect:
# "Export.SetOptions" output ExportSetting to "Export.ByView" input exportSetting!
byView = Orchid.Common.PDFexport.ByView(view=activeView, exportSetting=createSetting_2)
await_ = Orchid.Common.DataStream.Await(pass=createSetting_2, waitFor=byView)
deleteSetting = Orchid.Common.PDFexport.DeleteSetting(exportSetting=await_)

paperSize = Orchid.Common.PDFexport.PaperSize()
watch = Watch(paperSize)

# group: Print options there are rarely set
boolean = BoolSelector(true)  # graph input
boolean_2 = BoolSelector(false)  # graph input
print_rasterquality = RasterQuality("Medium")
print_colordepth = ColorDepthType("Gray Scale")  # graph input
setOptions = Orchid.Common.PDFexport.SetOptions(exportSetting=createSetting_2, viewLinksinBlue=boolean, hideReforWorkPlanes=boolean_2, hideUnreferencedViewTags=boolean, maskCoincidentLines=boolean, hideScopeBoxes=boolean_2, hideCropBoundaries=boolean_2, replaceHalftoneWithThinLines=boolean, createOutputUsing=boolean, rasterQuality=print_rasterquality, colorDepth=print_colordepth)  # frozen

string_3 = StringInput("Default")  # graph input

# group: Remove print setting
# note: Export Setting may be set
# both as an element and
# as a string
string_4 = StringInput("testSetting")  # graph input
deleteSetting_2 = Orchid.Common.PDFexport.DeleteSetting(exportSetting=string_4)  # frozen
export_setting = Setting("Default")

sheet_set = SheetSet("A3 set")  # graph input
getView = Orchid.RevitProject.Views.SheetSet.GetView(viewSheetSet=sheet_set)

# group: filePath --> file name incl. path
boolean_3 = BoolSelector(false)  # graph input
pdfexport_quality = ExportQuality("DPI300")
current = Orchid.Common.Directory.Current()
sheetNumber = Sheet.SheetNumber(sheet=getView)
code_block_4 = CodeBlock(a=current, b=sheetNumber) { a + "\\" + b; }

byViewSheetSet = Orchid.Common.PDFexport.ByViewSheetSet(combine=boolean_3, viewSheetSet=sheet_set)  # frozen
byView_2 = Orchid.Common.PDFexport.ByView(fileName=code_block_4, combine=boolean_3, view=getView)

# group: SheetSet
code_block_5 = CodeBlock { "Sheets"; }  # frozen
byName = Category.ByName(name=code_block_5)
all_elements_of_category = ElementsOfCategory(Category=byName)
string_5 = StringInput("testSet")  # graph input
create = Orchid.RevitProject.Views.SheetSet.Create(view=all_elements_of_category, name=string_5)
delete = Orchid.RevitProject.Views.SheetSet.Delete(viewSheetSet=create)  # frozen
getView_2 = Orchid.RevitProject.Views.SheetSet.GetView(viewSheetSet=create)
sheet_set_2 = SheetSet("A3 set")  # graph input
change = Orchid.RevitProject.Views.SheetSet.Change(view=getView_2, viewSheetSet=sheet_set_2)
