# Dynamo graph PDFexport_R23.dyn "PDFexport" (Dynamo 2.16.1.2727)
# packages: Orchid 216.3.0.5820

# group: Merge PDF files
code_block = CodeBlock()
# ---------- code_block.designscript (6 lines) ----------
//input documents
["%userprofile%\\Downloads\\PDF\\pdf1.pdf",
"%userprofile%\\Downloads\\PDF\\pdf2.pdf"];

//output file path
"%userprofile%\\Downloads\\PDF\\result.pdf";
# ----------------------------------------
mergePDF = Orchid.Common.File.MergePDF(documents=code_block.out0, filePath=code_block.out1)  # frozen

paperSize = Orchid.Common.PDFexport.PaperSize()
watch = Watch(paperSize)
string = StringInput("Default")  # graph input

# group: Remove print setting
# note: Export Setting may be set
# both as an element and
# as a string
string_2 = StringInput("testSetting")  # graph input
deleteSetting = Orchid.Common.PDFexport.DeleteSetting(exportSetting=string_2)  # frozen
export_setting = Setting("testSetting")

sheet_set = SheetSet("A3 set")  # graph input
getView = Orchid.RevitProject.Views.SheetSet.GetView(viewSheetSet=sheet_set)

# group: filePath --> file name incl. path
boolean = BoolSelector(false)  # graph input
pdfexport_quality = ExportQuality("DPI300")
directory = Orchid.RevitProject.Common.Document.Directory()
sheetNumber = Sheet.SheetNumber(sheet=getView)
code_block_2 = CodeBlock(a=directory, b=sheetNumber) { a + "\\" + b; }

byViewSheetSet = Orchid.Common.PDFexport.ByViewSheetSet(combine=boolean, viewSheetSet=sheet_set)  # frozen
byView = Orchid.Common.PDFexport.ByView(fileName=code_block_2, combine=boolean, view=getView)

# group: SheetSet
code_block_3 = CodeBlock { "Sheets"; }  # frozen
byName = Category.ByName(name=code_block_3)
all_elements_of_category = ElementsOfCategory(Category=byName)
string_3 = StringInput("testSet")  # graph input
create = Orchid.RevitProject.Views.SheetSet.Create(view=all_elements_of_category, name=string_3)
delete = Orchid.RevitProject.Views.SheetSet.Delete(viewSheetSet=create)  # frozen
getView_2 = Orchid.RevitProject.Views.SheetSet.GetView(viewSheetSet=create)
sheet_set_2 = SheetSet("A3 set")  # graph input
change = Orchid.RevitProject.Views.SheetSet.Change(view=getView_2, viewSheetSet=sheet_set_2)

# group: Print current view (center and fit to page)
string_4 = StringInput("testSetting2")  # graph input
pdfexport_papersizes = PaperSize("<Use Sheet Size>")
print_paperplacement = PaperPlacement("Center")  # graph input
print_zoomtype = ZoomType("Fit To Page")  # graph input
createSetting = Orchid.Common.PDFexport.CreateSetting(name=string_4, paperZize=pdfexport_papersizes, paperPlacement=print_paperplacement, zoomType=print_zoomtype)
activeView = Orchid.RevitProject.Common.Document.ActiveView()
# note: if export options there are rarely set need to be included, then connect:
# "Export.SetOptions" output ExportSetting to "Export.ByView" input exportSetting!
byView_2 = Orchid.Common.PDFexport.ByView(view=activeView, exportSetting=createSetting)
await_ = Orchid.Common.DataStream.Await(pass=createSetting, waitFor=byView_2)
deleteSetting_2 = Orchid.Common.PDFexport.DeleteSetting(exportSetting=await_)

# group: Print options there are rarely set
boolean_2 = BoolSelector(true)  # graph input
boolean_3 = BoolSelector(false)  # graph input
print_rasterquality = RasterQuality("Medium")
print_colordepth = ColorDepthType("Gray Scale")  # graph input
setOptions = Orchid.Common.PDFexport.SetOptions(exportSetting=createSetting, viewLinksinBlue=boolean_2, hideReforWorkPlanes=boolean_3, hideUnreferencedViewTags=boolean_2, maskCoincidentLines=boolean_2, hideScopeBoxes=boolean_3, hideCropBoundaries=boolean_3, replaceHalftoneWithThinLines=boolean_2, createOutputUsing=boolean_2, rasterQuality=print_rasterquality, colorDepth=print_colordepth)  # frozen

string_5 = StringInput("testSetting")  # graph input
createSetting_2 = Orchid.Common.PDFexport.CreateSetting(name=string_5)
pdfexport_papersizes_2 = PaperSize("ISO A3 : 297x420 mm")
print_pageorientation = PageOrientation("Portrait")  # graph input
print_paperplacement_2 = PaperPlacement("Lower Left")  # graph input
print_margintype = MarginType("User defined")  # graph input
code_block_4 = CodeBlock { [10,10]; }
print_zoomtype_2 = ZoomType("Zoom")  # graph input
code_block_5 = CodeBlock { 100; }
changeSetting = Orchid.Common.PDFexport.ChangeSetting(exportSetting=createSetting_2, paperZize=pdfexport_papersizes_2, pageOrientation=print_pageorientation, paperPlacement=print_paperplacement_2, marginType=print_margintype, margin=code_block_4, zoomType=print_zoomtype_2, zoom=code_block_5)
