# Dynamo graph Print.dyn (Dynamo 2.16.1.2727)
# packages: Orchid 216.3.0.8442

# group: SheetSet
code_block = CodeBlock { "Sheets"; }
byName = Category.ByName(name=code_block)
all_elements_of_category = ElementsOfCategory(Category=byName)
string = StringInput("testSet")  # graph input
create = Orchid.RevitProject.Views.SheetSet.Create(view=all_elements_of_category, name=string)
getView = Orchid.RevitProject.Views.SheetSet.GetView(viewSheetSet=create)
sheet_set = SheetSet("A3 set")  # graph input
change = Orchid.RevitProject.Views.SheetSet.Change(view=getView, viewSheetSet=sheet_set)
delete = Orchid.RevitProject.Views.SheetSet.Delete(viewSheetSet=create)

# group: Remove print setting
# note: Print Setting may be set
# both as an element and
# as a string
string_2 = StringInput("testSetting")  # graph input
deleteSetting = Orchid.Common.Print.DeleteSetting(printSetting=string_2)  # frozen
print_setting = Setting("Default")  # graph input

printer = Printer("Microsoft Print to PDF")  # graph input
string_3 = StringInput("testSetting")  # graph input
createSetting = Orchid.Common.Print.CreateSetting(printer=printer, name=string_3)
print_papersizes = PaperSize(p=printer)  # nothing selected
print_pageorientation = PageOrientation("Portrait")  # graph input
print_margintype = MarginType("User defined")  # graph input
code_block_2 = CodeBlock { [10,10]; }
changeSetting = Orchid.Common.Print.ChangeSetting(printer=printer, printSetting=createSetting, paperZize=print_papersizes, pageOrientation=print_pageorientation, marginType=print_margintype, margin=code_block_2)
printer_2 = Printer("Microsoft Print to PDF")  # graph input
sheet_set_2 = SheetSet("A3 set")  # graph input
getView_2 = Orchid.RevitProject.Views.SheetSet.GetView(viewSheetSet=sheet_set_2)

# group: filePath --> file name incl. path
current = Orchid.Common.Directory.Current()
string_4 = StringInput("testSet")  # graph input
sheetNumber = Sheet.SheetNumber(sheet=getView_2)
code_block_3 = CodeBlock(a=current, b=string_4, c=sheetNumber)
# ---------- code_block_3.designscript (3 lines) ----------
a + "\\" +
b + "\\" +
c;
# ----------------------------------------
# note: Set to "Select" to print the selected views
print_range = Range("Selected views/sheets")  # graph input

string_5 = StringInput("Default")  # graph input
byViewSheetSet = Orchid.Common.Print.ByViewSheetSet(printer=printer_2, fileName=code_block_3, viewSheetSet=sheet_set_2, printSetting=string_5)  # frozen
boolean = BoolSelector(true)  # graph input
boolean_2 = BoolSelector(true)  # graph input
byView = Orchid.Common.Print.ByView(printer=printer_2, combine=boolean, file=boolean_2, fileName=code_block_3, view=getView_2)
code_block_4 = CodeBlock { 100; }
print_zoomtype = ZoomType("Zoom")  # graph input
print_paperplacement = PaperPlacement("Offset from corner")  # graph input
code_block_5 = CodeBlock()
# ---------- code_block_5.designscript (7 lines) ----------
"Adobe PDF";
"Microsoft Print to PDF";
"Microsoft XPS Document Writer";

//Hidden built-in printer
//not supported at the moment!
"Revit DWF Exporter";
# ----------------------------------------
paperSize = Orchid.Common.Print.PaperSize(printer=printer)
watch = Watch(paperSize)

# group: Print current view (center and fit to page)
printer_3 = Printer("Microsoft Print to PDF")  # graph input
string_6 = StringInput("testSetting")  # graph input
print_papersizes_2 = PaperSize(p=printer_3)  # nothing selected
print_paperplacement_2 = PaperPlacement("Center")  # graph input
print_zoomtype_2 = ZoomType("Fit To Page")  # graph input
createSetting_2 = Orchid.Common.Print.CreateSetting(printer=printer_3, name=string_6, paperZize=print_papersizes_2, paperPlacement=print_paperplacement_2, zoomType=print_zoomtype_2)
print_range_2 = Range("Current window")  # graph input
activeView = Orchid.RevitProject.Common.Document.ActiveView()
# note: if print options there are rarely set need to be included, then connect:
# "Print.SetOptions" output Printsetting to "Print.ByView" input printSetting!
byView_2 = Orchid.Common.Print.ByView(printer=printer_3, printRange=print_range_2, view=activeView, printSetting=createSetting_2)
await_ = Orchid.Common.DataStream.Await(pass=createSetting_2, waitFor=byView_2)
deleteSetting_2 = Orchid.Common.Print.DeleteSetting(printSetting=await_)

# group: Merge PDF files
code_block_6 = CodeBlock()
# ---------- code_block_6.designscript (6 lines) ----------
//input documents
["%userprofile%\\Downloads\\PDF\\pdf1.pdf",
"%userprofile%\\Downloads\\PDF\\pdf2.pdf"];

//output file path
"%userprofile%\\Downloads\\PDF\\result.pdf";
# ----------------------------------------
mergePDF = Orchid.Common.File.MergePDF(documents=code_block_6.out0, filePath=code_block_6.out1)  # frozen

# group: Print options there are rarely set
boolean_3 = BoolSelector(true)  # graph input
boolean_4 = BoolSelector(false)  # graph input
print_hiddenlineviews = HiddenLineViewsType("Vector Processing")  # graph input
print_rasterquality = RasterQuality("Medium")  # graph input
print_colordepth = ColorDepthType("Gray Scale")  # graph input
setOptions = Orchid.Common.Print.SetOptions(printSetting=createSetting_2, viewLinksinBlue=boolean_3, hideReforWorkPlanes=boolean_4, hideUnreferencedViewTags=boolean_3, maskCoincidentLines=boolean_3, hideScopeBoxes=boolean_4, hideCropBoundaries=boolean_4, replaceHalftoneWithThinLines=boolean_3, hiddenLineViews=print_hiddenlineviews, rasterQuality=print_rasterquality, colorDepth=print_colordepth)  # frozen
