# Dynamo graph String.dyn (Dynamo 2.16.1.2727)
# packages: Orchid 216.3.0.8442

# group: Import from txt file
string = StringInput("%userprofile%\Programming\Testing\Data\test.txt")  # graph input
fromPath = Orchid.Common.File.FromPath(path=string)
readText = FileSystem.ReadText(file=fromPath)

string_2 = StringInput("\"Boolean.FaceFlipped|DanEDU\"")  # graph input
string_3 = StringInput("\"Boolean.Flipped|DanEDU\"")  # graph input
create = List.Create(item0=string_2, item1=string_3)
string_4 = StringInput("e\">")  # graph input
count = List.Count(list=create)
cycle = List.Cycle(list=string_4, amount=count)

# group: Get substring
substring = Orchid.Common.String.Substring(string=readText, startsWith=create, endsWith=cycle)
watch = Watch(substring)

string_5 = StringInput("\"FamilyInstance.IsFaceFlipped\"")  # graph input
string_6 = StringInput("\"FamilyInstance.IsFlipped\"")  # graph input
create_2 = List.Create(item0=string_5, item1=string_6)

# group: Replace string
replace = Orchid.Common.String.Replace(string=readText, searchFor=create, replaceWith=create_2)
watch_2 = Watch(replace)

# group: String format
string_7 = StringInput("My dog {0} is {1} years old and messures {2} meters.")
code_block = CodeBlock { "King"; }
number_slider = DoubleSlider(7, range=0..10 step 1)
number_slider_2 = DoubleSlider(1.53, range=0..10 step 0.01)
format = Orchid.Common.String.Format(string=string_7, item0=code_block, item1=number_slider, item2=number_slider_2)
watch_3 = Watch(format)
