# Dynamo graph Timer.dyn (Dynamo 2.16.1.2727)
# packages: Orchid 216.3.0.8442

# group: Important! Place DateTime.Now in upper left corner of the graph to get the correct time elapsed
code_block = CodeBlock { 1..80000; }
now = DateTime.Now()
timer = Orchid.Common.DataStream.Timer(pass=code_block, dateTime=now)
mul = timer.pass * timer.pass
timer_2 = Orchid.Common.DataStream.Timer(pass=mul, dateTime=timer.DateTime)
totalSeconds = TimeSpan.TotalSeconds(timeSpan=timer_2.TimeSpan)
watch = Watch(totalSeconds)
totalMilliseconds = TimeSpan.TotalMilliseconds(timeSpan=timer_2.TimeSpan)
watch_2 = Watch(totalMilliseconds)
