# Dynamo graph CompoundLayer_R23.dyn "CompoundLayer" (Dynamo 2.16.1.2727)
# packages: Orchid 216.3.0.5794

# group: Roofs
roof_types = RoofType("Warm - 500mm Steel Bar Joist / Steel Deck / EPDM Membrane")  # graph input
compound_layer_function = LayerFunction("Finish 2 [5]")  # graph input
code_block = CodeBlock { "Glass"; }
byName = Material.ByName(name=code_block)
code_block_2 = CodeBlock()
# ---------- code_block_2.designscript (6 lines) ----------
//thickness
100;
//wrap as boolean
true;
//index
3;
# ----------------------------------------
compound_layer_placement = LayerPlacement("Interior")  # graph input
createCompoundLayer = Orchid.RevitProject.Elements.SystemFamilyType.CreateCompoundLayer(elementType=roof_types, function=compound_layer_function, material=byName, thickness=code_block_2.out0, placement=compound_layer_placement, index=code_block_2.out2)

# group: Walls
categories = Categories("OST_Walls")  # graph input
all_elements_of_category = ElementsOfCategory(Category=categories)
elementType = Element.ElementType(element=all_elements_of_category)
uniqueItems = List.UniqueItems(list=elementType)
code_block_3 = CodeBlock { ["MyMat1","MyMat2"]; ["Glass","Copper"]; }
byName_2 = Material.ByName(name=code_block_3.out1)
code_block_4 = CodeBlock { [0,1]; }
setCompoundLayerMaterial = Orchid.RevitProject.Elements.SystemFamilyType.SetCompoundLayerMaterial(elementType=uniqueItems, material=byName_2, index=code_block_4)

watch = Watch(setCompoundLayerMaterial)

# group: Floors
floor_types = FloorTypes("Suspended - 300mm LW Concrete / Wood Planks")  # graph input
code_block_5 = CodeBlock { "Glass"; }
byName_3 = Material.ByName(name=code_block_5)
code_block_6 = CodeBlock()
# ---------- code_block_6.designscript (10 lines) ----------
//function
5;
//thickness
100;
//boolean
true;
//placement
"Interior";
//index
2;
# ----------------------------------------
createCompoundLayer_2 = Orchid.RevitProject.Elements.SystemFamilyType.CreateCompoundLayer(elementType=floor_types, material=byName_3, thickness=code_block_6.out1, structural=code_block_6.out2, index=code_block_6.out4)

# group: Walls
wall_types = WallTypes("Exterior - 468mm Masonry / LW Concrete")  # graph input
code_block_7 = CodeBlock { 3; }
deleteCompoundLayer = Orchid.RevitProject.Elements.SystemFamilyType.DeleteCompoundLayer(elementType=wall_types, index=code_block_7)

# group: Walls
wall_types_2 = WallTypes("Exterior - 468mm Masonry / LW Concrete")  # graph input
code_block_8 = CodeBlock { "Glass"; }
byName_4 = Material.ByName(name=code_block_8)
code_block_9 = CodeBlock { 1; }
setCompoundLayerMaterial_2 = Orchid.RevitProject.Elements.SystemFamilyType.SetCompoundLayerMaterial(elementType=wall_types_2, material=byName_4, index=code_block_9)

# group: Walls
wall_types_3 = WallTypes("Exterior - 468mm Masonry / LW Concrete")  # graph input
code_block_10 = CodeBlock { 300.0; 1; }
setCompoundLayerWidth = Orchid.RevitProject.Elements.SystemFamilyType.SetCompoundLayerWidth(elementType=wall_types_3, thickness=code_block_10.out0, index=code_block_10.out1)

# group: Walls
wall_types_4 = WallTypes("Exterior - 468mm Masonry / LW Concrete")  # graph input
compound_layer_function_2 = LayerFunction("Finish 2 [5]")  # graph input
code_block_11 = CodeBlock { "Glass"; }
byName_5 = Material.ByName(name=code_block_11)
code_block_12 = CodeBlock()  # same code as code_block_2
compound_layer_placement_2 = LayerPlacement("Interior")  # graph input
createCompoundLayer_3 = Orchid.RevitProject.Elements.SystemFamilyType.CreateCompoundLayer(elementType=wall_types_4, function=compound_layer_function_2, material=byName_5, thickness=code_block_12.out0, placement=compound_layer_placement_2, index=code_block_12.out2)

getCompoundLayerMaterial = Orchid.RevitProject.Elements.SystemFamilyType.GetCompoundLayerMaterial(elementType=elementType)
watch_2 = Watch(getCompoundLayerMaterial)
getCompoundLayerWidth = Orchid.RevitProject.Elements.SystemFamilyType.GetCompoundLayerWidth(elementType=elementType)
watch_3 = Watch(getCompoundLayerWidth)
name = Element.Name(element=getCompoundLayerMaterial)
watch_4 = Watch(name)

# group: Floors
categories_2 = Categories("OST_Floors")  # graph input
all_elements_of_category_2 = ElementsOfCategory(Category=categories_2)
elementType_2 = Element.ElementType(element=all_elements_of_category_2)
uniqueItems_2 = List.UniqueItems(list=elementType_2)
code_block_13 = CodeBlock { ["MyMat1","MyMat2"]; ["Glass","Copper"]; }
byName_6 = Material.ByName(name=code_block_13.out1)
code_block_14 = CodeBlock { [0,1]; }
setCompoundLayerMaterial_3 = Orchid.RevitProject.Elements.SystemFamilyType.SetCompoundLayerMaterial(elementType=uniqueItems_2, material=byName_6, index=code_block_14)

watch_5 = Watch(setCompoundLayerMaterial_3)

# group: Roofs
categories_3 = Categories("OST_Roofs")  # graph input
all_elements_of_category_3 = ElementsOfCategory(Category=categories_3)
elementType_3 = Element.ElementType(element=all_elements_of_category_3)
uniqueItems_3 = List.UniqueItems(list=elementType_3)
code_block_15 = CodeBlock { ["MyMat1","MyMat2"]; ["Glass","Copper"]; }
byName_7 = Material.ByName(name=code_block_15.out1)
code_block_16 = CodeBlock { [0,1]; }
setCompoundLayerMaterial_4 = Orchid.RevitProject.Elements.SystemFamilyType.SetCompoundLayerMaterial(elementType=uniqueItems_3, material=byName_7, index=code_block_16)

watch_6 = Watch(setCompoundLayerMaterial_4)

# group: Ceilings
categories_4 = Categories("OST_Ceilings")  # graph input
all_elements_of_category_4 = ElementsOfCategory(Category=categories_4)
elementType_4 = Element.ElementType(element=all_elements_of_category_4)
uniqueItems_4 = List.UniqueItems(list=elementType_4)
code_block_17 = CodeBlock { "MyMat1"; "Glass"; }
byName_8 = Material.ByName(name=code_block_17.out1)
code_block_18 = CodeBlock { 0; }
setCompoundLayerMaterial_5 = Orchid.RevitProject.Elements.SystemFamilyType.SetCompoundLayerMaterial(elementType=uniqueItems_4, material=byName_8, index=code_block_18)

watch_7 = Watch(setCompoundLayerMaterial_5)

# group: Floors
floor_types_2 = FloorTypes("Suspended - 300mm LW Concrete / Wood Planks")  # graph input
code_block_19 = CodeBlock { "Glass"; }
byName_9 = Material.ByName(name=code_block_19)
code_block_20 = CodeBlock { 1; }
setCompoundLayerMaterial_6 = Orchid.RevitProject.Elements.SystemFamilyType.SetCompoundLayerMaterial(elementType=floor_types_2, material=byName_9, index=code_block_20)

# group: Walls
wall_types_5 = WallTypes("Exterior - 468mm Masonry / LW Concrete")  # graph input
boolean = BoolSelector(true)  # graph input
code_block_21 = CodeBlock { 1; }
setCompoundLayerWrapping = Orchid.RevitProject.Elements.SystemFamilyType.SetCompoundLayerWrapping(elementType=wall_types_5, wrapping=boolean, index=code_block_21)

# group: Floors
floor_types_3 = FloorTypes("Suspended - 300mm LW Concrete / Wood Planks")  # graph input
boolean_2 = BoolSelector(true)  # graph input
code_block_22 = CodeBlock { 1; }
setCompoundLayerStructural = Orchid.RevitProject.Elements.SystemFamilyType.SetCompoundLayerStructural(elementType=floor_types_3, structural=boolean_2, index=code_block_22)

# group: Roofs
roof_types_2 = RoofType("Warm - 500mm Steel Bar Joist / Steel Deck / EPDM Membrane")  # graph input
boolean_3 = BoolSelector(true)  # graph input
code_block_23 = CodeBlock { 1; }
setCompoundLayerVariable = Orchid.RevitProject.Elements.SystemFamilyType.SetCompoundLayerVariable(elementType=roof_types_2, variable=boolean_3, index=code_block_23)
