# Dynamo graph Delete_R23.dyn "Delete" (Dynamo 2.16.1.2727)
# packages: Orchid 216.3.0.5794

code_block = CodeBlock { "Structural Columns"; "Windows"; "Doors"; "Walls"; }
byName = Category.ByName(name=code_block.out1)
all_elements_of_category = ElementsOfCategory(Category=byName)
byName_2 = Category.ByName(name=code_block.out2)
all_elements_of_category_2 = ElementsOfCategory(Category=byName_2)
byName_3 = Category.ByName(name=code_block.out0)
all_elements_of_category_3 = ElementsOfCategory(Category=byName_3)
code_block_2 = CodeBlock(windows=all_elements_of_category, doors=all_elements_of_category_2, columns=all_elements_of_category_3)
# ---------- code_block_2.designscript (3 lines) ----------
[windows,
[doors,
[columns]]];
# ----------------------------------------
code_block_3 = CodeBlock { Orchid.RevitProject.Elements.Element.Delete(element); }  # frozen; unwired: element
byName_4 = Category.ByName(name=code_block.out3)
all_elements_of_category_4 = ElementsOfCategory(Category=byName_4)
code_block_4 = CodeBlock(windows=all_elements_of_category, doors=all_elements_of_category_2, walls=all_elements_of_category_4)
# ---------- code_block_4.designscript (3 lines) ----------
[windows,
[doors,
[walls]]];
# ----------------------------------------
delete = Orchid.RevitProject.Elements.Element.Delete(element=code_block_4)
watch = Watch(delete)
