# Dynamo graph Elem+Fam.dyn (Dynamo 2.16.1.2727)
# packages: Orchid 216.3.0.8442

# group: Family
families = Family("Ext. Single-Flush")  # graph input
elementByFamily = Orchid.RevitProject.Elements.Selection.ElementByFamily(family=families)
watch = Watch(elementByFamily)

code_block = CodeBlock { ["Floors","Walls","Windows"]; }
elementByCategory = Orchid.RevitProject.Elements.Selection.ElementByCategory(category=code_block)
info = Orchid.RevitProject.Elements.Element.Info(element=elementByCategory.Element)
watch_2 = Watch(info.Owner)
watch_3 = Watch(info.Creator)
watch_4 = Watch(info.LastChangedBy)
watch_5 = Watch(info.RequestedBy)
name = Element.Name(element=elementByCategory.Element)
watch_6 = Watch(name)
familyName = Orchid.RevitProject.Elements.Element.FamilyName(element=elementByCategory.Element)
watch_7 = Watch(familyName)
elementType = Element.ElementType(element=elementByCategory.Element)
uniqueItems = List.UniqueItems(list=elementType@L2)
familyName_2 = Orchid.RevitProject.Elements.ElementType.FamilyName(elementType=uniqueItems)
watch_8 = Watch(familyName_2)
name_2 = Orchid.RevitProject.Elements.ElementType.Name(elementType=uniqueItems)
watch_9 = Watch(name_2)
