# Dynamo graph ElementRoom.dyn (Dynamo 2.16.1.2727)
# packages: Orchid 216.3.0.8442

# group: Room elements
code_block = CodeBlock { "Rooms"; }
elementByCategory = Orchid.RevitProject.Elements.Selection.ElementByCategory(category=code_block)
geometry = Element.Geometry(element=elementByCategory.Element)
boundingBox = Geometry.BoundingBox(geometry=geometry)
flatten = List.Flatten(list=boundingBox)

watch = Watch(elementByCategory.Element)

# group: FamilyInstance elements
code_block_2 = CodeBlock { ["Doors","Windows"]; }
elementByCategory_2 = Orchid.RevitProject.Elements.Selection.ElementByCategory(category=code_block_2)
flatten_2 = List.Flatten(list=elementByCategory_2.Element)
getFromToCalculationPoints = Orchid.RevitProject.Elements.FamilyInstance.GetFromToCalculationPoints(familyInstance=flatten_2)
lastItem = List.LastItem(list=getFromToCalculationPoints, lacing=Longest)
pointInside = Orchid.Geometry.BoundingBox.PointInside(boundingBox=flatten, point=lastItem, lacing=CrossProduct)
firstItem = List.FirstItem(list=getFromToCalculationPoints, lacing=Longest)
pointInside_2 = Orchid.Geometry.BoundingBox.PointInside(boundingBox=flatten, point=firstItem, lacing=CrossProduct)

# group: Set parameter value
filterByBoolMask = List.FilterByBoolMask(list=flatten_2, mask=pointInside_2@L2)
code_block_3 = CodeBlock { "Number"; "Comments"; }
getParameterValueByName = Element.GetParameterValueByName(element=elementByCategory.Element, parameterName=code_block_3.out0)
setParameterByName = Element.SetParameterByName(element=filterByBoolMask.in, parameterName=code_block_3.out1, value=getParameterValueByName)
await_ = Orchid.Common.DataStream.Await(pass=pointInside, waitFor=setParameterByName)
filterByBoolMask_2 = List.FilterByBoolMask(list=flatten_2, mask=await_@L2)
setParameterByName_2 = Element.SetParameterByName(element=filterByBoolMask_2.in, parameterName=code_block_3.out1, value=getParameterValueByName)

watch_2 = Watch(filterByBoolMask_2.in)
watch_3 = Watch(filterByBoolMask.in)
watch_4 = Watch(flatten_2)

# group: Solid intersect element
intersect = Orchid.Geometry.Solid.Intersect(solid=geometry)
intersect_2 = Orchid.Geometry.Solid.Intersect(solid=geometry, elements=flatten_2)

watch_5 = Watch(intersect)
watch_6 = Watch(intersect_2)

# group: Boundingbox intersect element
intersect_3 = Orchid.Geometry.BoundingBox.Intersect(boundingBox=boundingBox)
intersect_4 = Orchid.Geometry.BoundingBox.Intersect(boundingBox=boundingBox, element=flatten_2)

watch_7 = Watch(intersect_3)
watch_8 = Watch(intersect_4)
