# Dynamo graph ElementTag.dyn (Dynamo 2.16.1.2727)
# packages: Orchid 216.3.0.8442

# group: Get tag
code_block = CodeBlock { "Doors"; }
byName = Category.ByName(name=code_block)
all_elements_of_category = ElementsOfCategory(Category=byName)
getTag = Orchid.RevitProject.Elements.Element.GetTag(element=all_elements_of_category)

watch = Watch(all_elements_of_category)
watch_2 = Watch(getTag)
