# Dynamo graph Family.Save_R23.dyn "Family.Save" (Dynamo 2.16.1.2727)
# packages: Orchid 216.3.0.5794

# group: selected families by category in project
natural_category_name = CodeBlock()
# ---------- natural_category_name.designscript (12 lines) ----------
[
"Casework",
"Columns",
"Doors",
"Windows",
"Specialty Equipment",
"Structural Columns",
"Structural Foundations",
"Structural Framing",
"Structural Beam Systems",
"Structural Stiffeners"
];
# ----------------------------------------
byCategory = Orchid.RevitProject.Elements.Element.ByCategory(category=natural_category_name)
elementType = Element.ElementType(element=byCategory.Element)
uniqueItems = List.UniqueItems(list=elementType, lacing=Longest)
flatten = List.Flatten(list=uniqueItems)
family = FamilyType.Family(familyType=flatten)
string = StringInput("%userprofile%\Programming\Testing\Data\testSet")  # graph input
boolean = BoolSelector(true)  # graph input
save = Orchid.RevitProject.Elements.Family.Save(family=family, path=string, subfolder=boolean)

watch = Watch(save)
