# Dynamo graph File+Fam-Load.dyn (Dynamo 2.16.1.2727)
# packages: Orchid 216.3.0.8442

# group: Open all project files in directory
string = StringInput("%userprofile%\Programming\Testing\Data\testSet")  # graph input
code_block = CodeBlock { "*.rvt"; }
boolean = BoolSelector(false)  # graph input
contents = Orchid.Common.Directory.Contents(directory=string, searchString=code_block, deepSearch=boolean)
backgroundOpen = Orchid.RevitProject.Common.Document.BackgroundOpen(file=contents)  # frozen
load = Orchid.RevitProject.Elements.Family.Load(familyDocument=backgroundOpen)
await_ = Orchid.Common.DataStream.Await(pass=backgroundOpen, waitFor=load)
close = Orchid.RevitProject.Common.Document.Close(document=await_)

watch = Watch(load)

# group: Open all files in directory and sub directories
string_2 = StringInput("%userprofile%\Programming\Testing\Data\testSet")  # graph input
code_block_2 = CodeBlock { "*.rfa"; }
boolean_2 = BoolSelector(false)  # graph input
contents_2 = Orchid.Common.Directory.Contents(directory=string_2, searchString=code_block_2, deepSearch=boolean_2)
backgroundOpen_2 = Orchid.RevitProject.Common.Document.BackgroundOpen(file=contents_2)
load_2 = Orchid.RevitProject.Elements.Family.Load(familyDocument=backgroundOpen_2)
await_2 = Orchid.Common.DataStream.Await(pass=backgroundOpen_2, waitFor=load_2)
close_2 = Orchid.RevitProject.Common.Document.Close(document=await_2)

watch_2 = Watch(load_2)
