# Dynamo graph Intersect.dyn (Dynamo 2.16.1.2727)
# packages: Orchid 216.3.0.8442

# group: Category intersect element
elementHasMaterial = Orchid.RevitProject.Elements.Selection.ElementHasMaterial()
watch = Watch(elementHasMaterial.Element)
watch_2 = Watch(elementHasMaterial.Category)
intersectCategory = Orchid.RevitProject.Elements.Element.IntersectCategory(element=elementHasMaterial.Element)
watch_3 = Watch(intersectCategory)

natural_category_name = CodeBlock()
# ---------- natural_category_name.designscript (26 lines) ----------
[
"Casework",
"Ceilings",
"Columns",
"Curtain Wall Mullions",
"Curtain Panels",
"Curtain Systems",
"Doors",
"Entourage",
"Floors",
"Furniture",
"Furniture Systems",
"Generic Models",
"Plumbing Fixtures",
"Ramps",
"Roofs",
"Specialty Equipment",
"Stairs",
"Structural Columns",
"Structural Foundations",
"Structural Framing",
"Structural Beam Systems",
"Structural Stiffeners",
"Walls",
"Windows"
];
# ----------------------------------------

# group: Category intersect element
elementByCategory = Orchid.RevitProject.Elements.Selection.ElementByCategory(category=natural_category_name)
intersectCategory_2 = Orchid.RevitProject.Elements.Element.IntersectCategory(element=elementByCategory.Element)
watch_4 = Watch(intersectCategory_2)
watch_5 = Watch(elementByCategory.Category)
watch_6 = Watch(elementByCategory.Element)

# group: Sorting by boolean
doesIntersectOther = Orchid.RevitProject.Elements.Element.DoesIntersectOther(element=elementByCategory.Element)
anyTrue = Orchid.Common.List.AnyTrue(list=doesIntersectOther@L2)
watch_7 = Watch(anyTrue)
flatten = List.Flatten(list=elementByCategory.Element)
filterByBoolMask = List.FilterByBoolMask(list=flatten, mask=anyTrue)
watch_8 = Watch(filterByBoolMask.in)
watch_9 = Watch(flatten)
intersectCategory_3 = Orchid.RevitProject.Elements.Element.IntersectCategory(element=filterByBoolMask.in)
watch_10 = Watch(intersectCategory_3)

built_in_categories = CodeBlock()
# ---------- built_in_categories.designscript (26 lines) ----------
[
"OST_Casework",
"OST_Ceilings",
"OST_Columns",
"OST_CurtainWallMullions",
"OST_CurtainWallPanels",
"OST_CurtaSystem",
"OST_Doors",
"OST_Entourage",
"OST_Floors",
"OST_Furniture",
"OST_FurnitureSystems",
"OST_GenericModel",
"OST_PlumbingFixtures",
"OST_Ramps",
"OST_Roofs",
"OST_SpecialityEquipment",
"OST_Stairs",
"OST_StructuralColumns",
"OST_StructuralFoundation",
"OST_StructuralFraming",
"OST_StructuralFramingSystem",
"OST_StructuralStiffener",
"OST_Walls",
"OST_Windows"
];
# ----------------------------------------

# group: Element intersect element
elementHasMaterial_2 = Orchid.RevitProject.Elements.Selection.ElementHasMaterial()
watch_11 = Watch(elementHasMaterial_2.Element)
watch_12 = Watch(elementHasMaterial_2.Category)
flatten_2 = List.Flatten(list=elementHasMaterial_2.Element)
intersect = Orchid.RevitProject.Elements.Element.Intersect(element=elementHasMaterial_2.Element, elements=flatten_2)
watch_13 = Watch(intersect)

# group: Element intersect element
code_block = CodeBlock { "Structural Framing"; ["Doors", "Walls"]; }
byName = Category.ByName(name=code_block.out0)
all_elements_of_category = ElementsOfCategory(Category=byName)
watch_14 = Watch(all_elements_of_category)
byName_2 = Category.ByName(name=code_block.out1)
all_elements_of_category_2 = ElementsOfCategory(Category=byName_2)
flatten_3 = List.Flatten(list=all_elements_of_category_2)
intersect_2 = Orchid.RevitProject.Elements.Element.Intersect(element=all_elements_of_category, elements=flatten_3)
watch_15 = Watch(intersect_2)

# group: Category intersect element
code_block_2 = CodeBlock { "Structural Framing"; ["Doors", "Walls"]; }
byName_3 = Category.ByName(name=code_block_2.out0)
all_elements_of_category_3 = ElementsOfCategory(Category=byName_3)
watch_16 = Watch(all_elements_of_category_3)
byName_4 = Category.ByName(name=code_block_2.out1)
intersectCategory_4 = Orchid.RevitProject.Elements.Element.IntersectCategory(element=all_elements_of_category_3, category=byName_4)
watch_17 = Watch(intersectCategory_4)

# note: OOTB nodes
byName_5 = Category.ByName(name=natural_category_name)
all_elements_of_category_4 = ElementsOfCategory(Category=byName_5)
clean = Orchid.Common.List.Clean(list=all_elements_of_category_4)
intersectCategory_5 = Orchid.RevitProject.Elements.Element.IntersectCategory(element=clean)  # frozen
watch_18 = Watch(intersectCategory_5)
watch_19 = Watch(clean)

# group: Element intersect
elementHasMaterial_3 = Orchid.RevitProject.Elements.Selection.ElementHasMaterial()
watch_20 = Watch(elementHasMaterial_3.Element)
watch_21 = Watch(elementHasMaterial_3.Category)
intersect_3 = Orchid.RevitProject.Elements.Element.Intersect(element=elementHasMaterial_3.Element)
watch_22 = Watch(intersect_3)
