# Dynamo graph LightSource_FamilyType_R23.dyn "LightSource_FamilyType" (Dynamo 2.16.1.2727)
# packages: Orchid 216.3.0.5828

inDocument = Orchid.RevitProject.Elements.FamilyType.InDocument()
watch = Watch(inDocument.FamilyType)
watch_2 = Watch(inDocument.Category)

# group: collect
# File: Electrical_Basic
code_block = CodeBlock { "LundtofteLamp"; }
byName = Orchid.RevitProject.Elements.Family.ByName(name=code_block)
types = Family.Types(family=byName)

# group: Set light color filter data
code_block_2 = CodeBlock(familyType=types)
# ---------- code_block_2.designscript (3 lines) ----------
familyType;
Color.ByARGB
(0, 127, 127, 127);
# ----------------------------------------
setLightColorFilter = Orchid.RevitProject.Elements.FamilyType.SetLightColorFilter(familyType=code_block_2.familyType, color=code_block_2.out1)

# group: Get light color filter data
getLightColorFilter = Orchid.RevitProject.Elements.FamilyType.GetLightColorFilter(familyType=setLightColorFilter)
watch_3 = Watch(getLightColorFilter)

# group: Set light distribution data
code_block_3 = CodeBlock(familyType=types) { familyType; "Spherical"; }
light_distribution_styles = LightDistributionStyle("Spot light distribution")
setLightDistribution = Orchid.RevitProject.Elements.FamilyType.SetLightDistribution(familyType=code_block_3.familyType, style=light_distribution_styles)

# group: Get light distribution data
getLightDistribution = Orchid.RevitProject.Elements.FamilyType.GetLightDistribution(familyType=setLightDistribution)
watch_4 = Watch(getLightDistribution.Style)
watch_5 = Watch(getLightDistribution.Value)

# group: Set light shape data
code_block_4 = CodeBlock(familyType=types) { familyType; "Point"; }
light_shape_styles = LightShapeStyle("Rectangle")
setLightShape = Orchid.RevitProject.Elements.FamilyType.SetLightShape(familyType=code_block_4.familyType, style=light_shape_styles)

# group: Get light shape data
getLightShape = Orchid.RevitProject.Elements.FamilyType.GetLightShape(familyType=setLightShape)
watch_6 = Watch(getLightShape.Style)
watch_7 = Watch(getLightShape.Value)

# group: Set light dimming color data
code_block_5 = CodeBlock(familyType=types) { familyType; "None"; }
light_dimming_colors = LightDimmingColor("Incandescent lamp curve dimming color")
setLightDimmingColor = Orchid.RevitProject.Elements.FamilyType.SetLightDimmingColor(familyType=code_block_5.familyType, color=light_dimming_colors)

# group: Get light dimming color data
getLightDimmingColor = Orchid.RevitProject.Elements.FamilyType.GetLightDimmingColor(familyType=setLightDimmingColor)
watch_8 = Watch(getLightDimmingColor)

# group: Set light color
code_block_6 = CodeBlock(familyType=types)
# ---------- code_block_6.designscript (6 lines) ----------
familyType;
// Style
"PresetColor";

3100;
"FluorescentWarm";
# ----------------------------------------
setLightCustomColor = Orchid.RevitProject.Elements.FamilyType.SetLightCustomColor(familyType=code_block_6.familyType, value=code_block_6.out2)  # frozen
light_color_presets = ColorPreset("Fluorescent (Warm White)")
setLightPresetColor = Orchid.RevitProject.Elements.FamilyType.SetLightPresetColor(familyType=code_block_6.familyType, color=light_color_presets)  # frozen
light_color_styles = InitialColor("Custom color")
setLightColor = Orchid.RevitProject.Elements.FamilyType.SetLightColor(familyType=code_block_6.familyType, style=light_color_styles, color=light_color_presets, value=code_block_6.out2)

# group: Get light color
getLightColor = Orchid.RevitProject.Elements.FamilyType.GetLightColor(familyType=setLightCustomColor)
watch_9 = Watch(getLightColor.Value)
getLightColor_2 = Orchid.RevitProject.Elements.FamilyType.GetLightColor(familyType=setLightPresetColor)
watch_10 = Watch(getLightColor_2.Value)
getLightColor_3 = Orchid.RevitProject.Elements.FamilyType.GetLightColor(familyType=setLightColor)
watch_11 = Watch(getLightColor_3.Style)
watch_12 = Watch(getLightColor_3.Value)

# group: Set light intensity
code_block_7 = CodeBlock(familyType=types)
# ---------- code_block_7.designscript (14 lines) ----------
familyType;
// Style
"Flux";

// Wattage
10;
150;
// Flux
1400;
// Luminous
440;
// lluminance
50;
3048;
# ----------------------------------------
setLightWattageIntensity = Orchid.RevitProject.Elements.FamilyType.SetLightWattageIntensity(familyType=code_block_7.familyType, wattage=code_block_7.out2, efficacy=code_block_7.out3)  # frozen
setLightFluxIntensity = Orchid.RevitProject.Elements.FamilyType.SetLightFluxIntensity(familyType=code_block_7.familyType, value=code_block_7.out4)  # frozen
setLightLuminousIntensity = Orchid.RevitProject.Elements.FamilyType.SetLightLuminousIntensity(familyType=code_block_7.familyType, value=code_block_7.out5)  # frozen
setLightIlluminanceIntensity = Orchid.RevitProject.Elements.FamilyType.SetLightIlluminanceIntensity(familyType=code_block_7.familyType, illuminance=code_block_7.out6, distance=code_block_7.out7)  # frozen
light_intensities = InitialIntensity("Flux intensity")
setLightIntensity = Orchid.RevitProject.Elements.FamilyType.SetLightIntensity(familyType=code_block_7.familyType, style=light_intensities, valueA=code_block_7.out4)

# group: Get light intensity
getLightIntensity = Orchid.RevitProject.Elements.FamilyType.GetLightIntensity(familyType=setLightWattageIntensity)
watch_13 = Watch(getLightIntensity.Value)
getLightIntensity_2 = Orchid.RevitProject.Elements.FamilyType.GetLightIntensity(familyType=setLightFluxIntensity)
watch_14 = Watch(getLightIntensity_2.Value)
getLightIntensity_3 = Orchid.RevitProject.Elements.FamilyType.GetLightIntensity(familyType=setLightLuminousIntensity)
watch_15 = Watch(getLightIntensity_3.Value)
getLightIntensity_4 = Orchid.RevitProject.Elements.FamilyType.GetLightIntensity(familyType=setLightIlluminanceIntensity)
watch_16 = Watch(getLightIntensity_4.Value)
getLightIntensity_5 = Orchid.RevitProject.Elements.FamilyType.GetLightIntensity(familyType=setLightIntensity)
watch_17 = Watch(getLightIntensity_5.Style)
watch_18 = Watch(getLightIntensity_5.Value)

# group: Set light loss factor
code_block_8 = CodeBlock(familyType=types)
# ---------- code_block_8.designscript (7 lines) ----------
familyType;

// Style
"Basic";
3.0;
1.25;
0.75;
# ----------------------------------------
setBasicLossFactor = Orchid.RevitProject.Elements.FamilyType.SetBasicLossFactor(familyType=code_block_8.familyType, value=code_block_8.out2)  # frozen
setAdvancedLossFactor = Orchid.RevitProject.Elements.FamilyType.SetAdvancedLossFactor(familyType=code_block_8.familyType, temperature=code_block_8.out3, voltage=code_block_8.out3, ballast=code_block_8.out4, tilt=code_block_8.out4, surface=code_block_8.out4, lumen=code_block_8.out4, luminaire=code_block_8.out4)  # frozen
light_loss_factors = LossFactor("Basic loss factor")
setLightLossFactor = Orchid.RevitProject.Elements.FamilyType.SetLightLossFactor(familyType=code_block_8.familyType, style=light_loss_factors, value=code_block_8.out2, temperature=code_block_8.out3, voltage=code_block_8.out3, ballast=code_block_8.out4, tilt=code_block_8.out4, surface=code_block_8.out4, lumen=code_block_8.out4, luminaire=code_block_8.out4)

# group: Get light loss factor
getLightLossFactor = Orchid.RevitProject.Elements.FamilyType.GetLightLossFactor(familyType=setBasicLossFactor)
watch_19 = Watch(getLightLossFactor.Value)
getLightLossFactor_2 = Orchid.RevitProject.Elements.FamilyType.GetLightLossFactor(familyType=setAdvancedLossFactor)
watch_20 = Watch(getLightLossFactor_2.Value)
getLightLossFactor_3 = Orchid.RevitProject.Elements.FamilyType.GetLightLossFactor(familyType=setLightLossFactor)
watch_21 = Watch(getLightLossFactor_3.Style)
watch_22 = Watch(getLightLossFactor_3.Value)
