# Dynamo graph Selection.dyn (Dynamo 2.16.1.2727)
# packages: Orchid 216.3.0.8442

natural_category_name = CodeBlock()
# ---------- natural_category_name.designscript (26 lines) ----------
[
"Casework",
"Ceilings",
"Columns",
"Curtain Wall Mullions",
"Curtain Panels",
"Curtain Systems",
"Doors",
"Entourage",
"Floors",
"Furniture",
"Furniture Systems",
"Generic Models",
"Plumbing Fixtures",
"Ramps",
"Roofs",
"Specialty Equipment",
"Stairs",
"Structural Columns",
"Structural Foundations",
"Structural Framing",
"Structural Beam Systems",
"Structural Stiffeners",
"Walls",
"Windows"
];
# ----------------------------------------

# group: Selection by element
elementByCategory = Orchid.RevitProject.Elements.Selection.ElementByCategory(category=natural_category_name)
watch = Watch(elementByCategory.Category)
watch_2 = Watch(elementByCategory.Element)
elementHasMaterial = Orchid.RevitProject.Elements.Selection.ElementHasMaterial()
watch_3 = Watch(elementHasMaterial.Element)
watch_4 = Watch(elementHasMaterial.Category)

code_block = CodeBlock()
# ---------- code_block.designscript (9 lines) ----------
"Model";
"Annotation";
"AnalyticalModel";
"Internal";

["Model",
"Annotation",
"AnalyticalModel",
"Internal"];
# ----------------------------------------

# group: Selection by element type
boolean = BoolSelector(false)
elementTypeByCategoryType = Orchid.RevitProject.Elements.Selection.ElementTypeByCategoryType(categoryType=code_block.out0, library=boolean)
watch_5 = Watch(elementTypeByCategoryType.ElementType)
watch_6 = Watch(elementTypeByCategoryType.CategoryType)
watch_7 = Watch(elementTypeByCategoryType.Category)

# group: Selection by element
elementByCategoryType = Orchid.RevitProject.Elements.Selection.ElementByCategoryType(categoryType=code_block.out0)
watch_8 = Watch(elementByCategoryType.Element)
watch_9 = Watch(elementByCategoryType.Category)
watch_10 = Watch(elementByCategoryType.CategoryType)

# group: Selection by level
levels = Levels("Level 1")
boolean_2 = BoolSelector(true)
elementByLevel = Orchid.RevitProject.Elements.Selection.ElementByLevel(level=levels, spatial=boolean_2)
watch_11 = Watch(elementByLevel.Category)
watch_12 = Watch(elementByLevel.Element)

# group: Model elements
modelElement = Orchid.RevitProject.Elements.Selection.ModelElement()
watch_13 = Watch(modelElement.Category)
watch_14 = Watch(modelElement.Element)

# group: Family
inDocument = Orchid.RevitProject.Elements.Family.InDocument()
watch_15 = Watch(inDocument.Category)
watch_16 = Watch(inDocument.Family)
code_block_2 = CodeBlock()
# ---------- code_block_2.designscript (2 lines) ----------
["Doors",
"Windows"];
# ----------------------------------------
byName = Category.ByName(name=code_block_2)
byCategory = Orchid.RevitProject.Elements.Family.ByCategory(category=byName)
watch_17 = Watch(byCategory)

# group: OOTB nodes
byName_2 = Category.ByName(name=natural_category_name)
all_elements_of_category = ElementsOfCategory(Category=byName_2)
clean = Orchid.Common.List.Clean(list=all_elements_of_category)
watch_18 = Watch(clean)

# group: Selection by element type
boolean_3 = BoolSelector(false)
elementTypeHasMaterial = Orchid.RevitProject.Elements.Selection.ElementTypeHasMaterial(library=boolean_3)
watch_19 = Watch(elementTypeHasMaterial.Category)
watch_20 = Watch(elementTypeHasMaterial.ElementType)

# group: FamilyType
inDocument_2 = Orchid.RevitProject.Elements.FamilyType.InDocument()
watch_21 = Watch(inDocument_2.FamilyType)
watch_22 = Watch(inDocument_2.Category)
code_block_3 = CodeBlock()  # same code as code_block_2
byCategory_2 = Orchid.RevitProject.Elements.FamilyType.ByCategory(category=code_block_3)
watch_23 = Watch(byCategory_2)

code_block_4 = CodeBlock()
# ---------- code_block_4.designscript (3 lines) ----------
["Rooms",
"Spaces",
"Areas"];
# ----------------------------------------
built_in_categories = CodeBlock()
# ---------- built_in_categories.designscript (26 lines) ----------
[
"OST_Casework",
"OST_Ceilings",
"OST_Columns",
"OST_CurtainWallMullions",
"OST_CurtainWallPanels",
"OST_CurtaSystem",
"OST_Doors",
"OST_Entourage",
"OST_Floors",
"OST_Furniture",
"OST_FurnitureSystems",
"OST_GenericModel",
"OST_PlumbingFixtures",
"OST_Ramps",
"OST_Roofs",
"OST_SpecialityEquipment",
"OST_Stairs",
"OST_StructuralColumns",
"OST_StructuralFoundation",
"OST_StructuralFraming",
"OST_StructuralFramingSystem",
"OST_StructuralStiffener",
"OST_Walls",
"OST_Windows"
];
# ----------------------------------------

# group: Converters
toRevitType = Orchid.Common.Object.ToRevitType(object=byName_2)
toDynamoType = Orchid.Common.Object.ToDynamoType(object=toRevitType)
watch_24 = Watch(toDynamoType)
type = Object.Type(object=toDynamoType)
watch_25 = Watch(type)

# group: Converters Note: FamilyType in a project document is denoted FamilySymbol in Autodesk Revit API!
toRevitType_2 = Orchid.Common.Object.ToRevitType(object=byCategory_2)
watch_26 = Watch(toRevitType_2)
toDynamoType_2 = Orchid.Common.Object.ToDynamoType(object=toRevitType_2)
watch_27 = Watch(toDynamoType_2)
name = Element.Name(element=toDynamoType_2)
watch_28 = Watch(name)

# group: Selection
elementByFamily = Orchid.RevitProject.Elements.Selection.ElementByFamily(family=byCategory)
watch_29 = Watch(elementByFamily)
