# Dynamo graph SetType-Random.dyn (Dynamo 2.16.1.2727)
# packages: Orchid 216.3.0.8442

# group: Collect elements
family_types = FamilyTypes("Sunshade Panel Wide:Expanded metal Small")  # graph input
family_types_2 = FamilyTypes("Sunshade Panel Wide:Expanded metal Large")  # graph input
create = List.Create(item0=family_types, item1=family_types_2)
all_elements_of_family_type = ElementsOfFamilyType(Family_Type=create)

flatten = List.Flatten(list=all_elements_of_family_type)

# group: Randomization
count = List.Count(list=flatten)
randomList = Orchid.Common.Math.RandomList(amount=count)
round = Math.Round(number=randomList)

# group: Random
code_block = CodeBlock { 4; }
randomList_2 = Orchid.Common.Math.RandomList(amount=count, range=code_block)
watch = Watch(randomList_2)
random = Orchid.Common.Math.Random(range=code_block)
watch_2 = Watch(random)

asFamilyInstance = CurtainPanel.AsFamilyInstance(curtainPanel=flatten)
getItemAtIndex = List.GetItemAtIndex(list=create, index=round)

# group: SetType
setType = Orchid.RevitProject.Elements.FamilyInstance.SetType(familyInstance=asFamilyInstance, familyType=getItemAtIndex)
