# Dynamo graph SpatialElement.dyn (Dynamo 2.16.1.2727)
# packages: Orchid 216.3.0.8442

# group: Get boundary curves by specific boundary
code_block = CodeBlock { "Rooms"; "Spaces"; }
byName = Category.ByName(name=code_block.out0)
elementByCategory = Orchid.RevitProject.Elements.Selection.ElementByCategory(category=byName)
coreBoundary = Orchid.RevitProject.Elements.SpatialElement.CoreBoundary(spatialElement=elementByCategory.Element)
coreCenterBoundary = Orchid.RevitProject.Elements.SpatialElement.CoreCenterBoundary(spatialElement=elementByCategory.Element)
finishBoundary = Orchid.RevitProject.Elements.SpatialElement.FinishBoundary(spatialElement=elementByCategory.Element)
watch = Watch(finishBoundary.Element)
centerBoundary = Orchid.RevitProject.Elements.SpatialElement.CenterBoundary(spatialElement=elementByCategory.Element)
watch_2 = Watch(centerBoundary.Element)
watch_3 = Watch(finishBoundary.Curve)
watch_4 = Watch(centerBoundary.Curve)

# group: Get boundary curves
code_block_2 = CodeBlock { "Room"; "Space"; "Area"; }
all = Orchid.RevitProject.Elements.SpatialElement.InDocument(spatialType=code_block_2.out0)  # "SpatialElement.All"
boundary = Orchid.RevitProject.Elements.SpatialElement.Boundary(spatialElement=all)
watch_5 = Watch(boundary.Curve)
watch_6 = Watch(boundary.Element)
getSeparationLine = Orchid.RevitProject.Elements.SpatialElement.GetSeparationLine(spatialElement=all)
watch_7 = Watch(getSeparationLine.Curve)
watch_8 = Watch(getSeparationLine.Element)

# group: Change state for volume computation
boolean = BoolSelector(true)
volumeComputation = Orchid.RevitProject.Common.Document.VolumeComputation(state=boolean)

# group: Revit links
getRevitLink = Orchid.RevitProject.Common.Link.GetRevitLink()
instance = Orchid.RevitProject.Common.Link.Instance(link=getRevitLink)
document = Orchid.RevitProject.Common.Link.Document(instance=instance)
code_block_3 = CodeBlock { "Rooms"; "Spaces"; "Areas"; }
byName_2 = Category.ByName(name=code_block_3.out0)
elementByCategory_2 = Orchid.RevitProject.Elements.Selection.ElementByCategory(document=document, category=byName_2)
getSeparationLine_2 = Orchid.RevitProject.Elements.SpatialElement.GetSeparationLine(document=document, spatialElement=elementByCategory_2.Element)
watch_9 = Watch(getSeparationLine_2.Curve)
watch_10 = Watch(getSeparationLine_2.Element)
boundary_2 = Orchid.RevitProject.Elements.SpatialElement.Boundary(document=document, spatialElement=elementByCategory_2.Element)
watch_11 = Watch(boundary_2.Curve)
watch_12 = Watch(boundary_2.Element)

# group: Spatial Elements
all_2 = Orchid.RevitProject.Elements.SpatialElement.InDocument()  # "SpatialElement.All"
watch_13 = Watch(all_2)
code_block_4 = CodeBlock { "Room"; "Space"; "Area"; }
all_3 = Orchid.RevitProject.Elements.SpatialElement.InDocument(spatialType=code_block_4.out0)  # "SpatialElement.All"
watch_14 = Watch(all_3)

# group: Boundary conditions
spatialelement_boundarylocation = SpatialElementBoundaryLocation("Finish")
spatialelement_type = SpatialElementType("Room")
setBoundaryConditions = Orchid.RevitProject.Elements.SpatialElement.SetBoundaryConditions(boundaryLocation=spatialelement_boundarylocation, spatialType=spatialelement_type)

# group: Inside spatial element?
code_block_5 = CodeBlock { "Room"; "Space"; "Area"; 500; }
all_4 = Orchid.RevitProject.Elements.SpatialElement.InDocument(spatialType=code_block_5.out1)  # "SpatialElement.All"
byCoordinates = Point.ByCoordinates(x=code_block_5.out3, y=code_block_5.out3, z=code_block_5.out3)
isInsideSpace = Orchid.RevitProject.Elements.SpatialElement.IsInsideSpace(space=all_4, point=byCoordinates)
watch_15 = Watch(isInsideSpace)
all_5 = Orchid.RevitProject.Elements.SpatialElement.InDocument(spatialType=code_block_5.out0)  # "SpatialElement.All"
isInsideRoom = Orchid.RevitProject.Elements.SpatialElement.IsInsideRoom(room=all_5, point=byCoordinates)
watch_16 = Watch(isInsideRoom)

# group: Name, number, and location
code_block_6 = CodeBlock { "Room"; "Space"; "Area"; }
all_6 = Orchid.RevitProject.Elements.SpatialElement.InDocument(spatialType=code_block_6.out0)  # "SpatialElement.All"
centerLocation = Orchid.RevitProject.Elements.SpatialElement.CenterLocation(spatialElement=all_6)
location = Orchid.RevitProject.Elements.SpatialElement.Location(spatialElement=centerLocation)
watch_17 = Watch(location)
code_block_7 = CodeBlock { a = "Room "; b = 1..4; a+b; 101..104; }
setName = Orchid.RevitProject.Elements.SpatialElement.SetName(spatialElement=all_6, value=code_block_7.out2)
name = Orchid.RevitProject.Elements.SpatialElement.Name(spatialElement=setName)
watch_18 = Watch(name)
string_from_object = FromObject(object=code_block_7.out3)
setNumber = Orchid.RevitProject.Elements.SpatialElement.SetNumber(spatialElement=all_6, value=string_from_object)
number = Orchid.RevitProject.Elements.SpatialElement.Number(spatialElement=setNumber)
watch_19 = Watch(number)

# group: Height, area, volume, and phase
code_block_8 = CodeBlock { "Room"; "Space"; "Area"; }
all_7 = Orchid.RevitProject.Elements.SpatialElement.InDocument(spatialType=code_block_8.out1)  # "SpatialElement.All"
height = Orchid.RevitProject.Elements.SpatialElement.Height(spatialElement=all_7)
watch_20 = Watch(height)
area = Orchid.RevitProject.Elements.SpatialElement.Area(spatialElement=all_7)
watch_21 = Watch(area)
volume = Orchid.RevitProject.Elements.SpatialElement.Volume(spatialElement=all_7)
watch_22 = Watch(volume)
phase = Orchid.RevitProject.Elements.SpatialElement.Phase(spatialElement=all_7)
watch_23 = Watch(phase)
