# Dynamo graph SpatialElement_R23.dyn "SpatialElement" (Dynamo 2.16.1.2727)
# packages: Orchid 216.3.0.5828

# group: Get boundary curves by specific boundary
code_block = CodeBlock { "Rooms"; "Spaces"; }
byName = Category.ByName(name=code_block.out0)
byCategory = Orchid.RevitProject.Elements.Element.ByCategory(category=byName)
coreBoundary = Orchid.RevitProject.Elements.SpatialElement.CoreBoundary(spatialElement=byCategory.Element)
coreCenterBoundary = Orchid.RevitProject.Elements.SpatialElement.CoreCenterBoundary(spatialElement=byCategory.Element)
finishBoundary = Orchid.RevitProject.Elements.SpatialElement.FinishBoundary(spatialElement=byCategory.Element)
watch = Watch(finishBoundary.Element)
centerBoundary = Orchid.RevitProject.Elements.SpatialElement.CenterBoundary(spatialElement=byCategory.Element)
watch_2 = Watch(centerBoundary.Element)
watch_3 = Watch(finishBoundary.Curve)
watch_4 = Watch(centerBoundary.Curve)

# group: Get boundary curves
code_block_2 = CodeBlock { "SpatialElementType"; "Room"; "Space"; "Area"; }
enumByName = Orchid.AdeskApp.Revit.EnumByName(enumType=code_block_2.out0, valueName=code_block_2.out1)
inDocument = Orchid.RevitProject.Elements.SpatialElement.InDocument(spatialType=enumByName)
boundary = Orchid.RevitProject.Elements.SpatialElement.Boundary(spatialElement=inDocument)
watch_5 = Watch(boundary.Curve)
watch_6 = Watch(boundary.Element)
getSeparationLine = Orchid.RevitProject.Elements.SpatialElement.GetSeparationLine(spatialElement=inDocument)
watch_7 = Watch(getSeparationLine.Curve)
watch_8 = Watch(getSeparationLine.Element)

# group: Change state for volume computation
boolean = BoolSelector(true)
volumeComputation = Orchid.RevitProject.Common.Document.VolumeComputation(state=boolean)

# group: Revit links
# File: LinkedProject
getRevitLink = Orchid.RevitProject.Common.Link.GetRevitLink()
instance = Orchid.RevitProject.Common.Link.Instance(link=getRevitLink)
document = Orchid.RevitProject.Common.Link.Document(instance=instance)
code_block_3 = CodeBlock { "Rooms"; "Spaces"; "Areas"; }
byName_2 = Category.ByName(name=code_block_3.out0)
byCategory_2 = Orchid.RevitProject.Elements.Element.ByCategory(document=document, category=byName_2)
getSeparationLine_2 = Orchid.RevitProject.Elements.SpatialElement.GetSeparationLine(document=document, spatialElement=byCategory_2.Element)
watch_9 = Watch(getSeparationLine_2.Curve)
watch_10 = Watch(getSeparationLine_2.Element)
boundary_2 = Orchid.RevitProject.Elements.SpatialElement.Boundary(document=document, spatialElement=byCategory_2.Element)
watch_11 = Watch(boundary_2.Curve)
watch_12 = Watch(boundary_2.Element)

# group: Boundary conditions
spatialelement_boundarylocation = SpatialElementBoundaryLocation("Finish")
spatialelement_type = SpatialElementType("Room")
setBoundaryConditions = Orchid.RevitProject.Elements.SpatialElement.SetBoundaryConditions(boundaryLocation=spatialelement_boundarylocation, spatialType=spatialelement_type)

# group: Spatial Elements
code_block_4 = CodeBlock { "SpatialElementType"; "Room"; "Space"; "Area"; }
enumByName_2 = Orchid.AdeskApp.Revit.EnumByName(enumType=code_block_4.out0, valueName=code_block_4.out1)
inDocument_2 = Orchid.RevitProject.Elements.SpatialElement.InDocument(spatialType=enumByName_2)
watch_13 = Watch(inDocument_2)
inDocument_3 = Orchid.RevitProject.Elements.SpatialElement.InDocument()
watch_14 = Watch(inDocument_3)

# group: Height, area, volume, and phase
spatialelement_types = SpatialElementType("Space")
inDocument_4 = Orchid.RevitProject.Elements.SpatialElement.InDocument(spatialType=spatialelement_types)
area = Orchid.RevitProject.Elements.SpatialElement.Area(spatialElement=inDocument_4)
watch_15 = Watch(area)
phase = Orchid.RevitProject.Elements.SpatialElement.Phase(spatialElement=inDocument_4)
watch_16 = Watch(phase)
height = Orchid.RevitProject.Elements.SpatialElement.Height(spatialElement=inDocument_4)
watch_17 = Watch(height)
volume = Orchid.RevitProject.Elements.SpatialElement.Volume(spatialElement=inDocument_4)
watch_18 = Watch(volume)

# group: Name, number, and location
spatialelement_types_2 = SpatialElementType("Room")
inDocument_5 = Orchid.RevitProject.Elements.SpatialElement.InDocument()
centerLocation = Orchid.RevitProject.Elements.SpatialElement.CenterLocation(spatialElement=inDocument_5)
location = Orchid.RevitProject.Elements.SpatialElement.Location(spatialElement=centerLocation)
watch_19 = Watch(location)
code_block_5 = CodeBlock { a = "Room "; b = 1..4; a+b; 101..104; }
setName = Orchid.RevitProject.Elements.SpatialElement.SetName(spatialElement=inDocument_5, value=code_block_5.out2)
name = Orchid.RevitProject.Elements.SpatialElement.Name(spatialElement=setName)
watch_20 = Watch(name)
string_from_object = FromObject(object=code_block_5.out3)
setNumber = Orchid.RevitProject.Elements.SpatialElement.SetNumber(spatialElement=inDocument_5, value=string_from_object)
number = Orchid.RevitProject.Elements.SpatialElement.Number(spatialElement=setNumber)
watch_21 = Watch(number)

# group: Inside spatial element?
code_block_6 = CodeBlock { "SpatialElementType"; "Room"; "Space"; "Area"; 500; }
enumByName_3 = Orchid.AdeskApp.Revit.EnumByName(enumType=code_block_6.out0, valueName=code_block_6.out2)
inDocument_6 = Orchid.RevitProject.Elements.SpatialElement.InDocument(spatialType=enumByName_3)
byCoordinates = Point.ByCoordinates(x=code_block_6.out4, y=code_block_6.out4, z=code_block_6.out4)
isInsideSpace = Orchid.RevitProject.Elements.SpatialElement.IsInsideSpace(space=inDocument_6, point=byCoordinates)
watch_22 = Watch(isInsideSpace)
inDocument_7 = Orchid.RevitProject.Elements.SpatialElement.InDocument()
isInsideRoom = Orchid.RevitProject.Elements.SpatialElement.IsInsideRoom(room=inDocument_7, point=byCoordinates)
watch_23 = Watch(isInsideRoom)
