# Dynamo graph Transfer-Copy.dyn (Dynamo 2.16.1.2727)
# packages: Orchid 216.3.0.8442

string = StringInput("%userprofile%\Programming\Testing\Data\2023_Data\")  # graph input
string_2 = StringInput("defaultProject_extended")  # graph input
code_block = CodeBlock(a=string, b=string_2) { a+b+".rvt"; }
fromPath = Orchid.Common.File.FromPath(path=code_block)
backgroundOpen = Orchid.RevitProject.Common.Document.BackgroundOpen(file=fromPath)

# group: Transfer Category
code_block_2 = CodeBlock(document=backgroundOpen) { document; }
categories = Categories("OST_Roofs")  # graph input
boolean = BoolSelector(true)  # graph input
transferByCategory = Orchid.RevitProject.Common.Document.TransferByCategory(source=code_block_2, category=categories, append=boolean)
watch = Watch(transferByCategory)
await_ = Orchid.Common.DataStream.Await(pass=code_block_2, waitFor=transferByCategory)

# group: Transfer Type
code_block_3 = CodeBlock(document=backgroundOpen) { document; }
string_3 = StringInput("xExterior - 468mm Masonry / LW Concrete")  # graph input
string_4 = StringInput("x18x12M")  # graph input
create = List.Create(item0=string_3, item1=string_4)
boolean_2 = BoolSelector(true)  # graph input
transferByElementType = Orchid.RevitProject.Common.Document.TransferByElementType(source=code_block_3, elementType=create, append=boolean_2)
watch_2 = Watch(transferByElementType)
await_2 = Orchid.Common.DataStream.Await(pass=code_block_3, waitFor=transferByElementType)

# group: Copy Element
code_block_4 = CodeBlock(document=backgroundOpen) { document; }
categories_2 = Categories("OST_Floors")  # graph input
elementByCategory = Orchid.RevitProject.Elements.Selection.ElementByCategory(document=code_block_4, category=categories_2)
copyElement = Orchid.RevitProject.Common.Document.CopyElement(source=code_block_4, element=elementByCategory.Element)
watch_3 = Watch(copyElement)
await_3 = Orchid.Common.DataStream.Await(pass=code_block_4, waitFor=copyElement)

# group: Transfer Family
code_block_5 = CodeBlock(document=backgroundOpen) { document; }
string_5 = StringInput("Single-Light")  # graph input
string_6 = StringInput("xSingle-Light")  # graph input
create_2 = List.Create(item0=string_5, item1=string_6)
boolean_3 = BoolSelector(true)  # graph input
transferByFamily = Orchid.RevitProject.Common.Document.TransferByFamily(source=code_block_5, family=create_2, append=boolean_3)
watch_4 = Watch(transferByFamily)
await_4 = Orchid.Common.DataStream.Await(pass=code_block_5, waitFor=transferByFamily)

# group: Copy Schedule
code_block_6 = CodeBlock(document=backgroundOpen) { document; }
inDocument = Orchid.RevitProject.Views.View.InDocument(document=code_block_6)
string_from_object = FromObject(object=inDocument)
code_block_7 = CodeBlock { "Schedule"; }
contains = String.Contains(string=string_from_object, searchFor=code_block_7)
filterByBoolMask = List.FilterByBoolMask(list=inDocument, mask=contains)
copySchedule = Orchid.RevitProject.Common.Document.CopySchedule(source=code_block_6, schedule=filterByBoolMask.in)
watch_5 = Watch(copySchedule)
await_5 = Orchid.Common.DataStream.Await(pass=code_block_6, waitFor=copySchedule)

# group: Copy Drafting View
code_block_8 = CodeBlock(document=backgroundOpen) { document; }
inDocument_2 = Orchid.RevitProject.Views.View.InDocument(document=code_block_8)
string_from_object_2 = FromObject(object=inDocument_2)
code_block_9 = CodeBlock { "Drafting"; }
contains_2 = String.Contains(string=string_from_object_2, searchFor=code_block_9)
filterByBoolMask_2 = List.FilterByBoolMask(list=inDocument_2, mask=contains_2)
copyDraftingView = Orchid.RevitProject.Common.Document.CopyDraftingView(source=code_block_8, draftingView=filterByBoolMask_2.in)
watch_6 = Watch(copyDraftingView)
await_6 = Orchid.Common.DataStream.Await(pass=code_block_8, waitFor=copyDraftingView)

# group: Close document
create_3 = List.Create(item0=await_6, item1=await_5, item2=await_3, item3=await_, item4=await_2, item5=await_4)
firstItem = List.FirstItem(list=create_3)
close = Orchid.RevitProject.Common.Document.Close(document=firstItem)
