# Dynamo graph Workset.dyn "Workset_convert" (Dynamo 2.6.2.15705)
# packages: Orchid 206.3.1.8223

o_workset_userworkset = Orchid.RevitProject.Common.Workset.UserWorkset()
o_workset_name = Orchid.RevitProject.Common.Workset.Name(workset=o_workset_userworkset)
o_workset_byname = Orchid.RevitProject.Common.Workset.ByName(name=o_workset_name)
watch = Watch(o_workset_byname)
o_workset_id = Orchid.RevitProject.Common.Workset.Id(workset=o_workset_userworkset)
watch_2 = Watch(o_workset_id)
watch_3 = Watch(o_workset_name)
o_workset_byid = Orchid.RevitProject.Common.Workset.ById(id=o_workset_id)
watch_4 = Watch(o_workset_byid)
watch_5 = Watch(o_workset_userworkset)
o_workset_uniqueid = Orchid.RevitProject.Common.Workset.UniqueId(workset=o_workset_userworkset)
watch_6 = Watch(o_workset_uniqueid)
o_workset_all = Orchid.RevitProject.Common.Workset.All()

# group: Selection
natural_category_name = CodeBlock()
# ---------- natural_category_name.designscript (26 lines) ----------
[
"Casework",
"Ceilings",
"Columns",
"Curtain Wall Mullions",
"Curtain Panels",
"Curtain Systems",
"Doors",
"Entourage",
"Floors",
"Furniture",
"Furniture Systems",
"Generic Models",
"Plumbing Fixtures",
"Ramps",
"Roofs",
"Specialty Equipment",
"Stairs",
"Structural Columns",
"Structural Foundations",
"Structural Framing",
"Structural Beam Systems",
"Structural Stiffeners",
"Walls",
"Windows"
];
# ----------------------------------------
byName = Category.ByName(name=natural_category_name)
o_selection_elementbycategory = Orchid.RevitProject.Elements.Selection.ElementByCategory(category=byName)
code_block = CodeBlock { "Workset Text"; }
o_element_getworkset = Orchid.RevitProject.Elements.Element.GetWorkset(element=o_selection_elementbycategory.Element)
o_workset_name_2 = Orchid.RevitProject.Common.Workset.Name(workset=o_element_getworkset)
setParameterByName = Element.SetParameterByName(element=o_selection_elementbycategory.Element, parameterName=code_block, value=o_workset_name_2)
built_in_categories = CodeBlock()
# ---------- built_in_categories.designscript (26 lines) ----------
[
"OST_Casework",
"OST_Ceilings",
"OST_Columns",
"OST_CurtainWallMullions",
"OST_CurtainWallPanels",
"OST_CurtaSystem",
"OST_Doors",
"OST_Entourage",
"OST_Floors",
"OST_Furniture",
"OST_FurnitureSystems",
"OST_GenericModel",
"OST_PlumbingFixtures",
"OST_Ramps",
"OST_Roofs",
"OST_SpecialityEquipment",
"OST_Stairs",
"OST_StructuralColumns",
"OST_StructuralFoundation",
"OST_StructuralFraming",
"OST_StructuralFramingSystem",
"OST_StructuralStiffener",
"OST_Walls",
"OST_Windows"
];
# ----------------------------------------

# group: Worksets
o_worksets = Workset("View \"3D View: {3D}\"")  # graph input
watch_7 = Watch(o_worksets)
o_userworksets = UserWorkset("Shell and Core")
watch_8 = Watch(o_userworksets)

# group: SetOwner and Relinquish
boolean = BoolSelector(true)
o_element_relinquish = Orchid.RevitProject.Elements.Element.Relinquish(waitFor=boolean)
watch_9 = Watch(o_element_relinquish)
o_workset_userworkset_2 = Orchid.RevitProject.Common.Workset.UserWorkset()
o_workset_setowner = Orchid.RevitProject.Common.Workset.SetOwner(workset=o_workset_userworkset_2)
o_workset_relinquish = Orchid.RevitProject.Common.Workset.Relinquish(waitFor=o_workset_setowner)
watch_10 = Watch(o_workset_relinquish)

code_block_2 = CodeBlock { "Walls"; }
byName_2 = Category.ByName(name=code_block_2)
all_elements_of_category = ElementsOfCategory(Category=byName_2)
o_element_getworkset_2 = Orchid.RevitProject.Elements.Element.GetWorkset(element=all_elements_of_category)
watch_11 = Watch(o_element_getworkset_2)
code_block_3 = CodeBlock { "something"; }
o_workset_create = Orchid.RevitProject.Common.Workset.Create(name=code_block_3)
o_datastream_await = Orchid.Common.DataStream.Await(pass=code_block_3, waitFor=o_workset_create)
o_workset_byname_2 = Orchid.RevitProject.Common.Workset.ByName(name=o_datastream_await)
o_element_setworkset = Orchid.RevitProject.Elements.Element.SetWorkset(element=all_elements_of_category, workset=o_workset_byname_2)

# group: Selection
code_block_4 = CodeBlock()
# ---------- code_block_4.designscript (9 lines) ----------
"Model";
"Annotation";
"AnalyticalModel";
"Internal";

["Model",
"Annotation",
"AnalyticalModel",
"Internal"];
# ----------------------------------------
o_selection = Orchid.RevitProject.Elements.Selection.ElementByCategoryType(categoryType=code_block_4.out0)
code_block_5 = CodeBlock { "Workset Text"; }
o_element_getworkset_3 = Orchid.RevitProject.Elements.Element.GetWorkset(element=o_selection.Element)
o_workset_name_3 = Orchid.RevitProject.Common.Workset.Name(workset=o_element_getworkset_3)
setParameterByName_2 = Element.SetParameterByName(element=o_selection.Element, parameterName=code_block_5, value=o_workset_name_3)

# group: Selection
o_selection_elementhasmaterial = Orchid.RevitProject.Elements.Selection.ElementHasMaterial()
code_block_6 = CodeBlock { "Workset Text"; }
o_element_getworkset_4 = Orchid.RevitProject.Elements.Element.GetWorkset(element=o_selection_elementhasmaterial.Element)
o_workset_name_4 = Orchid.RevitProject.Common.Workset.Name(workset=o_element_getworkset_4)
setParameterByName_3 = Element.SetParameterByName(element=o_selection_elementhasmaterial.Element, parameterName=code_block_6, value=o_workset_name_4)

# group: Convert to Orchid type
o_workset_userworkset_3 = Orchid.RevitProject.Common.Workset.UserWorkset()
o_object_torevittype = Orchid.Common.Object.ToRevitType(object=o_workset_userworkset_3)
o_object_toorchidtype = Orchid.Common.Object.ToOrchidType(object=o_object_torevittype)
o_workset_name_5 = Orchid.RevitProject.Common.Workset.Name(workset=o_object_toorchidtype)
watch_12 = Watch(o_workset_name_5)
