# Dynamo graph AddSetGet_R23.dyn (Dynamo 2.16.2.5624)
# packages: Orchid 216.3.0.5794

# group: create family type
# File: defaultFamily
current = Orchid.RevitFamily.FamilyDocument.Current()
code_block = CodeBlock()
# ---------- code_block.designscript (2 lines) ----------
//Types to create
"Type 1";
# ----------------------------------------
create = Orchid.RevitFamily.FamilyType.Create(familyDocument=current, name=code_block)
name = Orchid.RevitFamily.FamilyType.Name(familyType=create)

# group: Add parameter
await_ = Orchid.Common.DataStream.Await(pass=current, waitFor=create)
code_block_2 = CodeBlock()
# ---------- code_block_2.designscript (6 lines) ----------
//Parameter name
"Test4";
//SpecType
"Material";
//GroupType
"AdskModelProperties";
# ----------------------------------------
byName = Orchid.AdeskApp.SpecType.ByName(string=code_block_2.out1)
byName_2 = Orchid.AdeskApp.GroupType.ByName(string=code_block_2.out2)
create_2 = Orchid.RevitFamily.FamilyParameter.Create(familyDocument=await_, parameterName=code_block_2.out0, specType=byName, groupType=byName_2)

# group: Set parameter
await_2 = Orchid.Common.DataStream.Await(pass=await_, waitFor=create_2)
code_block_3 = CodeBlock()
# ---------- code_block_3.designscript (6 lines) ----------
//Type
"Type 1";
//Parameter name
"Test4";
//Value
"Glass";
# ----------------------------------------
byName_3 = Orchid.RevitFamily.FamilyType.ByName(name=code_block_3.out0)
byName_4 = Material.ByName(name=code_block_3.out2)
setValue = Orchid.RevitFamily.FamilyParameter.SetValue(familyDocument=await_2, familyType=byName_3, parameterName=code_block_3.out1, value=byName_4)

# group: Filter by Type
code_block_4 = CodeBlock(data=setValue) { data; }
type = Object.Type(object=code_block_4)
toClass = Orchid.Common.String.ToClass(string=type)
classOf = Orchid.Common.Object.ClassOf(object=code_block_4, class=toClass)
watch = Watch(classOf)

# group: Add parameter
await_3 = Orchid.Common.DataStream.Await(pass=current, waitFor=create)
code_block_5 = CodeBlock()
# ---------- code_block_5.designscript (6 lines) ----------
//Parameter name
"Test2";
//SpecType
"Number";
//GroupType
"AdskModelProperties";
# ----------------------------------------
byName_5 = Orchid.AdeskApp.SpecType.ByName(string=code_block_5.out1)
byName_6 = Orchid.AdeskApp.GroupType.ByName(string=code_block_5.out2)
create_3 = Orchid.RevitFamily.FamilyParameter.Create(familyDocument=await_3, parameterName=code_block_5.out0, specType=byName_5, groupType=byName_6)

# group: Set parameter
await_4 = Orchid.Common.DataStream.Await(pass=await_3, waitFor=create_3)
code_block_6 = CodeBlock()
# ---------- code_block_6.designscript (6 lines) ----------
//Type
"Type 1";
//Parameter name
"Test2";
//Value
1.5;
# ----------------------------------------
byName_7 = Orchid.RevitFamily.FamilyType.ByName(name=code_block_6.out0)
setValue_2 = Orchid.RevitFamily.FamilyParameter.SetValue(familyDocument=await_4, familyType=byName_7, parameterName=code_block_6.out1, value=code_block_6.out2)

# group: Add parameter
await_5 = Orchid.Common.DataStream.Await(pass=current, waitFor=create)
code_block_7 = CodeBlock()
# ---------- code_block_7.designscript (14 lines) ----------
//Parameter name
"Test1";
//SpecType
"Integer";
//GroupType
"AdskModelProperties";
//ToolTip
"do this work?";
//Instances
true;
//Reporting
true;
//Condense output
false;
# ----------------------------------------
byName_8 = Orchid.AdeskApp.SpecType.ByName(string=code_block_7.out1)
byName_9 = Orchid.AdeskApp.GroupType.ByName(string=code_block_7.out2)
create_4 = Orchid.RevitFamily.FamilyParameter.Create(familyDocument=await_5, parameterName=code_block_7.out0, specType=byName_8, groupType=byName_9, tooltip=code_block_7.out3)

# group: Set parameter
await_6 = Orchid.Common.DataStream.Await(pass=await_5, waitFor=create_4)
code_block_8 = CodeBlock()
# ---------- code_block_8.designscript (6 lines) ----------
//Type
"Type 1";
//Parameter name
"Test1";
//Value
1;
# ----------------------------------------
byName_10 = Orchid.RevitFamily.FamilyType.ByName(familyDocument=await_6, name=code_block_8.out0)
setValue_3 = Orchid.RevitFamily.FamilyParameter.SetValue(familyDocument=await_6, familyType=byName_10, parameterName=code_block_8.out1, value=code_block_8.out2)

# group: Add parameter
await_7 = Orchid.Common.DataStream.Await(pass=current, waitFor=create)
code_block_9 = CodeBlock()
# ---------- code_block_9.designscript (6 lines) ----------
//Parameter name
"Test3";
//SpecType
"Text";
//GroupType
"AdskModelProperties";
# ----------------------------------------
byName_11 = Orchid.AdeskApp.SpecType.ByName(string=code_block_9.out1)
byName_12 = Orchid.AdeskApp.GroupType.ByName(string=code_block_9.out2)
create_5 = Orchid.RevitFamily.FamilyParameter.Create(familyDocument=await_7, parameterName=code_block_9.out0, specType=byName_11, groupType=byName_12)

# group: Set parameter
await_8 = Orchid.Common.DataStream.Await(pass=await_7, waitFor=create_5)
code_block_10 = CodeBlock()
# ---------- code_block_10.designscript (6 lines) ----------
//Type
"Type 1";
//Parameter name
"Test3";
//Value
"string";
# ----------------------------------------
byName_13 = Orchid.RevitFamily.FamilyType.ByName(name=code_block_10.out0)
setValue_4 = Orchid.RevitFamily.FamilyParameter.SetValue(familyDocument=await_8, familyType=byName_13, parameterName=code_block_10.out1, value=code_block_10.out2)

list_create = List.Create(item0=setValue_3, item1=setValue_2, item2=setValue_4, item3=setValue)

# group: Get Parameter
await_9 = Orchid.Common.DataStream.Await(pass=await_4, waitFor=list_create)
code_block_11 = CodeBlock()
# ---------- code_block_11.designscript (7 lines) ----------
//Type name
"Type 1";
//Parameter name
["Test1",
"Test2",
"Test3",
"Test4"];
# ----------------------------------------
byName_14 = Orchid.RevitFamily.FamilyType.ByName(name=code_block_11.out0)
getValue = Orchid.RevitFamily.FamilyParameter.GetValue(familyDocument=await_9, familyType=byName_14, parameterName=code_block_11.out1)
code_block_12 = CodeBlock(t=getValue.valueByParameter) { t[3]; }
name_2 = Material.Name(material=code_block_12)
watch_2 = Watch(name_2)
type_2 = Object.Type(object=getValue.valueByParameter)
watch_3 = Watch(type_2)
watch_4 = Watch(getValue.valueByParameter)

# group: Parameters
await_10 = Orchid.Common.DataStream.Await(pass=await_4, waitFor=list_create)
parameters = Orchid.RevitFamily.FamilyDocument.Parameters(familyDocument=await_10)
name_3 = FamilyParameter.Name(familyParameter=parameters)
watch_5 = Watch(name_3)
