# Dynamo graph CategoryReporting_R23.dyn "CategoryReporting" (Dynamo 2.16.1.2727)
# packages: Orchid 216.3.0.5794

current = Orchid.RevitFamily.FamilyDocument.Current()

# group: Create types
code_block = CodeBlock()
# ---------- code_block.designscript (2 lines) ----------
//Types to create
["Type 1", "Type 2"];
# ----------------------------------------
create = Orchid.RevitFamily.FamilyType.Create(familyDocument=current, name=code_block)

# group: Add parameter
await_ = Orchid.Common.DataStream.Await(pass=current, waitFor=create)
code_block_2 = CodeBlock()
# ---------- code_block_2.designscript (10 lines) ----------
//Parameter name
"Test";
//SpecType
"Text";
//GroupType
"AdskModelProperties";
//Tooltip
"Owner value";
//Instances
true;
# ----------------------------------------
byName = Orchid.AdeskApp.SpecType.ByName(string=code_block_2.out1)
byName_2 = Orchid.AdeskApp.GroupType.ByName(string=code_block_2.out2)
create_2 = Orchid.RevitFamily.FamilyParameter.Create(familyDocument=await_, parameterName=code_block_2.out0, specType=byName, groupType=byName_2, tooltip=code_block_2.out3, instance=code_block_2.out4)

# group: Set parameter
await_2 = Orchid.Common.DataStream.Await(pass=await_, waitFor=create_2)
code_block_3 = CodeBlock()
# ---------- code_block_3.designscript (6 lines) ----------
//Type
"Type 1";
//Parameter name
"Test";
//Value
"This is a test";
# ----------------------------------------
byName_3 = Orchid.RevitFamily.FamilyType.ByName(name=code_block_3.out0)
setValue = Orchid.RevitFamily.FamilyParameter.SetValue(familyDocument=await_2, familyType=byName_3, parameterName=code_block_3.out1, value=code_block_3.out2)

# group: Add parameter
await_3 = Orchid.Common.DataStream.Await(pass=current, waitFor=create)
# note: File: defaultFamily
code_block_4 = CodeBlock()
# ---------- code_block_4.designscript (8 lines) ----------
//Parameter name
"dim";
//SpecType
"Length";
//GroupType
"AdskModelProperties";
//Reporting
true;
# ----------------------------------------
byName_4 = Orchid.AdeskApp.SpecType.ByName(string=code_block_4.out1)
byName_5 = Orchid.AdeskApp.GroupType.ByName(string=code_block_4.out2)
create_3 = Orchid.RevitFamily.FamilyParameter.Create(familyDocument=await_3, parameterName=code_block_4.out0, specType=byName_4, groupType=byName_5, reporting=code_block_4.out3)

create_4 = List.Create(item0=create_3, item1=create_2)

# group: IsReporting parameter
name = FamilyParameter.Name(familyParameter=create_4)
isReporting = Orchid.RevitFamily.FamilyParameter.IsReporting(familyDocument=await_3, parameterName=name)
watch = Watch(isReporting)
watch_2 = Watch(name)

# group: Parameters
parameters = Orchid.RevitFamily.FamilyDocument.Parameters(familyDocument=await_3)
name_2 = FamilyParameter.Name(familyParameter=parameters)
watch_3 = Watch(name_2)

# group: Set the document category
code_block_5 = CodeBlock { "Casework"; }
byName_6 = Category.ByName(name=code_block_5)
setCategory = Orchid.RevitFamily.FamilyDocument.SetCategory(familyDocument=current, category=byName_6)

# group: Get the document category
await_4 = Orchid.Common.DataStream.Await(pass=current, waitFor=setCategory)
getCategory = Orchid.RevitFamily.FamilyDocument.GetCategory(familyDocument=await_4)
watch_4 = Watch(getCategory)
