# Dynamo graph FamilyType_R23.dyn "FamilyType" (Dynamo 2.16.1.2727)
# packages: Orchid 216.3.0.5794

# group: Get all family type
# note: This node is being processed among the first, while it always look at the current document and don't need a document to be loaded. This node is best to use in families where types are not added!
inDocument = Orchid.RevitFamily.FamilyType.InDocument()
name = Orchid.RevitFamily.FamilyType.Name(familyType=inDocument)
watch = Watch(name)
watch_2 = Watch(inDocument)

# group: Current family type
# note: This node is being processed among the first, while it always look at the current document and don't need a document to be loaded. This node is best to use in families where types are not added!
current = Orchid.RevitFamily.FamilyType.Current()
name_2 = Orchid.RevitFamily.FamilyType.Name(familyType=current)
watch_3 = Watch(name_2)

# group: Create type
current_2 = Orchid.RevitFamily.FamilyDocument.Current()
code_block = CodeBlock()
# ---------- code_block.designscript (2 lines) ----------
//Types to create
["Type 1", "Type 2"];
# ----------------------------------------
create = Orchid.RevitFamily.FamilyType.Create(familyDocument=current_2, name=code_block)

# group: Get all family type by document
await_ = Orchid.Common.DataStream.Await(pass=current_2, waitFor=create)
inDocument_2 = Orchid.RevitFamily.FamilyType.InDocument(familyDocument=await_)
name_3 = Orchid.RevitFamily.FamilyType.Name(familyType=inDocument_2)
watch_4 = Watch(name_3)

# group: Convert to Orchid type
toRevitType = Orchid.Common.Object.ToRevitType(object=create)
toOrchidType = Orchid.Common.Object.ToOrchidType(object=toRevitType)
name_4 = Orchid.RevitFamily.FamilyType.Name(familyType=toOrchidType)
watch_5 = Watch(name_4)

# group: Add parameter
code_block_2 = CodeBlock()
# ---------- code_block_2.designscript (15 lines) ----------
//Parameter name
["Test","something"];
//SpecType
"Text";
//"Length";
//GroupType
"AdskModelProperties";
//Tooltip
"Owner value";
//Instances
true;
//Reporting
true;
//Condense output
false;
# ----------------------------------------
byName = Orchid.AdeskApp.SpecType.ByName(string=code_block_2.out1)
byName_2 = Orchid.AdeskApp.GroupType.ByName(string=code_block_2.out2)
create_2 = Orchid.RevitFamily.FamilyParameter.Create(familyDocument=current_2, parameterName=code_block_2.out0, specType=byName, groupType=byName_2)

# group: Rename parameter
await_2 = Orchid.Common.DataStream.Await(pass=current_2, waitFor=create_2)
code_block_3 = CodeBlock()
# ---------- code_block_3.designscript (4 lines) ----------
//Source name
"Test";
//Target name
"NewTest";
# ----------------------------------------
rename = Orchid.RevitFamily.FamilyParameter.Rename(familyDocument=await_2, sourceName=code_block_3.out0, targetName=code_block_3.out1)
watch_6 = Watch(rename)

# group: Delete parameter
await_3 = Orchid.Common.DataStream.Await(pass=await_2, waitFor=rename)
code_block_4 = CodeBlock()
# ---------- code_block_4.designscript (2 lines) ----------
//Parameter name
"NewTest";
# ----------------------------------------
delete = Orchid.RevitFamily.FamilyParameter.Delete(familyDocument=await_3, parameterName=code_block_4)

# group: Rename type
# note: File: defaultFamily
await_4 = Orchid.Common.DataStream.Await(pass=current_2, waitFor=create)
code_block_5 = CodeBlock()
# ---------- code_block_5.designscript (4 lines) ----------
//Source name
"Type 1";
//Target name
"Type 3";
# ----------------------------------------
rename_2 = Orchid.RevitFamily.FamilyType.Rename(familyDocument=await_4, sourceName=code_block_5.out0, targetName=code_block_5.out1)

# group: Delete type
await_5 = Orchid.Common.DataStream.Await(pass=await_4, waitFor=rename_2)
name_5 = Orchid.RevitFamily.FamilyType.Name(familyType=rename_2)
byName_3 = Orchid.RevitFamily.FamilyType.ByName(name=name_5)
delete_2 = Orchid.RevitFamily.FamilyType.Delete(familyDocument=await_5, familyType=byName_3)
