# Dynamo graph ImportImage_R23.dyn "ImportImage" (Dynamo 2.16.1.2727)
# packages: Orchid 216.3.0.5794

# group: Open all files in directory and sub directories
current = Orchid.RevitFamily.FamilyDocument.Current()
string = StringInput("%userprofile%\Programming\Source\OrchidForDynamo\Samples\Data\testSet")  # graph input; frozen
code_block = CodeBlock { "*.rfa"; }
boolean = BoolSelector(false)  # graph input
contents = Orchid.Common.Directory.Contents(directory=string, searchString=code_block, deepSearch=boolean)
backgroundOpen = Orchid.RevitProject.Common.Document.BackgroundOpen(file=contents)

# group: Create default family type
# note: File: defaultFamily
code_block_2 = CodeBlock()
# ---------- code_block_2.designscript (2 lines) ----------
//Types to create
["Type 1", "Type 2"];
# ----------------------------------------
create = Orchid.RevitFamily.FamilyType.Create(familyDocument=current, name=code_block_2)

# group: Create parameter
await_ = Orchid.Common.DataStream.Await(pass=current, waitFor=create)
code_block_3 = CodeBlock()
# ---------- code_block_3.designscript (12 lines) ----------
//Parameter name
"AddedImage";
//SpecTypeType
"Image";
//GroupType
"AdskModelProperties";
//Instances
true;
//Reporting
true;
//Condense output
false;
# ----------------------------------------
byName = Orchid.AdeskApp.SpecType.ByName(string=code_block_3.out1)
byName_2 = Orchid.AdeskApp.GroupType.ByName(string=code_block_3.out2)
create_2 = Orchid.RevitFamily.FamilyParameter.Create(familyDocument=await_, parameterName=code_block_3.out0, specType=byName, groupType=byName_2)

# group: import image
string_2 = StringInput("%userprofile%\Programming\Source\OrchidForDynamo\Samples\Data\DefaultCustomNode.Small.png")  # graph input
boolean_2 = BoolSelector(false)  # graph input
importImage = Orchid.RevitProject.Common.Document.ImportImage(path=string_2, overwrite=boolean_2)
watch = Watch(importImage)

# group: Set parameter
await_2 = Orchid.Common.DataStream.Await(pass=await_, waitFor=create_2)
code_block_4 = CodeBlock()
# ---------- code_block_4.designscript (6 lines) ----------
//Type
"Type 1";
//Parameter name
"AddedImage";
//Value
"_default.Large.png";
# ----------------------------------------
byName_3 = Orchid.RevitFamily.FamilyType.ByName(name=code_block_4.out0)
setValue = Orchid.RevitFamily.FamilyParameter.SetValue(familyDocument=await_2, familyType=byName_3, parameterName=code_block_4.out1, value=importImage)

# group: Close files
await_3 = Orchid.Common.DataStream.Await(pass=await_2, waitFor=setValue)  # frozen
boolean_3 = BoolSelector(false)  # graph input
close = Orchid.RevitProject.Common.Document.Close(document=await_3, save=boolean_3)

element_types = ElementTypes("ImageType")  # graph input
all_elements_of_type = ElementsOfType(element_class=element_types)
watch_2 = Watch(all_elements_of_type)
