# Dynamo graph LightSource.dyn (Dynamo 2.16.1.2727)
# packages: Orchid 216.3.0.5799

code_block = CodeBlock { "Type 1"; "Type 2"; }
byName = Orchid.RevitFamily.FamilyType.ByName(name=code_block.out1)

# group: Initial Color
code_block_2 = CodeBlock(familyType=byName)
# ---------- code_block_2.designscript (6 lines) ----------
familyType;
// Style
"PresetColor";

3100;
"FluorescentWarm";
# ----------------------------------------
setLightCustomColor = Orchid.RevitFamily.FamilyParameter.SetLightCustomColor(familyType=code_block_2.familyType, value=code_block_2.out2)  # frozen
lighting_color_preset = ColorPreset("Fluorescent (Warm White)")
setLightPresetColor = Orchid.RevitFamily.FamilyParameter.SetLightPresetColor(familyType=code_block_2.familyType, name=lighting_color_preset)  # frozen
initial_color_style = InitialColor("Custom color")
setLightColor = Orchid.RevitFamily.FamilyParameter.SetLightColor(familyType=code_block_2.familyType, style=initial_color_style, value=code_block_2.out2)

# group: Initial Color
getLightColor = Orchid.RevitFamily.FamilyParameter.GetLightColor(familyType=setLightCustomColor)
watch = Watch(getLightColor.d1)
getLightColor_2 = Orchid.RevitFamily.FamilyParameter.GetLightColor(familyType=setLightPresetColor)
watch_2 = Watch(getLightColor_2.d1)
getLightColor_3 = Orchid.RevitFamily.FamilyParameter.GetLightColor(familyType=setLightColor)
watch_3 = Watch(getLightColor_3.Color)
watch_4 = Watch(getLightColor_3.d1)

# group: Initial Intensity
code_block_3 = CodeBlock(familyType=byName)
# ---------- code_block_3.designscript (14 lines) ----------
familyType;
// Style
"Flux";

// Wattage
10;
150;
// Flux
1400;
// Luminous
440;
// lluminance
50;
3048;
# ----------------------------------------
setLightWattageIntensity = Orchid.RevitFamily.FamilyParameter.SetLightWattageIntensity(familyType=code_block_3.familyType, wattage=code_block_3.out2, efficacy=code_block_3.out3)  # frozen
setLightFluxIntensity = Orchid.RevitFamily.FamilyParameter.SetLightFluxIntensity(familyType=code_block_3.familyType, value=code_block_3.out4)  # frozen
setLightLuminousIntensity = Orchid.RevitFamily.FamilyParameter.SetLightLuminousIntensity(familyType=code_block_3.familyType, value=code_block_3.out5)  # frozen
setLightIlluminanceIntensity = Orchid.RevitFamily.FamilyParameter.SetLightIlluminanceIntensity(familyType=code_block_3.familyType, illuminance=code_block_3.out6, distance=code_block_3.out7)  # frozen
initial_intensity_style = InitialIntensity("Flux intensity")
setLightIntensity = Orchid.RevitFamily.FamilyParameter.SetLightIntensity(familyType=code_block_3.familyType, style=initial_intensity_style, valueA=code_block_3.out4)

# group: Initial Intensity
getLightIntensity = Orchid.RevitFamily.FamilyParameter.GetLightIntensity(familyType=setLightWattageIntensity)
watch_5 = Watch(getLightIntensity.Value)
getLightIntensity_2 = Orchid.RevitFamily.FamilyParameter.GetLightIntensity(familyType=setLightFluxIntensity)
watch_6 = Watch(getLightIntensity_2.Value)
getLightIntensity_3 = Orchid.RevitFamily.FamilyParameter.GetLightIntensity(familyType=setLightLuminousIntensity)
watch_7 = Watch(getLightIntensity_3.Value)
getLightIntensity_4 = Orchid.RevitFamily.FamilyParameter.GetLightIntensity(familyType=setLightIlluminanceIntensity)
watch_8 = Watch(getLightIntensity_4.Value)
getLightIntensity_5 = Orchid.RevitFamily.FamilyParameter.GetLightIntensity(familyType=setLightIntensity)
watch_9 = Watch(getLightIntensity_5.Style)
watch_10 = Watch(getLightIntensity_5.Value)

# group: Loss Factor
code_block_4 = CodeBlock(familyType=byName)
# ---------- code_block_4.designscript (7 lines) ----------
familyType;

// Style
"Basic";
3.00;
1.25;
0.75;
# ----------------------------------------
setBasicLossFactor = Orchid.RevitFamily.FamilyParameter.SetBasicLossFactor(familyType=code_block_4.familyType, value=code_block_4.out2)
setAdvancedLossFactor = Orchid.RevitFamily.FamilyParameter.SetAdvancedLossFactor(familyType=code_block_4.familyType, temperature=code_block_4.out3, voltage=code_block_4.out3, ballast=code_block_4.out4, tilt=code_block_4.out4, surface=code_block_4.out4, lumen=code_block_4.out4, luminaire=code_block_4.out4)  # frozen
loss_factor_style = LossFactor("Basic loss factor")
setLightLossFactor = Orchid.RevitFamily.FamilyParameter.SetLightLossFactor(familyType=code_block_4.familyType, style=loss_factor_style, value=code_block_4.out2, temperature=code_block_4.out3, voltage=code_block_4.out3, ballast=code_block_4.out4, tilt=code_block_4.out4, surface=code_block_4.out4, lumen=code_block_4.out4, luminaire=code_block_4.out4)

# group: Loss Factor
getLightLossFactor = Orchid.RevitFamily.FamilyParameter.GetLightLossFactor(familyType=setBasicLossFactor)  # frozen
watch_11 = Watch(getLightLossFactor.Value)
getLightLossFactor_2 = Orchid.RevitFamily.FamilyParameter.GetLightLossFactor(familyType=setAdvancedLossFactor)
watch_12 = Watch(getLightLossFactor_2.Value)
getLightLossFactor_3 = Orchid.RevitFamily.FamilyParameter.GetLightLossFactor(familyType=setLightLossFactor)
watch_13 = Watch(getLightLossFactor_3.Style)
watch_14 = Watch(getLightLossFactor_3.Value)

inDocument = Orchid.RevitFamily.FamilyType.InDocument()

# group: Set light shape data
code_block_5 = CodeBlock(familyType=byName) { familyType; "Point"; }
light_shape_style = LightShapeStyle("Rectangle")
setLightShape = Orchid.RevitFamily.FamilyParameter.SetLightShape(familyType=code_block_5.familyType, style=light_shape_style)

# group: Get light shape data
getLightShape = Orchid.RevitFamily.FamilyParameter.GetLightShape(familyType=setLightShape)
watch_15 = Watch(getLightShape.Style)
watch_16 = Watch(getLightShape.Value)

# group: Set light distribution data
code_block_6 = CodeBlock(familyType=byName) { familyType; "Spherical"; }
light_distribution_style = LightDistributionStyle("Spot light distribution")
setLightDistribution = Orchid.RevitFamily.FamilyParameter.SetLightDistribution(familyType=code_block_6.familyType, style=light_distribution_style)

# group: Get light distribution data
getLightDistribution = Orchid.RevitFamily.FamilyParameter.GetLightDistribution(familyType=setLightDistribution)
watch_17 = Watch(getLightDistribution.Style)
watch_18 = Watch(getLightDistribution.Value)

# group: Set light color filter data
code_block_7 = CodeBlock(familyType=byName)
# ---------- code_block_7.designscript (3 lines) ----------
familyType;
Color.ByARGB
(0, 127, 127, 127);
# ----------------------------------------
setLightColorFilter = Orchid.RevitFamily.FamilyParameter.SetLightColorFilter(familyType=code_block_7.familyType, color=code_block_7.out1)

# group: Get light color filter data
getLightColorFilter = Orchid.RevitFamily.FamilyParameter.GetLightColorFilter(familyType=setLightColorFilter)
watch_19 = Watch(getLightColorFilter)

# group: Set light dimming color data
code_block_8 = CodeBlock(familyType=byName) { familyType; "None"; }
light_dimming_color = LightDimmingColor("Incandescent lamp curve dimming color")
setLightDimmingColor = Orchid.RevitFamily.FamilyParameter.SetLightDimmingColor(familyType=code_block_8.familyType, name=light_dimming_color)

# group: Get light dimming color data
getLightDimmingColor = Orchid.RevitFamily.FamilyParameter.GetLightDimmingColor(familyType=setLightDimmingColor)
watch_20 = Watch(getLightDimmingColor)
