# Dynamo graph Nested-Lookup.dyn (Dynamo 2.16.1.2727)
# packages: Orchid 216.3.0.5794

# group: Load a family (nested)
string = StringInput("..\testSet\Front - Plain.rfa")  # graph input
backgroundOpen = Orchid.RevitProject.Common.Document.BackgroundOpen(file=string)
load = Orchid.RevitFamily.Family.Load(familyDocument=backgroundOpen)
await_ = Orchid.Common.DataStream.Await(pass=backgroundOpen, waitFor=load)
close = Orchid.RevitProject.Common.Document.Close(document=await_)

# group: create default family type
# note: File: defaultFamily
current = Orchid.RevitFamily.FamilyDocument.Current()
create = Orchid.RevitFamily.FamilyType.Create(familyDocument=current)
await_2 = Orchid.Common.DataStream.Await(pass=current, waitFor=create)

# group: Create Family Type parameter (Category)
await_3 = Orchid.Common.DataStream.Await(pass=await_2, waitFor=load)
code_block = CodeBlock()
# ---------- code_block.designscript (8 lines) ----------
//Parameter name
["testFamily"];
//Parameter group
"PG_ADSK_MODEL_PROPERTIES";
//Instances
true;
//Reporting
true;
# ----------------------------------------
code_block_2 = CodeBlock { Revit.Category.ByName("Casework"); }
create_2 = Orchid.RevitFamily.FamilyParameter.Create(familyDocument=await_3, parameterName=code_block.out0, category=code_block_2, groupType=code_block.out1)

# group: Create ordinary parameter
code_block_3 = CodeBlock()
# ---------- code_block_3.designscript (6 lines) ----------
//Parameter name
["Width","Height","testValue"];
//Parameter type
"Length";
//Parameter group
"PG_ADSK_MODEL_PROPERTIES";
# ----------------------------------------
create_3 = Orchid.RevitFamily.FamilyParameter.Create(familyDocument=await_2, parameterName=code_block_3.out0, specType=code_block_3.out1, groupType=code_block_3.out2)

# group: Set parameter
await_4 = Orchid.Common.DataStream.Await(pass=await_2, waitFor=create_3)
code_block_4 = CodeBlock()
# ---------- code_block_4.designscript (4 lines) ----------
//Parameter name
"Width";
//Value
800.0;
# ----------------------------------------
setValue = Orchid.RevitFamily.FamilyParameter.SetValue(familyDocument=await_4, parameterName=code_block_4.out0, value=code_block_4.out1)

types = Family.Types(family=load)

# group: Associate parameter
await_5 = Orchid.Common.DataStream.Await(pass=await_4, waitFor=setValue)
code_block_5 = CodeBlock()
# ---------- code_block_5.designscript (2 lines) ----------
//Parameter name
"Width";
# ----------------------------------------
associate = Orchid.RevitFamily.FamilyParameter.Associate(familyDocument=await_5, parameterName=code_block_5, element=types, elementParameter=code_block_5)
await_6 = Orchid.Common.DataStream.Await(pass=await_5, waitFor=associate)

# group: parameters
parameters = Orchid.RevitFamily.FamilyDocument.Parameters(familyDocument=await_6)
name = FamilyParameter.Name(familyParameter=parameters)
watch = Watch(name)
toRevitType = Orchid.Common.Object.ToRevitType(object=parameters)

# group: Get nested family type (FamilySymbol) and converters Note: Nested families in a family document is denoted FamilySymbol, and FamilyType in a project document is denoted FamilySymbol in Autodesk Revit API!
getNested = Orchid.RevitFamily.FamilyType.GetNested(familyDocument=await_6)
toRevitType_2 = Orchid.Common.Object.ToRevitType(object=getNested)
toDynamoType = Orchid.Common.Object.ToDynamoType(object=toRevitType_2)
watch_2 = Watch(toDynamoType)
name_2 = Element.Name(element=toDynamoType)
watch_3 = Watch(name_2)
watch_4 = Watch(toRevitType_2)
watch_5 = Watch(getNested)

# group: Get nested data --> use OOTB nodes inside family document
lastItem = List.LastItem(list=getNested)
code_block_6 = CodeBlock()
# ---------- code_block_6.designscript (2 lines) ----------
//Parameter name
["Width"];
# ----------------------------------------
getParameterValueByName = Element.GetParameterValueByName(element=lastItem, parameterName=code_block_6)
watch_6 = Watch(getParameterValueByName)

# group: Create ordinary parameter
code_block_7 = CodeBlock()
# ---------- code_block_7.designscript (6 lines) ----------
//Parameter name
["Lookup Table Name","testKey"];
//Parameter type
"Text";
//Parameter group
"PG_ADSK_MODEL_PROPERTIES";
# ----------------------------------------
create_4 = Orchid.RevitFamily.FamilyParameter.Create(familyDocument=await_2, parameterName=code_block_7.out0, specType=code_block_7.out1, groupType=code_block_7.out2)

# group: Set parameter
create_5 = List.Create(item0=create_3, item1=create_4)
await_7 = Orchid.Common.DataStream.Await(pass=await_2, waitFor=create_5)
code_block_8 = CodeBlock()
# ---------- code_block_8.designscript (4 lines) ----------
//Parameter name
["Lookup Table Name","testKey"];
//Values
["CSVLookuptable","11x300"];
# ----------------------------------------
setValue_2 = Orchid.RevitFamily.FamilyParameter.SetValue(familyDocument=await_7, parameterName=code_block_8.out0, value=code_block_8.out1)

# group: Add lookup table and use it by setting a formula
await_8 = Orchid.Common.DataStream.Await(pass=await_7, waitFor=setValue_2)
string_2 = StringInput("..\CSVLookuptable.csv")  # graph input
addLookupTable = Orchid.RevitFamily.FamilyDocument.AddLookupTable(familyDocument=await_8, file=string_2)
await_9 = Orchid.Common.DataStream.Await(pass=await_8, waitFor=addLookupTable)
code_block_9 = CodeBlock()
# ---------- code_block_9.designscript (4 lines) ----------
//Parameter name
"testValue";
//Values
["size_lookup(Lookup Table Name, \"d\", 0, testKey)"];
# ----------------------------------------
string_3 = StringInput("size_lookup(Lookup Table Name, \"d\", 0, testKey)")  # graph input
set = Orchid.RevitFamily.Formula.Set(familyDocument=await_9, parameterName=code_block_9.out0, value=string_3)

# group: Get nested family and converters
getNested_2 = Orchid.RevitFamily.Family.GetNested(familyDocument=await_6)
toRevitType_3 = Orchid.Common.Object.ToRevitType(object=getNested_2.Family)
toDynamoType_2 = Orchid.Common.Object.ToDynamoType(object=toRevitType_3)
watch_7 = Watch(toDynamoType_2)
watch_8 = Watch(toRevitType_3)
watch_9 = Watch(getNested_2.Family)
name_3 = Element.Name(element=toDynamoType_2)
watch_10 = Watch(name_3)

# group: Has the parameter associated element
code_block_10 = CodeBlock()
# ---------- code_block_10.designscript (2 lines) ----------
//Parameter name
["Width","Height"];
# ----------------------------------------
hasAssociated = Orchid.RevitFamily.FamilyParameter.HasAssociated(familyDocument=await_6, parameterName=code_block_10)
watch_11 = Watch(hasAssociated)

# group: Get associated element and parameter
getAssociated = Orchid.RevitFamily.FamilyDocument.GetAssociated(familyDocument=await_6)
watch_12 = Watch(getAssociated.Element)
watch_13 = Watch(getAssociated.elementParameter)
watch_14 = Watch(getAssociated.Parameter)
code_block_11 = CodeBlock()  # same code as code_block_5
getAssociated_2 = Orchid.RevitFamily.FamilyParameter.GetAssociated(familyDocument=await_6, parameterName=code_block_11)
watch_15 = Watch(getAssociated_2.elementParameter)
watch_16 = Watch(getAssociated_2.Element)

# group: Deprecated converters
getNested_3 = Orchid.RevitFamily.Family.GetNested(familyDocument=await_6)
watch_17 = Watch(getNested_3.Family)
toRevitType_4 = Orchid.RevitProject.Elements.Element.ToRevitType(element=getNested_3.Family)
watch_18 = Watch(toRevitType_4)
toDynamoType_3 = Orchid.RevitProject.Elements.Element.ToDynamoType(element=toRevitType_4)
watch_19 = Watch(toDynamoType_3)
name_4 = Element.Name(element=toDynamoType_3)
watch_20 = Watch(name_4)

# group: Deprecated converters
getNested_4 = Orchid.RevitFamily.FamilyType.GetNested(familyDocument=await_6)
toRevitType_5 = Orchid.RevitProject.Elements.Element.ToRevitType(element=getNested_4)
toDynamoType_4 = Orchid.RevitProject.Elements.Element.ToDynamoType(element=toRevitType_5)
watch_21 = Watch(toDynamoType_4)
watch_22 = Watch(toRevitType_5)
watch_23 = Watch(getNested_4)
name_5 = Element.Name(element=toDynamoType_4)
watch_24 = Watch(name_5)
