# Dynamo graph NestedByCategory.dyn (Dynamo 2.16.1.2727)
# packages: Orchid 216.3.0.5794

# note: File: defaultFamily
code_block = CodeBlock { "Level Heads"; }
byName = Category.ByName(name=code_block)
o_family_getnestedbycategory = Orchid.RevitFamily.Family.GetNestedByCategory(category=byName)
watch = Watch(o_family_getnestedbycategory)
o_family_getnested = Orchid.RevitFamily.Family.GetNested()
watch_2 = Watch(o_family_getnested.Family)
watch_3 = Watch(o_family_getnested.Category)
