# Dynamo graph NestedByCategory_R23.dyn (Dynamo 2.16.2.5624)
# packages: Orchid 216.3.0.5794

# group: 
# File: defaultFamily
code_block = CodeBlock { "Level Heads"; }
byName = Category.ByName(name=code_block)
getNestedByCategory = Orchid.RevitFamily.Family.GetNestedByCategory(category=byName)
watch = Watch(getNestedByCategory)

getNested = Orchid.RevitFamily.Family.GetNested()
watch_2 = Watch(getNested.Family)
watch_3 = Watch(getNested.Category)
