# Dynamo graph SetGet_R23.dyn "SetGet" (Dynamo 2.16.1.2727)
# packages: Orchid 216.3.0.5794

# note: File: defaultFamily
directory_path = StringInput("%userprofile%\Programming\Testing\Data\testSet")  # graph input
string = StringInput("*.rfa")  # graph input
boolean = BoolSelector(false)  # graph input
contents = Orchid.Common.Directory.Contents(directory=directory_path, searchString=string, deepSearch=boolean)
backgroundOpen = Orchid.RevitProject.Common.Document.BackgroundOpen(file=contents)
create = Orchid.RevitFamily.FamilyType.Create(familyDocument=backgroundOpen)
await_ = Orchid.Common.DataStream.Await(pass=backgroundOpen, waitFor=create)
inDocument = Orchid.RevitFamily.FamilyType.InDocument(familyDocument=await_)
name = Orchid.RevitFamily.FamilyType.Name(familyType=inDocument)
code_block = CodeBlock()
# ---------- code_block.designscript (4 lines) ----------
//parameter name
"Model";
//value
"Testing";
# ----------------------------------------
inDocument_2 = Orchid.RevitFamily.FamilyType.InDocument()  # frozen
current = Orchid.RevitFamily.FamilyType.Current()  # frozen
code_block_2 = CodeBlock()
# ---------- code_block_2.designscript (4 lines) ----------
//parameter name
["Model", "Description"];
//value
["Testing1", "Testing2"];
# ----------------------------------------
setValue = Orchid.RevitFamily.FamilyParameter.SetValue(familyDocument=await_, familyType=inDocument, parameterName=code_block_2.out0, value=code_block_2.out1)
await_2 = Orchid.Common.DataStream.Await(pass=await_, waitFor=setValue)
getValue = Orchid.RevitFamily.FamilyParameter.GetValue(familyDocument=await_2, familyType=inDocument, parameterName=code_block_2.out0)
watch = Watch(getValue.valueByParameter)
watch_2 = Watch(getValue.valueByType)
name_2 = FamilyParameter.Name(familyParameter=setValue)
await_3 = Orchid.Common.DataStream.Await(pass=await_2, waitFor=getValue.valueByType)
boolean_2 = BoolSelector(true)  # graph input
close = Orchid.RevitProject.Common.Document.Close(document=await_3, save=boolean_2)

# group: Cleanup backup files
await_4 = Orchid.Common.DataStream.Await(pass=directory_path, waitFor=close)
string_2 = StringInput("*.0001.rfa")  # graph input
boolean_3 = BoolSelector(true)  # graph input
contents_2 = Orchid.Common.Directory.Contents(directory=await_4, searchString=string_2, deepSearch=boolean_3)
deleteFile = FileSystem.DeleteFile(path=contents_2)
