# Dynamo graph SharedParameter.dyn (Dynamo 2.16.1.2727)
# packages: Orchid 216.3.0.5794

# group: Add IFC parameters
addIFC = Orchid.RevitFamily.SharedParameter.AddIFC()
name = FamilyParameter.Name(familyParameter=addIFC)
watch = Watch(name)

# group: Add shared parameters by groupName by provided file
string = StringInput("%userprofile%\Programming\Source\OrchidForDynamo\Samples\Data\COBie Extension Shared Parameters.txt")  # graph input
fromPath = Orchid.Common.File.FromPath(path=string)
code_block = CodeBlock()
# ---------- code_block.designscript (14 lines) ----------
//SP Parameter group
["Floor", "Type"];
//GroupType
["Data", "AdskModelProperties"];
//Instance
[true,false];
//Reporting
//NOTE: this list must follow the order
//of true values in the "Instance" list.
//This list does not have to have same
//length as the above three lists!
[true];
//Condense output
false;
# ----------------------------------------
byName = Orchid.AdeskApp.GroupType.ByName(string=code_block.out1)
addByFile = Orchid.RevitFamily.SharedParameter.AddByFile(file=fromPath, groupName=code_block.out0, groupType=byName, instance=code_block.out2)
watch_2 = Watch(addByFile.GroupName)
name_2 = FamilyParameter.Name(familyParameter=addByFile.FamilyParameter)
watch_3 = Watch(name_2)

# group: Add shared parameters by groupName (current loaded)
# note: File: defaultFamily
code_block_2 = CodeBlock()
# ---------- code_block_2.designscript (14 lines) ----------
//SP Parameter group
["Energy", "Dimensions"];
//GroupType
["EnergyAnalysis", "Geometry"];
//Instance
[true, false];
//Reporting
//NOTE: this list must follow the order
//of true values in the "Instance" list.
//This list does not have to have same
//length as the above three lists!
[true];
//Condense output
false;
# ----------------------------------------
byName_2 = Orchid.AdeskApp.GroupType.ByName(string=code_block_2.out1)
addByGroup = Orchid.RevitFamily.SharedParameter.AddByGroup(groupName=code_block_2.out0, groupType=byName_2, instance=code_block_2.out2)
watch_4 = Watch(addByGroup.GroupName)
name_3 = FamilyParameter.Name(familyParameter=addByGroup.FamilyParameter)
watch_5 = Watch(name_3)
