# Dynamo graph Home.dyn (Dynamo 2.16.1.2727)
# packages: Orchid 216.3.0.5792

current = Orchid.RevitProject.Common.Document.Current()
name = Orchid.RevitProject.Common.Document.Name(document=current)
watch = Watch(name)
