# Dynamo graph IFCexportInBackground_R23.dyn (Dynamo 2.16.1.2727)
# packages: Orchid 216.3.0.5794

# group: Open all project files in directory
# note: File: emptyProject
string = StringInput("%userprofile%\Programming\Testing\Data\testSet")  # graph input
string_2 = StringInput("*.rfa")  # graph input
boolean = BoolSelector(false)  # graph input
contents = Orchid.Common.Directory.Contents(directory=string, searchString=string_2, deepSearch=boolean)
backgroundOpen = Orchid.RevitProject.Common.Document.BackgroundOpen(file=contents)
load = Orchid.RevitProject.Elements.Family.Load(familyDocument=backgroundOpen)
await_ = Orchid.Common.DataStream.Await(pass=backgroundOpen, waitFor=load)
close = Orchid.RevitProject.Common.Document.Close(document=await_)

# group: Place families in document
types = Family.Types(family=load)
flatten = List.Flatten(list=types)
count = List.Count(list=flatten)
code_block = CodeBlock(num=count) { (1..num)*2500; }
byCoordinates = Point.ByCoordinates(x=code_block)
levels = Levels("Level 1")  # graph input
byPointAndLevel = FamilyInstance.ByPointAndLevel(familyType=flatten, point=byCoordinates, level=levels)

# group: IFC Export based on prebuild IFC setting and a view
current = Orchid.RevitProject.Common.Document.Current()
await_2 = Orchid.Common.DataStream.Await(pass=current, waitFor=byPointAndLevel)
ifc_setting = Setting("IFC2x3 Coordination View 2.0")  # graph input
settingByName = Orchid.IfcExport.IFC.SettingByName(name=ifc_setting)
views = Views("{3D}")  # graph input
export = Orchid.IfcExport.IFC.Export(document=await_2, setting=settingByName, view=views)
