# Dynamo graph Ifc_R22.dyn (Dynamo 2.12.1.8246)
# packages: Orchid 206.3.1.8224

# group: Select IFC setting
code_block = CodeBlock { "<In-Session Setup>"; "IFC2x3 Coordination View 2.0"; "DanEDU - IFC2x3 Coordination View 2.0"; }
settingByName = Orchid.IfcExport.IFC.SettingByName(name=code_block.out0)

# group: IFC setting --> General
ifc_versions = Version("IFC4 Design Transfer View")  # graph input
ifc_exchange_requirements = ExchangeRequirement("Architectural Reference Exchange")
ifc_file_types = FileType("IFC")  # graph input
ifc_space_boundaries = SpaceBoundary("1st Level")  # graph input
ifc_project_origin = SitePlacement("Internal coordinates")  # graph input
boolean = BoolSelector(true)  # graph input
settingGeneral = Orchid.IfcExport.IFC.SettingGeneral(setting=settingByName, ifcVersion=ifc_versions, exchangeRequirement=ifc_exchange_requirements, ifcFileType=ifc_file_types, spaceBoundary=ifc_space_boundaries, projectOrigin=ifc_project_origin, splitByLevel=boolean)
phases = Phase("New Construction")

# group: IFC setting --> Additional/LOD
boolean_2 = BoolSelector(true)  # graph input
ifc_level_of_detail = LevelOfDetail("Medium")  # graph input
settingAdditional = Orchid.IfcExport.IFC.SettingAdditional(setting=settingGeneral, visibleElements=boolean_2, levelOfDetail=ifc_level_of_detail)

# group: file
directory = Orchid.RevitProject.Common.Document.Directory()
code_block_2 = CodeBlock { 1; }
subPath = Orchid.Common.Directory.SubPath(directory=directory, remove=code_block_2)
string = StringInput("DanEDU IFC export.txt")  # graph input
code_block_3 = CodeBlock(t1=subPath, t2=string) { t1+"\\"+t2; }

# group: IFC setting --> Property
boolean_3 = BoolSelector(true)  # graph input
settingProperty = Orchid.IfcExport.IFC.SettingProperty(setting=settingAdditional, baseQuantities=boolean_3, userProperty=boolean_3, userPropertyFile=code_block_3)

# group: IFC setting --> Advanced
boolean_4 = BoolSelector(true)  # graph input
settingAdvanced = Orchid.IfcExport.IFC.SettingAdvanced(setting=settingProperty, storeGuid=boolean_4)

# group: file
directory_2 = Orchid.RevitProject.Common.Document.Directory()
string_2 = StringInput("test")  # graph input
code_block_4 = CodeBlock(t1=directory_2, t2=string_2) { t1+"\\"+t2; }

# group: IFC Export
views = Views("{3D}")  # graph input
phases_2 = Phase("Existing")
boolean_5 = BoolSelector(true)  # graph input
export = Orchid.IfcExport.IFC.Export(setting=settingAdvanced, view=views, phase=phases_2, file=code_block_4, overwrite=boolean_5)
watch = Watch(export)

# group: IFC setting file format
type = Object.Type(object=settingAdvanced)
watch_2 = Watch(type)
watch_3 = Watch(settingAdvanced)

# group: IFC Export --> Multiple document export
# note: Can't run simultaneously in
# Revit versions below 2021
string_3 = StringInput(".\defaultBuilding.rvt")  # graph input; frozen
backgroundOpen = Orchid.RevitProject.Common.Document.BackgroundOpen(file=string_3)
export_2 = Orchid.IfcExport.IFC.Export(document=backgroundOpen)
await_ = Orchid.Common.DataStream.Await(pass=backgroundOpen, waitFor=export_2)
close = Orchid.RevitProject.Common.Document.Close(document=await_)
watch_4 = Watch(export_2)

# group: IFC Export based on prebuild IFC setting and a view
ifc_setting = Setting("IFC2x3 Coordination View 2.0")  # graph input
settingByName_2 = Orchid.IfcExport.IFC.SettingByName(name=ifc_setting)
views_2 = Views("{3D}")  # graph input
export_3 = Orchid.IfcExport.IFC.Export(setting=settingByName_2, view=views_2)

# group: IFC File Type
ifc_file_types_2 = FileType("IFC")  # graph input
string_4 = StringInput("ifc")  # graph input
fileTypeByName = Orchid.IfcExport.IFC.FileTypeByName(name=string_4)
fileTypes = Orchid.IfcExport.IFC.FileTypes()

# group: IFC Version
ifc_versions_2 = Version("IFC2x3 Coordination View 2.0")  # graph input
string_5 = StringInput("IFC2x3")  # graph input
versionByName = Orchid.IfcExport.IFC.VersionByName(name=string_5)
versions = Orchid.IfcExport.IFC.Versions()

# group: IFC Setting
ifc_settings = Setting("IFC2x3 Coordination View 2.0")  # graph input
string_6 = StringInput("IFC2x3 Coordination View 2.0")  # graph input
settingByName_3 = Orchid.IfcExport.IFC.SettingByName(name=string_6)
settings = Orchid.IfcExport.IFC.Settings()

# group: IFC Setting
string_7 = StringInput("dummy")  # graph input; frozen
createSetting = Orchid.IfcExport.IFC.CreateSetting(name=string_7)
code_block_5 = CodeBlock { "<In-Session Setup>"; "IFC2x3 Coordination View 2.0"; "DanEDU - IFC2x3 Coordination View 2.0"; }
settingByName_4 = Orchid.IfcExport.IFC.SettingByName(name=code_block_5.out1)
duplicateSetting = Orchid.IfcExport.IFC.DuplicateSetting(setting=settingByName_4, name=string_7)
renameSetting = Orchid.IfcExport.IFC.RenameSetting(setting=settingByName_4, name=string_7)
removeSetting = Orchid.IfcExport.IFC.RemoveSetting(name=string_7)
string_8 = StringInput("..\testIFCexport.json")  # graph input; frozen
importSetting = Orchid.IfcExport.IFC.ImportSetting(file=string_8)

watch_5 = Watch(fileTypes)
watch_6 = Watch(versions)
watch_7 = Watch(settings)
