# Dynamo graph Ifc_R23.dyn (Dynamo 2.16.1.2727)
# packages: Orchid 216.3.0.5794

# group: Select IFC setting
code_block = CodeBlock { "<In-Session Setup>"; "IFC2x3 Coordination View 2.0"; "DanEDU - IFC2x3 Coordination View 2.0"; }
settingByName = Orchid.IfcExport.IFC.SettingByName(name=code_block.out0)
ifc_settings = Setting("IFC 2x3 Coordination View 2.0")

# group: IFC setting --> General
# note: File: defaultProject
ifc_versions = Version("IFC4 Design Transfer View")  # graph input
ifc_exchange_requirements = ExchangeRequirement("Architectural Reference Exchange")
ifc_file_types = FileType("IFC")  # graph input
phases = Phase("Existing")
ifc_space_boundaries = SpaceBoundary("1st Level")  # graph input
ifc_project_origin = SitePlacement("Internal coordinates")  # graph input
boolean = BoolSelector(true)  # graph input
settingGeneral = Orchid.IfcExport.IFC.SettingGeneral(setting=settingByName, ifcVersion=ifc_versions, exchangeRequirement=ifc_exchange_requirements, ifcFileType=ifc_file_types, phase=phases, spaceBoundary=ifc_space_boundaries, projectOrigin=ifc_project_origin, splitByLevel=boolean)

# group: IFC setting --> Additional/LOD
boolean_2 = BoolSelector(true)  # graph input
ifc_level_of_detail = LevelOfDetail("Medium")  # graph input
settingAdditional = Orchid.IfcExport.IFC.SettingAdditional(setting=settingGeneral, visibleElements=boolean_2, levelOfDetail=ifc_level_of_detail)

# group: IFC setting --> Property
boolean_3 = BoolSelector(true)  # graph input
string = StringInput("%userprofile%\Programming\Testing\Data\DanEDU IFC export.txt")  # graph input
settingProperty = Orchid.IfcExport.IFC.SettingProperty(setting=settingAdditional, baseQuantities=boolean_3, userProperty=boolean_3, userPropertyFile=string)

# group: IFC setting --> Advanced
boolean_4 = BoolSelector(true)  # graph input
settingAdvanced = Orchid.IfcExport.IFC.SettingAdvanced(setting=settingProperty, storeGuid=boolean_4)

# group: IFC Export
views = Views("{3D}")  # graph input
string_2 = StringInput("%userprofile%\Programming\Testing\Data\2023_Data\Test")  # graph input
boolean_5 = BoolSelector(true)  # graph input
export = Orchid.IfcExport.IFC.Export(setting=settingAdvanced, view=views, file=string_2, overwrite=boolean_5)
watch = Watch(export)

# group: IFC setting file format
type = Object.Type(object=settingAdvanced)
watch_2 = Watch(type)
watch_3 = Watch(settingAdvanced)

# group: file
directory = Orchid.RevitProject.Common.Document.Directory()
string_3 = StringInput("test")  # graph input
code_block_2 = CodeBlock(t1=directory, t2=string_3) { t1+"\\"+t2; }

# group: IFC Export --> Multiple document export
string_4 = StringInput("%userprofile%\Programming\Testing\Data\2023_Data\defaultBuilding.rvt")  # graph input; frozen
backgroundOpen = Orchid.RevitProject.Common.Document.BackgroundOpen(file=string_4)
export_2 = Orchid.IfcExport.IFC.Export(document=backgroundOpen)
await_ = Orchid.Common.DataStream.Await(pass=backgroundOpen, waitFor=export_2)
close = Orchid.RevitProject.Common.Document.Close(document=await_)
watch_4 = Watch(export_2)

# group: IFC Export based on prebuild IFC setting and a view
ifc_setting = Setting("IFC 2x3 Coordination View 2.0")  # graph input
settingByName_2 = Orchid.IfcExport.IFC.SettingByName(name=ifc_setting)
views_2 = Views("{3D}")  # graph input
export_3 = Orchid.IfcExport.IFC.Export(setting=settingByName_2, view=views_2)

# group: IFC File Type
ifc_file_types_2 = FileType("IFC")  # graph input
string_5 = StringInput("ifc")  # graph input
fileTypeByName = Orchid.IfcExport.IFC.FileTypeByName(name=string_5)
fileTypes = Orchid.IfcExport.IFC.FileTypes()

# group: IFC Version
ifc_versions_2 = Version("IFC2x3 Coordination View 2.0")  # graph input
string_6 = StringInput("IFC2x3")  # graph input
versionByName = Orchid.IfcExport.IFC.VersionByName(name=string_6)
versions = Orchid.IfcExport.IFC.Versions()

# group: IFC Setting
ifc_settings_2 = Setting("IFC 2x3 Coordination View 2.0")  # graph input
string_7 = StringInput("IFC2x3 Coordination View 2.0")  # graph input
settingByName_3 = Orchid.IfcExport.IFC.SettingByName(name=string_7)
settings = Orchid.IfcExport.IFC.Settings()

# group: IFC Setting
string_8 = StringInput("dummy")  # graph input; frozen
createSetting = Orchid.IfcExport.IFC.CreateSetting(name=string_8)
code_block_3 = CodeBlock { "<In-Session Setup>"; "IFC2x3 Coordination View 2.0"; "DanEDU - IFC2x3 Coordination View 2.0"; }
settingByName_4 = Orchid.IfcExport.IFC.SettingByName(name=code_block_3.out1)
duplicateSetting = Orchid.IfcExport.IFC.DuplicateSetting(setting=settingByName_4, name=string_8)
renameSetting = Orchid.IfcExport.IFC.RenameSetting(setting=settingByName_4, name=string_8)
removeSetting = Orchid.IfcExport.IFC.RemoveSetting(name=string_8)
string_9 = StringInput("%userprofile%\Programming\Testing\Data\testIFCexport.json")  # graph input; frozen
importSetting = Orchid.IfcExport.IFC.ImportSetting(file=string_9)

watch_5 = Watch(fileTypes)
watch_6 = Watch(versions)
watch_7 = Watch(settings)

# group: file
directory_2 = Orchid.RevitProject.Common.Document.Directory()
code_block_4 = CodeBlock { 1; }
subPath = Orchid.Common.Directory.SubPath(directory=directory_2, remove=code_block_4)
string_10 = StringInput("DanEDU IFC export.txt")  # graph input
code_block_5 = CodeBlock(t1=subPath, t2=string_10) { t1+"\\"+t2; }

# group: Create a new IFC setting
string_11 = StringInput("TestExport")
createSetting_2 = Orchid.IfcExport.IFC.CreateSetting(name=string_11)
