# Dynamo graph Ifc_R24.dyn (Dynamo 2.17.0.3472)
# packages: Orchid 217.0.0.5868

# group: Create a new IFC setting
string = StringInput("TestExport")
createSetting = Orchid.IfcExport.IFC.CreateSetting(name=string)

# group: Select IFC setting
ifc_settings = Setting("IFC 2x3 Coordination View 2.0")
code_block = CodeBlock { "<In-Session Setup>"; "IFC2x3 Coordination View 2.0"; "DanEDU - IFC2x3 Coordination View 2.0"; }
settingByName = Orchid.IfcExport.IFC.SettingByName(name=code_block.out0)

# group: file
directory = Orchid.RevitProject.Common.Document.Directory()
string_2 = StringInput("test")  # graph input
code_block_2 = CodeBlock(t1=directory, t2=string_2) { t1+"\\"+t2; }

# group: IFC Export --> Multiple document export
string_3 = StringInput("%userprofile%\Programming\Testing\Data\2023_Data\defaultBuilding.rvt")  # graph input; frozen
backgroundOpen = Orchid.RevitProject.Common.Document.BackgroundOpen(file=string_3)
export = Orchid.IfcExport.IFC.Export(document=backgroundOpen)
await_ = Orchid.Common.DataStream.Await(pass=backgroundOpen, waitFor=export)
close = Orchid.RevitProject.Common.Document.Close(document=await_)
watch = Watch(export)

# group: IFC File Type
ifc_file_formats = FileFormat("IFC")  # graph input
string_4 = StringInput("ifc")  # graph input
fileFormatByName = Orchid.IfcExport.IFC.FileFormatByName(name=string_4)
fileFormat = Orchid.IfcExport.IFC.FileFormat()

# group: IFC Version
ifc_versions = Version("IFC2x3 Coordination View 2.0")  # graph input
string_5 = StringInput("IFC2x3")  # graph input
versionByName = Orchid.IfcExport.IFC.VersionByName(name=string_5)
version = Orchid.IfcExport.IFC.Version()

# group: IFC Setting
string_6 = StringInput("dummy")  # graph input; frozen
createSetting_2 = Orchid.IfcExport.IFC.CreateSetting(name=string_6)
code_block_3 = CodeBlock { "<In-Session Setup>"; "IFC2x3 Coordination View 2.0"; "DanEDU - IFC2x3 Coordination View 2.0"; }
settingByName_2 = Orchid.IfcExport.IFC.SettingByName(name=code_block_3.out1)
duplicateSetting = Orchid.IfcExport.IFC.DuplicateSetting(setting=settingByName_2, name=string_6)
renameSetting = Orchid.IfcExport.IFC.RenameSetting(setting=settingByName_2, name=string_6)
removeSetting = Orchid.IfcExport.IFC.RemoveSetting(name=string_6)
string_7 = StringInput("%userprofile%\Programming\Testing\Data\testIFCexport.json")  # graph input; frozen
importSetting = Orchid.IfcExport.IFC.ImportSetting(file=string_7)

watch_2 = Watch(fileFormat)
watch_3 = Watch(version)

# group: file
directory_2 = Orchid.RevitProject.Common.Document.Directory()
code_block_4 = CodeBlock { 1; }
subPath = Orchid.Common.Directory.SubPath(directory=directory_2, remove=code_block_4)
string_8 = StringInput("DanEDU IFC export.txt")  # graph input
code_block_5 = CodeBlock(t1=subPath, t2=string_8) { t1+"\\"+t2; }

# group: IFC setting --> General
# note: File: defaultProject
ifc_versions_2 = Version("IFC4 Design Transfer View")  # graph input
ifc_exchange_requirements = ExchangeRequirement("Architectural Reference Exchange")
ifc_file_types = FileFormat("IFC")  # graph input
phases = Phase("Existing")
ifc_space_boundaries = SpaceBoundary("1st Level")  # graph input
ifc_project_origin = SitePlacement("Internal coordinates")  # graph input
boolean = BoolSelector(true)  # graph input
settingGeneral = Orchid.IfcExport.IFC.SettingGeneral(setting=settingByName, ifcVersion=ifc_versions_2, exchangeRequirement=ifc_exchange_requirements, ifcFileFormat=ifc_file_types, phase=phases, spaceBoundary=ifc_space_boundaries, projectLocation=ifc_project_origin, splitByLevel=boolean)

# group: IFC setting --> Additional/LOD
ifc_linkedfile_exportas = LinkedFileExportAs("DontExport")
boolean_2 = BoolSelector(true)  # graph input
ifc_level_of_detail = LevelOfDetail("Medium")  # graph input
settingAdditional = Orchid.IfcExport.IFC.SettingAdditional(setting=settingGeneral, linkedFiles=ifc_linkedfile_exportas, visibleElements=boolean_2, levelOfDetail=ifc_level_of_detail)

# group: IFC setting --> Property
boolean_3 = BoolSelector(true)  # graph input
string_9 = StringInput("%userprofile%\Programming\Testing\Data\DanEDU IFC export.txt")  # graph input
settingProperty = Orchid.IfcExport.IFC.SettingProperty(setting=settingAdditional, baseQuantities=boolean_3, userProperty=boolean_3, userPropertyFile=string_9)

# group: IFC setting --> Advanced
boolean_4 = BoolSelector(true)  # graph input
settingAdvanced = Orchid.IfcExport.IFC.SettingAdvanced(setting=settingProperty, storeGuid=boolean_4)

# group: IFC Export
views = Views("{3D}")  # graph input
string_10 = StringInput("%userprofile%\Programming\Testing\Data\2023_Data\Test")  # graph input
boolean_5 = BoolSelector(true)  # graph input
export_2 = Orchid.IfcExport.IFC.Export(setting=settingAdvanced, view=views, file=string_10, overwrite=boolean_5)
watch_4 = Watch(export_2)

# group: IFC setting file format
type = Object.Type(object=settingAdvanced)
watch_5 = Watch(type)
watch_6 = Watch(settingAdvanced)

# group: IFC Export based on prebuild IFC setting and a view
ifc_setting = Setting("IFC 2x3 Coordination View 2.0")  # graph input
settingByName_3 = Orchid.IfcExport.IFC.SettingByName(name=ifc_setting)
views_2 = Views("{3D}")  # graph input
export_3 = Orchid.IfcExport.IFC.Export(setting=settingByName_3, view=views_2)

# group: IFC Setting
ifc_settings_2 = Setting("IFC 2x3 Coordination View 2.0")  # graph input
string_11 = StringInput("IFC2x3 Coordination View 2.0")  # graph input
settingByName_4 = Orchid.IfcExport.IFC.SettingByName(name=string_11)
settings = Orchid.IfcExport.IFC.Settings()

watch_7 = Watch(settings)
