# Dynamo graph Graphics.dyn (Dynamo 2.16.1.2727)
# packages: Orchid 216.3.0.8444

# group: Create, Set Render Appearance, SetShadingColor, Set Transparency, Set Surface Pattern, Set Surface Pattern Color, Set Cut Pattern, Set Cut Pattern Color
code_block = CodeBlock { "_test3"; }
create = Orchid.RevitMaterial.Material.Create(name=code_block)
code_block_2 = CodeBlock { "Diagonal down 3.0mm"; }
getByName = FillPatternElement.GetByName(name=code_block_2)
setCutBackgroundPattern = Orchid.RevitMaterial.Graphics.SetCutBackgroundPattern(material=create, pattern=getByName)
watch = Watch(setCutBackgroundPattern)
code_block_3 = CodeBlock { 55; 125; 85; }
byARGB = Color.ByARGB(red=code_block_3.out0, green=code_block_3.out1, blue=code_block_3.out2)
setCutBackgroundPatternColor = Orchid.RevitMaterial.Graphics.SetCutBackgroundPatternColor(material=setCutBackgroundPattern, color=byARGB)
getCutBackgroundPatternColor = Orchid.RevitMaterial.Graphics.GetCutBackgroundPatternColor(material=setCutBackgroundPatternColor)
watch_2 = Watch(getCutBackgroundPatternColor)
setSurfaceBackgroundPattern = Orchid.RevitMaterial.Graphics.SetSurfaceBackgroundPattern(material=create, pattern=getByName)
setSurfaceBackgroundPatternColor = Orchid.RevitMaterial.Graphics.SetSurfaceBackgroundPatternColor(material=setSurfaceBackgroundPattern, color=byARGB)
getCutBackgroundPattern = Orchid.RevitMaterial.Graphics.GetCutBackgroundPattern(material=setSurfaceBackgroundPatternColor)
watch_3 = Watch(getCutBackgroundPattern)
watch_4 = Watch(setSurfaceBackgroundPattern)
code_block_4 = CodeBlock { "Diagonal crosshatch 3.0mm"; }
getByName_2 = FillPatternElement.GetByName(name=code_block_4)
setCutForegroundPattern = Orchid.RevitMaterial.Graphics.SetCutForegroundPattern(material=create, pattern=getByName_2)
code_block_5 = CodeBlock { DSCore.Color.ByARGB(255,145,185,165); }
setCutForegroundPatternColor = Orchid.RevitMaterial.Graphics.SetCutForegroundPatternColor(material=setCutForegroundPattern, color=code_block_5)
getCutForegroundPatternColor = Orchid.RevitMaterial.Graphics.GetCutForegroundPatternColor(material=setCutForegroundPatternColor)
watch_5 = Watch(getCutForegroundPatternColor)
setSurfaceForegroundPattern = Orchid.RevitMaterial.Graphics.SetSurfaceForegroundPattern(material=create, pattern=getByName_2)
setSurfaceForegroundPatternColor = Orchid.RevitMaterial.Graphics.SetSurfaceForegroundPatternColor(material=setSurfaceForegroundPattern, color=code_block_5)
getCutForegroundPattern = Orchid.RevitMaterial.Graphics.GetCutForegroundPattern(material=setSurfaceForegroundPatternColor)
watch_6 = Watch(getCutForegroundPattern)
watch_7 = Watch(setCutForegroundPattern)
watch_8 = Watch(setSurfaceForegroundPattern)
code_block_6 = CodeBlock { 75; }
setTransparency = Orchid.RevitMaterial.Graphics.SetTransparency(material=create, transparency=code_block_6)
getTransparency = Orchid.RevitMaterial.Graphics.GetTransparency(material=setTransparency)
watch_9 = Watch(getTransparency)
code_block_7 = CodeBlock { DSCore.Color.ByARGB(255,25,60,30); }
setShadingColor = Orchid.RevitMaterial.Graphics.SetShadingColor(material=create, color=code_block_7)
getShadingColor = Orchid.RevitMaterial.Graphics.GetShadingColor(material=setShadingColor)
watch_10 = Watch(getShadingColor)
boolean = BoolSelector(false)  # graph input
setRenderAppearance = Orchid.RevitMaterial.Graphics.SetRenderAppearance(material=create, useRenderAppearance=boolean)
getRenderAppearance = Orchid.RevitMaterial.Graphics.GetRenderAppearance(material=setRenderAppearance)
watch_11 = Watch(getRenderAppearance)
watch_12 = Watch(create)
name = Material.Name(material=create)
watch_13 = Watch(name)

# group: Create, Get
code_block_8 = CodeBlock { "_test2"; }
create_2 = Orchid.RevitMaterial.Material.Create(name=code_block_8)
boolean_2 = BoolSelector(false)  # graph input
code_block_9 = CodeBlock { DSCore.Color.ByARGB(255,25,60,30); 50; }
code_block_10 = CodeBlock { "Earth"; }
getByName_3 = FillPatternElement.GetByName(name=code_block_10)
code_block_11 = CodeBlock { 45; 85; 65; }
byARGB_2 = Color.ByARGB(red=code_block_11.out0, green=code_block_11.out1, blue=code_block_11.out2)
set = Orchid.RevitMaterial.Graphics.Set(material=create_2, useRenderAppearance=boolean_2, shadingColor=code_block_9.out0, transparency=code_block_9.out1, surfaceForegroundPattern=getByName_3, surfaceForegroundPatternColor=byARGB_2, cutBackgroundPattern=getByName_3, cutBackgroundPatternColor=byARGB_2)
get = Orchid.RevitMaterial.Graphics.Get(material=set)
watch_14 = Watch(get.Transparency)
watch_15 = Watch(get.surfaceForegroundPattern)
watch_16 = Watch(get.surfaceForegroundPatternColor)
watch_17 = Watch(get.surfaceBackgroundPattern)
watch_18 = Watch(get.surfaceBackgroundPatternColor)
watch_19 = Watch(get.cutBackgroundPattern)
watch_20 = Watch(get.cutBackgroundPatternColor)
watch_21 = Watch(get.cutForegroundPatternColor)
watch_22 = Watch(get.cutForegroundPattern)
watch_23 = Watch(get.ShadingColor)
watch_24 = Watch(get.UseRenderAppearance)
watch_25 = Watch(create_2)
name_2 = Material.Name(material=create_2)
watch_26 = Watch(name_2)
fill_patterns = FillPatterns("Earth")  # graph input

# group: Smoothness, Shininess
code_block_12 = CodeBlock { "_test1"; }
create_3 = Orchid.RevitMaterial.Material.Create(name=code_block_12)
code_block_13 = CodeBlock { 50; }
setShininess = Orchid.RevitMaterial.Graphics.SetShininess(material=create_3, shininess=code_block_13)
getShininess = Orchid.RevitMaterial.Graphics.GetShininess(material=setShininess)
watch_27 = Watch(getShininess)
setSmoothness = Orchid.RevitMaterial.Graphics.SetSmoothness(material=create_3, smoothness=code_block_13)
getSmoothness = Orchid.RevitMaterial.Graphics.GetSmoothness(material=setSmoothness)
watch_28 = Watch(getSmoothness)
