# Dynamo graph Graphics_R23.dyn (Dynamo 2.16.1.2727)
# packages: Orchid 216.3.0.5828

# group: Create, Get
# File: defaultProject
code_block = CodeBlock { "_test2"; }
create = Orchid.RevitMaterial.Material.Create(name=code_block)
boolean = BoolSelector(false)  # graph input
code_block_2 = CodeBlock { DSCore.Color.ByARGB(255,25,60,30); 50; }
code_block_3 = CodeBlock { "Earth"; }
getByName = FillPatternElement.GetByName(name=code_block_3)
code_block_4 = CodeBlock { 45; 85; 65; }
byARGB = Color.ByARGB(red=code_block_4.out0, green=code_block_4.out1, blue=code_block_4.out2)
set = Orchid.RevitMaterial.Graphics.Set(material=create, useRenderAppearance=boolean, shadingColor=code_block_2.out0, transparency=code_block_2.out1, surfaceForegroundPattern=getByName, surfaceForegroundPatternColor=byARGB, cutBackgroundPattern=getByName, cutBackgroundPatternColor=byARGB)
get = Orchid.RevitMaterial.Graphics.Get(material=set)
watch = Watch(get.Transparency)
watch_2 = Watch(get.ShadingColor)
watch_3 = Watch(get.UseRenderAppearance)
watch_4 = Watch(create)
name = Material.Name(material=create)
watch_5 = Watch(name)
watch_6 = Watch(get.surfaceForegroundPattern)
watch_7 = Watch(get.cutForegroundPatternColor)
watch_8 = Watch(get.cutForegroundPattern)
watch_9 = Watch(get.surfaceForegroundPatternColor)
watch_10 = Watch(get.surfaceBackgroundPattern)
watch_11 = Watch(get.surfaceBackgroundPatternColor)
watch_12 = Watch(get.cutBackgroundPattern)
watch_13 = Watch(get.cutBackgroundPatternColor)
fill_patterns = FillPatterns("Earth")  # graph input

# group: Smoothness, Shininess
code_block_5 = CodeBlock { "_test1"; }
create_2 = Orchid.RevitMaterial.Material.Create(name=code_block_5)
code_block_6 = CodeBlock { 50; }
setShininess = Orchid.RevitMaterial.Graphics.SetShininess(material=create_2, shininess=code_block_6)
getShininess = Orchid.RevitMaterial.Graphics.GetShininess(material=setShininess)
watch_14 = Watch(getShininess)
setSmoothness = Orchid.RevitMaterial.Graphics.SetSmoothness(material=create_2, smoothness=code_block_6)
getSmoothness = Orchid.RevitMaterial.Graphics.GetSmoothness(material=setSmoothness)
watch_15 = Watch(getSmoothness)

# group: Create, Set Render Appearance, SetShadingColor, Set Transparency, Set Surface Pattern, Set Surface Pattern Color, Set Cut Pattern, Set Cut Pattern Color
code_block_7 = CodeBlock { "_test3"; }
create_3 = Orchid.RevitMaterial.Material.Create(name=code_block_7)
code_block_8 = CodeBlock { "Diagonal down 3.0mm"; }
getByName_2 = FillPatternElement.GetByName(name=code_block_8)
setCutBackgroundPattern = Orchid.RevitMaterial.Graphics.SetCutBackgroundPattern(material=create_3, pattern=getByName_2)
watch_16 = Watch(setCutBackgroundPattern)
code_block_9 = CodeBlock { 55; 125; 85; }
byARGB_2 = Color.ByARGB(red=code_block_9.out0, green=code_block_9.out1, blue=code_block_9.out2)
setCutBackgroundPatternColor = Orchid.RevitMaterial.Graphics.SetCutBackgroundPatternColor(material=setCutBackgroundPattern, color=byARGB_2)
getCutBackgroundPatternColor = Orchid.RevitMaterial.Graphics.GetCutBackgroundPatternColor(material=setCutBackgroundPatternColor)
watch_17 = Watch(getCutBackgroundPatternColor)
setSurfaceBackgroundPattern = Orchid.RevitMaterial.Graphics.SetSurfaceBackgroundPattern(material=create_3, pattern=getByName_2)
setSurfaceBackgroundPatternColor = Orchid.RevitMaterial.Graphics.SetSurfaceBackgroundPatternColor(material=setSurfaceBackgroundPattern, color=byARGB_2)
getCutBackgroundPattern = Orchid.RevitMaterial.Graphics.GetCutBackgroundPattern(material=setSurfaceBackgroundPatternColor)
watch_18 = Watch(getCutBackgroundPattern)
watch_19 = Watch(setSurfaceBackgroundPattern)
code_block_10 = CodeBlock { "Diagonal crosshatch 3.0mm"; }
getByName_3 = FillPatternElement.GetByName(name=code_block_10)
setCutForegroundPattern = Orchid.RevitMaterial.Graphics.SetCutForegroundPattern(material=create_3, pattern=getByName_3)
code_block_11 = CodeBlock { DSCore.Color.ByARGB(255,145,185,165); }
setCutForegroundPatternColor = Orchid.RevitMaterial.Graphics.SetCutForegroundPatternColor(material=setCutForegroundPattern, color=code_block_11)
getCutForegroundPatternColor = Orchid.RevitMaterial.Graphics.GetCutForegroundPatternColor(material=setCutForegroundPatternColor)
watch_20 = Watch(getCutForegroundPatternColor)
setSurfaceForegroundPattern = Orchid.RevitMaterial.Graphics.SetSurfaceForegroundPattern(material=create_3, pattern=getByName_3)
setSurfaceForegroundPatternColor = Orchid.RevitMaterial.Graphics.SetSurfaceForegroundPatternColor(material=setSurfaceForegroundPattern, color=code_block_11)
getCutForegroundPattern = Orchid.RevitMaterial.Graphics.GetCutForegroundPattern(material=setSurfaceForegroundPatternColor)
watch_21 = Watch(getCutForegroundPattern)
watch_22 = Watch(setCutForegroundPattern)
watch_23 = Watch(setSurfaceForegroundPattern)
code_block_12 = CodeBlock { 75; }
setTransparency = Orchid.RevitMaterial.Graphics.SetTransparency(material=create_3, transparency=code_block_12)
getTransparency = Orchid.RevitMaterial.Graphics.GetTransparency(material=setTransparency)
watch_24 = Watch(getTransparency)
code_block_13 = CodeBlock { DSCore.Color.ByARGB(255,25,60,30); }
setShadingColor = Orchid.RevitMaterial.Graphics.SetShadingColor(material=create_3, color=code_block_13)
getShadingColor = Orchid.RevitMaterial.Graphics.GetShadingColor(material=setShadingColor)
watch_25 = Watch(getShadingColor)
boolean_2 = BoolSelector(false)  # graph input
setRenderAppearance = Orchid.RevitMaterial.Graphics.SetRenderAppearance(material=create_3, useRenderAppearance=boolean_2)
getRenderAppearance = Orchid.RevitMaterial.Graphics.GetRenderAppearance(material=setRenderAppearance)
watch_26 = Watch(getRenderAppearance)
watch_27 = Watch(create_3)
name_2 = Material.Name(material=create_3)
watch_28 = Watch(name_2)
