# Dynamo graph Material.dyn (Dynamo 2.16.1.2727)
# packages: Orchid 216.3.0.8444

# group: Select
string = StringInput("Brick, Common")
byName = Material.ByName(name=string)
watch = Watch(byName)
materials = Material("Brick, Common")  # graph input
watch_2 = Watch(materials)

# group: Property parameter
propertyParameter = Orchid.RevitMaterial.Material.PropertyParameter(material=byName)
watch_3 = Watch(propertyParameter.AppearanceParameter)
watch_4 = Watch(propertyParameter.PhysicalParameter)
watch_5 = Watch(propertyParameter.ThermalParameter)
type = Object.Type(object=propertyParameter.PhysicalParameter)

# group: Properties
code_block = CodeBlock(data=byName) { data; }
thermal = Orchid.RevitMaterial.Material.Thermal(material=code_block)
watch_6 = Watch(thermal)
physical = Orchid.RevitMaterial.Material.Physical(material=code_block)
watch_7 = Watch(physical)
appearance = Orchid.RevitMaterial.Material.Appearance(material=code_block)
watch_8 = Watch(appearance)

# group: All
inDocument = Orchid.RevitMaterial.Material.InDocument()
watch_9 = Watch(inDocument)
name = Material.Name(material=inDocument)
watch_10 = Watch(name)

# group: Parameter
parameter = Orchid.RevitMaterial.Material.Parameter(material=byName)
watch_11 = Watch(parameter)
type_2 = Object.Type(object=parameter)

# group: Properties
properties = Orchid.RevitMaterial.Material.Properties(material=byName)
watch_12 = Watch(properties.Thermal)
watch_13 = Watch(properties.Physical)
watch_14 = Watch(properties.Appearance)

# group: Class/Category
getCategory = Orchid.RevitMaterial.Material.GetCategory(material=byName)
watch_15 = Watch(getCategory)
getClass = Orchid.RevitMaterial.Material.GetClass(material=byName)
watch_16 = Watch(getClass)

# group: Set appearance
appearances = Appearance("Dark Gray")
string_2 = StringInput("Default Wall")
byName_2 = Material.ByName(name=string_2)
string_3 = StringInput("Copper - Brushed")
byName_3 = Orchid.RevitMaterial.Appearance.ByName(name=string_3)
setAppearance = Orchid.RevitMaterial.Material.SetAppearance(material=byName_2, appearance=byName_3)

# group: Set property set
string_4 = StringInput("Default Wall")
byName_4 = Material.ByName(name=string_4)
material_aspects = MaterialAspect("Physical (Structural)")
physical_propertyset = PhysicalPropertySet("Brick - Common 1800kg")
setPhysical = Orchid.RevitMaterial.Material.SetPhysical(material=byName_4, aspect=material_aspects, propertySet=physical_propertyset)
material_aspects_2 = MaterialAspect("Thermal")
thermal_propertyset = ThermalPropertySet("Brick - Common")
setThermal = Orchid.RevitMaterial.Material.SetThermal(material=byName_4, aspect=material_aspects_2, propertySet=thermal_propertyset)
