# Dynamo graph Material_R23.dyn (Dynamo 2.16.1.2727)
# packages: Orchid 216.3.0.5828

# group: Select
# File: defaultProject
materials = Material("Brick, Common")  # graph input
watch = Watch(materials)
string = StringInput("Brick, Common")
byName = Material.ByName(name=string)
watch_2 = Watch(byName)

# group: All
inDocument = Orchid.RevitMaterial.Material.InDocument()
watch_3 = Watch(inDocument)
name = Material.Name(material=inDocument)
watch_4 = Watch(name)

# group: Property parameter
propertyParameter = Orchid.RevitMaterial.Material.PropertyParameter(material=byName)
watch_5 = Watch(propertyParameter.AppearanceParameter)
watch_6 = Watch(propertyParameter.ThermalParameter)
type = Object.Type(object=propertyParameter.PhysicalParameter)
watch_7 = Watch(propertyParameter.PhysicalParameter)

# group: Properties
properties = Orchid.RevitMaterial.Material.Properties(material=byName)
watch_8 = Watch(properties.Thermal)
watch_9 = Watch(properties.Physical)
watch_10 = Watch(properties.Appearance)

# group: Class/Category
getCategory = Orchid.RevitMaterial.Material.GetCategory(material=byName)
watch_11 = Watch(getCategory)
getClass = Orchid.RevitMaterial.Material.GetClass(material=byName)
watch_12 = Watch(getClass)

# group: Properties
code_block = CodeBlock(data=byName) { data; }
thermal = Orchid.RevitMaterial.Material.Thermal(material=code_block)
watch_13 = Watch(thermal)
physical = Orchid.RevitMaterial.Material.Physical(material=code_block)
watch_14 = Watch(physical)
appearance = Orchid.RevitMaterial.Material.Appearance(material=code_block)
watch_15 = Watch(appearance)

# group: Parameter
parameter = Orchid.RevitMaterial.Material.Parameter(material=byName)
watch_16 = Watch(parameter)
type_2 = Object.Type(object=parameter)

# group: Set appearance
appearances = Appearance("Dark Gray")
string_2 = StringInput("Default Wall")
byName_2 = Material.ByName(name=string_2)
string_3 = StringInput("Copper - Brushed")
byName_3 = Orchid.RevitMaterial.Appearance.ByName(name=string_3)
setAppearance = Orchid.RevitMaterial.Material.SetAppearance(material=byName_2, appearance=byName_3)

# group: Set property set
string_4 = StringInput("Default Wall")
byName_4 = Material.ByName(name=string_4)
material_aspect = MaterialAspect("Physical (Structural)")
physical_property_sets = PhysicalPropertySet("Brick - Common 1800kg")
setPhysical = Orchid.RevitMaterial.Material.SetPhysical(material=byName_4, aspect=material_aspect, propertySet=physical_property_sets)
material_aspect_2 = MaterialAspect("Thermal")
thermal_property_sets = ThermalPropertySet("Brick - Common")
setThermal = Orchid.RevitMaterial.Material.SetThermal(material=byName_4, aspect=material_aspect_2, propertySet=thermal_property_sets)
