# Dynamo graph Physical-Thermal-Concrete.dyn (Dynamo 2.16.1.2727)
# packages: Orchid 216.3.0.5794

# group: Create material: Concrete (C30)
code_block = CodeBlock { "_Concrete"; }
create = Orchid.RevitMaterial.Material.Create(name=code_block)
material_aspects = MaterialAspect("Thermal")  # graph input
thermal_type = ThermalType("Solid")  # graph input
create_2 = Orchid.RevitMaterial.Thermal.Create(name=code_block, type=thermal_type)
code_block_2 = CodeBlock()
# ---------- code_block_2.designscript (6 lines) ----------
"Concrete f'c=30 MPa";
"structural,concrete,CC:BS 8110";
"thermal,solid";
"Concrete";
"Orchid generated";
"https://github.com/erfajo/OrchidForDynamo";
# ----------------------------------------
setInformation = Orchid.RevitMaterial.Thermal.SetInformation(propertySet=create_2, description=code_block_2.out0, keywords=code_block_2.out2, subclass=code_block_2.out3, source=code_block_2.out4, sourceUrl=code_block_2.out5)
boolean = BoolSelector(false)  # graph input
physical_behavior = PhysicalBehavior("Isotropic")  # graph input
code_block_3 = CodeBlock { 1.046; 0.657; 2300; 0.95; 182.4; 0.01; 0; 2000000; }
setProperties = Orchid.RevitMaterial.Thermal.SetProperties(propertySet=setInformation, transmitsLight=boolean, behavior=physical_behavior, thermalConductivity=code_block_3.out0, specificHeat=code_block_3.out1, density=code_block_3.out2, emissivity=code_block_3.out3, permeability=code_block_3.out4, porosity=code_block_3.out5, reflectivity=code_block_3.out6, electricalResistivity=code_block_3.out7)
setThermal = Orchid.RevitMaterial.Material.SetThermal(material=create, aspect=material_aspects, propertySet=setProperties)
name = Material.Name(material=setThermal)
watch = Watch(name)
watch_2 = Watch(setThermal)
material_aspects_2 = MaterialAspect("Physical (Structural)")  # graph input
physical_types = PhysicalType("Concrete")  # graph input
create_3 = Orchid.RevitMaterial.Physical.Create(name=code_block, type=physical_types)
setInformation_2 = Orchid.RevitMaterial.Physical.SetInformation(propertySet=create_3, description=code_block_2.out0, keywords=code_block_2.out1, subclass=code_block_2.out3, source=code_block_2.out4, sourceUrl=code_block_2.out5)
physical_behavior_2 = PhysicalBehavior("Isotropic")  # graph input
setBehavior = Orchid.RevitMaterial.Physical.SetBehavior(propertySet=setInformation_2, behavior=physical_behavior_2)
code_block_4 = CodeBlock { 0.00001; }
setBasicThermal = Orchid.RevitMaterial.Physical.SetBasicThermal(propertySet=setBehavior, expansionCoefficient=code_block_4)
code_block_5 = CodeBlock { 20500; 0.2; 11200; 2406.45; }
setMechanical = Orchid.RevitMaterial.Physical.SetMechanical(propertySet=setBasicThermal, youngModulus=code_block_5.out0, poissonRatio=code_block_5.out1, shearModulus=code_block_5.out2, density=code_block_5.out3)
code_block_6 = CodeBlock { 30.0; 1.0; }
boolean_2 = BoolSelector(false)  # graph input
setConcrete = Orchid.RevitMaterial.Physical.SetConcrete(propertySet=setMechanical, compression=code_block_6.out0, shearStrengthReduction=code_block_6.out1, lightweight=boolean_2)
setPhysical = Orchid.RevitMaterial.Material.SetPhysical(material=create, aspect=material_aspects_2, propertySet=setConcrete)
name_2 = Material.Name(material=setPhysical)
watch_3 = Watch(name_2)
watch_4 = Watch(setPhysical)
boolean_3 = BoolSelector(true)  # graph input

getInformation = Orchid.RevitMaterial.Thermal.GetInformation(propertySet=setInformation)
watch_5 = Watch(getInformation.SourceUrl)
watch_6 = Watch(getInformation.Source)
watch_7 = Watch(getInformation.Subclass)
watch_8 = Watch(getInformation.Keywords)
watch_9 = Watch(getInformation.Description)
getInformation_2 = Orchid.RevitMaterial.Physical.GetInformation(propertySet=setInformation_2)
watch_10 = Watch(getInformation_2.Keywords)
watch_11 = Watch(getInformation_2.Subclass)
watch_12 = Watch(getInformation_2.Source)
watch_13 = Watch(getInformation_2.SourceUrl)
getYoungModulus = Orchid.RevitMaterial.Physical.GetYoungModulus(propertySet=setMechanical)
watch_14 = Watch(getYoungModulus.YoungModulusX)
watch_15 = Watch(getYoungModulus.YoungModulusY)
watch_16 = Watch(getYoungModulus.YoungModulusZ)
watch_17 = Watch(getYoungModulus.YoungModulus1)
getPoissonRatio = Orchid.RevitMaterial.Physical.GetPoissonRatio(propertySet=setMechanical)
watch_18 = Watch(getPoissonRatio.PoissonRatioX)
watch_19 = Watch(getPoissonRatio.PoissonRatioY)
watch_20 = Watch(getPoissonRatio.PoissonRatioZ)
watch_21 = Watch(getPoissonRatio.PoissonRatio12)
getShearModulus = Orchid.RevitMaterial.Physical.GetShearModulus(propertySet=setMechanical)
watch_22 = Watch(getShearModulus.ShearModulusX)
watch_23 = Watch(getShearModulus.ShearModulusY)
watch_24 = Watch(getShearModulus.ShearModulus)
watch_25 = Watch(getShearModulus.ShearModulusZ)
watch_26 = Watch(getShearModulus.ShearModulus12)
getConcrete = Orchid.RevitMaterial.Physical.GetConcrete(propertySet=setConcrete)
watch_27 = Watch(getConcrete.ShearStrengthReduction)
watch_28 = Watch(getConcrete.Lightweight)
watch_29 = Watch(getConcrete.Compression)
watch_30 = Watch(getYoungModulus.YoungModulus2)
watch_31 = Watch(getPoissonRatio.PoissonRatio23)
getExpansionCoefficient = Orchid.RevitMaterial.Physical.GetExpansionCoefficient(propertySet=setBasicThermal)
watch_32 = Watch(getExpansionCoefficient.ExpansionCoefficientX)
watch_33 = Watch(getExpansionCoefficient.ExpansionCoefficientY)
watch_34 = Watch(getExpansionCoefficient.ExpansionCoefficientZ)
watch_35 = Watch(getExpansionCoefficient.ExpansionCoefficient1)
watch_36 = Watch(getExpansionCoefficient.ExpansionCoefficient2)
getBehavior = Orchid.RevitMaterial.Physical.GetBehavior(propertySet=setBehavior)
watch_37 = Watch(getBehavior)
getProperties = Orchid.RevitMaterial.Thermal.GetProperties(propertySet=setProperties)
watch_38 = Watch(getProperties.ThermalConductivity)
watch_39 = Watch(getProperties.SpecificHeat)
watch_40 = Watch(getProperties.Density)
watch_41 = Watch(getProperties.Behavior)
watch_42 = Watch(getProperties.TransmitsLight)
watch_43 = Watch(getProperties.ElectricalResistivity)
watch_44 = Watch(getProperties.Reflectivity)
watch_45 = Watch(getProperties.Porosity)
watch_46 = Watch(getProperties.Permeability)
watch_47 = Watch(getProperties.Emissivity)
watch_48 = Watch(getInformation_2.Description)
watch_49 = Watch(getPoissonRatio.PoissonRatio)
watch_50 = Watch(getYoungModulus.YoungModulus)
watch_51 = Watch(getExpansionCoefficient.ExpansionCoefficient)
