# Dynamo graph Physical-Thermal-Concrete_R23.dyn (Dynamo 2.16.2.5624)
# packages: Orchid 2.16.4.6166

# group: Create material: Concrete (C30)
# File: defaultProject
boolean = BoolSelector(true)  # graph input
code_block = CodeBlock { "_Concrete"; }
physical_type = PhysicalType("Concrete")  # graph input
create = Orchid.RevitMaterial.Physical.Create(name=code_block, type=physical_type)
code_block_2 = CodeBlock()
# ---------- code_block_2.designscript (6 lines) ----------
"Concrete f'c=30 MPa";
"structural,concrete,CC:BS 8110";
"thermal,solid";
"Concrete";
"Orchid generated";
"https://github.com/erfajo/OrchidForDynamo";
# ----------------------------------------
setInformation = Orchid.RevitMaterial.Physical.SetInformation(propertySet=create, description=code_block_2.out0, keywords=code_block_2.out1, subclass=code_block_2.out3, source=code_block_2.out4, sourceUrl=code_block_2.out5)
physical_behavior = PhysicalBehavior("Isotropic")  # graph input
setBehavior = Orchid.RevitMaterial.Physical.SetBehavior(propertySet=setInformation, behavior=physical_behavior)
thermal_type = ThermalType("Solid")  # graph input
create_2 = Orchid.RevitMaterial.Thermal.Create(name=code_block, type=thermal_type)
setInformation_2 = Orchid.RevitMaterial.Thermal.SetInformation(propertySet=create_2, description=code_block_2.out0, keywords=code_block_2.out2, subclass=code_block_2.out3, source=code_block_2.out4, sourceUrl=code_block_2.out5)
code_block_3 = CodeBlock { 0.00001; }
setBasicThermal = Orchid.RevitMaterial.Physical.SetBasicThermal(propertySet=setBehavior, expansionCoefficient=code_block_3)
code_block_4 = CodeBlock { 20500; 0.2; 11200; 2406.45; }
setMechanical = Orchid.RevitMaterial.Physical.SetMechanical(propertySet=setBasicThermal, youngModulus=code_block_4.out0, poissonRatio=code_block_4.out1, shearModulus=code_block_4.out2, density=code_block_4.out3)
boolean_2 = BoolSelector(false)  # graph input
physical_behavior_2 = PhysicalBehavior("Isotropic")  # graph input
code_block_5 = CodeBlock { 1.046; 0.657; 2300; 0.95; 182.4; 0.01; 0; 2000000; }
setProperties = Orchid.RevitMaterial.Thermal.SetProperties(propertySet=setInformation_2, transmitsLight=boolean_2, behavior=physical_behavior_2, thermalConductivity=code_block_5.out0, specificHeat=code_block_5.out1, density=code_block_5.out2, emissivity=code_block_5.out3, permeability=code_block_5.out4, porosity=code_block_5.out5, reflectivity=code_block_5.out6, electricalResistivity=code_block_5.out7)
create_3 = Orchid.RevitMaterial.Material.Create(name=code_block)
material_aspect = MaterialAspect("Thermal")  # graph input
setThermal = Orchid.RevitMaterial.Material.SetThermal(material=create_3, aspect=material_aspect, propertySet=setProperties)
name = Material.Name(material=setThermal)
watch = Watch(name)
watch_2 = Watch(setThermal)
material_aspect_2 = MaterialAspect("Physical (Structural)")  # graph input
code_block_6 = CodeBlock { 30.0; 1.0; }
boolean_3 = BoolSelector(false)  # graph input
setConcrete = Orchid.RevitMaterial.Physical.SetConcrete(propertySet=setMechanical, compression=code_block_6.out0, shearStrengthReduction=code_block_6.out1, lightweight=boolean_3)
setPhysical = Orchid.RevitMaterial.Material.SetPhysical(material=create_3, aspect=material_aspect_2, propertySet=setConcrete)
name_2 = Material.Name(material=setPhysical)
watch_3 = Watch(name_2)
watch_4 = Watch(setPhysical)
name_3 = Element.Name(element=setProperties)  # frozen
byName = Orchid.RevitMaterial.Thermal.ByName(name=name_3)
watch_5 = Watch(byName)
name_4 = Element.Name(element=setConcrete)  # frozen
byName_2 = Orchid.RevitMaterial.Physical.ByName(name=name_4)
watch_6 = Watch(byName_2)
watch_7 = Watch(name_3)
watch_8 = Watch(name_4)

getInformation = Orchid.RevitMaterial.Physical.GetInformation(propertySet=setInformation)
watch_9 = Watch(getInformation.Keywords)
watch_10 = Watch(getInformation.Subclass)
watch_11 = Watch(getInformation.Source)
watch_12 = Watch(getInformation.SourceUrl)
getBehavior = Orchid.RevitMaterial.Physical.GetBehavior(propertySet=setBehavior)
watch_13 = Watch(getBehavior)
watch_14 = Watch(getInformation.Description)
getInformation_2 = Orchid.RevitMaterial.Thermal.GetInformation(propertySet=setInformation_2)
watch_15 = Watch(getInformation_2.SourceUrl)
watch_16 = Watch(getInformation_2.Source)
watch_17 = Watch(getInformation_2.Subclass)
watch_18 = Watch(getInformation_2.Keywords)
watch_19 = Watch(getInformation_2.Description)
getYoungModulus = Orchid.RevitMaterial.Physical.GetYoungModulus(propertySet=setMechanical)
watch_20 = Watch(getYoungModulus.YoungModulusX)
watch_21 = Watch(getYoungModulus.YoungModulusY)
watch_22 = Watch(getYoungModulus.YoungModulusZ)
watch_23 = Watch(getYoungModulus.YoungModulus1)
watch_24 = Watch(getYoungModulus.YoungModulus2)
getExpansionCoefficient = Orchid.RevitMaterial.Physical.GetExpansionCoefficient(propertySet=setBasicThermal)
watch_25 = Watch(getExpansionCoefficient.ExpansionCoefficientX)
watch_26 = Watch(getExpansionCoefficient.ExpansionCoefficientY)
watch_27 = Watch(getExpansionCoefficient.ExpansionCoefficientZ)
watch_28 = Watch(getExpansionCoefficient.ExpansionCoefficient1)
watch_29 = Watch(getExpansionCoefficient.ExpansionCoefficient2)
watch_30 = Watch(getYoungModulus.YoungModulus)
watch_31 = Watch(getExpansionCoefficient.ExpansionCoefficient)
getProperties = Orchid.RevitMaterial.Thermal.GetProperties(propertySet=setProperties)
watch_32 = Watch(getProperties.ThermalConductivity)
watch_33 = Watch(getProperties.SpecificHeat)
watch_34 = Watch(getProperties.Density)
watch_35 = Watch(getProperties.Behavior)
watch_36 = Watch(getProperties.TransmitsLight)
getPoissonRatio = Orchid.RevitMaterial.Physical.GetPoissonRatio(propertySet=setMechanical)
watch_37 = Watch(getPoissonRatio.PoissonRatioX)
watch_38 = Watch(getPoissonRatio.PoissonRatioY)
watch_39 = Watch(getPoissonRatio.PoissonRatioZ)
watch_40 = Watch(getPoissonRatio.PoissonRatio12)
watch_41 = Watch(getPoissonRatio.PoissonRatio23)
watch_42 = Watch(getProperties.ElectricalResistivity)
watch_43 = Watch(getProperties.Reflectivity)
watch_44 = Watch(getProperties.Porosity)
watch_45 = Watch(getProperties.Permeability)
watch_46 = Watch(getProperties.Emissivity)
watch_47 = Watch(getPoissonRatio.PoissonRatio)
getShearModulus = Orchid.RevitMaterial.Physical.GetShearModulus(propertySet=setMechanical)
watch_48 = Watch(getShearModulus.ShearModulusX)
watch_49 = Watch(getShearModulus.ShearModulusY)
watch_50 = Watch(getShearModulus.ShearModulus)
watch_51 = Watch(getShearModulus.ShearModulusZ)
watch_52 = Watch(getShearModulus.ShearModulus12)
getConcrete = Orchid.RevitMaterial.Physical.GetConcrete(propertySet=setConcrete)
watch_53 = Watch(getConcrete.ShearStrengthReduction)
watch_54 = Watch(getConcrete.Lightweight)
watch_55 = Watch(getConcrete.Compression)
getDensity = Orchid.RevitMaterial.Physical.GetDensity(propertySet=setMechanical)
watch_56 = Watch(getDensity)
