# Dynamo graph Physical-Thermal-Gas.dyn (Dynamo 2.16.1.2727)
# packages: Orchid 216.3.0.5794

# group: Create material: Oxygen
code_block = CodeBlock { "_Oxygen"; }
thermal_type = ThermalType("Gas")  # graph input
create = Orchid.RevitMaterial.Thermal.Create(name=code_block, type=thermal_type)
code_block_2 = CodeBlock()
# ---------- code_block_2.designscript (6 lines) ----------
"Oxygen, properties at atmospheric pressure";
"structural,gas";
"thermal,gas";
"Gas";
"Orchid generated";
"https://github.com/erfajo/OrchidForDynamo";
# ----------------------------------------
setInformation = Orchid.RevitMaterial.Thermal.SetInformation(propertySet=create, description=code_block_2.out0, keywords=code_block_2.out2, subclass=code_block_2.out3, source=code_block_2.out4, sourceUrl=code_block_2.out5)
code_block_3 = CodeBlock { 0.0242; 0.9118; 1.35; 0.01; 0; 1; }
setBasicThermal = Orchid.RevitMaterial.Thermal.SetBasicThermal(propertySet=setInformation, thermalConductivity=code_block_3.out0, specificHeat=code_block_3.out1, density=code_block_3.out2, emissivity=code_block_3.out3, gasViscosity=code_block_3.out4, compressibility=code_block_3.out5)
create_2 = Orchid.RevitMaterial.Material.Create(name=code_block)
material_aspects = MaterialAspect("Thermal")  # graph input
setThermal = Orchid.RevitMaterial.Material.SetThermal(material=create_2, aspect=material_aspects, propertySet=setBasicThermal)
watch = Watch(setThermal)
name = Material.Name(material=setThermal)
watch_2 = Watch(name)
boolean = BoolSelector(true)  # graph input
material_aspects_2 = MaterialAspect("Physical (Structural)")  # graph input
physical_types = PhysicalType("Gas")  # graph input
create_3 = Orchid.RevitMaterial.Physical.Create(name=code_block, type=physical_types)
setInformation_2 = Orchid.RevitMaterial.Physical.SetInformation(propertySet=create_3, description=code_block_2.out0, keywords=code_block_2.out1, subclass=code_block_2.out3, source=code_block_2.out4, sourceUrl=code_block_2.out5)
code_block_4 = CodeBlock { 500; }
setBasicThermal_2 = Orchid.RevitMaterial.Physical.SetBasicThermal(propertySet=setInformation_2, expansionCoefficient=code_block_4)
code_block_5 = CodeBlock { 1.35; }
setMechanical = Orchid.RevitMaterial.Physical.SetMechanical(propertySet=setBasicThermal_2, density=code_block_5)
setPhysical = Orchid.RevitMaterial.Material.SetPhysical(material=create_2, aspect=material_aspects_2, propertySet=setMechanical)
watch_3 = Watch(setPhysical)
name_2 = Material.Name(material=setPhysical)
watch_4 = Watch(name_2)

getInformation = Orchid.RevitMaterial.Thermal.GetInformation(propertySet=setInformation)
watch_5 = Watch(getInformation.Subclass)
watch_6 = Watch(getInformation.Keywords)
watch_7 = Watch(getInformation.Description)
watch_8 = Watch(getInformation.Source)
watch_9 = Watch(getInformation.SourceUrl)
getBasicThermal = Orchid.RevitMaterial.Thermal.GetBasicThermal(propertySet=setBasicThermal)
watch_10 = Watch(getBasicThermal.Density)
watch_11 = Watch(getBasicThermal.Emissivity)
watch_12 = Watch(getBasicThermal.GasViscosity)
watch_13 = Watch(getBasicThermal.SpecificHeat)
watch_14 = Watch(getBasicThermal.ThermalConductivity)
watch_15 = Watch(getBasicThermal.Compressibility)
getExpansionCoefficient = Orchid.RevitMaterial.Physical.GetExpansionCoefficient(propertySet=setBasicThermal_2)
watch_16 = Watch(getExpansionCoefficient.ExpansionCoefficient2)
getDensity = Orchid.RevitMaterial.Physical.GetDensity(propertySet=setMechanical)
watch_17 = Watch(getDensity)
watch_18 = Watch(getExpansionCoefficient.ExpansionCoefficient1)
watch_19 = Watch(getExpansionCoefficient.ExpansionCoefficientZ)
getInformation_2 = Orchid.RevitMaterial.Physical.GetInformation(propertySet=setInformation_2)
watch_20 = Watch(getInformation_2.SourceUrl)
watch_21 = Watch(getInformation_2.Source)
watch_22 = Watch(getExpansionCoefficient.ExpansionCoefficientY)
watch_23 = Watch(getInformation_2.Subclass)
watch_24 = Watch(getExpansionCoefficient.ExpansionCoefficientX)
watch_25 = Watch(getInformation_2.Keywords)
watch_26 = Watch(getExpansionCoefficient.ExpansionCoefficient)
watch_27 = Watch(getInformation_2.Description)
