# Dynamo graph Physical-Thermal-Gas_R23.dyn (Dynamo 2.16.1.2727)
# packages: Orchid 216.3.0.5828

# group: Create material: Oxygen
# File: defaultProject
boolean = BoolSelector(true)  # graph input
code_block = CodeBlock { "_Oxygen"; }
physical_type = PhysicalType("Gas")  # graph input
create = Orchid.RevitMaterial.Physical.Create(name=code_block, type=physical_type)
code_block_2 = CodeBlock()
# ---------- code_block_2.designscript (6 lines) ----------
"Oxygen, properties at atmospheric pressure";
"structural,gas";
"thermal,gas";
"Gas";
"Orchid generated";
"https://github.com/erfajo/OrchidForDynamo";
# ----------------------------------------
setInformation = Orchid.RevitMaterial.Physical.SetInformation(propertySet=create, description=code_block_2.out0, keywords=code_block_2.out1, subclass=code_block_2.out3, source=code_block_2.out4, sourceUrl=code_block_2.out5)
code_block_3 = CodeBlock { 500; }
setBasicThermal = Orchid.RevitMaterial.Physical.SetBasicThermal(propertySet=setInformation, expansionCoefficient=code_block_3)
code_block_4 = CodeBlock { 1.35; }
setMechanical = Orchid.RevitMaterial.Physical.SetMechanical(propertySet=setBasicThermal, density=code_block_4)
thermal_type = ThermalType("Gas")  # graph input
create_2 = Orchid.RevitMaterial.Thermal.Create(name=code_block, type=thermal_type)
setInformation_2 = Orchid.RevitMaterial.Thermal.SetInformation(propertySet=create_2, description=code_block_2.out0, keywords=code_block_2.out2, subclass=code_block_2.out3, source=code_block_2.out4, sourceUrl=code_block_2.out5)
code_block_5 = CodeBlock { 0.0242; 0.9118; 1.35; 0.01; 0; 1; }
setBasicThermal_2 = Orchid.RevitMaterial.Thermal.SetBasicThermal(propertySet=setInformation_2, thermalConductivity=code_block_5.out0, specificHeat=code_block_5.out1, density=code_block_5.out2, emissivity=code_block_5.out3, gasViscosity=code_block_5.out4, compressibility=code_block_5.out5)
create_3 = Orchid.RevitMaterial.Material.Create(name=code_block)
material_aspect = MaterialAspect("Thermal")  # graph input
setThermal = Orchid.RevitMaterial.Material.SetThermal(material=create_3, aspect=material_aspect, propertySet=setBasicThermal_2)
watch = Watch(setThermal)
name = Material.Name(material=setThermal)
watch_2 = Watch(name)
material_aspect_2 = MaterialAspect("Physical (Structural)")  # graph input
setPhysical = Orchid.RevitMaterial.Material.SetPhysical(material=create_3, aspect=material_aspect_2, propertySet=setMechanical)
watch_3 = Watch(setPhysical)
name_2 = Material.Name(material=setPhysical)
watch_4 = Watch(name_2)

getInformation = Orchid.RevitMaterial.Physical.GetInformation(propertySet=setInformation)
watch_5 = Watch(getInformation.SourceUrl)
watch_6 = Watch(getInformation.Source)
watch_7 = Watch(getInformation.Subclass)
watch_8 = Watch(getInformation.Keywords)
watch_9 = Watch(getInformation.Description)
getDensity = Orchid.RevitMaterial.Physical.GetDensity(propertySet=setMechanical)
watch_10 = Watch(getDensity)
getInformation_2 = Orchid.RevitMaterial.Thermal.GetInformation(propertySet=setInformation_2)
watch_11 = Watch(getInformation_2.Subclass)
watch_12 = Watch(getInformation_2.Keywords)
watch_13 = Watch(getInformation_2.Description)
watch_14 = Watch(getInformation_2.Source)
watch_15 = Watch(getInformation_2.SourceUrl)
getBasicThermal = Orchid.RevitMaterial.Thermal.GetBasicThermal(propertySet=setBasicThermal_2)
watch_16 = Watch(getBasicThermal.Density)
watch_17 = Watch(getBasicThermal.Emissivity)
watch_18 = Watch(getBasicThermal.GasViscosity)
watch_19 = Watch(getBasicThermal.SpecificHeat)
watch_20 = Watch(getBasicThermal.ThermalConductivity)
getExpansionCoefficient = Orchid.RevitMaterial.Physical.GetExpansionCoefficient(propertySet=setBasicThermal)
watch_21 = Watch(getExpansionCoefficient.ExpansionCoefficient2)
watch_22 = Watch(getExpansionCoefficient.ExpansionCoefficient1)
watch_23 = Watch(getExpansionCoefficient.ExpansionCoefficientZ)
watch_24 = Watch(getExpansionCoefficient.ExpansionCoefficientY)
watch_25 = Watch(getExpansionCoefficient.ExpansionCoefficientX)
watch_26 = Watch(getExpansionCoefficient.ExpansionCoefficient)
watch_27 = Watch(getBasicThermal.Compressibility)
