# Dynamo graph Physical-Thermal-Generic.dyn (Dynamo 2.16.1.2727)
# packages: Orchid 216.3.0.8444

# group: Create material: Timber (C24)
code_block = CodeBlock { "_Timber C24"; }
create = Orchid.RevitMaterial.Material.Create(name=code_block)
material_aspects = MaterialAspect("Thermal")  # graph input
thermal_type = ThermalType("Solid")  # graph input
create_2 = Orchid.RevitMaterial.Thermal.Create(name=code_block, type=thermal_type)
code_block_2 = CodeBlock()
# ---------- code_block_2.designscript (6 lines) ----------
"Strength Class C24 Timber";
"Eurocode,Structural,structural,wood,CC:EN 338";
"Wood,thermal,solid";
"Wood";
"Orchid generated";
"https://github.com/erfajo/OrchidForDynamo";
# ----------------------------------------
setInformation = Orchid.RevitMaterial.Thermal.SetInformation(propertySet=create_2, description=code_block_2.out0, keywords=code_block_2.out2, subclass=code_block_2.out3, source=code_block_2.out4, sourceUrl=code_block_2.out5)
boolean = BoolSelector(false)  # graph input
physical_behavior = PhysicalBehavior("Orthotropic")  # graph input
code_block_3 = CodeBlock { 0.12; 0.19; 496; 0.85; 0; 0.01; 0; 10000000; }
setProperties = Orchid.RevitMaterial.Thermal.SetProperties(propertySet=setInformation, transmitsLight=boolean, behavior=physical_behavior, thermalConductivity=code_block_3.out0, specificHeat=code_block_3.out1, density=code_block_3.out2, emissivity=code_block_3.out3, permeability=code_block_3.out4, porosity=code_block_3.out5, reflectivity=code_block_3.out6, electricalResistivity=code_block_3.out7)
setThermal = Orchid.RevitMaterial.Material.SetThermal(material=create, aspect=material_aspects, propertySet=setProperties)
watch = Watch(setThermal)
name = Material.Name(material=setThermal)
watch_2 = Watch(name)
material_aspects_2 = MaterialAspect("Physical (Structural)")  # graph input
physical_types = PhysicalType("Wood")  # graph input
create_3 = Orchid.RevitMaterial.Physical.Create(name=code_block, type=physical_types)
setInformation_2 = Orchid.RevitMaterial.Physical.SetInformation(propertySet=create_3, description=code_block_2.out0, keywords=code_block_2.out1, subclass=code_block_2.out3, source=code_block_2.out4, sourceUrl=code_block_2.out5)
physical_behavior_2 = PhysicalBehavior("Orthotropic")  # graph input
setBehavior = Orchid.RevitMaterial.Physical.SetBehavior(propertySet=setInformation_2, behavior=physical_behavior_2)
code_block_4 = CodeBlock { 0.00004; }
setBasicThermal = Orchid.RevitMaterial.Physical.SetBasicThermal(propertySet=setBehavior, expansionCoefficient=code_block_4)
code_block_5 = CodeBlock { 11000; 0.38; 690; 420; }
setMechanical = Orchid.RevitMaterial.Physical.SetMechanical(propertySet=setBasicThermal, youngModulus=code_block_5.out0, poissonRatio=code_block_5.out1, shearModulus=code_block_5.out2, density=code_block_5.out3)
code_block_6 = CodeBlock { "Multiple"; "C24"; 24; 21; 2.5; 4; 14; 0.5; 11000; }
wood_construction = WoodConstruction("Natural")  # graph input
setStrengthExtended = Orchid.RevitMaterial.Physical.SetStrengthExtended(propertySet=setMechanical, species=code_block_6.out0, grade=code_block_6.out1, bending=code_block_6.out2, parallelCompression=code_block_6.out3, perpendicularCompression=code_block_6.out4, parallelShear=code_block_6.out5, tensionParallel=code_block_6.out6, tensionPerpendicular=code_block_6.out7, averageModulus=code_block_6.out8, construction=wood_construction)
setPhysical = Orchid.RevitMaterial.Material.SetPhysical(material=create, aspect=material_aspects_2, propertySet=setStrengthExtended)
watch_3 = Watch(setPhysical)
name_2 = Material.Name(material=setPhysical)
watch_4 = Watch(name_2)
boolean_2 = BoolSelector(true)  # graph input

# group: Duplicate --> Thermal Asset
thermal_propertyset = ThermalPropertySet("Brick - Common")  # graph input
code_block_7 = CodeBlock { "_xx (thermal)"; }
duplicate = Orchid.RevitMaterial.Thermal.Duplicate(propertySet=thermal_propertyset, name=code_block_7)
watch_5 = Watch(duplicate)

# group: Duplicate --> Physical Asset
physical_propertyset = PhysicalPropertySet("Brick - Common 1800kg")  # graph input
code_block_8 = CodeBlock { "_xx (physical)"; }
duplicate_2 = Orchid.RevitMaterial.Physical.Duplicate(propertySet=physical_propertyset, name=code_block_8)
watch_6 = Watch(duplicate_2)

# group: All --> Physical Asset
inDocument = Orchid.RevitMaterial.Physical.InDocument()
watch_7 = Watch(inDocument)
name_3 = Element.Name(element=inDocument)
watch_8 = Watch(name_3)

# group: All --> Thermal Asset
inDocument_2 = Orchid.RevitMaterial.Thermal.InDocument()
watch_9 = Watch(inDocument_2)
name_4 = Element.Name(element=inDocument_2)
watch_10 = Watch(name_4)
