# Dynamo graph Physical-Thermal-Steel.dyn (Dynamo 2.16.1.2727)
# packages: Orchid 216.3.0.8444

# group: Create material: Steel (S275)
code_block = CodeBlock { "_Steel S275"; }
physical_types = PhysicalType("Metal")  # graph input
create = Orchid.RevitMaterial.Physical.Create(name=code_block, type=physical_types)
code_block_2 = CodeBlock()
# ---------- code_block_2.designscript (6 lines) ----------
"Steel, S275 (EN 10025-2)";
"1.0044,structural,metal,CC:EN 10025";
"thermal,solid";
"Steel";
"Orchid generated";
"https://github.com/erfajo/OrchidForDynamo";
# ----------------------------------------
setInformation = Orchid.RevitMaterial.Physical.SetInformation(propertySet=create, description=code_block_2.out0, keywords=code_block_2.out1, subclass=code_block_2.out3, source=code_block_2.out4, sourceUrl=code_block_2.out5)
physical_behavior = PhysicalBehavior("Isotropic")  # graph input
setBehavior = Orchid.RevitMaterial.Physical.SetBehavior(propertySet=setInformation, behavior=physical_behavior)
code_block_3 = CodeBlock { 0.00001; }
setBasicThermal = Orchid.RevitMaterial.Physical.SetBasicThermal(propertySet=setBehavior, expansionCoefficient=code_block_3)
code_block_4 = CodeBlock { 205000; 0.3; 80000; 7850; }
setMechanical = Orchid.RevitMaterial.Physical.SetMechanical(propertySet=setBasicThermal, youngModulus=code_block_4.out0, poissonRatio=code_block_4.out1, shearModulus=code_block_4.out2, density=code_block_4.out3)
code_block_5 = CodeBlock { 275; 430; }
boolean = BoolSelector(false)  # graph input
setStrength = Orchid.RevitMaterial.Physical.SetStrength(propertySet=setMechanical, yieldStress=code_block_5.out0, tensileStrength=code_block_5.out1, thermalTreated=boolean)
thermal_type = ThermalType("Solid")  # graph input
create_2 = Orchid.RevitMaterial.Thermal.Create(name=code_block, type=thermal_type)
setInformation_2 = Orchid.RevitMaterial.Thermal.SetInformation(propertySet=create_2, description=code_block_2.out0, keywords=code_block_2.out2, subclass=code_block_2.out3, source=code_block_2.out4, sourceUrl=code_block_2.out5)
boolean_2 = BoolSelector(false)  # graph input
physical_behavior_2 = PhysicalBehavior("Isotropic")  # graph input
code_block_6 = CodeBlock { 45; 0.48; 7850; 0.4; 0; 0.01; 0; 0; }
setProperties = Orchid.RevitMaterial.Thermal.SetProperties(propertySet=setInformation_2, transmitsLight=boolean_2, behavior=physical_behavior_2, thermalConductivity=code_block_6.out0, specificHeat=code_block_6.out1, density=code_block_6.out2, emissivity=code_block_6.out3, permeability=code_block_6.out4, porosity=code_block_6.out5, reflectivity=code_block_6.out6, electricalResistivity=code_block_6.out7)
create_3 = Orchid.RevitMaterial.Material.Create(name=code_block)
material_aspects = MaterialAspect("Thermal")  # graph input
setThermal = Orchid.RevitMaterial.Material.SetThermal(material=create_3, aspect=material_aspects, propertySet=setProperties)
watch = Watch(setThermal)
name = Material.Name(material=setThermal)
watch_2 = Watch(name)
material_aspects_2 = MaterialAspect("Physical (Structural)")  # graph input
setPhysical = Orchid.RevitMaterial.Material.SetPhysical(material=create_3, aspect=material_aspects_2, propertySet=setStrength)
watch_3 = Watch(setPhysical)
name_2 = Material.Name(material=setPhysical)
watch_4 = Watch(name_2)
boolean_3 = BoolSelector(true)  # graph input

getStrength = Orchid.RevitMaterial.Physical.GetStrength(propertySet=setStrength)
watch_5 = Watch(getStrength.ThermalTreated)
watch_6 = Watch(getStrength.TensileStrength)
watch_7 = Watch(getStrength.YieldStress)
getInformation = Orchid.RevitMaterial.Thermal.GetInformation(propertySet=setInformation_2)
watch_8 = Watch(getInformation.SourceUrl)
watch_9 = Watch(getInformation.Source)
watch_10 = Watch(getInformation.Subclass)
watch_11 = Watch(getInformation.Keywords)
watch_12 = Watch(getInformation.Description)
getProperties = Orchid.RevitMaterial.Thermal.GetProperties(propertySet=setProperties)
watch_13 = Watch(getProperties.ThermalConductivity)
watch_14 = Watch(getProperties.SpecificHeat)
watch_15 = Watch(getProperties.Density)
watch_16 = Watch(getProperties.Behavior)
watch_17 = Watch(getProperties.TransmitsLight)
watch_18 = Watch(getProperties.ElectricalResistivity)
watch_19 = Watch(getProperties.Reflectivity)
watch_20 = Watch(getProperties.Porosity)
watch_21 = Watch(getProperties.Permeability)
watch_22 = Watch(getProperties.Emissivity)
getShearModulus = Orchid.RevitMaterial.Physical.GetShearModulus(propertySet=setMechanical)
watch_23 = Watch(getShearModulus.ShearModulusX)
watch_24 = Watch(getShearModulus.ShearModulusY)
watch_25 = Watch(getShearModulus.ShearModulus)
getPoissonRatio = Orchid.RevitMaterial.Physical.GetPoissonRatio(propertySet=setMechanical)
watch_26 = Watch(getPoissonRatio.PoissonRatioX)
watch_27 = Watch(getPoissonRatio.PoissonRatioY)
watch_28 = Watch(getShearModulus.ShearModulusZ)
watch_29 = Watch(getShearModulus.ShearModulus12)
watch_30 = Watch(getPoissonRatio.PoissonRatioZ)
watch_31 = Watch(getPoissonRatio.PoissonRatio12)
getYoungModulus = Orchid.RevitMaterial.Physical.GetYoungModulus(propertySet=setMechanical)
watch_32 = Watch(getYoungModulus.YoungModulusY)
watch_33 = Watch(getYoungModulus.YoungModulusZ)
watch_34 = Watch(getYoungModulus.YoungModulus1)
watch_35 = Watch(getYoungModulus.YoungModulusX)
watch_36 = Watch(getPoissonRatio.PoissonRatio23)
watch_37 = Watch(getYoungModulus.YoungModulus2)
getExpansionCoefficient = Orchid.RevitMaterial.Physical.GetExpansionCoefficient(propertySet=setBasicThermal)
watch_38 = Watch(getExpansionCoefficient.ExpansionCoefficientX)
watch_39 = Watch(getExpansionCoefficient.ExpansionCoefficientY)
watch_40 = Watch(getExpansionCoefficient.ExpansionCoefficientZ)
watch_41 = Watch(getExpansionCoefficient.ExpansionCoefficient1)
watch_42 = Watch(getExpansionCoefficient.ExpansionCoefficient2)
getInformation_2 = Orchid.RevitMaterial.Physical.GetInformation(propertySet=setInformation)
watch_43 = Watch(getInformation_2.Subclass)
watch_44 = Watch(getInformation_2.Source)
watch_45 = Watch(getInformation_2.SourceUrl)
getBehavior = Orchid.RevitMaterial.Physical.GetBehavior(propertySet=setInformation)
watch_46 = Watch(getBehavior)
watch_47 = Watch(getInformation_2.Keywords)
watch_48 = Watch(getPoissonRatio.PoissonRatio)
watch_49 = Watch(getYoungModulus.YoungModulus)
watch_50 = Watch(getExpansionCoefficient.ExpansionCoefficient)
watch_51 = Watch(getInformation_2.Description)
