# Dynamo graph Physical-Thermal-Steel_R23.dyn (Dynamo 2.16.2.5624)
# packages: Orchid 2.16.4.6166

# group: Create material: Steel (S275)
# File: defaultProject
code_block = CodeBlock { "_Steel S275"; }
physical_type = PhysicalType("Metal")  # graph input
create = Orchid.RevitMaterial.Physical.Create(name=code_block, type=physical_type)
code_block_2 = CodeBlock()
# ---------- code_block_2.designscript (6 lines) ----------
"Steel, S275 (EN 10025-2)";
"1.0044,structural,metal,CC:EN 10025";
"thermal,solid";
"Steel";
"Orchid generated";
"https://github.com/erfajo/OrchidForDynamo";
# ----------------------------------------
setInformation = Orchid.RevitMaterial.Physical.SetInformation(propertySet=create, description=code_block_2.out0, keywords=code_block_2.out1, subclass=code_block_2.out3, source=code_block_2.out4, sourceUrl=code_block_2.out5)
boolean = BoolSelector(true)  # graph input
thermal_type = ThermalType("Solid")  # graph input
create_2 = Orchid.RevitMaterial.Thermal.Create(name=code_block, type=thermal_type)
setInformation_2 = Orchid.RevitMaterial.Thermal.SetInformation(propertySet=create_2, description=code_block_2.out0, keywords=code_block_2.out2, subclass=code_block_2.out3, source=code_block_2.out4, sourceUrl=code_block_2.out5)
physical_behavior = PhysicalBehavior("Isotropic")  # graph input
setBehavior = Orchid.RevitMaterial.Physical.SetBehavior(propertySet=setInformation, behavior=physical_behavior)
code_block_3 = CodeBlock { 0.00001; }
setBasicThermal = Orchid.RevitMaterial.Physical.SetBasicThermal(propertySet=setBehavior, expansionCoefficient=code_block_3)
code_block_4 = CodeBlock { 205000; 0.3; 80000; 7850; }
setMechanical = Orchid.RevitMaterial.Physical.SetMechanical(propertySet=setBasicThermal, youngModulus=code_block_4.out0, poissonRatio=code_block_4.out1, shearModulus=code_block_4.out2, density=code_block_4.out3)
boolean_2 = BoolSelector(false)  # graph input
physical_behavior_2 = PhysicalBehavior("Isotropic")  # graph input
code_block_5 = CodeBlock { 45; 0.48; 7850; 0.4; 0; 0.01; 0; 0; }
setProperties = Orchid.RevitMaterial.Thermal.SetProperties(propertySet=setInformation_2, transmitsLight=boolean_2, behavior=physical_behavior_2, thermalConductivity=code_block_5.out0, specificHeat=code_block_5.out1, density=code_block_5.out2, emissivity=code_block_5.out3, permeability=code_block_5.out4, porosity=code_block_5.out5, reflectivity=code_block_5.out6, electricalResistivity=code_block_5.out7)
code_block_6 = CodeBlock { 275; 430; }
boolean_3 = BoolSelector(false)  # graph input
setStrength = Orchid.RevitMaterial.Physical.SetStrength(propertySet=setMechanical, yieldStress=code_block_6.out0, tensileStrength=code_block_6.out1, thermalTreated=boolean_3)
create_3 = Orchid.RevitMaterial.Material.Create(name=code_block)
material_aspect = MaterialAspect("Thermal")  # graph input
setThermal = Orchid.RevitMaterial.Material.SetThermal(material=create_3, aspect=material_aspect, propertySet=setProperties)
watch = Watch(setThermal)
name = Material.Name(material=setThermal)
watch_2 = Watch(name)
material_aspect_2 = MaterialAspect("Physical (Structural)")  # graph input
setPhysical = Orchid.RevitMaterial.Material.SetPhysical(material=create_3, aspect=material_aspect_2, propertySet=setStrength)
watch_3 = Watch(setPhysical)
name_2 = Material.Name(material=setPhysical)
watch_4 = Watch(name_2)

getInformation = Orchid.RevitMaterial.Physical.GetInformation(propertySet=setInformation)
watch_5 = Watch(getInformation.Subclass)
watch_6 = Watch(getInformation.Source)
watch_7 = Watch(getInformation.SourceUrl)
watch_8 = Watch(getInformation.Keywords)
watch_9 = Watch(getInformation.Description)
getBehavior = Orchid.RevitMaterial.Physical.GetBehavior(propertySet=setInformation)
watch_10 = Watch(getBehavior)
getInformation_2 = Orchid.RevitMaterial.Thermal.GetInformation(propertySet=setInformation_2)
watch_11 = Watch(getInformation_2.SourceUrl)
watch_12 = Watch(getInformation_2.Source)
watch_13 = Watch(getInformation_2.Subclass)
watch_14 = Watch(getInformation_2.Keywords)
watch_15 = Watch(getInformation_2.Description)
getYoungModulus = Orchid.RevitMaterial.Physical.GetYoungModulus(propertySet=setMechanical)
watch_16 = Watch(getYoungModulus.YoungModulusY)
watch_17 = Watch(getYoungModulus.YoungModulusZ)
watch_18 = Watch(getYoungModulus.YoungModulus1)
watch_19 = Watch(getYoungModulus.YoungModulusX)
watch_20 = Watch(getYoungModulus.YoungModulus2)
getExpansionCoefficient = Orchid.RevitMaterial.Physical.GetExpansionCoefficient(propertySet=setBasicThermal)
watch_21 = Watch(getExpansionCoefficient.ExpansionCoefficientX)
watch_22 = Watch(getExpansionCoefficient.ExpansionCoefficientY)
watch_23 = Watch(getExpansionCoefficient.ExpansionCoefficientZ)
watch_24 = Watch(getExpansionCoefficient.ExpansionCoefficient1)
watch_25 = Watch(getExpansionCoefficient.ExpansionCoefficient2)
watch_26 = Watch(getYoungModulus.YoungModulus)
watch_27 = Watch(getExpansionCoefficient.ExpansionCoefficient)
getProperties = Orchid.RevitMaterial.Thermal.GetProperties(propertySet=setProperties)
watch_28 = Watch(getProperties.ThermalConductivity)
watch_29 = Watch(getProperties.SpecificHeat)
watch_30 = Watch(getProperties.Density)
watch_31 = Watch(getProperties.Behavior)
watch_32 = Watch(getProperties.TransmitsLight)
watch_33 = Watch(getProperties.ElectricalResistivity)
watch_34 = Watch(getProperties.Reflectivity)
watch_35 = Watch(getProperties.Porosity)
watch_36 = Watch(getProperties.Permeability)
watch_37 = Watch(getProperties.Emissivity)
getPoissonRatio = Orchid.RevitMaterial.Physical.GetPoissonRatio(propertySet=setMechanical)
watch_38 = Watch(getPoissonRatio.PoissonRatioX)
watch_39 = Watch(getPoissonRatio.PoissonRatioY)
watch_40 = Watch(getPoissonRatio.PoissonRatioZ)
watch_41 = Watch(getPoissonRatio.PoissonRatio12)
watch_42 = Watch(getPoissonRatio.PoissonRatio23)
watch_43 = Watch(getPoissonRatio.PoissonRatio)
getStrength = Orchid.RevitMaterial.Physical.GetStrength(propertySet=setStrength)
watch_44 = Watch(getStrength.ThermalTreated)
watch_45 = Watch(getStrength.TensileStrength)
watch_46 = Watch(getStrength.YieldStress)
getShearModulus = Orchid.RevitMaterial.Physical.GetShearModulus(propertySet=setMechanical)
watch_47 = Watch(getShearModulus.ShearModulusX)
watch_48 = Watch(getShearModulus.ShearModulusY)
watch_49 = Watch(getShearModulus.ShearModulus)
watch_50 = Watch(getShearModulus.ShearModulusZ)
watch_51 = Watch(getShearModulus.ShearModulus12)
getDensity = Orchid.RevitMaterial.Physical.GetDensity(propertySet=setMechanical)
watch_52 = Watch(getDensity)
