# Dynamo graph Physical-Thermal-Wood.dyn (Dynamo 2.16.1.2727)
# packages: Orchid 216.3.0.8444

# group: Create material: Timber (C24) --> XYZ values for SetBasicThermal and SetMechanical
code_block = CodeBlock { "_Timber C24 (XYZ)"; }
physical_types = PhysicalType("Wood")  # graph input
create = Orchid.RevitMaterial.Physical.Create(name=code_block, type=physical_types)
code_block_2 = CodeBlock()
# ---------- code_block_2.designscript (6 lines) ----------
"Strength Class C24 Timber";
"Eurocode,Structural,structural,wood,CC:EN 338";
"Wood,thermal,solid";
"Wood";
"Orchid generated";
"https://github.com/erfajo/OrchidForDynamo";
# ----------------------------------------
setInformation = Orchid.RevitMaterial.Physical.SetInformation(propertySet=create, description=code_block_2.out0, keywords=code_block_2.out1, subclass=code_block_2.out3, source=code_block_2.out4, sourceUrl=code_block_2.out5)
physical_behavior = PhysicalBehavior("Orthotropic")  # graph input
setBehavior = Orchid.RevitMaterial.Physical.SetBehavior(propertySet=setInformation, behavior=physical_behavior)
code_block_3 = CodeBlock { 0.0001; 0.0002; 0.0003; }
byCoordinates = Point.ByCoordinates(x=code_block_3.out0, y=code_block_3.out1, z=code_block_3.out2)
setBasicThermalByXYZ = Orchid.RevitMaterial.Physical.SetBasicThermalByXYZ(propertySet=setBehavior, expansionCoefficient=byCoordinates)
code_block_4 = CodeBlock()
# ---------- code_block_4.designscript (4 lines) ----------
Autodesk.Point.ByCoordinates(10000,11000,12000);
Autodesk.Point.ByCoordinates(0.3,0.35,0.4);
Autodesk.Point.ByCoordinates(650,700,750);
420;
# ----------------------------------------
setMechanicalByXYZ = Orchid.RevitMaterial.Physical.SetMechanicalByXYZ(propertySet=setBasicThermalByXYZ, youngModulus=code_block_4.out0, poissonRatio=code_block_4.out1, shearModulus=code_block_4.out2, density=code_block_4.out3)
code_block_5 = CodeBlock { "Multiple"; "C24"; 24; 21; 2.5; 4; 14; 0.5; 11000; }
wood_construction = WoodConstruction("Natural")  # graph input
setStrengthExtended = Orchid.RevitMaterial.Physical.SetStrengthExtended(propertySet=setMechanicalByXYZ, species=code_block_5.out0, grade=code_block_5.out1, bending=code_block_5.out2, parallelCompression=code_block_5.out3, perpendicularCompression=code_block_5.out4, parallelShear=code_block_5.out5, tensionParallel=code_block_5.out6, tensionPerpendicular=code_block_5.out7, averageModulus=code_block_5.out8, construction=wood_construction)
create_2 = Orchid.RevitMaterial.Material.Create(name=code_block)
material_aspects = MaterialAspect("Physical (Structural)")  # graph input
setPhysical = Orchid.RevitMaterial.Material.SetPhysical(material=create_2, aspect=material_aspects, propertySet=setStrengthExtended)
name = Material.Name(material=setPhysical)
watch = Watch(name)
watch_2 = Watch(setPhysical)
material_aspects_2 = MaterialAspect("Thermal")  # graph input
thermal_type = ThermalType("Solid")  # graph input
create_3 = Orchid.RevitMaterial.Thermal.Create(name=code_block, type=thermal_type)
setInformation_2 = Orchid.RevitMaterial.Thermal.SetInformation(propertySet=create_3, description=code_block_2.out0, keywords=code_block_2.out2, subclass=code_block_2.out3, source=code_block_2.out4, sourceUrl=code_block_2.out5)
boolean = BoolSelector(false)  # graph input
physical_behavior_2 = PhysicalBehavior("Isotropic")  # graph input
code_block_6 = CodeBlock { 0.12; 0.19; 496; 0.85; 0; 0.01; 0; 10000000; }
setProperties = Orchid.RevitMaterial.Thermal.SetProperties(propertySet=setInformation_2, transmitsLight=boolean, behavior=physical_behavior_2, thermalConductivity=code_block_6.out0, specificHeat=code_block_6.out1, density=code_block_6.out2, emissivity=code_block_6.out3, permeability=code_block_6.out4, porosity=code_block_6.out5, reflectivity=code_block_6.out6, electricalResistivity=code_block_6.out7)
setThermal = Orchid.RevitMaterial.Material.SetThermal(material=create_2, aspect=material_aspects_2, propertySet=setProperties)
name_2 = Material.Name(material=setThermal)
watch_3 = Watch(name_2)
watch_4 = Watch(setThermal)
boolean_2 = BoolSelector(true)  # graph input

getShearModulus = Orchid.RevitMaterial.Physical.GetShearModulus(propertySet=setMechanicalByXYZ)
watch_5 = Watch(getShearModulus.ShearModulusY)
watch_6 = Watch(getShearModulus.ShearModulusZ)
watch_7 = Watch(getShearModulus.ShearModulus12)
getStrengthExtended = Orchid.RevitMaterial.Physical.GetStrengthExtended(propertySet=setStrengthExtended)
watch_8 = Watch(getStrengthExtended.ParallelShear)
watch_9 = Watch(getStrengthExtended.TensionParallel)
watch_10 = Watch(getStrengthExtended.TensionPerpendicular)
watch_11 = Watch(getStrengthExtended.PerpendicularCompression)
watch_12 = Watch(getStrengthExtended.ParallelCompression)
watch_13 = Watch(getStrengthExtended.AverageModulus)
watch_14 = Watch(getStrengthExtended.Construction)
watch_15 = Watch(getStrengthExtended.Species)
watch_16 = Watch(getStrengthExtended.Grade)
watch_17 = Watch(getStrengthExtended.Bending)
watch_18 = Watch(getShearModulus.ShearModulusX)
watch_19 = Watch(getShearModulus.ShearModulus)
getYoungModulus = Orchid.RevitMaterial.Physical.GetYoungModulus(propertySet=setMechanicalByXYZ)
watch_20 = Watch(getYoungModulus.YoungModulusY)
watch_21 = Watch(getYoungModulus.YoungModulusZ)
watch_22 = Watch(getYoungModulus.YoungModulus1)
getPoissonRatio = Orchid.RevitMaterial.Physical.GetPoissonRatio(propertySet=setMechanicalByXYZ)
watch_23 = Watch(getPoissonRatio.PoissonRatioX)
watch_24 = Watch(getPoissonRatio.PoissonRatioY)
watch_25 = Watch(getPoissonRatio.PoissonRatioZ)
watch_26 = Watch(getPoissonRatio.PoissonRatio12)
watch_27 = Watch(getYoungModulus.YoungModulus2)
watch_28 = Watch(getPoissonRatio.PoissonRatio23)
watch_29 = Watch(getPoissonRatio.PoissonRatio)
watch_30 = Watch(getYoungModulus.YoungModulusX)
watch_31 = Watch(getYoungModulus.YoungModulus)
getProperties = Orchid.RevitMaterial.Thermal.GetProperties(propertySet=setProperties)
watch_32 = Watch(getProperties.Emissivity)
watch_33 = Watch(getProperties.Density)
watch_34 = Watch(getProperties.SpecificHeat)
watch_35 = Watch(getProperties.ThermalConductivity)
watch_36 = Watch(getProperties.Behavior)
watch_37 = Watch(getProperties.TransmitsLight)
watch_38 = Watch(getProperties.ElectricalResistivity)
watch_39 = Watch(getProperties.Reflectivity)
watch_40 = Watch(getProperties.Porosity)
watch_41 = Watch(getProperties.Permeability)
getExpansionCoefficient = Orchid.RevitMaterial.Physical.GetExpansionCoefficient(propertySet=setBasicThermalByXYZ)
watch_42 = Watch(getExpansionCoefficient.ExpansionCoefficientX)
watch_43 = Watch(getExpansionCoefficient.ExpansionCoefficientY)
watch_44 = Watch(getExpansionCoefficient.ExpansionCoefficientZ)
watch_45 = Watch(getExpansionCoefficient.ExpansionCoefficient1)
watch_46 = Watch(getExpansionCoefficient.ExpansionCoefficient2)
watch_47 = Watch(getExpansionCoefficient.ExpansionCoefficient)
getInformation = Orchid.RevitMaterial.Physical.GetInformation(propertySet=setInformation)
watch_48 = Watch(getInformation.Subclass)
watch_49 = Watch(getInformation.Source)
watch_50 = Watch(getInformation.SourceUrl)
getBehavior = Orchid.RevitMaterial.Physical.GetBehavior(propertySet=setInformation)
watch_51 = Watch(getBehavior)
watch_52 = Watch(getInformation.Keywords)
watch_53 = Watch(getInformation.Description)
getInformation_2 = Orchid.RevitMaterial.Thermal.GetInformation(propertySet=setInformation_2)
watch_54 = Watch(getInformation_2.SourceUrl)
watch_55 = Watch(getInformation_2.Source)
watch_56 = Watch(getInformation_2.Subclass)
watch_57 = Watch(getInformation_2.Keywords)
watch_58 = Watch(getInformation_2.Description)
