# Dynamo graph AutoIFCexport.dyn (Dynamo 2.12.1.8246)
# packages: Orchid 206.3.1.8223, Orchid 212.3.0.8333

# group: Open all project files in directory
string = StringInput("..\testSet")  # graph input
code_block = CodeBlock { "*.rvt"; }
boolean = BoolSelector(false)  # graph input
contents = Orchid.Common.Directory.Contents(directory=string, searchString=code_block, deepSearch=boolean)
backgroundOpen = Orchid.RevitProject.Common.Document.BackgroundOpen(file=contents)
load = Orchid.RevitProject.Elements.Family.Load(familyDocument=backgroundOpen)
await_ = Orchid.Common.DataStream.Await(pass=backgroundOpen, waitFor=load)
close = Orchid.RevitProject.Common.Document.Close(document=await_)

# group: Place families in document
types = Family.Types(family=load)
flatten = List.Flatten(list=types)
count = List.Count(list=flatten)
code_block_2 = CodeBlock(num=count) { (1..num)*2500; }
byCoordinates = Point.ByCoordinates(x=code_block_2)
levels = Levels("Level 1")  # graph input
byPointAndLevel = FamilyInstance.ByPointAndLevel(familyType=flatten, point=byCoordinates, level=levels)

# group: IFC Export based on prebuild IFC setting and a view
current = Orchid.RevitProject.Common.Document.Current()
await_2 = Orchid.Common.DataStream.Await(pass=current, waitFor=byPointAndLevel)
ifc_setting = Setting("IFC2x3 Coordination View 2.0")  # graph input
settingByName = Orchid.IfcExport.IFC.SettingByName(name=ifc_setting)
views = Views("{3D}")  # graph input
export = Orchid.IfcExport.IFC.Export(document=await_2, setting=settingByName, view=views)

# group: Prebuild IFC setting
ifc_setting_2 = Setting("IFC4 Design Transfer View")  # graph input; frozen
settingByName_2 = Orchid.IfcExport.IFC.SettingByName(name=ifc_setting_2)

# group: IFC setting --> General
ifc_space_boundary = SpaceBoundary("1st Level")  # graph input
ifc_project_origin = SitePlacement("Internal coordinates")  # graph input
boolean_2 = BoolSelector(true)  # graph input
settingGeneral = Orchid.IfcExport.IFC.SettingGeneral(setting=settingByName_2, ifcFileType=ifc_space_boundary, spaceBoundary=ifc_project_origin, projectOrigin=boolean_2)
ifc_version = Version("IFC4 Design Transfer View")  # graph input
ifc_file_type = FileType("IFC")  # graph input

# group: IFC setting --> Additional/LOD
boolean_3 = BoolSelector(true)  # graph input
ifc_level_of_detail = LevelOfDetail("Medium")  # graph input
settingAdditional = Orchid.IfcExport.IFC.SettingAdditional(setting=settingGeneral, visibleElements=boolean_3, levelOfDetail=ifc_level_of_detail)

# group: file
directory = Orchid.RevitProject.Common.Document.Directory()
code_block_3 = CodeBlock { 1; }
subPath = Orchid.Common.Directory.SubPath(directory=directory, remove=code_block_3)
string_2 = StringInput("DanEDU IFC export.txt")  # graph input
code_block_4 = CodeBlock(t1=subPath, t2=string_2) { t1+"\\"+t2; }

# group: IFC setting --> Property
boolean_4 = BoolSelector(true)  # graph input
settingProperty = Orchid.IfcExport.IFC.SettingProperty(setting=settingAdditional, baseQuantities=boolean_4, userProperty=boolean_4, userPropertyFile=code_block_4)

# group: IFC setting --> Advanced
boolean_5 = BoolSelector(true)  # graph input
settingAdvanced = Orchid.IfcExport.IFC.SettingAdvanced(setting=settingProperty, storeGuid=boolean_5)

# group: IFC setting file format
type = Object.Type(object=settingAdvanced)
watch = Watch(type)
watch_2 = Watch(settingAdvanced)

# group: IFC Export
boolean_6 = BoolSelector(false)  # graph input
views_2 = Views("{3D}")  # graph input
export_2 = Orchid.IfcExport.IFC.Export(setting=settingAdvanced, view=views_2)
watch_3 = Watch(export_2)
phases = Phase("Existing")  # graph input

# group: deprecated
loadFamily = Orchid.RevitProject.Common.Document.LoadFamily(family=contents)

# group: file
directory_2 = Orchid.RevitProject.Common.Document.Directory()
string_3 = StringInput("test")  # graph input
code_block_5 = CodeBlock(t1=directory_2, t2=string_3) { t1+"\\"+t2; }
