# Dynamo graph BuiltInParameter.dyn (Dynamo 2.3.1.11775)
# packages: Orchid 203.3.0.8042

all = Orchid.RevitProject.Parameters.BuiltInParameter.All()
label = Orchid.RevitProject.Parameters.BuiltInParameter.Label(parameterId=all)
watch = Watch(label)
code_block = CodeBlock { "MATERIAL_ID_PARAM"; }
byName = Orchid.RevitProject.Parameters.BuiltInParameter.ByName(name=code_block)
label_2 = Orchid.RevitProject.Parameters.BuiltInParameter.Label(parameterId=byName)
watch_2 = Watch(label_2)
name = Orchid.RevitProject.Parameters.BuiltInParameter.Name(parameterId=all)
watch_3 = Watch(name)
name_2 = Orchid.RevitProject.Parameters.BuiltInParameter.Name(parameterId=byName)
watch_4 = Watch(name_2)
builtin_parameter = BuiltInParameter("MATERIAL_ID_PARAM")  # graph input
watch_5 = Watch(byName)
watch_6 = Watch(all)
