# Dynamo graph BuiltInParameter_R23.dyn "BuiltInParameter" (Dynamo 2.16.1.2727)
# packages: Orchid 216.3.0.5794

inDocument = Orchid.RevitProject.Parameters.BuiltInParameter.InDocument()
label = Orchid.RevitProject.Parameters.BuiltInParameter.Label(parameterId=inDocument)
watch = Watch(label)
# note: File: defaultProject
code_block = CodeBlock { "MATERIAL_ID_PARAM"; }
byName = Orchid.RevitProject.Parameters.BuiltInParameter.ByName(name=code_block)
label_2 = Orchid.RevitProject.Parameters.BuiltInParameter.Label(parameterId=byName)
watch_2 = Watch(label_2)
name = Orchid.RevitProject.Parameters.BuiltInParameter.Name(parameterId=inDocument)
watch_3 = Watch(name)
name_2 = Orchid.RevitProject.Parameters.BuiltInParameter.Name(parameterId=byName)
watch_4 = Watch(name_2)
builtin_parameter = BuiltInParameter("MATERIAL_ID_PARAM")  # graph input
watch_5 = Watch(byName)
watch_6 = Watch(inDocument)
