# Dynamo graph BulkLoadFamily.dyn (Dynamo 2.12.1.8246)
# packages: Orchid 212.3.0.8348

current = Orchid.Common.Directory.Current()
string = StringInput("*.rvt")  # graph input
boolean = BoolSelector(false)  # graph input
contents = Orchid.Common.Directory.Contents(directory=current, searchString=string, deepSearch=boolean)
backgroundOpen = Orchid.RevitProject.Common.Document.BackgroundOpen(file=contents)
directory_path = StringInput("..\testSet")  # graph input
string_2 = StringInput("*.rfa")  # graph input
boolean_2 = BoolSelector(false)  # graph input
contents_2 = Orchid.Common.Directory.Contents(directory=directory_path, searchString=string_2, deepSearch=boolean_2)
loadFamily = Orchid.RevitProject.Common.Document.LoadFamily(document=backgroundOpen, familyFile=contents_2)
watch = Watch(loadFamily)
boolean_3 = BoolSelector(true)
close = Orchid.RevitProject.Common.Document.Close(document=loadFamily, save=boolean_3)
