# Dynamo graph BulkLoadFamily_R23.dyn "BulkLoadFamily" (Dynamo 2.16.1.2727)
# packages: Orchid 216.3.0.5794

directory_path = StringInput("%userprofile%\Programming\Testing\Data\testSet")  # graph input
string = StringInput("*.rvt")  # graph input
boolean = BoolSelector(false)  # graph input
contents = Orchid.Common.Directory.Contents(directory=directory_path, searchString=string, deepSearch=boolean)
backgroundOpen = Orchid.RevitProject.Common.Document.BackgroundOpen(file=contents)
# note: File: defaultProject
directory_path_2 = StringInput("%userprofile%\Programming\Testing\Data\testSet")  # graph input
string_2 = StringInput("*.rfa")  # graph input
boolean_2 = BoolSelector(false)  # graph input
contents_2 = Orchid.Common.Directory.Contents(directory=directory_path_2, searchString=string_2, deepSearch=boolean_2)
loadFamily = Orchid.RevitProject.Common.Document.LoadFamily(document=backgroundOpen, familyFile=contents_2)
watch = Watch(loadFamily)
boolean_3 = BoolSelector(true)
close = Orchid.RevitProject.Common.Document.Close(document=loadFamily, save=boolean_3)
