# Dynamo graph Collect families in project.dyn "Collect families in project_R23" (Dynamo 2.13.1.3887)
# packages: Orchid 213.0.1.8258

# group: Close files
await_ = Orchid.Common.DataStream.Await()  # unwired: pass, waitFor
boolean = BoolSelector(true)  # graph input
close = Orchid.RevitProject.Common.Document.Close(document=await_, save=boolean)  # frozen

# group: Collect family as document from current document
code_block = CodeBlock { ["Doors","Windows"]; }
byCategory = Orchid.RevitProject.Elements.Element.ByCategory(category=code_block)
elementType = Element.ElementType(element=byCategory.Element)
uniqueItems = List.UniqueItems(list=elementType, lacing=Longest)
flatten = List.Flatten(list=uniqueItems)
family = FamilyType.Family(familyType=flatten)
uniqueItems_2 = List.UniqueItems(list=family)
edit = Orchid.RevitProject.Elements.Family.Edit(family=uniqueItems_2)

code_block_2 = CodeBlock()
# ---------- code_block_2.designscript (10 lines) ----------
//Parameter name
"Creator Build";
//SP Parameter group
"Sheet & Project";
//Parameter group
"PG_ADSK_MODEL_PROPERTIES";
//Instances
true;
//Reporting
false;
# ----------------------------------------
add = Orchid.RevitFamily.SharedParameter.Add(familyDocument=edit, parameterName=code_block_2.out0, groupName=code_block_2.out1, group=code_block_2.out2, instance=code_block_2.out3)

# group: load back into the current project
await_2 = Orchid.Common.DataStream.Await(pass=edit, waitFor=add)
load = Orchid.RevitProject.Elements.Family.Load(familyDocument=await_2)
await_3 = Orchid.Common.DataStream.Await(pass=await_2, waitFor=load)
close_2 = Orchid.RevitProject.Common.Document.Close(document=await_3)

# group: Open all files in directory and sub directories
string = StringInput("..\testSet")  # graph input
code_block_3 = CodeBlock { "*.rfa"; true; }
contents = Orchid.Common.Directory.Contents(directory=string, searchString=code_block_3.out0)  # frozen
backgroundOpen = Orchid.RevitProject.Common.Document.BackgroundOpen(file=contents)
