# Dynamo graph DefaultTemplateTypes_R23.dyn (Dynamo 2.16.1.2727)
# packages: Orchid 216.3.0.5828

# group: Purge ViewTemplate
current = Document.Current()
purge = Orchid.RevitProject.Views.ViewTemplate.Purge(document=current)
await_ = Orchid.Common.DataStream.Await(waitFor=purge)  # unwired: pass

# group: Rename existing ViewTemplate
inDocument = Orchid.RevitProject.Views.ViewTemplate.InDocument()
name = Element.Name(element=inDocument.ViewTemplate)
code_block = CodeBlock(name=name) { "_dummy_" + name; }
setName = Orchid.RevitProject.Elements.Element.SetName(element=inDocument.ViewTemplate, name=code_block)

# group: Rename existing ViewFamilyType and Attribute
inDocument_2 = Orchid.RevitProject.Common.Attribute.InDocument()
code_block_2 = CodeBlock(name=inDocument_2.FamilyName) { !DSCore.String.Contains(name,"Tag"); }
filterByBoolMask = List.FilterByBoolMask(list=inDocument_2.ElementType, mask=code_block_2)
inDocument_3 = Orchid.RevitProject.Views.ViewFamilyType.InDocument()
join = List.Join(list0=filterByBoolMask.in, list1=inDocument_3.ViewFamilyType)
name_2 = Element.Name(element=join)
code_block_3 = CodeBlock(name=name_2) { "_dummy_" + name; }
setName_2 = Orchid.RevitProject.Elements.Element.SetName(element=join, name=code_block_3)
await_2 = Orchid.Common.DataStream.Await(pass=setName, waitFor=setName_2)

# group: Get default template
code_block_4 = CodeBlock()
# ---------- code_block_4.designscript (6 lines) ----------
path = "C:\\ProgramData\\Autodesk\\RVT ";
bygn = "\\Templates\\DTU\\DTU Building.rte";
syst = "\\Templates\\DTU\\DTU Systems.rte";
format =  Orchid.AdeskApp.Revit.Format;
path + format + bygn;
path + format + syst;
# ----------------------------------------
backgroundOpen = Orchid.RevitProject.Common.Document.BackgroundOpen(file=code_block_4.out4)
await_3 = Orchid.Common.DataStream.Await(pass=backgroundOpen, waitFor=await_2)

# group: Transfer default ViewTemplate
inDocument_4 = Orchid.RevitProject.Views.ViewTemplate.InDocument(document=await_3)
copyElement = Orchid.RevitProject.Common.Document.CopyElement(source=await_3, element=inDocument_4.ViewTemplate)
await_4 = Orchid.Common.DataStream.Await(pass=await_3, waitFor=copyElement)

# group: Transfer default ViewFamilyType
inDocument_5 = Orchid.RevitProject.Views.ViewFamilyType.InDocument(document=await_4)
code_block_5 = CodeBlock { true; }
transferByElementType = Orchid.RevitProject.Common.Document.TransferByElementType(source=await_4, elementType=inDocument_5.ViewFamilyType, append=code_block_5)
await_5 = Orchid.Common.DataStream.Await(pass=await_4, waitFor=transferByElementType)

code_block_6 = CodeBlock { "View Template applied to new views"; }
byName = Orchid.RevitProject.Parameters.Parameter.ByName(element=transferByElementType, name=code_block_6)
byName_2 = Orchid.RevitProject.Parameters.Parameter.ByName(element=inDocument_5.ViewFamilyType, name=code_block_6)
getValue = Orchid.RevitProject.Parameters.Parameter.GetValue(parameter=byName_2)
name_3 = Element.Name(element=getValue)
byName_3 = Orchid.RevitProject.Views.ViewTemplate.ByName(name=name_3)
setValue = Orchid.RevitProject.Parameters.Parameter.SetValue(parameter=byName, value=byName_3)

# group: Transfer default Attribute
inDocument_6 = Orchid.RevitProject.Common.Attribute.InDocument(document=await_5)
code_block_7 = CodeBlock(name=inDocument_6.FamilyName) { !DSCore.String.Contains(name,"Tag"); }
filterByBoolMask_2 = List.FilterByBoolMask(list=inDocument_6.ElementType, mask=code_block_7)
code_block_8 = CodeBlock { true; }
transferByElementType_2 = Orchid.RevitProject.Common.Document.TransferByElementType(source=await_5, elementType=filterByBoolMask_2.in, append=code_block_8)

# group: Close default Template
await_6 = Orchid.Common.DataStream.Await(pass=await_5, waitFor=setValue)
await_7 = Orchid.Common.DataStream.Await(pass=await_6, waitFor=transferByElementType_2)
close = Orchid.RevitProject.Common.Document.Close(document=await_7)
