# Dynamo graph Document.dyn (Dynamo 2.6.2.15705)
# packages: Orchid 206.3.1.8223

# group: All background open documents
opened = Orchid.RevitProject.Common.Document.Opened()
directory_path = StringInput("..\testSet")  # graph input
string = StringInput("*.rfa")  # graph input
boolean = BoolSelector(false)  # graph input
contents = Orchid.Common.Directory.Contents(directory=directory_path, searchString=string, deepSearch=boolean)
backgroundOpen = Orchid.RevitProject.Common.Document.BackgroundOpen(file=contents)
await_ = Orchid.Common.DataStream.Await(pass=opened, waitFor=backgroundOpen)
name = Orchid.RevitProject.Common.Document.Name(document=await_)
watch = Watch(name)
watch_2 = Watch(await_)

# group: Convert document
current = Document.Current()
toRevitType = Orchid.Common.Object.ToRevitType(object=current)
toDynamoType = Orchid.Common.Object.ToDynamoType(object=toRevitType)
watch_3 = Watch(toDynamoType)
watch_4 = Watch(toRevitType)

# group: Does document contain category?
categories = Categories("OST_MEPSpaces")  # graph input
code_block = CodeBlock()
# ---------- code_block.designscript (4 lines) ----------
// Categories to verify
["Areas","Rooms","Spaces"];
"Levels";
"Stairs";
# ----------------------------------------
byName = Category.ByName(name=code_block.out0)
containCategory = Orchid.RevitProject.Common.Document.ContainCategory(category=byName)
watch_5 = Watch(containCategory)

# group: Does document contain type?
code_block_2 = CodeBlock()
# ---------- code_block_2.designscript (4 lines) ----------
// Types to verify
["Area","Room","Space"];
"Level";
"Stairs";
# ----------------------------------------
containType = Orchid.RevitProject.Common.Document.ContainType(type=code_block_2.out0)
watch_6 = Watch(containType)
element_types = ElementTypes("Space")  # graph input

# group: Deprecated converter
current_2 = Document.Current()
toRevitType_2 = Orchid.RevitProject.Common.Document.ToRevitType(document=current_2)
watch_7 = Watch(toRevitType_2)
toDynamoType_2 = Orchid.RevitProject.Common.Document.ToDynamoType(document=toRevitType_2)
watch_8 = Watch(toDynamoType_2)
