# Dynamo graph Document_R23.dyn "Document" (Dynamo 2.16.1.2727)
# packages: Orchid 216.3.0.5794

# group: All background open documents
opened = Orchid.RevitProject.Common.Document.Opened()
directory_path = StringInput("%userprofile%\Programming\Testing\Data\testSet")  # graph input
string = StringInput("*.rfa")  # graph input
boolean = BoolSelector(false)  # graph input
contents = Orchid.Common.Directory.Contents(directory=directory_path, searchString=string, deepSearch=boolean)
backgroundOpen = Orchid.RevitProject.Common.Document.BackgroundOpen(file=contents)
await_ = Orchid.Common.DataStream.Await(pass=opened, waitFor=backgroundOpen)
boolean_2 = BoolSelector(true)
name = Orchid.RevitProject.Common.Document.Name(document=await_, withExtension=boolean_2)
watch = Watch(name)
watch_2 = Watch(await_)

# group: Wrap/Unwrap document
# note: File: defaultProject
current = Document.Current()
toRevitType = Orchid.Common.Object.ToRevitType(object=current)
toDynamoType = Orchid.Common.Object.ToDynamoType(object=toRevitType)
watch_3 = Watch(toDynamoType)
watch_4 = Watch(toRevitType)

# group: Does document contain category?
categories = Categories("OST_MEPSpaces")  # graph input
code_block = CodeBlock()
# ---------- code_block.designscript (4 lines) ----------
// Categories to verify
["Areas","Rooms","Spaces"];
"Levels";
"Stairs";
# ----------------------------------------
byName = Category.ByName(name=code_block.out0)
containCategory = Orchid.RevitProject.Common.Document.ContainCategory(category=byName)
watch_5 = Watch(containCategory)

# group: Does document contain type?
code_block_2 = CodeBlock()
# ---------- code_block_2.designscript (4 lines) ----------
// Types to verify
["Area","Room","Space"];
"Level";
"Stairs";
# ----------------------------------------
containType = Orchid.RevitProject.Common.Document.ContainType(type=code_block_2.out0)
watch_6 = Watch(containType)
element_types = ElementTypes("Space")  # graph input
