# Dynamo graph ExportDWGfromView.dyn (Dynamo 2.12.1.8246)
# packages: Orchid 206.5.0.8318, Orchid 212.3.0.8334

# group: Get view by name in model
code_block = CodeBlock { "FloorPlan"; }
byName = Orchid.RevitProject.Views.ViewType.ByName(name=code_block)
byType = Orchid.RevitProject.Views.View.ByType(viewType=byName)
name = Element.Name(element=byType)
code_block_2 = CodeBlock()
# ---------- code_block_2.designscript (2 lines) ----------
// View to find
"EXPORT DWG";
# ----------------------------------------
boolean = BoolSelector(true)
contains = Orchid.Common.String.Contains(string=name, searchFor=code_block_2, ignoreCase=boolean)
filterByBoolMask = List.FilterByBoolMask(list=byType, mask=contains)

# group: Path
current = Orchid.RevitProject.Common.Document.Current()
path = Orchid.RevitProject.Common.Document.Path(document=current)
directoryName = FileSystem.DirectoryName(path=path)
name_2 = Element.Name(element=filterByBoolMask.in)
code_block_3 = CodeBlock(a=directoryName, b=name_2) { a+"\\"+b; }
fileName = FileSystem.FileName(path=path)
code_block_4 = CodeBlock(a=directoryName, b=fileName) { a+"\\XREF\\"+b; }

# group: Set "IBB 2000" export settings
code_block_5 = CodeBlock()
# ---------- code_block_5.designscript (10 lines) ----------
"IBB 2000";
true;
// filepaths
path1 = "C:\\ProgramData\\Autodesk\\RVT ";
path2 = "\\Libraries\\DanEDU\\Generic Project\\";
layer = "DanEDU Exportlayers Arkitekt.txt";
lines = "DanEDU Linetypes.lin";
format =  Orchid.Revit.Format;
layerMapping = path1 + format + path2 + layer;
lineTypes =path1 + format + path2 + lines;
# ----------------------------------------
createDWGOption = Orchid.RevitProject.Common.ExportOption.CreateDWGOption(name=code_block_5.out0, mergedViews=code_block_5.out1, layerMapping=code_block_5.layerMapping, hatchPatternsFile=code_block_5.lineTypes)

# group: DWG
boolean_2 = BoolSelector(true)
exportDWG = Orchid.RevitProject.Common.Document.ExportDWG(document=current, option=createDWGOption, view=filterByBoolMask.in, file=code_block_4, overwrite=boolean_2)

# group: Delete "BIPS 2005" export settings
DWG = Orchid.RevitProject.Common.ExportOption.DWG()
code_block_6 = CodeBlock(option=DWG) { name = Revit.Element.Name(option); name == "BIPS 2005"; }
filterByBoolMask_2 = List.FilterByBoolMask(list=DWG, mask=code_block_6.out1)
delete = Orchid.RevitProject.Elements.Element.Delete(element=filterByBoolMask_2.in)
