# Dynamo graph ExportDWGfromView_R23.dyn (Dynamo 2.16.1.2727)
# packages: Orchid 2.16.4.5987

# group: Get view by name in model
code_block = CodeBlock { "ViewType"; "FloorPlan"; }
enumByName = Orchid.AdeskApp.Revit.EnumByName(enumType=code_block.out0, valueName=code_block.out1)
byViewType = Orchid.RevitProject.Views.View.ByViewType(viewType=enumByName)
name = Element.Name(element=byViewType)
code_block_2 = CodeBlock()
# ---------- code_block_2.designscript (2 lines) ----------
// View to find
"DTU_Export DWG";
# ----------------------------------------
boolean = BoolSelector(true)
contains = Orchid.Common.String.Contains(string=name, searchFor=code_block_2, ignoreCase=boolean)
filterByBoolMask = List.FilterByBoolMask(list=byViewType, mask=contains)

# group: Path
current = Orchid.RevitProject.Common.Document.Current()
path = Orchid.RevitProject.Common.Document.Path(document=current)
directoryName = FileSystem.DirectoryName(path=path)
name_2 = Element.Name(element=filterByBoolMask.in)
code_block_3 = CodeBlock(a=directoryName, b=name_2) { a+"\\"+b; }
fileName = FileSystem.FileName(path=path)
code_block_4 = CodeBlock(a=directoryName, b=fileName) { a+"\\XREF\\"+b; }

# group: Set "IBB 2000" export settings
# note: File: any DTU building file
code_block_5 = CodeBlock()
# ---------- code_block_5.designscript (18 lines) ----------
"IBB 2000";

// merge files into one?
true;

// filepaths
path1 = "C:\\ProgramData\\Autodesk\\RVT ";
path2 = "\\Libraries\\DanEDU\\Generic Project\\";
layer = "DanEDU Exportlayers.txt";
lines = "DanEDU Linetypes.lin";
format =  Orchid.AdeskApp.Revit.Format;
layerMapping = path1 + format + path2 + layer;
lineTypes =path1 + format + path2 + lines;

// export using shared coordinate?
true;
// preserve coincident lines
true;
# ----------------------------------------
createAcadOption = Orchid.RevitProject.Common.ExportOption.CreateAcadOption(name=code_block_5.out0, layerMapping=code_block_5.layerMapping)
acadOptionSettings = Orchid.RevitProject.Common.ExportOption.AcadOptionSettings(option=createAcadOption, linetypesFile=code_block_5.lineTypes)
acadOptionGenerel = Orchid.RevitProject.Common.ExportOption.AcadOptionGenerel(option=acadOptionSettings)  # frozen

# group: DWG
boolean_2 = BoolSelector(true)
exportDWG = Orchid.RevitProject.Common.Document.ExportDWG(document=current, option=acadOptionSettings, view=filterByBoolMask.in, file=code_block_4, overwrite=boolean_2)

# group: Delete "BIPS 2005" export settings
acadOptions = Orchid.RevitProject.Common.ExportOption.AcadOptions()  # frozen
code_block_6 = CodeBlock(option=acadOptions) { name = Revit.Element.Name(option); name == "BIPS 2005"; }
filterByBoolMask_2 = List.FilterByBoolMask(list=acadOptions, mask=code_block_6.out1)
delete = Orchid.RevitProject.Elements.Element.Delete(element=filterByBoolMask_2.in)
