# Dynamo graph ExportSchedules_R23.dyn "ExportSchedules" (Dynamo 2.16.1.2727)
# packages: Orchid 216.3.0.5794

# group: Path
# note: File: defaultProject
current = Orchid.RevitProject.Common.Document.Current()
path = Orchid.RevitProject.Common.Document.Path(document=current)
directoryName = FileSystem.DirectoryName(path=path)
string = StringInput("\Schedule")  # graph input
code_block = CodeBlock(a=directoryName, b=string) { a+b; }

# group: Schedules
code_block_2 = CodeBlock { "Room Schedule"; }
byName = Orchid.RevitProject.Views.View.ByName(name=code_block_2)
getData = Orchid.RevitProject.Schedules.Schedule.GetData(scheduleView=byName)

# group: Export to Excel
code_block_3 = CodeBlock { 0; }
exportToExcel = Data.ExportToExcel(filePath=code_block, sheetName=code_block_2, startRow=code_block_3, startColumn=code_block_3, data=getData)
