# Dynamo graph Filter.dyn (Dynamo 2.16.1.2727)
# packages: Orchid 216.3.0.5799

# group: Orchid -> Filter rule for (element) parameters
code_block = CodeBlock { "test2"; }
code_block_2 = CodeBlock { "Windows"; }
byName = Category.ByName(name=code_block_2)
all_elements_of_category = ElementsOfCategory(Category=byName)
firstItem = List.FirstItem(list=all_elements_of_category)
elementType = Element.ElementType(element=firstItem)
code_block_3 = CodeBlock { "Width"; "Greater"; 1000; }
byName_2 = Orchid.RevitProject.Parameters.Parameter.ByName(element=elementType, name=code_block_3.out0)
create = Orchid.RevitProject.Filters.FilterRule.Create(parameter=byName_2, ruleType=code_block_3.out1, value=code_block_3.out2)
code_block_4 = CodeBlock { ["Doors","Windows"]; }
byName_3 = Category.ByName(name=code_block_4)
byRule = Orchid.RevitProject.Filters.ParameterFilter.ByRule(name=code_block, filterRule=create, category=byName_3)

# group: Add filter to view, and set visibility
views = Views("{3D}")  # graph input
boolean = BoolSelector(false)  # graph input
addFilter = Orchid.RevitProject.Views.View.AddFilter(view=views, parameterFilter=byRule, visibility=boolean)
filters = View.Filters(view=addFilter)

# group: Filter rule for user-defined parameters (project, shared, and global parameters)
code_block_5 = CodeBlock { "test1"; }
# note: File: defaultProject_param
code_block_6 = CodeBlock()
# ---------- code_block_6.designscript (12 lines) ----------
// Parameter name
"TestStringParameter";
"TestIntegerParameter";
"TestDoubleParameter";

// Rule Type
"==";

// values
"Something";
1000;
1000.0;
# ----------------------------------------
create_2 = Orchid.RevitProject.Filters.FilterRule.Create(parameterName=code_block_6.out0, ruleType=code_block_6.out3, value=code_block_6.out4)
byName_4 = Orchid.RevitProject.Parameters.ProjectParameter.ByName(parameterName=code_block_6.out2)
create_3 = Orchid.RevitProject.Filters.FilterRule.Create(parameter=byName_4, ruleType=code_block_6.out3, value=code_block_6.out6)
create_4 = List.Create(item0=create_2, item1=create_3)
code_block_7 = CodeBlock { ["Doors","Windows"]; }
byName_5 = Category.ByName(name=code_block_7)
boolean_2 = BoolSelector(false)  # graph input
byRule_2 = Orchid.RevitProject.Filters.ParameterFilter.ByRule(name=code_block_5, filterRule=create_4, category=byName_5, andOr=boolean_2)
id = Element.Id(element=byName_4)
watch = Watch(id)
name = Element.Name(element=byName_4)
watch_2 = Watch(name)

# group: OOTB -> Filter rule for (element) parameters. Notice the need to convert between SI and Imperial units!
code_block_8 = CodeBlock { "test3"; }
code_block_9 = CodeBlock { ["Windows","Doors"]; }
byName_6 = Category.ByName(name=code_block_9)
code_block_10 = CodeBlock { "Greater"; "Width"; 1000; }
convert_by_units = DynamoUnitConvert(code_block_10.out2, MeasurementType="autodesk.unit.quantity:length-1.0.4", FromConversion="autodesk.unit.unit:millimeters-1.0.1", ToConversion="autodesk.unit.unit:feet-1.0.1")
code_block_11 = CodeBlock { "Windows"; }
byName_7 = Category.ByName(name=code_block_11)
all_elements_of_category_2 = ElementsOfCategory(Category=byName_7)
firstItem_2 = List.FirstItem(list=all_elements_of_category_2)
elementType_2 = Element.ElementType(element=firstItem_2)
parameterByName = Parameter.ParameterByName(element=elementType_2, name=code_block_10.out1)
byRuleType = Revit.Filter.FilterRule.ByRuleType(type=code_block_10.out0, value=convert_by_units, parameter=parameterByName)
byRules = Revit.Filter.ParameterFilterElement.ByRules(name=code_block_8, categories=byName_6, rules=byRuleType)

# group: Get FilterRule and convert so it can be sat as an AND filter
getRule = Orchid.RevitProject.Filters.ParameterFilter.GetRule(parameterFilter=byRules)
code_block_12 = CodeBlock { "test4"; }
boolean_3 = BoolSelector(true)  # graph input
byRule_3 = Orchid.RevitProject.Filters.ParameterFilter.ByRule(name=code_block_12, filterRule=getRule, category=byName_3, andOr=boolean_3)

# group: Add filter rule set
ruleTree = Orchid.RevitProject.Filters.ParameterFilter.RuleTree(parameterFilter=byRule_2)
addRuleSet = Orchid.RevitProject.Filters.ParameterFilter.AddRuleSet(parameterFilter=byRule_2, filterRule=create, ruleTree=ruleTree)
ruleTree_2 = Orchid.RevitProject.Filters.ParameterFilter.RuleTree(parameterFilter=addRuleSet)
boolean_4 = BoolSelector(false)  # graph input
addRuleSet_2 = Orchid.RevitProject.Filters.ParameterFilter.AddRuleSet(parameterFilter=addRuleSet, filterRule=getRule, ruleTree=ruleTree_2, andOr=boolean_4)
code_block_13 = CodeBlock(filterRule=create) { filterRule; [3]; [3,2]; }
ruleTree_3 = Orchid.RevitProject.Filters.ParameterFilter.RuleTree(parameterFilter=addRuleSet_2)
boolean_5 = BoolSelector(true)  # graph input
addRuleSet_3 = Orchid.RevitProject.Filters.ParameterFilter.AddRuleSet(parameterFilter=addRuleSet_2, filterRule=code_block_13.filterRule, ruleTree=ruleTree_3, attachedTo=code_block_13.out1, andOr=boolean_5)
ruleTree_4 = Orchid.RevitProject.Filters.ParameterFilter.RuleTree(parameterFilter=addRuleSet_3)
watch_3 = Watch(ruleTree_4)
watch_4 = Watch(ruleTree_3)
watch_5 = Watch(ruleTree_2)

parameter_filters = ParameterFilter("Architectural")  # graph input
watch_6 = Watch(parameter_filters)
inDocument = Orchid.RevitProject.Filters.ParameterFilter.InDocument()
watch_7 = Watch(inDocument)
await_ = Orchid.Common.DataStream.Await(pass=code_block_5, waitFor=byRule_2)
byName_8 = Orchid.RevitProject.Filters.ParameterFilter.ByName(name=await_)
watch_8 = Watch(byName_8)

# group: Ruletype
code_block_14 = CodeBlock()
# ---------- code_block_14.designscript (25 lines) ----------
// Dynamo RuleTypes
// Please notice the spelling
// issue --> GeaterOrEqual
"BeginsWith";
"Contains";
"EndsWith";
"Equals";
"Greater";
"Less";
"GeaterOrEqual";
"GreaterOrEqual";
"LessOrEqual";
"NotBeginsWith";
"NotContains";
"NotEndsWith";
"NotEquals";

// Orchid additional
// Ruletypes
"==";
">";
"<";
">=";
"<=";
"!=";
# ----------------------------------------
select_rule_type = RuleTypes("Greater")  # graph input

# group: Converter
toRevitType = Orchid.Common.Object.ToRevitType(object=byName_8)
toDynamoType = Orchid.Common.Object.ToDynamoType(object=toRevitType)
watch_9 = Watch(toDynamoType)
watch_10 = Watch(toRevitType)
