# Dynamo graph Filter_R23.dyn "Filter" (Dynamo 2.16.1.2727)
# packages: Orchid 216.3.0.5812

# group: Orchid -> Filter rule for (element) parameters
code_block = CodeBlock { "test2"; }
code_block_2 = CodeBlock { "Windows"; }
byName = Category.ByName(name=code_block_2)
all_elements_of_category = ElementsOfCategory(Category=byName)
firstItem = List.FirstItem(list=all_elements_of_category)
elementType = Element.ElementType(element=firstItem)
code_block_3 = CodeBlock { "Width"; "Greater"; 2000; }
byName_2 = Orchid.RevitProject.Parameters.Parameter.ByName(element=elementType, name=code_block_3.out0)
create = Orchid.RevitProject.Filters.FilterRule.Create(parameter=byName_2, ruleType=code_block_3.out1, value=code_block_3.out2)
code_block_4 = CodeBlock { ["Doors","Windows"]; }
byName_3 = Category.ByName(name=code_block_4)
create_2 = Orchid.RevitProject.Filters.ParameterFilter.Create(name=code_block, filterRule=create, category=byName_3)

# group: Add filter to view, and set visibility
views = Views("{3D}")  # graph input
boolean = BoolSelector(false)  # graph input
addFilter = Orchid.RevitProject.Views.View.AddFilter(view=views, parameterFilter=create_2, visibility=boolean)
filters = View.Filters(view=addFilter)

# group: Filter rule for user-defined parameters (project, shared, and global parameters)
code_block_5 = CodeBlock { "test1"; }
# note: File: defaultProject_param
code_block_6 = CodeBlock()
# ---------- code_block_6.designscript (12 lines) ----------
// Parameter name
"TestStringParameter";
"TestIntegerParameter";
"TestDoubleParameter";

// Rule Type
"==";

// values
"Something";
500;
500.0;
# ----------------------------------------
create_3 = Orchid.RevitProject.Filters.FilterRule.Create(parameterName=code_block_6.out0, ruleType=code_block_6.out3, value=code_block_6.out4)
byName_4 = Orchid.RevitProject.Parameters.ProjectParameter.ByName(parameterName=code_block_6.out2)
create_4 = Orchid.RevitProject.Filters.FilterRule.Create(parameter=byName_4, ruleType=code_block_6.out3, value=code_block_6.out6)
create_5 = List.Create(item0=create_3, item1=create_4)
code_block_7 = CodeBlock { ["Doors","Windows"]; }
byName_5 = Category.ByName(name=code_block_7)
boolean_2 = BoolSelector(false)  # graph input
create_6 = Orchid.RevitProject.Filters.ParameterFilter.Create(name=code_block_5, filterRule=create_5, category=byName_5, andOr=boolean_2)
id = Element.Id(element=byName_4)
watch = Watch(id)
name = Element.Name(element=byName_4)
watch_2 = Watch(name)

# group: OOTB -> Filter rule for (element) parameters. Notice the need to convert between SI and Imperial units!
code_block_8 = CodeBlock { "test3"; }
code_block_9 = CodeBlock { ["Windows","Doors"]; }
byName_6 = Category.ByName(name=code_block_9)
code_block_10 = CodeBlock { "Greater"; "Width"; 1000; }
convert_by_units = DynamoUnitConvert(code_block_10.out2, MeasurementType="autodesk.unit.quantity:length-1.0.4", FromConversion="autodesk.unit.unit:millimeters-1.0.1", ToConversion="autodesk.unit.unit:feet-1.0.1")
code_block_11 = CodeBlock { "Windows"; }
byName_7 = Category.ByName(name=code_block_11)
all_elements_of_category_2 = ElementsOfCategory(Category=byName_7)
firstItem_2 = List.FirstItem(list=all_elements_of_category_2)
elementType_2 = Element.ElementType(element=firstItem_2)
parameterByName = Parameter.ParameterByName(element=elementType_2, name=code_block_10.out1)
byRuleType = Revit.Filter.FilterRule.ByRuleType(type=code_block_10.out0, value=convert_by_units, parameter=parameterByName)
byRules = Revit.Filter.ParameterFilterElement.ByRules(name=code_block_8, categories=byName_6, rules=byRuleType)

# group: Get FilterRule and convert so it can be sat as an AND filter
getRule = Orchid.RevitProject.Filters.ParameterFilter.GetRule(parameterFilter=byRules)
code_block_12 = CodeBlock { "test4"; }
boolean_3 = BoolSelector(true)  # graph input
create_7 = Orchid.RevitProject.Filters.ParameterFilter.Create(name=code_block_12, filterRule=getRule, category=byName_3, andOr=boolean_3)

# group: Add filter rule set
ruleTree = Orchid.RevitProject.Filters.ParameterFilter.RuleTree(parameterFilter=create_6)
addRule = Orchid.RevitProject.Filters.ParameterFilter.AddRule(parameterFilter=create_6, ruleTree=ruleTree, filterRule=create)
ruleTree_2 = Orchid.RevitProject.Filters.ParameterFilter.RuleTree(parameterFilter=addRule)
boolean_4 = BoolSelector(false)  # graph input
addRule_2 = Orchid.RevitProject.Filters.ParameterFilter.AddRule(parameterFilter=addRule, ruleTree=ruleTree_2, filterRule=getRule, andOr=boolean_4)
ruleTree_3 = Orchid.RevitProject.Filters.ParameterFilter.RuleTree(parameterFilter=addRule_2)
code_block_13 = CodeBlock { [3]; [3,2]; }
boolean_5 = BoolSelector(false)  # graph input
addRule_3 = Orchid.RevitProject.Filters.ParameterFilter.AddRule(parameterFilter=addRule_2, ruleTree=ruleTree_3, atIndex=code_block_13.out0, filterRule=create, andOr=boolean_5)
ruleTree_4 = Orchid.RevitProject.Filters.ParameterFilter.RuleTree(parameterFilter=addRule_3)
watch_3 = Watch(ruleTree_4)
watch_4 = Watch(ruleTree_3)
watch_5 = Watch(ruleTree_2)
watch_6 = Watch(ruleTree)

parameter_filters = ParameterFilter("Architectural")  # graph input
watch_7 = Watch(parameter_filters)
inDocument = Orchid.RevitProject.Filters.ParameterFilter.InDocument()
watch_8 = Watch(inDocument)
await_ = Orchid.Common.DataStream.Await(pass=code_block_5, waitFor=create_6)
byName_8 = Orchid.RevitProject.Filters.ParameterFilter.ByName(name=await_)
watch_9 = Watch(byName_8)

# group: Ruletype
code_block_14 = CodeBlock()
# ---------- code_block_14.designscript (25 lines) ----------
// Dynamo RuleTypes
// Please notice the spelling
// issue --> GeaterOrEqual
"BeginsWith";
"Contains";
"EndsWith";
"Equals";
"Greater";
"Less";
"GeaterOrEqual";
"GreaterOrEqual";
"LessOrEqual";
"NotBeginsWith";
"NotContains";
"NotEndsWith";
"NotEquals";

// Orchid additional
// Ruletypes
"==";
">";
"<";
">=";
"<=";
"!=";
# ----------------------------------------
select_rule_type = RuleTypes("Greater")  # graph input

# group: Converter
toRevitType = Orchid.Common.Object.ToRevitType(object=byName_8)
toDynamoType = Orchid.Common.Object.ToDynamoType(object=toRevitType)
watch_10 = Watch(toDynamoType)
watch_11 = Watch(toRevitType)

# group: Remove/Replace filter rule
code_block_15 = CodeBlock { [3]; [3,2]; }
replaceRule = Orchid.RevitProject.Filters.ParameterFilter.ReplaceRule(parameterFilter=addRule_3, ruleTree=ruleTree_4, atIndex=code_block_15.out0, filterRule=byRuleType)
ruleTree_5 = Orchid.RevitProject.Filters.ParameterFilter.RuleTree(parameterFilter=replaceRule)
code_block_16 = CodeBlock { 2; }
removeRule = Orchid.RevitProject.Filters.ParameterFilter.RemoveRule(parameterFilter=replaceRule, ruleTree=ruleTree_5, atIndex=code_block_16)
ruleTree_6 = Orchid.RevitProject.Filters.ParameterFilter.RuleTree(parameterFilter=removeRule)
watch_12 = Watch(ruleTree_6)
watch_13 = Watch(ruleTree_5)

ruleTree_7 = Orchid.RevitProject.Filters.ParameterFilter.RuleTree(parameterFilter=byRules)
watch_14 = Watch(ruleTree_7)
ruleTree_8 = Orchid.RevitProject.Filters.ParameterFilter.RuleTree(parameterFilter=create_7)
watch_15 = Watch(ruleTree_8)

# group: Clear rules
clearRules = Orchid.RevitProject.Filters.ParameterFilter.ClearRules(parameterFilter=create_7)  # frozen

# group: Get Filter Rule from Ruletree
code_block_17 = CodeBlock(ruleTree=ruleTree_4) { ruleTree[0]; ruleTree[3][0]; ruleTree[3][1]; }
getRule_2 = Orchid.RevitProject.Filters.ElementFilter.GetRule(elementFilter=code_block_17.out0)
watch_16 = Watch(getRule_2)
watch_17 = Watch(code_block_17.out2)
