# Dynamo graph Form.dyn (Dynamo 2.3.1.11775)
# packages: Orchid 203.3.0.8042

element_types = ElementTypes("Extrusion")  # graph input
all_elements_of_type = ElementsOfType(element_type=element_types)
solids = Element.Solids(element=all_elements_of_type)
watch = Watch(solids)
solid = Orchid.Common.Geometry.Form.Solid(form=all_elements_of_type)
watch_2 = Watch(solid)

# group: Dynamo Solid
get = Orchid.Common.Geometry.Form.Get()
solid_2 = Orchid.Common.Geometry.Form.Solid(form=get)
watch_3 = Watch(solid_2)
intersect = Orchid.Common.Geometry.Solid.Intersect(solid=solid_2)
watch_4 = Watch(intersect)

# group: Orchid Solid
get_2 = Orchid.Common.Geometry.Form.Get()
ocSolid = Orchid.Common.Geometry.Form.OcSolid(form=get_2)
intersect_2 = Orchid.Common.Geometry.OcSolid.Intersect(ocSolid=ocSolid)
watch_5 = Watch(intersect_2)
watch_6 = Watch(ocSolid)
union = Orchid.Common.Geometry.OcSolid.Union(ocSolid=ocSolid)
area = Orchid.Common.Geometry.OcSolid.Area(ocSolid=union)
watch_7 = Watch(area)
volumne = Orchid.Common.Geometry.OcSolid.Volumne(ocSolid=union)
watch_8 = Watch(volumne)
watch_9 = Watch(union)
toDynamoType = Orchid.Common.Geometry.OcSolid.ToDynamoType(ocSolid=union)
watch_10 = Watch(toDynamoType)

byUnion = Solid.ByUnion(solids=solid_2)

# group (continued): Dynamo Solid
area_2 = Solid.Area(solid=byUnion)
watch_11 = Watch(area_2)
volume = Solid.Volume(solid=byUnion)
watch_12 = Watch(volume)
watch_13 = Watch(byUnion)
toOrchidType = Orchid.Common.Geometry.Solid.ToOrchidType(solid=byUnion)
watch_14 = Watch(toOrchidType)

element_types_2 = ElementTypes("FreeFormElement")  # graph input
