# Dynamo graph Grid_R23.dyn "Grid" (Dynamo 2.16.1.2727)
# packages: Orchid 216.3.0.5794

# group: Get grid
code_block = CodeBlock { "Grids"; }
byName = Category.ByName(name=code_block)
all_elements_of_category = ElementsOfCategory(Category=byName)

# group: Get level location
# note: File: defaultBuilding
code_block_2 = CodeBlock { "Levels"; }
byName_2 = Category.ByName(name=code_block_2)
all_elements_of_category_2 = ElementsOfCategory(Category=byName_2)
elevation = Level.Elevation(level=all_elements_of_category_2)

# group: Adjust grid line extents
maximumItem = List.MaximumItem(list=elevation)
code_block_3 = CodeBlock()
# ---------- code_block_3.designscript (3 lines) ----------
// extent grid lines
// above/below model
2000;
# ----------------------------------------
minimumItem = List.MinimumItem(list=elevation)
code_block_4 = CodeBlock(top=maximumItem, value=code_block_3, bottom=minimumItem) { top+value; bottom-value; }
setVerticalExtents = Orchid.RevitProject.Datums.Grid.SetVerticalExtents(grid=all_elements_of_category, topExtent=code_block_4.out0, bottomExtent=code_block_4.out1)

# group: Move grid line extents
code_block_5 = CodeBlock()
# ---------- code_block_5.designscript (2 lines) ----------
// distance
-2000;
# ----------------------------------------
moveVerticalExtents = Orchid.RevitProject.Datums.Grid.MoveVerticalExtents(grid=all_elements_of_category, distance=code_block_5)

# group: Get vertical extents
getVerticalExtents = Orchid.RevitProject.Datums.Grid.GetVerticalExtents(grid=moveVerticalExtents)
watch = Watch(getVerticalExtents.Grid)
watch_2 = Watch(getVerticalExtents.TopExtent)
watch_3 = Watch(getVerticalExtents.BottomExtent)
