# Dynamo graph Group_R23.dyn (Dynamo 2.16.1.2727)
# packages: Orchid 216.3.0.5986

# group: Create group
# File: defaultProject
code_block = CodeBlock()
# ---------- code_block.designscript (11 lines) ----------
"CategoryType";

"Model";
"Annotation";
"AnalyticalModel";
"Internal";

["Model",
"Annotation",
"AnalyticalModel",
"Internal"];
# ----------------------------------------
enumByName = Orchid.AdeskApp.Revit.EnumByName(enumType=code_block.out0, valueName=code_block.out1)
byCategoryType = Orchid.RevitProject.Elements.Element.ByCategoryType(categoryType=enumByName)
watch = Watch(byCategoryType.Element)
code_block_2 = CodeBlock { "test"; }
flatten = List.Flatten(list=byCategoryType.Element)
create = Orchid.RevitProject.Elements.Group.Create(name=code_block_2, element=flatten)

# group: Group delete
code_block_3 = CodeBlock { "test"; }
delete = Orchid.RevitProject.Elements.Group.Delete(name=code_block_3)  # frozen
delete_2 = Orchid.RevitProject.Elements.Group.Delete()  # frozen; unwired: group
getByName = Orchid.RevitProject.Elements.Group.GetByName(name=code_block_3)
delete_3 = Orchid.RevitProject.Elements.Group.Delete(group=getByName)  # frozen
groups = Group("test")

# group: Group ungroup
code_block_4 = CodeBlock { "test"; }
unGroup = Orchid.RevitProject.Elements.Group.UnGroup(name=code_block_4)  # frozen
unGroup_2 = Orchid.RevitProject.Elements.Group.UnGroup()  # frozen; unwired: group
getByName_2 = Orchid.RevitProject.Elements.Group.GetByName(name=code_block_4)
unGroup_3 = Orchid.RevitProject.Elements.Group.UnGroup(group=getByName_2)  # frozen
groups_2 = Group("test")

# group: GroupType delete
code_block_5 = CodeBlock { "test"; }
delete_4 = Orchid.RevitProject.Elements.GroupType.Delete(name=code_block_5)  # frozen
delete_5 = Orchid.RevitProject.Elements.GroupType.Delete()  # frozen; unwired: groupType
groupTypes = GroupType("test")
