# Dynamo graph Ifc_R22.dyn (Dynamo 2.12.1.8246)
# packages: Orchid 206.3.1.8224

# group: Select IFC setting
code_block = CodeBlock { "<In-Session Setup>"; "IFC2x3 Coordination View 2.0"; "DanEDU - IFC2x3 Coordination View 2.0"; }
o_ifc_settingbyname = Orchid.IfcExport.IFC.SettingByName(name=code_block.out0)

# group: IFC setting --> General
o_ifc_versions = Version("IFC4 Design Transfer View")  # graph input
o_ifc_exchange_requirements = ExchangeRequirement("Architectural Reference Exchange")
o_ifc_file_types = FileType("IFC")  # graph input
o_ifc_space_boundaries = SpaceBoundary("1st Level")  # graph input
o_ifc_project_origin = SitePlacement("Internal coordinates")  # graph input
boolean = BoolSelector(true)  # graph input
o_ifc_settinggeneral = Orchid.IfcExport.IFC.SettingGeneral(setting=o_ifc_settingbyname, ifcVersion=o_ifc_versions, exchangeRequirement=o_ifc_exchange_requirements, ifcFileType=o_ifc_file_types, spaceBoundary=o_ifc_space_boundaries, projectOrigin=o_ifc_project_origin, splitByLevel=boolean)
o_phases = Phase("New Construction")

# group: IFC setting --> Additional/LOD
boolean_2 = BoolSelector(true)  # graph input
o_ifc_level_of_detail = LevelOfDetail("Medium")  # graph input
o_ifc_settingadditional = Orchid.IfcExport.IFC.SettingAdditional(setting=o_ifc_settinggeneral, visibleElements=boolean_2, levelOfDetail=o_ifc_level_of_detail)

# group: file
o_document_directory = Orchid.RevitProject.Common.Document.Directory()
code_block_2 = CodeBlock { 1; }
o_directory_subpath = Orchid.Common.Directory.SubPath(directory=o_document_directory, remove=code_block_2)
string = StringInput("DanEDU IFC export.txt")  # graph input
code_block_3 = CodeBlock(t1=o_directory_subpath, t2=string) { t1+"\\"+t2; }

# group: IFC setting --> Property
boolean_3 = BoolSelector(true)  # graph input
o_ifc_settingproperty = Orchid.IfcExport.IFC.SettingProperty(setting=o_ifc_settingadditional, baseQuantities=boolean_3, userProperty=boolean_3, userPropertyFile=code_block_3)

# group: IFC setting --> Advanced
boolean_4 = BoolSelector(true)  # graph input
o_ifc_settingadvanced = Orchid.IfcExport.IFC.SettingAdvanced(setting=o_ifc_settingproperty, storeGuid=boolean_4)

# group: file
o_document_directory_2 = Orchid.RevitProject.Common.Document.Directory()
string_2 = StringInput("test")  # graph input
code_block_4 = CodeBlock(t1=o_document_directory_2, t2=string_2) { t1+"\\"+t2; }

# group: IFC Export
views = Views("{3D}")  # graph input
o_phases_2 = Phase("Existing")
boolean_5 = BoolSelector(true)  # graph input
o_ifc_export = Orchid.IfcExport.IFC.Export(setting=o_ifc_settingadvanced, view=views, phase=o_phases_2, file=code_block_4, overwrite=boolean_5)
watch = Watch(o_ifc_export)

# group: IFC setting file format
type = Object.Type(object=o_ifc_settingadvanced)
watch_2 = Watch(type)
watch_3 = Watch(o_ifc_settingadvanced)

# group: IFC Export --> Multiple document export
# note: Can't run simultaneously in
# Revit versions below 2021
string_3 = StringInput(".\defaultBuilding.rvt")  # graph input; frozen
o_document_backgroundopen = Orchid.RevitProject.Common.Document.BackgroundOpen(file=string_3)
o_ifc_export_2 = Orchid.IfcExport.IFC.Export(document=o_document_backgroundopen)
o_datastream_await = Orchid.Common.DataStream.Await(pass=o_document_backgroundopen, waitFor=o_ifc_export_2)
o_document_close = Orchid.RevitProject.Common.Document.Close(document=o_datastream_await)
watch_4 = Watch(o_ifc_export_2)

# group: IFC Export based on prebuild IFC setting and a view
o_ifc_setting = Setting("IFC2x3 Coordination View 2.0")  # graph input
o_ifc_settingbyname_2 = Orchid.IfcExport.IFC.SettingByName(name=o_ifc_setting)
views_2 = Views("{3D}")  # graph input
o_ifc_export_3 = Orchid.IfcExport.IFC.Export(setting=o_ifc_settingbyname_2, view=views_2)

# group: IFC File Type
o_ifc_file_types_2 = FileType("IFC")  # graph input
string_4 = StringInput("ifc")  # graph input
o_ifc_filetypebyname = Orchid.IfcExport.IFC.FileTypeByName(name=string_4)
o_ifc_allfiletype = Orchid.IfcExport.IFC.AllFileType()

# group: IFC Version
o_ifc_versions_2 = Version("IFC2x3 Coordination View 2.0")  # graph input
string_5 = StringInput("IFC2x3")  # graph input
o_ifc_versionbyname = Orchid.IfcExport.IFC.VersionByName(name=string_5)
o_ifc_allversion = Orchid.IfcExport.IFC.AllVersion()

# group: IFC Setting
o_ifc_settings = Setting("IFC2x3 Coordination View 2.0")  # graph input
string_6 = StringInput("IFC2x3 Coordination View 2.0")  # graph input
o_ifc_settingbyname_3 = Orchid.IfcExport.IFC.SettingByName(name=string_6)
o_ifc_allsetting = Orchid.IfcExport.IFC.AllSetting()

# group: IFC Setting
string_7 = StringInput("dummy")  # graph input; frozen
o_ifc_createsetting = Orchid.IfcExport.IFC.CreateSetting(name=string_7)
code_block_5 = CodeBlock { "<In-Session Setup>"; "IFC2x3 Coordination View 2.0"; "DanEDU - IFC2x3 Coordination View 2.0"; }
o_ifc_settingbyname_4 = Orchid.IfcExport.IFC.SettingByName(name=code_block_5.out1)
o_ifc_duplicatesetting = Orchid.IfcExport.IFC.DuplicateSetting(setting=o_ifc_settingbyname_4, name=string_7)
o_ifc_renamesetting = Orchid.IfcExport.IFC.RenameSetting(setting=o_ifc_settingbyname_4, name=string_7)
o_ifc_removesetting = Orchid.IfcExport.IFC.RemoveSetting(name=string_7)
string_8 = StringInput("..\testIFCexport.json")  # graph input; frozen
o_ifc_importsetting = Orchid.IfcExport.IFC.ImportSetting(file=string_8)

watch_5 = Watch(o_ifc_allfiletype)
watch_6 = Watch(o_ifc_allversion)
watch_7 = Watch(o_ifc_allsetting)
