# Dynamo graph Level-ReferencePlane_R23.dyn (Dynamo 2.16.2.5624)
# packages: Orchid 2.16.4.6167

# group: All reference planes
inDocument = Orchid.RevitProject.Datums.ReferencePlane.InDocument()
plane = ReferencePlane.Plane(referencePlane=inDocument)
watch = Watch(plane)
name = Element.Name(element=inDocument)
watch_2 = Watch(name)
watch_3 = Watch(inDocument)

# group: ReferencePlane by name
code_block = CodeBlock()
# ---------- code_block.designscript (9 lines) ----------
// if a reference plane is named
// "Reference Plane", then its a
// generic name, there should fail
// when requested by that name
"Reference Plane";

// Valid name values
"Site";
"Some dummy name";
# ----------------------------------------
byName = Orchid.RevitProject.Datums.ReferencePlane.ByName(name=code_block.out1)
watch_4 = Watch(byName)

# group: All levels -> Structural and/or Building Story
inDocument_2 = Orchid.RevitProject.Datums.Level.InDocument()
isStructural = Orchid.RevitProject.Datums.Level.IsStructural(level=inDocument_2)
filterByBoolMask = List.FilterByBoolMask(list=inDocument_2, mask=isStructural)
watch_5 = Watch(filterByBoolMask.in)
isBuildingStory = Orchid.RevitProject.Datums.Level.IsBuildingStory(level=inDocument_2)
filterByBoolMask_2 = List.FilterByBoolMask(list=inDocument_2, mask=isBuildingStory)
watch_6 = Watch(filterByBoolMask_2.in)
structural = Orchid.RevitProject.Datums.Level.Structural()
watch_7 = Watch(structural)
buildingStory = Orchid.RevitProject.Datums.Level.BuildingStory()
watch_8 = Watch(buildingStory)

# group: Get/Set Elevation
inDocument_3 = Orchid.RevitProject.Datums.Level.InDocument()
boolean = BoolSelector(false)
getElevation = Orchid.RevitProject.Datums.Level.GetElevation(level=inDocument_3, origin=boolean)
watch_9 = Watch(getElevation)
code_block_2 = CodeBlock { [0,3200,6400]; [2000,5200,8400]; }
setElevation = Orchid.RevitProject.Datums.Level.SetElevation(level=inDocument_3, value=code_block_2.out1)
watch_10 = Watch(setElevation)

# group: Level by name
code_block_3 = CodeBlock { "Level 1"; "Some dummy name"; }
byName_2 = Orchid.RevitProject.Datums.Level.ByName(name=code_block_3.out0)
watch_11 = Watch(byName_2)

# group: Propagation View
# File: defaultProject_extended
inDocument_4 = Orchid.RevitProject.Datums.Level.InDocument()
activeView = Orchid.RevitProject.Common.Document.ActiveView()
isVisibleInView = Orchid.RevitProject.Datums.Datum.IsVisibleInView(element=inDocument_4, view=activeView)
filterByBoolMask_3 = List.FilterByBoolMask(list=inDocument_4, mask=isVisibleInView)
getPropagationView = Orchid.RevitProject.Datums.Datum.GetPropagationView(element=filterByBoolMask_3.in, view=activeView)
uniqueItems = List.UniqueItems(list=getPropagationView)
setPropagationView = Orchid.RevitProject.Datums.Datum.SetPropagationView(element=filterByBoolMask_3.in, view=activeView, target=uniqueItems)
isVisibleInView_2 = Orchid.RevitProject.Elements.Element.IsVisibleInView(element=inDocument_4, view=activeView)
