# Dynamo graph LevelDependingViews.dyn (Dynamo 2.16.1.2727)
# packages: Orchid 216.3.0.5794

# group: View
# note: File: defaultProject
plan = Orchid.RevitProject.Views.View.Plan()
associatedLevel = Orchid.RevitProject.Views.View.AssociatedLevel(view=plan)
watch = Watch(associatedLevel)

# group: Level
buildingStory = Orchid.RevitProject.Datums.Level.BuildingStory()
allAssociatedPlans = Orchid.RevitProject.Datums.Level.AllAssociatedPlans(level=buildingStory)
onSheet = Orchid.RevitProject.Views.View.OnSheet(view=allAssociatedPlans)
filterByBoolMask = List.FilterByBoolMask(list=allAssociatedPlans, mask=onSheet)
inDocument = Orchid.RevitProject.Datums.Level.InDocument()
associatedFloorPlan = Orchid.RevitProject.Datums.Level.AssociatedFloorPlan(level=buildingStory)
watch_2 = Watch(associatedFloorPlan)
watch_3 = Watch(allAssociatedPlans)

# group: Associated view, viewport, and sheet
associated = Orchid.RevitProject.Views.View.Associated(view=filterByBoolMask.in)
clean = Orchid.Common.List.Clean(list=associated.Viewport)
associated_2 = Orchid.RevitProject.Views.Viewport.Associated(viewport=clean)
watch_4 = Watch(associated_2.View)
clean_2 = Orchid.Common.List.Clean(list=associated.Sheet)
watch_5 = Watch(clean_2)
watch_6 = Watch(clean)
associated_3 = Orchid.RevitProject.Views.Sheet.Associated(sheet=clean_2)
watch_7 = Watch(associated_3.View)
watch_8 = Watch(associated_2.Sheet)
watch_9 = Watch(associated_3.Viewport)

# group: Sheet
code_block = CodeBlock { "A.101"; "Level 1 (door)"; }
getByNameAndNumber = Orchid.RevitProject.Views.Sheet.GetByNameAndNumber(number=code_block.out0, name=code_block.out1)
watch_10 = Watch(getByNameAndNumber)

# group: Viewport label
getLabel = Orchid.RevitProject.Views.Viewport.GetLabel(viewport=clean)
watch_11 = Watch(getLabel)
label = Orchid.RevitProject.Views.Viewport.Label()
watch_12 = Watch(label)
string = StringInput("Title")
labelByName = Orchid.RevitProject.Views.Viewport.LabelByName(name=string)
setLabel = Orchid.RevitProject.Views.Viewport.SetLabel(viewport=clean, label=labelByName)
name = Element.Name(element=label)
watch_13 = Watch(name)
