# Dynamo graph LinkedCloudDocumentRepath_R23.dyn "LinkedCloudDocumentRepath" (Dynamo 2.16.1.2727)
# packages: Orchid 216.3.0.5794

# group: Get Revit Linked document
# note: File: Linked360Project
getRevitLink = Orchid.RevitProject.Common.Link.GetRevitLink()
info = Orchid.RevitProject.Common.Link.Info(link=getRevitLink)
list_create = List.Create(item0=info.Name, item1=info.Status, item2=info.ReferenceType, item3=info.Path, item4=info.PathType)
watch = Watch(list_create)

# group: Repath Cloud link to local path
cloudToLocal = Orchid.Common.File.CloudToLocal(path=info.Path)
watch_2 = Watch(cloudToLocal)
repath = Orchid.RevitProject.Common.Link.Repath(link=getRevitLink, file=cloudToLocal)
cloudToLocal_2 = Orchid.Common.Directory.CloudToLocal(path=info.Path)
watch_3 = Watch(cloudToLocal_2)
