# Dynamo graph LinkedCloudDocument_R23.dyn "LinkedCloudDocument" (Dynamo 2.16.1.2727)
# packages: Orchid 216.3.0.5794

# group: Get Revit Linked document
getRevitLink = Orchid.RevitProject.Common.Link.GetRevitLink()
info = Orchid.RevitProject.Common.Link.Info(link=getRevitLink)
list_create = List.Create(item0=info.Name, item1=info.Status, item2=info.ReferenceType, item3=info.Path, item4=info.PathType)
watch = Watch(list_create)

# group: Get Link
# note: File: Linked360Project
getLink = Orchid.RevitProject.Common.Link.GetLink()
watch_2 = Watch(getLink.Type)
watch_3 = Watch(getLink.Link)

# group: Get Link by type
link_types = LinkType("Revit Link")
getLinkByType = Orchid.RevitProject.Common.Link.GetLinkByType(linkType=link_types)
watch_4 = Watch(getLinkByType)
code_block = CodeBlock { "RevitLink"; }
