# Dynamo graph LinkedDocument-pin.dyn (Dynamo 2.3.1.11775)
# packages: Orchid 203.3.0.8042, Orchid 203.3.0.8045

string = StringInput(".\defaultProject_2020.rvt")  # graph input
backgroundOpen = Orchid.RevitProject.Common.Document.BackgroundOpen(file=string)

# group: Link revit file
string_2 = StringInput(".\defaultBuilding_2020.rvt")  # graph input
link_positioning = Positioning("Origin")  # graph input
code_block = CodeBlock { 10000; }
byCoordinates = Point.ByCoordinates(y=code_block)
attachment_type = AttachmentType("Overlay")  # graph input
path_types = PathType("Relative")
setRevitFile = Orchid.RevitProject.Common.Link.SetRevitFile(document=backgroundOpen, file=string_2, positioning=link_positioning, referencePoint=byCoordinates, attachmentType=attachment_type, pathType=path_types)

pin = Orchid.RevitProject.Elements.Element.Pin(document=backgroundOpen, element=setRevitFile.Instance)
await_ = Orchid.Common.DataStream.Await(pass=backgroundOpen, waitFor=pin)
name = Orchid.RevitProject.Common.Document.Name(document=backgroundOpen)
code_block_2 = CodeBlock(name=name) { name+"_copy.rvt"; true; }
saveAs = Orchid.RevitProject.Common.Document.SaveAs(document=await_, name=code_block_2.out0, overwrite=code_block_2.out1)
close = Orchid.RevitProject.Common.Document.Close(document=saveAs)
watch = Watch(setRevitFile.Instance)
watch_2 = Watch(setRevitFile.Link)

# group: Pin
categories = Categories("OST_Walls")  # graph input
all_elements_of_category = ElementsOfCategory(Category=categories)  # frozen
pin_2 = Orchid.RevitProject.Elements.Element.Pin(element=all_elements_of_category)
unPin = Orchid.RevitProject.Elements.Element.UnPin(element=all_elements_of_category)

# group: Pin
categories_2 = Categories("OST_Walls")  # graph input
all_elements_of_category_2 = ElementsOfCategory(Category=categories_2)  # frozen
pin_3 = Orchid.RevitProject.Elements.Element.Pin(element=all_elements_of_category_2)
unPin_2 = Orchid.RevitProject.Elements.Element.UnPin(element=all_elements_of_category_2)
