# Dynamo graph LinkedDocument-pin_R23.dyn (Dynamo 2.16.1.2727)
# packages: Orchid 216.3.0.5828

# group: 
# File: defaultProject
string = StringInput("%userprofile%\Programming\Testing\Data\2023_Data\defaultProject.rvt")  # graph input
backgroundOpen = Orchid.RevitProject.Common.Document.BackgroundOpen(file=string)

# group: Link revit file
string_2 = StringInput("%userprofile%\Programming\Testing\Data\2023_Data\\defaultBuilding.rvt")  # graph input
link_positionings = Positioning("Origin")  # graph input
code_block = CodeBlock { 10000; }
byCoordinates = Point.ByCoordinates(y=code_block)
attachment_types = AttachmentType("Overlay")  # graph input
path_types = PathType("Relative")
setRevitFile = Orchid.RevitProject.Common.Link.SetRevitFile(document=backgroundOpen, file=string_2, positioning=link_positionings, referencePoint=byCoordinates, attachmentType=attachment_types, pathType=path_types)

pin = Orchid.RevitProject.Elements.Element.Pin(element=setRevitFile.Instance)
await_ = Orchid.Common.DataStream.Await(pass=backgroundOpen, waitFor=pin)
name = Orchid.RevitProject.Common.Document.Name(document=backgroundOpen)
code_block_2 = CodeBlock(name=name) { name+"_copy.rvt"; true; }
saveAs = Orchid.RevitProject.Common.Document.SaveAs(document=await_, name=code_block_2.out0, overwrite=code_block_2.out1)
watch = Watch(setRevitFile.Instance)
watch_2 = Watch(setRevitFile.Link)

# group: Pin
categories = Categories("OST_Walls")  # graph input
all_elements_of_category = ElementsOfCategory(Category=categories)
pin_2 = Orchid.RevitProject.Elements.Element.Pin(element=all_elements_of_category)
unPin = Orchid.RevitProject.Elements.Element.UnPin(element=all_elements_of_category)  # frozen

# group: Pin
categories_2 = Categories("OST_Floors")  # graph input
all_elements_of_category_2 = ElementsOfCategory(Category=categories_2)
pin_3 = Orchid.RevitProject.Elements.Element.Pin(element=all_elements_of_category_2)
unPin_2 = Orchid.RevitProject.Elements.Element.UnPin(element=all_elements_of_category_2)  # frozen
