# Dynamo graph LinkedDocument_R23.dyn (Dynamo 2.16.1.2727)
# packages: Orchid 216.3.0.5828

# group: Get all links
getLink = Orchid.RevitProject.Common.Link.GetLink()
watch = Watch(getLink.Link)
watch_2 = Watch(getLink.Type)

# group: Get links by type
code_block = CodeBlock { "RevitLink"; }
link_types = LinkType("Revit Link")
getLinkByType = Orchid.RevitProject.Common.Link.GetLinkByType(linkType=link_types)
watch_3 = Watch(getLinkByType)

# group: Link cad file
string = StringInput("%userprofile%\Programming\Testing\Data\Drawing1.dwg")  # graph input
link_positionings = Positioning("Center")  # graph input
import_units = Unit("Millimeter")  # graph input
import_color_modes = ColorMode("BlackAndWhite")  # graph input
code_block_2 = CodeBlock { -1000; }
byCoordinates = Point.ByCoordinates(y=code_block_2)
model_views = ModelView("Level 1 (door)")  # graph input
boolean = BoolSelector(false)  # graph input
setCadFile = Orchid.RevitProject.Common.Link.SetCadFile(file=string, positioning=link_positionings, unit=import_units, colorMode=import_color_modes, referencePoint=byCoordinates, view=model_views, orientToView=boolean)
watch_4 = Watch(setCadFile.Instance)
watch_5 = Watch(setCadFile.Link)

# group: Link revit file
# File: defaultProject
# Output: LinkedProject
string_2 = StringInput("defaultBuilding.rvt")  # graph input
link_positionings_2 = Positioning("Origin")  # graph input
code_block_3 = CodeBlock { 10000; }
byCoordinates_2 = Point.ByCoordinates(y=code_block_3)
attachment_types = AttachmentType("Overlay")  # graph input
path_types = PathType("Relative")
setRevitFile = Orchid.RevitProject.Common.Link.SetRevitFile(file=string_2, positioning=link_positionings_2, referencePoint=byCoordinates_2, attachmentType=attachment_types, pathType=path_types)
watch_6 = Watch(setRevitFile.Link)
watch_7 = Watch(setRevitFile.Instance)

# group: Convert to CAD link
select_model_element = DSModelElementSelection()  # nothing selected; graph input; frozen
watch_8 = Watch(select_model_element)
convertToLink = Orchid.RevitProject.Common.Link.ConvertToLink(instance=select_model_element)
watch_9 = Watch(convertToLink)

# group: CAD links
getCadLink = Orchid.RevitProject.Common.Link.GetCadLink()
watch_10 = Watch(getCadLink)
name = Element.Name(element=getCadLink)
watch_11 = Watch(name)
reload = Orchid.RevitProject.Common.Link.Reload(link=getCadLink)
watch_12 = Watch(reload)

# group: Revit links
getRevitLink = Orchid.RevitProject.Common.Link.GetRevitLink()
name_2 = Element.Name(element=getRevitLink)
watch_13 = Watch(name_2)
reload_2 = Orchid.RevitProject.Common.Link.Reload(link=getRevitLink)
watch_14 = Watch(getRevitLink)
unload = Orchid.RevitProject.Common.Link.Unload(link=getRevitLink)  # frozen
string_3 = StringInput("defaultBuilding.rvt")  # graph input
repath = Orchid.RevitProject.Common.Link.Repath(link=getRevitLink, file=string_3)  # frozen
path_types_2 = PathType("Relative")

# group: Convert to Revit link
select_model_element_2 = DSModelElementSelection()  # nothing selected; graph input; frozen
watch_15 = Watch(select_model_element_2)
convertToLink_2 = Orchid.RevitProject.Common.Link.ConvertToLink(instance=select_model_element_2)
watch_16 = Watch(convertToLink_2)

# group: Dropdown selector
external_links = Links("Standard")  # graph input
watch_17 = Watch(external_links)
revit_links = RevitLinks("defaultBuilding.rvt")
watch_18 = Watch(revit_links)
cad_links = CadLinks("Drawing1")
watch_19 = Watch(cad_links)

# group: Link cad file
string_4 = StringInput("%userprofile%\Programming\Testing\Data\Drawing1.dwg")  # graph input
code_block_4 = CodeBlock { -1000; }
byCoordinates_3 = Point.ByCoordinates(x=code_block_4, y=code_block_4)
model_views_2 = ModelView("Level 1 (door)")  # graph input
boolean_2 = BoolSelector(true)  # graph input
setCadFile_2 = Orchid.RevitProject.Common.Link.SetCadFile(file=string_4, positioning=byCoordinates_3, colorMode=model_views_2, referencePoint=boolean_2)  # frozen; unwired: view
watch_20 = Watch(setCadFile_2.Instance)
watch_21 = Watch(setCadFile_2.Link)
