# Dynamo graph Load families.dyn (Dynamo 2.16.1.2727)
# packages: Orchid 216.3.0.5794

# note: File: defaultProject
directory_path = StringInput("%userprofile%\Programming\Testing\Data\testSet")  # graph input
string = StringInput("*.rfa")  # graph input
boolean = BoolSelector(true)  # graph input
contents = Orchid.Common.Directory.Contents(directory=directory_path, searchString=string, deepSearch=boolean)
backgroundOpen = Orchid.RevitProject.Common.Document.BackgroundOpen(file=contents)
code_block = CodeBlock()
# ---------- code_block.designscript (8 lines) ----------
//Parameter name
"Creator Build";
//SP Parameter group
"Sheet & Project";
//GroupType
"AdskModelProperties";
//Instances
true;
# ----------------------------------------
byName = Orchid.AdeskApp.GroupType.ByName(string=code_block.out2)
add = Orchid.RevitFamily.SharedParameter.Add(familyDocument=backgroundOpen, parameterName=code_block.out0, groupName=code_block.out1, groupType=byName, instance=code_block.out3)
await_ = Orchid.Common.DataStream.Await(pass=backgroundOpen, waitFor=add)
code_block_2 = CodeBlock { "Creator Build"; }
creator_build = StringInput("\"2022.0406.0\"")  # graph input
set = Orchid.RevitFamily.Formula.Set(familyDocument=await_, parameterName=code_block_2, value=creator_build)
await_2 = Orchid.Common.DataStream.Await(pass=await_, waitFor=set)
load = Orchid.RevitProject.Elements.Family.Load(familyDocument=await_2)
await_3 = Orchid.Common.DataStream.Await(pass=await_2, waitFor=load)
close = Orchid.RevitProject.Common.Document.Close(document=await_3)
