# Dynamo graph Location-Level-ReferencePlane.dyn (Dynamo 2.16.1.2727)
# packages: Orchid 216.3.0.5799

# group: Project location - Internal point
get = Orchid.RevitProject.Common.Location.Get()
watch = Watch(get)
name = Element.Name(element=get)
watch_2 = Watch(name)
project_origin = Origin("Internal")  # graph input
set = Orchid.RevitProject.Common.Location.Set(location=project_origin)
watch_3 = Watch(set)
getPoint = Orchid.RevitProject.Common.Location.GetPoint(location=project_origin)
watch_4 = Watch(getPoint)
getVector = Orchid.RevitProject.Common.Location.GetVector(location=project_origin)
watch_5 = Watch(getVector)

# group: Project Position -> Survey point
code_block = CodeBlock { 0; 2000; -2000; 10; }
setProjectPosition = Orchid.RevitProject.Common.Location.SetProjectPosition(northSouth=code_block.out1, eastWest=code_block.out1, elevation=code_block.out1, angle=code_block.out3)  # frozen
select_model_element = DSModelElementSelection()  # 1 picked in the model; graph input
setProjectPosition_2 = Orchid.RevitProject.Common.Location.SetProjectPosition(element=select_model_element, northSouth=code_block.out0, eastWest=code_block.out0, elevation=code_block.out0, angle=code_block.out0)
getProjectPosition = Orchid.RevitProject.Common.Location.GetProjectPosition(element=select_model_element)
watch_6 = Watch(getProjectPosition.Angle)
watch_7 = Watch(getProjectPosition.Elevation)
watch_8 = Watch(getProjectPosition.EastWest)
watch_9 = Watch(getProjectPosition.NorthSouth)

# group: All levels -> Structural and/or Building Story
inDocument = Orchid.RevitProject.Datums.Level.InDocument()
isStructural = Orchid.RevitProject.Datums.Level.IsStructural(level=inDocument)
filterByBoolMask = List.FilterByBoolMask(list=inDocument, mask=isStructural)
watch_10 = Watch(filterByBoolMask.in)
isBuildingStory = Orchid.RevitProject.Datums.Level.IsBuildingStory(level=inDocument)
filterByBoolMask_2 = List.FilterByBoolMask(list=inDocument, mask=isBuildingStory)
watch_11 = Watch(filterByBoolMask_2.in)
structural = Orchid.RevitProject.Datums.Level.Structural()
watch_12 = Watch(structural)
buildingStory = Orchid.RevitProject.Datums.Level.BuildingStory()
watch_13 = Watch(buildingStory)

# group: Get/Set Elevation
inDocument_2 = Orchid.RevitProject.Datums.Level.InDocument()
boolean = BoolSelector(false)
getElevation = Orchid.RevitProject.Datums.Level.GetElevation(level=inDocument_2, origin=boolean)
watch_14 = Watch(getElevation)
code_block_2 = CodeBlock { [0,3200,6400]; [2000,5200,8400]; }
setElevation = Orchid.RevitProject.Datums.Level.SetElevation(level=inDocument_2, value=code_block_2.out1)
watch_15 = Watch(setElevation)

# group: Level by name
code_block_3 = CodeBlock { "Level 1"; "Some dummy name"; }
byName = Orchid.RevitProject.Datums.Level.ByName(name=code_block_3.out0)
watch_16 = Watch(byName)

# group: Propagation View
inDocument_3 = Orchid.RevitProject.Datums.Level.InDocument()
activeView = Orchid.RevitProject.Common.Document.ActiveView()
isVisibleInView = Orchid.RevitProject.Datums.Datum.IsVisibleInView(element=inDocument_3, view=activeView)
filterByBoolMask_3 = List.FilterByBoolMask(list=inDocument_3, mask=isVisibleInView)
getPropagationView = Orchid.RevitProject.Datums.Datum.GetPropagationView(element=filterByBoolMask_3.in, view=activeView)
uniqueItems = List.UniqueItems(list=getPropagationView)
setPropagationView = Orchid.RevitProject.Datums.Datum.SetPropagationView(element=filterByBoolMask_3.in, view=activeView, target=uniqueItems)
isVisibleInView_2 = Orchid.RevitProject.Elements.Element.IsVisibleInView(element=inDocument_3, view=activeView)

# group: Site - World Coordinate
siteLocation = Orchid.RevitProject.Common.Location.SiteLocation()
watch_17 = Watch(siteLocation.Longitude)
watch_18 = Watch(siteLocation.Latitude)

# group: ReferencePlane by name
code_block_4 = CodeBlock()
# ---------- code_block_4.designscript (9 lines) ----------
// if a reference plane is named
// "Reference Plane", then its a
// generic name, there should fail
// when requested by that name
"Reference Plane";

// Valid name values
"Site";
"Some dummy name";
# ----------------------------------------
byName_2 = Orchid.RevitProject.Datums.ReferencePlane.ByName(name=code_block_4.out1)
watch_19 = Watch(byName_2)

# group: All reference planes
inDocument_4 = Orchid.RevitProject.Datums.ReferencePlane.InDocument()
plane = ReferencePlane.Plane(referencePlane=inDocument_4)
watch_20 = Watch(plane)
name_2 = Element.Name(element=inDocument_4)
watch_21 = Watch(name_2)
watch_22 = Watch(inDocument_4)

# group: Obsolete warning
inDocument_5 = Orchid.RevitProject.Datums.Level.InDocument()
watch_23 = Watch(inDocument_5)
