# Dynamo graph Location-Level-ReferencePlane_R23.dyn (Dynamo 2.16.2.5624)
# packages: Orchid 2.16.4.6167

# group: All reference planes
inDocument = Orchid.RevitProject.Datums.ReferencePlane.InDocument()
plane = ReferencePlane.Plane(referencePlane=inDocument)
watch = Watch(plane)
name = Element.Name(element=inDocument)
watch_2 = Watch(name)
watch_3 = Watch(inDocument)

# group: ReferencePlane by name
code_block = CodeBlock()
# ---------- code_block.designscript (9 lines) ----------
// if a reference plane is named
// "Reference Plane", then its a
// generic name, there should fail
// when requested by that name
"Reference Plane";

// Valid name values
"Site";
"Some dummy name";
# ----------------------------------------
byName = Orchid.RevitProject.Datums.ReferencePlane.ByName(name=code_block.out1)
watch_4 = Watch(byName)

# group: Project Position -> Survey point
project_locations = ProjectLocation("Internal")  # graph input
getProjectPosition = Orchid.RevitProject.Common.Location.GetProjectPosition(element=project_locations)
watch_5 = Watch(getProjectPosition.Angle)
watch_6 = Watch(getProjectPosition.Elevation)
select_model_element = DSModelElementSelection()  # 1 picked in the model; graph input
watch_7 = Watch(getProjectPosition.EastWest)
watch_8 = Watch(getProjectPosition.NorthSouth)

# group: All levels -> Structural and/or Building Story
inDocument_2 = Orchid.RevitProject.Datums.Level.InDocument()
isStructural = Orchid.RevitProject.Datums.Level.IsStructural(level=inDocument_2)
filterByBoolMask = List.FilterByBoolMask(list=inDocument_2, mask=isStructural)
watch_9 = Watch(filterByBoolMask.in)
isBuildingStory = Orchid.RevitProject.Datums.Level.IsBuildingStory(level=inDocument_2)
filterByBoolMask_2 = List.FilterByBoolMask(list=inDocument_2, mask=isBuildingStory)
watch_10 = Watch(filterByBoolMask_2.in)
structural = Orchid.RevitProject.Datums.Level.Structural()
watch_11 = Watch(structural)
buildingStory = Orchid.RevitProject.Datums.Level.BuildingStory()
watch_12 = Watch(buildingStory)

# group: Get/Set Elevation
inDocument_3 = Orchid.RevitProject.Datums.Level.InDocument()
boolean = BoolSelector(false)
getElevation = Orchid.RevitProject.Datums.Level.GetElevation(level=inDocument_3, origin=boolean)
watch_13 = Watch(getElevation)
code_block_2 = CodeBlock { [0,3200,6400]; [2000,5200,8400]; }
setElevation = Orchid.RevitProject.Datums.Level.SetElevation(level=inDocument_3, value=code_block_2.out1)
watch_14 = Watch(setElevation)

# group: Level by name
code_block_3 = CodeBlock { "Level 1"; "Some dummy name"; }
byName_2 = Orchid.RevitProject.Datums.Level.ByName(name=code_block_3.out0)
watch_15 = Watch(byName_2)

# group: Propagation View
# File: defaultProject_extended
inDocument_4 = Orchid.RevitProject.Datums.Level.InDocument()
activeView = Orchid.RevitProject.Common.Document.ActiveView()
isVisibleInView = Orchid.RevitProject.Datums.Datum.IsVisibleInView(element=inDocument_4, view=activeView)
filterByBoolMask_3 = List.FilterByBoolMask(list=inDocument_4, mask=isVisibleInView)
getPropagationView = Orchid.RevitProject.Datums.Datum.GetPropagationView(element=filterByBoolMask_3.in, view=activeView)
uniqueItems = List.UniqueItems(list=getPropagationView)
setPropagationView = Orchid.RevitProject.Datums.Datum.SetPropagationView(element=filterByBoolMask_3.in, view=activeView, target=uniqueItems)
isVisibleInView_2 = Orchid.RevitProject.Elements.Element.IsVisibleInView(element=inDocument_4, view=activeView)

# group: Site - World Coordinate
siteLocation = Orchid.RevitProject.Common.Location.SiteLocation()
watch_16 = Watch(siteLocation.Longitude)
watch_17 = Watch(siteLocation.Latitude)

# group: Project location - Internal point
project_locations_2 = ProjectLocation("Internal")  # graph input
set = Orchid.RevitProject.Common.Location.Set(location=project_locations_2)  # frozen
watch_18 = Watch(set)
projectPoint = Orchid.RevitProject.Common.Location.ProjectPoint(location=project_locations_2)
watch_19 = Watch(projectPoint)
current = Orchid.RevitProject.Common.Location.Current()
name_2 = Element.Name(element=current)
watch_20 = Watch(name_2)
watch_21 = Watch(current)

# group: Project Position -> Survey point
code_block_4 = CodeBlock { 2000; -2000; 0; 10; }
setProjectPosition = Orchid.RevitProject.Common.Location.SetProjectPosition(northSouth=code_block_4.out0, eastWest=code_block_4.out1, elevation=code_block_4.out2, angle=code_block_4.out3)  # frozen
setProjectPosition_2 = Orchid.RevitProject.Common.Location.SetProjectPosition(element=project_locations, northSouth=code_block_4.out0, eastWest=code_block_4.out1, elevation=code_block_4.out2, angle=code_block_4.out3)  # frozen

# group: Linked document position in the linked file
getRevitLink = Orchid.RevitProject.Common.Link.GetRevitLink()
instance = Orchid.RevitProject.Common.Link.Instance(link=getRevitLink)
document = Orchid.RevitProject.Common.Link.Document(instance=instance)
getProjectPosition_2 = Orchid.RevitProject.Common.Location.GetProjectPosition(document=document)
watch_22 = Watch(getProjectPosition_2.EastWest)
watch_23 = Watch(getProjectPosition_2.NorthSouth)
watch_24 = Watch(getProjectPosition_2.Elevation)
watch_25 = Watch(getProjectPosition_2.Angle)
