# Dynamo graph Location_R23.dyn (Dynamo 2.16.2.5624)
# packages: Orchid 2.16.4.6167

# group: Project location
# File: defaultProject
project_locations = ProjectLocation("DKTM3")  # graph input
current = Orchid.RevitProject.Common.Location.Current()
watch = Watch(current)
name = Element.Name(element=current)
watch_2 = Watch(name)
boolean = BoolSelector(false)
projectPoint = Orchid.RevitProject.Common.Location.ProjectPoint(location=project_locations, byOrigin=boolean)
watch_3 = Watch(projectPoint)
set = Orchid.RevitProject.Common.Location.Set(location=project_locations)  # frozen
watch_4 = Watch(set)

# group: Element location
boolean_2 = BoolSelector(false)
getProjectPosition = Orchid.RevitProject.Common.Location.GetProjectPosition(element=project_locations, byOrigin=boolean_2)
watch_5 = Watch(getProjectPosition.NorthSouth)
watch_6 = Watch(getProjectPosition.EastWest)
watch_7 = Watch(getProjectPosition.Angle)
watch_8 = Watch(getProjectPosition.Elevation)

# group: OOTB current location points
basePoint = Coordinates.BasePoint()
watch_9 = Watch(basePoint)
surveyPoint = Coordinates.SurveyPoint()
# note: Note: the survey point in the OOTB node might fail, if larger values is set in the document!
watch_10 = Watch(surveyPoint)
projectRotation = Coordinates.ProjectRotation()
watch_11 = Watch(projectRotation)

# group: Current location points
boolean_3 = BoolSelector(false)
surveyPoint_2 = Orchid.RevitProject.Common.Location.SurveyPoint(byOrigin=boolean_3)
watch_12 = Watch(surveyPoint_2)
basePoint_2 = Orchid.RevitProject.Common.Location.BasePoint(byOrigin=boolean_3)
watch_13 = Watch(basePoint_2)
internalOrigin = Orchid.RevitProject.Common.Location.InternalOrigin(byOrigin=boolean_3)
watch_14 = Watch(internalOrigin)
rotation = Orchid.RevitProject.Common.Location.Rotation()
watch_15 = Watch(rotation)

# group: Document location
current_2 = Document.Current()
boolean_4 = BoolSelector(false)
getProjectPosition_2 = Orchid.RevitProject.Common.Location.GetProjectPosition(document=current_2, byOrigin=boolean_4)
watch_16 = Watch(getProjectPosition_2.NorthSouth)
watch_17 = Watch(getProjectPosition_2.EastWest)
watch_18 = Watch(getProjectPosition_2.Elevation)
watch_19 = Watch(getProjectPosition_2.Angle)

# group: World Coordinates
siteLocation = Orchid.RevitProject.Common.Location.SiteLocation()
watch_20 = Watch(siteLocation.Longitude)
watch_21 = Watch(siteLocation.Latitude)

# group: Set Project Position -> Survey point
# When testing, run individual one at the time!
current_3 = Document.Current()
boolean_5 = BoolSelector(false)
code_block = CodeBlock { 2000; -2000; 0; 10; }
setProjectPosition = Orchid.RevitProject.Common.Location.SetProjectPosition(document=current_3, byOrigin=boolean_5, northSouth=code_block.out0, eastWest=code_block.out1, elevation=code_block.out2, angle=code_block.out3)  # frozen
project_locations_2 = ProjectLocation("Internal")  # graph input
setProjectPosition_2 = Orchid.RevitProject.Common.Location.SetProjectPosition(element=project_locations_2, byOrigin=boolean_5, northSouth=code_block.out0, eastWest=code_block.out1, elevation=code_block.out2, angle=code_block.out3)  # frozen
