# Dynamo graph Open View.dyn (Dynamo 2.16.1.2727)
# packages: Orchid 216.3.0.5794

# note: File: defaultProject
views = Views("{3D}")  # graph input
openView = Orchid.RevitProject.Common.Document.OpenView(view=views)
watch = Watch(openView)
