# Dynamo graph ParameterAttachedCategories.dyn (Dynamo 2.12.1.8246)
# packages: Orchid 212.3.0.8333

code_block = CodeBlock { "Occupant"; "IfcExportAs[Type]"; }
byName = Orchid.RevitProject.Parameters.ProjectParameter.ByName(parameterName=code_block.out1)
getCategory = Orchid.RevitProject.Parameters.ProjectParameter.GetCategory(parameter=byName)
watch = Watch(getCategory)
byName_2 = Orchid.RevitProject.Parameters.Definition.ByName(name=code_block.out1)
getCategory_2 = Orchid.RevitProject.Parameters.Definition.GetCategory(definition=byName_2)
watch_2 = Watch(getCategory_2)
getCategory_3 = Orchid.RevitProject.Parameters.ProjectParameter.GetCategory(parameterName=code_block.out1)
watch_3 = Watch(getCategory_3)

# group: Add IFC parameters
code_block_2 = CodeBlock { ["Doors", "Walls"]; }  # frozen
byName_3 = Category.ByName(name=code_block_2)
addIFC = Orchid.RevitProject.Parameters.SharedParameter.AddIFC(category=byName_3)
