# Dynamo graph ParameterAttachedCategories_R23.dyn "ParameterAttachedCategories" (Dynamo 2.16.1.2727)
# packages: Orchid 216.3.0.5794

code_block = CodeBlock { "Occupant"; "IfcExportAs[Type]"; }
byName = Orchid.RevitProject.Parameters.ProjectParameter.ByName(parameterName=code_block.out1)
getCategory = Orchid.RevitProject.Parameters.ProjectParameter.GetCategory(parameter=byName)
watch = Watch(getCategory)
byName_2 = Orchid.RevitProject.Parameters.Definition.ByName(name=code_block.out1)
getCategory_2 = Orchid.RevitProject.Parameters.Definition.GetCategory(definition=byName_2)
watch_2 = Watch(getCategory_2)
getCategory_3 = Orchid.RevitProject.Parameters.ProjectParameter.GetCategory(parameterName=code_block.out1)
watch_3 = Watch(getCategory_3)

# group: Add IFC parameters
# note: File: defaultProject
code_block_2 = CodeBlock { ["Doors", "Walls"]; }
byName_3 = Category.ByName(name=code_block_2)
addIFC = Orchid.RevitProject.Parameters.SharedParameter.AddIFC(category=byName_3)
