# Dynamo graph ParameterBinding_R23.dyn (Dynamo 2.16.2.5624)
# packages: Orchid 2.16.4.6115

# group: Shared parameters
boolean = BoolSelector(true)
boolean_2 = BoolSelector(true)
sharedParameters = Orchid.RevitProject.Common.Document.SharedParameters()

# group: Project parameters
# File: defaultProject
boolean_3 = BoolSelector(true)
projectParameters = Orchid.RevitProject.Common.Document.ProjectParameters()

# group: Info
watch = Watch(sharedParameters.Definition)
name = Element.Name(element=sharedParameters.ParameterElement)
sortByKey = List.SortByKey(list=sharedParameters.ParameterElement, keys=name)
watch_2 = Watch(sortByKey.sortedKeys)

# group: Group by binding
binding = Orchid.RevitProject.Parameters.ProjectParameter.Binding(parameter=sharedParameters.ParameterElement)
name_2 = Element.Name(element=binding.Instance)
sortByKey_2 = List.SortByKey(list=binding.Instance, keys=name_2)
watch_3 = Watch(sortByKey_2.sortedKeys)
name_3 = Element.Name(element=binding.Type)
sortByKey_3 = List.SortByKey(list=binding.Type, keys=name_3)
watch_4 = Watch(sortByKey_3.sortedKeys)

# group: Sort by binding
isInstanceBound = Orchid.RevitProject.Parameters.ProjectParameter.IsInstanceBound(parameter=sharedParameters.ParameterElement)
filterByBoolMask = List.FilterByBoolMask(list=sharedParameters.ParameterElement, mask=isInstanceBound)
name_4 = Element.Name(element=filterByBoolMask.in)
sortByKey_4 = List.SortByKey(list=filterByBoolMask.in, keys=name_4)
watch_5 = Watch(sortByKey_4.sortedKeys)
name_5 = Element.Name(element=filterByBoolMask.out)
sortByKey_5 = List.SortByKey(list=filterByBoolMask.out, keys=name_5)
watch_6 = Watch(sortByKey_5.sortedKeys)

# group: Info
watch_7 = Watch(projectParameters.Definition)
name_6 = Element.Name(element=projectParameters.ParameterElement)
sortByKey_6 = List.SortByKey(list=projectParameters.ParameterElement, keys=name_6)
watch_8 = Watch(sortByKey_6.sortedKeys)

# group: Group by binding
binding_2 = Orchid.RevitProject.Parameters.ProjectParameter.Binding(parameter=projectParameters.ParameterElement)
name_7 = Element.Name(element=binding_2.Instance)
sortByKey_7 = List.SortByKey(list=binding_2.Instance, keys=name_7)
watch_9 = Watch(sortByKey_7.sortedKeys)
name_8 = Element.Name(element=binding_2.Type)
sortByKey_8 = List.SortByKey(list=binding_2.Type, keys=name_8)
watch_10 = Watch(sortByKey_8.sortedKeys)

# group: Sort by binding
isInstanceBound_2 = Orchid.RevitProject.Parameters.ProjectParameter.IsInstanceBound(parameter=projectParameters.ParameterElement)
filterByBoolMask_2 = List.FilterByBoolMask(list=projectParameters.ParameterElement, mask=isInstanceBound_2)
name_9 = Element.Name(element=filterByBoolMask_2.in)
sortByKey_9 = List.SortByKey(list=filterByBoolMask_2.in, keys=name_9)
watch_11 = Watch(sortByKey_9.sortedKeys)
name_10 = Element.Name(element=filterByBoolMask_2.out)
sortByKey_10 = List.SortByKey(list=filterByBoolMask_2.out, keys=name_10)
watch_12 = Watch(sortByKey_10.sortedKeys)
