# Dynamo graph ParameterHandling.dyn (Dynamo 2.16.1.2727)
# packages: Orchid 216.3.0.5794

# group: Parameter definition (external)
code_block = CodeBlock()
# ---------- code_block.designscript (4 lines) ----------
//Parameter name
["Creator Name",
"Creator Organization",
"Creator Build"];
# ----------------------------------------
getExternal = Orchid.RevitProject.Parameters.Definition.GetExternal(name=code_block)
watch = Watch(getExternal)

# group: Project parameters in document
# note: File: defaultProject
projectParameters = Orchid.RevitProject.Common.Document.ProjectParameters()
name = Element.Name(element=projectParameters.ParameterElement)
watch_2 = Watch(projectParameters.Definition)
watch_3 = Watch(projectParameters.ParameterElement)
watch_4 = Watch(name)

# group: Parameter Definitions
parameter_definitions = ParameterDefinition("Occupant")
type = Object.Type(object=parameter_definitions)
watch_5 = Watch(parameter_definitions)

# group: Shared parameters in document
sharedParameters = Orchid.RevitProject.Common.Document.SharedParameters()
watch_6 = Watch(sharedParameters.Guid)
watch_7 = Watch(sharedParameters.Definition)
name_2 = Element.Name(element=sharedParameters.ParameterElement)
watch_8 = Watch(sharedParameters.ParameterElement)
watch_9 = Watch(name_2)

# group: Parameter definition
byName = Orchid.RevitProject.Parameters.Definition.ByName(name=name)
watch_10 = Watch(byName)
byParameter = Orchid.RevitProject.Parameters.Definition.ByParameter(parameter=sharedParameters.ParameterElement)
watch_11 = Watch(byParameter)

# group: Shared Parameter Definitions
shared_parameter_definitions = SharedParameterDefinition("Creator Organization")
type_2 = Object.Type(object=shared_parameter_definitions)
watch_12 = Watch(shared_parameter_definitions)

# group: Definitions
code_block_2 = CodeBlock { "Creator Name"; }
byName_2 = Orchid.RevitProject.Parameters.ProjectParameter.ByName(parameterName=code_block_2)
byParameter_2 = Orchid.RevitProject.Parameters.Definition.ByParameter(parameter=byName_2)
watch_13 = Watch(byParameter_2)
byName_3 = Orchid.RevitProject.Parameters.Definition.ByName(name=code_block_2)
watch_14 = Watch(byName_3)
watch_15 = Watch(byName_2)
id = Element.Id(element=byName_2)
byId = Orchid.RevitProject.Parameters.ProjectParameter.ById(id=id)
watch_16 = Watch(byId)

# group: clean for unwanted parameters
string = StringInput("ParameterCopy")  # graph input
contains = String.Contains(string=name_2, searchFor=string)
filterByBoolMask = List.FilterByBoolMask(list=sharedParameters.ParameterElement, mask=contains)
watch_17 = Watch(filterByBoolMask.in)
delete = Orchid.RevitProject.Elements.Element.Delete(element=filterByBoolMask.in)  # frozen
name_3 = Element.Name(element=filterByBoolMask.in)
watch_18 = Watch(name_3)

# group: Parameters
project_parameters = ProjectParameter("Occupant")
watch_19 = Watch(project_parameters)
global_parameters = GlobalParameter("GlobalParamTest")
watch_20 = Watch(global_parameters)
shared_parameters = SharedParameter("Creator Name")
watch_21 = Watch(shared_parameters)

# group: Global parameters in document
globalParameters = Orchid.RevitProject.Common.Document.GlobalParameters()
watch_22 = Watch(globalParameters.ParameterElement)
name_4 = Element.Name(element=globalParameters.ParameterElement)
watch_23 = Watch(name_4)
watch_24 = Watch(globalParameters.Definition)
toRevitType = Orchid.Common.Object.ToRevitType(object=globalParameters.ParameterElement)
watch_25 = Watch(toRevitType)
toDynamoType = Orchid.Common.Object.ToDynamoType(object=toRevitType)
watch_26 = Watch(toDynamoType)

# group: Associate --> global parameters
code_block_3 = CodeBlock { "Windows"; }
byName_4 = Category.ByName(name=code_block_3)
all_elements_of_category = ElementsOfCategory(Category=byName_4)
code_block_4 = CodeBlock { "AssociateParameter"; }
associate = Orchid.RevitProject.Parameters.GlobalParameter.Associate(element=all_elements_of_category, parameterName=code_block_4, globalParameter=globalParameters.ParameterElement, lacing=Longest)
await_ = Orchid.Common.DataStream.Await(pass=all_elements_of_category, waitFor=associate)
getAssociated = Orchid.RevitProject.Parameters.GlobalParameter.GetAssociated(element=await_, parameterName=code_block_4)
watch_27 = Watch(getAssociated)
hasAssociated = Orchid.RevitProject.Parameters.GlobalParameter.HasAssociated(element=await_, parameterName=code_block_4)
watch_28 = Watch(hasAssociated)
