# Dynamo graph ParameterSet.dyn (Dynamo 2.16.1.2727)
# packages: Orchid 216.3.0.5799

# group: Add project parameter
code_block = CodeBlock()
# ---------- code_block.designscript (14 lines) ----------
//Parameter name
["test1","test2"];
//SpecType
"Text";
//GroupType
"IdentityData";
//Tooltip
"Some tooltip";
//Instances
true;
//Vary Between Groups
true;
//Category
["Walls","Windows"];
# ----------------------------------------
byName = Orchid.AdeskApp.SpecType.ByName(string=code_block.out1)
byName_2 = Orchid.AdeskApp.GroupType.ByName(string=code_block.out2)
byName_3 = Category.ByName(name=code_block.out6)
create = Orchid.RevitProject.Parameters.ProjectParameter.Create(parameterName=code_block.out0, specType=byName, groupType=byName_2, tooltip=code_block.out3, instance=code_block.out4, vary=code_block.out5, category=byName_3)

# group: Add shared parameter
code_block_2 = CodeBlock()
# ---------- code_block_2.designscript (14 lines) ----------
//Parameter name
["Creator Name",
"Creator Organization",
"Creator Build"];
//SP Parameter group
"Sheet & Project";
//GroupType
"AdskModelProperties";
//Instances
true;
//Vary Between Groups
true;
//Category
"Doors";
# ----------------------------------------
byName_4 = Orchid.AdeskApp.GroupType.ByName(string=code_block_2.out2)
byName_5 = Category.ByName(name=code_block_2.out5)
add = Orchid.RevitProject.Parameters.SharedParameter.Add(parameterName=code_block_2.out0, groupName=code_block_2.out1, groupType=byName_4, category=byName_5)

# group: Delete parameter
code_block_3 = CodeBlock()
# ---------- code_block_3.designscript (2 lines) ----------
["Creator Build",
"test2"];
# ----------------------------------------
delete = Orchid.RevitProject.Parameters.ProjectParameter.Delete(parameterName=code_block_3)  # frozen

# group: Create shared parameter
code_block_4 = CodeBlock()
# ---------- code_block_4.designscript (16 lines) ----------
//Parameter name
"Dynamo test parameter";
//SP Parameter group
"Dynamo test group";
//SpecType
"Text";
//GroupType
"AdskModelProperties";
//Tooltip
"Some tooltip";
//Instances
true;
//Vary Between Groups
true;
//Category
"Doors";
# ----------------------------------------
byName_6 = Orchid.AdeskApp.GroupType.ByName(string=code_block_4.out3)
byName_7 = Category.ByName(name=code_block_4.out7)
add_2 = Orchid.RevitProject.Parameters.SharedParameter.Add(parameterName=code_block_4.out0, groupName=code_block_4.out1, groupType=byName_6, instance=code_block_4.out5, vary=code_block_4.out6, category=byName_7)  # frozen
byName_8 = Orchid.AdeskApp.SpecType.ByName(string=code_block_4.out2)
create_2 = Orchid.RevitProject.Parameters.SharedParameter.Create(parameterName=code_block_4.out0, groupName=code_block_4.out1, specType=byName_8, groupType=byName_6, tooltip=code_block_4.out4, category=byName_7)

# group: Change parameter and category binding in the project
code_block_5 = CodeBlock()
# ---------- code_block_5.designscript (17 lines) ----------
// Parameter name
// Note: a project parameter created inside
// Revit can't be changed! Only user-defined
// parameters created from Dynamo and shared
// parameters can be changed!

// test, shared parameter;
"Creator Name";
// test, created from Dynamo;
"test1";
// test, created inside Revit;
"ChangeCategory";

//Instances
true;
//Category
["Doors", "Entourage", "Floors"];
# ----------------------------------------
byName_9 = Orchid.RevitProject.Parameters.ProjectParameter.ByName(parameterName=code_block_5.out0)
byName_10 = Category.ByName(name=code_block_5.out4)
changeCategory = Orchid.RevitProject.Parameters.ProjectParameter.ChangeCategory(parameter=byName_9, category=byName_10)  # frozen
changeCategory_2 = Orchid.RevitProject.Parameters.ProjectParameter.ChangeCategory(parameterName=code_block_5.out0, category=byName_10)
