# Dynamo graph Purge Background_R23.dyn "Purge Background" (Dynamo 2.16.1.2727)
# packages: Orchid 216.3.0.5794

# note: File: defaultProject
directory_path = StringInput("%userprofile%\Programming\Testing\Data\testSet")  # graph input
string = StringInput("*.rfa")  # graph input
boolean = BoolSelector(false)  # graph input
contents = Orchid.Common.Directory.Contents(directory=directory_path, searchString=string, deepSearch=boolean)
backgroundOpen = Orchid.RevitProject.Common.Document.BackgroundOpen(file=contents)

# group: Purge
boolean_2 = BoolSelector(true)  # graph input
purge = Orchid.RevitFamily.FamilyDocument.Purge(familyDocument=backgroundOpen, completely=boolean_2)

await_ = Orchid.Common.DataStream.Await(pass=backgroundOpen, waitFor=purge)
boolean_3 = BoolSelector(true)  # graph input
close = Orchid.RevitProject.Common.Document.Close(document=await_, save=boolean_3)

# group: Cleanup backup files
await_2 = Orchid.Common.DataStream.Await(pass=directory_path, waitFor=close)
string_2 = StringInput("*.0001.rfa")  # graph input
boolean_4 = BoolSelector(true)  # graph input
contents_2 = Orchid.Common.Directory.Contents(directory=await_2, searchString=string_2, deepSearch=boolean_4)
deleteFile = FileSystem.DeleteFile(path=contents_2)
