# Dynamo graph Purge PostCommand.dyn (Dynamo 2.3.1.11775)
# packages: Orchid 203.3.0.8042

# group: orchid
boolean = BoolSelector(false)  # graph input
o_postcommand_purge = Orchid.RevitProject.Common.PostCommand.Purge(activate=boolean)  # frozen

# group: orchid
boolean_2 = BoolSelector(false)  # graph input
o_document_purge = Orchid.RevitProject.Common.Document.Purge(completely=boolean_2)
