# Dynamo graph Purge_R23.dyn (Dynamo 2.16.2.5624)
# packages: Orchid 2.16.4.6115

# group: Imported dwg files etc.
purge = Orchid.RevitProject.Common.Imports.Purge()
code_block = CodeBlock { "ImportInstance"; }  # frozen
byName = Orchid.RevitProject.Elements.Class.ByName(name=code_block)
ofClass = Orchid.RevitProject.Elements.Element.OfClass(class=byName)
delete = Orchid.RevitProject.Elements.Element.Delete(element=ofClass)

# group: Imported lines from dwg files etc.
deleteImported = Orchid.RevitProject.Categories.Category.DeleteImported()
code_block_2 = CodeBlock { "Imports in Families"; }  # frozen
byName_2 = Category.ByName(name=code_block_2)
byCategory = Orchid.RevitProject.Categories.SubCategory.ByCategory(category=byName_2)
delete_2 = Orchid.RevitProject.Categories.SubCategory.Delete(category=byName_2, subCategory=byCategory)
imported = Orchid.RevitProject.Categories.Category.Imported()  # frozen
delete_3 = Orchid.RevitProject.Elements.Element.Delete(element=imported)

# group: Document purge
boolean = BoolSelector(true)  # graph input
purge_2 = Orchid.RevitProject.Common.Document.Purge(completely=boolean)

# group: 
# All is included in Document.Purge
purge_3 = Orchid.RevitProject.Views.ViewTemplate.Purge()  # frozen
purge_4 = Orchid.Geometry.LineStyle.Purge()  # frozen
purge_5 = Orchid.Geometry.LinePattern.Purge()  # frozen
purge_6 = Orchid.RevitProject.Filters.ParameterFilter.Purge()  # frozen
purge_7 = Orchid.RevitProject.Parameters.Parameter.Purge()  # frozen

# group: 
# All is included in Document.Purge
purge_8 = Orchid.RevitMaterial.Material.Purge()  # frozen
purge_9 = Orchid.RevitMaterial.Visual.Asset.Purge()  # frozen

# group: FamilyDocument purge
boolean_2 = BoolSelector(true)  # graph input
purge_10 = Orchid.RevitFamily.FamilyDocument.Purge(completely=boolean_2)  # frozen

# group: Sheet
purge_11 = Orchid.RevitProject.Views.Sheet.Purge()

# group: PostCommand
boolean_3 = BoolSelector(false)  # graph input
purge_12 = Orchid.RevitProject.Common.PostCommand.Purge(activate=boolean_3)  # frozen

# group: Delete Revisions
deleteAll = Orchid.RevitProject.Common.Revision.DeleteAll()
deleteAll_2 = Orchid.RevitProject.Common.RevisionCloud.DeleteAll()
