# Dynamo graph Revisions.dyn (Dynamo 2.16.1.2727)
# packages: Orchid 216.3.0.5799

# group: Delete RevisionCloud
inDocument = Orchid.RevitProject.Common.RevisionCloud.InDocument()  # frozen
delete = Orchid.RevitProject.Common.RevisionCloud.Delete(revisionCloud=inDocument)
watch = Watch(delete)
revision = RevisionCloud.Revision(revisionCloud=inDocument)

# group: Set -- in Revit 2021 and before
revisions = Revision("Seq. 1 - Revision 1")  # graph input
code_block = CodeBlock { "Date 5678"; "Some description"; true; "CCC"; "DDD"; }
select_revision_visibility = RevisionVisibility("TagVisible")  # graph input
select_revision_number_type = RevisionNumberType("Numeric")  # graph input
set = Orchid.RevitProject.Common.Revision.Set(revision=revisions, revDate=code_block.out0, description=code_block.out1, issued=code_block.out2, issuedTo=code_block.out3, issuedBy=code_block.out4, visibility=select_revision_visibility, numbering=select_revision_number_type)  # frozen

# group: DeleteAll
deleteAll = Orchid.RevitProject.Common.RevisionCloud.DeleteAll()  # frozen
watch_2 = Watch(deleteAll)

# group: Get
revisions_2 = Revision("Seq. 1 - Revision 1")  # graph input
get = Orchid.RevitProject.Common.Revision.Get(revision=revisions_2)
name = Element.Name(element=revisions_2)

# group: Add to Sheet / Remove from Sheet
sheet_views = SheetView("Level 1 (door)")  # graph input
revisions_3 = Revision("Seq. 1 - Revision 1")  # graph input
addToSheet = Orchid.RevitProject.Common.Revision.AddToSheet(sheet=sheet_views, revision=revisions_3)
removeFromSheet = Orchid.RevitProject.Common.Revision.RemoveFromSheet(sheet=sheet_views, revision=revisions_3)

# group: All
inDocument_2 = Orchid.RevitProject.Common.Revision.InDocument()
lastItem = List.LastItem(list=inDocument_2)
delete_2 = Orchid.RevitProject.Common.Revision.Delete(revision=lastItem)  # frozen
watch_3 = Watch(inDocument_2)

# group: Create -- in Revit 2022 and beyond
code_block_2 = CodeBlock { "Date 1234"; "New description"; true; "AAA"; "BBB"; }
select_revision_visibility_2 = RevisionVisibility("CloudAndTagVisible")  # graph input
revisionNumberings = RevisionNumbering("Numeric")
create = Orchid.RevitProject.Common.Revision.Create(revDate=code_block_2.out0, description=code_block_2.out1, issued=code_block_2.out2, issuedTo=code_block_2.out3, issuedBy=code_block_2.out4, visibility=select_revision_visibility_2, numbering=revisionNumberings)

# group: Numbering
select_revision_numbering = RevisionNumbering("PerProject")  # graph input
setNumbering = Orchid.RevitProject.Common.Revision.SetNumbering(numbering=select_revision_numbering)  # frozen
getNumbering = Orchid.RevitProject.Common.Revision.GetNumbering()

# group: DeleteAll
deleteAll_2 = Orchid.RevitProject.Common.Revision.DeleteAll()  # frozen
watch_4 = Watch(deleteAll_2)

# group: Create Revision Numbering -- in Revit 2022 and beyond
code_block_3 = CodeBlock { "Test"; }
select_revision_number_type_2 = RevisionNumberType("Alphanumeric")  # graph input
create_2 = Orchid.RevitProject.Common.RevisionNumbering.Create(name=code_block_3, numberType=select_revision_number_type_2)

# group: All -- in Revit 2022 and beyond
inDocument_3 = Orchid.RevitProject.Common.RevisionNumbering.InDocument()
watch_5 = Watch(inDocument_3)
name_2 = Element.Name(element=inDocument_3)

# group: Set -- in Revit 2022 and beyond
revisions_4 = Revision("Seq. 1 - Revision 1")  # graph input
code_block_4 = CodeBlock { "Date 5678"; "Some description"; true; "CCC"; "DDD"; }
select_revision_visibility_3 = RevisionVisibility("TagVisible")  # graph input
revisionNumberings_2 = RevisionNumbering("Numeric")
set_2 = Orchid.RevitProject.Common.Revision.Set(revision=revisions_4, revDate=code_block_4.out0, description=code_block_4.out1, issued=code_block_4.out2, issuedTo=code_block_4.out3, issuedBy=code_block_4.out4, visibility=select_revision_visibility_3, numbering=revisionNumberings_2)

# group: Create -- in Revit 2021 and before
code_block_5 = CodeBlock { "Date 1234"; "Some description"; true; "AAA"; "BBB"; }
select_revision_visibility_4 = RevisionVisibility("CloudAndTagVisible")  # graph input
select_revision_number_type_3 = RevisionNumberType("Numeric")  # graph input
create_3 = Orchid.RevitProject.Common.Revision.Create(revDate=code_block_5.out0, description=code_block_5.out1, issued=code_block_5.out2, issuedTo=code_block_5.out3, issuedBy=code_block_5.out4, visibility=select_revision_visibility_4, numbering=select_revision_number_type_3)  # frozen
