# Dynamo graph Revisions_R23.dyn "Revisions" (Dynamo 2.16.1.2727)
# packages: Orchid 216.3.0.5794

# group: Delete RevisionCloud
inDocument = Orchid.RevitProject.Common.RevisionCloud.InDocument()  # frozen
delete = Orchid.RevitProject.Common.RevisionCloud.Delete(revisionCloud=inDocument)
watch = Watch(delete)
revision = RevisionCloud.Revision(revisionCloud=inDocument)

# group: DeleteAll
deleteAll = Orchid.RevitProject.Common.RevisionCloud.DeleteAll()  # frozen
watch_2 = Watch(deleteAll)

# group: Get
revisions = Revision("Seq. 1 - Revision 1")  # graph input
get = Orchid.RevitProject.Common.Revision.Get(revision=revisions)
name = Element.Name(element=revisions)

# group: Add to Sheet / Remove from Sheet
sheet_views = SheetView("Level 1 (door)")  # graph input
revisions_2 = Revision("Seq. 1 - Revision 1")  # graph input
addToSheet = Orchid.RevitProject.Common.Revision.AddToSheet(sheet=sheet_views, revision=revisions_2)
removeFromSheet = Orchid.RevitProject.Common.Revision.RemoveFromSheet(sheet=sheet_views, revision=revisions_2)  # frozen

# group: InDocument
inDocument_2 = Orchid.RevitProject.Common.Revision.InDocument()
lastItem = List.LastItem(list=inDocument_2)
delete_2 = Orchid.RevitProject.Common.Revision.Delete(revision=lastItem)  # frozen
watch_3 = Watch(inDocument_2)

# group: Create
# note: File: defaultProject
code_block = CodeBlock { "Date 1234"; "New description"; true; "AAA"; "BBB"; }
select_revision_visibility = RevisionVisibility("CloudAndTagVisible")  # graph input
revisionNumberings = RevisionNumbering("Numeric")
create = Orchid.RevitProject.Common.Revision.Create(revDate=code_block.out0, description=code_block.out1, issued=code_block.out2, issuedTo=code_block.out3, issuedBy=code_block.out4, visibility=select_revision_visibility, numbering=revisionNumberings)

# group: Numbering
select_revision_numbering = RevisionNumbering("PerProject")  # graph input
setNumbering = Orchid.RevitProject.Common.Revision.SetNumbering(numbering=select_revision_numbering)  # frozen
getNumbering = Orchid.RevitProject.Common.Revision.GetNumbering()

# group: DeleteAll
deleteAll_2 = Orchid.RevitProject.Common.Revision.DeleteAll()  # frozen
watch_4 = Watch(deleteAll_2)

# group: Create Revision Numbering
code_block_2 = CodeBlock { "Test"; }
select_revision_number_type = RevisionNumberType("Alphanumeric")  # graph input
create_2 = Orchid.RevitProject.Common.RevisionNumbering.Create(name=code_block_2, numberType=select_revision_number_type)

# group: InDocument
inDocument_3 = Orchid.RevitProject.Common.RevisionNumbering.InDocument()
watch_5 = Watch(inDocument_3)
name_2 = Element.Name(element=inDocument_3)

# group: Set
revisions_3 = Revision("Seq. 1 - Revision 1")  # graph input
code_block_3 = CodeBlock { "Date 5678"; "Some description"; true; "CCC"; "DDD"; }
select_revision_visibility_2 = RevisionVisibility("TagVisible")  # graph input
revisionNumberings_2 = RevisionNumbering("Numeric")
set = Orchid.RevitProject.Common.Revision.Set(revision=revisions_3, revDate=code_block_3.out0, description=code_block_3.out1, issued=code_block_3.out2, issuedTo=code_block_3.out3, issuedBy=code_block_3.out4, visibility=select_revision_visibility_2, numbering=revisionNumberings_2)
