# Dynamo graph RoomSpace_R23.dyn "RoomSpace" (Dynamo 2.16.1.2727)
# packages: Orchid 216.3.0.5794

# group: Get spatial element phase
code_block = CodeBlock { ["Rooms", "Spaces"]; }
byName = Category.ByName(name=code_block)
all_elements_of_category = ElementsOfCategory(Category=byName)
phase = Orchid.RevitProject.Elements.SpatialElement.Phase(spatialElement=all_elements_of_category)
groupByKey = List.GroupByKey(list=all_elements_of_category, keys=phase, lacing=Longest)
watch = Watch(groupByKey.groups)
watch_2 = Watch(groupByKey.uniqueKeys)

# group: Get spatial element status
code_block_2 = CodeBlock { ["Rooms", "Spaces"]; }
byName_2 = Category.ByName(name=code_block_2)
all_elements_of_category_2 = ElementsOfCategory(Category=byName_2)
status = Orchid.RevitProject.Elements.SpatialElement.Status(spatialElement=all_elements_of_category_2)
groupByKey_2 = List.GroupByKey(list=all_elements_of_category_2, keys=status, lacing=Longest)
watch_3 = Watch(groupByKey_2.groups)
watch_4 = Watch(groupByKey_2.uniqueKeys)

# group: Create room by phase
# note: File: defaultProject
code_block_3 = CodeBlock { "Rooms"; "Existing"; "New Construction"; }
byName_3 = Orchid.RevitProject.Common.Phase.ByName(name=code_block_3.out2)
levels = Levels("Level 2")
byName_4 = Category.ByName(name=code_block_3.out0)
all_elements_of_category_3 = ElementsOfCategory(Category=byName_4)
centerLocation = Orchid.RevitProject.Elements.SpatialElement.CenterLocation(spatialElement=all_elements_of_category_3)
location = Orchid.RevitProject.Elements.SpatialElement.Location(spatialElement=centerLocation)
name = Orchid.RevitProject.Elements.SpatialElement.Name(spatialElement=centerLocation)
number = Orchid.RevitProject.Elements.SpatialElement.Number(spatialElement=centerLocation)
# note: The SpatialElement nodes may be replaced
# with the following dynamo nodes if exists!
# Room.Location
# Room.Name
# Room.Number
createSpace = Orchid.RevitProject.Elements.SpatialElement.CreateSpace(phase=byName_3, level=levels, location=location, name=name, number=number)
centerLocation_2 = Orchid.RevitProject.Elements.SpatialElement.CenterLocation(spatialElement=createSpace)

# group: Create space by phase
code_block_4 = CodeBlock { "Spaces"; "Existing"; "New Construction"; }
byName_5 = Orchid.RevitProject.Common.Phase.ByName(name=code_block_4.out2)
levels_2 = Levels("Level 2")
byName_6 = Category.ByName(name=code_block_4.out0)
all_elements_of_category_4 = ElementsOfCategory(Category=byName_6)
centerLocation_3 = Orchid.RevitProject.Elements.SpatialElement.CenterLocation(spatialElement=all_elements_of_category_4)
location_2 = Orchid.RevitProject.Elements.SpatialElement.Location(spatialElement=centerLocation_3)
name_2 = Orchid.RevitProject.Elements.SpatialElement.Name(spatialElement=centerLocation_3)
number_2 = Orchid.RevitProject.Elements.SpatialElement.Number(spatialElement=centerLocation_3)
# note: The SpatialElement nodes may be replaced
# with the following dynamo nodes if exists!
# Space.Location
# Space.Name
# Space.Number
createSpace_2 = Orchid.RevitProject.Elements.SpatialElement.CreateSpace(phase=byName_5, level=levels_2, location=location_2, name=name_2, number=number_2)
centerLocation_4 = Orchid.RevitProject.Elements.SpatialElement.CenterLocation(spatialElement=createSpace_2)
