# Dynamo graph RotateByOrigin_R23.dyn "RotateByOrigin" (Dynamo 2.16.1.2727)
# packages: Orchid 216.3.0.5794

# group: Collect elements
code_block = CodeBlock { "--ModelElements--"; }
code_block_2 = CodeBlock()
# ---------- code_block_2.designscript (2 lines) ----------
// Category type elements
"Model";
# ----------------------------------------
byCategoryType = Orchid.RevitProject.Elements.Element.ByCategoryType(categoryType=code_block_2)
string_from_object = FromObject(object=byCategoryType.Category)
code_block_3 = CodeBlock()
# ---------- code_block_3.designscript (2 lines) ----------
// Filter for Curtain elements
"Curtain";
# ----------------------------------------
contains = String.Contains(string=string_from_object, searchFor=code_block_3)
filterByBoolMask = List.FilterByBoolMask(list=byCategoryType.Element, mask=contains)
allStackedWall = Orchid.RevitProject.Elements.Wall.StackedWalls()  # "Wall.AllStackedWall"
inDocument = Orchid.RevitProject.Elements.Sweep.InDocument()
code_block_4 = CodeBlock { "MultistoryStairs"; }
byName = Orchid.RevitProject.Elements.Class.ByName(name=code_block_4)
all_elements_of_type = ElementsOfType(element_type=byName)
allSeparationLine = Orchid.RevitProject.Elements.SpatialElement.SeparationLines()  # "SpatialElement.AllSeparationLine"
join = List.Join(list0=filterByBoolMask.out, list1=allStackedWall, list2=inDocument, list3=all_elements_of_type, list4=allSeparationLine.Element)
flatten = List.Flatten(list=join)
create = Orchid.RevitProject.Elements.Group.Create(name=code_block, element=flatten)

# group: Collect special elements
inDocument_2 = Orchid.RevitProject.Datums.ReferencePlane.InDocument()
inDocument_3 = Orchid.RevitProject.Datums.Level.InDocument()
inDocument_4 = Orchid.RevitProject.Datums.Grid.InDocument()
allModel = Orchid.RevitProject.Elements.Group.Model()  # "Group.AllModel"
join_2 = List.Join(list0=inDocument_2, list1=inDocument_3, list2=inDocument_4, list3=allModel)

# group: Collect annotation elements
code_block_5 = CodeBlock()
# ---------- code_block_5.designscript (2 lines) ----------
// Category type elements
"Annotation";
# ----------------------------------------
byCategoryType_2 = Orchid.RevitProject.Elements.Element.ByCategoryType(categoryType=code_block_5)
code_block_6 = CodeBlock(category=byCategoryType_2.Category)
# ---------- code_block_6.designscript (3 lines) ----------
category.Name == "Section Boxes" ||
category.Name == "Revision Clouds"
? true : false;
# ----------------------------------------
filterByBoolMask_2 = List.FilterByBoolMask(list=byCategoryType_2.Element, mask=code_block_6)

# group: Collect additional elements that not can be grouped
allDetail = Orchid.RevitProject.Elements.Group.Detail()  # "Group.AllDetail"
ownerViewType = Orchid.RevitProject.Elements.Element.OwnerViewType(element=allDetail)
code_block_7 = CodeBlock(t=ownerViewType) { t != "Detail"? true : false; }
filterByBoolMask_3 = List.FilterByBoolMask(list=allDetail, mask=code_block_7)

# group: Collect linked instances
getCadLink = Orchid.RevitProject.Common.Link.GetCadLink()
getRevitLink = Orchid.RevitProject.Common.Link.GetRevitLink()
list_create = List.Create(item0=getCadLink, item1=getRevitLink)
flatten_2 = List.Flatten(list=list_create)
instance = Orchid.RevitProject.Common.Link.Instance(link=flatten_2)

# group: Project Origin
code_block_8 = CodeBlock { Autodesk.Point.ByCoordinates(0, 0, 0); -90; }

# group: join lists and unpin element
join_3 = List.Join(list0=create, list1=join_2, list2=filterByBoolMask_2.out, list3=filterByBoolMask_3.in, list4=instance)
flatten_3 = List.Flatten(list=join_3)
clean = Orchid.Common.List.Clean(list=flatten_3)
isPinned = Orchid.RevitProject.Elements.Element.IsPinned(element=clean)
filterByBoolMask_4 = List.FilterByBoolMask(list=clean, mask=isPinned)
unPin = Orchid.RevitProject.Elements.Element.UnPin(element=filterByBoolMask_4.in)
isCopyMonitored = Orchid.RevitProject.Elements.Element.IsCopyMonitored(element=clean)
filterByBoolMask_5 = List.FilterByBoolMask(list=clean, mask=isCopyMonitored)
await_ = Orchid.Common.DataStream.Await(pass=filterByBoolMask_5.out, waitFor=unPin)
rotate = Orchid.RevitProject.Elements.Element.Rotate(element=await_, point=code_block_8.out0, angle=code_block_8.out1)

# group: re-pin elements
await_2 = Orchid.Common.DataStream.Await(pass=unPin, waitFor=rotate)
pin = Orchid.RevitProject.Elements.Element.Pin(element=await_2)

# group: Adjust view crop box
model = Orchid.RevitProject.Views.View.Model()
rotate_2 = Orchid.RevitProject.Views.View.Rotate(view=model, point=code_block_8.out0, angle=code_block_8.out1)

# group: Adjust sectionsbox
threeD = Orchid.RevitProject.Views.View.ThreeD()
rotateSectionBox = Orchid.RevitProject.Views.View.RotateSectionBox(view3D=threeD, point=code_block_8.out0, angle=code_block_8.out1)

# group: Ungroup model elements
code_block_9 = CodeBlock { "--ModelElements--"; }
await_3 = Orchid.Common.DataStream.Await(pass=code_block_9, waitFor=rotate)
unGroup = Orchid.RevitProject.Elements.Group.UnGroup(name=await_3)

# group: dimensions
code_block_10 = CodeBlock()  # frozen
# ---------- code_block_10.designscript (4 lines) ----------
["Dimensions",
"SpotCoordinates",
"SpotElevations",
"SpotSlopes"];
# ----------------------------------------
byName_2 = Category.ByName(name=code_block_10)
all_elements_of_category = ElementsOfCategory(Category=byName_2)
