# Dynamo graph Scheduling.dyn (Dynamo 2.16.1.2727)
# packages: Orchid 216.3.0.5794

# group: Add shared parameter
code_block = CodeBlock()
# ---------- code_block.designscript (6 lines) ----------
//Parameter name
"ProductID";
//GroupType
"DTU_Facility";
//GroupType
"AdskModelProperties";
# ----------------------------------------
byName = Orchid.AdeskApp.GroupType.ByName(string=code_block.out2)
add = Orchid.RevitProject.Parameters.SharedParameter.Add(parameterName=code_block.out0, groupName=code_block.out1, groupType=byName)

# group: Create Schedules
code_block_2 = CodeBlock()
# ---------- code_block_2.designscript (7 lines) ----------
[
//"Ceilings",
"Doors",
"Floors",
"Windows",
"Walls"
];
# ----------------------------------------
byName_2 = Category.ByName(name=code_block_2)
code_block_3 = CodeBlock(category=byName_2) { t = category; t+"_Shedule"; "RegularSchedule"; }
createSchedule = ScheduleView.CreateSchedule(category=code_block_3.t, name=code_block_3.out1, scheduleType=code_block_3.out2)
await_ = Orchid.Common.DataStream.Await(pass=createSchedule, waitFor=add)
schedulableFields = ScheduleView.SchedulableFields(scheduleView=await_)
code_block_4 = CodeBlock()
# ---------- code_block_4.designscript (9 lines) ----------
[
"ProductID",
"Type",
"Count",

// these are not avalible
// in all schedules!
"Level",
"Base Constraint"];
# ----------------------------------------
byName_3 = Orchid.RevitProject.Schedules.SchedulableField.ByName(schedulableField=schedulableFields@L2, name=code_block_4)
clean = Orchid.Common.List.Clean(list=byName_3)
addFields = ScheduleView.AddFields(scheduleView=createSchedule@L1, fields=clean@L2)

# group: Set the schedule
schedule_footer_types = ScheduleFooterType("Totals")
schedule_field_display_types = ScheduleFieldDisplayType("Totals")
code_block_5 = CodeBlock()
# ---------- code_block_5.designscript (7 lines) ----------
["ProductID","Type"];
// footer
["Totals","None"];
// blankLine
[true,false];
"Totals";
true;
# ----------------------------------------
sortingGrouping = Orchid.RevitProject.Schedules.Schedule.SortingGrouping(scheduleView=addFields, name=code_block_5.out0, footer=code_block_5.out1, blankLine=code_block_5.out2, grandTotals=code_block_5.out3, itemize=code_block_5.out4)
code_block_6 = CodeBlock { "Count"; "Right"; "Totals"; }
formatting = Orchid.RevitProject.Schedules.Schedule.Formatting(scheduleView=sortingGrouping, name=code_block_6.out0, horizontalAlignment=code_block_6.out1, calculate=code_block_6.out2)
horizontal_alignment_styles = HorizontalAlignmentStyle("Right")
schedule_sort_order = ScheduleSortOrder("Ascending")
schedule_heading_orientations = ScheduleHeadingOrientation("Horizontal")

# group: Selection
# note: File: defaultProject
code_block_7 = CodeBlock { "Model"; "Annotation"; "AnalyticalModel"; "Internal"; }
byCategoryType = Orchid.RevitProject.Elements.Element.ByCategoryType(categoryType=code_block_7.out0)
watch = Watch(byCategoryType.Category)
copyTo = Orchid.Common.Clipboard.CopyTo(object=byCategoryType.Category)
