# Dynamo graph Scheduling_R23.dyn (Dynamo 2.16.1.2727)
# packages: Orchid 216.3.0.5828

# group: Selection
# File: defaultProject
code_block = CodeBlock { "Model"; "Annotation"; "AnalyticalModel"; "Internal"; }
byCategoryType = Orchid.RevitProject.Elements.Element.ByCategoryType(categoryType=code_block.out0)
watch = Watch(byCategoryType.Category)
copyTo = Orchid.Common.Clipboard.CopyTo(object=byCategoryType.Category)

# group: Add shared parameter
code_block_2 = CodeBlock()
# ---------- code_block_2.designscript (6 lines) ----------
//Parameter name
"ProductID";
//GroupType
"DTU_Facility";
//GroupType
"AdskModelProperties";
# ----------------------------------------
byName = Orchid.AdeskApp.GroupType.ByName(string=code_block_2.out2)
add = Orchid.RevitProject.Parameters.SharedParameter.Add(parameterName=code_block_2.out0, groupName=code_block_2.out1, groupType=byName)

# group: Create Schedules
code_block_3 = CodeBlock()
# ---------- code_block_3.designscript (7 lines) ----------
[
//"Ceilings",
"Doors",
"Floors",
"Windows",
"Walls"
];
# ----------------------------------------
byName_2 = Category.ByName(name=code_block_3)
code_block_4 = CodeBlock(category=byName_2) { t = category; t+"_Shedule"; "RegularSchedule"; }
createSchedule = ScheduleView.CreateSchedule(category=code_block_4.t, name=code_block_4.out1, scheduleType=code_block_4.out2)
await_ = Orchid.Common.DataStream.Await(pass=createSchedule, waitFor=add)
schedulableFields = ScheduleView.SchedulableFields(scheduleView=await_)
code_block_5 = CodeBlock()
# ---------- code_block_5.designscript (9 lines) ----------
[
"ProductID",
"Type",
"Count",

// these are not avalible
// in all schedules!
"Level",
"Base Constraint"];
# ----------------------------------------
byName_3 = Orchid.RevitProject.Schedules.SchedulableField.ByName(schedulableField=schedulableFields@L2, name=code_block_5)
clean = Orchid.Common.List.Clean(list=byName_3)
addFields = ScheduleView.AddFields(scheduleView=createSchedule@L1, fields=clean@L2)
schedule_type = ScheduleTypes("RegularSchedule")

# group: Set the schedule
schedule_footer_types = ScheduleFooterType("Totals")
schedule_sort_order = ScheduleSortOrder("Ascending")
code_block_6 = CodeBlock()
# ---------- code_block_6.designscript (8 lines) ----------
["ProductID","Type"];
// footer
"ScheduleFooter";
["Totals","None"];
// blankLine
[true,false];
"Totals";
true;
# ----------------------------------------
enumByName = Orchid.Common.Orchid.EnumByName(enumType=code_block_6.out1, valueName=code_block_6.out2)
enumByName_2 = Orchid.Common.Orchid.EnumByName(enumType=code_block_6.out1, valueName=code_block_6.out4)
sortingGrouping = Orchid.RevitProject.Schedules.Schedule.SortingGrouping(scheduleView=addFields, name=code_block_6.out0, footer=enumByName, blankLine=code_block_6.out3, grandTotals=enumByName_2, itemize=code_block_6.out5)

# group: Format the schedule
schedule_field_display_types = ScheduleFieldDisplayType("Totals")
horizontal_alignment_styles = HorizontalAlignmentStyle("Right")
schedule_heading_orientations = ScheduleHeadingOrientation("Horizontal")
code_block_7 = CodeBlock { "Count"; "ScheduleHorizontalAlignment"; "Right"; "ScheduleFieldDisplayType"; "Totals"; }
enumByName_3 = Orchid.AdeskApp.Revit.EnumByName(enumType=code_block_7.out1, valueName=code_block_7.out2)
enumByName_4 = Orchid.AdeskApp.Revit.EnumByName(enumType=code_block_7.out3, valueName=code_block_7.out4)
formatting = Orchid.RevitProject.Schedules.Schedule.Formatting(scheduleView=sortingGrouping, name=code_block_7.out0, horizontalAlignment=enumByName_3, calculate=enumByName_4)
