# Dynamo graph SharedParameter.dyn (Dynamo 2.16.1.2727)
# packages: Orchid 216.3.0.8440

# group: Add shared parameters by groupName (current loaded)
code_block = CodeBlock()
# ---------- code_block.designscript (14 lines) ----------
//SP Parameter group
["Energy","Dimensions"];
//GroupType
["EnergyAnalysis", "Geometry"];
//Instance
[true,false];
//Vary pr group
//NOTE: this list must follow the order
//of true values in the "Instance" list.
//This list does not have to have same
//length as the above three lists!
[true];
//Categories
["Doors", "Windows", "Floors", "Walls"];
# ----------------------------------------
byName = Orchid.AdeskApp.GroupType.ByName(string=code_block.out1)
byName_2 = Category.ByName(name=code_block.out4)
addByGroup = Orchid.RevitProject.Parameters.SharedParameter.AddByGroup(groupName=code_block.out0, groupType=byName, instance=code_block.out2, vary=code_block.out3, category=byName_2)
name = Element.Name(element=addByGroup.ParameterElement)
watch = Watch(name)
watch_2 = Watch(addByGroup.GroupName)

# group: Add shared parameters by groupName by provided file
string = StringInput("%userprofile%\Programming\Testing\Data\COBie Extension Shared Parameters.txt")  # graph input
fromPath = Orchid.Common.File.FromPath(path=string)
code_block_2 = CodeBlock()
# ---------- code_block_2.designscript (14 lines) ----------
//SP Parameter group
["Floor", "Type"];
//GroupType
["", "AdskModelProperties"];
//Instance
[true,false];
//Vary pr group
//NOTE: this list must follow the order
//of true values in the "Instance" list.
//This list does not have to have same
//length as the above three lists!
[true];
//Categories
["Doors", "Windows", "Floors", "Walls"];
# ----------------------------------------
byName_3 = Orchid.AdeskApp.GroupType.ByName(string=code_block_2.out1)
byName_4 = Category.ByName(name=code_block_2.out4)
addByFile = Orchid.RevitProject.Parameters.SharedParameter.AddByFile(file=fromPath, groupName=code_block_2.out0, groupType=byName_3, instance=code_block_2.out2, vary=code_block_2.out3, category=byName_4)
name_2 = Element.Name(element=addByFile.ParameterElement)
watch_3 = Watch(name_2)
watch_4 = Watch(addByFile.GroupName)

# group: Set the shared parameter file
string_2 = StringInput("%userprofile%\Personal\Modellering\Revit\Common\Shared Parameters.txt")  # graph input
fromPath_2 = Orchid.Common.File.FromPath(path=string_2)
code_block_3 = CodeBlock(data=fromPath_2) { data; }
setFile = Orchid.RevitProject.Parameters.SharedParameter.SetFile(file=code_block_3)
watch_5 = Watch(setFile)
string_3 = StringInput("..\COBie Extension Shared Parameters.txt")  # graph input
string_4 = StringInput("%userprofile%\Programming\Testing\Data\COBie Extension Shared Parameters.txt")  # graph input
fromPath_3 = Orchid.Common.File.FromPath(path=string_4)

# group: Get shared parameters by file
byFile = Orchid.RevitProject.Parameters.SharedParameter.ByFile(file=setFile)
watch_6 = Watch(byFile.ParameterName)
watch_7 = Watch(byFile.ParameterType)
watch_8 = Watch(byFile.Definition)
watch_9 = Watch(byFile.Guid)
watch_10 = Watch(byFile.GroupName)

# group: Get shared parameter file
getFile = Orchid.RevitProject.Parameters.SharedParameter.GetFile()
watch_11 = Watch(getFile)

# group: Select elements
code_block_4 = CodeBlock()
# ---------- code_block_4.designscript (2 lines) ----------
// Category type elements
"Model";
# ----------------------------------------
elementByCategoryType = Orchid.RevitProject.Elements.Selection.ElementByCategoryType(categoryType=code_block_4)
watch_12 = Watch(elementByCategoryType.Category)

# group: Add IFC parameters
addIFC = Orchid.RevitProject.Parameters.SharedParameter.AddIFC(category=elementByCategoryType.Category)
name_3 = Element.Name(element=addIFC)
watch_13 = Watch(name_3)

# group: Group by type and group name
groupByTypeAndGroupName = Orchid.RevitProject.Parameters.SharedParameter.GroupByTypeAndGroupName(file=setFile)
watch_14 = Watch(groupByTypeAndGroupName.ParameterName)
watch_15 = Watch(groupByTypeAndGroupName.Definition)
watch_16 = Watch(groupByTypeAndGroupName.ParameterType)
watch_17 = Watch(groupByTypeAndGroupName.GroupName)
watch_18 = Watch(groupByTypeAndGroupName.Guid)

# group: Group by group name and type
groupByGroupNameAndType = Orchid.RevitProject.Parameters.SharedParameter.GroupByGroupNameAndType(file=setFile)
watch_19 = Watch(groupByGroupNameAndType.ParameterName)
watch_20 = Watch(groupByGroupNameAndType.GroupName)
watch_21 = Watch(groupByGroupNameAndType.ParameterType)
watch_22 = Watch(groupByGroupNameAndType.Definition)
watch_23 = Watch(groupByGroupNameAndType.Guid)
