# Dynamo graph SheetViews.dyn (Dynamo 2.12.1.8246)
# packages: Orchid 212.1.1.8268

all = Orchid.RevitProject.Views.Sheet.All()
content = Orchid.RevitProject.Views.Sheet.Content(sheet=all)
watch = Watch(content)
onSheet = Orchid.RevitProject.Schedules.Schedule.OnSheet(sheet=all)
watch_2 = Watch(onSheet)
onSheet_2 = Orchid.RevitProject.Views.View.OnSheet(sheet=all)
watch_3 = Watch(onSheet_2)
flatten = List.Flatten(list=content)
watch_4 = Watch(flatten)
flatten_2 = List.Flatten(list=onSheet)
watch_5 = Watch(flatten_2)
flatten_3 = List.Flatten(list=onSheet_2)
watch_6 = Watch(flatten_3)
