# Dynamo graph SheetViews_R23.dyn "SheetViews" (Dynamo 2.16.1.2727)
# packages: Orchid 216.3.0.5794

# note: File: defaultProject
inDocument = Orchid.RevitProject.Views.Sheet.InDocument()
content = Orchid.RevitProject.Views.Sheet.Content(sheet=inDocument)
watch = Watch(content)
onSheet = Orchid.RevitProject.Schedules.Schedule.OnSheet(sheet=inDocument)
watch_2 = Watch(onSheet)
onSheet_2 = Orchid.RevitProject.Views.View.OnSheet(sheet=inDocument)
watch_3 = Watch(onSheet_2)
flatten = List.Flatten(list=content)
watch_4 = Watch(flatten)
flatten_2 = List.Flatten(list=onSheet)
watch_5 = Watch(flatten_2)
flatten_3 = List.Flatten(list=onSheet_2)
watch_6 = Watch(flatten_3)
