# Dynamo graph View-Cropbox.dyn (Dynamo 2.3.1.11775)
# packages: Orchid 203.3.0.8042

# group: Adjust view crop box
modelAll = Orchid.RevitProject.Views.View.ModelAll()
getCropBox = Orchid.RevitProject.Views.View.GetCropBox(view=modelAll)

# group: Proces by vector
select_model_element = DSModelElementSelection()  # 1 picked in the model; graph input
getLocation = Element.GetLocation(element=select_model_element)
asVector = Point.AsVector(point=getLocation)
reverse = Vector.Reverse(vector=asVector)

# group: ...by curve
startPoint = Curve.StartPoint(curve=getCropBox.Curve)
add = Point.Add(point=startPoint, vectorToAdd=reverse)
endPoint = Curve.EndPoint(curve=getCropBox.Curve)
add_2 = Point.Add(point=endPoint, vectorToAdd=reverse)
byStartPointEndPoint = Line.ByStartPointEndPoint(startPoint=add, endPoint=add_2)
setCropBox = Orchid.RevitProject.Views.View.SetCropBox(view=modelAll, curve=byStartPointEndPoint)

# group: Adjust view crop box
modelAll_2 = Orchid.RevitProject.Views.View.ModelAll()
moveCropBox = Orchid.RevitProject.Views.View.MoveCropBox(view=modelAll_2, vector=reverse)

# group: Adjust sectionsbox
threeD = Orchid.RevitProject.Views.View.ThreeD()
moveSectionBox = Orchid.RevitProject.Views.View.MoveSectionBox(view3D=threeD, vector=reverse)

# group: ...by bounding box
minPoint = BoundingBox.MinPoint(boundingBox=getCropBox.BoundingBox)
add_3 = Point.Add(point=minPoint, vectorToAdd=reverse)
maxPoint = BoundingBox.MaxPoint(boundingBox=getCropBox.BoundingBox)
add_4 = Point.Add(point=maxPoint, vectorToAdd=reverse)
byCorners = BoundingBox.ByCorners(min=add_3, max=add_4)
setCropBox_2 = Orchid.RevitProject.Views.View.SetCropBox(view=modelAll, boundingBox=byCorners)

# group: Adjust view
modelAll_3 = Orchid.RevitProject.Views.View.ModelAll()
move = Orchid.RevitProject.Views.View.Move(view=modelAll_3, vector=reverse)

# group: Model view
model_views = ModelView("Level 1 (door)")  # graph input
watch = Watch(model_views)

# group: Sheet view
sheet_views = SheetView("Level 1 (door)")  # graph input
watch_2 = Watch(sheet_views)

# group: Design option
design_options = DesignOption("No types found.")  # graph input
watch_3 = Watch(design_options)

# group: Scope box
scope_boxes = ScopeBox("No types found.")  # graph input
watch_4 = Watch(scope_boxes)

# group: Collect all view
all = Orchid.RevitProject.Views.View.All()
watch_5 = Watch(all)
threeD_2 = Orchid.RevitProject.Views.View.ThreeD()
watch_6 = Watch(threeD_2)

# group: Collect sselected view by view family type
code_block = CodeBlock()
# ---------- code_block.designscript (3 lines) ----------
["Floor Plan",
"Section",
"3D View"];
# ----------------------------------------
byName = Orchid.RevitProject.Views.ViewFamilyType.ByName(name=code_block)
byFamilyType = Orchid.RevitProject.Views.View.ByFamilyType(viewType=byName)
watch_7 = Watch(byFamilyType)
view_family_types = ViewFamilyType("Floor Plan")

# group: Collect sselected view by view family type
code_block_2 = CodeBlock()
# ---------- code_block_2.designscript (3 lines) ----------
["FloorPlan",
"Section",
"ThreeD"];
# ----------------------------------------
byName_2 = Orchid.RevitProject.Views.ViewType.ByName(name=code_block_2)
byType = Orchid.RevitProject.Views.View.ByType(viewType=byName_2)
watch_8 = Watch(byType)
view_type = ViewType("FloorPlan")

# group: Adjust viewport on sheet
all_2 = Orchid.RevitProject.Views.Viewport.All()
move_2 = Orchid.RevitProject.Views.Viewport.Move(viewport=all_2, vector=reverse)
