# Dynamo graph View-Cropbox_R23.dyn (Dynamo 2.16.1.2727)
# packages: Orchid 216.3.0.5794

# group: Adjust view crop box
model = Orchid.RevitProject.Views.View.Model()
getCropBox = Orchid.RevitProject.Views.View.GetCropBox(view=model)

# group: Proces by vector
select_model_element = DSModelElementSelection()  # 1 picked in the model; graph input
getLocation = Element.GetLocation(element=select_model_element)
asVector = Point.AsVector(point=getLocation)
reverse = Vector.Reverse(vector=asVector)

# group: ...by curve
startPoint = Curve.StartPoint(curve=getCropBox.Curve)
add = Point.Add(point=startPoint, vectorToAdd=reverse)
endPoint = Curve.EndPoint(curve=getCropBox.Curve)
add_2 = Point.Add(point=endPoint, vectorToAdd=reverse)
byStartPointEndPoint = Line.ByStartPointEndPoint(startPoint=add, endPoint=add_2)
setCropBox = Orchid.RevitProject.Views.View.SetCropBox(view=model, curve=byStartPointEndPoint)

# group: Adjust view crop box
model_2 = Orchid.RevitProject.Views.View.Model()
moveCropBox = Orchid.RevitProject.Views.View.MoveCropBox(view=model_2, point=getLocation)

# group: Adjust sectionsbox
threeD = Orchid.RevitProject.Views.View.ThreeD()
moveSectionBox = Orchid.RevitProject.Views.View.MoveSectionBox(view3D=threeD, point=getLocation)

# group: ...by bounding box
minPoint = BoundingBox.MinPoint(boundingBox=getCropBox.BoundingBox)
add_3 = Point.Add(point=minPoint, vectorToAdd=reverse)
maxPoint = BoundingBox.MaxPoint(boundingBox=getCropBox.BoundingBox)
add_4 = Point.Add(point=maxPoint, vectorToAdd=reverse)
byCorners = BoundingBox.ByCorners(min=add_3, max=add_4)
setCropBox_2 = Orchid.RevitProject.Views.View.SetCropBox(view=model, boundingBox=byCorners)

# group: Adjust view
model_3 = Orchid.RevitProject.Views.View.Model()
move = Orchid.RevitProject.Views.View.Move(view=model_3, point=getLocation)

# group: Model view
model_views = ModelView("Level 1 (door)")  # graph input
watch = Watch(model_views)

# group: Sheet view
sheet_views = SheetView("Level 1 (door)")  # graph input
watch_2 = Watch(sheet_views)

# group: Design option
design_options = DesignOption("Option 1  <primary>")
watch_3 = Watch(design_options)

# group: Scope box
# File: defaultProject_extended
scope_boxes = ScopeBox("Scope Box 1")
watch_4 = Watch(scope_boxes)

# group: Collect all view
inDocument = Orchid.RevitProject.Views.View.InDocument()
watch_5 = Watch(inDocument)
threeD_2 = Orchid.RevitProject.Views.View.ThreeD()
watch_6 = Watch(threeD_2)

# group: Collect sselected view by view family type
code_block = CodeBlock()
# ---------- code_block.designscript (3 lines) ----------
["Floor Plan",
"Section",
"3D View"];
# ----------------------------------------
byName = Orchid.RevitProject.Views.ViewFamilyType.ByName(name=code_block)
byViewFamilyType = Orchid.RevitProject.Views.View.ByViewFamilyType(viewFamilyType=byName.ViewFamilyType)
watch_7 = Watch(byViewFamilyType)
view_family_types = ViewFamilyType("Floor Plan")

# group: Collect sselected view by view family type
code_block_2 = CodeBlock()
# ---------- code_block_2.designscript (3 lines) ----------
["FloorPlan",
"Section",
"ThreeD"];
# ----------------------------------------
byName_2 = Orchid.RevitProject.Views.ViewType.ByName(name=code_block_2)
byViewType = Orchid.RevitProject.Views.View.ByViewType(viewType=byName_2)
watch_8 = Watch(byViewType)
viewType = ViewType("FloorPlan")

# group: Adjust viewport on sheet
inDocument_2 = Orchid.RevitProject.Views.Viewport.InDocument()
move_2 = Orchid.RevitProject.Views.Viewport.Move(viewport=inDocument_2, point=getLocation)
