# Dynamo graph ViewDuplicate-ViewTemplate.dyn (Dynamo 2.16.1.2727)
# packages: Orchid 216.3.0.5799

# group: Duplicate view
inDocument = Orchid.RevitProject.Datums.Level.InDocument()
byLevel = FloorPlanView.ByLevel(level=inDocument)
concat = String.Concat()  # unwired: string0, string1
code_block = CodeBlock()
# ---------- code_block.designscript (5 lines) ----------
// Text to add
["DTUfm CHECK - ",
"DTUfm UPLOAD - ",
"EXPORT DWG - ",
"Color CHECK - "];
# ----------------------------------------
name = Element.Name(element=inDocument)
cartesianProduct = List.CartesianProduct(comb=concat, list1=code_block, list2=name)
transpose = List.Transpose(lists=cartesianProduct)
view_duplicate_options = ViewDuplicateOption("Duplicate")  # graph input
duplicate = Orchid.RevitProject.Views.View.Duplicate(view=byLevel, name=transpose, option=view_duplicate_options)
transpose_2 = List.Transpose(lists=duplicate)
await_ = Orchid.Common.DataStream.Await(pass=byLevel, waitFor=duplicate)
delete = Orchid.RevitProject.Elements.Element.Delete(element=await_)
buildingStory = Orchid.RevitProject.Datums.Level.BuildingStory()

# group: Find view template in model
inDocument_2 = Orchid.RevitProject.Views.ViewTemplate.InDocument()
code_block_2 = CodeBlock()
# ---------- code_block_2.designscript (5 lines) ----------
// ViewTemplate to use
["DTUfm - CHECK",
"DTUfm - UPLOAD",
"DTU Export DWG",
"DTU Color CHECK"];
# ----------------------------------------
name_2 = Element.Name(element=inDocument_2)
contains = List.Contains(list=code_block_2, item=name_2@L1)
filterByBoolMask = List.FilterByBoolMask(list=inDocument_2, mask=contains)

# group: Set view template
name_3 = Element.Name(element=filterByBoolMask.in)
byKeysValues = DesignScript.Builtin.Dictionary.ByKeysValues(keys=name_3, values=filterByBoolMask.in)
valueAtKey = DesignScript.Builtin.Dictionary.ValueAtKey(dictionary=byKeysValues, key=code_block_2)
set = Orchid.RevitProject.Views.ViewTemplate.Set(view=transpose_2, viewTemplate=valueAtKey)

watch = Watch(set)
