# Dynamo graph ViewHandling_R23.dyn (Dynamo 2.16.1.2727)
# packages: Orchid 216.3.0.5985

# group: Get views
activeView = Orchid.RevitProject.Common.Document.ActiveView()
inDocument = Orchid.RevitProject.Views.Sheet.InDocument()
view = Orchid.RevitProject.Views.Sheet.View(sheet=inDocument)
flatten = List.Flatten(list=view)

# group: Has view a view template attached
hasViewTemplate = Orchid.RevitProject.Views.View.HasViewTemplate(view=flatten)
watch = Watch(hasViewTemplate)

# group: Set link visibility
# File: LinkedProject
code_block = CodeBlock { "Level 1 (door)"; }
byName = Orchid.RevitProject.Views.View.ByName(name=code_block)
getRevitLink = Orchid.RevitProject.Common.Link.GetRevitLink()
boolean = BoolSelector(false)
setLinkVisibility = Orchid.RevitProject.Views.View.SetLinkVisibility(view=byName, link=getRevitLink, visible=boolean)

# group: Get link visibility
getLinkVisibility = Orchid.RevitProject.Views.View.GetLinkVisibility(view=byName)
watch_2 = Watch(getLinkVisibility.Link)
watch_3 = Watch(getLinkVisibility.boolean)

# group: Get link visibility
getRevitLink_2 = Orchid.RevitProject.Common.Link.GetRevitLink()
getLinkVisibility_2 = Orchid.RevitProject.Views.View.GetLinkVisibility(view=flatten, link=getRevitLink_2)
watch_4 = Watch(getLinkVisibility_2)
