# Dynamo graph WallHole.dyn (Dynamo 2.3.1.11775)
# packages: Orchid 203.3.0.8042

# group: Get hole elements as document (family edit)
code_block = CodeBlock { "Generic Models"; }
byName = Category.ByName(name=code_block)
elementByCategory = Orchid.RevitProject.Elements.Selection.ElementByCategory(category=byName)
name = Element.Name(element=elementByCategory.Element)
code_block_2 = CodeBlock()
# ---------- code_block_2.designscript (2 lines) ----------
// Search string
"Hole";
# ----------------------------------------
contains = String.Contains(str=name, searchFor=code_block_2)
filterByBoolMask = List.FilterByBoolMask(list=elementByCategory.Element, mask=contains)
getFamily = FamilyInstance.GetFamily(familyInstance=filterByBoolMask.in)
edit = Orchid.RevitProject.Elements.Family.Edit(family=getFamily)

# group: filter for valid holes
get = Orchid.Common.Geometry.Form.Get(document=edit)
code_block_3 = CodeBlock { "Walls"; }
byName_2 = Category.ByName(name=code_block_3)
elementByCategory_2 = Orchid.RevitProject.Elements.Selection.ElementByCategory(category=byName_2)

# group: find host elements (OcSolid)
ocSolid = Orchid.Common.Geometry.Form.OcSolid(form=get)
intersect = Orchid.Common.Geometry.OcSolid.Intersect(ocSolid=ocSolid, elements=elementByCategory_2.Element)
watch = Watch(intersect)
intersect_2 = Orchid.Common.Geometry.OcSolid.Intersect(ocSolid=ocSolid)
watch_2 = Watch(intersect_2)

# group: find host elements (Solid)
solid = Orchid.Common.Geometry.Form.Solid(form=get)
intersect_3 = Orchid.Common.Geometry.Solid.Intersect(solid=solid, elements=elementByCategory_2.Element)
watch_3 = Watch(intersect_3)
intersect_4 = Orchid.Common.Geometry.Solid.Intersect(solid=solid)
watch_4 = Watch(intersect_4)

# group: close document
await_ = Orchid.Common.DataStream.Await(pass=edit, waitFor=solid)  # frozen
close = Orchid.RevitProject.Common.Document.Close(document=await_)
