# Dynamo graph WallHole_R23.dyn "WallHole" (Dynamo 2.16.1.2727)
# packages: Orchid 216.3.0.5794

# group: Get hole elements as document (family edit)
# note: File: WallHole
code_block = CodeBlock { "Generic Models"; }
byName = Category.ByName(name=code_block)
byCategory = Orchid.RevitProject.Elements.Element.ByCategory(category=byName)
name = Element.Name(element=byCategory.Element)
code_block_2 = CodeBlock()
# ---------- code_block_2.designscript (2 lines) ----------
// Search string
"Hole";
# ----------------------------------------
contains = String.Contains(string=name, searchFor=code_block_2)
filterByBoolMask = List.FilterByBoolMask(list=byCategory.Element, mask=contains)
getFamily = FamilyInstance.GetFamily(familyInstance=filterByBoolMask.in)
edit = Orchid.RevitProject.Elements.Family.Edit(family=getFamily)

# group: filter for valid holes
get = Orchid.Geometry.Form.Get(document=edit)
code_block_3 = CodeBlock { "Walls"; }
byName_2 = Category.ByName(name=code_block_3)
byCategory_2 = Orchid.RevitProject.Elements.Element.ByCategory(category=byName_2)

# group: find host elements (OcSolid)
ocSolid = Orchid.Geometry.Form.OcSolid(form=get)
intersect = Orchid.Geometry.OcSolid.Intersect(ocSolid=ocSolid, elements=byCategory_2.Element)
watch = Watch(intersect)
intersect_2 = Orchid.Geometry.OcSolid.Intersect(ocSolid=ocSolid)
watch_2 = Watch(intersect_2)

# group: find host elements (Solid)
solid = Orchid.Geometry.Form.Solid(form=get)
intersect_3 = Orchid.Geometry.Solid.Intersect(solid=solid, elements=byCategory_2.Element)
watch_3 = Watch(intersect_3)
intersect_4 = Orchid.Geometry.Solid.Intersect(solid=solid)
watch_4 = Watch(intersect_4)

# group: close document
await_ = Orchid.Common.DataStream.Await(pass=edit, waitFor=solid)  # frozen
close = Orchid.RevitProject.Common.Document.Close(document=await_)
