# Dynamo graph Workset_R23.dyn (Dynamo 2.16.1.2727)
# packages: Orchid 216.3.0.5985

# group: Selection
# File: worksharing_locale
code_block = CodeBlock()
# ---------- code_block.designscript (11 lines) ----------
"CategoryType";

"Model";
"Annotation";
"AnalyticalModel";
"Internal";

["Model",
"Annotation",
"AnalyticalModel",
"Internal"];
# ----------------------------------------
enumByName = Orchid.AdeskApp.Revit.EnumByName(enumType=code_block.out0, valueName=code_block.out1)
byCategoryType = Orchid.RevitProject.Elements.Element.ByCategoryType(categoryType=enumByName)
code_block_2 = CodeBlock { "WorksetToFilter"; }
getWorkset = Orchid.RevitProject.Elements.Element.GetWorkset(element=byCategoryType.Element)
name = Orchid.RevitProject.Common.Workset.Name(workset=getWorkset)
setParameterByName = Element.SetParameterByName(element=byCategoryType.Element, parameterName=code_block_2, value=name)

# group: Selection
hasMaterial = Orchid.RevitProject.Elements.Element.HasMaterial()
code_block_3 = CodeBlock { "WorksetToFilter"; }
getWorkset_2 = Orchid.RevitProject.Elements.Element.GetWorkset(element=hasMaterial.Element)
name_2 = Orchid.RevitProject.Common.Workset.Name(workset=getWorkset_2)
setParameterByName_2 = Element.SetParameterByName(element=hasMaterial.Element, parameterName=code_block_3, value=name_2)

userWorkset = Orchid.RevitProject.Common.Workset.UserWorkset()
name_3 = Orchid.RevitProject.Common.Workset.Name(workset=userWorkset)
byName = Orchid.RevitProject.Common.Workset.ByName(name=name_3)
watch = Watch(byName)
id = Orchid.RevitProject.Common.Workset.Id(workset=userWorkset)
watch_2 = Watch(id)
watch_3 = Watch(name_3)
byId = Orchid.RevitProject.Common.Workset.ById(id=id)
watch_4 = Watch(byId)
watch_5 = Watch(userWorkset)
uniqueId = Orchid.RevitProject.Common.Workset.UniqueId(workset=userWorkset)
watch_6 = Watch(uniqueId)
inDocument = Orchid.RevitProject.Common.Workset.InDocument()

# group: Selection
materialHostable = Orchid.RevitProject.Categories.Category.MaterialHostable()
byCategory = Orchid.RevitProject.Elements.Element.ByCategory(category=materialHostable)
code_block_4 = CodeBlock { "WorksetToFilter"; }
getWorkset_3 = Orchid.RevitProject.Elements.Element.GetWorkset(element=byCategory.Element)
name_4 = Orchid.RevitProject.Common.Workset.Name(workset=getWorkset_3)
setParameterByName_3 = Element.SetParameterByName(element=byCategory.Element, parameterName=code_block_4, value=name_4)

# group: Worksets
worksets = Workset("View \"3D View: {3D}\"")  # graph input
watch_7 = Watch(worksets)
user_worksets = UserWorkset("Test")
watch_8 = Watch(user_worksets)

# group: SetOwner and Relinquish
boolean = BoolSelector(true)
relinquish = Orchid.RevitProject.Elements.Element.Relinquish(waitFor=boolean)
watch_9 = Watch(relinquish)
userWorkset_2 = Orchid.RevitProject.Common.Workset.UserWorkset()
setOwner = Orchid.RevitProject.Common.Workset.SetOwner(workset=userWorkset_2)
relinquish_2 = Orchid.RevitProject.Common.Workset.Relinquish(waitFor=setOwner)
watch_10 = Watch(relinquish_2)

code_block_5 = CodeBlock { "Walls"; }
byName_2 = Category.ByName(name=code_block_5)
all_elements_of_category = ElementsOfCategory(Category=byName_2)
getWorkset_4 = Orchid.RevitProject.Elements.Element.GetWorkset(element=all_elements_of_category)
watch_11 = Watch(getWorkset_4)
code_block_6 = CodeBlock { "something"; }
create = Orchid.RevitProject.Common.Workset.Create(name=code_block_6)
await_ = Orchid.Common.DataStream.Await(pass=code_block_6, waitFor=create)
byName_3 = Orchid.RevitProject.Common.Workset.ByName(name=await_)
setWorkset = Orchid.RevitProject.Elements.Element.SetWorkset(element=all_elements_of_category, workset=byName_3)

# group: Category by name
natural_category_name = CodeBlock()
# ---------- natural_category_name.designscript (26 lines) ----------
[
"Casework",
"Ceilings",
"Columns",
"Curtain Wall Mullions",
"Curtain Panels",
"Curtain Systems",
"Doors",
"Entourage",
"Floors",
"Furniture",
"Furniture Systems",
"Generic Models",
"Plumbing Fixtures",
"Ramps",
"Roofs",
"Specialty Equipment",
"Stairs",
"Structural Columns",
"Structural Foundations",
"Structural Framing",
"Structural Beam Systems",
"Structural Stiffeners",
"Walls",
"Windows"
];
# ----------------------------------------
byName_4 = Category.ByName(name=natural_category_name)
built_in_categories = CodeBlock()
# ---------- built_in_categories.designscript (26 lines) ----------
[
"OST_Casework",
"OST_Ceilings",
"OST_Columns",
"OST_CurtainWallMullions",
"OST_CurtainWallPanels",
"OST_CurtaSystem",
"OST_Doors",
"OST_Entourage",
"OST_Floors",
"OST_Furniture",
"OST_FurnitureSystems",
"OST_GenericModel",
"OST_PlumbingFixtures",
"OST_Ramps",
"OST_Roofs",
"OST_SpecialityEquipment",
"OST_Stairs",
"OST_StructuralColumns",
"OST_StructuralFoundation",
"OST_StructuralFraming",
"OST_StructuralFramingSystem",
"OST_StructuralStiffener",
"OST_Walls",
"OST_Windows"
];
# ----------------------------------------

# group: Convert to Orchid type
userWorkset_3 = Orchid.RevitProject.Common.Workset.UserWorkset()
toRevitType = Orchid.Common.Object.ToRevitType(object=userWorkset_3)
toOrchidType = Orchid.Common.Object.ToOrchidType(object=toRevitType)
name_5 = Orchid.RevitProject.Common.Workset.Name(workset=toOrchidType)
watch_12 = Watch(name_5)

# group: Set global visibility
code_block_7 = CodeBlock { "Test"; }
byName_5 = Orchid.RevitProject.Common.Workset.ByName(name=code_block_7)
boolean_2 = BoolSelector(false)
setGlobalVisibility = Orchid.RevitProject.Common.Workset.SetGlobalVisibility(workset=byName_5, visibility=boolean_2)

# group: Get global visibility
getGlobalVisibility = Orchid.RevitProject.Common.Workset.GetGlobalVisibility()
watch_13 = Watch(getGlobalVisibility.Workset)
watch_14 = Watch(getGlobalVisibility.boolean)

# group: Set view visibility
# open "Level 1 (door)"
activeView = Orchid.RevitProject.Common.Document.ActiveView()
code_block_8 = CodeBlock { "Test"; }
byName_6 = Orchid.RevitProject.Common.Workset.ByName(name=code_block_8)
view_workset_visibility = WorksetVisibility("Hidden")
setWorksetVisibility = Orchid.RevitProject.Views.View.SetWorksetVisibility(view=activeView, workset=byName_6, visibility=view_workset_visibility)

# group: Get view visibility
activeView_2 = Orchid.RevitProject.Common.Document.ActiveView()
getWorksetVisibility = Orchid.RevitProject.Views.View.GetWorksetVisibility(view=activeView_2)
watch_15 = Watch(getWorksetVisibility.Workset)
watch_16 = Watch(getWorksetVisibility.Enum)
code_block_9 = CodeBlock { "Test"; }
byName_7 = Orchid.RevitProject.Common.Workset.ByName(name=code_block_9)
getWorksetVisibility_2 = Orchid.RevitProject.Views.View.GetWorksetVisibility(view=activeView_2, workset=byName_7)
watch_17 = Watch(getWorksetVisibility_2)
