# Dynamo graph moveToOrigin_Worksets.dyn "MoveToOrigin_Worksets" (Dynamo 2.19.3.6394)
# packages: Orchid 2.19.1.6221

# group: Adjust sectionsbox
code_block = CodeBlock { "ViewType"; "ThreeD"; }  # frozen
enumByName = Orchid.AdeskApp.Revit.EnumByName(enumType=code_block.out0, valueName=code_block.out1)
byViewType = Orchid.RevitProject.Views.View.ByViewType(viewType=enumByName)
watch = Watch(byViewType)

# group: new origin -> as vector
select_model_element = DSModelElementSelection()  # 1 picked in the model; graph input
getLocation = Element.GetLocation(element=select_model_element)
reverse = Orchid.Geometry.Point.Reverse(point=getLocation)

# group: Write coordinate to txt file and copy coordinate to clipboard
current = Orchid.RevitProject.Common.Document.Current()
boolean = BoolSelector(false)
path = Orchid.RevitProject.Common.Document.Path(document=current, withExtension=boolean)
code_block_2 = CodeBlock(file=path) { file+".txt"; }
string_from_object = FromObject(obj=reverse)
writeText = FileSystem.WriteText(filePath=code_block_2, text=string_from_object)
copyTo = Orchid.Common.Clipboard.CopyTo(object=reverse)

# group: Set workset ownership
inDocument = Orchid.RevitProject.Common.Workset.InDocument()
setOwner = Orchid.RevitProject.Common.Workset.SetOwner(workset=inDocument)

# group: Select elements
code_block_3 = CodeBlock()
# ---------- code_block_3.designscript (4 lines) ----------
// Revit enumeration
"CategoryType";
// Category type elements
"Model";
# ----------------------------------------
enumByName_2 = Orchid.AdeskApp.Revit.EnumByName(enumType=code_block_3.out0, valueName=code_block_3.out1)
await_ = Orchid.Common.DataStream.Await(pass=enumByName_2, waitFor=setOwner)
byCategoryType = Orchid.RevitProject.Elements.Element.ByCategoryType(categoryType=await_)
string_from_object_2 = FromObject(obj=byCategoryType.Category)
code_block_4 = CodeBlock()
# ---------- code_block_4.designscript (2 lines) ----------
// Filter for Curtain elements
"Curtain";
# ----------------------------------------
contains = String.Contains(string=string_from_object_2, searchFor=code_block_4)
filterByBoolMask = List.FilterByBoolMask(list=byCategoryType.Element, mask=contains)
stackedWalls = Orchid.RevitProject.Elements.Wall.StackedWalls()
inDocument_2 = Orchid.RevitProject.Elements.Sweep.InDocument()
code_block_5 = CodeBlock { "MultistoryStairs"; }
byName = Orchid.RevitProject.Elements.Class.ByName(name=code_block_5)
all_elements_of_class = ElementsOfType(element_type=byName)
separationLines = Orchid.RevitProject.Elements.SpatialElement.SeparationLines()
flatten = List.Flatten(list=separationLines.Element)
join = List.Join(list0=filterByBoolMask.out, list1=stackedWalls, list2=inDocument_2, list3=all_elements_of_class, list4=flatten)

# group: Select special elements
inDocument_3 = Orchid.RevitProject.Datums.SketchPlane.InDocument()
inDocument_4 = Orchid.RevitProject.Datums.ReferencePlane.InDocument()
inDocument_5 = Orchid.RevitProject.Datums.Level.InDocument()
inDocument_6 = Orchid.RevitProject.Datums.Grid.InDocument()
model = Orchid.RevitProject.Elements.Group.Model()
join_2 = List.Join(list0=inDocument_3, list1=inDocument_4, list2=inDocument_5, list3=inDocument_6, list4=model)

# group: Select elements
code_block_6 = CodeBlock()
# ---------- code_block_6.designscript (4 lines) ----------
// Revit enumeration
"CategoryType";
// Category type elements
"Annotation";
# ----------------------------------------
enumByName_3 = Orchid.AdeskApp.Revit.EnumByName(enumType=code_block_6.out0, valueName=code_block_6.out1)
byCategoryType_2 = Orchid.RevitProject.Elements.Element.ByCategoryType(categoryType=enumByName_3)
code_block_7 = CodeBlock(category=byCategoryType_2.Category)
# ---------- code_block_7.designscript (3 lines) ----------
category.Name == "Section Boxes" ||
category.Name == "Revision Clouds"
? true : false;
# ----------------------------------------
filterByBoolMask_2 = List.FilterByBoolMask(list=byCategoryType_2.Element, mask=code_block_7)

# group: Select additional elements that not can be grouped
detail = Orchid.RevitProject.Elements.Group.Detail()
ownerViewType = Orchid.RevitProject.Elements.Element.OwnerViewType(element=detail)
code_block_8 = CodeBlock(t=ownerViewType) { t != "Detail"? true : false; }
filterByBoolMask_3 = List.FilterByBoolMask(list=detail, mask=code_block_8)

# group: Collect linked instances
cadLink = Orchid.RevitProject.Common.Link.CadLink()
revitLink = Orchid.RevitProject.Common.Link.RevitLink()
list_create = List.Create(item0=cadLink, item1=revitLink)
instance = Orchid.RevitProject.Common.Link.Instance(link=list_create)

# group: Adjust sectionsbox
threeD = Orchid.RevitProject.Views.View.ThreeD()
moveSectionBox = Orchid.RevitProject.Views.View.MoveSectionBox(view3D=threeD, point=reverse)
await_2 = Orchid.Common.DataStream.Await(pass=reverse, waitFor=moveSectionBox)

# group: join lists and unpin element
join_3 = List.Join(list0=join, list1=join_2, list2=filterByBoolMask_2.out, list3=filterByBoolMask_3.in, list4=instance)
flatten_2 = List.Flatten(list=join_3)
clean = Orchid.Common.List.Clean(list=flatten_2)
isCopyMonitored = Orchid.RevitProject.Elements.Element.IsCopyMonitored(element=clean)
filterByBoolMask_4 = List.FilterByBoolMask(list=clean, mask=isCopyMonitored)
isPinned = Orchid.RevitProject.Elements.Element.IsPinned(element=clean)
filterByBoolMask_5 = List.FilterByBoolMask(list=clean, mask=isPinned)
list_create_2 = List.Create(item0=filterByBoolMask_4.in, item1=filterByBoolMask_5.in)
unPin = Orchid.RevitProject.Elements.Element.UnPin(element=list_create_2)
await_3 = Orchid.Common.DataStream.Await(pass=clean, waitFor=unPin)
move = Orchid.RevitProject.Elements.Element.Move(element=await_3, point=await_2)

# group: re-pin elements
await_4 = Orchid.Common.DataStream.Await(pass=unPin, waitFor=move)
pin = Orchid.RevitProject.Elements.Element.Pin(element=await_4)

# group: Revisions -> delete or add
# note: If revisions is deleted, then remember to
# remove they are added to the "move" list
deleteAll = Orchid.RevitProject.Common.Revision.DeleteAll()  # frozen
inDocument_7 = Orchid.RevitProject.Common.RevisionCloud.InDocument()  # frozen
deleteAll_2 = Orchid.RevitProject.Common.RevisionCloud.DeleteAll()  # frozen

# group: Adjust view crop box
model_2 = Orchid.RevitProject.Views.View.Model()
move_2 = Orchid.RevitProject.Views.View.Move(view=model_2, point=await_2)

# group: Relinquish workset
await_5 = Orchid.Common.DataStream.Await(pass=await_4, waitFor=move_2)
count = List.Count(list=await_5)
relinquish = Orchid.RevitProject.Common.Workset.Relinquish(waitFor=count)
