# Dynamo graph moveToOrigin_Worksets_R23.dyn "MoveToOrigin_Worksets_R23" (Dynamo 2.16.1.2727)
# packages: Orchid 2.16.4.5987

# group: new origin -> as vector
select_model_element = DSModelElementSelection()  # 1 picked in the model; graph input
getLocation = Element.GetLocation(element=select_model_element)
reverse = Orchid.Geometry.Point.Reverse(point=getLocation)

# group: Write coordinate to txt file and copy coordinate to clipboard
current = Orchid.RevitProject.Common.Document.Current()
boolean = BoolSelector(false)
path = Orchid.RevitProject.Common.Document.Path(document=current, withExtension=boolean)
code_block = CodeBlock(file=path) { file+".txt"; }
string_from_object = FromObject(obj=reverse)
writeText = FileSystem.WriteText(filePath=code_block, text=string_from_object)
copyTo = Orchid.Common.Clipboard.CopyTo(object=reverse)

# group: Adjust view crop box
model = Orchid.RevitProject.Views.View.Model()
move = Orchid.RevitProject.Views.View.Move(view=model, point=reverse)

# group: Adjust sectionsbox
threeD = Orchid.RevitProject.Views.View.ThreeD()
moveSectionBox = Orchid.RevitProject.Views.View.MoveSectionBox(view3D=threeD, point=reverse)

# group: Set workset ownership
inDocument = Orchid.RevitProject.Common.Workset.InDocument()
setOwner = Orchid.RevitProject.Common.Workset.SetOwner(workset=inDocument)

# group: Collect elements
code_block_2 = CodeBlock()
# ---------- code_block_2.designscript (4 lines) ----------
// Revit enumeration
"CategoryType";
// Category type elements
"Model";
# ----------------------------------------
enumByName = Orchid.AdeskApp.Revit.EnumByName(enumType=code_block_2.out0, valueName=code_block_2.out1)
await_ = Orchid.Common.DataStream.Await(pass=enumByName, waitFor=setOwner)
byCategoryType = Orchid.RevitProject.Elements.Element.ByCategoryType(categoryType=await_)
string_from_object_2 = FromObject(obj=byCategoryType.Category)
code_block_3 = CodeBlock()
# ---------- code_block_3.designscript (2 lines) ----------
// Filter for Curtain elements
"Curtain";
# ----------------------------------------
contains = String.Contains(string=string_from_object_2, searchFor=code_block_3)
filterByBoolMask = List.FilterByBoolMask(list=byCategoryType.Element, mask=contains)
stackedWalls = Orchid.RevitProject.Elements.Wall.StackedWalls()
inDocument_2 = Orchid.RevitProject.Elements.Sweep.InDocument()
separationLines = Orchid.RevitProject.Elements.SpatialElement.SeparationLines()
flatten = List.Flatten(list=separationLines.Element)
join = List.Join(list0=filterByBoolMask.out, list1=stackedWalls, list2=inDocument_2, list3=flatten)

# group: Collect special elements
code_block_4 = CodeBlock { "MultistoryStairs"; }
byName = Orchid.RevitProject.Elements.Class.ByName(name=code_block_4)
all_elements_of_type = ElementsOfType(element_type=byName)
inDocument_3 = Orchid.RevitProject.Datums.ReferencePlane.InDocument()
inDocument_4 = Orchid.RevitProject.Datums.Level.InDocument()
inDocument_5 = Orchid.RevitProject.Datums.Grid.InDocument()
model_2 = Orchid.RevitProject.Elements.Group.Model()
join_2 = List.Join(list0=all_elements_of_type, list1=inDocument_3, list2=inDocument_4, list3=inDocument_5, list4=model_2)

# group: Collect elements
code_block_5 = CodeBlock()
# ---------- code_block_5.designscript (4 lines) ----------
// Revit enumeration
"CategoryType";
// Category type elements
"Annotation";
# ----------------------------------------
enumByName_2 = Orchid.AdeskApp.Revit.EnumByName(enumType=code_block_5.out0, valueName=code_block_5.out1)
byCategoryType_2 = Orchid.RevitProject.Elements.Element.ByCategoryType(categoryType=enumByName_2)
code_block_6 = CodeBlock(category=byCategoryType_2.Category)
# ---------- code_block_6.designscript (3 lines) ----------
category.Name == "Section Boxes" ||
category.Name == "Revision Clouds"
? true : false;
# ----------------------------------------
filterByBoolMask_2 = List.FilterByBoolMask(list=byCategoryType_2.Element, mask=code_block_6)

# group: Collect additional elements that not can be grouped
detail = Orchid.RevitProject.Elements.Group.Detail()
ownerViewType = Orchid.RevitProject.Elements.Element.OwnerViewType(element=detail)
code_block_7 = CodeBlock(t=ownerViewType) { t != "Detail"? true : false; }
filterByBoolMask_3 = List.FilterByBoolMask(list=detail, mask=code_block_7)

# group: Collect linked instances
getCadLink = Orchid.RevitProject.Common.Link.GetCadLink()
getRevitLink = Orchid.RevitProject.Common.Link.GetRevitLink()
list_create = List.Create(item0=getCadLink, item1=getRevitLink)
instance = Orchid.RevitProject.Common.Link.Instance(link=list_create)

# group: join lists and unpin element
join_3 = List.Join(list0=join, list1=join_2, list2=filterByBoolMask_2.out, list3=filterByBoolMask_3.in, list4=instance)
flatten_2 = List.Flatten(list=join_3)
clean = Orchid.Common.List.Clean(list=flatten_2)
isPinned = Orchid.RevitProject.Elements.Element.IsPinned(element=clean)
filterByBoolMask_4 = List.FilterByBoolMask(list=clean, mask=isPinned)
unPin = Orchid.RevitProject.Elements.Element.UnPin(element=filterByBoolMask_4.in)
isCopyMonitored = Orchid.RevitProject.Elements.Element.IsCopyMonitored(element=clean)
filterByBoolMask_5 = List.FilterByBoolMask(list=clean, mask=isCopyMonitored)
await_2 = Orchid.Common.DataStream.Await(pass=filterByBoolMask_5.out, waitFor=unPin)
move_2 = Orchid.RevitProject.Elements.Element.Move(element=await_2, point=reverse)

# group: re-pin elements
await_3 = Orchid.Common.DataStream.Await(pass=unPin, waitFor=move_2)
pin = Orchid.RevitProject.Elements.Element.Pin(element=await_3)

# group: Relinquish workset
relinquish = Orchid.RevitProject.Common.Workset.Relinquish(waitFor=move_2)

# group: Revisions -> delete or add
# note: If revisions is deleted, then remember to
# remove they are added to the "move" list
deleteAll = Orchid.RevitProject.Common.Revision.DeleteAll()  # frozen
inDocument_6 = Orchid.RevitProject.Common.RevisionCloud.InDocument()  # frozen
deleteAll_2 = Orchid.RevitProject.Common.RevisionCloud.DeleteAll()  # frozen

# group: Adjust sectionsbox
code_block_8 = CodeBlock { "ViewType"; "ThreeD"; }  # frozen
enumByName_3 = Orchid.AdeskApp.Revit.EnumByName(enumType=code_block_8.out0, valueName=code_block_8.out1)
byViewType = Orchid.RevitProject.Views.View.ByViewType(viewType=enumByName_3)
watch = Watch(byViewType)
