# Dynamo graph Connector_Mechanical_R23.dyn "Connector_Mechanical" (Dynamo 2.16.1.2727)
# packages: Orchid 216.3.0.5794

# note: File: Ventilation_Basic
code_block = CodeBlock { "VI 1"; }
byName = Orchid.RevitProject.Systems.MEPSystem.ByName(name=code_block)

# group: Component
handlingUnit = Orchid.RevitProject.Systems.Mechanical.HandlingUnit(mechanicalSystem=byName)
connector = Orchid.RevitProject.Systems.FamilyInstance.Connector(familyInstance=handlingUnit)
fitting = Orchid.RevitProject.Systems.Mechanical.Fitting(mechanicalSystem=byName)
accessory = Orchid.RevitProject.Systems.Mechanical.Accessory(mechanicalSystem=byName)
terminal = Orchid.RevitProject.Systems.Mechanical.Terminal(mechanicalSystem=byName)
equipment = Orchid.RevitProject.Systems.Mechanical.Equipment(mechanicalSystem=byName)
component = Orchid.RevitProject.Systems.Mechanical.Component(mechanicalSystem=byName)

code_block_2 = CodeBlock(data=connector) { data; }
shape = Orchid.RevitProject.Systems.Connector.Shape(connector=code_block_2)
watch = Watch(shape.Shape)
watch_2 = Watch(shape.Dimension)
connection = Orchid.RevitProject.Systems.Connector.Connection(connector=code_block_2)
watch_3 = Watch(connection)
isConnected = Orchid.RevitProject.Systems.Connector.IsConnected(connector=code_block_2)
watch_4 = Watch(isConnected)
host = Orchid.RevitProject.Systems.Connector.Host(connector=code_block_2)
watch_5 = Watch(host)
vector = Orchid.RevitProject.Systems.Connector.Vector(connector=code_block_2)
watch_6 = Watch(vector)
watch_7 = Watch(connector)
direction = Orchid.RevitProject.Systems.Connector.Direction(connector=code_block_2)
watch_8 = Watch(direction)
location = Orchid.RevitProject.Systems.Connector.Location(connector=code_block_2)
watch_9 = Watch(location)

# group: Network
network = Orchid.RevitProject.Systems.Mechanical.Network(mechanicalSystem=byName)
connector_2 = Orchid.RevitProject.Systems.Element.Connector(element=network)
duct = Orchid.RevitProject.Systems.Mechanical.Duct(mechanicalSystem=byName)

isPrimary = Orchid.RevitProject.Systems.Connector.IsPrimary(connector=code_block_2)
watch_10 = Watch(isPrimary)
mep_systems = MEPSystem("VI 1")  # graph input
