# Dynamo graph Connector_Piping_R23.dyn "Connector_Piping" (Dynamo 2.16.1.2727)
# packages: Orchid 216.3.0.5794

# note: File: Colling_changed
code_block = CodeBlock { "Cooling Supply"; }
byName = Orchid.RevitProject.Systems.MEPSystem.ByName(name=code_block)

# group: Component
component = Orchid.RevitProject.Systems.Piping.Component(pipingSystem=byName)
accessory = Orchid.RevitProject.Systems.Piping.Accessory(pipingSystem=byName)
fitting = Orchid.RevitProject.Systems.Piping.Fitting(pipingSystem=byName)
equipment = Orchid.RevitProject.Systems.Piping.Equipment(pipingSystem=byName)
connector = Orchid.RevitProject.Systems.FamilyInstance.Connector(familyInstance=equipment)

mep_systems = MEPSystem("Cooling Supply")  # graph input
watch = Watch(connector)
code_block_2 = CodeBlock(data=connector) { data; }
host = Orchid.RevitProject.Systems.Connector.Host(connector=code_block_2)
watch_2 = Watch(host)

# group: Network
pipe = Orchid.RevitProject.Systems.Piping.Pipe(pipingSystem=byName)
connector_2 = Orchid.RevitProject.Systems.Element.Connector(element=pipe)
network = Orchid.RevitProject.Systems.Piping.Network(pipingSystem=byName)

isPrimary = Orchid.RevitProject.Systems.Connector.IsPrimary(connector=code_block_2)
watch_3 = Watch(isPrimary)
direction = Orchid.RevitProject.Systems.Connector.Direction(connector=code_block_2)
watch_4 = Watch(direction)
connection = Orchid.RevitProject.Systems.Connector.Connection(connector=code_block_2)
watch_5 = Watch(connection)
vector = Orchid.RevitProject.Systems.Connector.Vector(connector=code_block_2)
watch_6 = Watch(vector)
shape = Orchid.RevitProject.Systems.Connector.Shape(connector=code_block_2)
watch_7 = Watch(shape.Shape)
location = Orchid.RevitProject.Systems.Connector.Location(connector=code_block_2)
watch_8 = Watch(location)
watch_9 = Watch(shape.Dimension)
isConnected = Orchid.RevitProject.Systems.Connector.IsConnected(connector=code_block_2)
watch_10 = Watch(isConnected)
