# Dynamo graph Mechanical.dyn (Dynamo 2.12.1.8246)
# packages: Orchid 203.3.0.8042, Orchid 212.3.0.8334

# group: Filter System by type
all = Orchid.RevitProject.Systems.MEPSystem.All()
# note: Dropdown value:
# MechanicalSystem
element_types = ElementTypes("MechanicalSystem")  # graph input
typeOf = Orchid.RevitProject.Elements.Element.TypeOf(element=all, type=element_types)
code_block = CodeBlock(system=typeOf) { system; system[0]; }
name = Element.Name(element=typeOf)
byName = Orchid.RevitProject.Systems.MEPSystem.ByName(name=name)
watch = Watch(name)
watch_2 = Watch(typeOf)

boolean = BoolSelector(false)
component = Orchid.RevitProject.Systems.Mechanical.Component(mechanicalSystem=code_block.out1, include=boolean)
connector = Orchid.RevitProject.Systems.FamilyInstance.Connector(familyInstance=component)
handlingUnit = Orchid.RevitProject.Systems.Mechanical.HandlingUnit(mechanicalSystem=code_block.out1)

# group: System
MEPSystem = Orchid.RevitProject.Systems.Connector.MEPSystem(connector=connector)
watch_3 = Watch(MEPSystem.System)
watch_4 = Watch(MEPSystem.Type)
MEPSystem_2 = Orchid.RevitProject.Systems.FamilyInstance.MEPSystem(familyInstance=component)
watch_5 = Watch(MEPSystem_2.System)
MEPSystem_3 = Orchid.RevitProject.Systems.Element.MEPSystem(element=handlingUnit)
watch_6 = Watch(MEPSystem_3.System)
watch_7 = Watch(MEPSystem_3.Classification)
watch_8 = Watch(MEPSystem_2.Classification)

create = Orchid.RevitProject.Systems.Mechanical.Create()  # unwired: baseConnector, connectors, type
watch_9 = Watch(connector)
watch_10 = Watch(component)
mep_systems = MEPSystem("VI 1")  # graph input
code_block_2 = CodeBlock(system=mep_systems) { system; }

# group: Filter SystemType by type
all_2 = Orchid.RevitProject.Systems.MEPSystemType.All()
# note: Dropdown value:
# MechanicalSystemType
element_types_2 = ElementTypes("MechanicalSystemType")  # graph input
typeOf_2 = Orchid.RevitProject.Elements.Element.TypeOf(element=all_2, type=element_types_2)
name_2 = Element.Name(element=typeOf_2)
byName_2 = Orchid.RevitProject.Systems.MEPSystemType.ByName(name=name_2)
watch_11 = Watch(name_2)
watch_12 = Watch(typeOf_2)

# group: Calculation point
code_block_3 = CodeBlock { "LCA MBB"; "PCA MBB"; }
byName_3 = Family.ByName(name=code_block_3.out1)
hasSpatialCalculationPoint = Orchid.RevitProject.Elements.Family.HasSpatialCalculationPoint(family=byName_3)
categories = Categories("OST_DuctTerminal")  # graph input
all_elements_of_category = ElementsOfCategory(Category=categories)
getFromToCalculationPoints = Orchid.RevitProject.Elements.FamilyInstance.GetFromToCalculationPoints(familyInstance=all_elements_of_category)  # frozen
hasFromToCalculationPoints = Orchid.RevitProject.Elements.FamilyInstance.HasFromToCalculationPoints(familyInstance=all_elements_of_category)  # frozen
getSpatialCalculationPoint = Orchid.RevitProject.Elements.FamilyInstance.GetSpatialCalculationPoint(familyInstance=all_elements_of_category)
hasSpatialCalculationPoint_2 = Orchid.RevitProject.Elements.FamilyInstance.HasSpatialCalculationPoint(familyInstance=all_elements_of_category)
# note: Dropdown value:
# Air Terminals
families = Family("PCA MBB")  # graph input

class_ = Orchid.RevitProject.Systems.MEPSystem.Class(system=typeOf)

# group (continued): Filter System by type
watch_13 = Watch(class_)

# group: Duplicate
code_block_4 = CodeBlock { "test"; }
duplicate = Orchid.RevitProject.Systems.Mechanical.Duplicate(mechanicalSystem=code_block.out1, systemName=code_block_4)  # frozen
watch_14 = Watch(duplicate)

# group: SystemType
MEPSystemType = Orchid.RevitProject.Systems.Connector.MEPSystemType(connector=connector)
watch_15 = Watch(MEPSystemType)
MEPSystemType_2 = Orchid.RevitProject.Systems.FamilyInstance.MEPSystemType(familyInstance=component)
watch_16 = Watch(MEPSystemType_2)
MEPSystemType_3 = Orchid.RevitProject.Systems.Element.MEPSystemType(element=handlingUnit)
watch_17 = Watch(MEPSystemType_3)

# group: Network
network = Orchid.RevitProject.Systems.Mechanical.Network(mechanicalSystem=code_block_2)
watch_18 = Watch(network)
duct = Orchid.RevitProject.Systems.Mechanical.Duct(mechanicalSystem=code_block_2)
watch_19 = Watch(duct)

boolean_2 = BoolSelector(true)

# group: Component
terminal = Orchid.RevitProject.Systems.Mechanical.Terminal(mechanicalSystem=code_block_2)
watch_20 = Watch(terminal)
equipment = Orchid.RevitProject.Systems.Mechanical.Equipment(mechanicalSystem=code_block_2)
watch_21 = Watch(equipment)
handlingUnit_2 = Orchid.RevitProject.Systems.Mechanical.HandlingUnit(mechanicalSystem=code_block_2)
watch_22 = Watch(handlingUnit_2)
accessory = Orchid.RevitProject.Systems.Mechanical.Accessory(mechanicalSystem=code_block_2)
watch_23 = Watch(accessory)
fitting = Orchid.RevitProject.Systems.Mechanical.Fitting(mechanicalSystem=code_block_2)
watch_24 = Watch(fitting)
component_2 = Orchid.RevitProject.Systems.Mechanical.Component(mechanicalSystem=code_block_2, include=boolean_2)
watch_25 = Watch(component_2)

# group: MEP
mep_system_class = MEPSystemClass("CableTrayConduit")  # graph input
mep_system_types = MEPSystemType("57-Udsugning")  # graph input
duct_system_type = DuctSystemType("ExhaustAir")  # graph input
mep_systems_2 = MEPSystem("VI 1")  # graph input

watch_26 = Watch(mep_systems_2)
name_3 = Element.Name(element=mep_systems_2)
watch_27 = Watch(name_3)
