# Dynamo graph ApplicationInfo_R21.dyn "ApplicationInfo" (Dynamo 2.12.1.8246)
# packages: Orchid 206.5.0.8348, Orchid 212.3.0.8358

# group: DateTime
o_culture = Culture("da-DK")
o_culture_2 = Culture("en-US")
now = DateTime.Now()
code_block = CodeBlock { "da-DK"; "en-GB"; "es-ES"; "fr-FR"; "de-DE"; "zh-Hant"; "ja-JP"; "en-US"; }
o_culture_byname = Orchid.Common.Global.Culture.ByName(name=code_block.out0)
o_datetime_now = Orchid.Common.Global.DateTime.Now(culture=o_culture_byname)
o_culture_byname_2 = Orchid.Common.Global.Culture.ByName(name=code_block.out5)
o_culture_setdatetime = Orchid.Common.Global.Culture.SetDateTime(culture=o_culture_byname_2)
o_datetime_now_2 = Orchid.Common.Global.DateTime.Now(culture=o_culture_setdatetime)
o_culture_byname_3 = Orchid.Common.Global.Culture.ByName(name=code_block.out7)
o_culture_edit = Orchid.Common.Global.Culture.Edit(culture=o_culture_byname_3)
string = StringInput("\"%a, %d %b %Y %H:%M:%S\"")
o_culture_setdatetime_2 = Orchid.Common.Global.Culture.SetDateTime(culture=o_culture_edit, full=string)
o_datetime_now_3 = Orchid.Common.Global.DateTime.Now(culture=o_culture_setdatetime_2)
list_create = List.Create(item0=now, item1=o_datetime_now, item2=o_datetime_now_2, item3=o_datetime_now_3)

# group: Revit info
o_revit_username = Orchid.AdeskApp.Revit.Username()
o_revit_applicationfolder = Orchid.AdeskApp.Revit.ApplicationFolder()
o_revit_format = Orchid.AdeskApp.Revit.Format()
o_revit_version = Orchid.AdeskApp.Revit.Version()
o_revit_versionbuild = Orchid.AdeskApp.Revit.VersionBuild()
o_revit_language = Orchid.AdeskApp.Revit.Language()
list_create_2 = List.Create(item0=o_revit_username, item1=o_revit_applicationfolder, item2=o_revit_format, item3=o_revit_version, item4=o_revit_versionbuild, item5=o_revit_language)

# group: Dynamo info
o_dynamo_graphpath = Orchid.AdeskApp.Dynamo.GraphPath()
o_dynamo_graphguid = Orchid.AdeskApp.Dynamo.GraphGuid()
o_dynamo_version = Orchid.AdeskApp.Dynamo.Version()
o_dynamo_versionbuild = Orchid.AdeskApp.Dynamo.VersionBuild()
o_dynamo_applicationfolder = Orchid.AdeskApp.Dynamo.ApplicationFolder()
o_dynamo_packagespath = Orchid.AdeskApp.Dynamo.PackagesPath()
o_dynamo_definitionspath = Orchid.AdeskApp.Dynamo.DefinitionsPath()
list_create_3 = List.Create(item0=o_dynamo_graphpath, item1=o_dynamo_graphguid, item2=o_dynamo_version, item3=o_dynamo_versionbuild, item4=o_dynamo_applicationfolder, item5=o_dynamo_packagespath, item6=o_dynamo_definitionspath)

# group: Document info
o_document_info = Orchid.RevitProject.Common.Document.Info()
o_document_unit = Orchid.RevitProject.Common.Document.Unit()
o_document_name = Orchid.RevitProject.Common.Document.Name()
o_document_path = Orchid.RevitProject.Common.Document.Path()
o_document_directory = Orchid.RevitProject.Common.Document.Directory()
list_create_4 = List.Create(item0=o_document_info, item1=o_document_unit, item2=o_document_name, item3=o_document_path, item4=o_document_directory)

list_create_5 = List.Create(item0=list_create_2, item1=list_create_3, item2=list_create_4)
watch = Watch(list_create_5)
watch_2 = Watch(list_create)
