# Dynamo graph Revit Application_R21.dyn (Dynamo 2.6.2.15705)
# packages: Orchid 206.6.0.5794

o_revit_username = Orchid.AdeskApp.Revit.Username()
watch = Watch(o_revit_username)
o_revit_versionbuild = Orchid.AdeskApp.Revit.VersionBuild()
watch_2 = Watch(o_revit_versionbuild)
o_revit_version = Orchid.AdeskApp.Revit.Version()
watch_3 = Watch(o_revit_version)
o_revit_format = Orchid.AdeskApp.Revit.Format()
watch_4 = Watch(o_revit_format)
