# Dynamo graph Core-Scripting_R22.dyn "Core-Scripting_R21" (Dynamo 2.12.1.8246)
# packages: Orchid 212.4.0.5794

# group: CSV writer with delimiter
string = StringInput("%userprofile%\Programming\Testing\Data\")  # graph input
o_directory_frompath = Orchid.Common.Directory.FromPath(path=string)
code_block = CodeBlock(dir=o_directory_frompath) { dir + "test.csv"; }
string_2 = StringInput("\n")
code_block_2 = CodeBlock { ["Hello","World"]; }
sort = List.Sort(list=code_block_2)  # frozen
join = String.Join(separator=string_2, string0=sort)
writeText = FileSystem.WriteText(filePath=code_block, text=join)
watch = Watch(join)

# group: Filter a list by Null values as the mask
code_block_3 = CodeBlock()
# ---------- code_block_3.designscript (3 lines) ----------
"A".."H";
["X","X",null,"X",
null,null,"X",null];
# ----------------------------------------
o_list_filterbynullmask = Orchid.Common.List.FilterByNullMask(list=code_block_3.out0, mask=code_block_3.out1)
watch_2 = Watch(o_list_filterbynullmask.out)
watch_3 = Watch(o_list_filterbynullmask.in)

# group: Python -> the "old" way
string_3 = StringInput("%userprofile%\Programming\Testing\Data\")  # graph input
string_4 = StringInput("ScriptTest.py")  # graph input
o_directory_contents = Orchid.Common.Directory.Contents(directory=string_3, searchString=string_4)
readText = FileSystem.ReadText(file=o_directory_contents)
watch_4 = Watch(readText)
python_script_from_string = PythonStringNode(script=readText)  # CPython3
watch_5 = Watch(python_script_from_string)

# group: Python
string_5 = StringInput("%userprofile%\Programming\Testing\Data\")  # graph input
string_6 = StringInput("ScriptTest.py")  # graph input
boolean = BoolSelector(false)  # graph input
o_scripting_scriptfilereader = Orchid.Common.Scripting.ScriptFileReader(path=string_5, file=string_6, refresh=boolean)
python_script_from_string_2 = PythonStringNode(script=o_scripting_scriptfilereader)  # CPython3
watch_6 = Watch(python_script_from_string_2)
watch_7 = Watch(o_scripting_scriptfilereader)

# group: Await
code_block_4 = CodeBlock { [1..5,1..5,1..5]; }
code_block_5 = CodeBlock { ["a".."e","a".."e"]; }
o_datastream_await = Orchid.Common.DataStream.Await(pass=code_block_4, waitFor=code_block_5)
watch_8 = Watch(o_datastream_await)

# group: Python
code_block_6 = CodeBlock()
# ---------- code_block_6.designscript (6 lines) ----------
t1 = "%userprofile%\\Programming\\Testing\\Data\\";
t2 = Orchid.Common.Directory.FromPath(t1);
t3 = "ScriptTest.py";
t4 = false;

Orchid.Common.Scripting.ScriptFileReader(t2, t3, t4);
# ----------------------------------------
watch_9 = Watch(code_block_6.out4)
python_script_from_string_3 = PythonStringNode(script=code_block_6.out4)  # CPython3
watch_10 = Watch(python_script_from_string_3)

# group: File from path
string_7 = StringInput("%userprofile%\Programming\Testing\Data\ScriptTest.py")  # graph input
o_file_frompath = Orchid.Common.File.FromPath(path=string_7)
readText_2 = FileSystem.ReadText(file=o_file_frompath)
watch_11 = Watch(readText_2)
watch_12 = Watch(o_file_frompath)

# group: directory from path
string_8 = StringInput("%userprofile%\Programming\Testing\Data\testSet")  # graph input
o_directory_frompath_2 = Orchid.Common.Directory.FromPath(path=string_8)
o_directory_contents_2 = Orchid.Common.Directory.Contents(directory=o_directory_frompath_2)
watch_13 = Watch(o_directory_contents_2)
watch_14 = Watch(o_directory_frompath_2)

# group: About the package
o_about_orchid = Orchid.About.Orchid()
watch_15 = Watch(o_about_orchid)

# group: Dynamo Packages and Definitions Path
o_dynamo_packagespath = Orchid.AdeskApp.Dynamo.PackagesPath()
watch_16 = Watch(o_dynamo_packagespath)
code_block_7 = CodeBlock { Orchid.AdeskApp.Dynamo.PackagesPath(); Orchid.AdeskApp.Dynamo.DefinitionsPath(); }
watch_17 = Watch(code_block_7.out0)
o_dynamo_definitionspath = Orchid.AdeskApp.Dynamo.DefinitionsPath()
watch_18 = Watch(o_dynamo_definitionspath)
watch_19 = Watch(code_block_7.out1)

# group: Circut
code_block_8 = CodeBlock { [1..5,1..5,1..5]; }
boolean_2 = BoolSelector(true)  # graph input
o_datastream_circut = Orchid.Common.DataStream.Circut(pass=code_block_8, state=boolean_2)
watch_20 = Watch(o_datastream_circut)

# group: Filter by Type
code_block_9 = CodeBlock { 2..5..0.5; [2,2.5,3,3.5,4,4.5,5]; }
code_block_10 = CodeBlock { "System.Double"; "System.Int32"; "System.Int64"; }
o_string_toclass = Orchid.Common.String.ToClass(string=code_block_10.out0)
o_object_classof = Orchid.Common.Object.ClassOf(object=code_block_9.out1, class=o_string_toclass)
watch_21 = Watch(o_object_classof)

# group: Current directory
o_directory_current = Orchid.Common.Directory.Current()
watch_22 = Watch(o_directory_current)

# group: Update the package
o_about_update = Orchid.About.Update()
watch_23 = Watch(o_about_update)

# group: Current dynamo graph file
o_dynamo_graphpath = Orchid.AdeskApp.Dynamo.GraphPath()
watch_24 = Watch(o_dynamo_graphpath)
