# Dynamo graph Directory-Rename_R22.dyn "Directory-Rename_R21" (Dynamo 2.12.1.8246)
# packages: Orchid 212.4.0.5794

# group: Open all files in directory and sub directories
string = StringInput("%userprofile%\Programming\Testing\Data\testSet")  # graph input
code_block = CodeBlock { "*.rfa"; false; }
o_directory_contents = Orchid.Common.Directory.Contents(directory=string, searchString=code_block.out0, deepSearch=code_block.out1)

code_block_2 = CodeBlock { false; }
fileName = FileSystem.FileName(path=o_directory_contents, withExtension=code_block_2)

# group: rename all files in directory and sub directories
string_2 = StringInput("%userprofile%\Programming\Testing\Data\testSet")  # graph input
code_block_3 = CodeBlock()
# ---------- code_block_3.designscript (3 lines) ----------
"rfa";
//new names (check list length)
["dummy1","dummy2"];
# ----------------------------------------
o_file_rename = Orchid.Common.File.Rename(directory=string_2, extension=code_block_3.out0, sourceName=fileName, targetName=code_block_3.out1)

watch = Watch(o_file_rename)
watch_2 = Watch(o_directory_contents)
directory_path = StringInput("%userprofile%\Programming\Testing\Data\testSet")  # graph input
code_block_4 = CodeBlock { "*.rfa"; false; }
o_directory_contents_2 = Orchid.Common.Directory.Contents(directory=directory_path, searchString=code_block_4.out0, deepSearch=code_block_4.out1)
partition = DoubleInput(1)  # graph input
sliced_into = DoubleInput(2)  # graph input
count = List.Count(list=o_directory_contents_2)
code_block_5 = CodeBlock(partition=partition, sliced=sliced_into, count=count)
# ---------- code_block_5.designscript (4 lines) ----------
//start
Math.Floor(((partition-1)/sliced)*count);
//end
Math.Ceiling((partition/sliced)*count);
# ----------------------------------------
slice = List.Slice(list=o_directory_contents_2, start=code_block_5.out0, end=code_block_5.out1)
watch_3 = Watch(slice)
