# Dynamo graph File.NewProject_R22.dyn "File.NewProject_R21" (Dynamo 2.12.1.8246)
# packages: Orchid 212.4.0.5794

# group: Template and New Projects
directory_path = StringInput("%userprofile%\Programming\Testing\Data\testSet\")  # graph input
project_file_name = CodeBlock { ["new1", "new2"]; }
extension = StringInput(".rvt")  # graph input
code_block = CodeBlock(a=directory_path, b=project_file_name, c=extension) { a+b+c; }
template_path = StringInput("C:\ProgramData\Autodesk\RVT 2022\Templates\DanEDU\DanEDU Building.rte")  # graph input

# group: Template and New Projects
template_path_2 = StringInput("C:\ProgramData\Autodesk\RVT 2022\Templates\DanEDU\DanEDU Systems.rte")  # graph input
directory_path_2 = StringInput("%userprofile%\Programming\Testing\Data\testSet\")  # graph input
project_file_name_2 = CodeBlock { ["new3", "new4"]; }
extension_2 = StringInput(".rvt")  # graph input
code_block_2 = CodeBlock(a=directory_path_2, b=project_file_name_2, c=extension_2) { a+b+c; }

create = List.Create(item0=template_path, item1=template_path_2)
o_document_newproject = Orchid.RevitProject.Common.Document.NewProject(file=code_block, template=create)
watch = Watch(o_document_newproject)
o_document_newproject_2 = Orchid.RevitProject.Common.Document.NewProject(file=code_block_2, template=template_path_2)
watch_2 = Watch(o_document_newproject_2)
