# Dynamo graph Info-Clipboard_R21.dyn (Dynamo 2.12.1.8246)
# packages: Orchid 212.4.0.8442

# group: Current document Info and copy to clipboard
o_document_info = Orchid.RevitProject.Common.Document.Info()
o_clipboard_copyto = Orchid.Common.Clipboard.CopyTo(object=o_document_info)

watch = Watch(o_clipboard_copyto)
watch_2 = Watch(o_document_info)

# group: File Info and copy to clipboard
directory_path = StringInput("%userprofile%\Programming\Testing\Data\testSet")  # graph input
o_directory_contents = Orchid.Common.Directory.Contents(directory=directory_path)
o_file_info = Orchid.Common.File.Info(file=o_directory_contents)
o_clipboard_copyto_2 = Orchid.Common.Clipboard.CopyTo(object=o_file_info)

watch_3 = Watch(o_file_info)
watch_4 = Watch(o_clipboard_copyto_2)

# group: Clipboard --> copy int
code_block = CodeBlock { 1..5; }
watch_5 = Watch(code_block)
o_clipboard_copyto_3 = Orchid.Common.Clipboard.CopyTo(object=code_block)  # frozen

# group: Clipboard --> copy element
o_selection_elementhasmaterial = Orchid.RevitProject.Elements.Selection.ElementHasMaterial()
watch_6 = Watch(o_selection_elementhasmaterial.Element)
o_clipboard_copyto_4 = Orchid.Common.Clipboard.CopyTo(object=o_selection_elementhasmaterial.Element)  # frozen
