# Dynamo graph List.IncrementalCount_R21.dyn "List.IncrementalCount" (Dynamo 2.3.1.11775)
# packages: Orchid 206.6.0.5794

list_values = CodeBlock()
# ---------- list_values.designscript (6 lines) ----------
[
"a","a", 0,
[],null,"",
"something",
"whatever"
];
# ----------------------------------------
code_block = CodeBlock(list=list_values) { Orchid.Common.List.IncrementalCount(list); }
watch = Watch(code_block)
o_list_incrementalcount = Orchid.Common.List.IncrementalCount(list=list_values)
watch_2 = Watch(o_list_incrementalcount)
list_values_2 = CodeBlock()
# ---------- list_values_2.designscript (9 lines) ----------
[
"a","a", 0,
[],null,"",
"something",
[[["in",[]],
"several",null],
"depths","",0],
"whatever"
];
# ----------------------------------------
o_list_incrementalcount_2 = Orchid.Common.List.IncrementalCount(list=list_values_2)
watch_3 = Watch(o_list_incrementalcount_2)
searchfor_values = CodeBlock()
# ---------- searchfor_values.designscript (8 lines) ----------
//default values
[[], null, ""];

//various test values
[[]];
"something";
["something", []];
[[], null, 0, "", "whatever"];
# ----------------------------------------
watch_4 = Watch(list_values_2)
