# Dynamo graph List.Replace_R21.dyn "List.Replace" (Dynamo 2.3.1.11775)
# packages: Orchid 206.3.0.8040

list_values = CodeBlock()
# ---------- list_values.designscript (6 lines) ----------
[
"a","a", 0,
[],null,"",
"something",
"whatever"
];
# ----------------------------------------
replacewith_value = CodeBlock { "x"; }
code_block = CodeBlock(list=list_values, replaceWith=replacewith_value) { Orchid.Common.List.Replace(list, searchFor, replaceWith); }  # unwired: searchFor
watch = Watch(code_block)
o_list_replace = Orchid.Common.List.Replace(list=list_values, replaceWith=replacewith_value)
watch_2 = Watch(o_list_replace)
list_values_2 = CodeBlock()
# ---------- list_values_2.designscript (9 lines) ----------
[
"a","a", 0,
[],null,"",
"something",
[[["in",[]],
"several",null],
"depths","",0],
"whatever"
];
# ----------------------------------------
o_list_replace_2 = Orchid.Common.List.Replace(list=list_values_2, replaceWith=replacewith_value)
watch_3 = Watch(o_list_replace_2)
code_block_2 = CodeBlock()
# ---------- code_block_2.designscript (10 lines) ----------
//list values
[
[0,0,0],
["","",""],
[2,2,2]
];
//searchFor
"";
//replaceWith value
1;
# ----------------------------------------
o_list_replace_3 = Orchid.Common.List.Replace(list=code_block_2.out0, searchFor=code_block_2.out1, replaceWith=code_block_2.out2)
watch_4 = Watch(o_list_replace_3)
watch_5 = Watch(list_values_2)
searchfor_values = CodeBlock()
# ---------- searchfor_values.designscript (8 lines) ----------
//default values
[[], null, ""];

//various test values
[[]];
"something";
["something", []];
[[], null, 0, "", "whatever"];
# ----------------------------------------
