# Dynamo graph Operators_R22.dyn "Operators_R21" (Dynamo 2.6.2.15705)

# group: Math.Addition
code_block = CodeBlock { 3; }
number_slider = DoubleSlider(5, range=0..10 step 1)
number_slider_2 = DoubleSlider(19.3, range=0..100 step 0.1)
o_math_addition = Orchid.Common.Math.Addition(value0=code_block, value1=number_slider, value2=number_slider_2)
watch = Watch(o_math_addition)

# group: Math.Multiplication
code_block_2 = CodeBlock { 3; }
number_slider_3 = DoubleSlider(5, range=0..10 step 1)
number_slider_4 = DoubleSlider(19.3, range=0..100 step 0.1)
o_math_multiplication = Orchid.Common.Math.Multiplication(value0=code_block_2, value1=number_slider_3, value2=number_slider_4)
watch_2 = Watch(o_math_multiplication)

# group: Math.Subtraction
code_block_3 = CodeBlock { 3; }
number_slider_5 = DoubleSlider(5, range=0..10 step 1)
number_slider_6 = DoubleSlider(19.3, range=0..100 step 0.1)
o_math_subtraction = Orchid.Common.Math.Subtraction(value0=code_block_3, value1=number_slider_5, value2=number_slider_6)
watch_3 = Watch(o_math_subtraction)

# group: Math.Division
code_block_4 = CodeBlock { 3; }
number_slider_7 = DoubleSlider(5, range=0..10 step 1)
number_slider_8 = DoubleSlider(19.3, range=0..100 step 0.1)
o_math_division = Orchid.Common.Math.Division(value0=code_block_4, value1=number_slider_7, value2=number_slider_8)
watch_4 = Watch(o_math_division)
