# Dynamo graph Print_R21.dyn "Print" (Dynamo 2.3.1.11775)
# packages: Orchid 206.3.0.8040

# group: Merge PDF files
code_block = CodeBlock()
# ---------- code_block.designscript (6 lines) ----------
//input documents
["%userprofile%\\Downloads\\PDF\\pdf1.pdf",
"%userprofile%\\Downloads\\PDF\\pdf2.pdf"];

//output file path
"%userprofile%\\Downloads\\PDF\\result.pdf";
# ----------------------------------------
o_file_mergepdf = Orchid.Common.File.MergePDF(documents=code_block.out0, filePath=code_block.out1)  # frozen

# group: Print current view (center and fit to page)
o_printer = Printer("Microsoft Print to PDF")  # graph input
string = StringInput("testSetting")  # graph input
o_print_papersizes = PaperSize("A3", p=o_printer)
o_print_paperplacement = PaperPlacement("Center")  # graph input
o_print_zoomtype = ZoomType("Fit To Page")  # graph input
o_print_createsetting = Orchid.Common.Print.CreateSetting(printer=o_printer, name=string, paperZize=o_print_papersizes, paperPlacement=o_print_paperplacement, zoomType=o_print_zoomtype)
o_print_range = Range("Current window")  # graph input
o_document_activeview = Orchid.RevitProject.Common.Document.ActiveView()
o_print_byview = Orchid.Common.Print.ByView(printer=o_printer, printRange=o_print_range, view=o_document_activeview, printSetting=o_print_createsetting)
# note: if print options there are rarely set need to be included, then connect:
# "Print.SetOptions" output Printsetting to "Print.ByView" input printSetting!
o_datastream_await = Orchid.Common.DataStream.Await(pass=o_print_createsetting, waitFor=o_print_byview)
o_print_deletesetting = Orchid.Common.Print.DeleteSetting(printSetting=o_datastream_await)

# group: Print options there are rarely set
boolean = BoolSelector(true)  # graph input
boolean_2 = BoolSelector(false)  # graph input
o_print_hiddenlineviews = HiddenLineViewsType("Vector Processing")  # graph input
o_print_rasterquality = RasterQuality("Medium")  # graph input
o_print_colordepth = ColorDepthType("Gray Scale")  # graph input
o_print_setoptions = Orchid.Common.Print.SetOptions(printSetting=o_print_createsetting, viewLinksinBlue=boolean, hideReforWorkPlanes=boolean_2, hideUnreferencedViewTags=boolean, maskCoincidentLines=boolean, hideScopeBoxes=boolean_2, hideCropBoundaries=boolean_2, replaceHalftoneWithThinLines=boolean, hiddenLineViews=o_print_hiddenlineviews, rasterQuality=o_print_rasterquality, colorDepth=o_print_colordepth)  # frozen

# note: Print Setting may be set
# both as an element and
# as a string
o_print_setting = Setting("Default")  # graph input

# group: Remove print setting
# note: Print Setting may be set
# both as an element and
# as a string
string_2 = StringInput("testSetting")  # graph input
o_print_deletesetting_2 = Orchid.Common.Print.DeleteSetting(printSetting=string_2)  # frozen
o_print_setting_2 = Setting("Default")  # graph input

o_printer_2 = Printer("Microsoft Print to PDF")  # graph input
string_3 = StringInput("testSetting")  # graph input
o_print_createsetting_2 = Orchid.Common.Print.CreateSetting(printer=o_printer_2, name=string_3)
o_print_papersizes_2 = PaperSize("A3", p=o_printer_2)
o_print_pageorientation = PageOrientation("Portrait")  # graph input
o_print_margintype = MarginType("User defined")  # graph input
code_block_2 = CodeBlock { [10,10]; }
o_print_changesetting = Orchid.Common.Print.ChangeSetting(printer=o_printer_2, printSetting=o_print_createsetting_2, paperZize=o_print_papersizes_2, pageOrientation=o_print_pageorientation, marginType=o_print_margintype, margin=code_block_2)
o_printer_3 = Printer("Microsoft Print to PDF")  # graph input
o_sheet_set = SheetSet("A3 set")  # graph input
o_sheetset_getview = Orchid.RevitProject.Views.SheetSet.GetView(viewSheetSet=o_sheet_set)

# group: filePath --> file name incl. path
o_directory_current = Orchid.Common.Directory.Current()
string_4 = StringInput("testSet")  # graph input
sheetNumber = Sheet.SheetNumber(sheet=o_sheetset_getview)
code_block_3 = CodeBlock(a=o_directory_current, b=string_4, c=sheetNumber)
# ---------- code_block_3.designscript (3 lines) ----------
a + "\\" +
b + "\\" +
c;
# ----------------------------------------
# note: Set to "Select" to print the selected views
o_print_range_2 = Range("Selected views/sheets")  # graph input

string_5 = StringInput("Default")  # graph input
o_print_byviewsheetset = Orchid.Common.Print.ByViewSheetSet(printer=o_printer_3, fileName=code_block_3, viewSheetSet=o_sheet_set, printSetting=string_5)  # frozen
boolean_3 = BoolSelector(true)  # graph input
boolean_4 = BoolSelector(true)  # graph input
o_print_byview_2 = Orchid.Common.Print.ByView(printer=o_printer_3, combine=boolean_3, file=boolean_4, fileName=code_block_3, view=o_sheetset_getview)
code_block_4 = CodeBlock { 100; }
o_print_zoomtype_2 = ZoomType("Zoom")  # graph input
o_print_paperplacement_2 = PaperPlacement("Offset from corner")  # graph input
code_block_5 = CodeBlock()
# ---------- code_block_5.designscript (7 lines) ----------
"Adobe PDF";
"Microsoft Print to PDF";
"Microsoft XPS Document Writer";

//Hidden built-in printer
//not supported at the moment!
"Revit DWF Exporter";
# ----------------------------------------
o_print_papersize = Orchid.Common.Print.PaperSize(printer=o_printer_2)
watch = Watch(o_print_papersize)

# group: SheetSet
categories = Categories("OST_ShaftOpening")  # graph input; frozen
all_elements_of_category = ElementsOfCategory(Category=categories)
string_6 = StringInput("testSet")  # graph input
o_sheetset_create = Orchid.RevitProject.Views.SheetSet.Create(view=all_elements_of_category, name=string_6)
o_sheetset_delete = Orchid.RevitProject.Views.SheetSet.Delete(viewSheetSet=o_sheetset_create)
o_sheetset_getview_2 = Orchid.RevitProject.Views.SheetSet.GetView(viewSheetSet=o_sheetset_create)
o_sheet_set_2 = SheetSet("A3 set")  # graph input
o_sheetset_change = Orchid.RevitProject.Views.SheetSet.Change(view=o_sheetset_getview_2, viewSheetSet=o_sheet_set_2)
