# Dynamo graph Timer_R21.dyn "Timer" (Dynamo 2.3.1.11775)
# packages: Orchid 206.6.0.5794

# group: Important! Place DateTime.Now in upper left corner of the graph to get the correct time elapsed
code_block = CodeBlock { 1..80000; }
now = DateTime.Now()
o_datastream_timer = Orchid.Common.DataStream.Timer(pass=code_block, dateTime=now)
mul = o_datastream_timer.pass * o_datastream_timer.pass
o_datastream_timer_2 = Orchid.Common.DataStream.Timer(pass=mul, dateTime=o_datastream_timer.DateTime)
totalSeconds = TimeSpan.TotalSeconds(timeSpan=o_datastream_timer_2.TimeSpan)
watch = Watch(totalSeconds)
totalMilliseconds = TimeSpan.TotalMilliseconds(timeSpan=o_datastream_timer_2.TimeSpan)
watch_2 = Watch(totalMilliseconds)
