# Dynamo graph Analytical elements_R21.dyn "Analytical elements" (Dynamo 2.3.1.11775)
# packages: Orchid 206.3.0.8044

categories = Categories("OST_FloorAnalytical")  # graph input
all_elements_of_category = ElementsOfCategory(Category=categories)

# group: Changes the alignment method of the analytical element
code_block = CodeBlock { "Alignment Method"; }
# note: false = Automatic detection
# true  = Projection
boolean = BoolSelector(false)  # graph input
setParameterByName = Element.SetParameterByName(element=all_elements_of_category, parameterName=code_block, value=boolean)

categories_2 = Categories("OST_WallAnalytical")  # graph input
all_elements_of_category_2 = ElementsOfCategory(Category=categories_2)

# group: Changes the alignment method of the analytical element
code_block_2 = CodeBlock { "Alignment Method"; "Top Extension Method"; "Base Extension Method"; }
# note: false = Automatic detection
# true  = Projection
boolean_2 = BoolSelector(false)  # graph input
setParameterByName_2 = Element.SetParameterByName(element=all_elements_of_category_2, parameterName=code_block_2.out2, value=boolean_2)
setParameterByName_3 = Element.SetParameterByName(element=all_elements_of_category_2, parameterName=code_block_2.out1, value=boolean_2)
setParameterByName_4 = Element.SetParameterByName(element=all_elements_of_category_2, parameterName=code_block_2.out0, value=boolean_2)

# group: Changes the location of the analytical element
code_block_3 = CodeBlock { "Center of Core"; "Center of Element"; "Interior Face of Element"; "Exterior Face of Element"; }
setAnalyticalLocation = Orchid.RevitProject.Elements.SystemFamily.SetAnalyticalLocation(element=all_elements_of_category_2, location=code_block_3.out1)

# group: Changes the location of the analytical element
code_block_4 = CodeBlock { "Top of Element"; "Bottom of Element"; "Center of Element"; }
setAnalyticalLocation_2 = Orchid.RevitProject.Elements.SystemFamily.SetAnalyticalLocation(element=all_elements_of_category, location=code_block_4.out0)
