# Dynamo graph Elem+Fam_R21.dyn "Elem+Fam" (Dynamo 2.12.1.8246)
# packages: Orchid 206.3.0.8040, Orchid 212.3.0.8333

code_block = CodeBlock { ["Floors","Walls","Windows"]; }
o_selection_elementbycategory = Orchid.RevitProject.Elements.Selection.ElementByCategory(category=code_block)
elementType = Element.ElementType(element=o_selection_elementbycategory.Element)
uniqueItems = List.UniqueItems(list=elementType@L2)
o_elementtype_familyname = Orchid.RevitProject.Elements.ElementType.FamilyName(elementType=uniqueItems)
watch = Watch(o_elementtype_familyname)
o_elementtype_name = Orchid.RevitProject.Elements.ElementType.Name(elementType=uniqueItems)
watch_2 = Watch(o_elementtype_name)
name = Element.Name(element=o_selection_elementbycategory.Element)
watch_3 = Watch(name)
o_element_familyname = Orchid.RevitProject.Elements.Element.FamilyName(element=o_selection_elementbycategory.Element)
watch_4 = Watch(o_element_familyname)
o_element_info = Orchid.RevitProject.Elements.Element.Info(element=o_selection_elementbycategory.Element)
watch_5 = Watch(o_element_info.Owner)
watch_6 = Watch(o_element_info.Creator)
watch_7 = Watch(o_element_info.LastChangedBy)
watch_8 = Watch(o_element_info.RequestedBy)

# group: Family
o_families = Family("Ext. Single-Flush")  # graph input
o_selection_elementbyfamily = Orchid.RevitProject.Elements.Selection.ElementByFamily(family=o_families)
watch_9 = Watch(o_selection_elementbyfamily)
