# Dynamo graph ElementRoom_R21.dyn "ElementRoom" (Dynamo 2.3.1.11775)
# packages: Orchid 206.3.0.8040

# group: Room elements
code_block = CodeBlock { "Rooms"; }
o_selection_elementbycategory = Orchid.RevitProject.Elements.Selection.ElementByCategory(category=code_block)
geometry = Element.Geometry(element=o_selection_elementbycategory.Element)
boundingBox = Geometry.BoundingBox(geometry=geometry)
flatten = List.Flatten(list=boundingBox)

# group: FamilyInstance elements
code_block_2 = CodeBlock { ["Doors","Windows"]; }
o_selection_elementbycategory_2 = Orchid.RevitProject.Elements.Selection.ElementByCategory(category=code_block_2)
flatten_2 = List.Flatten(list=o_selection_elementbycategory_2.Element)
o_familyinstance = Orchid.RevitProject.Elements.FamilyInstance.GetFromToCalculationPoints(familyInstance=flatten_2)
lastItem = List.LastItem(list=o_familyinstance, lacing=Longest)
o_boundingbox_pointinside = Orchid.Common.Geometry.BoundingBox.PointInside(boundingBox=flatten, point=lastItem, lacing=CrossProduct)
firstItem = List.FirstItem(list=o_familyinstance, lacing=Longest)
o_boundingbox_pointinside_2 = Orchid.Common.Geometry.BoundingBox.PointInside(boundingBox=flatten, point=firstItem, lacing=CrossProduct)

# group: Set parameter value
filterByBoolMask = List.FilterByBoolMask(list=flatten_2, mask=o_boundingbox_pointinside_2@L2)
code_block_3 = CodeBlock { "Number"; "Comments"; }
getParameterValueByName = Element.GetParameterValueByName(element=o_selection_elementbycategory.Element, parameterName=code_block_3.out0)
setParameterByName = Element.SetParameterByName(element=filterByBoolMask.in, parameterName=code_block_3.out1, value=getParameterValueByName)
o_datastream_await = Orchid.Common.DataStream.Await(pass=o_boundingbox_pointinside, waitFor=setParameterByName)
filterByBoolMask_2 = List.FilterByBoolMask(list=flatten_2, mask=o_datastream_await@L2)
setParameterByName_2 = Element.SetParameterByName(element=filterByBoolMask_2.in, parameterName=code_block_3.out1, value=getParameterValueByName)

watch = Watch(filterByBoolMask_2.in)
watch_2 = Watch(filterByBoolMask.in)
watch_3 = Watch(flatten_2)

# group: Solid intersect element
o_solid_intersect = Orchid.Common.Geometry.Solid.Intersect(solid=geometry)
watch_4 = Watch(o_solid_intersect)
o_solid_intersect_2 = Orchid.Common.Geometry.Solid.Intersect(solid=geometry, elements=flatten_2)
watch_5 = Watch(o_solid_intersect_2)

# group: Boundingbox intersect element
o_boundingbox_intersect = Orchid.Common.Geometry.BoundingBox.Intersect(boundingBox=boundingBox)
watch_6 = Watch(o_boundingbox_intersect)
o_boundingbox_intersect_2 = Orchid.Common.Geometry.BoundingBox.Intersect(boundingBox=boundingBox, element=flatten_2)
watch_7 = Watch(o_boundingbox_intersect_2)

watch_8 = Watch(o_selection_elementbycategory.Element)
