# Dynamo graph Exterior Direction_R21.dyn "Exterior Direction" (Dynamo 2.12.1.8246)
# packages: Orchid 206.3.0.8040

# group: Collect Family elements
code_block = CodeBlock { "Windows"; "Doors"; }
byName = Category.ByName(name=code_block.out0)
all_elements_of_category = ElementsOfCategory(Category=byName)
byName_2 = Category.ByName(name=code_block.out1)
all_elements_of_category_2 = ElementsOfCategory(Category=byName_2)
elementType = Element.ElementType(element=all_elements_of_category_2)
string = StringInput("Function")  # graph input
getParameterValueByName = Element.GetParameterValueByName(element=elementType, parameterName=string)
code_block_2 = CodeBlock(t=getParameterValueByName) { t == 0 ? false : true; }
groupByKey = List.GroupByKey(list=all_elements_of_category_2, keys=code_block_2)
code_block_3 = CodeBlock(keys=groupByKey.uniqueKeys, list=groupByKey.groups) { keys == true ? list : null; }
flatten = List.Flatten(list=code_block_3)
o_list_clean = Orchid.Common.List.Clean(list=flatten)
create = List.Create(item0=all_elements_of_category, item1=o_list_clean)
flatten_2 = List.Flatten(list=create)
code_block_4 = CodeBlock(elements=flatten_2) { elements; }
facingOrientation = FamilyInstance.FacingOrientation(familyInstance=flatten_2)

# group: Collect Curtain Panels elements
code_block_5 = CodeBlock { "Curtain Panels"; }
byName_3 = Category.ByName(name=code_block_5)
all_elements_of_category_3 = ElementsOfCategory(Category=byName_3)
name = Element.Name(element=all_elements_of_category_3)
code_block_6 = CodeBlock(t=name) { t == "Wall" ? true : false; }
groupByKey_2 = List.GroupByKey(list=all_elements_of_category_3, keys=code_block_6)
code_block_7 = CodeBlock(keys=groupByKey_2.uniqueKeys, list=groupByKey_2.groups) { keys == false ? list : null; }
flatten_3 = List.Flatten(list=code_block_7)
o_list_clean_2 = Orchid.Common.List.Clean(list=flatten_3)
elementType_2 = Element.ElementType(element=o_list_clean_2)
groupByKey_3 = List.GroupByKey(list=o_list_clean_2, keys=elementType_2)
code_block_8 = CodeBlock(list=groupByKey_3.groups)
# ---------- code_block_8.designscript (4 lines) ----------
// Curtain Panels
list[0];
// Basic Walls as panels (if exist)
list;
# ----------------------------------------

# group: Curtain Panels
code_block_9 = CodeBlock(elements=code_block_8.out0) { elements; }
panelPlane = CurtainPanel.PanelPlane(curtainPanel=code_block_8.out0)
normal = Plane.Normal(plane=panelPlane)

# group: Basic Walls as panels
verifyListExist = Python(IN[0]=code_block_8.list)  # CPython3
# ---------- verifyListExist.python (5 lines) ----------
try :
	if len(IN[0]) > 1 :
		OUT = IN[0][1]
except :
	OUT = None
# ----------------------------------------
code_block_10 = CodeBlock(elements=verifyListExist) { elements; }
o_wall_orientation = Orchid.RevitProject.Elements.Wall.Orientation(wall=verifyListExist)

# group: Code Block content
code_block_11 = CodeBlock { "Walls"; }
byName_4 = Category.ByName(name=code_block_11)
all_elements_of_category_4 = ElementsOfCategory(Category=byName_4)
elementType_3 = Element.ElementType(element=all_elements_of_category_4)
string_2 = StringInput("Function")  # graph input
getParameterValueByName_2 = Element.GetParameterValueByName(element=elementType_3, parameterName=string_2)
groupByKey_4 = List.GroupByKey(list=all_elements_of_category_4, keys=getParameterValueByName_2)
code_block_12 = CodeBlock(keys=groupByKey_4.uniqueKeys, list=groupByKey_4.groups) { keys == 1 ? list : null; }
flatten_4 = List.Flatten(list=code_block_12)
o_list_clean_3 = Orchid.Common.List.Clean(list=flatten_4)
elementType_4 = Element.ElementType(element=o_list_clean_3)
string_3 = StringInput("Family Name")  # graph input
getParameterValueByName_3 = Element.GetParameterValueByName(element=elementType_4, parameterName=string_3)
groupByKey_5 = List.GroupByKey(list=o_list_clean_3, keys=getParameterValueByName_3)
code_block_13 = CodeBlock(list=groupByKey_5.groups)
# ---------- code_block_13.designscript (4 lines) ----------
// Basic  Walls
list[0];
// Curtain Walls (if exist)
list;
# ----------------------------------------

# group: Basic Walls (stacked wall elements removed)
string_4 = StringInput("Mark")  # graph input
parameterIsReadOnly = Python(IN[0]=code_block_13.out0, IN[1]=string_4)  # CPython3
# ---------- parameterIsReadOnly.python (19 lines) ----------
import clr
clr.AddReference('RevitAPI')
from Autodesk.Revit.DB import *

elements = UnwrapElement(IN[0])
paramname = IN[1]

t1 = []
for elem in elements :
	try :
		for param in elem.Parameters :
			if param.Definition.Name == paramname :
				if param.IsReadOnly :
					t1.append(True)
				else :
					t1.append(False)
	except :
		t1.append(False)
OUT = t1
# ----------------------------------------
groupByKey_6 = List.GroupByKey(list=code_block_13.out0, keys=parameterIsReadOnly)
code_block_14 = CodeBlock(list=groupByKey_6.groups) { list[0]; }
code_block_15 = CodeBlock(elements=code_block_14) { elements; }
o_wall_orientation_2 = Orchid.RevitProject.Elements.Wall.Orientation(wall=code_block_14)

# group: Curtain Walls
verifyListExist_2 = Python(IN[0]=code_block_13.list)  # CPython3; same code as verifyListExist
code_block_16 = CodeBlock(elements=verifyListExist_2) { elements; }
o_wall_orientation_3 = Orchid.RevitProject.Elements.Wall.Orientation(wall=verifyListExist_2)

# group: True North relative to Project North
code_block_17 = CodeBlock { "Site - Project Base Point"; }
byName_5 = Category.ByName(name=code_block_17)
all_elements_of_category_5 = ElementsOfCategory(Category=byName_5)
string_5 = StringInput("Angle to True North")  # graph input
getParameterValueByName_4 = Element.GetParameterValueByName(element=all_elements_of_category_5, parameterName=string_5)

# group: Create element list. Create 'True North' list based on count
create_2 = List.Create(item0=code_block_4, item1=code_block_9, item2=code_block_10, item3=code_block_15, item4=code_block_16)
code_block_18 = CodeBlock(list=create_2, north=getParameterValueByName_4)
# ---------- code_block_18.designscript (4 lines) ----------
// Element list
t1 = DSCore.List.Clean(Flatten(list), false);
// 'True North' list based on count
DSCore.List.Cycle(north,Count(t1));
# ----------------------------------------

# group: Parameter name to be set
string_6 = StringInput("Exterior Direction")  # graph input

# group: Calculate orientation relative to True North (and Project North)
create_3 = List.Create(item0=facingOrientation, item1=normal, item2=o_wall_orientation, item3=o_wall_orientation_2, item4=o_wall_orientation_3)
code_block_19 = CodeBlock(list=create_3)
# ---------- code_block_19.designscript (2 lines) ----------
// Element relative direction
DSCore.List.Clean(Flatten(list), false);
# ----------------------------------------
YAxis = Vector.YAxis()
ZAxis = Vector.ZAxis()
angleAboutAxis = Vector.AngleAboutAxis(vector=code_block_19, otherVector=YAxis, rotationAxis=ZAxis)
code_block_20 = CodeBlock(a=angleAboutAxis, b=code_block_18.out1) { Math.Round(a+b >= 360 ? a+b-360 : a+b , 3); }

setParameterByName = Element.SetParameterByName(element=code_block_18.t1, parameterName=string_6, value=code_block_20)
