# Dynamo graph Family.Save_R21.dyn "Family.Save" (Dynamo 2.3.1.11775)
# packages: Orchid 206.3.0.8042

# group: selected families by category in project
natural_category_name = CodeBlock()
# ---------- natural_category_name.designscript (12 lines) ----------
[
"Casework",
"Columns",
"Doors",
"Windows",
"Specialty Equipment",
"Structural Columns",
"Structural Foundations",
"Structural Framing",
"Structural Beam Systems",
"Structural Stiffeners"
];
# ----------------------------------------
o_selection_elementbycategory = Orchid.RevitProject.Elements.Selection.ElementByCategory(category=natural_category_name)
string = StringInput("..\testSet")  # graph input
boolean = BoolSelector(true)  # graph input

elementType = Element.ElementType(element=o_selection_elementbycategory.Element)

# group (continued): selected families by category in project
uniqueItems = List.UniqueItems(list=elementType, lacing=Longest)
flatten = List.Flatten(list=uniqueItems)
family = FamilyType.Family(familyType=flatten)
o_family_save = Orchid.RevitProject.Elements.Family.Save(family=family, path=string, subfolder=boolean)

watch = Watch(o_family_save)
