# Dynamo graph File+Fam-Load_R22.dyn "File+Fam-Load_R21" (Dynamo 2.12.1.8246)
# packages: Orchid 212.4.0.5794

# group: Open all project files in directory
string = StringInput("%userprofile%\Programming\Testing\Data\testSet")  # graph input
code_block = CodeBlock { "*.rvt"; }
boolean = BoolSelector(false)  # graph input
o_directory_contents = Orchid.Common.Directory.Contents(directory=string, searchString=code_block, deepSearch=boolean)
o_document_backgroundopen = Orchid.RevitProject.Common.Document.BackgroundOpen(file=o_directory_contents)  # frozen
o_family_load = Orchid.RevitProject.Elements.Family.Load(familyDocument=o_document_backgroundopen)
o_datastream_await = Orchid.Common.DataStream.Await(pass=o_document_backgroundopen, waitFor=o_family_load)
o_document_close = Orchid.RevitProject.Common.Document.Close(document=o_datastream_await)

watch = Watch(o_family_load)

# group: Open all files in directory and sub directories
string_2 = StringInput("%userprofile%\Programming\Testing\Data\testSet")  # graph input
code_block_2 = CodeBlock { "*.rfa"; }
boolean_2 = BoolSelector(false)  # graph input
o_directory_contents_2 = Orchid.Common.Directory.Contents(directory=string_2, searchString=code_block_2, deepSearch=boolean_2)
o_document_backgroundopen_2 = Orchid.RevitProject.Common.Document.BackgroundOpen(file=o_directory_contents_2)
o_family_load_2 = Orchid.RevitProject.Elements.Family.Load(familyDocument=o_document_backgroundopen_2)
o_datastream_await_2 = Orchid.Common.DataStream.Await(pass=o_document_backgroundopen_2, waitFor=o_family_load_2)
o_document_close_2 = Orchid.RevitProject.Common.Document.Close(document=o_datastream_await_2)

watch_2 = Watch(o_family_load_2)
