# Dynamo graph Filter_R21.dyn (Dynamo 2.6.2.15705)
# packages: Orchid 206.6.0.5794

# group: Filter elements
# note: File: defaultProject
code_block = CodeBlock { ["Windows","Doors"]; }
byName = Category.ByName(name=code_block)
all_elements_of_category = ElementsOfCategory(Category=byName)
code_block_2 = CodeBlock { "Equals"; "Doors"; "Windows"; }
byName_2 = Category.ByName(name=code_block_2.out2)
o_filter_bycategory = Orchid.RevitProject.Elements.Filter.ByCategory(element=all_elements_of_category, ruleType=code_block_2.out0, value=byName_2)
o_filter_bycategory_2 = Orchid.RevitProject.Elements.Filter.ByCategory(element=all_elements_of_category, ruleType=code_block_2.out0, value=code_block_2.out1)
code_block_3 = CodeBlock { "Contains"; "12x"; }
o_filter_byname = Orchid.RevitProject.Elements.Filter.ByName(element=all_elements_of_category, ruleType=code_block_3.out0, value=code_block_3.out1)
code_block_4 = CodeBlock { "Equals"; "Family"; }
family_types = FamilyTypes("Int. Single-Flush:9x21M")  # graph input
o_filter_byparameter = Orchid.RevitProject.Elements.Filter.ByParameter(element=all_elements_of_category, ruleType=code_block_4.out0, parameterName=code_block_4.out1, value=family_types)
code_block_5 = CodeBlock { "=="; "Level"; }
levels = Levels("Level 1")  # graph input
o_filter_byparameter_2 = Orchid.RevitProject.Elements.Filter.ByParameter(element=all_elements_of_category, ruleType=code_block_5.out0, parameterName=code_block_5.out1, value=levels)
elementType = Element.ElementType(element=all_elements_of_category)
code_block_6 = CodeBlock { "Greater"; "Width"; 1000; }
o_filter_byparameter_3 = Orchid.RevitProject.Elements.Filter.ByParameter(element=elementType, ruleType=code_block_6.out0, parameterName=code_block_6.out1, value=code_block_6.out2)

watch = Watch(o_filter_bycategory)
watch_2 = Watch(o_filter_bycategory_2)
watch_3 = Watch(o_filter_byname)
watch_4 = Watch(o_filter_byparameter)
code_block_7 = CodeBlock()
# ---------- code_block_7.designscript (25 lines) ----------
// Dynamo RuleTypes
// Please notice the spelling
// issue --> GeaterOrEqual
"BeginsWith";
"Contains";
"EndsWith";
"Equals";
"Greater";
"Less";
"GeaterOrEqual";
"GreaterOrEqual";
"LessOrEqual";
"NotBeginsWith";
"NotContains";
"NotEndsWith";
"NotEquals";

// Orchid additional
// Ruletypes
"==";
">";
"<";
">=";
"<=";
"!=";
# ----------------------------------------
select_rule_type = RuleTypes("GreaterOrEqual")  # graph input
watch_5 = Watch(o_filter_byparameter_2)
watch_6 = Watch(o_filter_byparameter_3)
