# Dynamo graph LightSource_FamilyType_R22.dyn "LightSource_FamilyType" (Dynamo 2.12.1.8246)
# packages: Orchid 212.4.0.5794

o_familytype_indocument = Orchid.RevitProject.Elements.FamilyType.InDocument()
watch = Watch(o_familytype_indocument.FamilyType)
watch_2 = Watch(o_familytype_indocument.Category)

# group: collect
code_block = CodeBlock { "LundtofteLamp"; }
o_family_byname = Orchid.RevitProject.Elements.Family.ByName(name=code_block)
types = Family.Types(family=o_family_byname)

# group: Set light color
code_block_2 = CodeBlock(familyType=types)
# ---------- code_block_2.designscript (6 lines) ----------
familyType;
// Style
"PresetColor";

3100;
"FluorescentWarm";
# ----------------------------------------
o_familytype_setlightcustomcolor = Orchid.RevitProject.Elements.FamilyType.SetLightCustomColor(familyType=code_block_2.familyType, value=code_block_2.out2)  # frozen
o_lighting_color_preset = ColorPreset("Fluorescent (Warm White)")
o_familytype_setlightpresetcolor = Orchid.RevitProject.Elements.FamilyType.SetLightPresetColor(familyType=code_block_2.familyType, name=o_lighting_color_preset)  # frozen
o_initial_color_style = InitialColor("Custom color")
o_familytype_setlightcolor = Orchid.RevitProject.Elements.FamilyType.SetLightColor(familyType=code_block_2.familyType, style=o_initial_color_style, name=o_lighting_color_preset, value=code_block_2.out2)

# group: Get light color
o_familytype_getlightcolor = Orchid.RevitProject.Elements.FamilyType.GetLightColor(familyType=o_familytype_setlightcustomcolor)
watch_3 = Watch(o_familytype_getlightcolor.Value)
o_familytype_getlightcolor_2 = Orchid.RevitProject.Elements.FamilyType.GetLightColor(familyType=o_familytype_setlightpresetcolor)
watch_4 = Watch(o_familytype_getlightcolor_2.Value)
o_familytype_getlightcolor_3 = Orchid.RevitProject.Elements.FamilyType.GetLightColor(familyType=o_familytype_setlightcolor)
watch_5 = Watch(o_familytype_getlightcolor_3.Style)
watch_6 = Watch(o_familytype_getlightcolor_3.Value)

# group: Set light intensity
code_block_3 = CodeBlock(familyType=types)
# ---------- code_block_3.designscript (14 lines) ----------
familyType;
// Style
"Flux";

// Wattage
10;
150;
// Flux
1400;
// Luminous
440;
// lluminance
50;
3048;
# ----------------------------------------
o_familytype = Orchid.RevitProject.Elements.FamilyType.SetLightWattageIntensity(familyType=code_block_3.familyType, wattage=code_block_3.out2, efficacy=code_block_3.out3)  # frozen
o_familytype_2 = Orchid.RevitProject.Elements.FamilyType.SetLightFluxIntensity(familyType=code_block_3.familyType, value=code_block_3.out4)  # frozen
o_familytype_3 = Orchid.RevitProject.Elements.FamilyType.SetLightLuminousIntensity(familyType=code_block_3.familyType, value=code_block_3.out5)  # frozen
o_familytype_4 = Orchid.RevitProject.Elements.FamilyType.SetLightIlluminanceIntensity(familyType=code_block_3.familyType, illuminance=code_block_3.out6, distance=code_block_3.out7)  # frozen
o_initial_intensity_style = InitialIntensity("Flux intensity")
o_familytype_setlightintensity = Orchid.RevitProject.Elements.FamilyType.SetLightIntensity(familyType=code_block_3.familyType, style=o_initial_intensity_style, valueA=code_block_3.out4)

# group: Get light intensity
o_familytype_getlightintensity = Orchid.RevitProject.Elements.FamilyType.GetLightIntensity(familyType=o_familytype)
watch_7 = Watch(o_familytype_getlightintensity.Value)
o_familytype_getlightintensity_2 = Orchid.RevitProject.Elements.FamilyType.GetLightIntensity(familyType=o_familytype_2)
watch_8 = Watch(o_familytype_getlightintensity_2.Value)
o_familytype_getlightintensity_3 = Orchid.RevitProject.Elements.FamilyType.GetLightIntensity(familyType=o_familytype_3)
watch_9 = Watch(o_familytype_getlightintensity_3.Value)
o_familytype_getlightintensity_4 = Orchid.RevitProject.Elements.FamilyType.GetLightIntensity(familyType=o_familytype_4)
watch_10 = Watch(o_familytype_getlightintensity_4.Value)
o_familytype_getlightintensity_5 = Orchid.RevitProject.Elements.FamilyType.GetLightIntensity(familyType=o_familytype_setlightintensity)
watch_11 = Watch(o_familytype_getlightintensity_5.Style)
watch_12 = Watch(o_familytype_getlightintensity_5.Value)

# group: Set light loss factor
code_block_4 = CodeBlock(familyType=types)
# ---------- code_block_4.designscript (7 lines) ----------
familyType;

// Style
"Basic";
3.0;
1.25;
0.75;
# ----------------------------------------
o_familytype_setbasiclossfactor = Orchid.RevitProject.Elements.FamilyType.SetBasicLossFactor(familyType=code_block_4.familyType, value=code_block_4.out2)  # frozen
o_familytype_5 = Orchid.RevitProject.Elements.FamilyType.SetAdvancedLossFactor(familyType=code_block_4.familyType, temperature=code_block_4.out3, voltage=code_block_4.out3, ballast=code_block_4.out4, tilt=code_block_4.out4, surface=code_block_4.out4, lumen=code_block_4.out4, luminaire=code_block_4.out4)  # frozen
o_loss_factor_style = LossFactor("Basic loss factor")
o_familytype_setlightlossfactor = Orchid.RevitProject.Elements.FamilyType.SetLightLossFactor(familyType=code_block_4.familyType, style=o_loss_factor_style, value=code_block_4.out2, temperature=code_block_4.out3, voltage=code_block_4.out3, ballast=code_block_4.out4, tilt=code_block_4.out4, surface=code_block_4.out4, lumen=code_block_4.out4, luminaire=code_block_4.out4)

# group: Get light loss factor
o_familytype_getlightlossfactor = Orchid.RevitProject.Elements.FamilyType.GetLightLossFactor(familyType=o_familytype_setbasiclossfactor)
watch_13 = Watch(o_familytype_getlightlossfactor.Value)
o_familytype_getlightlossfactor_2 = Orchid.RevitProject.Elements.FamilyType.GetLightLossFactor(familyType=o_familytype_5)
watch_14 = Watch(o_familytype_getlightlossfactor_2.Value)
o_familytype_getlightlossfactor_3 = Orchid.RevitProject.Elements.FamilyType.GetLightLossFactor(familyType=o_familytype_setlightlossfactor)
watch_15 = Watch(o_familytype_getlightlossfactor_3.Style)
watch_16 = Watch(o_familytype_getlightlossfactor_3.Value)

# group: Set light dimming color data
code_block_5 = CodeBlock(familyType=types) { familyType; "None"; }
o_light_dimming_color = LightDimmingColor("Incandescent lamp curve dimming color")
o_familytype_6 = Orchid.RevitProject.Elements.FamilyType.SetLightDimmingColor(familyType=code_block_5.familyType, name=o_light_dimming_color)

# group: Get light dimming color data
o_familytype_7 = Orchid.RevitProject.Elements.FamilyType.GetLightDimmingColor(familyType=o_familytype_6)
watch_17 = Watch(o_familytype_7)

# group: Set light color filter data
code_block_6 = CodeBlock(familyType=types)
# ---------- code_block_6.designscript (3 lines) ----------
familyType;
Color.ByARGB
(0, 127, 127, 127);
# ----------------------------------------
o_familytype_setlightcolorfilter = Orchid.RevitProject.Elements.FamilyType.SetLightColorFilter(familyType=code_block_6.familyType, color=code_block_6.out1)

# group: Get light color filter data
o_familytype_getlightcolorfilter = Orchid.RevitProject.Elements.FamilyType.GetLightColorFilter(familyType=o_familytype_setlightcolorfilter)
watch_18 = Watch(o_familytype_getlightcolorfilter)

# group: Set light distribution data
code_block_7 = CodeBlock(familyType=types) { familyType; "Spherical"; }
o_light_distribution_style = LightDistributionStyle("Spot light distribution")
o_familytype_8 = Orchid.RevitProject.Elements.FamilyType.SetLightDistribution(familyType=code_block_7.familyType, style=o_light_distribution_style)

# group: Get light distribution data
o_familytype_9 = Orchid.RevitProject.Elements.FamilyType.GetLightDistribution(familyType=o_familytype_8)
watch_19 = Watch(o_familytype_9.Style)
watch_20 = Watch(o_familytype_9.Value)

# group: Set light shape data
code_block_8 = CodeBlock(familyType=types) { familyType; "Point"; }
o_light_shape_style = LightShapeStyle("Rectangle")
o_familytype_setlightshape = Orchid.RevitProject.Elements.FamilyType.SetLightShape(familyType=code_block_8.familyType, style=o_light_shape_style)

# group: Get light shape data
o_familytype_getlightshape = Orchid.RevitProject.Elements.FamilyType.GetLightShape(familyType=o_familytype_setlightshape)
watch_21 = Watch(o_familytype_getlightshape.Style)
watch_22 = Watch(o_familytype_getlightshape.Value)
