# Dynamo graph Material_R21.dyn "Material" (Dynamo 2.3.1.11775)
# packages: Orchid 206.3.0.8042

o_selection_elementhasmaterial = Orchid.RevitProject.Elements.Selection.ElementHasMaterial()
o_list_clean = Orchid.Common.List.Clean(list=o_selection_elementhasmaterial.Element)
flatten = List.Flatten(list=o_list_clean)

# group: get elements sorted by used materials including summarized area and volumne
getMaterials = Element.GetMaterials(element=flatten)
flatten_2 = List.Flatten(list=getMaterials)
uniqueItems = List.UniqueItems(list=flatten_2)
o_material_sum = Orchid.RevitProject.Elements.Material.Sum(material=uniqueItems)
element_by_material_watch = Watch(o_material_sum.Material)
volumne_watch = Watch(o_material_sum.volumne)
area_watch = Watch(o_material_sum.area)
name = Element.Name(element=uniqueItems)
material_name_watch = Watch(name)

# group: get materials--their area and volumne--by elements
o_material_sumbyelement = Orchid.RevitProject.Elements.Material.SumByElement(element=flatten)
volumne_watch_2 = Watch(o_material_sumbyelement.volumne)
area_watch_2 = Watch(o_material_sumbyelement.area)
name_2 = Element.Name(element=o_material_sumbyelement.Material)
material_name_watch_2 = Watch(name_2)
material_by_element_watch = Watch(o_material_sumbyelement.Material)

# group: get summarized (area and volumne) materials by elements and their asset density
o_material_quantity = Orchid.RevitProject.Elements.Material.Quantity(element=flatten)
volumne_watch_3 = Watch(o_material_quantity.volumne)
o_material_density = Orchid.RevitMaterial.Material.Density(material=o_material_quantity.Material)
physical_density_watch = Watch(o_material_density.Physical)
thermal_density_watch = Watch(o_material_density.Thermal)
area_watch_3 = Watch(o_material_quantity.area)
name_3 = Element.Name(element=o_material_quantity.Material)
material_name_watch_3 = Watch(name_3)

natural_category_name = CodeBlock()
# ---------- natural_category_name.designscript (26 lines) ----------
[
"Casework",
"Ceilings",
"Columns",
"Curtain Wall Mullions",
"Curtain Panels",
"Curtain Systems",
"Doors",
"Entourage",
"Floors",
"Furniture",
"Furniture Systems",
"Generic Models",
"Plumbing Fixtures",
"Ramps",
"Roofs",
"Specialty Equipment",
"Stairs",
"Structural Columns",
"Structural Foundations",
"Structural Framing",
"Structural Beam Systems",
"Structural Stiffeners",
"Walls",
"Windows"
];
# ----------------------------------------
byName = Category.ByName(name=natural_category_name)
all_elements_of_category = ElementsOfCategory(Category=byName)
