# Dynamo graph SetType-Random_R21.dyn (Dynamo 2.6.2.15705)
# packages: Orchid 206.6.0.5794

# group: Collect elements
# note: File: CurtainPanel
family_types = FamilyTypes("Sunshade Panel Wide:Expanded metal Small")  # graph input
family_types_2 = FamilyTypes("Sunshade Panel Wide:Expanded metal Large")  # graph input
create = List.Create(item0=family_types, item1=family_types_2)
all_elements_of_family_type = ElementsOfFamilyType(Family_Type=create)

flatten = List.Flatten(list=all_elements_of_family_type)
asFamilyInstance = CurtainPanel.AsFamilyInstance(curtainPanel=flatten)

# group: Randomization
count = List.Count(list=flatten)
o_math_randomlist = Orchid.Common.Math.RandomList(amount=count)
round = Math.Round(number=o_math_randomlist)

getItemAtIndex = List.GetItemAtIndex(list=create, index=round)

# group: SetType
o_familyinstance_settype = Orchid.RevitProject.Elements.FamilyInstance.SetType(familyInstance=asFamilyInstance, familyType=getItemAtIndex)

# group: Random
code_block = CodeBlock { 4; }
o_math_randomlist_2 = Orchid.Common.Math.RandomList(amount=count, range=code_block)
watch = Watch(o_math_randomlist_2)
o_math_random = Orchid.Common.Math.Random(range=code_block)
watch_2 = Watch(o_math_random)
