# Dynamo graph SpatialElement_R21.dyn (Dynamo 2.6.2.15705)
# packages: Orchid 206.6.0.5794

# group: Boundary conditions
o_spatialelement = SpatialElementBoundaryLocation("Finish")  # "o|SpatialElement BoundaryLocation"
o_spatialelement_type = SpatialElementType("Room")
o_spatialelement_2 = Orchid.RevitProject.Elements.SpatialElement.SetBoundaryConditions(boundaryLocation=o_spatialelement, spatialType=o_spatialelement_type)

# group: Get boundary curves
code_block = CodeBlock { "Room"; "Space"; "Area"; }
o_spatialelement_indocument = Orchid.RevitProject.Elements.SpatialElement.InDocument(spatialType=code_block.out0)
o_spatialelement_3 = Orchid.RevitProject.Elements.SpatialElement.GetSeparationLine(spatialElement=o_spatialelement_indocument)
watch = Watch(o_spatialelement_3.Curve)
o_spatialelement_boundary = Orchid.RevitProject.Elements.SpatialElement.Boundary(spatialElement=o_spatialelement_indocument)
watch_2 = Watch(o_spatialelement_boundary.Curve)
watch_3 = Watch(o_spatialelement_3.Element)
watch_4 = Watch(o_spatialelement_boundary.Element)

# group: Change state for volume computation
boolean = BoolSelector(true)
o_document_volumecomputation = Orchid.RevitProject.Common.Document.VolumeComputation(state=boolean)

# group: Revit links
# note: File: LinkedProject
o_link_getrevitlink = Orchid.RevitProject.Common.Link.GetRevitLink()
o_link_instance = Orchid.RevitProject.Common.Link.Instance(link=o_link_getrevitlink)
o_link_document = Orchid.RevitProject.Common.Link.Document(instance=o_link_instance)
code_block_2 = CodeBlock { "Rooms"; "Spaces"; "Areas"; }
byName = Category.ByName(name=code_block_2.out0)
o_element_bycategory = Orchid.RevitProject.Elements.Element.ByCategory(document=o_link_document, category=byName)
o_spatialelement_4 = Orchid.RevitProject.Elements.SpatialElement.GetSeparationLine(document=o_link_document, spatialElement=o_element_bycategory.Element)
watch_5 = Watch(o_spatialelement_4.Curve)
watch_6 = Watch(o_spatialelement_4.Element)
o_spatialelement_boundary_2 = Orchid.RevitProject.Elements.SpatialElement.Boundary(document=o_link_document, spatialElement=o_element_bycategory.Element)
watch_7 = Watch(o_spatialelement_boundary_2.Curve)
watch_8 = Watch(o_spatialelement_boundary_2.Element)

# group: Get boundary curves by specific boundary
code_block_3 = CodeBlock { "Rooms"; "Spaces"; }
byName_2 = Category.ByName(name=code_block_3.out0)
o_element_bycategory_2 = Orchid.RevitProject.Elements.Element.ByCategory(category=byName_2)
o_spatialelement_coreboundary = Orchid.RevitProject.Elements.SpatialElement.CoreBoundary(spatialElement=o_element_bycategory_2.Element)
o_spatialelement_5 = Orchid.RevitProject.Elements.SpatialElement.CoreCenterBoundary(spatialElement=o_element_bycategory_2.Element)
o_spatialelement_finishboundary = Orchid.RevitProject.Elements.SpatialElement.FinishBoundary(spatialElement=o_element_bycategory_2.Element)
watch_9 = Watch(o_spatialelement_finishboundary.Element)
watch_10 = Watch(o_spatialelement_finishboundary.Curve)
o_spatialelement_centerboundary = Orchid.RevitProject.Elements.SpatialElement.CenterBoundary(spatialElement=o_element_bycategory_2.Element)
watch_11 = Watch(o_spatialelement_centerboundary.Curve)
watch_12 = Watch(o_spatialelement_centerboundary.Element)

# group: Spatial Elements
code_block_4 = CodeBlock { "Room"; "Space"; "Area"; }
o_spatialelement_indocument_2 = Orchid.RevitProject.Elements.SpatialElement.InDocument(spatialType=code_block_4.out0)
watch_13 = Watch(o_spatialelement_indocument_2)
o_spatialelement_indocument_3 = Orchid.RevitProject.Elements.SpatialElement.InDocument()
watch_14 = Watch(o_spatialelement_indocument_3)

# group: Inside spatial element?
code_block_5 = CodeBlock { "Room"; "Space"; "Area"; 500; }
o_spatialelement_indocument_4 = Orchid.RevitProject.Elements.SpatialElement.InDocument(spatialType=code_block_5.out1)
byCoordinates = Point.ByCoordinates(x=code_block_5.out3, y=code_block_5.out3, z=code_block_5.out3)
o_spatialelement_isinsidespace = Orchid.RevitProject.Elements.SpatialElement.IsInsideSpace(space=o_spatialelement_indocument_4, point=byCoordinates)
watch_15 = Watch(o_spatialelement_isinsidespace)
o_spatialelement_indocument_5 = Orchid.RevitProject.Elements.SpatialElement.InDocument(spatialType=code_block_5.out0)
o_spatialelement_isinsideroom = Orchid.RevitProject.Elements.SpatialElement.IsInsideRoom(room=o_spatialelement_indocument_5, point=byCoordinates)
watch_16 = Watch(o_spatialelement_isinsideroom)

# group: Name, number, and location
code_block_6 = CodeBlock { "Room"; "Space"; "Area"; }
o_spatialelement_indocument_6 = Orchid.RevitProject.Elements.SpatialElement.InDocument(spatialType=code_block_6.out0)
o_spatialelement_centerlocation = Orchid.RevitProject.Elements.SpatialElement.CenterLocation(spatialElement=o_spatialelement_indocument_6)
o_spatialelement_location = Orchid.RevitProject.Elements.SpatialElement.Location(spatialElement=o_spatialelement_centerlocation)
watch_17 = Watch(o_spatialelement_location)
code_block_7 = CodeBlock { a = "Room "; b = 1..4; a+b; 101..104; }
o_spatialelement_setname = Orchid.RevitProject.Elements.SpatialElement.SetName(spatialElement=o_spatialelement_indocument_6, value=code_block_7.out2)
o_spatialelement_name = Orchid.RevitProject.Elements.SpatialElement.Name(spatialElement=o_spatialelement_setname)
watch_18 = Watch(o_spatialelement_name)
string_from_object = FromObject(obj=code_block_7.out3)
o_spatialelement_setnumber = Orchid.RevitProject.Elements.SpatialElement.SetNumber(spatialElement=o_spatialelement_indocument_6, value=string_from_object)
o_spatialelement_number = Orchid.RevitProject.Elements.SpatialElement.Number(spatialElement=o_spatialelement_setnumber)
watch_19 = Watch(o_spatialelement_number)

# group: Height, area, volume, and phase
code_block_8 = CodeBlock { "Room"; "Space"; "Area"; }
o_spatialelement_indocument_7 = Orchid.RevitProject.Elements.SpatialElement.InDocument(spatialType=code_block_8.out1)
o_spatialelement_height = Orchid.RevitProject.Elements.SpatialElement.Height(spatialElement=o_spatialelement_indocument_7)
watch_20 = Watch(o_spatialelement_height)
o_spatialelement_area = Orchid.RevitProject.Elements.SpatialElement.Area(spatialElement=o_spatialelement_indocument_7)
watch_21 = Watch(o_spatialelement_area)
o_spatialelement_volume = Orchid.RevitProject.Elements.SpatialElement.Volume(spatialElement=o_spatialelement_indocument_7)
watch_22 = Watch(o_spatialelement_volume)
o_spatialelement_phase = Orchid.RevitProject.Elements.SpatialElement.Phase(spatialElement=o_spatialelement_indocument_7)
watch_23 = Watch(o_spatialelement_phase)
