# Dynamo graph SystemFamilyType_R21.dyn "SystemFamilyType" (Dynamo 2.3.1.11775)
# packages: Orchid 206.3.0.8042

# group: Ceiling
o_ceiling_types = CeilingType("Generic - 300mm")  # graph input
o_systemfamilytype = Orchid.RevitProject.Elements.SystemFamilyType.ThermalProperties(elementType=o_ceiling_types)
watch = Watch(o_systemfamilytype.HeatTransferCoefficient)
watch_2 = Watch(o_systemfamilytype.ThermalResistance)
watch_3 = Watch(o_systemfamilytype.ThermalMass)
watch_4 = Watch(o_systemfamilytype.Absorptance)
watch_5 = Watch(o_systemfamilytype.Roughness)

# group: Floor
floor_types = FloorTypes("Suspended - 300mm LW Concrete / Wood Planks")  # graph input
o_systemfamilytype_2 = Orchid.RevitProject.Elements.SystemFamilyType.ThermalProperties(elementType=floor_types)
watch_6 = Watch(o_systemfamilytype_2.HeatTransferCoefficient)
watch_7 = Watch(o_systemfamilytype_2.ThermalResistance)
watch_8 = Watch(o_systemfamilytype_2.ThermalMass)
watch_9 = Watch(o_systemfamilytype_2.Absorptance)
watch_10 = Watch(o_systemfamilytype_2.Roughness)
o_floortype_isfoundationslab = Orchid.RevitProject.Elements.FloorType.IsFoundationSlab(FloorType=floor_types)
watch_11 = Watch(o_floortype_isfoundationslab)
o_floortype_structuralmaterial = Orchid.RevitProject.Elements.FloorType.StructuralMaterial(FloorType=floor_types)
watch_12 = Watch(o_floortype_structuralmaterial)

wall_types = WallTypes("Exterior - 468mm Masonry / LW Concrete")  # graph input
o_systemfamilytype_3 = Orchid.RevitProject.Elements.SystemFamilyType.ThermalProperties(elementType=wall_types)
watch_13 = Watch(o_systemfamilytype_3.HeatTransferCoefficient)
watch_14 = Watch(o_systemfamilytype_3.ThermalResistance)
watch_15 = Watch(o_systemfamilytype_3.ThermalMass)
watch_16 = Watch(o_systemfamilytype_3.Absorptance)

# group: Roof
o_roof_types = RoofType("Warm - 500mm Steel Bar Joist / Steel Deck / EPDM Membrane")  # graph input
o_systemfamilytype_4 = Orchid.RevitProject.Elements.SystemFamilyType.ThermalProperties(elementType=o_roof_types)
watch_17 = Watch(o_systemfamilytype_4.Roughness)
watch_18 = Watch(o_systemfamilytype_4.Absorptance)
watch_19 = Watch(o_systemfamilytype_4.ThermalMass)
watch_20 = Watch(o_systemfamilytype_4.ThermalResistance)
watch_21 = Watch(o_systemfamilytype_4.HeatTransferCoefficient)

watch_22 = Watch(o_systemfamilytype_3.Roughness)
o_walltype_function = Orchid.RevitProject.Elements.WallType.Function(wallType=wall_types)
watch_23 = Watch(o_walltype_function)
o_walltype_kind = Orchid.RevitProject.Elements.WallType.Kind(wallType=wall_types)
watch_24 = Watch(o_walltype_kind)
o_walltype_width = Orchid.RevitProject.Elements.WallType.Width(wallType=wall_types)
watch_25 = Watch(o_walltype_width)
