# Dynamo graph Tagging_R21.dyn "Tagging" (Dynamo 2.12.1.8246)
# packages: Orchid 212.3.0.8317

# group: Space tagging
o_model_views = ModelView("Level 1 (hvac)")  # graph input
categories = Categories("OST_MEPSpaces")  # graph input
all_elements_of_category = ElementsOfCategory(Category=categories)
code_block = CodeBlock { "Space Tag"; "Text and Area"; }
byFamilyNameAndTypeName = FamilyType.ByFamilyNameAndTypeName(familyName=code_block.out0, typeName=code_block.out1)
o_tag_byspatialelement = Orchid.RevitProject.Annotations.Tag.BySpatialElement(view=o_model_views, spatialElement=all_elements_of_category, tagType=byFamilyNameAndTypeName)

watch = Watch(o_tag_byspatialelement)

# group: Space tagging by location
o_model_views_2 = ModelView("Level 1 (hvac)")  # graph input
categories_2 = Categories("OST_MEPSpaces")  # graph input
all_elements_of_category_2 = ElementsOfCategory(Category=categories_2)
code_block_2 = CodeBlock { "Space Tag"; "Text and Area"; }
byFamilyNameAndTypeName_2 = FamilyType.ByFamilyNameAndTypeName(familyName=code_block_2.out0, typeName=code_block_2.out1)
getLocation = Element.GetLocation(element=all_elements_of_category_2)
code_block_3 = CodeBlock { true; }
o_tag = Orchid.RevitProject.Annotations.Tag.BySpatialElementAndLocation(view=o_model_views_2, spatialElement=all_elements_of_category_2, tagType=byFamilyNameAndTypeName_2, location=getLocation, addLeader=code_block_3, allowMultiple=code_block_3)

watch_2 = Watch(o_tag)

# group: Area tagging
o_model_views_3 = ModelView("Level 1 (area)")  # graph input
categories_3 = Categories("OST_Areas")  # graph input
all_elements_of_category_3 = ElementsOfCategory(Category=categories_3)
code_block_4 = CodeBlock { "Area Tag"; "Text Only"; }
byFamilyNameAndTypeName_3 = FamilyType.ByFamilyNameAndTypeName(familyName=code_block_4.out0, typeName=code_block_4.out1)
o_tag_byspatialelement_2 = Orchid.RevitProject.Annotations.Tag.BySpatialElement(view=o_model_views_3, spatialElement=all_elements_of_category_3, tagType=byFamilyNameAndTypeName_3)

watch_3 = Watch(o_tag_byspatialelement_2)

# group: Room tagging by location
o_model_views_4 = ModelView("Level 1 (room)")  # graph input
categories_4 = Categories("OST_Rooms")  # graph input
all_elements_of_category_4 = ElementsOfCategory(Category=categories_4)
code_block_5 = CodeBlock { "Room Tag"; "Text Only"; }
byFamilyNameAndTypeName_4 = FamilyType.ByFamilyNameAndTypeName(familyName=code_block_5.out0, typeName=code_block_5.out1)
getLocation_2 = Element.GetLocation(element=all_elements_of_category_4)
code_block_6 = CodeBlock { true; }
o_tag_2 = Orchid.RevitProject.Annotations.Tag.BySpatialElementAndLocation(view=o_model_views_4, spatialElement=all_elements_of_category_4, tagType=byFamilyNameAndTypeName_4, location=getLocation_2, addLeader=code_block_6, allowMultiple=code_block_6)

watch_4 = Watch(o_tag_2)

# group: Room tagging
o_model_views_5 = ModelView("Level 1 (room)")  # graph input
categories_5 = Categories("OST_Rooms")  # graph input
all_elements_of_category_5 = ElementsOfCategory(Category=categories_5)
code_block_7 = CodeBlock { "Room Tag"; "Text Only"; }
byFamilyNameAndTypeName_5 = FamilyType.ByFamilyNameAndTypeName(familyName=code_block_7.out0, typeName=code_block_7.out1)
o_tag_byspatialelement_3 = Orchid.RevitProject.Annotations.Tag.BySpatialElement(view=o_model_views_5, spatialElement=all_elements_of_category_5, tagType=byFamilyNameAndTypeName_5)

watch_5 = Watch(o_tag_byspatialelement_3)

# group: Element tagging by location
o_model_views_6 = ModelView("Level 1 (room)")  # graph input
categories_6 = Categories("OST_Doors")  # graph input
all_elements_of_category_6 = ElementsOfCategory(Category=categories_6)
code_block_8 = CodeBlock { "Door Tag"; "Hinging"; }
byFamilyNameAndTypeName_6 = FamilyType.ByFamilyNameAndTypeName(familyName=code_block_8.out0, typeName=code_block_8.out1)
getLocation_3 = Element.GetLocation(element=all_elements_of_category_6)
code_block_9 = CodeBlock { true; }
o_tag_byelementandlocation = Orchid.RevitProject.Annotations.Tag.ByElementAndLocation(view=o_model_views_6, element=all_elements_of_category_6, tagType=byFamilyNameAndTypeName_6, location=getLocation_3, addLeader=code_block_9, allowMultiple=code_block_9)

watch_6 = Watch(o_tag_byelementandlocation)

# group: Area tagging by location
o_model_views_7 = ModelView("Level 1 (area)")  # graph input
categories_7 = Categories("OST_Areas")  # graph input
all_elements_of_category_7 = ElementsOfCategory(Category=categories_7)
code_block_10 = CodeBlock { "Area Tag"; "Text Only"; }
byFamilyNameAndTypeName_7 = FamilyType.ByFamilyNameAndTypeName(familyName=code_block_10.out0, typeName=code_block_10.out1)
getLocation_4 = Element.GetLocation(element=all_elements_of_category_7)
code_block_11 = CodeBlock { true; }
o_tag_3 = Orchid.RevitProject.Annotations.Tag.BySpatialElementAndLocation(view=o_model_views_7, spatialElement=all_elements_of_category_7, tagType=byFamilyNameAndTypeName_7, location=getLocation_4, addLeader=code_block_11, allowMultiple=code_block_11)

watch_7 = Watch(o_tag_3)

# group: Element tagging
o_model_views_8 = ModelView("Level 1 (room)")  # graph input
categories_8 = Categories("OST_Doors")  # graph input
all_elements_of_category_8 = ElementsOfCategory(Category=categories_8)
code_block_12 = CodeBlock { "Door Tag"; "Hinging"; }
byFamilyNameAndTypeName_8 = FamilyType.ByFamilyNameAndTypeName(familyName=code_block_12.out0, typeName=code_block_12.out1)
o_tag_byelement = Orchid.RevitProject.Annotations.Tag.ByElement(view=o_model_views_8, element=all_elements_of_category_8, tagType=byFamilyNameAndTypeName_8)

watch_8 = Watch(o_tag_byelement)
