# Dynamo graph Transfer-Copy_R22.dyn "Transfer-Copy_R21" (Dynamo 2.12.1.8246)
# packages: Orchid 212.4.0.5794

string = StringInput("%userprofile%\Programming\Testing\Data\2022_Data\")  # graph input
string_2 = StringInput("defaultProject_extended")  # graph input
code_block = CodeBlock(a=string, b=string_2) { a+b+".rvt"; }
o_file_frompath = Orchid.Common.File.FromPath(path=code_block)
o_document_backgroundopen = Orchid.RevitProject.Common.Document.BackgroundOpen(file=o_file_frompath)

# group: Transfer Type
code_block_2 = CodeBlock(document=o_document_backgroundopen) { document; }
string_3 = StringInput("xExterior - 468mm Masonry / LW Concrete")  # graph input
string_4 = StringInput("x18x12M")  # graph input
create = List.Create(item0=string_3, item1=string_4)
boolean = BoolSelector(true)  # graph input
o_document_transferbyelementtype = Orchid.RevitProject.Common.Document.TransferByElementType(source=code_block_2, elementType=create, append=boolean)
watch = Watch(o_document_transferbyelementtype)
o_datastream_await = Orchid.Common.DataStream.Await(pass=code_block_2, waitFor=o_document_transferbyelementtype)

# group: Copy Drafting View
# note: File: defaultProject
code_block_3 = CodeBlock(document=o_document_backgroundopen) { document; }
o_view_indocument = Orchid.RevitProject.Views.View.InDocument(document=code_block_3)
string_from_object = FromObject(obj=o_view_indocument)
code_block_4 = CodeBlock { "Drafting"; }
contains = String.Contains(string=string_from_object, searchFor=code_block_4)
filterByBoolMask = List.FilterByBoolMask(list=o_view_indocument, mask=contains)
o_document_copydraftingview = Orchid.RevitProject.Common.Document.CopyDraftingView(source=code_block_3, draftingView=filterByBoolMask.in)
o_datastream_await_2 = Orchid.Common.DataStream.Await(pass=code_block_3, waitFor=o_document_copydraftingview)
watch_2 = Watch(o_document_copydraftingview)

# group: Copy Schedule
code_block_5 = CodeBlock(document=o_document_backgroundopen) { document; }
code_block_6 = CodeBlock { "Schedule"; }

o_view_indocument_2 = Orchid.RevitProject.Views.View.InDocument(document=code_block_5)

# group (continued): Copy Schedule
string_from_object_2 = FromObject(obj=o_view_indocument_2)
contains_2 = String.Contains(string=string_from_object_2, searchFor=code_block_6)
filterByBoolMask_2 = List.FilterByBoolMask(list=o_view_indocument_2, mask=contains_2)
o_document_copyschedule = Orchid.RevitProject.Common.Document.CopySchedule(source=code_block_5, schedule=filterByBoolMask_2.in)
o_datastream_await_3 = Orchid.Common.DataStream.Await(pass=code_block_5, waitFor=o_document_copyschedule)
watch_3 = Watch(o_document_copyschedule)

# group: Copy Element
code_block_7 = CodeBlock(document=o_document_backgroundopen) { document; }
categories = Categories("OST_Floors")  # graph input
o_element_bycategory = Orchid.RevitProject.Elements.Element.ByCategory(document=code_block_7, category=categories)
o_document_copyelement = Orchid.RevitProject.Common.Document.CopyElement(source=code_block_7, element=o_element_bycategory.Element)
o_datastream_await_4 = Orchid.Common.DataStream.Await(pass=code_block_7, waitFor=o_document_copyelement)
watch_4 = Watch(o_document_copyelement)

# group: Transfer Category
code_block_8 = CodeBlock(document=o_document_backgroundopen) { document; }
categories_2 = Categories("OST_Roofs")  # graph input
boolean_2 = BoolSelector(true)  # graph input
o_document_transferbycategory = Orchid.RevitProject.Common.Document.TransferByCategory(source=code_block_8, category=categories_2, append=boolean_2)
o_datastream_await_5 = Orchid.Common.DataStream.Await(pass=code_block_8, waitFor=o_document_transferbycategory)
watch_5 = Watch(o_document_transferbycategory)

# group: Transfer Family
code_block_9 = CodeBlock(document=o_document_backgroundopen) { document; }
string_5 = StringInput("Single-Light")  # graph input
string_6 = StringInput("xSingle-Light")  # graph input
create_2 = List.Create(item0=string_5, item1=string_6)
boolean_3 = BoolSelector(true)  # graph input
o_document_transferbyfamily = Orchid.RevitProject.Common.Document.TransferByFamily(source=code_block_9, family=create_2, append=boolean_3)
o_datastream_await_6 = Orchid.Common.DataStream.Await(pass=code_block_9, waitFor=o_document_transferbyfamily)
watch_6 = Watch(o_document_transferbyfamily)

# group: Close document
create_3 = List.Create(item0=o_datastream_await_2, item1=o_datastream_await_3, item2=o_datastream_await_4, item3=o_datastream_await_5, item4=o_datastream_await, item5=o_datastream_await_6)
firstItem = List.FirstItem(list=create_3)
o_document_close = Orchid.RevitProject.Common.Document.Close(document=firstItem)
