# Dynamo graph AddConvert_R22.dyn "AddConvert_R21" (Dynamo 2.12.1.8246)
# packages: Orchid 212.4.0.5794

# group: create family type
o_familydocument_current = Orchid.RevitFamily.FamilyDocument.Current()
o_familytype_create = Orchid.RevitFamily.FamilyType.Create(familyDocument=o_familydocument_current)
o_familytype_name = Orchid.RevitFamily.FamilyType.Name(familyType=o_familytype_create)

# group: Add shared parameter
o_datastream_await = Orchid.Common.DataStream.Await(pass=o_familydocument_current, waitFor=o_familytype_create)
code_block = CodeBlock()
# ---------- code_block.designscript (14 lines) ----------
//Parameter name
["Creator Name",
"Creator Organization",
"Creator Build"];
//SP Parameter group
"Sheet & Project";
//Parameter group
"PG_ADSK_MODEL_PROPERTIES";
//Instances
true;
//Reporting
true;
//Condense output
false;
# ----------------------------------------
o_sharedparameter_add = Orchid.RevitFamily.SharedParameter.Add(familyDocument=o_datastream_await, parameterName=code_block.out0, groupName=code_block.out1, group=code_block.out2, instance=code_block.out3)

# group: Toggle shared to family parameter and vice versa
o_familyparameter = Orchid.RevitFamily.FamilyParameter.ToggleFamilyShared(familyDocument=o_datastream_await, parameter=o_sharedparameter_add)
code_block_2 = CodeBlock { true; }
o_familyparameter_2 = Orchid.RevitFamily.FamilyParameter.ToggleFamilyShared(familyDocument=o_datastream_await, parameter=o_familyparameter, shared=code_block_2)
name = FamilyParameter.Name(familyParameter=o_familyparameter_2)
watch = Watch(name)

# group: Set formula
o_datastream_await_2 = Orchid.Common.DataStream.Await(pass=o_familydocument_current, waitFor=o_sharedparameter_add)
code_block_3 = CodeBlock()
# ---------- code_block_3.designscript (8 lines) ----------
//Parameter name
["Creator Name",
"Creator Organization",
"Creator Build"];
//Values
["\"Erik Falck Jørgensen\"",
"\"Danish Educational Content\"",
"\"2022.0406.0\""];
# ----------------------------------------
o_formula_set = Orchid.RevitFamily.Formula.Set(familyDocument=o_datastream_await_2, parameterName=code_block_3.out0, value=code_block_3.out1)

# group: Get Formula
o_datastream_await_3 = Orchid.Common.DataStream.Await(pass=o_datastream_await_2, waitFor=o_formula_set)
code_block_4 = CodeBlock()
# ---------- code_block_4.designscript (4 lines) ----------
//Parameter name
["Creator Name",
"Creator Organization",
"Creator Build"];
# ----------------------------------------
o_formula_get = Orchid.RevitFamily.Formula.Get(familyDocument=o_datastream_await_3, parameterName=code_block_4)

# group: Remove formula
o_datastream_await_4 = Orchid.Common.DataStream.Await(pass=o_datastream_await_3, waitFor=o_formula_get)
code_block_5 = CodeBlock()  # same code as code_block_4
o_formula_remove = Orchid.RevitFamily.Formula.Remove(familyDocument=o_datastream_await_4, parameterName=code_block_5)

# group: Set parameter value
o_datastream_await_5 = Orchid.Common.DataStream.Await(pass=o_datastream_await_4, waitFor=o_formula_remove)
code_block_6 = CodeBlock()
# ---------- code_block_6.designscript (8 lines) ----------
//Parameter name
["Creator Name",
"Creator Organization",
"Creator Build"];
//value
["name","org","build"];
//Condense output
false;
# ----------------------------------------
o_familyparameter_setvalue = Orchid.RevitFamily.FamilyParameter.SetValue(familyDocument=o_datastream_await_5, parameterName=code_block_6.out0, value=code_block_6.out1)

# group: Deprecated --> shared to family parameter
name_2 = FamilyParameter.Name(familyParameter=o_sharedparameter_add)
code_block_7 = CodeBlock()
# ---------- code_block_7.designscript (2 lines) ----------
//Instances
true;
# ----------------------------------------
o_sharedparameter_convert = Orchid.RevitFamily.SharedParameter.Convert(familyDocument=o_datastream_await, parameterName=name_2, instance=code_block_7)  # frozen

# group: Deprecated --> family to shared parameter
code_block_8 = CodeBlock()  # same code as code_block_4
o_definition_getexternal = Orchid.RevitFamily.Definition.GetExternal(name=code_block_8)
o_datastream_await_6 = Orchid.Common.DataStream.Await(pass=o_definition_getexternal, waitFor=o_sharedparameter_convert)
o_familyparameter_convert = Orchid.RevitFamily.FamilyParameter.Convert(familyDocument=o_datastream_await, definition=o_datastream_await_6)

watch_2 = Watch(o_formula_get)

# group: Dynamo FamilyDocument
current = Document.Current()
byDocument = FamilyDocument.ByDocument(document=current)

types = FamilyDocument.Types(familyDocument=o_datastream_await)
watch_3 = Watch(types)

# group: Create shared parameter
o_datastream_await_7 = Orchid.Common.DataStream.Await(pass=o_familydocument_current, waitFor=o_familytype_create)
code_block_9 = CodeBlock()
# ---------- code_block_9.designscript (8 lines) ----------
//Parameter name
"Dynamo test parameter";
//SP Parameter group
"Dynamo test group";
//SP Parameter type
"Text";
//Parameter group
"PG_ADSK_MODEL_PROPERTIES";
# ----------------------------------------
o_sharedparameter_create = Orchid.RevitFamily.SharedParameter.Create(familyDocument=o_datastream_await_7, parameterName=code_block_9.out0, groupName=code_block_9.out1, type=code_block_9.out2, group=code_block_9.out3)

o_object_torevittype = Orchid.Common.Object.ToRevitType(object=o_sharedparameter_create)
o_object_todynamotype = Orchid.Common.Object.ToDynamoType(object=o_object_torevittype)
watch_4 = Watch(o_object_todynamotype)
watch_5 = Watch(o_object_torevittype)

# group: Add family parameter
o_datastream_await_8 = Orchid.Common.DataStream.Await(pass=o_familydocument_current, waitFor=o_familytype_create)
code_block_10 = CodeBlock()
# ---------- code_block_10.designscript (6 lines) ----------
//Parameter name
["test1","test2"];
//SP Parameter type
"Text";
//Parameter group
"PG_ADSK_MODEL_PROPERTIES";
# ----------------------------------------
o_familyparameter_create = Orchid.RevitFamily.FamilyParameter.Create(familyDocument=o_datastream_await_8, parameterName=code_block_10.out0, type=code_block_10.out1, group=code_block_10.out2)

# group: Toogle instance to type and change group
o_datastream_await_9 = Orchid.Common.DataStream.Await(pass=o_datastream_await_8, waitFor=o_familyparameter_create)
code_block_11 = CodeBlock()
# ---------- code_block_11.designscript (4 lines) ----------
//Instances
true;
//Parameter group
"PG_TEXT";
# ----------------------------------------
o_familyparameter_3 = Orchid.RevitFamily.FamilyParameter.ToggleInstanceType(familyDocument=o_datastream_await_9, parameter=o_familyparameter_create, instance=code_block_11.out0)
o_familyparameter_changegroup = Orchid.RevitFamily.FamilyParameter.ChangeGroup(familyDocument=o_datastream_await_9, parameter=o_familyparameter_3, group=code_block_11.out1)
