# Dynamo graph BulkUpgrade_R21.dyn "BulkUpgrade" (Dynamo 2.6.2.15705)
# packages: Orchid 206.3.1.8213

directory_path = StringInput("..\testSet")  # graph input
string = StringInput("*.rfa")  # graph input
boolean = BoolSelector(false)  # graph input
o_directory_contents = Orchid.Common.Directory.Contents(directory=directory_path, searchString=string, deepSearch=boolean)
o_document_backgroundopen = Orchid.RevitProject.Common.Document.BackgroundOpen(file=o_directory_contents)
code_block = CodeBlock()
# ---------- code_block.designscript (8 lines) ----------
//Parameter name
"Creator Build";
//SP Parameter group
"Sheet & Project";
//Parameter group
"PG_ADSK_MODEL_PROPERTIES";
//Instances
true;
# ----------------------------------------
o_sharedparameter_add = Orchid.RevitFamily.SharedParameter.Add(familyDocument=o_document_backgroundopen, parameterName=code_block.out0, groupName=code_block.out1, group=code_block.out2, instance=code_block.out3)
o_datastream_await = Orchid.Common.DataStream.Await(pass=o_document_backgroundopen, waitFor=o_sharedparameter_add)
code_block_2 = CodeBlock()
# ---------- code_block_2.designscript (2 lines) ----------
//parameter name
"Creator Build";
# ----------------------------------------
creator_build = StringInput("\"2020.0406.0\"")  # graph input
o_formula_set = Orchid.RevitFamily.Formula.Set(familyDocument=o_datastream_await, parameterName=code_block_2, value=creator_build)
o_datastream_await_2 = Orchid.Common.DataStream.Await(pass=o_datastream_await, waitFor=o_formula_set)
boolean_2 = BoolSelector(true)  # graph input
o_document_close = Orchid.RevitProject.Common.Document.Close(document=o_datastream_await_2, save=boolean_2)

# group: Cleanup backup files
o_datastream_await_3 = Orchid.Common.DataStream.Await(pass=directory_path, waitFor=o_document_close)
string_2 = StringInput("*.0001.rfa")  # graph input
boolean_3 = BoolSelector(true)  # graph input
o_directory_contents_2 = Orchid.Common.Directory.Contents(directory=o_datastream_await_3, searchString=string_2, deepSearch=boolean_3)
deleteFile = FileSystem.DeleteFile(path=o_directory_contents_2)
