# Dynamo graph CategoryReporting_R21.dyn "CategoryReporting" (Dynamo 2.12.1.8246)
# packages: Orchid 206.3.1.8213

o_familydocument_current = Orchid.RevitFamily.FamilyDocument.Current()

# group: Create types
code_block = CodeBlock()
# ---------- code_block.designscript (2 lines) ----------
//Types to create
["Type 1", "Type 2"];
# ----------------------------------------
o_familytype_create = Orchid.RevitFamily.FamilyType.Create(familyDocument=o_familydocument_current, name=code_block)

# group: Add parameter
o_datastream_await = Orchid.Common.DataStream.Await(pass=o_familydocument_current, waitFor=o_familytype_create)
code_block_2 = CodeBlock()
# ---------- code_block_2.designscript (10 lines) ----------
//Parameter name
"Test";
//Parameter type
"Text";
//Parameter group
"PG_ADSK_MODEL_PROPERTIES";
//Tooltip
"Owner value";
//Instances
true;
# ----------------------------------------
o_familyparameter_create = Orchid.RevitFamily.FamilyParameter.Create(familyDocument=o_datastream_await, parameterName=code_block_2.out0, type=code_block_2.out1, group=code_block_2.out2, tooltip=code_block_2.out3, instance=code_block_2.out4)

# group: Set parameter
o_datastream_await_2 = Orchid.Common.DataStream.Await(pass=o_datastream_await, waitFor=o_familyparameter_create)
code_block_3 = CodeBlock()
# ---------- code_block_3.designscript (6 lines) ----------
//Type
"Type 1";
//Parameter name
"Test";
//Value
"This is a test";
# ----------------------------------------
o_familyparameter_setvalue = Orchid.RevitFamily.FamilyParameter.SetValue(familyDocument=o_datastream_await_2, familyType=code_block_3.out0, parameterName=code_block_3.out1, value=code_block_3.out2)

# group: Add parameter
o_datastream_await_3 = Orchid.Common.DataStream.Await(pass=o_familydocument_current, waitFor=o_familytype_create)
code_block_4 = CodeBlock()
# ---------- code_block_4.designscript (8 lines) ----------
//Parameter name
"dim";
//Parameter type
"Length";
//Parameter group
"PG_ADSK_MODEL_PROPERTIES";
//Reporting
true;
# ----------------------------------------
o_familyparameter_create_2 = Orchid.RevitFamily.FamilyParameter.Create(familyDocument=o_datastream_await_3, parameterName=code_block_4.out0, type=code_block_4.out1, group=code_block_4.out2, reporting=code_block_4.out3)

create = List.Create(item0=o_familyparameter_create_2, item1=o_familyparameter_create)

# group: IsReporting parameter
name = FamilyParameter.Name(familyParameter=create)
o_familyparameter_isreporting = Orchid.RevitFamily.FamilyParameter.IsReporting(familyDocument=o_datastream_await_3, parameterName=name)

watch = Watch(o_familyparameter_isreporting)
watch_2 = Watch(name)

# group: Parameters
o_familydocument_parameters = Orchid.RevitFamily.FamilyDocument.Parameters(familyDocument=o_datastream_await_3)
name_2 = FamilyParameter.Name(familyParameter=o_familydocument_parameters)

watch_3 = Watch(name_2)

# group: Set the document category
code_block_5 = CodeBlock { "Casework"; }
byName = Category.ByName(name=code_block_5)
o_familydocument_setcategory = Orchid.RevitFamily.FamilyDocument.SetCategory(familyDocument=o_familydocument_current, category=byName)

# group: Get the document category
o_datastream_await_4 = Orchid.Common.DataStream.Await(pass=o_familydocument_current, waitFor=o_familydocument_setcategory)
o_familydocument_getcategory = Orchid.RevitFamily.FamilyDocument.GetCategory(familyDocument=o_datastream_await_4)
