# Dynamo graph ImportImage_R21.dyn "ImportImage" (Dynamo 2.12.1.8246)
# packages: Orchid 206.3.1.8213

o_familydocument_current = Orchid.RevitFamily.FamilyDocument.Current()

# group: Create default family type
code_block = CodeBlock()
# ---------- code_block.designscript (2 lines) ----------
//Types to create
["Type 1", "Type 2"];
# ----------------------------------------
o_familytype_create = Orchid.RevitFamily.FamilyType.Create(familyDocument=o_familydocument_current, name=code_block)

# group: Create parameter
o_datastream_await = Orchid.Common.DataStream.Await(pass=o_familydocument_current, waitFor=o_familytype_create)
code_block_2 = CodeBlock()
# ---------- code_block_2.designscript (12 lines) ----------
//Parameter name
"AddedImage";
//Parameter type
"Image";
//Parameter group
"PG_ADSK_MODEL_PROPERTIES";
//Instances
true;
//Reporting
true;
//Condense output
false;
# ----------------------------------------
o_familyparameter_create = Orchid.RevitFamily.FamilyParameter.Create(familyDocument=o_datastream_await, parameterName=code_block_2.out0, type=code_block_2.out1, group=code_block_2.out2)

# group: import image
string = StringInput("..\DefaultCustomNode.Small.png")  # graph input
boolean = BoolSelector(false)  # graph input
o_document_importimage = Orchid.RevitProject.Common.Document.ImportImage(path=string, overwrite=boolean)

# group: Set parameter
o_datastream_await_2 = Orchid.Common.DataStream.Await(pass=o_datastream_await, waitFor=o_familyparameter_create)
code_block_3 = CodeBlock()
# ---------- code_block_3.designscript (6 lines) ----------
//Type
"Type 1";
//Parameter name
"AddedImage";
//Value
"_default.Large.png";
# ----------------------------------------
o_familyparameter_setvalue = Orchid.RevitFamily.FamilyParameter.SetValue(familyDocument=o_datastream_await_2, parameterName=code_block_3.out1, value=o_document_importimage)

# group: Close files
o_datastream_await_3 = Orchid.Common.DataStream.Await(pass=o_datastream_await_2, waitFor=o_familyparameter_setvalue)  # frozen
boolean_2 = BoolSelector(false)  # graph input
o_document_close = Orchid.RevitProject.Common.Document.Close(document=o_datastream_await_3, save=boolean_2)

watch = Watch(o_document_importimage)
element_types = ElementTypes("ImageType")  # graph input
all_elements_of_type = ElementsOfType(element_type=element_types)
watch_2 = Watch(all_elements_of_type)

# group: Open all files in directory and sub directories
string_2 = StringInput("..\testSet")  # graph input
code_block_4 = CodeBlock { "*.rfa"; }
boolean_3 = BoolSelector(false)  # graph input
o_directory_contents = Orchid.Common.Directory.Contents(directory=string_2, searchString=code_block_4, deepSearch=boolean_3)
o_document_backgroundopen = Orchid.RevitProject.Common.Document.BackgroundOpen(file=o_directory_contents)  # frozen
