# Dynamo graph SharedParameter_R21.dyn (Dynamo 2.12.1.8246)
# packages: Orchid 206.3.1.8213, Orchid 212.4.0.8440

# group: Add shared parameters by groupName by provided file
string = StringInput("%userprofile%\Programming\Source\OrchidForDynamo\Samples\Data\COBie Extension Shared Parameters.txt")  # graph input
o_file_frompath = Orchid.Common.File.FromPath(path=string)
code_block = CodeBlock()
# ---------- code_block.designscript (14 lines) ----------
//SP Parameter group
["Floor","Type"];
//Parameter group
["DATA", "PG_ADSK_MODEL_PROPERTIES"];
//Instance
[true,false];
//Reporting
//NOTE: this list must follow the order
//of true values in the "Instance" list.
//This list does not have to have same
//length as the above three lists!
[true];
//Condense output
false;
# ----------------------------------------
o_sharedparameter_addbyfile = Orchid.RevitFamily.SharedParameter.AddByFile(file=o_file_frompath, groupName=code_block.out0, group=code_block.out1, instance=code_block.out2)
name = FamilyParameter.Name(familyParameter=o_sharedparameter_addbyfile.FamilyParameter)
watch = Watch(name)
watch_2 = Watch(o_sharedparameter_addbyfile.GroupName)

# group: Add shared parameters by groupName (current loaded)
code_block_2 = CodeBlock()
# ---------- code_block_2.designscript (14 lines) ----------
//SP Parameter group
["Energy", "Dimensions"];
//Parameter group
["PG_ENERGY_ANALYSIS", "PG_GEOMETRY"];
//Instance
[true, false];
//Reporting
//NOTE: this list must follow the order
//of true values in the "Instance" list.
//This list does not have to have same
//length as the above three lists!
[true];
//Condense output
false;
# ----------------------------------------
o_sharedparameter_addbygroup = Orchid.RevitFamily.SharedParameter.AddByGroup(groupName=code_block_2.out0, group=code_block_2.out1, instance=code_block_2.out2)
name_2 = FamilyParameter.Name(familyParameter=o_sharedparameter_addbygroup.FamilyParameter)
watch_3 = Watch(name_2)
watch_4 = Watch(o_sharedparameter_addbygroup.GroupName)

# group: Add IFC parameters
o_sharedparameter_addifc = Orchid.RevitFamily.SharedParameter.AddIFC()
name_3 = FamilyParameter.Name(familyParameter=o_sharedparameter_addifc)
watch_5 = Watch(name_3)
