# Dynamo graph Physical-Thermal-Concrete_R21.dyn "Physical-Thermal-Concrete" (Dynamo 2.6.2.15705)
# packages: Orchid 206.3.1.8192

# group: Create material: Concrete (C30)
code_block = CodeBlock { "_Concrete"; }
o_material_create = Orchid.RevitMaterial.Material.Create(name=code_block)
o_material_aspect = MaterialAspect("Thermal")  # graph input
o_thermal_type = ThermalType("Solid")  # graph input
o_thermal_create = Orchid.RevitMaterial.Thermal.Create(name=code_block, type=o_thermal_type)
code_block_2 = CodeBlock()
# ---------- code_block_2.designscript (6 lines) ----------
"Concrete f'c=30 MPa";
"structural,concrete,CC:BS 8110";
"thermal,solid";
"Concrete";
"Orchid generated";
"https://github.com/erfajo/OrchidForDynamo";
# ----------------------------------------
o_thermal_setinformation = Orchid.RevitMaterial.Thermal.SetInformation(propertySet=o_thermal_create, description=code_block_2.out0, keywords=code_block_2.out2, subclass=code_block_2.out3, source=code_block_2.out4, sourceUrl=code_block_2.out5)
boolean = BoolSelector(false)  # graph input
o_physical_behavior = PhysicalBehavior("Isotropic")  # graph input
code_block_3 = CodeBlock { 1.046; 0.657; 2300; 0.95; 182.4; 0.01; 0; 2000000; }
o_thermal_setproperties = Orchid.RevitMaterial.Thermal.SetProperties(propertySet=o_thermal_setinformation, transmitsLight=boolean, behavior=o_physical_behavior, thermalConductivity=code_block_3.out0, specificHeat=code_block_3.out1, density=code_block_3.out2, emissivity=code_block_3.out3, permeability=code_block_3.out4, porosity=code_block_3.out5, reflectivity=code_block_3.out6, electricalResistivity=code_block_3.out7)
o_material_setthermal = Orchid.RevitMaterial.Material.SetThermal(material=o_material_create, aspect=o_material_aspect, propertySet=o_thermal_setproperties)
name = Material.Name(material=o_material_setthermal)
watch = Watch(name)
watch_2 = Watch(o_material_setthermal)
o_material_aspect_2 = MaterialAspect("Physical (Structural)")  # graph input
o_physical_type = PhysicalType("Concrete")  # graph input
o_physical_create = Orchid.RevitMaterial.Physical.Create(name=code_block, type=o_physical_type)
o_physical_setinformation = Orchid.RevitMaterial.Physical.SetInformation(propertySet=o_physical_create, description=code_block_2.out0, keywords=code_block_2.out1, subclass=code_block_2.out3, source=code_block_2.out4, sourceUrl=code_block_2.out5)
o_physical_behavior_2 = PhysicalBehavior("Isotropic")  # graph input
o_physical_setbehavior = Orchid.RevitMaterial.Physical.SetBehavior(propertySet=o_physical_setinformation, behavior=o_physical_behavior_2)
code_block_4 = CodeBlock { 0.00001; }
o_physical_setbasicthermal = Orchid.RevitMaterial.Physical.SetBasicThermal(propertySet=o_physical_setbehavior, expansionCoefficient=code_block_4)
code_block_5 = CodeBlock { 20500; 0.2; 11200; 2406.45; }
o_physical_setmechanical = Orchid.RevitMaterial.Physical.SetMechanical(propertySet=o_physical_setbasicthermal, youngModulus=code_block_5.out0, poissonRatio=code_block_5.out1, shearModulus=code_block_5.out2, density=code_block_5.out3)
code_block_6 = CodeBlock { 30.0; 1.0; }
boolean_2 = BoolSelector(false)  # graph input
o_physical_setconcrete = Orchid.RevitMaterial.Physical.SetConcrete(propertySet=o_physical_setmechanical, compression=code_block_6.out0, shearStrengthReduction=code_block_6.out1, lightweight=boolean_2)
o_material_setphysical = Orchid.RevitMaterial.Material.SetPhysical(material=o_material_create, aspect=o_material_aspect_2, propertySet=o_physical_setconcrete)
name_2 = Material.Name(material=o_material_setphysical)
watch_3 = Watch(name_2)
watch_4 = Watch(o_material_setphysical)
boolean_3 = BoolSelector(true)  # graph input

o_thermal_getinformation = Orchid.RevitMaterial.Thermal.GetInformation(propertySet=o_thermal_setinformation)
watch_5 = Watch(o_thermal_getinformation.SourceUrl)
watch_6 = Watch(o_thermal_getinformation.Source)
watch_7 = Watch(o_thermal_getinformation.Subclass)
watch_8 = Watch(o_thermal_getinformation.Keywords)
watch_9 = Watch(o_thermal_getinformation.Description)
o_physical_getinformation = Orchid.RevitMaterial.Physical.GetInformation(propertySet=o_physical_setinformation)
watch_10 = Watch(o_physical_getinformation.Keywords)
watch_11 = Watch(o_physical_getinformation.Subclass)
watch_12 = Watch(o_physical_getinformation.Source)
watch_13 = Watch(o_physical_getinformation.SourceUrl)
o_physical_getyoungmodulus = Orchid.RevitMaterial.Physical.GetYoungModulus(propertySet=o_physical_setmechanical)
watch_14 = Watch(o_physical_getyoungmodulus.YoungModulusX)
watch_15 = Watch(o_physical_getyoungmodulus.YoungModulusY)
watch_16 = Watch(o_physical_getyoungmodulus.YoungModulusZ)
watch_17 = Watch(o_physical_getyoungmodulus.YoungModulus1)
o_physical_getpoissonratio = Orchid.RevitMaterial.Physical.GetPoissonRatio(propertySet=o_physical_setmechanical)
watch_18 = Watch(o_physical_getpoissonratio.PoissonRatioX)
watch_19 = Watch(o_physical_getpoissonratio.PoissonRatioY)
watch_20 = Watch(o_physical_getpoissonratio.PoissonRatioZ)
watch_21 = Watch(o_physical_getpoissonratio.PoissonRatio12)
o_physical_getshearmodulus = Orchid.RevitMaterial.Physical.GetShearModulus(propertySet=o_physical_setmechanical)
watch_22 = Watch(o_physical_getshearmodulus.ShearModulusX)
watch_23 = Watch(o_physical_getshearmodulus.ShearModulusY)
watch_24 = Watch(o_physical_getshearmodulus.ShearModulus)
watch_25 = Watch(o_physical_getshearmodulus.ShearModulusZ)
watch_26 = Watch(o_physical_getshearmodulus.ShearModulus12)
o_physical_getconcrete = Orchid.RevitMaterial.Physical.GetConcrete(propertySet=o_physical_setconcrete)
watch_27 = Watch(o_physical_getconcrete.ShearStrengthReduction)
watch_28 = Watch(o_physical_getconcrete.Lightweight)
watch_29 = Watch(o_physical_getconcrete.Compression)
watch_30 = Watch(o_physical_getyoungmodulus.YoungModulus2)
watch_31 = Watch(o_physical_getpoissonratio.PoissonRatio23)
o_physical = Orchid.RevitMaterial.Physical.GetExpansionCoefficient(propertySet=o_physical_setbasicthermal)
watch_32 = Watch(o_physical.ExpansionCoefficientX)
watch_33 = Watch(o_physical.ExpansionCoefficientY)
watch_34 = Watch(o_physical.ExpansionCoefficientZ)
watch_35 = Watch(o_physical.ExpansionCoefficient1)
watch_36 = Watch(o_physical.ExpansionCoefficient2)
o_physical_getbehavior = Orchid.RevitMaterial.Physical.GetBehavior(propertySet=o_physical_setbehavior)
watch_37 = Watch(o_physical_getbehavior)
o_thermal_getproperties = Orchid.RevitMaterial.Thermal.GetProperties(propertySet=o_thermal_setproperties)
watch_38 = Watch(o_thermal_getproperties.ThermalConductivity)
watch_39 = Watch(o_thermal_getproperties.SpecificHeat)
watch_40 = Watch(o_thermal_getproperties.Density)
watch_41 = Watch(o_thermal_getproperties.Behavior)
watch_42 = Watch(o_thermal_getproperties.TransmitsLight)
watch_43 = Watch(o_thermal_getproperties.ElectricalResistivity)
watch_44 = Watch(o_thermal_getproperties.Reflectivity)
watch_45 = Watch(o_thermal_getproperties.Porosity)
watch_46 = Watch(o_thermal_getproperties.Permeability)
watch_47 = Watch(o_thermal_getproperties.Emissivity)
watch_48 = Watch(o_physical_getinformation.Description)
watch_49 = Watch(o_physical_getpoissonratio.PoissonRatio)
watch_50 = Watch(o_physical_getyoungmodulus.YoungModulus)
watch_51 = Watch(o_physical.ExpansionCoefficient)
