# Dynamo graph Physical-Thermal-Wood_R21.dyn "Physical-Thermal-Wood" (Dynamo 2.6.2.15705)
# packages: Orchid 206.3.1.8192

# group: Create material: Timber (C24) --> XYZ values for SetBasicThermal and SetMechanical
code_block = CodeBlock { "_Timber C24 (XYZ)"; }
o_physical_type = PhysicalType("Wood")  # graph input
o_physical_create = Orchid.RevitMaterial.Physical.Create(name=code_block, type=o_physical_type)
code_block_2 = CodeBlock()
# ---------- code_block_2.designscript (6 lines) ----------
"Strength Class C24 Timber";
"Eurocode,Structural,structural,wood,CC:EN 338";
"Wood,thermal,solid";
"Wood";
"Orchid generated";
"https://github.com/erfajo/OrchidForDynamo";
# ----------------------------------------
o_physical_setinformation = Orchid.RevitMaterial.Physical.SetInformation(propertySet=o_physical_create, description=code_block_2.out0, keywords=code_block_2.out1, subclass=code_block_2.out3, source=code_block_2.out4, sourceUrl=code_block_2.out5)
o_physical_behavior = PhysicalBehavior("Orthotropic")  # graph input
o_physical_setbehavior = Orchid.RevitMaterial.Physical.SetBehavior(propertySet=o_physical_setinformation, behavior=o_physical_behavior)
code_block_3 = CodeBlock { 0.0001; 0.0002; 0.0003; }
byCoordinates = Point.ByCoordinates(x=code_block_3.out0, y=code_block_3.out1, z=code_block_3.out2)
o_physical_setbasicthermalbyxyz = Orchid.RevitMaterial.Physical.SetBasicThermalByXYZ(propertySet=o_physical_setbehavior, expansionCoefficient=byCoordinates)
code_block_4 = CodeBlock()
# ---------- code_block_4.designscript (4 lines) ----------
Autodesk.Point.ByCoordinates(10000,11000,12000);
Autodesk.Point.ByCoordinates(0.3,0.35,0.4);
Autodesk.Point.ByCoordinates(650,700,750);
420;
# ----------------------------------------
o_physical_setmechanicalbyxyz = Orchid.RevitMaterial.Physical.SetMechanicalByXYZ(propertySet=o_physical_setbasicthermalbyxyz, youngModulus=code_block_4.out0, poissonRatio=code_block_4.out1, shearModulus=code_block_4.out2, density=code_block_4.out3)
code_block_5 = CodeBlock { "Multiple"; "C24"; 24; 21; 2.5; 4; 14; 0.5; 11000; }
o_wood_construction = WoodConstruction("Natural")  # graph input
o_physical_setstrengthextended = Orchid.RevitMaterial.Physical.SetStrengthExtended(propertySet=o_physical_setmechanicalbyxyz, species=code_block_5.out0, grade=code_block_5.out1, bending=code_block_5.out2, parallelCompression=code_block_5.out3, perpendicularCompression=code_block_5.out4, parallelShear=code_block_5.out5, tensionParallel=code_block_5.out6, tensionPerpendicular=code_block_5.out7, averageModulus=code_block_5.out8, construction=o_wood_construction)
o_material_create = Orchid.RevitMaterial.Material.Create(name=code_block)
o_material_aspect = MaterialAspect("Physical (Structural)")  # graph input
o_material_setphysical = Orchid.RevitMaterial.Material.SetPhysical(material=o_material_create, aspect=o_material_aspect, propertySet=o_physical_setstrengthextended)
name = Material.Name(material=o_material_setphysical)
watch = Watch(name)
watch_2 = Watch(o_material_setphysical)
o_material_aspect_2 = MaterialAspect("Thermal")  # graph input
o_thermal_type = ThermalType("Solid")  # graph input
o_thermal_create = Orchid.RevitMaterial.Thermal.Create(name=code_block, type=o_thermal_type)
o_thermal_setinformation = Orchid.RevitMaterial.Thermal.SetInformation(propertySet=o_thermal_create, description=code_block_2.out0, keywords=code_block_2.out2, subclass=code_block_2.out3, source=code_block_2.out4, sourceUrl=code_block_2.out5)
boolean = BoolSelector(false)  # graph input
o_physical_behavior_2 = PhysicalBehavior("Isotropic")  # graph input
code_block_6 = CodeBlock { 0.12; 0.19; 496; 0.85; 0; 0.01; 0; 10000000; }
o_thermal_setproperties = Orchid.RevitMaterial.Thermal.SetProperties(propertySet=o_thermal_setinformation, transmitsLight=boolean, behavior=o_physical_behavior_2, thermalConductivity=code_block_6.out0, specificHeat=code_block_6.out1, density=code_block_6.out2, emissivity=code_block_6.out3, permeability=code_block_6.out4, porosity=code_block_6.out5, reflectivity=code_block_6.out6, electricalResistivity=code_block_6.out7)
o_material_setthermal = Orchid.RevitMaterial.Material.SetThermal(material=o_material_create, aspect=o_material_aspect_2, propertySet=o_thermal_setproperties)
name_2 = Material.Name(material=o_material_setthermal)
watch_3 = Watch(name_2)
watch_4 = Watch(o_material_setthermal)
boolean_2 = BoolSelector(true)  # graph input

o_physical_getshearmodulus = Orchid.RevitMaterial.Physical.GetShearModulus(propertySet=o_physical_setmechanicalbyxyz)
watch_5 = Watch(o_physical_getshearmodulus.ShearModulusY)
watch_6 = Watch(o_physical_getshearmodulus.ShearModulusZ)
watch_7 = Watch(o_physical_getshearmodulus.ShearModulus12)
o_physical_getstrengthextended = Orchid.RevitMaterial.Physical.GetStrengthExtended(propertySet=o_physical_setstrengthextended)
watch_8 = Watch(o_physical_getstrengthextended.ParallelShear)
watch_9 = Watch(o_physical_getstrengthextended.TensionParallel)
watch_10 = Watch(o_physical_getstrengthextended.TensionPerpendicular)
watch_11 = Watch(o_physical_getstrengthextended.PerpendicularCompression)
watch_12 = Watch(o_physical_getstrengthextended.ParallelCompression)
watch_13 = Watch(o_physical_getstrengthextended.AverageModulus)
watch_14 = Watch(o_physical_getstrengthextended.Construction)
watch_15 = Watch(o_physical_getstrengthextended.Species)
watch_16 = Watch(o_physical_getstrengthextended.Grade)
watch_17 = Watch(o_physical_getstrengthextended.Bending)
watch_18 = Watch(o_physical_getshearmodulus.ShearModulusX)
watch_19 = Watch(o_physical_getshearmodulus.ShearModulus)
o_physical_getyoungmodulus = Orchid.RevitMaterial.Physical.GetYoungModulus(propertySet=o_physical_setmechanicalbyxyz)
watch_20 = Watch(o_physical_getyoungmodulus.YoungModulusY)
watch_21 = Watch(o_physical_getyoungmodulus.YoungModulusZ)
watch_22 = Watch(o_physical_getyoungmodulus.YoungModulus1)
o_physical_getpoissonratio = Orchid.RevitMaterial.Physical.GetPoissonRatio(propertySet=o_physical_setmechanicalbyxyz)
watch_23 = Watch(o_physical_getpoissonratio.PoissonRatioX)
watch_24 = Watch(o_physical_getpoissonratio.PoissonRatioY)
watch_25 = Watch(o_physical_getpoissonratio.PoissonRatioZ)
watch_26 = Watch(o_physical_getpoissonratio.PoissonRatio12)
watch_27 = Watch(o_physical_getyoungmodulus.YoungModulus2)
watch_28 = Watch(o_physical_getpoissonratio.PoissonRatio23)
watch_29 = Watch(o_physical_getpoissonratio.PoissonRatio)
watch_30 = Watch(o_physical_getyoungmodulus.YoungModulusX)
watch_31 = Watch(o_physical_getyoungmodulus.YoungModulus)
o_thermal_getproperties = Orchid.RevitMaterial.Thermal.GetProperties(propertySet=o_thermal_setproperties)
watch_32 = Watch(o_thermal_getproperties.Emissivity)
watch_33 = Watch(o_thermal_getproperties.Density)
watch_34 = Watch(o_thermal_getproperties.SpecificHeat)
watch_35 = Watch(o_thermal_getproperties.ThermalConductivity)
watch_36 = Watch(o_thermal_getproperties.Behavior)
watch_37 = Watch(o_thermal_getproperties.TransmitsLight)
watch_38 = Watch(o_thermal_getproperties.ElectricalResistivity)
watch_39 = Watch(o_thermal_getproperties.Reflectivity)
watch_40 = Watch(o_thermal_getproperties.Porosity)
watch_41 = Watch(o_thermal_getproperties.Permeability)
o_physical = Orchid.RevitMaterial.Physical.GetExpansionCoefficient(propertySet=o_physical_setbasicthermalbyxyz)
watch_42 = Watch(o_physical.ExpansionCoefficientX)
watch_43 = Watch(o_physical.ExpansionCoefficientY)
watch_44 = Watch(o_physical.ExpansionCoefficientZ)
watch_45 = Watch(o_physical.ExpansionCoefficient1)
watch_46 = Watch(o_physical.ExpansionCoefficient2)
watch_47 = Watch(o_physical.ExpansionCoefficient)
o_physical_getinformation = Orchid.RevitMaterial.Physical.GetInformation(propertySet=o_physical_setinformation)
watch_48 = Watch(o_physical_getinformation.Subclass)
watch_49 = Watch(o_physical_getinformation.Source)
watch_50 = Watch(o_physical_getinformation.SourceUrl)
o_physical_getbehavior = Orchid.RevitMaterial.Physical.GetBehavior(propertySet=o_physical_setbehavior)
watch_51 = Watch(o_physical_getbehavior)
watch_52 = Watch(o_physical_getinformation.Keywords)
watch_53 = Watch(o_physical_getinformation.Description)
o_thermal_getinformation = Orchid.RevitMaterial.Thermal.GetInformation(propertySet=o_thermal_setinformation)
watch_54 = Watch(o_thermal_getinformation.SourceUrl)
watch_55 = Watch(o_thermal_getinformation.Source)
watch_56 = Watch(o_thermal_getinformation.Subclass)
watch_57 = Watch(o_thermal_getinformation.Keywords)
watch_58 = Watch(o_thermal_getinformation.Description)
