# Dynamo graph AutoIFCexport_R21.dyn "AutoIFCexport" (Dynamo 2.12.1.8246)
# packages: Orchid 206.6.0.5794, Orchid 212.4.0.5794

# group: Open all project files in directory
string = StringInput("..\testSet")  # graph input
code_block = CodeBlock { "*.rvt"; }
boolean = BoolSelector(false)  # graph input
o_directory_contents = Orchid.Common.Directory.Contents(directory=string, searchString=code_block, deepSearch=boolean)
o_document_backgroundopen = Orchid.RevitProject.Common.Document.BackgroundOpen(file=o_directory_contents)
o_family_load = Orchid.RevitProject.Elements.Family.Load(familyDocument=o_document_backgroundopen)
o_datastream_await = Orchid.Common.DataStream.Await(pass=o_document_backgroundopen, waitFor=o_family_load)
o_document_close = Orchid.RevitProject.Common.Document.Close(document=o_datastream_await)

# group: Place families in document
types = Family.Types(family=o_family_load)
flatten = List.Flatten(list=types)
count = List.Count(list=flatten)
code_block_2 = CodeBlock(num=count) { (1..num)*2500; }
byCoordinates = Point.ByCoordinates(x=code_block_2)
levels = Levels("Level 1")  # graph input
byPointAndLevel = FamilyInstance.ByPointAndLevel(familyType=flatten, point=byCoordinates, level=levels)

# group: IFC Export based on prebuild IFC setting and a view
o_document_current = Orchid.RevitProject.Common.Document.Current()
o_datastream_await_2 = Orchid.Common.DataStream.Await(pass=o_document_current, waitFor=byPointAndLevel)
o_ifc_setting = Setting("IFC2x3 Coordination View 2.0")  # graph input
o_ifc_settingbyname = Orchid.IfcExport.IFC.SettingByName(name=o_ifc_setting)
views = Views("{3D}")  # graph input
o_ifc_export = Orchid.IfcExport.IFC.Export(document=o_datastream_await_2, setting=o_ifc_settingbyname, view=views)

# group: Prebuild IFC setting
o_ifc_setting_2 = Setting("IFC4 Design Transfer View")  # graph input; frozen
o_ifc_settingbyname_2 = Orchid.IfcExport.IFC.SettingByName(name=o_ifc_setting_2)

# group: IFC setting --> General
o_ifc_space_boundary = SpaceBoundary("1st Level")  # graph input
o_ifc_project_origin = SitePlacement("Internal coordinates")  # graph input
boolean_2 = BoolSelector(true)  # graph input
o_ifc_settinggeneral = Orchid.IfcExport.IFC.SettingGeneral(setting=o_ifc_settingbyname_2, ifcFileType=o_ifc_space_boundary, spaceBoundary=o_ifc_project_origin, projectOrigin=boolean_2)
o_ifc_version = Version("IFC4 Design Transfer View")  # graph input
o_ifc_file_type = FileType("IFC")  # graph input

# group: IFC setting --> Additional/LOD
boolean_3 = BoolSelector(true)  # graph input
o_ifc_level_of_detail = LevelOfDetail("Medium")  # graph input
o_ifc_settingadditional = Orchid.IfcExport.IFC.SettingAdditional(setting=o_ifc_settinggeneral, visibleElements=boolean_3, levelOfDetail=o_ifc_level_of_detail)

# group: file
o_document_directory = Orchid.RevitProject.Common.Document.Directory()
code_block_3 = CodeBlock { 1; }
o_directory_subpath = Orchid.Common.Directory.SubPath(directory=o_document_directory, remove=code_block_3)
string_2 = StringInput("DanEDU IFC export.txt")  # graph input
code_block_4 = CodeBlock(t1=o_directory_subpath, t2=string_2) { t1+"\\"+t2; }

# group: IFC setting --> Property
boolean_4 = BoolSelector(true)  # graph input
o_ifc_settingproperty = Orchid.IfcExport.IFC.SettingProperty(setting=o_ifc_settingadditional, baseQuantities=boolean_4, userProperty=boolean_4, userPropertyFile=code_block_4)

# group: IFC setting --> Advanced
boolean_5 = BoolSelector(true)  # graph input
o_ifc_settingadvanced = Orchid.IfcExport.IFC.SettingAdvanced(setting=o_ifc_settingproperty, storeGuid=boolean_5)

# group: IFC setting file format
type = Object.Type(object=o_ifc_settingadvanced)
watch = Watch(type)
watch_2 = Watch(o_ifc_settingadvanced)

# group: IFC Export
boolean_6 = BoolSelector(false)  # graph input
views_2 = Views("{3D}")  # graph input
o_ifc_export_2 = Orchid.IfcExport.IFC.Export(setting=o_ifc_settingadvanced, view=views_2)
watch_3 = Watch(o_ifc_export_2)
o_phases = Phase("Existing")  # graph input

# group: deprecated
o_document_loadfamily = Orchid.RevitProject.Common.Document.LoadFamily(family=o_directory_contents)

# group: file
o_document_directory_2 = Orchid.RevitProject.Common.Document.Directory()
string_3 = StringInput("test")  # graph input
code_block_5 = CodeBlock(t1=o_document_directory_2, t2=string_3) { t1+"\\"+t2; }
