# Dynamo graph BuiltInParameter_R21.dyn "BuiltInParameter" (Dynamo 2.3.1.11775)
# packages: Orchid 206.6.0.5794

o_builtinparameter_indocument = Orchid.RevitProject.Parameters.BuiltInParameter.InDocument()
o_builtinparameter_label = Orchid.RevitProject.Parameters.BuiltInParameter.Label(parameterId=o_builtinparameter_indocument)
watch = Watch(o_builtinparameter_label)
code_block = CodeBlock { "MATERIAL_ID_PARAM"; }
o_builtinparameter_byname = Orchid.RevitProject.Parameters.BuiltInParameter.ByName(name=code_block)
o_builtinparameter_label_2 = Orchid.RevitProject.Parameters.BuiltInParameter.Label(parameterId=o_builtinparameter_byname)
watch_2 = Watch(o_builtinparameter_label_2)
o_builtinparameter_name = Orchid.RevitProject.Parameters.BuiltInParameter.Name(parameterId=o_builtinparameter_indocument)
watch_3 = Watch(o_builtinparameter_name)
o_builtinparameter_name_2 = Orchid.RevitProject.Parameters.BuiltInParameter.Name(parameterId=o_builtinparameter_byname)
watch_4 = Watch(o_builtinparameter_name_2)
o_builtin_parameter = BuiltInParameter("MATERIAL_ID_PARAM")  # graph input
watch_5 = Watch(o_builtinparameter_byname)
watch_6 = Watch(o_builtinparameter_indocument)
