# Dynamo graph ExportDWGfromView_R21.dyn "ExportDWGfromView" (Dynamo 2.12.1.8246)
# packages: Orchid 206.6.0.5794, Orchid 212.4.0.5794

# group: Get view by name in model
code_block = CodeBlock { "FloorPlan"; }
o_viewtype_byname = Orchid.RevitProject.Views.ViewType.ByName(name=code_block)
o_view_bytype = Orchid.RevitProject.Views.View.ByType(viewType=o_viewtype_byname)
name = Element.Name(element=o_view_bytype)
code_block_2 = CodeBlock()
# ---------- code_block_2.designscript (2 lines) ----------
// View to find
"EXPORT DWG";
# ----------------------------------------
boolean = BoolSelector(true)
o_string_contains = Orchid.Common.String.Contains(string=name, searchFor=code_block_2, ignoreCase=boolean)
filterByBoolMask = List.FilterByBoolMask(list=o_view_bytype, mask=o_string_contains)

# group: Path
o_document_current = Orchid.RevitProject.Common.Document.Current()
o_document_path = Orchid.RevitProject.Common.Document.Path(document=o_document_current)
directoryName = FileSystem.DirectoryName(path=o_document_path)
name_2 = Element.Name(element=filterByBoolMask.in)
code_block_3 = CodeBlock(a=directoryName, b=name_2) { a+"\\"+b; }
fileName = FileSystem.FileName(path=o_document_path)
code_block_4 = CodeBlock(a=directoryName, b=fileName) { a+"\\XREF\\"+b; }

# group: Set "IBB 2000" export settings
code_block_5 = CodeBlock()
# ---------- code_block_5.designscript (10 lines) ----------
"IBB 2000";
true;
// filepaths
path1 = "C:\\ProgramData\\Autodesk\\RVT ";
path2 = "\\Libraries\\DanEDU\\Generic Project\\";
layer = "DanEDU Exportlayers Arkitekt.txt";
lines = "DanEDU Linetypes.lin";
format =  Orchid.Revit.Format;
layerMapping = path1 + format + path2 + layer;
lineTypes =path1 + format + path2 + lines;
# ----------------------------------------
o_exportoption_createacadoption = Orchid.RevitProject.Common.ExportOption.CreateAcadOption(name=code_block_5.out0, mergedViews=code_block_5.out1, layerMapping=code_block_5.layerMapping, hatchPatternsFile=code_block_5.lineTypes)

# group: DWG
boolean_2 = BoolSelector(true)
o_document_exportdwg = Orchid.RevitProject.Common.Document.ExportDWG(document=o_document_current, option=o_exportoption_createacadoption, view=filterByBoolMask.in, file=code_block_4, overwrite=boolean_2)

# group: Delete "BIPS 2005" export settings
o_exportoption_acadoptions = Orchid.RevitProject.Common.ExportOption.AcadOptions()
code_block_6 = CodeBlock(option=o_exportoption_acadoptions) { name = Revit.Element.Name(option); name == "BIPS 2005"; }
filterByBoolMask_2 = List.FilterByBoolMask(list=o_exportoption_acadoptions, mask=code_block_6.out1)
o_element_delete = Orchid.RevitProject.Elements.Element.Delete(element=filterByBoolMask_2.in)
