# Dynamo graph ExportSchedules_R21.dyn "ExportSchedules" (Dynamo 2.3.1.11775)
# packages: Orchid 206.3.0.8042

# group: Schedules
code_block = CodeBlock { "Room Schedule"; }
o_view_byname = Orchid.RevitProject.Views.View.ByName(name=code_block)
o_schedule_getdata = Orchid.RevitProject.Schedules.Schedule.GetData(scheduleView=o_view_byname)

# group: Export to Excel
string = StringInput(".\Skemaer")  # graph input
code_block_2 = CodeBlock { 0; }
exportExcel = Data.ExportExcel(filePath=string, sheetName=code_block, startRow=code_block_2, startCol=code_block_2, data=o_schedule_getdata)
