# Dynamo graph LinkedCloudDocumentRepath_R21.dyn "LinkedCloudDocumentRepath" (Dynamo 2.3.1.11775)
# packages: Orchid 206.3.0.8042

# group: Get Revit Linked document
o_link_getrevitlink = Orchid.RevitProject.Common.Link.GetRevitLink()
o_link_info = Orchid.RevitProject.Common.Link.Info(link=o_link_getrevitlink)
list_create = List.Create(item0=o_link_info.Name, item1=o_link_info.Status, item2=o_link_info.ReferenceType, item3=o_link_info.Path, item4=o_link_info.PathType)
watch = Watch(list_create)

# group: Repath Cloud link to local path
o_file_cloudtolocal = Orchid.Common.File.CloudToLocal(path=o_link_info.Path)
watch_2 = Watch(o_file_cloudtolocal)
o_link_repath = Orchid.RevitProject.Common.Link.Repath(link=o_link_getrevitlink, file=o_file_cloudtolocal)
o_directory_cloudtolocal = Orchid.Common.Directory.CloudToLocal(path=o_link_info.Path)
watch_3 = Watch(o_directory_cloudtolocal)
