# Dynamo graph LinkedCloudDocument_R21.dyn "LinkedCloudDocument" (Dynamo 2.3.1.11775)
# packages: Orchid 206.3.0.8042

# group: Get Revit Linked document
o_link_getrevitlink = Orchid.RevitProject.Common.Link.GetRevitLink()
o_link_info = Orchid.RevitProject.Common.Link.Info(link=o_link_getrevitlink)
list_create = List.Create(item0=o_link_info.Name, item1=o_link_info.Status, item2=o_link_info.ReferenceType, item3=o_link_info.Path, item4=o_link_info.PathType)
watch = Watch(list_create)

# group: Get Link
o_link_getlink = Orchid.RevitProject.Common.Link.GetLink()
watch_2 = Watch(o_link_getlink.Type)
watch_3 = Watch(o_link_getlink.Link)

# group: Get Link by type
o_link_types = LinkType("Revit Link")
o_link_getlinkbytype = Orchid.RevitProject.Common.Link.GetLinkByType(linkType=o_link_types)
watch_4 = Watch(o_link_getlinkbytype)
code_block = CodeBlock { "RevitLink"; }
