# Dynamo graph LinkedDocument-pin_R21.dyn "LinkedDocument-pin" (Dynamo 2.3.1.11775)
# packages: Orchid 206.6.0.5794, Orchid 206.6.0.5794

string = StringInput(".\defaultProject_2020.rvt")  # graph input
o_document_backgroundopen = Orchid.RevitProject.Common.Document.BackgroundOpen(file=string)

# group: Link revit file
string_2 = StringInput(".\defaultBuilding_2020.rvt")  # graph input
o_link_positioning = Positioning("Origin")  # graph input
code_block = CodeBlock { 10000; }
byCoordinates = Point.ByCoordinates(y=code_block)
o_attachment_type = AttachmentType("Overlay")  # graph input
o_path_types = PathType("Relative")
o_link_setrevitfile = Orchid.RevitProject.Common.Link.SetRevitFile(document=o_document_backgroundopen, file=string_2, positioning=o_link_positioning, referencePoint=byCoordinates, attachmentType=o_attachment_type, pathType=o_path_types)

o_element_pin = Orchid.RevitProject.Elements.Element.Pin(document=o_document_backgroundopen, element=o_link_setrevitfile.Instance)
o_datastream_await = Orchid.Common.DataStream.Await(pass=o_document_backgroundopen, waitFor=o_element_pin)
o_document_name = Orchid.RevitProject.Common.Document.Name(document=o_document_backgroundopen)
code_block_2 = CodeBlock(name=o_document_name) { name+"_copy.rvt"; true; }
o_document_saveas = Orchid.RevitProject.Common.Document.SaveAs(document=o_datastream_await, name=code_block_2.out0, overwrite=code_block_2.out1)
o_document_close = Orchid.RevitProject.Common.Document.Close(document=o_document_saveas)
watch = Watch(o_link_setrevitfile.Instance)
watch_2 = Watch(o_link_setrevitfile.Link)

# group: Pin
categories = Categories("OST_Walls")  # graph input
all_elements_of_category = ElementsOfCategory(Category=categories)  # frozen
o_element_pin_2 = Orchid.RevitProject.Elements.Element.Pin(element=all_elements_of_category)
o_element_unpin = Orchid.RevitProject.Elements.Element.UnPin(element=all_elements_of_category)

# group: Pin
categories_2 = Categories("OST_Walls")  # graph input
all_elements_of_category_2 = ElementsOfCategory(Category=categories_2)  # frozen
o_element_pin_3 = Orchid.RevitProject.Elements.Element.Pin(element=all_elements_of_category_2)
o_element_unpin_2 = Orchid.RevitProject.Elements.Element.UnPin(element=all_elements_of_category_2)
