# Dynamo graph Load families_R21.dyn "Load families" (Dynamo 2.6.2.15705)
# packages: Orchid 206.6.0.5794, Orchid 206.6.0.5794

directory_path = StringInput("..\testSet")  # graph input
string = StringInput("*.rfa")  # graph input
boolean = BoolSelector(false)  # graph input
o_directory_contents = Orchid.Common.Directory.Contents(directory=directory_path, searchString=string, deepSearch=boolean)
o_document_backgroundopen = Orchid.RevitProject.Common.Document.BackgroundOpen(file=o_directory_contents)
code_block = CodeBlock()
# ---------- code_block.designscript (8 lines) ----------
//Parameter name
"Creator Build";
//SP Parameter group
"Sheet & Project";
//Parameter group
"PG_ADSK_MODEL_PROPERTIES";
//Instances
true;
# ----------------------------------------
o_sharedparameter_add = Orchid.RevitFamily.SharedParameter.Add(familyDocument=o_document_backgroundopen, parameterName=code_block.out0, groupName=code_block.out1, group=code_block.out2, instance=code_block.out3)
o_datastream_await = Orchid.Common.DataStream.Await(pass=o_document_backgroundopen, waitFor=o_sharedparameter_add)
code_block_2 = CodeBlock { "Creator Build"; }
creator_build = StringInput("\"2020.0406.0\"")  # graph input
o_formula_set = Orchid.RevitFamily.Formula.Set(familyDocument=o_datastream_await, parameterName=code_block_2, value=creator_build)
o_datastream_await_2 = Orchid.Common.DataStream.Await(pass=o_datastream_await, waitFor=o_formula_set)
o_family_load = Orchid.RevitProject.Elements.Family.Load(familyDocument=o_datastream_await_2)
o_datastream_await_3 = Orchid.Common.DataStream.Await(pass=o_datastream_await_2, waitFor=o_family_load)
o_document_close = Orchid.RevitProject.Common.Document.Close(document=o_datastream_await_3)
