# Dynamo graph Location_R21.dyn "Location" (Dynamo 2.3.1.11775)
# packages: Orchid 206.3.0.8042

# group: Project location
o_project_origin = Origin("Internal")  # graph input
o_location_getvector = Orchid.RevitProject.Common.Location.GetVector(location=o_project_origin)
watch = Watch(o_location_getvector)
o_location_getpoint = Orchid.RevitProject.Common.Location.GetPoint(location=o_project_origin)
watch_2 = Watch(o_location_getpoint)
o_location_set = Orchid.RevitProject.Common.Location.Set(location=o_project_origin)
watch_3 = Watch(o_location_set)
o_location_get = Orchid.RevitProject.Common.Location.Get()
watch_4 = Watch(o_location_get)
name = Element.Name(element=o_location_get)
watch_5 = Watch(name)

# group: Project phase
o_phases = Phase("New Construction")  # graph input
watch_6 = Watch(o_phases)
