# Dynamo graph Open View_R21.dyn "Open View" (Dynamo 2.3.1.11775)
# packages: Orchid 206.3.0.8042

views = Views("{3D}")  # graph input
o_document_openview = Orchid.RevitProject.Common.Document.OpenView(view=views)
watch = Watch(o_document_openview)
