# Dynamo graph ParameterSet_R21.dyn "ParameterSet" (Dynamo 2.12.1.8246)
# packages: Orchid 212.3.0.8317

# group: Change parameter and category binding in the project
code_block = CodeBlock()
# ---------- code_block.designscript (17 lines) ----------
// Parameter name
// Note: a project parameter created inside
// Revit can't be changed! Only user-defined
// parameters created from Dynamo and shared
// parameters can be changed!

// test, shared parameter;
"Creator Name";
// test, created from Dynamo;
"test1";
// test, created inside Revit;
"ChangeCategory";

//Instances
true;
//Category
["Doors", "Entourage", "Floors"];
# ----------------------------------------
o_projectparameter_byname = Orchid.RevitProject.Parameters.ProjectParameter.ByName(parameterName=code_block.out0)
byName = Category.ByName(name=code_block.out4)
o_projectparameter = Orchid.RevitProject.Parameters.ProjectParameter.ChangeCategory(parameter=o_projectparameter_byname, category=byName)  # frozen
o_projectparameter_2 = Orchid.RevitProject.Parameters.ProjectParameter.ChangeCategory(parameterName=code_block.out0, category=byName)

# group: Create shared parameter
code_block_2 = CodeBlock()
# ---------- code_block_2.designscript (16 lines) ----------
//Parameter name
"Dynamo test parameter";
//SP Parameter group
"Dynamo test group";
//SP Parameter type
"Text";
//Parameter group
"PG_ADSK_MODEL_PROPERTIES";
//Tooltip
"Some tooltip";
//Instances
true;
//Vary Between Groups
true;
//Category
"Doors";
# ----------------------------------------
byName_2 = Category.ByName(name=code_block_2.out7)
o_sharedparameter_add = Orchid.RevitProject.Parameters.SharedParameter.Add(parameterName=code_block_2.out0, groupName=code_block_2.out1, group=code_block_2.out3, tooltip=code_block_2.out4, instance=code_block_2.out5, vary=code_block_2.out6, category=byName_2)  # frozen
o_sharedparameter_create = Orchid.RevitProject.Parameters.SharedParameter.Create(parameterName=code_block_2.out0, groupName=code_block_2.out1, type=code_block_2.out2, group=code_block_2.out3, tooltip=code_block_2.out4, category=byName_2)  # frozen

# group: Add shared parameter
code_block_3 = CodeBlock()
# ---------- code_block_3.designscript (14 lines) ----------
//Parameter name
["Creator Name",
"Creator Organization",
"Creator Build"];
//SP Parameter group
"Sheet & Project";
//Parameter group
"PG_ADSK_MODEL_PROPERTIES";
//Instances
true;
//Vary Between Groups
true;
//Category
"Doors";
# ----------------------------------------
byName_3 = Category.ByName(name=code_block_3.out5)
o_sharedparameter_add_2 = Orchid.RevitProject.Parameters.SharedParameter.Add(parameterName=code_block_3.out0, groupName=code_block_3.out1, group=code_block_3.out2, vary=byName_3)

# group: Delete parameter
code_block_4 = CodeBlock()
# ---------- code_block_4.designscript (2 lines) ----------
["Creator Build",
"test2"];
# ----------------------------------------
o_projectparameter_delete = Orchid.RevitProject.Parameters.ProjectParameter.Delete(parameterName=code_block_4)  # frozen

# group: Add project parameter
code_block_5 = CodeBlock()
# ---------- code_block_5.designscript (14 lines) ----------
//Parameter name
["test1","test2"];
//Parameter type
"Text";
//Parameter group
"PG_IDENTITY_DATA";
//Tooltip
"Some tooltip";
//Instances
true;
//Vary Between Groups
true;
//Category
["Walls","Windows"];
# ----------------------------------------
byName_4 = Category.ByName(name=code_block_5.out6)
o_projectparameter_create = Orchid.RevitProject.Parameters.ProjectParameter.Create(parameterName=code_block_5.out0, type=code_block_5.out1, group=code_block_5.out2, tooltip=code_block_5.out3, instance=code_block_5.out4, vary=code_block_5.out5, category=byName_4)
