# Dynamo graph Purge PostCommand_R21.dyn "Purge PostCommand" (Dynamo 2.3.1.11775)
# packages: Orchid 206.6.0.5794

# group: orchid
boolean = BoolSelector(false)  # graph input
o_postcommand_purge = Orchid.RevitProject.Common.PostCommand.Purge(activate=boolean)  # frozen

# group: orchid
boolean_2 = BoolSelector(false)  # graph input
o_document_purge = Orchid.RevitProject.Common.Document.Purge(completely=boolean_2)
