# Dynamo graph RoomSpace_R21.dyn "RoomSpace" (Dynamo 2.3.1.11775)
# packages: Orchid 206.6.0.5794, Orchid 206.6.0.5794

# group: Get spatial element phase
code_block = CodeBlock { ["Rooms", "Spaces"]; }
byName = Category.ByName(name=code_block)
all_elements_of_category = ElementsOfCategory(Category=byName)
o_spatialelement_phase = Orchid.RevitProject.Elements.SpatialElement.Phase(spatialElement=all_elements_of_category)
groupByKey = List.GroupByKey(list=all_elements_of_category, keys=o_spatialelement_phase, lacing=Longest)
watch = Watch(groupByKey.groups)
watch_2 = Watch(groupByKey.unique_keys)

# group: Get spatial element status
code_block_2 = CodeBlock { ["Rooms", "Spaces"]; }
byName_2 = Category.ByName(name=code_block_2)
all_elements_of_category_2 = ElementsOfCategory(Category=byName_2)
o_spatialelement_status = Orchid.RevitProject.Elements.SpatialElement.Status(spatialElement=all_elements_of_category_2)
groupByKey_2 = List.GroupByKey(list=all_elements_of_category_2, keys=o_spatialelement_status, lacing=Longest)
watch_3 = Watch(groupByKey_2.groups)
watch_4 = Watch(groupByKey_2.unique_keys)

# group: Create room by phase
code_block_3 = CodeBlock { "Rooms"; "Existing"; "New Construction"; }
o_phase_byname = Orchid.RevitProject.Common.Phase.ByName(name=code_block_3.out2)
levels = Levels("Level 2")
byName_3 = Category.ByName(name=code_block_3.out0)
all_elements_of_category_3 = ElementsOfCategory(Category=byName_3)
o_spatialelement_centerlocation = Orchid.RevitProject.Elements.SpatialElement.CenterLocation(spatialElement=all_elements_of_category_3)
o_spatialelement_location = Orchid.RevitProject.Elements.SpatialElement.Location(spatialElement=o_spatialelement_centerlocation)
o_spatialelement_name = Orchid.RevitProject.Elements.SpatialElement.Name(spatialElement=o_spatialelement_centerlocation)
# note: The SpatialElement nodes may be replaced
# with the following dynamo nodes if exists!
# Room.Location
# Room.Name
# Room.Number
o_spatialelement_number = Orchid.RevitProject.Elements.SpatialElement.Number(spatialElement=o_spatialelement_centerlocation)
o_spatialelement_createspace = Orchid.RevitProject.Elements.SpatialElement.CreateSpace(phase=o_phase_byname, level=levels, location=o_spatialelement_location, name=o_spatialelement_name, number=o_spatialelement_number)
o_spatialelement_centerlocation_2 = Orchid.RevitProject.Elements.SpatialElement.CenterLocation(spatialElement=o_spatialelement_createspace)

# group: Create space by phase
code_block_4 = CodeBlock { "Spaces"; "Existing"; "New Construction"; }
o_phase_byname_2 = Orchid.RevitProject.Common.Phase.ByName(name=code_block_4.out2)
levels_2 = Levels("Level 2")
byName_4 = Category.ByName(name=code_block_4.out0)
all_elements_of_category_4 = ElementsOfCategory(Category=byName_4)
o_spatialelement_centerlocation_3 = Orchid.RevitProject.Elements.SpatialElement.CenterLocation(spatialElement=all_elements_of_category_4)
o_spatialelement_location_2 = Orchid.RevitProject.Elements.SpatialElement.Location(spatialElement=o_spatialelement_centerlocation_3)
o_spatialelement_name_2 = Orchid.RevitProject.Elements.SpatialElement.Name(spatialElement=o_spatialelement_centerlocation_3)
# note: The SpatialElement nodes may be replaced
# with the following dynamo nodes if exists!
# Space.Location
# Space.Name
# Space.Number
o_spatialelement_number_2 = Orchid.RevitProject.Elements.SpatialElement.Number(spatialElement=o_spatialelement_centerlocation_3)
o_spatialelement_createspace_2 = Orchid.RevitProject.Elements.SpatialElement.CreateSpace(phase=o_phase_byname_2, level=levels_2, location=o_spatialelement_location_2, name=o_spatialelement_name_2, number=o_spatialelement_number_2)
o_spatialelement_centerlocation_4 = Orchid.RevitProject.Elements.SpatialElement.CenterLocation(spatialElement=o_spatialelement_createspace_2)
