# Dynamo graph ViewDuplicate-ViewTemplate_R21.dyn "ViewDuplicate-ViewTemplate" (Dynamo 2.3.1.11775)
# packages: Orchid 206.6.0.5794

# group: Duplicate view
o_level_indocument = Orchid.RevitProject.Datums.Level.InDocument()
byLevel = FloorPlanView.ByLevel(level=o_level_indocument)
concat = String.Concat()  # unwired: string0, string1
code_block = CodeBlock()
# ---------- code_block.designscript (5 lines) ----------
// Text to add
["DTUfm CHECK - ",
"DTUfm UPLOAD - ",
"EXPORT DWG - ",
"Color CHECK - "];
# ----------------------------------------
name = Element.Name(element=o_level_indocument)
cartesianProduct = List.CartesianProduct(comb=concat, list1=code_block, list2=name)
transpose = List.Transpose(lists=cartesianProduct)
o_view_duplicate_options = ViewDuplicateOption("Duplicate")  # graph input
o_view_duplicate = Orchid.RevitProject.Views.View.Duplicate(view=byLevel, name=transpose, option=o_view_duplicate_options)
transpose_2 = List.Transpose(lists=o_view_duplicate)
o_datastream_await = Orchid.Common.DataStream.Await(pass=byLevel, waitFor=o_view_duplicate)
o_element_delete = Orchid.RevitProject.Elements.Element.Delete(element=o_datastream_await)
o_level_buildingstory = Orchid.RevitProject.Datums.Level.BuildingStory()

# group: Find view template in model
o_viewtemplate_indocument = Orchid.RevitProject.Views.ViewTemplate.InDocument()
code_block_2 = CodeBlock()
# ---------- code_block_2.designscript (5 lines) ----------
// ViewTemplate to use
["DTUfm - CHECK",
"DTUfm - UPLOAD",
"DTU Export DWG",
"DTU Color CHECK"];
# ----------------------------------------
name_2 = Element.Name(element=o_viewtemplate_indocument)
contains = List.Contains(list=code_block_2, item=name_2@L1)
filterByBoolMask = List.FilterByBoolMask(list=o_viewtemplate_indocument, mask=contains)

# group: Set view template
name_3 = Element.Name(element=filterByBoolMask.in)
byKeysValues = DesignScript.Builtin.Dictionary.ByKeysValues(keys=name_3, values=filterByBoolMask.in)
valueAtKey = DesignScript.Builtin.Dictionary.ValueAtKey(dictionary=byKeysValues, key=code_block_2)
o_viewtemplate_set = Orchid.RevitProject.Views.ViewTemplate.Set(view=transpose_2, viewTemplate=valueAtKey)

watch = Watch(o_viewtemplate_set)
