# Dynamo graph WallHole_R21.dyn "WallHole" (Dynamo 2.3.1.11775)
# packages: Orchid 206.3.0.8042

# group: Get hole elements as document (family edit)
code_block = CodeBlock { "Generic Models"; }
byName = Category.ByName(name=code_block)
o_selection_elementbycategory = Orchid.RevitProject.Elements.Selection.ElementByCategory(category=byName)
name = Element.Name(element=o_selection_elementbycategory.Element)
code_block_2 = CodeBlock()
# ---------- code_block_2.designscript (2 lines) ----------
// Search string
"Hole";
# ----------------------------------------
contains = String.Contains(str=name, searchFor=code_block_2)
filterByBoolMask = List.FilterByBoolMask(list=o_selection_elementbycategory.Element, mask=contains)
getFamily = FamilyInstance.GetFamily(familyInstance=filterByBoolMask.in)
o_family_edit = Orchid.RevitProject.Elements.Family.Edit(family=getFamily)

# group: filter for valid holes
o_form_get = Orchid.Common.Geometry.Form.Get(document=o_family_edit)
code_block_3 = CodeBlock { "Walls"; }
byName_2 = Category.ByName(name=code_block_3)
o_selection_elementbycategory_2 = Orchid.RevitProject.Elements.Selection.ElementByCategory(category=byName_2)

# group: find host elements (OcSolid)
o_form_ocsolid = Orchid.Common.Geometry.Form.OcSolid(form=o_form_get)
o_ocsolid_intersect = Orchid.Common.Geometry.OcSolid.Intersect(ocSolid=o_form_ocsolid, elements=o_selection_elementbycategory_2.Element)
watch = Watch(o_ocsolid_intersect)
o_ocsolid_intersect_2 = Orchid.Common.Geometry.OcSolid.Intersect(ocSolid=o_form_ocsolid)
watch_2 = Watch(o_ocsolid_intersect_2)

# group: find host elements (Solid)
o_form_solid = Orchid.Common.Geometry.Form.Solid(form=o_form_get)
o_solid_intersect = Orchid.Common.Geometry.Solid.Intersect(solid=o_form_solid, elements=o_selection_elementbycategory_2.Element)
watch_3 = Watch(o_solid_intersect)
o_solid_intersect_2 = Orchid.Common.Geometry.Solid.Intersect(solid=o_form_solid)
watch_4 = Watch(o_solid_intersect_2)

# group: close document
o_datastream_await = Orchid.Common.DataStream.Await(pass=o_family_edit, waitFor=o_form_solid)  # frozen
o_document_close = Orchid.RevitProject.Common.Document.Close(document=o_datastream_await)
