# Dynamo graph moveToOrigin_Worksets_R21.dyn "moveToOrigin_Worksets" (Dynamo 2.3.2.15696)
# packages: Orchid 206.6.0.5794, Orchid 206.6.0.5794, Orchid 206.6.0.5794

# group: new origin -> as vector
select_model_element = DSModelElementSelection()  # 1 picked in the model; graph input
getLocation = Element.GetLocation(element=select_model_element)
o_point_reverse = Orchid.Geometry.Point.Reverse(point=getLocation)

# group: Write coordinate to txt file and copy coordinate to clipboard
o_document_current = Orchid.RevitProject.Common.Document.Current()
boolean = BoolSelector(false)
o_document_path = Orchid.RevitProject.Common.Document.Path(document=o_document_current, withExtension=boolean)
code_block = CodeBlock(file=o_document_path) { file+".txt"; }
string_from_object = FromObject(obj=o_point_reverse)
writeText = FileSystem.WriteText(filePath=code_block, text=string_from_object)
o_clipboard_copyto = Orchid.Common.Clipboard.CopyTo(object=o_point_reverse)

# group: Adjust view crop box
o_view_model = Orchid.RevitProject.Views.View.Model()
o_view_move = Orchid.RevitProject.Views.View.Move(view=o_view_model, point=o_point_reverse)

# group: Adjust sectionsbox
o_view_threed = Orchid.RevitProject.Views.View.ThreeD()
o_view_movesectionbox = Orchid.RevitProject.Views.View.MoveSectionBox(view3D=o_view_threed, point=o_point_reverse)

# group: Set workset ownership
o_workset_indocument = Orchid.RevitProject.Common.Workset.InDocument()
o_workset_setowner = Orchid.RevitProject.Common.Workset.SetOwner(workset=o_workset_indocument)

# group: Select elements
code_block_2 = CodeBlock()
# ---------- code_block_2.designscript (2 lines) ----------
// Category type elements
"Model";
# ----------------------------------------
o_datastream_await = Orchid.Common.DataStream.Await(pass=code_block_2, waitFor=o_workset_setowner)
o_element_bycategorytype = Orchid.RevitProject.Elements.Element.ByCategoryType(categoryType=o_datastream_await)
string_from_object_2 = FromObject(obj=o_element_bycategorytype.Category)
code_block_3 = CodeBlock()
# ---------- code_block_3.designscript (2 lines) ----------
// Filter for Curtain elements
"Curtain";
# ----------------------------------------
contains = String.Contains(str=string_from_object_2, searchFor=code_block_3)
filterByBoolMask = List.FilterByBoolMask(list=o_element_bycategorytype.Element, mask=contains)
o_wall_allstackedwall = Orchid.RevitProject.Elements.Wall.AllStackedWall()
o_sweep_indocument = Orchid.RevitProject.Elements.Sweep.InDocument()
o_spatialelement = Orchid.RevitProject.Elements.SpatialElement.AllSeparationLine()
flatten = List.Flatten(list=o_spatialelement.Element)
join = List.Join(list0=filterByBoolMask.out, list1=o_wall_allstackedwall, list2=o_sweep_indocument, list3=flatten)

# group: Select special elements
code_block_4 = CodeBlock { "MultistoryStairs"; }
o_class_byname = Orchid.RevitProject.Elements.Class.ByName(name=code_block_4)
all_elements_of_type = ElementsOfType(element_type=o_class_byname)
o_referenceplane_indocument = Orchid.RevitProject.Datums.ReferencePlane.InDocument()
o_level_indocument = Orchid.RevitProject.Datums.Level.InDocument()
o_grid_indocument = Orchid.RevitProject.Datums.Grid.InDocument()
o_group_allmodel = Orchid.RevitProject.Elements.Group.AllModel()
join_2 = List.Join(list0=all_elements_of_type, list1=o_referenceplane_indocument, list2=o_level_indocument, list3=o_grid_indocument, list4=o_group_allmodel)

# group: Select elements
code_block_5 = CodeBlock()
# ---------- code_block_5.designscript (2 lines) ----------
// Category type elements
"Annotation";
# ----------------------------------------
o_element_bycategorytype_2 = Orchid.RevitProject.Elements.Element.ByCategoryType(categoryType=code_block_5)
code_block_6 = CodeBlock(category=o_element_bycategorytype_2.Category)
# ---------- code_block_6.designscript (3 lines) ----------
category.Name == "Section Boxes" ||
category.Name == "Revision Clouds"
? true : false;
# ----------------------------------------
filterByBoolMask_2 = List.FilterByBoolMask(list=o_element_bycategorytype_2.Element, mask=code_block_6)

# group: Select additional elements that not can be grouped
o_group_alldetail = Orchid.RevitProject.Elements.Group.AllDetail()
o_element_ownerviewtype = Orchid.RevitProject.Elements.Element.OwnerViewType(element=o_group_alldetail)
code_block_7 = CodeBlock(t=o_element_ownerviewtype) { t != "Detail"? true : false; }
filterByBoolMask_3 = List.FilterByBoolMask(list=o_group_alldetail, mask=code_block_7)

# group: join lists and unpin element
join_3 = List.Join(list0=join, list1=join_2, list2=filterByBoolMask_2.out, list3=filterByBoolMask_3.in)
flatten_2 = List.Flatten(list=join_3)
o_list_clean = Orchid.Common.List.Clean(list=flatten_2)
o_element_ispinned = Orchid.RevitProject.Elements.Element.IsPinned(element=o_list_clean)
filterByBoolMask_4 = List.FilterByBoolMask(list=o_list_clean, mask=o_element_ispinned)
o_element_unpin = Orchid.RevitProject.Elements.Element.UnPin(element=filterByBoolMask_4.in)
o_element_iscopymonitored = Orchid.RevitProject.Elements.Element.IsCopyMonitored(element=o_list_clean)
filterByBoolMask_5 = List.FilterByBoolMask(list=o_list_clean, mask=o_element_iscopymonitored)
o_datastream_await_2 = Orchid.Common.DataStream.Await(pass=filterByBoolMask_5.out, waitFor=o_element_unpin)
o_element_move = Orchid.RevitProject.Elements.Element.Move(element=o_datastream_await_2, point=o_point_reverse)

# group: re-pin elements
o_datastream_await_3 = Orchid.Common.DataStream.Await(pass=o_element_unpin, waitFor=o_element_move)
o_element_pin = Orchid.RevitProject.Elements.Element.Pin(element=o_datastream_await_3)

# group: Relinquish workset
o_workset_relinquish = Orchid.RevitProject.Common.Workset.Relinquish(waitFor=o_element_move)

# group: Revisions -> delete or add
o_revision_deleteall = Orchid.RevitProject.Common.Revision.DeleteAll()  # frozen
o_revisioncloud_indocument = Orchid.RevitProject.Common.RevisionCloud.InDocument()  # frozen
# note: If revisions is deleted, then remember to
# remove they are added to the "move" list
o_revisioncloud_deleteall = Orchid.RevitProject.Common.RevisionCloud.DeleteAll()  # frozen

# group: Adjust sectionsbox
code_block_8 = CodeBlock { "ThreeD"; }
o_viewtype_byname = Orchid.RevitProject.Views.ViewType.ByName(name=code_block_8)
o_view_bytype = Orchid.RevitProject.Views.View.ByType(viewType=o_viewtype_byname)
watch = Watch(o_view_bytype)
