# Dynamo graph ChangeMEPSystemClass_R21.dyn "ChangeMEPSystemClass" (Dynamo 2.3.1.11775)
# packages: Orchid 206.6.0.5794

code_block = CodeBlock()
# ---------- code_block.designscript (3 lines) ----------
["Kølevand, 30% propylene gylkol, Frem",
"Kølevand, 30% propylene gylkol, Retur"];
["Cooling Supply","Cooling Return"];
# ----------------------------------------
o_mepsystem_byname = Orchid.RevitProject.Systems.MEPSystem.ByName(name=code_block.out0)
o_piping_pipe = Orchid.RevitProject.Systems.Piping.Pipe(pipingSystem=o_mepsystem_byname)
o_mepsystemtype_byname = Orchid.RevitProject.Systems.MEPSystemType.ByName(name=code_block.out1)
o_pipe_setsystemtype = Orchid.RevitProject.Systems.Networks.Pipe.SetSystemType(element=o_piping_pipe, systemType=o_mepsystemtype_byname)
