# Dynamo graph Connector_Mechanical_R21.dyn "Connector_Mechanical" (Dynamo 2.3.1.11775)
# packages: Orchid 206.3.0.8042

code_block = CodeBlock { "VI 1"; }
o_mepsystem_byname = Orchid.RevitProject.Systems.MEPSystem.ByName(name=code_block)

# group: Component
o_mechanical_handlingunit = Orchid.RevitProject.Systems.Mechanical.HandlingUnit(mechanicalSystem=o_mepsystem_byname)
o_familyinstance_connector = Orchid.RevitProject.Systems.FamilyInstance.Connector(familyInstance=o_mechanical_handlingunit)
o_mechanical_fitting = Orchid.RevitProject.Systems.Mechanical.Fitting(mechanicalSystem=o_mepsystem_byname)
o_mechanical_accessory = Orchid.RevitProject.Systems.Mechanical.Accessory(mechanicalSystem=o_mepsystem_byname)
o_mechanical_terminal = Orchid.RevitProject.Systems.Mechanical.Terminal(mechanicalSystem=o_mepsystem_byname)
o_mechanical_equipment = Orchid.RevitProject.Systems.Mechanical.Equipment(mechanicalSystem=o_mepsystem_byname)
o_mechanical_component = Orchid.RevitProject.Systems.Mechanical.Component(mechanicalSystem=o_mepsystem_byname)

code_block_2 = CodeBlock(data=o_familyinstance_connector) { data; }
o_connector_shape = Orchid.RevitProject.Systems.Connector.Shape(connector=code_block_2)
watch = Watch(o_connector_shape.Shape)
watch_2 = Watch(o_connector_shape.Dimension)
o_connector_connection = Orchid.RevitProject.Systems.Connector.Connection(connector=code_block_2)
watch_3 = Watch(o_connector_connection)
o_connector_isconnected = Orchid.RevitProject.Systems.Connector.IsConnected(connector=code_block_2)
watch_4 = Watch(o_connector_isconnected)
o_connector_host = Orchid.RevitProject.Systems.Connector.Host(connector=code_block_2)
watch_5 = Watch(o_connector_host)
o_connector_vector = Orchid.RevitProject.Systems.Connector.Vector(connector=code_block_2)
watch_6 = Watch(o_connector_vector)
watch_7 = Watch(o_familyinstance_connector)
o_connector_direction = Orchid.RevitProject.Systems.Connector.Direction(connector=code_block_2)
watch_8 = Watch(o_connector_direction)
o_connector_location = Orchid.RevitProject.Systems.Connector.Location(connector=code_block_2)
watch_9 = Watch(o_connector_location)

# group: Network
o_mechanical_network = Orchid.RevitProject.Systems.Mechanical.Network(mechanicalSystem=o_mepsystem_byname)
o_element_connector = Orchid.RevitProject.Systems.Element.Connector(element=o_mechanical_network)
o_mechanical_duct = Orchid.RevitProject.Systems.Mechanical.Duct(mechanicalSystem=o_mepsystem_byname)

o_connector_isprimary = Orchid.RevitProject.Systems.Connector.IsPrimary(connector=code_block_2)
watch_10 = Watch(o_connector_isprimary)
o_mep_systems = MEPSystem("VI 1")  # graph input
