# Dynamo graph Mechanical_R21.dyn "Mechanical" (Dynamo 2.12.1.8246)
# packages: Orchid 206.6.0.5794, Orchid 212.3.0.8334

# group: Filter System by type
o_mepsystem_indocument = Orchid.RevitProject.Systems.MEPSystem.InDocument()
# note: Dropdown value:
# MechanicalSystem
element_types = ElementTypes("MechanicalSystem")  # graph input
o_element_classof = Orchid.RevitProject.Elements.Element.ClassOf(element=o_mepsystem_indocument, type=element_types)
code_block = CodeBlock(system=o_element_classof) { system; system[0]; }
name = Element.Name(element=o_element_classof)
o_mepsystem_byname = Orchid.RevitProject.Systems.MEPSystem.ByName(name=name)
watch = Watch(name)
watch_2 = Watch(o_element_classof)

boolean = BoolSelector(false)
o_mechanical_component = Orchid.RevitProject.Systems.Mechanical.Component(mechanicalSystem=code_block.out1, include=boolean)
o_familyinstance_connector = Orchid.RevitProject.Systems.FamilyInstance.Connector(familyInstance=o_mechanical_component)
o_mechanical_handlingunit = Orchid.RevitProject.Systems.Mechanical.HandlingUnit(mechanicalSystem=code_block.out1)

# group: System
o_connector_mepsystem = Orchid.RevitProject.Systems.Connector.MEPSystem(connector=o_familyinstance_connector)
watch_3 = Watch(o_connector_mepsystem.System)
watch_4 = Watch(o_connector_mepsystem.Type)
o_familyinstance_mepsystem = Orchid.RevitProject.Systems.FamilyInstance.MEPSystem(familyInstance=o_mechanical_component)
watch_5 = Watch(o_familyinstance_mepsystem.System)
o_element_mepsystem = Orchid.RevitProject.Systems.Element.MEPSystem(element=o_mechanical_handlingunit)
watch_6 = Watch(o_element_mepsystem.System)
watch_7 = Watch(o_element_mepsystem.Classification)
watch_8 = Watch(o_familyinstance_mepsystem.Classification)

o_mechanical_create = Orchid.RevitProject.Systems.Mechanical.Create()  # unwired: baseConnector, connectors, type
watch_9 = Watch(o_familyinstance_connector)
watch_10 = Watch(o_mechanical_component)
o_mep_systems = MEPSystem("VI 1")  # graph input
code_block_2 = CodeBlock(system=o_mep_systems) { system; }

# group: Filter SystemType by type
o_mepsystemtype_indocument = Orchid.RevitProject.Systems.MEPSystemType.InDocument()
# note: Dropdown value:
# MechanicalSystemType
element_types_2 = ElementTypes("MechanicalSystemType")  # graph input
o_element_classof_2 = Orchid.RevitProject.Elements.Element.ClassOf(element=o_mepsystemtype_indocument, type=element_types_2)
name_2 = Element.Name(element=o_element_classof_2)
o_mepsystemtype_byname = Orchid.RevitProject.Systems.MEPSystemType.ByName(name=name_2)
watch_11 = Watch(name_2)
watch_12 = Watch(o_element_classof_2)

# group: Calculation point
code_block_3 = CodeBlock { "LCA MBB"; "PCA MBB"; }
byName = Family.ByName(name=code_block_3.out1)
o_family = Orchid.RevitProject.Elements.Family.HasSpatialCalculationPoint(family=byName)
categories = Categories("OST_DuctTerminal")  # graph input
all_elements_of_category = ElementsOfCategory(Category=categories)
o_familyinstance = Orchid.RevitProject.Elements.FamilyInstance.GetFromToCalculationPoints(familyInstance=all_elements_of_category)  # frozen
o_familyinstance_2 = Orchid.RevitProject.Elements.FamilyInstance.HasFromToCalculationPoints(familyInstance=all_elements_of_category)  # frozen
o_familyinstance_3 = Orchid.RevitProject.Elements.FamilyInstance.GetSpatialCalculationPoint(familyInstance=all_elements_of_category)
o_familyinstance_4 = Orchid.RevitProject.Elements.FamilyInstance.HasSpatialCalculationPoint(familyInstance=all_elements_of_category)
# note: Dropdown value:
# Air Terminals
o_families = Family("PCA MBB")  # graph input

o_mepsystem_class = Orchid.RevitProject.Systems.MEPSystem.Class(system=o_element_classof)

# group (continued): Filter System by type
watch_13 = Watch(o_mepsystem_class)

# group: Duplicate
code_block_4 = CodeBlock { "test"; }
o_mechanical_duplicate = Orchid.RevitProject.Systems.Mechanical.Duplicate(mechanicalSystem=code_block.out1, systemName=code_block_4)  # frozen
watch_14 = Watch(o_mechanical_duplicate)

# group: SystemType
o_connector_mepsystemtype = Orchid.RevitProject.Systems.Connector.MEPSystemType(connector=o_familyinstance_connector)
watch_15 = Watch(o_connector_mepsystemtype)
o_familyinstance_mepsystemtype = Orchid.RevitProject.Systems.FamilyInstance.MEPSystemType(familyInstance=o_mechanical_component)
watch_16 = Watch(o_familyinstance_mepsystemtype)
o_element_mepsystemtype = Orchid.RevitProject.Systems.Element.MEPSystemType(element=o_mechanical_handlingunit)
watch_17 = Watch(o_element_mepsystemtype)

# group: Network
o_mechanical_network = Orchid.RevitProject.Systems.Mechanical.Network(mechanicalSystem=code_block_2)
watch_18 = Watch(o_mechanical_network)
o_mechanical_duct = Orchid.RevitProject.Systems.Mechanical.Duct(mechanicalSystem=code_block_2)
watch_19 = Watch(o_mechanical_duct)

boolean_2 = BoolSelector(true)

# group: Component
o_mechanical_terminal = Orchid.RevitProject.Systems.Mechanical.Terminal(mechanicalSystem=code_block_2)
watch_20 = Watch(o_mechanical_terminal)
o_mechanical_equipment = Orchid.RevitProject.Systems.Mechanical.Equipment(mechanicalSystem=code_block_2)
watch_21 = Watch(o_mechanical_equipment)
o_mechanical_handlingunit_2 = Orchid.RevitProject.Systems.Mechanical.HandlingUnit(mechanicalSystem=code_block_2)
watch_22 = Watch(o_mechanical_handlingunit_2)
o_mechanical_accessory = Orchid.RevitProject.Systems.Mechanical.Accessory(mechanicalSystem=code_block_2)
watch_23 = Watch(o_mechanical_accessory)
o_mechanical_fitting = Orchid.RevitProject.Systems.Mechanical.Fitting(mechanicalSystem=code_block_2)
watch_24 = Watch(o_mechanical_fitting)
o_mechanical_component_2 = Orchid.RevitProject.Systems.Mechanical.Component(mechanicalSystem=code_block_2, include=boolean_2)
watch_25 = Watch(o_mechanical_component_2)

# group: MEP
o_mep_system_class = MEPSystemClass("CableTrayConduit")  # graph input
o_mep_system_types = MEPSystemType("57-Udsugning")  # graph input
o_duct_system_type = DuctSystemType("ExhaustAir")  # graph input
o_mep_systems_2 = MEPSystem("VI 1")  # graph input

watch_26 = Watch(o_mep_systems_2)
name_3 = Element.Name(element=o_mep_systems_2)
watch_27 = Watch(name_3)
