# Dynamo graph Culture_R22.dyn (Dynamo 2.12.1.8246)
# packages: Orchid 212.4.0.5794

# group: Current culture Current revit culture
o_revit_culture = Orchid.AdeskApp.Revit.Culture()
o_culture_edit = Orchid.Common.Global.Culture.Edit(culture=o_revit_culture)
o_culture_current = Orchid.Common.Global.Culture.Current()

# group: Modify number
code_block = CodeBlock { 4; ","; }
o_culture_setnumber = Orchid.Common.Global.Culture.SetNumber(culture=o_culture_edit, digit=code_block.out0, decimal=code_block.out1)
o_culture_setnumbersymbol = Orchid.Common.Global.Culture.SetNumberSymbol(culture=o_culture_setnumber)

# group: Modify percentage
code_block_2 = CodeBlock { 4; ",,"; }
o_culture_setpercentage = Orchid.Common.Global.Culture.SetPercentage(culture=o_culture_edit, digit=code_block_2.out0, decimal=code_block_2.out1)
o_culture_setpercentagesymbol = Orchid.Common.Global.Culture.SetPercentageSymbol(culture=o_culture_setpercentage)

# group: Modify currency
code_block_3 = CodeBlock { 4; ".."; "#"; }
o_culture_setcurrency = Orchid.Common.Global.Culture.SetCurrency(culture=o_culture_edit, digit=code_block_3.out0, decimal=code_block_3.out1)
o_culture_setcurrencysymbol = Orchid.Common.Global.Culture.SetCurrencySymbol(culture=o_culture_setcurrency, symbol=code_block_3.out2)

# group: All Cultures
o_culture_all = Orchid.Common.Global.Culture.All()
watch = Watch(o_culture_all)

# group: All Languages
o_language_all = Orchid.AdeskApp.Language.All()
watch_2 = Watch(o_language_all)

# group: Culture name, by name, and display name
code_block_4 = CodeBlock { "da-dk"; }
o_culture_byname = Orchid.Common.Global.Culture.ByName(name=code_block_4)
watch_3 = Watch(o_culture_byname)
o_culture_displayname = Orchid.Common.Global.Culture.DisplayName(culture=o_culture_byname)
watch_4 = Watch(o_culture_displayname)
o_culture_name = Orchid.Common.Global.Culture.Name(culture=o_culture_byname)
watch_5 = Watch(o_culture_name)
o_culture = Culture("da-DK")

# group: Language name and by name
code_block_5 = CodeBlock { "English_USA"; }
o_language_byname = Orchid.AdeskApp.Language.ByName(name=code_block_5)
watch_6 = Watch(o_language_byname)
o_revit_language = Orchid.AdeskApp.Revit.Language()
watch_7 = Watch(o_revit_language)
o_language_culture = Orchid.AdeskApp.Language.Culture(language=o_revit_language)
watch_8 = Watch(o_language_culture)
o_revit_language_2 = Language("English_USA")

# group: Modify calendar, time and date
code_block_6 = CodeBlock { "Tuesday"; }
o_culture_setcalendar = Orchid.Common.Global.Culture.SetCalendar(culture=o_culture_edit, firstDay=code_block_6)
o_culture_setdatetime = Orchid.Common.Global.Culture.SetDateTime(culture=o_culture_setcalendar)
o_culture_setdate = Orchid.Common.Global.Culture.SetDate(culture=o_culture_setdatetime)
o_culture_settime = Orchid.Common.Global.Culture.SetTime(culture=o_culture_setdate)

# group: DateTime
today = DateTime.Today()
format = DateTime.Format(dateTime=today)
watch_9 = Watch(format)
dayOfWeek = DateTime.DayOfWeek(dateTime=today)
watch_10 = Watch(dayOfWeek)
