# Dynamo graph EnumerationHandling_R22.dyn (Dynamo 2.12.1.8246)
# packages: Orchid 212.4.0.5820, Orchid 212.4.0.5889

# group: Revit enumeration by enum type and value
code_block = CodeBlock { "ViewDuplicateOption"; "AsDependent"; }
o_revit_enumbyname = Orchid.AdeskApp.Revit.EnumByName(enumType=code_block.out0, valueName=code_block.out1)
type = Object.Type(object=o_revit_enumbyname)
watch = Watch(type)
o_view_duplicate_options = ViewDuplicateOption("AsDependent")

# group: Enumeration by assembly, enum type, and value
code_block_2 = CodeBlock { "RevitAPI"; "ZoomType"; "Zoom"; }
o_object_enumbyname = Orchid.Common.Object.EnumByName(assemblyName=code_block_2.out0, enumType=code_block_2.out1, valueName=code_block_2.out2)
type_2 = Object.Type(object=o_object_enumbyname)
watch_2 = Watch(type_2)
o_print_zoom_type = ZoomType("Zoom")

# group: Orchid enumeration by enum type and value
o_light_loss_factors = LossFactor("Basic loss factor")
code_block_3 = CodeBlock { "LossFactor"; "Basic"; }
o_orchid_enumbyname = Orchid.Common.Orchid.EnumByName(enumType=code_block_3.out0, valueName=code_block_3.out1)
type_3 = Object.Type(object=o_orchid_enumbyname)
watch_3 = Watch(type_3)

# group: Revit (MEP System) enumeration by enum type and value
code_block_4 = CodeBlock { "ElectricalSystemType"; "Data"; }
o_revit_enumbyname_2 = Orchid.AdeskApp.Revit.EnumByName(enumType=code_block_4.out0, valueName=code_block_4.out1)
type_4 = Object.Type(object=o_revit_enumbyname_2)
watch_4 = Watch(type_4)
o_electrical_system_types = ElectricalSystemType("Data")

# group: Revit (Material/Structural) enumeration by enum type and value
code_block_5 = CodeBlock { "StructuralAssetClass"; "Concrete"; }
o_revit_enumbyname_3 = Orchid.AdeskApp.Revit.EnumByName(enumType=code_block_5.out0, valueName=code_block_5.out1)
type_5 = Object.Type(object=o_revit_enumbyname_3)
watch_5 = Watch(type_5)
o_physical_type = PhysicalType("Concrete")

# group: Revit (Material/Termal) enumeration by enum type and value
o_thermal_type = ThermalType("Liquid")
code_block_6 = CodeBlock { "ThermalMaterialType"; "Liquid"; }
o_revit_enumbyname_4 = Orchid.AdeskApp.Revit.EnumByName(enumType=code_block_6.out0, valueName=code_block_6.out1)
type_6 = Object.Type(object=o_revit_enumbyname_4)
watch_6 = Watch(type_6)

# group: Dynamo enumeration by enum type and value
code_block_7 = CodeBlock { "ScheduleType"; "RegularSchedule"; }
o_dynamo_enumbyname = Orchid.AdeskApp.Dynamo.EnumByName(enumType=code_block_7.out0, valueName=code_block_7.out1)
type_7 = Object.Type(object=o_dynamo_enumbyname)
watch_7 = Watch(type_7)
