# Dynamo graph List Index_R22.dyn "List Index_R21" (Dynamo 2.12.1.8246)
# packages: Orchid 212.4.0.5794

# group: Input
code_block = CodeBlock { dataSet(); element(); replace(); }
code_block_2 = CodeBlock()
# ---------- code_block_2.designscript (7 lines) ----------
def element() {
	t1 = "b";
	t2 = 9;
	t3 = dataSet()[3][1];

	return = t1;
};
# ----------------------------------------
code_block_3 = CodeBlock()
# ---------- code_block_3.designscript (7 lines) ----------
def replace() {
	t1 = "c";
	t2 = 5;
	t3 = dataSet()[3][0];

	return = t1;
};
# ----------------------------------------
code_block_4 = CodeBlock()
# ---------- code_block_4.designscript (52 lines) ----------
def dataSet() {
	// Char data sets
	// 1D list
	c1 = ["a", "a", "a", "a", "b"];

	// 2D list
	c2 = [["a", "a", "a", "a", "b"],
	["a", "b", "a"],
	["a", "a", "a", "b", "b", "a"]];

	// nD list
	c3 = ["a", "a", "b",
	["a", "a", "a", "a", "b"],
	["a", "b", "a",
	["a", "a", "b", "b", "a", "a"]]];

	// nD list
	c4 = ["a", "b", ["a", ["a", "b",
	["a", "b"]], "a", "b"],
	["a", "b", "a",
	["a", "a", "b", "b", "a"]]];

	// Integer data sets
	// 1D list
	i1 = [1, 1, 9, 1, 1];

	// 2D list
	i2 = [[1, 1, 9, 1, 1],
	[9, 1, 1],
	[1, 1, 9, 9, 1, 1]];

	// nD list
	i3 = [1, 9, 1,
	[1, 1, 1, 9, 1],
	[1, 1, 9,
	[1, 1, 1, 9, 9, 1]]];

	// nD list
	i4 = [1, 9, [1, [9, 1,
	[1, 9]], 1, 9],
	[9, 9, 1,
	[1, 9, 9, 1, 1]]];

	// element data set
	e1 = List.FirstItem(
	Orchid.RevitProject.Elements
	.Element.HasMaterial(null))
	.ElementType;

	// return data set
	return = c3;
};
# ----------------------------------------

# group: Item index
o_list_indexof = Orchid.Common.List.IndexOf(list=code_block.out0, item=code_block.out1)
indexOf = List.IndexOf(list=code_block.out0, element=code_block.out1)
watch = Watch(o_list_indexof)
watch_2 = Watch(indexOf)

# group: Get items
o_list_getitematindex = Orchid.Common.List.GetItemAtIndex(list=code_block.out0, index=o_list_indexof)
watch_3 = Watch(o_list_getitematindex)
getItemAtIndex = List.GetItemAtIndex(list=code_block.out0, index=indexOf)
watch_4 = Watch(getItemAtIndex)

watch_5 = Watch(code_block.out0)

# group: Replace items
o_list_replaceitematindex = Orchid.Common.List.ReplaceItemAtIndex(list=code_block.out0, index=o_list_indexof, item=code_block.out2)
watch_6 = Watch(o_list_replaceitematindex)
replaceItemAtIndex = List.ReplaceItemAtIndex(list=code_block.out0, index=indexOf, item=code_block.out2)
watch_7 = Watch(replaceItemAtIndex)

# group: Get items by code block
code_block_5 = CodeBlock(t=code_block.out0) { t[4][3][3]; }
watch_8 = Watch(code_block_5)
