# Dynamo graph List.Clean_R21.dyn "List.Clean" (Dynamo 2.3.1.11775)
# packages: Orchid 206.6.0.5794

list_values = CodeBlock()
# ---------- list_values.designscript (6 lines) ----------
[
"a","a", 0,
[],null,"",
"something",
"whatever"
];
# ----------------------------------------
code_block = CodeBlock(list=list_values) { Orchid.Common.List.Clean(list,searchFor); }  # unwired: searchFor
watch = Watch(code_block)
o_list_clean = Orchid.Common.List.Clean(list=list_values)
watch_2 = Watch(o_list_clean)
list_values_2 = CodeBlock()
# ---------- list_values_2.designscript (9 lines) ----------
[
"a","a", 0,
[],null,"",
"something",
[[["in",[]],
"several",null],
"depths","",0],
"whatever"
];
# ----------------------------------------
o_list_clean_2 = Orchid.Common.List.Clean(list=list_values_2)
watch_3 = Watch(o_list_clean_2)
searchfor_values = CodeBlock()
# ---------- searchfor_values.designscript (8 lines) ----------
//default values
[[], null, ""];

//various test values
[[]];
"something";
["something", []];
[[], null, 0, "", "whatever"];
# ----------------------------------------
watch_4 = Watch(list_values_2)
