# Dynamo graph List.SummationByKey_R21.dyn "List.SummationByKey" (Dynamo 2.3.1.11775)
# packages: Orchid 206.6.0.5794

code_block = CodeBlock { "Walls"; }
byName = Category.ByName(name=code_block)
all_elements_of_category = ElementsOfCategory(Category=byName)
code_block_2 = CodeBlock { "Area"; }
getParameterValueByName = Element.GetParameterValueByName(element=all_elements_of_category, parameterName=code_block_2)
code_block_3 = CodeBlock { "Family"; }
getParameterValueByName_2 = Element.GetParameterValueByName(element=all_elements_of_category, parameterName=code_block_3)
groupByKey = List.GroupByKey(list=getParameterValueByName, keys=getParameterValueByName_2)
name = Element.Name(element=groupByKey.unique_keys)
watch = Watch(name)
type = Object.Type(obj=groupByKey.groups)
o_list_summationbykey = Orchid.Common.List.SummationByKey(list=getParameterValueByName, keys=getParameterValueByName_2)
watch_2 = Watch(o_list_summationbykey.unique_keys)
watch_3 = Watch(groupByKey.unique_keys)
watch_4 = Watch(o_list_summationbykey.summarized_groups)
o_list_groupbyequal = Orchid.Common.List.GroupByEqual(list=getParameterValueByName_2)
watch_5 = Watch(o_list_groupbyequal.groups)
type_2 = Object.Type(obj=o_list_summationbykey.summarized_groups)
watch_6 = Watch(groupByKey.groups)
watch_7 = Watch(o_list_groupbyequal.unique_keys)
code_block_4 = CodeBlock(x=getParameterValueByName) { x:int[]; }
type_3 = Object.Type(obj=code_block_4)
