# Dynamo graph MergePDF_R21.dyn "MergePDF" (Dynamo 2.3.1.11775)
# packages: Orchid 206.6.0.5794

code_block = CodeBlock()
# ---------- code_block.designscript (6 lines) ----------
//input documents
["%userprofile%\\Downloads\\PDF\\pdf1.pdf",
"%userprofile%\\Downloads\\PDF\\pdf2.pdf"];

//output file path
"%userprofile%\\Downloads\\PDF\\result.pdf";
# ----------------------------------------
o_file_mergepdf = Orchid.Common.File.MergePDF(documents=code_block.out0, filePath=code_block.out1)
