# Dynamo graph Sorting_R22.dyn "Sorting_R21" (Dynamo 2.12.1.8246)
# packages: Orchid 212.4.0.5794

# group: ASCII table
string = StringInput("%userprofile%\Programming\Testing\Data\")  # graph input
string_2 = StringInput("AsciiTable.txt")  # graph input
o_directory_contents = Orchid.Common.Directory.Contents(directory=string, searchString=string_2)
readText = FileSystem.ReadText(file=o_directory_contents)
string_3 = StringInput("\n")  # graph input
split = String.Split(string=readText, separator0=string_3)
shuffle = List.Shuffle(list=split)

sort = List.Sort(list=shuffle)
built_in = Watch(sort)
o_list_sort = Orchid.Common.List.Sort(list=shuffle)
my_sort = Watch(o_list_sort)
ascii = Watch(split)

# group: testbed
code_block = CodeBlock()
# ---------- code_block.designscript (6 lines) ----------
[
["elm0", "Elm 2", "elm10", "elm1","elm9",
["olm0", "olm10", "olm1", "Olm 2", "olm9"]
],
["Elm1", "elm5", "alm12"]
];
# ----------------------------------------
code_block_2 = CodeBlock { ["c",4,2.2,"b",6,"a1",3,"a10","a9"]; }
code_block_3 = CodeBlock { ["elm0", "elm10", "elm1", "Elm 2", "elm9", "Elm 11", "alm12", "elm13"]; }
code_block_4 = CodeBlock { [["elm0", "elm10", "elm1", "Elm 2", "elm9"], ["Elm 11", "alm12", "elm13"]]; }
code_block_5 = CodeBlock()
# ---------- code_block_5.designscript (7 lines) ----------
[
[
["elm0", "Elm 2", "elm10", "elm1","elm9"],
["olm0", "olm10", "olm1", "Olm 2", "olm9"]
],
["Elm11", "alm12", "elm13"]
];
# ----------------------------------------
code_block_6 = CodeBlock { [[1,2,3,[6,4,5]],[2,1,5],[4,3,2]]; }

boolean = BoolSelector(false)  # graph input
o_list_sort_2 = Orchid.Common.List.Sort(list=code_block, descending=boolean)
my_sort_2 = Watch(o_list_sort_2)
input = Watch(code_block)

# group: numbers and chars mixed
sort_2 = List.Sort(list=code_block_2)
type = Object.Type(object=sort_2)
o_list_sortnatural = Orchid.Common.List.SortNatural(list=code_block_2)
code_block_7 = CodeBlock(t=o_list_sortnatural) { t[0]+t[1]; }
code_block_8 = CodeBlock(t=sort_2) { t[0]+t[1]; }
type_2 = Object.Type(object=o_list_sortnatural)
o_list_sort_3 = Orchid.Common.List.Sort(list=code_block_2)
type_3 = Object.Type(object=o_list_sort_3)

o_list_sortnatural_2 = Orchid.Common.List.SortNatural(list=code_block, descending=boolean)
my_sort_natural = Watch(o_list_sortnatural_2)
sort_3 = List.Sort(list=code_block)
built_in_2 = Watch(sort_3)
code_block_9 = CodeBlock(list=code_block, descending=boolean) { Orchid.Common.List.SortNatural(list,descending); }
watch = Watch(code_block_9)

# group: Revit elements
code_block_10 = CodeBlock { "Windows"; "Doors"; "Walls"; }
byName = Category.ByName(name=code_block_10.out1)
all_elements_of_category = ElementsOfCategory(Category=byName)
byName_2 = Category.ByName(name=code_block_10.out2)
all_elements_of_category_2 = ElementsOfCategory(Category=byName_2)

byName_3 = Category.ByName(name=code_block_10.out0)

# group (continued): Revit elements
all_elements_of_category_3 = ElementsOfCategory(Category=byName_3)
code_block_11 = CodeBlock(windows=all_elements_of_category_3, doors=all_elements_of_category, walls=all_elements_of_category_2)
# ---------- code_block_11.designscript (7 lines) ----------
[windows,
doors,
walls];

[windows.Name,
doors.Name,
walls.Name];
# ----------------------------------------
code_block_12 = CodeBlock(windows=all_elements_of_category_3, doors=all_elements_of_category, walls=all_elements_of_category_2)
# ---------- code_block_12.designscript (7 lines) ----------
[windows,
[doors,
[walls]]];

[windows.Name,
[doors.Name,
[walls.Name]]];
# ----------------------------------------

sort_4 = List.Sort(list=code_block_11.out1)
built_in_3 = Watch(sort_4)
input_2 = Watch(code_block_11.out1)
sort_5 = List.Sort(list=code_block_11.out0)
built_in_4 = Watch(sort_5)
boolean_2 = BoolSelector(false)  # graph input
o_list_sortnatural_3 = Orchid.Common.List.SortNatural(list=code_block_12.out0, descending=boolean_2)
my_sort_natural_2 = Watch(o_list_sortnatural_3)
o_list_sort_4 = Orchid.Common.List.Sort(list=code_block_12.out0, descending=boolean_2)
my_sort_3 = Watch(o_list_sort_4)
o_list_sortnatural_4 = Orchid.Common.List.SortNatural(list=code_block_12.out1, descending=boolean_2)
my_sort_natural_3 = Watch(o_list_sortnatural_4)
o_list_sort_5 = Orchid.Common.List.Sort(list=code_block_12.out1, descending=boolean_2)
my_sort_4 = Watch(o_list_sort_5)
