# Dynamo graph String_R22.dyn "String_R21" (Dynamo 2.12.1.8246)
# packages: Orchid 212.4.0.5794

# group: Import from txt file
string = StringInput("%userprofile%\Programming\Testing\Data\test.txt")  # graph input
o_file_frompath = Orchid.Common.File.FromPath(path=string)
readText = FileSystem.ReadText(file=o_file_frompath)

string_2 = StringInput("\"Boolean.FaceFlipped|DanEDU\"")  # graph input
string_3 = StringInput("\"Boolean.Flipped|DanEDU\"")  # graph input
create = List.Create(item0=string_2, item1=string_3)
string_4 = StringInput("e\">")  # graph input
count = List.Count(list=create)
cycle = List.Cycle(list=string_4, amount=count)

# group: Get substring
o_string_substring = Orchid.Common.String.Substring(string=readText, startsWith=create, endsWith=cycle)
watch = Watch(o_string_substring)

string_5 = StringInput("\"FamilyInstance.IsFaceFlipped\"")  # graph input
string_6 = StringInput("\"FamilyInstance.IsFlipped\"")  # graph input
create_2 = List.Create(item0=string_5, item1=string_6)

# group: Replace string
o_string_replace = Orchid.Common.String.Replace(string=readText, searchFor=create, replaceWith=create_2)
watch_2 = Watch(o_string_replace)

# group: String format
string_7 = StringInput("My dog {0} is {1} years old and messures {2} meters.")
code_block = CodeBlock { "King"; }
number_slider = DoubleSlider(7, range=0..10 step 1)
number_slider_2 = DoubleSlider(1.53, range=0..10 step 0.01)
o_string_format = Orchid.Common.String.Format(string=string_7, item0=code_block, item1=number_slider, item2=number_slider_2)
watch_3 = Watch(o_string_format)
