# Dynamo graph Analytical areaload_R21.dyn (Dynamo 2.6.2.15705)
# packages: Orchid 206.6.0.5794

# group: Input
code_block = CodeBlock { "Floors"; }
byName = Category.ByName(name=code_block)
all_elements_of_category = ElementsOfCategory(Category=byName)

# group: Check if "Structural"
code_block_2 = CodeBlock { "Structural"; }
getParameterValueByName = Element.GetParameterValueByName(element=all_elements_of_category, parameterName=code_block_2)
code_block_3 = CodeBlock(key=getParameterValueByName) { key == 1 ? true : false; }
filterByBoolMask = List.FilterByBoolMask(list=all_elements_of_category, mask=code_block_3)

# group: Import from Excel
# note: File: analyticalProject
string = StringInput("%userprofile%\Programming\Testing\Data\Structural Loads.xlsx")  # graph input
o_file_frompath = Orchid.Common.File.FromPath(path=string)
file_from_path = FileObject(path=o_file_frompath)
string_2 = StringInput("Sheet1")  # graph input
boolean = BoolSelector(false)
importExcel = Data.ImportExcel(file=file_from_path, sheetName=string_2, showExcel=boolean)
restOfItems = List.RestOfItems(list=importExcel)
transpose = List.Transpose(lists=restOfItems)

# group: Get data from Excel, by analytical values from the floor
code_block_4 = CodeBlock(list=transpose) { list[0]; list[1]; }
byKeysValues = DesignScript.Builtin.Dictionary.ByKeysValues(keys=code_block_4.out0, values=code_block_4.out1)
code_block_5 = CodeBlock()
# ---------- code_block_5.designscript (5 lines) ----------
[
"Variable load [kN/m2]",
"Snowload [kN/m2]",
"Deadload [kN/m2]"
];
# ----------------------------------------
getParameterValueByName_2 = Element.GetParameterValueByName(element=filterByBoolMask.in, parameterName=code_block_5, lacing=Longest)
valueAtKey = DesignScript.Builtin.Dictionary.ValueAtKey(dictionary=byKeysValues, key=getParameterValueByName_2)
o_systemfamily_getanalytical = Orchid.RevitProject.Elements.SystemFamily.GetAnalytical(element=filterByBoolMask.in)
string_from_object = FromObject(object=valueAtKey)
setParameterByName = Element.SetParameterByName(element=o_systemfamily_getanalytical, parameterName=code_block_5, value=string_from_object, lacing=Longest)

# group: Remove old loads
code_block_6 = CodeBlock { "Structural Loads - Area Loads"; }
byName_2 = Category.ByName(name=code_block_6)
all_elements_of_category_2 = ElementsOfCategory(Category=byName_2)
delete = Orchid.RevitProject.Elements.Element.Delete(element=all_elements_of_category_2)

# group: Load cases - Adds load corresponding to the floor (kN/m2)
code_block_7 = CodeBlock { "AreaLoadType"; }
o_class_byname = Orchid.RevitProject.Elements.Class.ByName(name=code_block_7)
all_elements_of_type = ElementsOfType(element_type=o_class_byname)
o_datastream_await = Orchid.Common.DataStream.Await(pass=valueAtKey, waitFor=delete)
code_block_8 = CodeBlock(value=o_datastream_await) { -value; }
o_systemfamily_setareaload = Orchid.RevitProject.Elements.SystemFamily.SetAreaLoad(element=filterByBoolMask.in, areaLoadType=all_elements_of_type, value=code_block_8)
code_block_9 = CodeBlock { "Load Case"; }
code_block_10 = CodeBlock { "Structural Load Cases"; }
byName_3 = Category.ByName(name=code_block_10)
all_elements_of_category_3 = ElementsOfCategory(Category=byName_3)
code_block_11 = CodeBlock(load=all_elements_of_category_3)
# ---------- code_block_11.designscript (8 lines) ----------
[
//Live load
load[1],
//Snow load
load[3],
//Dead load
load[0]
];
# ----------------------------------------
setParameterByName_2 = Element.SetParameterByName(element=o_systemfamily_setareaload, parameterName=code_block_9, value=code_block_11)
name = Element.Name(element=all_elements_of_category_3)
watch = Watch(name)
