# Dynamo graph Analytical elements_R21.dyn (Dynamo 2.6.2.15705)
# packages: Orchid 206.6.0.5794

categories = Categories("OST_WallAnalytical")  # graph input
# note: File: analyticalProject
all_elements_of_category = ElementsOfCategory(Category=categories)

# group: Changes the alignment method of the analytical element
code_block = CodeBlock { "Alignment Method"; "Top Extension Method"; "Base Extension Method"; }
# note: false = Automatic detection
# true  = Projection
boolean = BoolSelector(false)  # graph input
setParameterByName = Element.SetParameterByName(element=all_elements_of_category, parameterName=code_block.out0, value=boolean)
setParameterByName_2 = Element.SetParameterByName(element=all_elements_of_category, parameterName=code_block.out2, value=boolean)
setParameterByName_3 = Element.SetParameterByName(element=all_elements_of_category, parameterName=code_block.out1, value=boolean)

# group: Changes the location of the analytical element
code_block_2 = CodeBlock { "Center of Core"; "Center of Element"; "Interior Face of Element"; "Exterior Face of Element"; }
o_systemfamily = Orchid.RevitProject.Elements.SystemFamily.SetAnalyticalLocation(element=all_elements_of_category, location=code_block_2.out1)

categories_2 = Categories("OST_FloorAnalytical")  # graph input
all_elements_of_category_2 = ElementsOfCategory(Category=categories_2)

# group: Changes the location of the analytical element
code_block_3 = CodeBlock { "Top of Element"; "Bottom of Element"; "Center of Element"; }
o_systemfamily_2 = Orchid.RevitProject.Elements.SystemFamily.SetAnalyticalLocation(element=all_elements_of_category_2, location=code_block_3.out0)

# group: Changes the alignment method of the analytical element
code_block_4 = CodeBlock { "Alignment Method"; }
# note: false = Automatic detection
# true  = Projection
boolean_2 = BoolSelector(false)  # graph input
setParameterByName_4 = Element.SetParameterByName(element=all_elements_of_category_2, parameterName=code_block_4, value=boolean_2)
