# Dynamo graph Category_R22.dyn (Dynamo 2.12.1.8246)
# packages: Orchid 212.4.0.5794, Orchid 212.4.0.5985

# group: Category --> BuiltInCategory and CategoryType
o_category_indocument = Orchid.RevitProject.Categories.Category.InDocument()
watch = Watch(o_category_indocument)
o_category_categorytype = Orchid.RevitProject.Categories.Category.CategoryType(category=o_category_indocument)
groupByKey = List.GroupByKey(list=o_category_indocument, keys=o_category_categorytype)
watch_2 = Watch(groupByKey.groups)
watch_3 = Watch(groupByKey.uniqueKeys)
watch_4 = Watch(o_category_categorytype)

# group: enum
code_block = CodeBlock()
# ---------- code_block.designscript (11 lines) ----------
"CategoryType";

"Model";
"Annotation";
"AnalyticalModel";
"Internal";

["Model",
"Annotation",
"AnalyticalModel",
"Internal"];
# ----------------------------------------
o_revit_enumbyname = Orchid.AdeskApp.Revit.EnumByName(enumType=code_block.out0, valueName=code_block.out1)

# group: Category --> ByCategoryType
# note: File: defaultProject
o_category_bycategorytype = Orchid.RevitProject.Categories.Category.ByCategoryType(categoryType=o_revit_enumbyname)
watch_5 = Watch(o_category_bycategorytype)

# group: Category --> Imported
imported = Orchid.RevitProject.Categories.Category.Imported()
watch_6 = Watch(imported)
deleteImported = Orchid.RevitProject.Categories.Category.DeleteImported()  # frozen

natural_category_name = CodeBlock()
# ---------- natural_category_name.designscript (26 lines) ----------
[
"Casework",
"Ceilings",
"Columns",
"Curtain Wall Mullions",
"Curtain Panels",
"Curtain Systems",
"Doors",
"Entourage",
"Floors",
"Furniture",
"Furniture Systems",
"Generic Models",
"Plumbing Fixtures",
"Ramps",
"Roofs",
"Specialty Equipment",
"Stairs",
"Structural Columns",
"Structural Foundations",
"Structural Framing",
"Structural Beam Systems",
"Structural Stiffeners",
"Walls",
"Windows"
];
# ----------------------------------------

# group: SubCategory
o_subcategory_bycategory = Orchid.RevitProject.Categories.SubCategory.ByCategory(category=natural_category_name)
watch_7 = Watch(o_subcategory_bycategory)
code_block_2 = CodeBlock(list=o_subcategory_bycategory) { list[0][3]; }
string_from_object = FromObject(obj=code_block_2)
o_subcategory_byname = Orchid.RevitProject.Categories.SubCategory.ByName(name=string_from_object)
watch_8 = Watch(o_subcategory_byname)

built_in_categories = CodeBlock()
# ---------- built_in_categories.designscript (26 lines) ----------
[
"OST_Casework",
"OST_Ceilings",
"OST_Columns",
"OST_CurtainWallMullions",
"OST_CurtainWallPanels",
"OST_CurtaSystem",
"OST_Doors",
"OST_Entourage",
"OST_Floors",
"OST_Furniture",
"OST_FurnitureSystems",
"OST_GenericModel",
"OST_PlumbingFixtures",
"OST_Ramps",
"OST_Roofs",
"OST_SpecialityEquipment",
"OST_Stairs",
"OST_StructuralColumns",
"OST_StructuralFoundation",
"OST_StructuralFraming",
"OST_StructuralFramingSystem",
"OST_StructuralStiffener",
"OST_Walls",
"OST_Windows"
];
# ----------------------------------------

# group: SubCategory
code_block_3 = CodeBlock { "Casework"; "Cabinet"; "Test"; }
o_subcategory_byname_2 = Orchid.RevitProject.Categories.SubCategory.ByName(category=code_block_3.out0, name=code_block_3.out1)
watch_9 = Watch(o_subcategory_byname_2)
o_subcategory_create = Orchid.RevitProject.Categories.SubCategory.Create(category=code_block_3.out0, name=code_block_3.out2)
o_subcategory_delete = Orchid.RevitProject.Categories.SubCategory.Delete(category=code_block_3.out0, subCategory=o_subcategory_create)
watch_10 = Watch(o_subcategory_delete)

# group: CategorySet
boolean = BoolSelector(false)
o_categoryset_architecture = Orchid.RevitProject.Categories.CategorySet.Architecture(instance=boolean)
watch_11 = Watch(o_categoryset_architecture)
o_categoryset_structure = Orchid.RevitProject.Categories.CategorySet.Structure(instance=boolean)
watch_12 = Watch(o_categoryset_structure)
o_categoryset_infrastructure = Orchid.RevitProject.Categories.CategorySet.Infrastructure(instance=boolean)
watch_13 = Watch(o_categoryset_infrastructure)
o_categoryset_mechanical = Orchid.RevitProject.Categories.CategorySet.Mechanical(instance=boolean)
watch_14 = Watch(o_categoryset_mechanical)
o_categoryset_electrical = Orchid.RevitProject.Categories.CategorySet.Electrical(instance=boolean)
watch_15 = Watch(o_categoryset_electrical)
o_categoryset_piping = Orchid.RevitProject.Categories.CategorySet.Piping(instance=boolean)
watch_16 = Watch(o_categoryset_piping)
