# Dynamo graph Delete_R22.dyn "--Delete_R22" (Dynamo 2.12.1.8246)
# packages: Orchid 212.4.0.5794

code_block = CodeBlock { Orchid.RevitProject.Elements.Element.Delete(element); }  # frozen; unwired: element
# note: File: defaultProject
code_block_2 = CodeBlock { "Structural Columns"; "Windows"; "Doors"; "Walls"; }
byName = Category.ByName(name=code_block_2.out1)
all_elements_of_category = ElementsOfCategory(Category=byName)
byName_2 = Category.ByName(name=code_block_2.out2)
all_elements_of_category_2 = ElementsOfCategory(Category=byName_2)
byName_3 = Category.ByName(name=code_block_2.out3)
all_elements_of_category_3 = ElementsOfCategory(Category=byName_3)
code_block_3 = CodeBlock(windows=all_elements_of_category, doors=all_elements_of_category_2, walls=all_elements_of_category_3)
# ---------- code_block_3.designscript (3 lines) ----------
[windows,
doors,
walls];
# ----------------------------------------
o_element_delete = Orchid.RevitProject.Elements.Element.Delete(element=code_block_3)
watch = Watch(o_element_delete)
byName_4 = Category.ByName(name=code_block_2.out0)
all_elements_of_category_4 = ElementsOfCategory(Category=byName_4)
code_block_4 = CodeBlock(windows=all_elements_of_category, doors=all_elements_of_category_2, columns=all_elements_of_category_4)
# ---------- code_block_4.designscript (3 lines) ----------
[windows,
[doors,
[columns]]];
# ----------------------------------------
