# Dynamo graph Elem+Fam_R22.dyn (Dynamo 2.12.1.8246)
# packages: Orchid 212.4.0.5794

# note: File: defaultProject
code_block = CodeBlock { ["Floors","Walls","Windows"]; }
byName = Category.ByName(name=code_block)
o_element_bycategory = Orchid.RevitProject.Elements.Element.ByCategory(category=byName)
elementType = Element.ElementType(element=o_element_bycategory.Element)
uniqueItems = List.UniqueItems(list=elementType@L2)
o_elementtype_familyname = Orchid.RevitProject.Elements.ElementType.FamilyName(elementType=uniqueItems)
watch = Watch(o_elementtype_familyname)
o_elementtype_name = Orchid.RevitProject.Elements.ElementType.Name(elementType=uniqueItems)
watch_2 = Watch(o_elementtype_name)
name = Element.Name(element=o_element_bycategory.Element)
watch_3 = Watch(name)
o_element_familyname = Orchid.RevitProject.Elements.Element.FamilyName(element=o_element_bycategory.Element)
watch_4 = Watch(o_element_familyname)
o_element_info = Orchid.RevitProject.Elements.Element.Info(element=o_element_bycategory.Element)
watch_5 = Watch(o_element_info.Owner)
watch_6 = Watch(o_element_info.Creator)
watch_7 = Watch(o_element_info.LastChangedBy)
watch_8 = Watch(o_element_info.RequestedBy)

# group: Family
o_families = Family("Ext. Single-Flush")  # graph input
o_element_byfamily = Orchid.RevitProject.Elements.Element.ByFamily(family=o_families)
watch_9 = Watch(o_element_byfamily)
