# Dynamo graph ElementRoom_R21.dyn (Dynamo 2.6.2.15705)
# packages: Orchid 206.6.0.5794

# group: Room elements
code_block = CodeBlock { "Rooms"; }
byName = Category.ByName(name=code_block)
o_element_bycategory = Orchid.RevitProject.Elements.Element.ByCategory(category=byName)
geometry = Element.Geometry(element=o_element_bycategory)
boundingBox = Geometry.BoundingBox(geometry=geometry)
flatten = List.Flatten(list=boundingBox)

# group: FamilyInstance elements
# note: File: defaultProject_room2
code_block_2 = CodeBlock { ["Doors","Windows"]; }
byName_2 = Category.ByName(name=code_block_2)
o_element_bycategory_2 = Orchid.RevitProject.Elements.Element.ByCategory(category=byName_2)
flatten_2 = List.Flatten(list=o_element_bycategory_2)
o_familyinstance = Orchid.RevitProject.Elements.FamilyInstance.GetFromToCalculationPoints(familyInstance=flatten_2)
lastItem = List.LastItem(list=o_familyinstance, lacing=Longest)
o_boundingbox_pointinside = Orchid.Geometry.BoundingBox.PointInside(boundingBox=flatten, point=lastItem, lacing=CrossProduct)
firstItem = List.FirstItem(list=o_familyinstance, lacing=Longest)
o_boundingbox_pointinside_2 = Orchid.Geometry.BoundingBox.PointInside(boundingBox=flatten, point=firstItem, lacing=CrossProduct)

# group: Set parameter value
filterByBoolMask = List.FilterByBoolMask(list=flatten_2, mask=o_boundingbox_pointinside_2@L2)
code_block_3 = CodeBlock { "Number"; "Comments"; }
getParameterValueByName = Element.GetParameterValueByName(element=o_element_bycategory, parameterName=code_block_3.out0)
setParameterByName = Element.SetParameterByName(element=filterByBoolMask.in, parameterName=code_block_3.out1, value=getParameterValueByName)
o_datastream_await = Orchid.Common.DataStream.Await(pass=o_boundingbox_pointinside, waitFor=setParameterByName)
filterByBoolMask_2 = List.FilterByBoolMask(list=flatten_2, mask=o_datastream_await@L2)
setParameterByName_2 = Element.SetParameterByName(element=filterByBoolMask_2.in, parameterName=code_block_3.out1, value=getParameterValueByName)

watch = Watch(filterByBoolMask_2.in)
watch_2 = Watch(filterByBoolMask.in)
watch_3 = Watch(flatten_2)

# group: Solid intersect element
o_solid_intersect = Orchid.Geometry.Solid.Intersect(solid=geometry)
watch_4 = Watch(o_solid_intersect)
o_solid_intersect_2 = Orchid.Geometry.Solid.Intersect(solid=geometry, elements=flatten_2)
watch_5 = Watch(o_solid_intersect_2)

# group: Boundingbox intersect element
o_boundingbox_intersect = Orchid.Geometry.BoundingBox.Intersect(boundingBox=boundingBox)
watch_6 = Watch(o_boundingbox_intersect)
o_boundingbox_intersect_2 = Orchid.Geometry.BoundingBox.Intersect(boundingBox=boundingBox, element=flatten_2)
watch_7 = Watch(o_boundingbox_intersect_2)

watch_8 = Watch(o_element_bycategory)
