# Dynamo graph ElementTag_R22.dyn "ElementTags" (Dynamo 2.12.1.8246)
# packages: Orchid 212.4.0.5794

# group: Get tag
code_block = CodeBlock { "Doors"; }
byName = Category.ByName(name=code_block)
all_elements_of_category = ElementsOfCategory(Category=byName)
o_element_gettag = Orchid.RevitProject.Elements.Element.GetTag(element=all_elements_of_category)

watch = Watch(all_elements_of_category)
watch_2 = Watch(o_element_gettag)
