# Dynamo graph Family-Associated_R21.dyn (Dynamo 2.6.2.15705)
# packages: Orchid 206.6.0.5794

# note: File: defaultProject
code_block = CodeBlock { "Generic Models"; }
byName = Category.ByName(name=code_block)
all_elements_of_category = ElementsOfCategory(Category=byName)
elementType = Element.ElementType(element=all_elements_of_category)
family = FamilyType.Family(familyType=elementType)
watch = Watch(family)
o_family_hasassociated = Orchid.RevitProject.Elements.Family.HasAssociated(family=family)
watch_2 = Watch(o_family_hasassociated)
watch_3 = Watch(elementType)
o_familytype_hasassociated = Orchid.RevitProject.Elements.FamilyType.HasAssociated(familyType=elementType)
watch_4 = Watch(o_familytype_hasassociated)
