# Dynamo graph Family.Save_R21.dyn (Dynamo 2.6.2.15705)
# packages: Orchid 206.6.0.5794

# group: selected families by category in project
# note: File: defaultProject
natural_category_name = CodeBlock()
# ---------- natural_category_name.designscript (12 lines) ----------
[
"Casework",
"Columns",
"Doors",
"Windows",
"Specialty Equipment",
"Structural Columns",
"Structural Foundations",
"Structural Framing",
"Structural Beam Systems",
"Structural Stiffeners"
];
# ----------------------------------------
string = StringInput("%userprofile%\Programming\Testing\Data\testSet")  # graph input
boolean = BoolSelector(true)  # graph input

byName = Category.ByName(name=natural_category_name)

# group (continued): selected families by category in project
o_element_bycategory = Orchid.RevitProject.Elements.Element.ByCategory(category=byName)

elementType = Element.ElementType(element=o_element_bycategory)

# group (continued): selected families by category in project
uniqueItems = List.UniqueItems(list=elementType, lacing=Longest)
flatten = List.Flatten(list=uniqueItems)
family = FamilyType.Family(familyType=flatten)
o_family_save = Orchid.RevitProject.Elements.Family.Save(family=family, path=string, subfolder=boolean)

watch = Watch(o_family_save)
