# Dynamo graph Flipped_R21.dyn (Dynamo 2.6.2.15705)
# packages: Orchid 206.6.0.5794

code_block = CodeBlock { "Walls"; }
byName = Category.ByName(name=code_block)
all_elements_of_category = ElementsOfCategory(Category=byName)

# group: Boolean
code_block_2 = CodeBlock(data=all_elements_of_category) { data; }
o_wall_isflipped = Orchid.RevitProject.Elements.Wall.IsFlipped(wall=code_block_2)
groupByKey = List.GroupByKey(list=code_block_2, keys=o_wall_isflipped)

watch = Watch(groupByKey.groups)
watch_2 = Watch(groupByKey.unique_keys)

# group: Element
code_block_3 = CodeBlock(data=all_elements_of_category) { data; }
o_wall_flipped = Orchid.RevitProject.Elements.Wall.Flipped(wall=code_block_3)
code_block_4 = CodeBlock { "Comments"; "Is flipped"; "Not flipped"; }
setParameterByName = Element.SetParameterByName(element=o_wall_flipped.true, parameterName=code_block_4.out0, value=code_block_4.out1)
setParameterByName_2 = Element.SetParameterByName(element=o_wall_flipped.false, parameterName=code_block_4.out0, value=code_block_4.out2)

watch_3 = Watch(setParameterByName)
watch_4 = Watch(setParameterByName_2)
o_object_hashing = Orchid.Common.Object.Hashing(object=all_elements_of_category)
watch_5 = Watch(o_object_hashing)
code_block_5 = CodeBlock { "Doors"; }
byName_2 = Category.ByName(name=code_block_5)
all_elements_of_category_2 = ElementsOfCategory(Category=byName_2)

# group: Element
setParameterByName_3 = Element.SetParameterByName()  # unwired: element, parameterName, value
code_block_6 = CodeBlock(data=all_elements_of_category_2) { data; }
o_familyinstance_faceflipped = Orchid.RevitProject.Elements.FamilyInstance.FaceFlipped(familyInstance=code_block_6)
code_block_7 = CodeBlock { "Opening Side"; "in"; "out"; }
# note: If an element dont include the needed parameter will a normal node fail, however, using Function.Apply will prevent from that!
function_apply = ApplyFunction(func=setParameterByName_3, arg1=o_familyinstance_faceflipped.true, arg2=code_block_7.out0, arg3=code_block_7.out1)
o_list_clean = Orchid.Common.List.Clean(list=function_apply)
function_apply_2 = ApplyFunction(func=setParameterByName_3, arg1=o_familyinstance_faceflipped.false, arg2=code_block_7.out0, arg3=code_block_7.out2)
o_list_clean_2 = Orchid.Common.List.Clean(list=function_apply_2)

watch_6 = Watch(o_list_clean)

# group: Boolean
code_block_8 = CodeBlock(data=all_elements_of_category_2) { data; }
o_familyinstance_ishandflipped = Orchid.RevitProject.Elements.FamilyInstance.IsHandFlipped(familyInstance=code_block_8)
groupByKey_2 = List.GroupByKey(list=code_block_8, keys=o_familyinstance_ishandflipped)
o_familyinstance_isfaceflipped = Orchid.RevitProject.Elements.FamilyInstance.IsFaceFlipped(familyInstance=code_block_8)
groupByKey_3 = List.GroupByKey(list=code_block_8, keys=o_familyinstance_isfaceflipped)

watch_7 = Watch(groupByKey_2.groups)
watch_8 = Watch(groupByKey_3.groups)

# group: Element
code_block_9 = CodeBlock(data=all_elements_of_category_2) { data; }
o_familyinstance_handflipped = Orchid.RevitProject.Elements.FamilyInstance.HandFlipped(familyInstance=code_block_9)
code_block_10 = CodeBlock { "Hinge Side"; "R"; "L"; }
# note: File: defaultProject
setParameterByName_4 = Element.SetParameterByName(element=o_familyinstance_handflipped.true, parameterName=code_block_10.out0, value=code_block_10.out1)
setParameterByName_5 = Element.SetParameterByName(element=o_familyinstance_handflipped.false, parameterName=code_block_10.out0, value=code_block_10.out2)

watch_9 = Watch(setParameterByName_4)
watch_10 = Watch(o_list_clean_2)
watch_11 = Watch(groupByKey_2.unique_keys)
watch_12 = Watch(groupByKey_3.unique_keys)
watch_13 = Watch(setParameterByName_5)
watch_14 = Watch(all_elements_of_category_2)
o_familyinstance_handorientation = Orchid.RevitProject.Elements.FamilyInstance.HandOrientation(familyInstance=all_elements_of_category_2)
watch_15 = Watch(o_familyinstance_handorientation)
