# Dynamo graph Intersect_R21.dyn (Dynamo 2.6.2.15705)
# packages: Orchid 206.6.0.5794

# group: Element intersect element
code_block = CodeBlock { "Structural Framing"; ["Doors", "Walls"]; }
byName = Category.ByName(name=code_block.out0)
all_elements_of_category = ElementsOfCategory(Category=byName)
byName_2 = Category.ByName(name=code_block.out1)
all_elements_of_category_2 = ElementsOfCategory(Category=byName_2)
flatten = List.Flatten(list=all_elements_of_category_2)
o_element_intersect = Orchid.RevitProject.Elements.Element.Intersect(element=all_elements_of_category, elements=flatten)
watch = Watch(o_element_intersect)
watch_2 = Watch(all_elements_of_category)

natural_category_name = CodeBlock()
# ---------- natural_category_name.designscript (26 lines) ----------
[
"Casework",
"Ceilings",
"Columns",
"Curtain Wall Mullions",
"Curtain Panels",
"Curtain Systems",
"Doors",
"Entourage",
"Floors",
"Furniture",
"Furniture Systems",
"Generic Models",
"Plumbing Fixtures",
"Ramps",
"Roofs",
"Specialty Equipment",
"Stairs",
"Structural Columns",
"Structural Foundations",
"Structural Framing",
"Structural Beam Systems",
"Structural Stiffeners",
"Walls",
"Windows"
];
# ----------------------------------------

# group: Category intersect element
byName_3 = Category.ByName(name=natural_category_name)
o_element_bycategory = Orchid.RevitProject.Elements.Element.ByCategory(category=byName_3)
o_element_intersectcategory = Orchid.RevitProject.Elements.Element.IntersectCategory(element=o_element_bycategory.Element)
watch_3 = Watch(o_element_intersectcategory)
watch_4 = Watch(o_element_bycategory.Category)
watch_5 = Watch(o_element_bycategory.Element)

# group: Sorting by boolean
flatten_2 = List.Flatten(list=o_element_bycategory.Element)
o_element_doesintersectother = Orchid.RevitProject.Elements.Element.DoesIntersectOther(element=o_element_bycategory.Element)
o_list_anytrue = Orchid.Common.List.AnyTrue(list=o_element_doesintersectother@L2)
filterByBoolMask = List.FilterByBoolMask(list=flatten_2, mask=o_list_anytrue)
o_element_intersectcategory_2 = Orchid.RevitProject.Elements.Element.IntersectCategory(element=filterByBoolMask.in)
watch_6 = Watch(o_element_intersectcategory_2)
watch_7 = Watch(filterByBoolMask.in)
watch_8 = Watch(flatten_2)
watch_9 = Watch(o_list_anytrue)

# group: Category intersect element
code_block_2 = CodeBlock { "Structural Framing"; ["Doors", "Walls"]; }
byName_4 = Category.ByName(name=code_block_2.out0)
all_elements_of_category_3 = ElementsOfCategory(Category=byName_4)
byName_5 = Category.ByName(name=code_block_2.out1)
o_element_intersectcategory_3 = Orchid.RevitProject.Elements.Element.IntersectCategory(element=all_elements_of_category_3, category=byName_5)
watch_10 = Watch(o_element_intersectcategory_3)
watch_11 = Watch(all_elements_of_category_3)

# note: OOTB nodes
byName_6 = Category.ByName(name=natural_category_name)
all_elements_of_category_4 = ElementsOfCategory(Category=byName_6)
o_list_clean = Orchid.Common.List.Clean(list=all_elements_of_category_4)
o_element_intersectcategory_4 = Orchid.RevitProject.Elements.Element.IntersectCategory(element=o_list_clean)
watch_12 = Watch(o_element_intersectcategory_4)
watch_13 = Watch(o_list_clean)

# group: Category intersect element
# note: File: defaultProject_extended
o_element_hasmaterial = Orchid.RevitProject.Elements.Element.HasMaterial()
watch_14 = Watch(o_element_hasmaterial.Element)
watch_15 = Watch(o_element_hasmaterial.Category)
o_element_intersectcategory_5 = Orchid.RevitProject.Elements.Element.IntersectCategory(element=o_element_hasmaterial.Element)
watch_16 = Watch(o_element_intersectcategory_5)

# group: Element intersect element
o_element_hasmaterial_2 = Orchid.RevitProject.Elements.Element.HasMaterial()
watch_17 = Watch(o_element_hasmaterial_2.Element)
watch_18 = Watch(o_element_hasmaterial_2.Category)
flatten_3 = List.Flatten(list=o_element_hasmaterial_2.Element)
o_element_intersect_2 = Orchid.RevitProject.Elements.Element.Intersect(element=o_element_hasmaterial_2.Element, elements=flatten_3)
watch_19 = Watch(o_element_intersect_2)

# group: Element intersect
o_element_hasmaterial_3 = Orchid.RevitProject.Elements.Element.HasMaterial()
watch_20 = Watch(o_element_hasmaterial_3.Element)
watch_21 = Watch(o_element_hasmaterial_3.Category)
o_element_intersect_3 = Orchid.RevitProject.Elements.Element.Intersect(element=o_element_hasmaterial_3.Element)
watch_22 = Watch(o_element_intersect_3)

built_in_categories = CodeBlock()
# ---------- built_in_categories.designscript (26 lines) ----------
[
"OST_Casework",
"OST_Ceilings",
"OST_Columns",
"OST_CurtainWallMullions",
"OST_CurtainWallPanels",
"OST_CurtaSystem",
"OST_Doors",
"OST_Entourage",
"OST_Floors",
"OST_Furniture",
"OST_FurnitureSystems",
"OST_GenericModel",
"OST_PlumbingFixtures",
"OST_Ramps",
"OST_Roofs",
"OST_SpecialityEquipment",
"OST_Stairs",
"OST_StructuralColumns",
"OST_StructuralFoundation",
"OST_StructuralFraming",
"OST_StructuralFramingSystem",
"OST_StructuralStiffener",
"OST_Walls",
"OST_Windows"
];
# ----------------------------------------
