# Dynamo graph AddSetGet_R22.dyn "AddSetGet_R21" (Dynamo 2.12.1.8246)
# packages: Orchid 212.4.0.5794, Orchid 212.4.0.8440

# group: create family type
o_familydocument_current = Orchid.RevitFamily.FamilyDocument.Current()
code_block = CodeBlock()
# ---------- code_block.designscript (2 lines) ----------
//Types to create
"Type 1";
# ----------------------------------------
o_familytype_create = Orchid.RevitFamily.FamilyType.Create(familyDocument=o_familydocument_current, name=code_block)
o_familytype_name = Orchid.RevitFamily.FamilyType.Name(familyType=o_familytype_create)

# group: Add parameter
o_datastream_await = Orchid.Common.DataStream.Await(pass=o_familydocument_current, waitFor=o_familytype_create)
code_block_2 = CodeBlock()
# ---------- code_block_2.designscript (6 lines) ----------
//Parameter name
"Test4";
//Parameter type
"Material";
//Parameter group
"PG_ADSK_MODEL_PROPERTIES";
# ----------------------------------------
o_familyparameter_create = Orchid.RevitFamily.FamilyParameter.Create(familyDocument=o_datastream_await, parameterName=code_block_2.out0, type=code_block_2.out1, group=code_block_2.out2)

# group: Set parameter
o_datastream_await_2 = Orchid.Common.DataStream.Await(pass=o_datastream_await, waitFor=o_familyparameter_create)
code_block_3 = CodeBlock()
# ---------- code_block_3.designscript (6 lines) ----------
//Type
"Type 1";
//Parameter name
"Test4";
//Value
"Glass";
# ----------------------------------------
o_familytype_byname = Orchid.RevitFamily.FamilyType.ByName(name=code_block_3.out0)
byName = Material.ByName(name=code_block_3.out2)
o_familyparameter_setvalue = Orchid.RevitFamily.FamilyParameter.SetValue(familyDocument=o_datastream_await_2, familyType=o_familytype_byname, parameterName=code_block_3.out1, value=byName)

# group: Filter by Type
code_block_4 = CodeBlock(data=o_familyparameter_setvalue) { data; }
type = Object.Type(object=code_block_4)

o_string_toclass = Orchid.Common.String.ToClass(string=type)
o_object_classof = Orchid.Common.Object.ClassOf(object=code_block_4, class=o_string_toclass)

# group (continued): Filter by Type
watch = Watch(o_object_classof)

# group: Add parameter
o_datastream_await_3 = Orchid.Common.DataStream.Await(pass=o_familydocument_current, waitFor=o_familytype_create)
code_block_5 = CodeBlock()
# ---------- code_block_5.designscript (6 lines) ----------
//Parameter name
"Test2";
//Parameter type
"Number";
//Parameter group
"PG_ADSK_MODEL_PROPERTIES";
# ----------------------------------------
o_familyparameter_create_2 = Orchid.RevitFamily.FamilyParameter.Create(familyDocument=o_datastream_await_3, parameterName=code_block_5.out0, type=code_block_5.out1, group=code_block_5.out2)

# group: Set parameter
o_datastream_await_4 = Orchid.Common.DataStream.Await(pass=o_datastream_await_3, waitFor=o_familyparameter_create_2)
code_block_6 = CodeBlock()
# ---------- code_block_6.designscript (6 lines) ----------
//Type
"Type 1";
//Parameter name
"Test2";
//Value
1.5;
# ----------------------------------------
o_familytype_byname_2 = Orchid.RevitFamily.FamilyType.ByName(name=code_block_6.out0)
o_familyparameter_setvalue_2 = Orchid.RevitFamily.FamilyParameter.SetValue(familyDocument=o_datastream_await_4, familyType=o_familytype_byname_2, parameterName=code_block_6.out1, value=code_block_6.out2)

# group: Add parameter
o_datastream_await_5 = Orchid.Common.DataStream.Await(pass=o_familydocument_current, waitFor=o_familytype_create)
code_block_7 = CodeBlock()
# ---------- code_block_7.designscript (14 lines) ----------
//Parameter name
"Test1";
//Parameter type
"Integer";
//Parameter group
"PG_ADSK_MODEL_PROPERTIES";
//ToolTip
"do this work?";
//Instances
true;
//Reporting
true;
//Condense output
false;
# ----------------------------------------
o_familyparameter_create_3 = Orchid.RevitFamily.FamilyParameter.Create(familyDocument=o_datastream_await_5, parameterName=code_block_7.out0, type=code_block_7.out1, group=code_block_7.out2, tooltip=code_block_7.out3)

# group: Set parameter
o_datastream_await_6 = Orchid.Common.DataStream.Await(pass=o_datastream_await_5, waitFor=o_familyparameter_create_3)
code_block_8 = CodeBlock()
# ---------- code_block_8.designscript (6 lines) ----------
//Type
"Type 1";
//Parameter name
"Test1";
//Value
1;
# ----------------------------------------
o_familytype_byname_3 = Orchid.RevitFamily.FamilyType.ByName(familyDocument=o_datastream_await_6, name=code_block_8.out0)
o_familyparameter_setvalue_3 = Orchid.RevitFamily.FamilyParameter.SetValue(familyDocument=o_datastream_await_6, familyType=o_familytype_byname_3, parameterName=code_block_8.out1, value=code_block_8.out2)

# group: Add parameter
o_datastream_await_7 = Orchid.Common.DataStream.Await(pass=o_familydocument_current, waitFor=o_familytype_create)
code_block_9 = CodeBlock()
# ---------- code_block_9.designscript (6 lines) ----------
//Parameter name
"Test3";
//Parameter type
"Text";
//Parameter group
"PG_ADSK_MODEL_PROPERTIES";
# ----------------------------------------
o_familyparameter_create_4 = Orchid.RevitFamily.FamilyParameter.Create(familyDocument=o_datastream_await_7, parameterName=code_block_9.out0, type=code_block_9.out1, group=code_block_9.out2)

# group: Set parameter
o_datastream_await_8 = Orchid.Common.DataStream.Await(pass=o_datastream_await_7, waitFor=o_familyparameter_create_4)
code_block_10 = CodeBlock()
# ---------- code_block_10.designscript (6 lines) ----------
//Type
"Type 1";
//Parameter name
"Test3";
//Value
"string";
# ----------------------------------------
o_familytype_byname_4 = Orchid.RevitFamily.FamilyType.ByName(name=code_block_10.out0)
o_familyparameter_setvalue_4 = Orchid.RevitFamily.FamilyParameter.SetValue(familyDocument=o_datastream_await_8, familyType=o_familytype_byname_4, parameterName=code_block_10.out1, value=code_block_10.out2)

create = List.Create(item0=o_familyparameter_setvalue_3, item1=o_familyparameter_setvalue_2, item2=o_familyparameter_setvalue_4, item3=o_familyparameter_setvalue)

# group: Get Parameter
o_datastream_await_9 = Orchid.Common.DataStream.Await(pass=o_datastream_await_4, waitFor=create)
code_block_11 = CodeBlock()
# ---------- code_block_11.designscript (7 lines) ----------
//Type name
"Type 1";
//Parameter name
["Test1",
"Test2",
"Test3",
"Test4"];
# ----------------------------------------
o_familytype_byname_5 = Orchid.RevitFamily.FamilyType.ByName(name=code_block_11.out0)
o_familyparameter_getvalue = Orchid.RevitFamily.FamilyParameter.GetValue(familyDocument=o_datastream_await_9, familyType=o_familytype_byname_5, parameterName=code_block_11.out1)
code_block_12 = CodeBlock(t=o_familyparameter_getvalue.valueByParameter) { t[3]; }
name = Material.Name(material=code_block_12)
watch_2 = Watch(name)
type_2 = Object.Type(object=o_familyparameter_getvalue.valueByParameter)
watch_3 = Watch(type_2)
watch_4 = Watch(o_familyparameter_getvalue.valueByParameter)

# group: Parameters
o_datastream_await_10 = Orchid.Common.DataStream.Await(pass=o_datastream_await_4, waitFor=create)
o_familydocument_parameters = Orchid.RevitFamily.FamilyDocument.Parameters(familyDocument=o_datastream_await_10)
name_2 = FamilyParameter.Name(familyParameter=o_familydocument_parameters)
watch_5 = Watch(name_2)
