# Dynamo graph ConvertIFCforFamily_R21.dyn (Dynamo 2.6.2.15705)
# packages: Orchid 206.6.0.5794

directory_path = StringInput("%userprofile%\Programming\Testing\Data\testSet")  # graph input
string = StringInput("*.rfa")  # graph input
boolean = BoolSelector(false)  # graph input
contents = Orchid.Common.Directory.Contents(directory=directory_path, searchString=string, deepSearch=boolean)  # frozen
backgroundOpen = Orchid.RevitProject.Common.Document.BackgroundOpen(file=contents)
o_familydocument_current = Orchid.RevitFamily.FamilyDocument.Current()
create = Orchid.RevitFamily.FamilyType.Create(familyDocument=o_familydocument_current)
await_ = Orchid.Common.DataStream.Await(pass=o_familydocument_current, waitFor=create)
inDocument = Orchid.RevitFamily.FamilyType.InDocument()
code_block = CodeBlock()
# ---------- code_block.designscript (2 lines) ----------
//parameter name
["IfcExportAs", "IFC CAD Layer"];
# ----------------------------------------
getValue = Orchid.RevitFamily.FamilyParameter.GetValue(familyDocument=await_, familyType=inDocument, parameterName=code_block)
await_2 = Orchid.Common.DataStream.Await(pass=await_, waitFor=getValue.valueByParameter)
code_block_2 = CodeBlock()
# ---------- code_block_2.designscript (10 lines) ----------
//Parameter name
["IfcExportAs[Type]",
"IFC CAD Layer"];
//SP Parameter group
["IFC Type Properties",
"IFC Properties"];
//Parameter group
["PG_IFC","PG_IFC"];
//Instance parameter
[false,true];
# ----------------------------------------
delete = Orchid.RevitFamily.FamilyParameter.Delete(familyDocument=await_2, parameterName=code_block)
await_3 = Orchid.Common.DataStream.Await(pass=code_block_2.out2, waitFor=delete)
add = Orchid.RevitFamily.SharedParameter.Add(familyDocument=await_2, parameterName=code_block_2.out0, groupName=code_block_2.out1, group=await_3, instance=code_block_2.out3, lacing=Longest)
await_4 = Orchid.Common.DataStream.Await(pass=await_2, waitFor=add)
inDocument_2 = Orchid.RevitFamily.FamilyType.InDocument()
setValue = Orchid.RevitFamily.FamilyParameter.SetValue(familyDocument=await_4, familyType=inDocument_2, parameterName=code_block_2.out0, value=getValue.valueByParameter)
await_5 = Orchid.Common.DataStream.Await(pass=await_4, waitFor=setValue)  # frozen
boolean_2 = BoolSelector(true)  # graph input
close = Orchid.RevitProject.Common.Document.Close(document=await_5, save=boolean_2)

# group: Cleanup backup files
await_6 = Orchid.Common.DataStream.Await(pass=directory_path, waitFor=close)
string_2 = StringInput("*.0001.rfa")  # graph input
boolean_3 = BoolSelector(true)  # graph input
contents_2 = Orchid.Common.Directory.Contents(directory=await_6, searchString=string_2, deepSearch=boolean_3)
deleteFile = FileSystem.DeleteFile(path=contents_2)
