# Dynamo graph FamilyType_R21.dyn (Dynamo 2.12.1.8246)
# packages: Orchid 206.6.0.5794

# group: Create type
o_familydocument_current = Orchid.RevitFamily.FamilyDocument.Current()
code_block = CodeBlock()
# ---------- code_block.designscript (2 lines) ----------
//Types to create
["Type 1", "Type 2"];
# ----------------------------------------
o_familytype_create = Orchid.RevitFamily.FamilyType.Create(familyDocument=o_familydocument_current, name=code_block)

# group: Add parameter
code_block_2 = CodeBlock()
# ---------- code_block_2.designscript (15 lines) ----------
//Parameter name
["Test","something"];
//Parameter type
"Text";
//"Length";
//Parameter group
"PG_ADSK_MODEL_PROPERTIES";
//Tooltip
"Owner value";
//Instances
true;
//Reporting
true;
//Condense output
false;
# ----------------------------------------
o_familyparameter_create = Orchid.RevitFamily.FamilyParameter.Create(familyDocument=o_familydocument_current, parameterName=code_block_2.out0, type=code_block_2.out1, group=code_block_2.out2)

# group: Rename parameter
o_datastream_await = Orchid.Common.DataStream.Await(pass=o_familydocument_current, waitFor=o_familyparameter_create)
code_block_3 = CodeBlock()
# ---------- code_block_3.designscript (4 lines) ----------
//Source name
"Test";
//Target name
"NewTest";
# ----------------------------------------
o_familyparameter_rename = Orchid.RevitFamily.FamilyParameter.Rename(familyDocument=o_datastream_await, sourceName=code_block_3.out0, targetName=code_block_3.out1)
watch = Watch(o_familyparameter_rename)

# group: Delete parameter
o_datastream_await_2 = Orchid.Common.DataStream.Await(pass=o_datastream_await, waitFor=o_familyparameter_rename)
code_block_4 = CodeBlock()
# ---------- code_block_4.designscript (2 lines) ----------
//Parameter name
"NewTest";
# ----------------------------------------
o_familyparameter_delete = Orchid.RevitFamily.FamilyParameter.Delete(familyDocument=o_datastream_await_2, parameterName=code_block_4)

# group: Rename type
o_datastream_await_3 = Orchid.Common.DataStream.Await(pass=o_familydocument_current, waitFor=o_familytype_create)
code_block_5 = CodeBlock()
# ---------- code_block_5.designscript (4 lines) ----------
//Source name
"Type 1";
//Target name
"Type 3";
# ----------------------------------------
o_familytype_rename = Orchid.RevitFamily.FamilyType.Rename(familyDocument=o_datastream_await_3, sourceName=code_block_5.out0, targetName=code_block_5.out1)

# group: Delete type
code_block_6 = CodeBlock()
# ---------- code_block_6.designscript (2 lines) ----------
//Type name
"Type 3";
# ----------------------------------------
o_datastream_await_4 = Orchid.Common.DataStream.Await(pass=o_datastream_await_3, waitFor=o_familytype_rename)
o_familytype_name = Orchid.RevitFamily.FamilyType.Name(familyType=o_familytype_rename)
o_familytype_byname = Orchid.RevitFamily.FamilyType.ByName(name=o_familytype_name)
o_familytype_delete = Orchid.RevitFamily.FamilyType.Delete(familyDocument=o_datastream_await_4, familyType=o_familytype_byname)

# group: Get all family type
# note: This node is being processed among the first, while it always look at the current document and don't need a document to be loaded. This node is best to use in families where types are not added!
o_familytype_indocument = Orchid.RevitFamily.FamilyType.InDocument()
o_familytype_name_2 = Orchid.RevitFamily.FamilyType.Name(familyType=o_familytype_indocument)
watch_2 = Watch(o_familytype_name_2)
watch_3 = Watch(o_familytype_indocument)

# group: Get all family type by document
o_datastream_await_5 = Orchid.Common.DataStream.Await(pass=o_familydocument_current, waitFor=o_familytype_create)

o_familytype_indocument_2 = Orchid.RevitFamily.FamilyType.InDocument(familyDocument=o_datastream_await_5)

# group (continued): Get all family type by document
o_familytype_name_3 = Orchid.RevitFamily.FamilyType.Name(familyType=o_familytype_indocument_2)
watch_4 = Watch(o_familytype_name_3)

# group: Convert to Orchid type
o_object_torevittype = Orchid.Common.Object.ToRevitType(object=o_familytype_create)
o_object_toorchidtype = Orchid.Common.Object.ToOrchidType(object=o_object_torevittype)
o_familytype_name_4 = Orchid.RevitFamily.FamilyType.Name(familyType=o_object_toorchidtype)
watch_5 = Watch(o_familytype_name_4)

# group: Current family type
# note: This node is being processed among the first, while it always look at the current document and don't need a document to be loaded. This node is best to use in families where types are not added!
o_familytype_current = Orchid.RevitFamily.FamilyType.Current()
o_familytype_name_5 = Orchid.RevitFamily.FamilyType.Name(familyType=o_familytype_current)
watch_6 = Watch(o_familytype_name_5)

# group: Deprecated converter
o_familytype_torevittype = Orchid.RevitFamily.FamilyType.ToRevitType(familyType=o_familytype_create)
o_familytype_toorchidtype = Orchid.RevitFamily.FamilyType.ToOrchidType(familyType=o_familytype_torevittype)
o_familytype_name_6 = Orchid.RevitFamily.FamilyType.Name(familyType=o_familytype_toorchidtype)
watch_7 = Watch(o_familytype_name_6)
