# Dynamo graph FormSetGet_R22.dyn "FormSetGet" (Dynamo 2.12.1.8246)
# packages: Orchid 212.4.0.5794

# group: Create ordinary parameter
o_familydocument_current = Orchid.RevitFamily.FamilyDocument.Current()
code_block = CodeBlock()
# ---------- code_block.designscript (6 lines) ----------
//Parameter name
"Material";
//Parameter type
"Material";
//Parameter group
"PG_ADSK_MODEL_PROPERTIES";
# ----------------------------------------
o_familyparameter_create = Orchid.RevitFamily.FamilyParameter.Create(familyDocument=o_familydocument_current, parameterName=code_block.out0, type=code_block.out1, group=code_block.out2)

# group: Set parameter
o_datastream_await = Orchid.Common.DataStream.Await(pass=o_familydocument_current, waitFor=o_familyparameter_create)
code_block_2 = CodeBlock()
# ---------- code_block_2.designscript (2 lines) ----------
//Parameter name
"Material";
# ----------------------------------------
o_material = Material("Glass")  # graph input
o_familyparameter_setvalue = Orchid.RevitFamily.FamilyParameter.SetValue(familyDocument=o_datastream_await, parameterName=code_block_2, value=o_material)

# group: Select geometry
element_types = ElementTypes("Extrusion")  # graph input
all_elements_of_type = ElementsOfType(element_type=element_types)

# group: Associate parameter
o_datastream_await_2 = Orchid.Common.DataStream.Await(pass=o_datastream_await, waitFor=o_familyparameter_setvalue)
code_block_3 = CodeBlock()  # same code as code_block_2
o_familyparameter_associate = Orchid.RevitFamily.FamilyParameter.Associate(familyDocument=o_datastream_await_2, parameterName=code_block_3, element=all_elements_of_type, elementParameter=code_block_3)

# group: Create FamilyType based parameter
o_familydocument_current_2 = Orchid.RevitFamily.FamilyDocument.Current()
code_block_4 = CodeBlock()
# ---------- code_block_4.designscript (6 lines) ----------
//Parameter name
"Nested Family";
//Parameter type
"Generic Models";
//Parameter group
"PG_ADSK_MODEL_PROPERTIES";
# ----------------------------------------
byName = Category.ByName(name=code_block_4.out1)
o_familyparameter_create_2 = Orchid.RevitFamily.FamilyParameter.Create(familyDocument=o_familydocument_current_2, parameterName=code_block_4.out0, category=byName, group=code_block_4.out2)
