# Dynamo graph Form_R21.dyn (Dynamo 2.6.2.15705)
# packages: Orchid 206.6.0.5794

element_types = ElementTypes("Extrusion")  # graph input
all_elements_of_type = ElementsOfType(element_type=element_types)
solids = Element.Solids(element=all_elements_of_type)
watch = Watch(solids)
o_form_solid = Orchid.Geometry.Form.Solid(form=all_elements_of_type)
watch_2 = Watch(o_form_solid)

# group: Dynamo Solid
o_form_get = Orchid.Geometry.Form.Get()
o_form_solid_2 = Orchid.Geometry.Form.Solid(form=o_form_get)
watch_3 = Watch(o_form_solid_2)
o_solid_intersect = Orchid.Geometry.Solid.Intersect(solid=o_form_solid_2)
watch_4 = Watch(o_solid_intersect)

# group: Orchid Solid
o_form_get_2 = Orchid.Geometry.Form.Get()
o_form_ocsolid = Orchid.Geometry.Form.OcSolid(form=o_form_get_2)
o_ocsolid_intersect = Orchid.Geometry.OcSolid.Intersect(ocSolid=o_form_ocsolid)
watch_5 = Watch(o_ocsolid_intersect)
watch_6 = Watch(o_form_ocsolid)
o_ocsolid_union = Orchid.Geometry.OcSolid.Union(ocSolid=o_form_ocsolid)
o_ocsolid_area = Orchid.Geometry.OcSolid.Area(ocSolid=o_ocsolid_union)
watch_7 = Watch(o_ocsolid_area)
o_ocsolid_volumne = Orchid.Geometry.OcSolid.Volumne(ocSolid=o_ocsolid_union)
watch_8 = Watch(o_ocsolid_volumne)
watch_9 = Watch(o_ocsolid_union)
o_ocsolid_todynamotype = Orchid.Geometry.OcSolid.ToDynamoType(ocSolid=o_ocsolid_union)
watch_10 = Watch(o_ocsolid_todynamotype)

byUnion = Solid.ByUnion(solids=o_form_solid_2)

# group (continued): Dynamo Solid
area = Solid.Area(solid=byUnion)
watch_11 = Watch(area)
volume = Solid.Volume(solid=byUnion)
watch_12 = Watch(volume)
watch_13 = Watch(byUnion)
o_solid_toorchidtype = Orchid.Geometry.Solid.ToOrchidType(solid=byUnion)
watch_14 = Watch(o_solid_toorchidtype)

# note: File: 3solid (Geometry folder)
element_types_2 = ElementTypes("FreeFormElement")  # graph input
