# Dynamo graph LightSource_R22.dyn (Dynamo 2.12.1.8246)
# packages: Orchid 212.4.0.5828

o_familytype_indocument = Orchid.RevitFamily.FamilyType.InDocument()
# note: File: LundtofteLamp_two
code_block = CodeBlock { "Type 1"; "Type 2"; }
o_familytype_byname = Orchid.RevitFamily.FamilyType.ByName(name=code_block.out1)

# group: Set light shape data
code_block_2 = CodeBlock(familyType=o_familytype_byname) { familyType; "Point"; }
o_light_shape_style = LightShapeStyle("Rectangle")
o_familyparameter_setlightshape = Orchid.RevitFamily.FamilyParameter.SetLightShape(familyType=code_block_2.familyType, style=o_light_shape_style)

# group: Get light shape data
o_familyparameter_getlightshape = Orchid.RevitFamily.FamilyParameter.GetLightShape(familyType=o_familyparameter_setlightshape)
watch = Watch(o_familyparameter_getlightshape.Style)
watch_2 = Watch(o_familyparameter_getlightshape.Value)

# group: Set light distribution data
code_block_3 = CodeBlock(familyType=o_familytype_byname) { familyType; "Spherical"; }
o_light_distribution_style = LightDistributionStyle("Spot light distribution")
o_familyparameter = Orchid.RevitFamily.FamilyParameter.SetLightDistribution(familyType=code_block_3.familyType, style=o_light_distribution_style)

# group: Get light distribution data
o_familyparameter_2 = Orchid.RevitFamily.FamilyParameter.GetLightDistribution(familyType=o_familyparameter)
watch_3 = Watch(o_familyparameter_2.Style)
watch_4 = Watch(o_familyparameter_2.Value)

# group: Set light color filter data
code_block_4 = CodeBlock(familyType=o_familytype_byname)
# ---------- code_block_4.designscript (3 lines) ----------
familyType;
Color.ByARGB
(0, 127, 127, 127);
# ----------------------------------------
o_familyparameter_3 = Orchid.RevitFamily.FamilyParameter.SetLightColorFilter(familyType=code_block_4.familyType, color=code_block_4.out1)

# group: Get light color filter data
o_familyparameter_4 = Orchid.RevitFamily.FamilyParameter.GetLightColorFilter(familyType=o_familyparameter_3)
watch_5 = Watch(o_familyparameter_4)

# group: Initial Color
code_block_5 = CodeBlock(familyType=o_familytype_byname)
# ---------- code_block_5.designscript (6 lines) ----------
familyType;
// Style
"PresetColor";

3100;
"FluorescentWarm";
# ----------------------------------------
o_familyparameter_5 = Orchid.RevitFamily.FamilyParameter.SetLightCustomColor(familyType=code_block_5.familyType, value=code_block_5.out2)  # frozen
o_lighting_color_preset = ColorPreset("Fluorescent (Warm White)")
o_familyparameter_6 = Orchid.RevitFamily.FamilyParameter.SetLightPresetColor(familyType=code_block_5.familyType, color=o_lighting_color_preset)  # frozen
o_initial_color_style = InitialColor("Custom color")
o_familyparameter_setlightcolor = Orchid.RevitFamily.FamilyParameter.SetLightColor(familyType=code_block_5.familyType, style=o_initial_color_style, value=code_block_5.out2)

# group: Initial Color
o_familyparameter_getlightcolor = Orchid.RevitFamily.FamilyParameter.GetLightColor(familyType=o_familyparameter_5)
watch_6 = Watch(o_familyparameter_getlightcolor.d1)
o_familyparameter_getlightcolor_2 = Orchid.RevitFamily.FamilyParameter.GetLightColor(familyType=o_familyparameter_6)
watch_7 = Watch(o_familyparameter_getlightcolor_2.d1)
o_familyparameter_getlightcolor_3 = Orchid.RevitFamily.FamilyParameter.GetLightColor(familyType=o_familyparameter_setlightcolor)
watch_8 = Watch(o_familyparameter_getlightcolor_3.Color)
watch_9 = Watch(o_familyparameter_getlightcolor_3.d1)

# group: Initial Intensity
code_block_6 = CodeBlock(familyType=o_familytype_byname)
# ---------- code_block_6.designscript (14 lines) ----------
familyType;
// Style
"Flux";

// Wattage
10;
150;
// Flux
1400;
// Luminous
440;
// lluminance
50;
3048;
# ----------------------------------------
o_familyparameter_7 = Orchid.RevitFamily.FamilyParameter.SetLightWattageIntensity(familyType=code_block_6.familyType, wattage=code_block_6.out2, efficacy=code_block_6.out3)  # frozen
o_familyparameter_8 = Orchid.RevitFamily.FamilyParameter.SetLightFluxIntensity(familyType=code_block_6.familyType, value=code_block_6.out4)  # frozen
o_familyparameter_9 = Orchid.RevitFamily.FamilyParameter.SetLightLuminousIntensity(familyType=code_block_6.familyType, value=code_block_6.out5)  # frozen
o_familyparameter_10 = Orchid.RevitFamily.FamilyParameter.SetLightIlluminanceIntensity(familyType=code_block_6.familyType, illuminance=code_block_6.out6, distance=code_block_6.out7)  # frozen
o_initial_intensity_style = InitialIntensity("Flux intensity")
o_familyparameter_11 = Orchid.RevitFamily.FamilyParameter.SetLightIntensity(familyType=code_block_6.familyType, style=o_initial_intensity_style, valueA=code_block_6.out4)

# group: Initial Intensity
o_familyparameter_12 = Orchid.RevitFamily.FamilyParameter.GetLightIntensity(familyType=o_familyparameter_7)
watch_10 = Watch(o_familyparameter_12.Value)
o_familyparameter_13 = Orchid.RevitFamily.FamilyParameter.GetLightIntensity(familyType=o_familyparameter_8)
watch_11 = Watch(o_familyparameter_13.Value)
o_familyparameter_14 = Orchid.RevitFamily.FamilyParameter.GetLightIntensity(familyType=o_familyparameter_9)
watch_12 = Watch(o_familyparameter_14.Value)
o_familyparameter_15 = Orchid.RevitFamily.FamilyParameter.GetLightIntensity(familyType=o_familyparameter_10)
watch_13 = Watch(o_familyparameter_15.Value)
o_familyparameter_16 = Orchid.RevitFamily.FamilyParameter.GetLightIntensity(familyType=o_familyparameter_11)
watch_14 = Watch(o_familyparameter_16.Style)
watch_15 = Watch(o_familyparameter_16.Value)

# group: Loss Factor
code_block_7 = CodeBlock(familyType=o_familytype_byname)
# ---------- code_block_7.designscript (7 lines) ----------
familyType;

// Style
"Basic";
3.00;
1.25;
0.75;
# ----------------------------------------
o_familyparameter_17 = Orchid.RevitFamily.FamilyParameter.SetBasicLossFactor(familyType=code_block_7.familyType, value=code_block_7.out2)
o_familyparameter_18 = Orchid.RevitFamily.FamilyParameter.SetAdvancedLossFactor(familyType=code_block_7.familyType, temperature=code_block_7.out3, voltage=code_block_7.out3, ballast=code_block_7.out4, tilt=code_block_7.out4, surface=code_block_7.out4, lumen=code_block_7.out4, luminaire=code_block_7.out4)  # frozen
o_loss_factor_style = LossFactor("Basic loss factor")
o_familyparameter_19 = Orchid.RevitFamily.FamilyParameter.SetLightLossFactor(familyType=code_block_7.familyType, style=o_loss_factor_style, value=code_block_7.out2, temperature=code_block_7.out3, voltage=code_block_7.out3, ballast=code_block_7.out4, tilt=code_block_7.out4, surface=code_block_7.out4, lumen=code_block_7.out4, luminaire=code_block_7.out4)

# group: Loss Factor
o_familyparameter_20 = Orchid.RevitFamily.FamilyParameter.GetLightLossFactor(familyType=o_familyparameter_17)  # frozen
watch_16 = Watch(o_familyparameter_20.Value)
o_familyparameter_21 = Orchid.RevitFamily.FamilyParameter.GetLightLossFactor(familyType=o_familyparameter_18)
watch_17 = Watch(o_familyparameter_21.Value)
o_familyparameter_22 = Orchid.RevitFamily.FamilyParameter.GetLightLossFactor(familyType=o_familyparameter_19)
watch_18 = Watch(o_familyparameter_22.Style)
watch_19 = Watch(o_familyparameter_22.Value)

# group: Set light dimming color data
code_block_8 = CodeBlock(familyType=o_familytype_byname) { familyType; "None"; }
o_light_dimming_color = LightDimmingColor("Incandescent lamp curve dimming color")
o_familyparameter_23 = Orchid.RevitFamily.FamilyParameter.SetLightDimmingColor(familyType=code_block_8.familyType, color=o_light_dimming_color)

# group: Get light dimming color data
o_familyparameter_24 = Orchid.RevitFamily.FamilyParameter.GetLightDimmingColor(familyType=o_familyparameter_23)
watch_20 = Watch(o_familyparameter_24)
