# Dynamo graph Nested-Lookup_R22.dyn "Nested-Lookup_R21" (Dynamo 2.12.1.8246)
# packages: Orchid 212.4.0.5801

# group: Load a family (nested)
string = StringInput("%userprofile%\Programming\Testing\Data\testSet\Front - Plain.rfa")  # graph input
o_document_backgroundopen = Orchid.RevitProject.Common.Document.BackgroundOpen(file=string)
o_family_load = Orchid.RevitFamily.Family.Load(familyDocument=o_document_backgroundopen)
o_datastream_await = Orchid.Common.DataStream.Await(pass=o_document_backgroundopen, waitFor=o_family_load)
o_document_close = Orchid.RevitProject.Common.Document.Close(document=o_datastream_await)

# group: create default family type
o_familydocument_current = Orchid.RevitFamily.FamilyDocument.Current()
o_familytype_create = Orchid.RevitFamily.FamilyType.Create(familyDocument=o_familydocument_current)
o_datastream_await_2 = Orchid.Common.DataStream.Await(pass=o_familydocument_current, waitFor=o_familytype_create)

# group: Create Family Type parameter (Category)
o_datastream_await_3 = Orchid.Common.DataStream.Await(pass=o_datastream_await_2, waitFor=o_family_load)
code_block = CodeBlock()
# ---------- code_block.designscript (8 lines) ----------
//Parameter name
["testFamily"];
//Parameter group
"PG_ADSK_MODEL_PROPERTIES";
//Instances
true;
//Reporting
true;
# ----------------------------------------
code_block_2 = CodeBlock { Revit.Category.ByName("Casework"); }
o_familyparameter_create = Orchid.RevitFamily.FamilyParameter.Create(familyDocument=o_datastream_await_3, parameterName=code_block.out0, category=code_block_2, group=code_block.out1)

# group: Create ordinary parameter
code_block_3 = CodeBlock()
# ---------- code_block_3.designscript (6 lines) ----------
//Parameter name
["Width","Height","testValue"];
//Parameter type
"Length";
//Parameter group
"PG_ADSK_MODEL_PROPERTIES";
# ----------------------------------------
o_familyparameter_create_2 = Orchid.RevitFamily.FamilyParameter.Create(familyDocument=o_datastream_await_2, parameterName=code_block_3.out0, type=code_block_3.out1, group=code_block_3.out2)

# group: Set parameter
o_datastream_await_4 = Orchid.Common.DataStream.Await(pass=o_datastream_await_2, waitFor=o_familyparameter_create_2)
code_block_4 = CodeBlock()
# ---------- code_block_4.designscript (4 lines) ----------
//Parameter name
"Width";
//Value
800.0;
# ----------------------------------------
o_familyparameter_setvalue = Orchid.RevitFamily.FamilyParameter.SetValue(familyDocument=o_datastream_await_4, parameterName=code_block_4.out0, value=code_block_4.out1)

types = Family.Types(family=o_family_load)

# group: Associate parameter
o_datastream_await_5 = Orchid.Common.DataStream.Await(pass=o_datastream_await_4, waitFor=o_familyparameter_setvalue)
code_block_5 = CodeBlock()
# ---------- code_block_5.designscript (2 lines) ----------
//Parameter name
"Width";
# ----------------------------------------
o_familyparameter_associate = Orchid.RevitFamily.FamilyParameter.Associate(familyDocument=o_datastream_await_5, parameterName=code_block_5, element=types, elementParameter=code_block_5)
o_datastream_await_6 = Orchid.Common.DataStream.Await(pass=o_datastream_await_5, waitFor=o_familyparameter_associate)

# group: parameters
o_familydocument_parameters = Orchid.RevitFamily.FamilyDocument.Parameters(familyDocument=o_datastream_await_6)
o_familyparameter_name = FamilyParameter.Name(familyParameter=o_familydocument_parameters)
watch = Watch(o_familyparameter_name)
o_object_torevittype = Orchid.Common.Object.ToRevitType(object=o_familydocument_parameters)

# group: Get nested family type (FamilySymbol) and converters Note: Nested families in a family document is denoted FamilySymbol, and FamilyType in a project document is denoted FamilySymbol in Autodesk Revit API!
o_familytype_getnested = Orchid.RevitFamily.FamilyType.GetNested(familyDocument=o_datastream_await_6)
o_object_torevittype_2 = Orchid.Common.Object.ToRevitType(object=o_familytype_getnested)
o_object_todynamotype = Orchid.Common.Object.ToDynamoType(object=o_object_torevittype_2)
watch_2 = Watch(o_object_todynamotype)
name = Element.Name(element=o_object_todynamotype)
watch_3 = Watch(name)
watch_4 = Watch(o_object_torevittype_2)
watch_5 = Watch(o_familytype_getnested)

# group: Get nested data --> use OOTB nodes inside family document
lastItem = List.LastItem(list=o_familytype_getnested)
code_block_6 = CodeBlock()
# ---------- code_block_6.designscript (2 lines) ----------
//Parameter name
["Width"];
# ----------------------------------------
getParameterValueByName = Element.GetParameterValueByName(element=lastItem, parameterName=code_block_6)
watch_6 = Watch(getParameterValueByName)

# group: Create ordinary parameter
code_block_7 = CodeBlock()
# ---------- code_block_7.designscript (6 lines) ----------
//Parameter name
["Lookup Table Name","testKey"];
//Parameter type
"Text";
//Parameter group
"PG_ADSK_MODEL_PROPERTIES";
# ----------------------------------------
o_familyparameter_create_3 = Orchid.RevitFamily.FamilyParameter.Create(familyDocument=o_datastream_await_2, parameterName=code_block_7.out0, type=code_block_7.out1, group=code_block_7.out2)

# group: Set parameter
create = List.Create(item0=o_familyparameter_create_2, item1=o_familyparameter_create_3)
o_datastream_await_7 = Orchid.Common.DataStream.Await(pass=o_datastream_await_2, waitFor=create)
code_block_8 = CodeBlock()
# ---------- code_block_8.designscript (4 lines) ----------
//Parameter name
["Lookup Table Name","testKey"];
//Values
["CSVLookuptable","11x300"];
# ----------------------------------------
o_familyparameter_setvalue_2 = Orchid.RevitFamily.FamilyParameter.SetValue(familyDocument=o_datastream_await_7, parameterName=code_block_8.out0, value=code_block_8.out1)

# group: Add lookup table and use it by setting a formula
o_datastream_await_8 = Orchid.Common.DataStream.Await(pass=o_datastream_await_7, waitFor=o_familyparameter_setvalue_2)
string_2 = StringInput("%userprofile%\Programming\Testing\Data\CSVLookuptable.csv")  # graph input
o_familydocument_addlookuptable = Orchid.RevitFamily.FamilyDocument.AddLookupTable(familyDocument=o_datastream_await_8, file=string_2)
o_datastream_await_9 = Orchid.Common.DataStream.Await(pass=o_datastream_await_8, waitFor=o_familydocument_addlookuptable)
code_block_9 = CodeBlock()
# ---------- code_block_9.designscript (4 lines) ----------
//Parameter name
"testValue";
//Values
["size_lookup(Lookup Table Name, \"d\", 0, testKey)"];
# ----------------------------------------
string_3 = StringInput("size_lookup(Lookup Table Name, \"d\", 0, testKey)")  # graph input
o_formula_set = Orchid.RevitFamily.Formula.Set(familyDocument=o_datastream_await_9, parameterName=code_block_9.out0, value=string_3)

# group: Get nested family and converters
o_family_getnested = Orchid.RevitFamily.Family.GetNested(familyDocument=o_datastream_await_6)
o_object_torevittype_3 = Orchid.Common.Object.ToRevitType(object=o_family_getnested.Family)
o_object_todynamotype_2 = Orchid.Common.Object.ToDynamoType(object=o_object_torevittype_3)
watch_7 = Watch(o_object_todynamotype_2)
watch_8 = Watch(o_object_torevittype_3)
watch_9 = Watch(o_family_getnested.Family)
name_2 = Element.Name(element=o_object_todynamotype_2)
watch_10 = Watch(name_2)

# group: Has the parameter associated element
code_block_10 = CodeBlock()
# ---------- code_block_10.designscript (2 lines) ----------
//Parameter name
["Width","Height"];
# ----------------------------------------
o_familyparameter_hasassociated = Orchid.RevitFamily.FamilyParameter.HasAssociated(familyDocument=o_datastream_await_6, parameterName=code_block_10)
watch_11 = Watch(o_familyparameter_hasassociated)

# group: Get associated element and parameter
o_familydocument_getassociated = Orchid.RevitFamily.FamilyDocument.GetAssociated(familyDocument=o_datastream_await_6)
watch_12 = Watch(o_familydocument_getassociated.Element)
watch_13 = Watch(o_familydocument_getassociated.elementParameter)
watch_14 = Watch(o_familydocument_getassociated.Parameter)
code_block_11 = CodeBlock()  # same code as code_block_5
o_familyparameter_getassociated = Orchid.RevitFamily.FamilyParameter.GetAssociated(familyDocument=o_datastream_await_6, parameterName=code_block_11)
watch_15 = Watch(o_familyparameter_getassociated.elementParameter)
watch_16 = Watch(o_familyparameter_getassociated.Element)

# group: Deprecated converters
o_family_getnested_2 = Orchid.RevitFamily.Family.GetNested(familyDocument=o_datastream_await_6)
watch_17 = Watch(o_family_getnested_2.Family)
o_element_torevittype = Orchid.RevitProject.Elements.Element.ToRevitType(element=o_family_getnested_2.Family)
watch_18 = Watch(o_element_torevittype)
o_element_todynamotype = Orchid.RevitProject.Elements.Element.ToDynamoType(element=o_element_torevittype)
watch_19 = Watch(o_element_todynamotype)
name_3 = Element.Name(element=o_element_todynamotype)
watch_20 = Watch(name_3)

# group: Deprecated converters
o_familytype_getnested_2 = Orchid.RevitFamily.FamilyType.GetNested(familyDocument=o_datastream_await_6)
o_element_torevittype_2 = Orchid.RevitProject.Elements.Element.ToRevitType(element=o_familytype_getnested_2)
o_element_todynamotype_2 = Orchid.RevitProject.Elements.Element.ToDynamoType(element=o_element_torevittype_2)
watch_21 = Watch(o_element_todynamotype_2)
watch_22 = Watch(o_element_torevittype_2)
watch_23 = Watch(o_familytype_getnested_2)
name_4 = Element.Name(element=o_element_todynamotype_2)
watch_24 = Watch(name_4)
