# Dynamo graph NestedByCategory_R22.dyn "ByCategory" (Dynamo 2.12.1.8246)
# packages: Orchid 203.5.0.8348, Orchid 212.3.0.8352

code_block = CodeBlock { "Level Heads"; }
byName = Category.ByName(name=code_block)
o_family_getnestedbycategory = Orchid.RevitFamily.Family.GetNestedByCategory(category=byName)
watch = Watch(o_family_getnestedbycategory)
o_family_getnested = Orchid.RevitFamily.Family.GetNested()
watch_2 = Watch(o_family_getnested.Family)
watch_3 = Watch(o_family_getnested.Category)
