# Dynamo graph ReorderParameters_R21.dyn "ReorderParameters" (Dynamo 2.6.2.15705)
# packages: Orchid 206.6.0.5794

# group: Reorder parameters
code_block = CodeBlock()
# ---------- code_block.designscript (29 lines) ----------
// new order
[
// Graphics
"Sealing",
"Hinging",
"Above Cutplane",
// Materials and Finishes
"Case/Transom",
"Frame/Mullion",
"Glass",
"Embrasure",
"Sill Plate",
"Wall Surface",
// Dimensions
"Width",
"Height",
"Seal Width",
"Rebate Depth",
"Case Depth",
"Case Width",
"Rabbet Depth",
"Rabbet Width",
"Frame Depth",
"Frame Width",
"Glass Thickness",
"Default Sill Height",
"Rough Width",
"Rough Height"
];
# ----------------------------------------
o_familyparameter_byname = Orchid.RevitFamily.FamilyParameter.ByName(name=code_block)
o_familyparameter_reorder = Orchid.RevitFamily.FamilyParameter.Reorder(familyParameter=o_familyparameter_byname)

code_block_2 = CodeBlock()
# ---------- code_block_2.designscript (29 lines) ----------
// Orginal order
[
// Graphics
"Hinging",
"Above Cutplane",
"Sealing",
// Materials and Finishes
"Glass",
"Frame/Mullion",
"Case/Transom",
"Embrasure",
"Sill Plate",
"Wall Surface",
// Dimensions
"Width",
"Height",
"Rebate Depth",
"Seal Width",
"Case Depth",
"Case Width",
"Frame Depth",
"Frame Width",
"Rabbet Depth",
"Rabbet Width",
"Glass Thickness",
"Default Sill Height",
"Rough Width",
"Rough Height"
];
# ----------------------------------------
