# Dynamo graph SetGet_R21.dyn (Dynamo 2.6.2.15705)
# packages: Orchid 206.6.0.5794

directory_path = StringInput("%userprofile%\Programming\Testing\Data\testSet")  # graph input
string = StringInput("*.rfa")  # graph input
boolean = BoolSelector(false)  # graph input
o_directory_contents = Orchid.Common.Directory.Contents(directory=directory_path, searchString=string, deepSearch=boolean)
o_document_backgroundopen = Orchid.RevitProject.Common.Document.BackgroundOpen(file=o_directory_contents)
o_familytype_create = Orchid.RevitFamily.FamilyType.Create(familyDocument=o_document_backgroundopen)
o_datastream_await = Orchid.Common.DataStream.Await(pass=o_document_backgroundopen, waitFor=o_familytype_create)
o_familytype_indocument = Orchid.RevitFamily.FamilyType.InDocument(familyDocument=o_datastream_await)
o_familytype_name = Orchid.RevitFamily.FamilyType.Name(familyType=o_familytype_indocument)
code_block = CodeBlock()
# ---------- code_block.designscript (4 lines) ----------
//parameter name
"Model";
//value
"Testing";
# ----------------------------------------
o_familytype_indocument_2 = Orchid.RevitFamily.FamilyType.InDocument()  # frozen
o_familytype_current = Orchid.RevitFamily.FamilyType.Current()  # frozen
code_block_2 = CodeBlock()
# ---------- code_block_2.designscript (4 lines) ----------
//parameter name
["Model", "Description"];
//value
["Testing1", "Testing2"];
# ----------------------------------------
o_familyparameter_setvalue = Orchid.RevitFamily.FamilyParameter.SetValue(familyDocument=o_datastream_await, familyType=o_familytype_indocument, parameterName=code_block_2.out0, value=code_block_2.out1)
o_datastream_await_2 = Orchid.Common.DataStream.Await(pass=o_datastream_await, waitFor=o_familyparameter_setvalue)
o_familyparameter_getvalue = Orchid.RevitFamily.FamilyParameter.GetValue(familyDocument=o_datastream_await_2, familyType=o_familytype_indocument, parameterName=code_block_2.out0)
watch = Watch(o_familyparameter_getvalue.valueByParameter)
watch_2 = Watch(o_familyparameter_getvalue.valueByType)
name = FamilyParameter.Name(familyParameter=o_familyparameter_setvalue)
o_datastream_await_3 = Orchid.Common.DataStream.Await(pass=o_datastream_await_2, waitFor=o_familyparameter_getvalue.valueByType)
boolean_2 = BoolSelector(true)  # graph input
o_document_close = Orchid.RevitProject.Common.Document.Close(document=o_datastream_await_3, save=boolean_2)

# group: Cleanup backup files
o_datastream_await_4 = Orchid.Common.DataStream.Await(pass=directory_path, waitFor=o_document_close)
string_2 = StringInput("*.0001.rfa")  # graph input
boolean_3 = BoolSelector(true)  # graph input
o_directory_contents_2 = Orchid.Common.Directory.Contents(directory=o_datastream_await_4, searchString=string_2, deepSearch=boolean_3)
deleteFile = FileSystem.DeleteFile(path=o_directory_contents_2)
