# Dynamo graph IFCexportInBackground_R22.dyn "AutoIFCexport_R22" (Dynamo 2.12.1.8246)
# packages: Orchid 212.4.0.5794

# group: Open all project files in directory
# note: File: emptyProject
string = StringInput("%userprofile%\Programming\Testing\Data\testSet")  # graph input
code_block = CodeBlock { "*.rvt"; }
boolean = BoolSelector(false)  # graph input
o_directory_contents = Orchid.Common.Directory.Contents(directory=string, searchString=code_block, deepSearch=boolean)
o_document_backgroundopen = Orchid.RevitProject.Common.Document.BackgroundOpen(file=o_directory_contents)
o_family_load = Orchid.RevitProject.Elements.Family.Load(familyDocument=o_document_backgroundopen)
o_datastream_await = Orchid.Common.DataStream.Await(pass=o_document_backgroundopen, waitFor=o_family_load)
o_document_close = Orchid.RevitProject.Common.Document.Close(document=o_datastream_await)

# group: Place families in document
types = Family.Types(family=o_family_load)
flatten = List.Flatten(list=types)
count = List.Count(list=flatten)
code_block_2 = CodeBlock(num=count) { (1..num)*2500; }
byCoordinates = Point.ByCoordinates(x=code_block_2)
levels = Levels("Level 1")  # graph input
byPointAndLevel = FamilyInstance.ByPointAndLevel(familyType=flatten, point=byCoordinates, level=levels)

# group: IFC Export based on prebuild IFC setting and a view
o_document_current = Orchid.RevitProject.Common.Document.Current()
o_datastream_await_2 = Orchid.Common.DataStream.Await(pass=o_document_current, waitFor=byPointAndLevel)
o_ifc_settings = Setting("IFC 2x3 Coordination View 2.0")  # graph input
o_ifc_settingbyname = Orchid.IfcExport.IFC.SettingByName(name=o_ifc_settings)
views = Views("{3D}")  # graph input
o_ifc_export = Orchid.IfcExport.IFC.Export(document=o_datastream_await_2, setting=o_ifc_settingbyname, view=views)
