# Dynamo graph Apperance_R22.dyn "--Apperance_R22" (Dynamo 2.12.1.8246)
# packages: Orchid 212.4.0.5825

# group: Create appearance and material: Timber (C24)
code_block = CodeBlock { "_Timber C24"; "GenericSchema"; "HardwoodSchema"; }
o_material_create = Orchid.RevitMaterial.Material.Create(name=code_block.out0)
o_appearance_create = Orchid.RevitMaterial.Appearance.Create(name=code_block.out0, schema=code_block.out1)
o_material_setappearance = Orchid.RevitMaterial.Material.SetAppearance(material=o_material_create, appearance=o_appearance_create)
watch = Watch(o_material_setappearance)
name = Material.Name(material=o_material_setappearance)
watch_2 = Watch(name)

# group: All
o_appearance_indocument = Orchid.RevitMaterial.Appearance.InDocument()
watch_3 = Watch(o_appearance_indocument)
name_2 = Element.Name(element=o_appearance_indocument)
watch_4 = Watch(name_2)

# group: Duplicate
code_block_2 = CodeBlock { "Default Wall"; "_xx"; }
o_appearance_byname = Orchid.RevitMaterial.Appearance.ByName(name=code_block_2.out0)
o_appearance_duplicate = Orchid.RevitMaterial.Appearance.Duplicate(appearance=o_appearance_byname, name=code_block_2.out1)
watch_5 = Watch(o_appearance_duplicate)
o_appearances = Appearance("Default Wall")  # graph input

# group: Asset handling
o_asset_schema = AssetSchema("Concrete")
boolean = BoolSelector(false)
o_asset_byschema = Orchid.RevitMaterial.Visual.Asset.BySchema(schema=o_asset_schema, default=boolean)
code_block_3 = CodeBlock(t=o_asset_byschema) { "_test1"; t[0]; }
o_appearance_create_2 = Orchid.RevitMaterial.Appearance.Create(name=code_block_3.out0, asset=code_block_3.out1)
o_asset_category = Orchid.RevitMaterial.Visual.Asset.Category(asset=o_asset_byschema)
o_asset_bycategory = Orchid.RevitMaterial.Visual.Asset.ByCategory(category=o_asset_category)
code_block_4 = CodeBlock()
# ---------- code_block_4.designscript (36 lines) ----------
// Asset Schemas

// Ceramic
"CeramicSchema";
// Concrete
"ConcreteSchema";
// Generic
"GenericSchema";
// Glazing
"GlazingSchema";
// Layered
"PrismLayeredSchema";
// Masonry
"MasonryCMUSchema";
// Metal
"PrismMetalSchema";
// Metalic Paint
"MetallicPaintSchema";
// Mirror
"MirrorSchema";
// Opaque
"PrismOpaqueSchema";
// Plastic
"PlasticVinylSchema";
// Solid Glass
"SolidGlassSchema";
// Stone
"StoneSchema";
// Transparent
"PrismTransparentSchema";
// Wall Paint
"WallPaintSchema";
// Water
"WaterSchema";
// Wood
"HardwoodSchema";
# ----------------------------------------
o_asset_byschema_2 = Orchid.RevitMaterial.Visual.Asset.BySchema(schema=code_block_4.out0, default=boolean)
o_object_torevittype = Orchid.Common.Object.ToRevitType(object=o_asset_byschema_2)
o_object_toorchidtype = Orchid.Common.Object.ToOrchidType(object=o_object_torevittype)
watch_6 = Watch(o_object_toorchidtype)
watch_7 = Watch(o_object_torevittype)

# group: Material Appearance Asset
code_block_5 = CodeBlock { "Default"; "Copper - Brushed"; }
byName = Material.ByName(name=code_block_5.out0)
o_appearance_byname_2 = Orchid.RevitMaterial.Appearance.ByName(name=code_block_5.out1)
o_material_setappearance_2 = Orchid.RevitMaterial.Material.SetAppearance(material=byName, appearance=o_appearance_byname_2)
watch_8 = Watch(o_material_setappearance_2)

# group: Material Appearance: Timber (C24)
code_block_6 = CodeBlock { "_Timber C24"; }
o_appearance_byname_3 = Orchid.RevitMaterial.Appearance.ByName(name=code_block_6)
code_block_7 = CodeBlock()
# ---------- code_block_7.designscript (6 lines) ----------
// Description
"Hardwood material";
// Keyword
"pine,wood,interior,
furniture,materials,
hardwood";
# ----------------------------------------
o_appearance_setinformation = Orchid.RevitMaterial.Appearance.SetInformation(appearance=o_appearance_byname_3, description=code_block_7.out0, keyword=code_block_7.out1)
code_block_8 = CodeBlock { 145; 15; 65; }
byARGB = Color.ByARGB(red=code_block_8.out0, green=code_block_8.out1, blue=code_block_8.out2)
string = StringInput("%userprofile%\Programming\Testing\Data\Stone_3.bmp")  # graph input
o_file_frompath = Orchid.Common.File.FromPath(path=string)
o_texture_image = Orchid.RevitMaterial.Visual.Texture.Image(path=o_file_frompath)
code_block_9 = CodeBlock { 70; 50; true; }
o_texture_slider = Orchid.RevitMaterial.Visual.Texture.Slider(value=code_block_9.out1)
o_appearance_setgeneric = Orchid.RevitMaterial.Appearance.SetGeneric(appearance=o_appearance_setinformation, color=byARGB, texture=o_texture_image, imageFade=code_block_9.out0, glossiness=o_texture_slider, highlights=code_block_9.out2)
code_block_10 = CodeBlock { 40; }
o_appearance_setreflectivity = Orchid.RevitMaterial.Appearance.SetReflectivity(appearance=o_appearance_setgeneric, direct=code_block_10, oblique=code_block_10)
code_block_11 = CodeBlock { 35; 90; 15; 1.52; }
o_texture_slider_2 = Orchid.RevitMaterial.Visual.Texture.Slider(value=code_block_11.out2)
o_transparency_refraction = TransparencyRefraction("Alcohol")
o_appearance_settransparency = Orchid.RevitMaterial.Appearance.SetTransparency(appearance=o_appearance_setreflectivity, amount=code_block_11.out0, texture=o_texture_image, imageFade=code_block_11.out1, translucency=o_texture_slider_2, refraction=o_transparency_refraction)
o_appearance_setcutouts = Orchid.RevitMaterial.Appearance.SetCutouts(appearance=o_appearance_settransparency, texture=o_texture_image)
code_block_12 = CodeBlock { Color.ByARGB(255, 205, 135, 165); 10.0; 6500.0; }
o_texture_color = Orchid.RevitMaterial.Visual.Texture.Color(color=code_block_12.out0)
o_self_illumination_luminance = SelfIlluminationLuminance("Cell Phone Screen")
o_self_illumination_color = SelfIlluminationColorTemperatur("Moonlight")  # "o|Self Illumination Color Temperature"
o_appearance_setselfillumination = Orchid.RevitMaterial.Appearance.SetSelfIllumination(appearance=o_appearance_setcutouts, texture=o_texture_color, luminance=o_self_illumination_luminance, colorTemperature=o_self_illumination_color)
code_block_13 = CodeBlock { -500; }
o_texture_slider_3 = Orchid.RevitMaterial.Visual.Texture.Slider(value=code_block_13)
o_appearance_setbump = Orchid.RevitMaterial.Appearance.SetBump(appearance=o_appearance_setselfillumination, texture=o_texture_image, amount=o_texture_slider_3)
code_block_14 = CodeBlock { Color.ByARGB(255, 50, 115, 65); }
o_appearance_settint = Orchid.RevitMaterial.Appearance.SetTint(appearance=o_appearance_setbump, color=code_block_14)
