# Dynamo graph Graphics_R22.dyn "--Graphics_R22" (Dynamo 2.12.1.8246)
# packages: Orchid 212.4.0.5825

# group: Smoothness, Shininess
code_block = CodeBlock { "_test1"; }
o_material_create = Orchid.RevitMaterial.Material.Create(name=code_block)
code_block_2 = CodeBlock { 50; }
o_graphics_setshininess = Orchid.RevitMaterial.Graphics.SetShininess(material=o_material_create, shininess=code_block_2)
o_graphics_getshininess = Orchid.RevitMaterial.Graphics.GetShininess(material=o_graphics_setshininess)
watch = Watch(o_graphics_getshininess)
o_graphics_setsmoothness = Orchid.RevitMaterial.Graphics.SetSmoothness(material=o_material_create, smoothness=code_block_2)
o_graphics_getsmoothness = Orchid.RevitMaterial.Graphics.GetSmoothness(material=o_graphics_setsmoothness)
watch_2 = Watch(o_graphics_getsmoothness)

# group: Create, Get
code_block_3 = CodeBlock { "_test2"; }
o_material_create_2 = Orchid.RevitMaterial.Material.Create(name=code_block_3)
boolean = BoolSelector(false)  # graph input
code_block_4 = CodeBlock { DSCore.Color.ByARGB(255,25,60,30); 50; }
code_block_5 = CodeBlock { "Earth"; }
getByName = FillPatternElement.GetByName(name=code_block_5)
code_block_6 = CodeBlock { 45; 85; 65; }
byARGB = Color.ByARGB(red=code_block_6.out0, green=code_block_6.out1, blue=code_block_6.out2)
o_graphics_set = Orchid.RevitMaterial.Graphics.Set(material=o_material_create_2, useRenderAppearance=boolean, shadingColor=code_block_4.out0, transparency=code_block_4.out1, surfaceForegroundPattern=getByName, surfaceForegroundPatternColor=byARGB, cutBackgroundPattern=getByName, cutBackgroundPatternColor=byARGB)
o_graphics_get = Orchid.RevitMaterial.Graphics.Get(material=o_graphics_set)
watch_3 = Watch(o_graphics_get.Transparency)
watch_4 = Watch(o_graphics_get.cutForegroundPattern)
watch_5 = Watch(o_graphics_get.ShadingColor)
watch_6 = Watch(o_graphics_get.UseRenderAppearance)
watch_7 = Watch(o_material_create_2)
name = Material.Name(material=o_material_create_2)
watch_8 = Watch(name)
watch_9 = Watch(o_graphics_get.surfaceForegroundPattern)
watch_10 = Watch(o_graphics_get.cutForegroundPatternColor)
watch_11 = Watch(o_graphics_get.surfaceForegroundPatternColor)
watch_12 = Watch(o_graphics_get.surfaceBackgroundPattern)
watch_13 = Watch(o_graphics_get.surfaceBackgroundPatternColor)
watch_14 = Watch(o_graphics_get.cutBackgroundPattern)
watch_15 = Watch(o_graphics_get.cutBackgroundPatternColor)
fill_patterns = FillPatterns("Earth")  # graph input

# group: Create, Set Render Appearance, SetShadingColor, Set Transparency, Set Surface Pattern, Set Surface Pattern Color, Set Cut Pattern, Set Cut Pattern Color
code_block_7 = CodeBlock { "_test3"; }
o_material_create_3 = Orchid.RevitMaterial.Material.Create(name=code_block_7)
code_block_8 = CodeBlock { "Diagonal down 3.0mm"; }
getByName_2 = FillPatternElement.GetByName(name=code_block_8)
o_graphics = Orchid.RevitMaterial.Graphics.SetCutBackgroundPattern(material=o_material_create_3, pattern=getByName_2)
watch_16 = Watch(o_graphics)
code_block_9 = CodeBlock { 55; 125; 85; }
byARGB_2 = Color.ByARGB(red=code_block_9.out0, green=code_block_9.out1, blue=code_block_9.out2)
o_graphics_2 = Orchid.RevitMaterial.Graphics.SetCutBackgroundPatternColor(material=o_graphics, color=byARGB_2)
o_graphics_3 = Orchid.RevitMaterial.Graphics.GetCutBackgroundPatternColor(material=o_graphics_2)
watch_17 = Watch(o_graphics_3)
o_graphics_4 = Orchid.RevitMaterial.Graphics.SetSurfaceBackgroundPattern(material=o_material_create_3, pattern=getByName_2)
o_graphics_5 = Orchid.RevitMaterial.Graphics.SetSurfaceBackgroundPatternColor(material=o_graphics_4, color=byARGB_2)
o_graphics_6 = Orchid.RevitMaterial.Graphics.GetCutBackgroundPattern(material=o_graphics_5)
watch_18 = Watch(o_graphics_6)
watch_19 = Watch(o_graphics_4)
code_block_10 = CodeBlock { "Diagonal crosshatch 3.0mm"; }
getByName_3 = FillPatternElement.GetByName(name=code_block_10)
o_graphics_7 = Orchid.RevitMaterial.Graphics.SetCutForegroundPattern(material=o_material_create_3, pattern=getByName_3)
code_block_11 = CodeBlock { DSCore.Color.ByARGB(255,145,185,165); }
o_graphics_8 = Orchid.RevitMaterial.Graphics.SetCutForegroundPatternColor(material=o_graphics_7, color=code_block_11)
o_graphics_9 = Orchid.RevitMaterial.Graphics.GetCutForegroundPatternColor(material=o_graphics_8)
watch_20 = Watch(o_graphics_9)
o_graphics_10 = Orchid.RevitMaterial.Graphics.SetSurfaceForegroundPattern(material=o_material_create_3, pattern=getByName_3)
o_graphics_11 = Orchid.RevitMaterial.Graphics.SetSurfaceForegroundPatternColor(material=o_graphics_10, color=code_block_11)
o_graphics_12 = Orchid.RevitMaterial.Graphics.GetCutForegroundPattern(material=o_graphics_11)
watch_21 = Watch(o_graphics_12)
watch_22 = Watch(o_graphics_7)
watch_23 = Watch(o_graphics_10)
code_block_12 = CodeBlock { 75; }
o_graphics_settransparency = Orchid.RevitMaterial.Graphics.SetTransparency(material=o_material_create_3, transparency=code_block_12)
o_graphics_gettransparency = Orchid.RevitMaterial.Graphics.GetTransparency(material=o_graphics_settransparency)
watch_24 = Watch(o_graphics_gettransparency)
code_block_13 = CodeBlock { DSCore.Color.ByARGB(255,25,60,30); }
o_graphics_setshadingcolor = Orchid.RevitMaterial.Graphics.SetShadingColor(material=o_material_create_3, color=code_block_13)
o_graphics_getshadingcolor = Orchid.RevitMaterial.Graphics.GetShadingColor(material=o_graphics_setshadingcolor)
watch_25 = Watch(o_graphics_getshadingcolor)
boolean_2 = BoolSelector(false)  # graph input
o_graphics_setrenderappearance = Orchid.RevitMaterial.Graphics.SetRenderAppearance(material=o_material_create_3, useRenderAppearance=boolean_2)
o_graphics_getrenderappearance = Orchid.RevitMaterial.Graphics.GetRenderAppearance(material=o_graphics_setrenderappearance)
watch_26 = Watch(o_graphics_getrenderappearance)
watch_27 = Watch(o_material_create_3)
name_2 = Material.Name(material=o_material_create_3)
watch_28 = Watch(name_2)
