# Dynamo graph Material_R21.dyn (Dynamo 2.6.2.15705)
# packages: Orchid 206.6.0.5794

# group: Select
string = StringInput("Brick, Common")
byName = Material.ByName(name=string)
watch = Watch(byName)
o_materials = Material("Brick, Common")  # graph input
watch_2 = Watch(o_materials)

# group: Property parameter
o_material_propertyparameter = Orchid.RevitMaterial.Material.PropertyParameter(material=byName)
watch_3 = Watch(o_material_propertyparameter.AppearanceParameter)
watch_4 = Watch(o_material_propertyparameter.PhysicalParameter)
watch_5 = Watch(o_material_propertyparameter.ThermalParameter)
type = Object.Type(obj=o_material_propertyparameter.PhysicalParameter)

# group: Properties
code_block = CodeBlock(data=byName) { data; }
o_material_thermal = Orchid.RevitMaterial.Material.Thermal(material=code_block)
watch_6 = Watch(o_material_thermal)
o_material_physical = Orchid.RevitMaterial.Material.Physical(material=code_block)
watch_7 = Watch(o_material_physical)
o_material_appearance = Orchid.RevitMaterial.Material.Appearance(material=code_block)
watch_8 = Watch(o_material_appearance)

# group: All
o_material_indocument = Orchid.RevitMaterial.Material.InDocument()
watch_9 = Watch(o_material_indocument)
name = Material.Name(material=o_material_indocument)
watch_10 = Watch(name)

# group: Parameter
o_material_parameter = Orchid.RevitMaterial.Material.Parameter(material=byName)
watch_11 = Watch(o_material_parameter)
type_2 = Object.Type(obj=o_material_parameter)

# group: Properties
o_material_properties = Orchid.RevitMaterial.Material.Properties(material=byName)
watch_12 = Watch(o_material_properties.Thermal)
watch_13 = Watch(o_material_properties.Physical)
watch_14 = Watch(o_material_properties.Appearance)

# group: Class/Category
o_material_getcategory = Orchid.RevitMaterial.Material.GetCategory(material=byName)
watch_15 = Watch(o_material_getcategory)
o_material_getclass = Orchid.RevitMaterial.Material.GetClass(material=byName)
watch_16 = Watch(o_material_getclass)

# group: Set appearance
o_appearances = Appearance("Default")
string_2 = StringInput("Default Wall")
byName_2 = Material.ByName(name=string_2)
string_3 = StringInput("Copper - Brushed")
o_appearance_byname = Orchid.RevitMaterial.Appearance.ByName(name=string_3)
o_material_setappearance = Orchid.RevitMaterial.Material.SetAppearance(material=byName_2, appearance=o_appearance_byname)

# group: Set property set
string_4 = StringInput("Default Wall")
byName_3 = Material.ByName(name=string_4)
o_material_aspects = MaterialAspect("Physical (Structural)")
o_physical_propertyset = PhysicalPropertySet("Brick - Common 1800kg")
o_material_setphysical = Orchid.RevitMaterial.Material.SetPhysical(material=byName_3, aspect=o_material_aspects, propertySet=o_physical_propertyset)
o_material_aspects_2 = MaterialAspect("Thermal")
o_thermal_propertyset = ThermalPropertySet("Brick - Common")
o_material_setthermal = Orchid.RevitMaterial.Material.SetThermal(material=byName_3, aspect=o_material_aspects_2, propertySet=o_thermal_propertyset)
