# Dynamo graph Physical-Thermal-Gas_R22.dyn (Dynamo 2.12.1.8246)
# packages: Orchid 212.4.0.5825

# group: Create material: Oxygen
boolean = BoolSelector(true)  # graph input
code_block = CodeBlock { "_Oxygen"; }
o_physical_types = PhysicalType("Gas")  # graph input
o_physical_create = Orchid.RevitMaterial.Physical.Create(name=code_block, type=o_physical_types)
code_block_2 = CodeBlock()
# ---------- code_block_2.designscript (6 lines) ----------
"Oxygen, properties at atmospheric pressure";
"structural,gas";
"thermal,gas";
"Gas";
"Orchid generated";
"https://github.com/erfajo/OrchidForDynamo";
# ----------------------------------------
o_physical_setinformation = Orchid.RevitMaterial.Physical.SetInformation(propertySet=o_physical_create, description=code_block_2.out0, keywords=code_block_2.out1, subclass=code_block_2.out3, source=code_block_2.out4, sourceUrl=code_block_2.out5)
code_block_3 = CodeBlock { 500; }
o_physical_setbasicthermal = Orchid.RevitMaterial.Physical.SetBasicThermal(propertySet=o_physical_setinformation, expansionCoefficient=code_block_3)
code_block_4 = CodeBlock { 1.35; }
o_physical_setmechanical = Orchid.RevitMaterial.Physical.SetMechanical(propertySet=o_physical_setbasicthermal, density=code_block_4)
o_thermal_type = ThermalType("Gas")  # graph input
o_thermal_create = Orchid.RevitMaterial.Thermal.Create(name=code_block, type=o_thermal_type)
o_thermal_setinformation = Orchid.RevitMaterial.Thermal.SetInformation(propertySet=o_thermal_create, description=code_block_2.out0, keywords=code_block_2.out2, subclass=code_block_2.out3, source=code_block_2.out4, sourceUrl=code_block_2.out5)
code_block_5 = CodeBlock { 0.0242; 0.9118; 1.35; 0.01; 0; 1; }
o_thermal_setbasicthermal = Orchid.RevitMaterial.Thermal.SetBasicThermal(propertySet=o_thermal_setinformation, thermalConductivity=code_block_5.out0, specificHeat=code_block_5.out1, density=code_block_5.out2, emissivity=code_block_5.out3, gasViscosity=code_block_5.out4, compressibility=code_block_5.out5)
o_material_create = Orchid.RevitMaterial.Material.Create(name=code_block)
o_material_aspect = MaterialAspect("Thermal")  # graph input
o_material_setthermal = Orchid.RevitMaterial.Material.SetThermal(material=o_material_create, aspect=o_material_aspect, propertySet=o_thermal_setbasicthermal)
watch = Watch(o_material_setthermal)
name = Material.Name(material=o_material_setthermal)
watch_2 = Watch(name)
o_material_aspect_2 = MaterialAspect("Physical (Structural)")  # graph input
o_material_setphysical = Orchid.RevitMaterial.Material.SetPhysical(material=o_material_create, aspect=o_material_aspect_2, propertySet=o_physical_setmechanical)
watch_3 = Watch(o_material_setphysical)
name_2 = Material.Name(material=o_material_setphysical)
watch_4 = Watch(name_2)

o_physical_getdensity = Orchid.RevitMaterial.Physical.GetDensity(propertySet=o_physical_setmechanical)
watch_5 = Watch(o_physical_getdensity)
o_physical_getinformation = Orchid.RevitMaterial.Physical.GetInformation(propertySet=o_physical_setinformation)
watch_6 = Watch(o_physical_getinformation.SourceUrl)
watch_7 = Watch(o_physical_getinformation.Source)
watch_8 = Watch(o_physical_getinformation.Subclass)
watch_9 = Watch(o_physical_getinformation.Keywords)
watch_10 = Watch(o_physical_getinformation.Description)
o_thermal_getinformation = Orchid.RevitMaterial.Thermal.GetInformation(propertySet=o_thermal_setinformation)
watch_11 = Watch(o_thermal_getinformation.Subclass)
watch_12 = Watch(o_thermal_getinformation.Keywords)
watch_13 = Watch(o_thermal_getinformation.Description)
watch_14 = Watch(o_thermal_getinformation.Source)
watch_15 = Watch(o_thermal_getinformation.SourceUrl)
o_thermal_getbasicthermal = Orchid.RevitMaterial.Thermal.GetBasicThermal(propertySet=o_thermal_setbasicthermal)
watch_16 = Watch(o_thermal_getbasicthermal.Density)
watch_17 = Watch(o_thermal_getbasicthermal.Emissivity)
watch_18 = Watch(o_thermal_getbasicthermal.GasViscosity)
watch_19 = Watch(o_thermal_getbasicthermal.SpecificHeat)
watch_20 = Watch(o_thermal_getbasicthermal.ThermalConductivity)
o_physical = Orchid.RevitMaterial.Physical.GetExpansionCoefficient(propertySet=o_physical_setbasicthermal)
watch_21 = Watch(o_physical.ExpansionCoefficient2)
watch_22 = Watch(o_physical.ExpansionCoefficient1)
watch_23 = Watch(o_physical.ExpansionCoefficientZ)
watch_24 = Watch(o_physical.ExpansionCoefficientY)
watch_25 = Watch(o_physical.ExpansionCoefficientX)
watch_26 = Watch(o_physical.ExpansionCoefficient)
watch_27 = Watch(o_thermal_getbasicthermal.Compressibility)
