# Dynamo graph Physical-Thermal-Generic_R21.dyn (Dynamo 2.6.2.15705)
# packages: Orchid 206.6.0.5794

# group: Create material: Timber (C24)
code_block = CodeBlock { "_Timber C24"; }
o_material_create = Orchid.RevitMaterial.Material.Create(name=code_block)
o_material_aspect = MaterialAspect("Thermal")  # graph input
o_thermal_type = ThermalType("Solid")  # graph input
o_thermal_create = Orchid.RevitMaterial.Thermal.Create(name=code_block, type=o_thermal_type)
code_block_2 = CodeBlock()
# ---------- code_block_2.designscript (6 lines) ----------
"Strength Class C24 Timber";
"Eurocode,Structural,structural,wood,CC:EN 338";
"Wood,thermal,solid";
"Wood";
"Orchid generated";
"https://github.com/erfajo/OrchidForDynamo";
# ----------------------------------------
o_thermal_setinformation = Orchid.RevitMaterial.Thermal.SetInformation(propertySet=o_thermal_create, description=code_block_2.out0, keywords=code_block_2.out2, subclass=code_block_2.out3, source=code_block_2.out4, sourceUrl=code_block_2.out5)
boolean = BoolSelector(false)  # graph input
o_physical_behavior = PhysicalBehavior("Orthotropic")  # graph input
code_block_3 = CodeBlock { 0.12; 0.19; 496; 0.85; 0; 0.01; 0; 10000000; }
o_thermal_setproperties = Orchid.RevitMaterial.Thermal.SetProperties(propertySet=o_thermal_setinformation, transmitsLight=boolean, behavior=o_physical_behavior, thermalConductivity=code_block_3.out0, specificHeat=code_block_3.out1, density=code_block_3.out2, emissivity=code_block_3.out3, permeability=code_block_3.out4, porosity=code_block_3.out5, reflectivity=code_block_3.out6, electricalResistivity=code_block_3.out7)
o_material_setthermal = Orchid.RevitMaterial.Material.SetThermal(material=o_material_create, aspect=o_material_aspect, propertySet=o_thermal_setproperties)
watch = Watch(o_material_setthermal)
name = Material.Name(material=o_material_setthermal)
watch_2 = Watch(name)
o_material_aspect_2 = MaterialAspect("Physical (Structural)")  # graph input
o_physical_types = PhysicalType("Wood")  # graph input
o_physical_create = Orchid.RevitMaterial.Physical.Create(name=code_block, type=o_physical_types)
o_physical_setinformation = Orchid.RevitMaterial.Physical.SetInformation(propertySet=o_physical_create, description=code_block_2.out0, keywords=code_block_2.out1, subclass=code_block_2.out3, source=code_block_2.out4, sourceUrl=code_block_2.out5)
o_physical_behavior_2 = PhysicalBehavior("Orthotropic")  # graph input
o_physical_setbehavior = Orchid.RevitMaterial.Physical.SetBehavior(propertySet=o_physical_setinformation, behavior=o_physical_behavior_2)
code_block_4 = CodeBlock { 0.00004; }
o_physical_setbasicthermal = Orchid.RevitMaterial.Physical.SetBasicThermal(propertySet=o_physical_setbehavior, expansionCoefficient=code_block_4)
code_block_5 = CodeBlock { 11000; 0.38; 690; 420; }
o_physical_setmechanical = Orchid.RevitMaterial.Physical.SetMechanical(propertySet=o_physical_setbasicthermal, youngModulus=code_block_5.out0, poissonRatio=code_block_5.out1, shearModulus=code_block_5.out2, density=code_block_5.out3)
code_block_6 = CodeBlock { "Multiple"; "C24"; 24; 21; 2.5; 4; 14; 0.5; 11000; }
o_wood_construction = WoodConstruction("Natural")  # graph input
o_physical_setstrengthextended = Orchid.RevitMaterial.Physical.SetStrengthExtended(propertySet=o_physical_setmechanical, species=code_block_6.out0, grade=code_block_6.out1, bending=code_block_6.out2, parallelCompression=code_block_6.out3, perpendicularCompression=code_block_6.out4, parallelShear=code_block_6.out5, tensionParallel=code_block_6.out6, tensionPerpendicular=code_block_6.out7, averageModulus=code_block_6.out8, construction=o_wood_construction)
o_material_setphysical = Orchid.RevitMaterial.Material.SetPhysical(material=o_material_create, aspect=o_material_aspect_2, propertySet=o_physical_setstrengthextended)
watch_3 = Watch(o_material_setphysical)
name_2 = Material.Name(material=o_material_setphysical)
watch_4 = Watch(name_2)
boolean_2 = BoolSelector(true)  # graph input

# group: Duplicate --> Thermal Asset
o_thermal_propertyset = ThermalPropertySet("Brick - Common")  # graph input
code_block_7 = CodeBlock { "_xx (thermal)"; }
o_thermal_duplicate = Orchid.RevitMaterial.Thermal.Duplicate(propertySet=o_thermal_propertyset, name=code_block_7)
watch_5 = Watch(o_thermal_duplicate)

# group: Duplicate --> Physical Asset
o_physical_propertyset = PhysicalPropertySet("Brick - Common 1800kg")  # graph input
code_block_8 = CodeBlock { "_xx (physical)"; }
o_physical_duplicate = Orchid.RevitMaterial.Physical.Duplicate(propertySet=o_physical_propertyset, name=code_block_8)
watch_6 = Watch(o_physical_duplicate)

# group: All --> Physical Asset
o_physical_indocument = Orchid.RevitMaterial.Physical.InDocument()
watch_7 = Watch(o_physical_indocument)
name_3 = Element.Name(element=o_physical_indocument)
watch_8 = Watch(name_3)

# group: All --> Thermal Asset
o_thermal_indocument = Orchid.RevitMaterial.Thermal.InDocument()
watch_9 = Watch(o_thermal_indocument)
name_4 = Element.Name(element=o_thermal_indocument)
watch_10 = Watch(name_4)
