# Dynamo graph Physical-Thermal-Steel_R22.dyn (Dynamo 2.12.1.8246)
# packages: Orchid 212.4.0.5825

# group: Create material: Steel (S275)
code_block = CodeBlock { "_Steel S275"; }
o_physical_types = PhysicalType("Metal")  # graph input
o_physical_create = Orchid.RevitMaterial.Physical.Create(name=code_block, type=o_physical_types)
code_block_2 = CodeBlock()
# ---------- code_block_2.designscript (6 lines) ----------
"Steel, S275 (EN 10025-2)";
"1.0044,structural,metal,CC:EN 10025";
"thermal,solid";
"Steel";
"Orchid generated";
"https://github.com/erfajo/OrchidForDynamo";
# ----------------------------------------
o_physical_setinformation = Orchid.RevitMaterial.Physical.SetInformation(propertySet=o_physical_create, description=code_block_2.out0, keywords=code_block_2.out1, subclass=code_block_2.out3, source=code_block_2.out4, sourceUrl=code_block_2.out5)
o_physical_behavior = PhysicalBehavior("Isotropic")  # graph input
o_physical_setbehavior = Orchid.RevitMaterial.Physical.SetBehavior(propertySet=o_physical_setinformation, behavior=o_physical_behavior)
boolean = BoolSelector(true)  # graph input
code_block_3 = CodeBlock { 0.00001; }
o_physical_setbasicthermal = Orchid.RevitMaterial.Physical.SetBasicThermal(propertySet=o_physical_setbehavior, expansionCoefficient=code_block_3)
code_block_4 = CodeBlock { 205000; 0.3; 80000; 7850; }
o_physical_setmechanical = Orchid.RevitMaterial.Physical.SetMechanical(propertySet=o_physical_setbasicthermal, youngModulus=code_block_4.out0, poissonRatio=code_block_4.out1, shearModulus=code_block_4.out2, density=code_block_4.out3)
code_block_5 = CodeBlock { 275; 430; }
boolean_2 = BoolSelector(false)  # graph input
o_physical_setstrength = Orchid.RevitMaterial.Physical.SetStrength(propertySet=o_physical_setmechanical, yieldStress=code_block_5.out0, tensileStrength=code_block_5.out1, thermalTreated=boolean_2)
o_thermal_type = ThermalType("Solid")  # graph input
o_thermal_create = Orchid.RevitMaterial.Thermal.Create(name=code_block, type=o_thermal_type)
o_thermal_setinformation = Orchid.RevitMaterial.Thermal.SetInformation(propertySet=o_thermal_create, description=code_block_2.out0, keywords=code_block_2.out2, subclass=code_block_2.out3, source=code_block_2.out4, sourceUrl=code_block_2.out5)
boolean_3 = BoolSelector(false)  # graph input
o_physical_behavior_2 = PhysicalBehavior("Isotropic")  # graph input
code_block_6 = CodeBlock { 45; 0.48; 7850; 0.4; 0; 0.01; 0; 0; }
o_thermal_setproperties = Orchid.RevitMaterial.Thermal.SetProperties(propertySet=o_thermal_setinformation, transmitsLight=boolean_3, behavior=o_physical_behavior_2, thermalConductivity=code_block_6.out0, specificHeat=code_block_6.out1, density=code_block_6.out2, emissivity=code_block_6.out3, permeability=code_block_6.out4, porosity=code_block_6.out5, reflectivity=code_block_6.out6, electricalResistivity=code_block_6.out7)
o_material_create = Orchid.RevitMaterial.Material.Create(name=code_block)
o_material_aspect = MaterialAspect("Thermal")  # graph input
o_material_setthermal = Orchid.RevitMaterial.Material.SetThermal(material=o_material_create, aspect=o_material_aspect, propertySet=o_thermal_setproperties)
watch = Watch(o_material_setthermal)
name = Material.Name(material=o_material_setthermal)
watch_2 = Watch(name)
o_material_aspect_2 = MaterialAspect("Physical (Structural)")  # graph input
o_material_setphysical = Orchid.RevitMaterial.Material.SetPhysical(material=o_material_create, aspect=o_material_aspect_2, propertySet=o_physical_setstrength)
watch_3 = Watch(o_material_setphysical)
name_2 = Material.Name(material=o_material_setphysical)
watch_4 = Watch(name_2)

o_physical_getinformation = Orchid.RevitMaterial.Physical.GetInformation(propertySet=o_physical_setinformation)
watch_5 = Watch(o_physical_getinformation.Subclass)
watch_6 = Watch(o_physical_getinformation.Source)
watch_7 = Watch(o_physical_getinformation.SourceUrl)
watch_8 = Watch(o_physical_getinformation.Keywords)
watch_9 = Watch(o_physical_getinformation.Description)
o_physical_getbehavior = Orchid.RevitMaterial.Physical.GetBehavior(propertySet=o_physical_setbehavior)
watch_10 = Watch(o_physical_getbehavior)
o_physical_getyoungmodulus = Orchid.RevitMaterial.Physical.GetYoungModulus(propertySet=o_physical_setmechanical)
watch_11 = Watch(o_physical_getyoungmodulus.YoungModulusY)
watch_12 = Watch(o_physical_getyoungmodulus.YoungModulusZ)
watch_13 = Watch(o_physical_getyoungmodulus.YoungModulus1)
watch_14 = Watch(o_physical_getyoungmodulus.YoungModulusX)
watch_15 = Watch(o_physical_getyoungmodulus.YoungModulus2)
o_physical = Orchid.RevitMaterial.Physical.GetExpansionCoefficient(propertySet=o_physical_setbasicthermal)
watch_16 = Watch(o_physical.ExpansionCoefficientX)
watch_17 = Watch(o_physical.ExpansionCoefficientY)
watch_18 = Watch(o_physical.ExpansionCoefficientZ)
watch_19 = Watch(o_physical.ExpansionCoefficient1)
watch_20 = Watch(o_physical.ExpansionCoefficient2)
watch_21 = Watch(o_physical_getyoungmodulus.YoungModulus)
watch_22 = Watch(o_physical.ExpansionCoefficient)
o_physical_getstrength = Orchid.RevitMaterial.Physical.GetStrength(propertySet=o_physical_setstrength)
watch_23 = Watch(o_physical_getstrength.ThermalTreated)
watch_24 = Watch(o_physical_getstrength.TensileStrength)
watch_25 = Watch(o_physical_getstrength.YieldStress)
o_thermal_getinformation = Orchid.RevitMaterial.Thermal.GetInformation(propertySet=o_thermal_setinformation)
watch_26 = Watch(o_thermal_getinformation.SourceUrl)
watch_27 = Watch(o_thermal_getinformation.Source)
watch_28 = Watch(o_thermal_getinformation.Subclass)
watch_29 = Watch(o_thermal_getinformation.Keywords)
watch_30 = Watch(o_thermal_getinformation.Description)
o_thermal_getproperties = Orchid.RevitMaterial.Thermal.GetProperties(propertySet=o_thermal_setproperties)
watch_31 = Watch(o_thermal_getproperties.ThermalConductivity)
watch_32 = Watch(o_thermal_getproperties.SpecificHeat)
watch_33 = Watch(o_thermal_getproperties.Density)
watch_34 = Watch(o_thermal_getproperties.Behavior)
watch_35 = Watch(o_thermal_getproperties.TransmitsLight)
watch_36 = Watch(o_thermal_getproperties.ElectricalResistivity)
watch_37 = Watch(o_thermal_getproperties.Reflectivity)
watch_38 = Watch(o_thermal_getproperties.Porosity)
watch_39 = Watch(o_thermal_getproperties.Permeability)
watch_40 = Watch(o_thermal_getproperties.Emissivity)
o_physical_getshearmodulus = Orchid.RevitMaterial.Physical.GetShearModulus(propertySet=o_physical_setmechanical)
watch_41 = Watch(o_physical_getshearmodulus.ShearModulusX)
watch_42 = Watch(o_physical_getshearmodulus.ShearModulusY)
watch_43 = Watch(o_physical_getshearmodulus.ShearModulus)
o_physical_getpoissonratio = Orchid.RevitMaterial.Physical.GetPoissonRatio(propertySet=o_physical_setmechanical)
watch_44 = Watch(o_physical_getpoissonratio.PoissonRatioX)
watch_45 = Watch(o_physical_getpoissonratio.PoissonRatioY)
watch_46 = Watch(o_physical_getshearmodulus.ShearModulusZ)
watch_47 = Watch(o_physical_getshearmodulus.ShearModulus12)
watch_48 = Watch(o_physical_getpoissonratio.PoissonRatioZ)
watch_49 = Watch(o_physical_getpoissonratio.PoissonRatio12)
watch_50 = Watch(o_physical_getpoissonratio.PoissonRatio23)
watch_51 = Watch(o_physical_getpoissonratio.PoissonRatio)
