# Dynamo graph BulkLoadFamily_R22.dyn (Dynamo 2.12.1.8246)
# packages: Orchid 212.4.0.5794

directory_path = StringInput("%userprofile%\Programming\Testing\Data\testSet")  # graph input
string = StringInput("*.rvt")  # graph input
boolean = BoolSelector(false)  # graph input
o_directory_contents = Orchid.Common.Directory.Contents(directory=directory_path, searchString=string, deepSearch=boolean)
o_document_backgroundopen = Orchid.RevitProject.Common.Document.BackgroundOpen(file=o_directory_contents)
# note: File: defaultProject
directory_path_2 = StringInput("%userprofile%\Programming\Testing\Data\testSet")  # graph input
string_2 = StringInput("*.rfa")  # graph input
boolean_2 = BoolSelector(false)  # graph input
o_directory_contents_2 = Orchid.Common.Directory.Contents(directory=directory_path_2, searchString=string_2, deepSearch=boolean_2)
o_document_loadfamily = Orchid.RevitProject.Common.Document.LoadFamily(document=o_document_backgroundopen, familyFile=o_directory_contents_2)
watch = Watch(o_document_loadfamily)
boolean_3 = BoolSelector(true)
o_document_close = Orchid.RevitProject.Common.Document.Close(document=o_document_loadfamily, save=boolean_3)
