# Dynamo graph Collect families in project_R21.dyn (Dynamo 2.6.2.15705)
# packages: Orchid 206.6.0.5794

# group: Close files
o_datastream_await = Orchid.Common.DataStream.Await()  # unwired: pass, waitFor
boolean = BoolSelector(true)  # graph input
o_document_close = Orchid.RevitProject.Common.Document.Close(document=o_datastream_await, save=boolean)  # frozen

# group: Collect family as document from current document
code_block = CodeBlock { ["Doors","Windows"]; }
byName = Category.ByName(name=code_block)
o_element_bycategory = Orchid.RevitProject.Elements.Element.ByCategory(category=byName)
elementType = Element.ElementType(element=o_element_bycategory.Element)
uniqueItems = List.UniqueItems(list=elementType, lacing=Longest)
flatten = List.Flatten(list=uniqueItems)
family = FamilyType.Family(familyType=flatten)

uniqueItems_2 = List.UniqueItems(list=family)

# group (continued): Collect family as document from current document
o_family_edit = Orchid.RevitProject.Elements.Family.Edit(family=uniqueItems_2)

code_block_2 = CodeBlock()
# ---------- code_block_2.designscript (10 lines) ----------
//Parameter name
"Creator Build";
//SP Parameter group
"Sheet & Project";
//Parameter group
"PG_ADSK_MODEL_PROPERTIES";
//Instances
true;
//Reporting
false;
# ----------------------------------------
o_sharedparameter_add = Orchid.RevitFamily.SharedParameter.Add(familyDocument=o_family_edit, parameterName=code_block_2.out0, groupName=code_block_2.out1, group=code_block_2.out2, instance=code_block_2.out3)

# group: load back into the current project
o_datastream_await_2 = Orchid.Common.DataStream.Await(pass=o_family_edit, waitFor=o_sharedparameter_add)
o_family_load = Orchid.RevitProject.Elements.Family.Load(familyDocument=o_datastream_await_2)
o_datastream_await_3 = Orchid.Common.DataStream.Await(pass=o_datastream_await_2, waitFor=o_family_load)
o_document_close_2 = Orchid.RevitProject.Common.Document.Close(document=o_datastream_await_3)

# group: Open all files in directory and sub directories
string = StringInput("%userprofile%\Programming\Testing\Data\testSet")  # graph input
code_block_3 = CodeBlock { "*.rfa"; true; }
o_directory_contents = Orchid.Common.Directory.Contents(directory=string, searchString=code_block_3.out0)  # frozen
o_document_backgroundopen = Orchid.RevitProject.Common.Document.BackgroundOpen(file=o_directory_contents)
