# Dynamo graph DefaultTemplateTypes_R22.dyn (Dynamo 2.12.1.8246)
# packages: Orchid 212.4.0.5823

# group: Rename existing ViewTemplate
o_viewtemplate_indocument = Orchid.RevitProject.Views.ViewTemplate.InDocument()
name = Element.Name(element=o_viewtemplate_indocument.ViewTemplate)
code_block = CodeBlock(name=name) { "_dummy_" + name; }
o_element_setname = Orchid.RevitProject.Elements.Element.SetName(element=o_viewtemplate_indocument.ViewTemplate, name=code_block)

# group: Rename existing ViewFamilyType and Attribute
o_attribute_indocument = Orchid.RevitProject.Common.Attribute.InDocument()
code_block_2 = CodeBlock(name=o_attribute_indocument.FamilyName) { !DSCore.String.Contains(name,"Tag"); }
filterByBoolMask = List.FilterByBoolMask(list=o_attribute_indocument.ElementType, mask=code_block_2)
o_viewfamilytype_indocument = Orchid.RevitProject.Views.ViewFamilyType.InDocument()
join = List.Join(list0=filterByBoolMask.in, list1=o_viewfamilytype_indocument.ViewFamilyType)
name_2 = Element.Name(element=join)
code_block_3 = CodeBlock(name=name_2) { "_dummy_" + name; }
o_element_setname_2 = Orchid.RevitProject.Elements.Element.SetName(element=join, name=code_block_3)
o_datastream_await = Orchid.Common.DataStream.Await(pass=o_element_setname, waitFor=o_element_setname_2)

# group: Get default template
code_block_4 = CodeBlock()
# ---------- code_block_4.designscript (6 lines) ----------
path = "C:\\ProgramData\\Autodesk\\RVT ";
bygn = "\\Templates\\DTU\\DTU Building.rte";
syst = "\\Templates\\DTU\\DTU Systems.rte";
format =  Orchid.AdeskApp.Revit.Format;
path + format + bygn;
path + format + syst;
# ----------------------------------------
o_document_backgroundopen = Orchid.RevitProject.Common.Document.BackgroundOpen(file=code_block_4.out4)
o_datastream_await_2 = Orchid.Common.DataStream.Await(pass=o_document_backgroundopen, waitFor=o_datastream_await)

# group: Transfer default ViewTemplate
o_viewtemplate_indocument_2 = Orchid.RevitProject.Views.ViewTemplate.InDocument(document=o_datastream_await_2)
o_document_copyelement = Orchid.RevitProject.Common.Document.CopyElement(source=o_datastream_await_2, element=o_viewtemplate_indocument_2.ViewTemplate)
o_datastream_await_3 = Orchid.Common.DataStream.Await(pass=o_datastream_await_2, waitFor=o_document_copyelement)

# group: Transfer default ViewFamilyType
o_viewfamilytype_indocument_2 = Orchid.RevitProject.Views.ViewFamilyType.InDocument(document=o_datastream_await_3)
code_block_5 = CodeBlock { true; }
o_document_transferbyelementtype = Orchid.RevitProject.Common.Document.TransferByElementType(source=o_datastream_await_3, elementType=o_viewfamilytype_indocument_2.ViewFamilyType, append=code_block_5)
o_datastream_await_4 = Orchid.Common.DataStream.Await(pass=o_datastream_await_3, waitFor=o_document_transferbyelementtype)

code_block_6 = CodeBlock { "View Template applied to new views"; }
o_parameter_byname = Orchid.RevitProject.Parameters.Parameter.ByName(element=o_document_transferbyelementtype, name=code_block_6)
o_parameter_byname_2 = Orchid.RevitProject.Parameters.Parameter.ByName(element=o_viewfamilytype_indocument_2.ViewFamilyType, name=code_block_6)
o_parameter_getvalue = Orchid.RevitProject.Parameters.Parameter.GetValue(parameter=o_parameter_byname_2)
name_3 = Element.Name(element=o_parameter_getvalue)
o_viewtemplate_byname = Orchid.RevitProject.Views.ViewTemplate.ByName(name=name_3)
o_parameter_setvalue = Orchid.RevitProject.Parameters.Parameter.SetValue(parameter=o_parameter_byname, value=o_viewtemplate_byname)

# group: Transfer default Attribute
o_attribute_indocument_2 = Orchid.RevitProject.Common.Attribute.InDocument(document=o_datastream_await_4)
code_block_7 = CodeBlock(name=o_attribute_indocument_2.FamilyName) { !DSCore.String.Contains(name,"Tag"); }
filterByBoolMask_2 = List.FilterByBoolMask(list=o_attribute_indocument_2.ElementType, mask=code_block_7)
code_block_8 = CodeBlock { true; }
o_document_transferbyelementtype_2 = Orchid.RevitProject.Common.Document.TransferByElementType(source=o_datastream_await_4, elementType=filterByBoolMask_2.in, append=code_block_8)

# group: Close default Template
o_datastream_await_5 = Orchid.Common.DataStream.Await(pass=o_datastream_await_4, waitFor=o_parameter_setvalue)
o_datastream_await_6 = Orchid.Common.DataStream.Await(pass=o_datastream_await_5, waitFor=o_document_transferbyelementtype_2)
o_document_close = Orchid.RevitProject.Common.Document.Close(document=o_datastream_await_6)

# group: Purge ViewTemplate
current = Document.Current()  # frozen
o_viewtemplate_purge = Orchid.RevitProject.Views.ViewTemplate.Purge(document=current)
o_datastream_await_7 = Orchid.Common.DataStream.Await(waitFor=o_viewtemplate_purge)  # unwired: pass
