# Dynamo graph Document_R22.dyn (Dynamo 2.12.1.8246)
# packages: Orchid 206.6.0.5794

# group: All background open documents
o_document_opened = Orchid.RevitProject.Common.Document.Opened()
directory_path = StringInput("%userprofile%\Programming\Testing\Data\testSet")  # graph input
string = StringInput("*.rfa")  # graph input
boolean = BoolSelector(false)  # graph input
o_directory_contents = Orchid.Common.Directory.Contents(directory=directory_path, searchString=string, deepSearch=boolean)
o_document_backgroundopen = Orchid.RevitProject.Common.Document.BackgroundOpen(file=o_directory_contents)
o_datastream_await = Orchid.Common.DataStream.Await(pass=o_document_opened, waitFor=o_document_backgroundopen)
o_document_name = Orchid.RevitProject.Common.Document.Name(document=o_datastream_await)
watch = Watch(o_document_name)
watch_2 = Watch(o_datastream_await)

# group: Convert document
# note: File: defaultProject
current = Document.Current()
o_object_torevittype = Orchid.Common.Object.ToRevitType(object=current)
o_object_todynamotype = Orchid.Common.Object.ToDynamoType(object=o_object_torevittype)
watch_3 = Watch(o_object_todynamotype)
watch_4 = Watch(o_object_torevittype)

# group: Does document contain category?
categories = Categories("OST_MEPSpaces")  # graph input
code_block = CodeBlock()
# ---------- code_block.designscript (4 lines) ----------
// Categories to verify
["Areas","Rooms","Spaces"];
"Levels";
"Stairs";
# ----------------------------------------
byName = Category.ByName(name=code_block.out0)
o_document_containcategory = Orchid.RevitProject.Common.Document.ContainCategory(category=byName)
watch_5 = Watch(o_document_containcategory)

# group: Does document contain type?
code_block_2 = CodeBlock()
# ---------- code_block_2.designscript (4 lines) ----------
// Types to verify
["Area","Room","Space"];
"Level";
"Stairs";
# ----------------------------------------
o_document_containtype = Orchid.RevitProject.Common.Document.ContainType(type=code_block_2.out0)
watch_6 = Watch(o_document_containtype)
element_types = ElementTypes("Space")  # graph input

# group: Deprecated converter
current_2 = Document.Current()
o_document_torevittype = Orchid.RevitProject.Common.Document.ToRevitType(document=current_2)
watch_7 = Watch(o_document_torevittype)
o_document_todynamotype = Orchid.RevitProject.Common.Document.ToDynamoType(document=o_document_torevittype)
watch_8 = Watch(o_document_todynamotype)
