# Dynamo graph ExportDWGfromView_R22.dyn (Dynamo 2.12.1.8246)
# packages: Orchid 212.4.0.5803, Orchid 2.12.5.5987

# group: Get view by name in model
code_block = CodeBlock { "ViewType"; "FloorPlan"; }
o_revit_enumbyname = Orchid.AdeskApp.Revit.EnumByName(enumType=code_block.out0, valueName=code_block.out1)
o_view_byviewtype = Orchid.RevitProject.Views.View.ByViewType(viewType=o_revit_enumbyname)
name = Element.Name(element=o_view_byviewtype)
code_block_2 = CodeBlock()
# ---------- code_block_2.designscript (2 lines) ----------
// View to find
"DTU_Export DWG";
# ----------------------------------------
boolean = BoolSelector(true)
o_string_contains = Orchid.Common.String.Contains(string=name, searchFor=code_block_2, ignoreCase=boolean)
filterByBoolMask = List.FilterByBoolMask(list=o_view_byviewtype, mask=o_string_contains)

# group: Path
o_document_current = Orchid.RevitProject.Common.Document.Current()
o_document_path = Orchid.RevitProject.Common.Document.Path(document=o_document_current)
directoryName = FileSystem.DirectoryName(path=o_document_path)
name_2 = Element.Name(element=filterByBoolMask.in)
code_block_3 = CodeBlock(a=directoryName, b=name_2) { a+"\\"+b; }
boolean_2 = BoolSelector(false)
fileName = FileSystem.FileName(path=o_document_path, withExtension=boolean_2)
code_block_4 = CodeBlock(a=directoryName, b=fileName) { a+"\\XREF\\"+b; }

# group: Set "IBB 2000" export settings
code_block_5 = CodeBlock()
# ---------- code_block_5.designscript (19 lines) ----------
"IBB 2000";

// merge files into one?
true;

// filepaths
path1 = "C:\\ProgramData\\Autodesk\\RVT ";
path2 = "\\Libraries\\DanEDU\\Generic Project\\";
layer = "DanEDU Exportlayers Arkitekt.txt";
lines = "DanEDU Linetypes.lin";
format =  Orchid.AdeskApp.Revit.Format;
layerMapping = path1 + format + path2 + layer;
lineTypes =path1 + format + path2 + lines;

// export using shared coordinates
true;

// preserve coincident lines
true;
# ----------------------------------------
o_exportoption_createacadoption = Orchid.RevitProject.Common.ExportOption.CreateAcadOption(name=code_block_5.out0, layerMapping=code_block_5.layerMapping)
o_exportoption = Orchid.RevitProject.Common.ExportOption.AcadOptionSettings(option=o_exportoption_createacadoption, linetypesFile=code_block_5.lineTypes)
o_exportoption_acadoptiongenerel = Orchid.RevitProject.Common.ExportOption.AcadOptionGenerel(option=o_exportoption)  # frozen

# group: DWG
boolean_3 = BoolSelector(true)
o_document_exportdwg = Orchid.RevitProject.Common.Document.ExportDWG(document=o_document_current, option=o_exportoption, view=filterByBoolMask.in, file=code_block_4, overwrite=boolean_3)

# group: Delete "BIPS 2005" export settings
o_exportoption_acadoptions = Orchid.RevitProject.Common.ExportOption.AcadOptions()  # frozen
code_block_6 = CodeBlock(option=o_exportoption_acadoptions) { name = Revit.Element.Name(option); name == "BIPS 2005"; }
filterByBoolMask_2 = List.FilterByBoolMask(list=o_exportoption_acadoptions, mask=code_block_6.out1)
o_element_delete = Orchid.RevitProject.Elements.Element.Delete(element=filterByBoolMask_2.in)
