# Dynamo graph Filter_R22.dyn (Dynamo 2.12.1.8246)
# packages: Orchid 212.4.0.5812

# group: Orchid -> Filter rule for (element) parameters
code_block = CodeBlock { "test2"; }
code_block_2 = CodeBlock { "Windows"; }
byName = Category.ByName(name=code_block_2)
all_elements_of_category = ElementsOfCategory(Category=byName)
firstItem = List.FirstItem(list=all_elements_of_category)
elementType = Element.ElementType(element=firstItem)
code_block_3 = CodeBlock { "Width"; "Greater"; 2000; }
o_parameter_byname = Orchid.RevitProject.Parameters.Parameter.ByName(element=elementType, name=code_block_3.out0)
o_filterrule_create = Orchid.RevitProject.Filters.FilterRule.Create(parameter=o_parameter_byname, ruleType=code_block_3.out1, value=code_block_3.out2)
code_block_4 = CodeBlock { ["Doors","Windows"]; }
byName_2 = Category.ByName(name=code_block_4)
o_parameterfilter_create = Orchid.RevitProject.Filters.ParameterFilter.Create(name=code_block, filterRule=o_filterrule_create, category=byName_2)

# group: Add filter to view, and set visibility
views = Views("{3D}")  # graph input
boolean = BoolSelector(false)  # graph input
o_view_addfilter = Orchid.RevitProject.Views.View.AddFilter(view=views, parameterFilter=o_parameterfilter_create, visibility=boolean)
filters = View.Filters(view=o_view_addfilter)

# group: Filter rule for user-defined parameters (project, shared, and global parameters)
code_block_5 = CodeBlock { "test1"; }
# note: File: defaultProject_param
code_block_6 = CodeBlock()
# ---------- code_block_6.designscript (12 lines) ----------
// Parameter name
"TestStringParameter";
"TestIntegerParameter";
"TestDoubleParameter";

// Rule Type
"==";

// values
"Something";
500;
500.0;
# ----------------------------------------
o_filterrule_create_2 = Orchid.RevitProject.Filters.FilterRule.Create(parameterName=code_block_6.out0, ruleType=code_block_6.out3, value=code_block_6.out4)
o_projectparameter_byname = Orchid.RevitProject.Parameters.ProjectParameter.ByName(parameterName=code_block_6.out2)
o_filterrule_create_3 = Orchid.RevitProject.Filters.FilterRule.Create(parameter=o_projectparameter_byname, ruleType=code_block_6.out3, value=code_block_6.out6)
code_block_7 = CodeBlock { ["Doors","Windows"]; }
byName_3 = Category.ByName(name=code_block_7)
boolean_2 = BoolSelector(false)  # graph input
id = Element.Id(element=o_projectparameter_byname)
watch = Watch(id)
name = Element.Name(element=o_projectparameter_byname)
watch_2 = Watch(name)

create = List.Create(item0=o_filterrule_create_2, item1=o_filterrule_create_3)

# group (continued): Filter rule for user-defined parameters (project, shared, and global parameters)
o_parameterfilter_create_2 = Orchid.RevitProject.Filters.ParameterFilter.Create(name=code_block_5, filterRule=create, category=byName_3, andOr=boolean_2)

# group: OOTB -> Filter rule for (element) parameters. Notice the need to convert between SI and Imperial units!
code_block_8 = CodeBlock { "test3"; }
code_block_9 = CodeBlock { ["Windows","Doors"]; }
byName_4 = Category.ByName(name=code_block_9)
code_block_10 = CodeBlock { "Greater"; "Width"; 1000; }
convert_between_units = DynamoConvert(code_block_10.out2, MeasurementType="Length", FromConversion="Millimeters", ToConversion="Feet")
code_block_11 = CodeBlock { "Windows"; }
byName_5 = Category.ByName(name=code_block_11)
all_elements_of_category_2 = ElementsOfCategory(Category=byName_5)
firstItem_2 = List.FirstItem(list=all_elements_of_category_2)
elementType_2 = Element.ElementType(element=firstItem_2)
parameterByName = Parameter.ParameterByName(element=elementType_2, name=code_block_10.out1)
byRuleType = Revit.Filter.FilterRule.ByRuleType(type=code_block_10.out0, value=convert_between_units, parameter=parameterByName)
byRules = Revit.Filter.ParameterFilterElement.ByRules(name=code_block_8, categories=byName_4, rules=byRuleType)

# group: Get FilterRule and convert so it can be sat as an AND filter
o_parameterfilter_getrule = Orchid.RevitProject.Filters.ParameterFilter.GetRule(parameterFilter=byRules)
code_block_12 = CodeBlock { "test4"; }
boolean_3 = BoolSelector(true)  # graph input
o_parameterfilter_create_3 = Orchid.RevitProject.Filters.ParameterFilter.Create(name=code_block_12, filterRule=o_parameterfilter_getrule, category=byName_2, andOr=boolean_3)

# group: Add filter rule
o_parameterfilter_ruletree = Orchid.RevitProject.Filters.ParameterFilter.RuleTree(parameterFilter=o_parameterfilter_create_2)
o_parameterfilter_addrule = Orchid.RevitProject.Filters.ParameterFilter.AddRule(parameterFilter=o_parameterfilter_create_2, ruleTree=o_parameterfilter_ruletree, filterRule=o_filterrule_create)
o_parameterfilter_ruletree_2 = Orchid.RevitProject.Filters.ParameterFilter.RuleTree(parameterFilter=o_parameterfilter_addrule)
boolean_4 = BoolSelector(false)  # graph input
o_parameterfilter_addrule_2 = Orchid.RevitProject.Filters.ParameterFilter.AddRule(parameterFilter=o_parameterfilter_addrule, ruleTree=o_parameterfilter_ruletree_2, filterRule=o_parameterfilter_getrule, andOr=boolean_4)
o_parameterfilter_ruletree_3 = Orchid.RevitProject.Filters.ParameterFilter.RuleTree(parameterFilter=o_parameterfilter_addrule_2)
code_block_13 = CodeBlock { [3]; [3,2]; }
boolean_5 = BoolSelector(false)  # graph input
o_parameterfilter_addrule_3 = Orchid.RevitProject.Filters.ParameterFilter.AddRule(parameterFilter=o_parameterfilter_addrule_2, ruleTree=o_parameterfilter_ruletree_3, atIndex=code_block_13.out0, filterRule=o_filterrule_create, andOr=boolean_5)
o_parameterfilter_ruletree_4 = Orchid.RevitProject.Filters.ParameterFilter.RuleTree(parameterFilter=o_parameterfilter_addrule_3)
watch_3 = Watch(o_parameterfilter_ruletree_4)
watch_4 = Watch(o_parameterfilter_ruletree_3)
watch_5 = Watch(o_parameterfilter_ruletree_2)
watch_6 = Watch(o_parameterfilter_ruletree)

o_parameter_filters = ParameterFilter("Architectural")  # graph input
watch_7 = Watch(o_parameter_filters)
o_parameterfilter_indocument = Orchid.RevitProject.Filters.ParameterFilter.InDocument()
watch_8 = Watch(o_parameterfilter_indocument)
o_datastream_await = Orchid.Common.DataStream.Await(pass=code_block_5, waitFor=o_parameterfilter_create_2)
o_parameterfilter_byname = Orchid.RevitProject.Filters.ParameterFilter.ByName(name=o_datastream_await)
watch_9 = Watch(o_parameterfilter_byname)

# group: Ruletype
code_block_14 = CodeBlock()
# ---------- code_block_14.designscript (25 lines) ----------
// Dynamo RuleTypes
// Please notice the spelling
// issue --> GeaterOrEqual
"BeginsWith";
"Contains";
"EndsWith";
"Equals";
"Greater";
"Less";
"GeaterOrEqual";
"GreaterOrEqual";
"LessOrEqual";
"NotBeginsWith";
"NotContains";
"NotEndsWith";
"NotEquals";

// Orchid additional
// Ruletypes
"==";
">";
"<";
">=";
"<=";
"!=";
# ----------------------------------------
select_rule_type = RuleTypes("Greater")  # graph input

# group: Converter
o_object_torevittype = Orchid.Common.Object.ToRevitType(object=o_parameterfilter_byname)
o_object_todynamotype = Orchid.Common.Object.ToDynamoType(object=o_object_torevittype)
watch_10 = Watch(o_object_todynamotype)
watch_11 = Watch(o_object_torevittype)

# group: Remove/Replace filter rule
code_block_15 = CodeBlock { [3]; [3,2]; }
o_parameterfilter_replacerule = Orchid.RevitProject.Filters.ParameterFilter.ReplaceRule(parameterFilter=o_parameterfilter_addrule_3, ruleTree=o_parameterfilter_ruletree_4, atIndex=code_block_15.out0, filterRule=byRuleType)
o_parameterfilter_ruletree_5 = Orchid.RevitProject.Filters.ParameterFilter.RuleTree(parameterFilter=o_parameterfilter_replacerule)
code_block_16 = CodeBlock { 2; }
o_parameterfilter_removerule = Orchid.RevitProject.Filters.ParameterFilter.RemoveRule(parameterFilter=o_parameterfilter_replacerule, ruleTree=o_parameterfilter_ruletree_5, atIndex=code_block_16)
o_parameterfilter_ruletree_6 = Orchid.RevitProject.Filters.ParameterFilter.RuleTree(parameterFilter=o_parameterfilter_removerule)
watch_12 = Watch(o_parameterfilter_ruletree_6)
watch_13 = Watch(o_parameterfilter_ruletree_5)

o_parameterfilter_ruletree_7 = Orchid.RevitProject.Filters.ParameterFilter.RuleTree(parameterFilter=byRules)
watch_14 = Watch(o_parameterfilter_ruletree_7)
o_parameterfilter_ruletree_8 = Orchid.RevitProject.Filters.ParameterFilter.RuleTree(parameterFilter=o_parameterfilter_create_3)
watch_15 = Watch(o_parameterfilter_ruletree_8)

# group: Clear rules
o_parameterfilter_clearrules = Orchid.RevitProject.Filters.ParameterFilter.ClearRules(parameterFilter=o_parameterfilter_create_3)  # frozen

# group: Get FilterRule from Ruletree
code_block_17 = CodeBlock(ruleTree=o_parameterfilter_ruletree_4) { ruleTree[0]; ruleTree[3][0]; ruleTree[3][1]; }
watch_16 = Watch(code_block_17.out2)
o_elementfilter_getrule = Orchid.RevitProject.Filters.ElementFilter.GetRule(elementFilter=code_block_17.out0)
watch_17 = Watch(o_elementfilter_getrule)
