# Dynamo graph Group_R21.dyn "Group" (Dynamo 2.12.1.8246)
# packages: Orchid 206.6.0.5794

# group: Create group
code_block = CodeBlock()
# ---------- code_block.designscript (9 lines) ----------
"Model";
"Annotation";
"AnalyticalModel";
"Internal";

["Model",
"Annotation",
"AnalyticalModel",
"Internal"];
# ----------------------------------------
o_element_bycategorytype = Orchid.RevitProject.Elements.Element.ByCategoryType(categoryType=code_block.out0)
watch = Watch(o_element_bycategorytype.Element)
code_block_2 = CodeBlock { "test"; }
flatten = List.Flatten(list=o_element_bycategorytype.Element)
o_group_create = Orchid.RevitProject.Elements.Group.Create(name=code_block_2, element=flatten)

# group: Group delete
code_block_3 = CodeBlock { "test"; }
o_group_delete = Orchid.RevitProject.Elements.Group.Delete(name=code_block_3)  # frozen
o_groups = Group("test")  # graph input
o_group_delete_2 = Orchid.RevitProject.Elements.Group.Delete(group=o_groups)  # frozen
o_group_getbyname = Orchid.RevitProject.Elements.Group.GetByName(name=code_block_3)
o_group_delete_3 = Orchid.RevitProject.Elements.Group.Delete(group=o_group_getbyname)  # frozen

# group: Group ungroup
code_block_4 = CodeBlock { "test"; }
o_group_ungroup = Orchid.RevitProject.Elements.Group.UnGroup(name=code_block_4)  # frozen
o_groups_2 = Group("test")  # graph input
o_group_ungroup_2 = Orchid.RevitProject.Elements.Group.UnGroup(group=o_groups_2)  # frozen
o_group_getbyname_2 = Orchid.RevitProject.Elements.Group.GetByName(name=code_block_4)
o_group_ungroup_3 = Orchid.RevitProject.Elements.Group.UnGroup(group=o_group_getbyname_2)  # frozen

# group: GroupType delete
code_block_5 = CodeBlock { "test"; }
o_grouptype_delete = Orchid.RevitProject.Elements.GroupType.Delete(name=code_block_5)  # frozen
o_grouptypes = GroupType("test")  # graph input
o_grouptype_delete_2 = Orchid.RevitProject.Elements.GroupType.Delete(groupType=o_grouptypes)  # frozen
