# Dynamo graph LevelDependingViews_R22.dyn (Dynamo 2.12.1.8246)
# packages: Orchid 212.4.0.5804

# group: Level
o_level_buildingstory = Orchid.RevitProject.Datums.Level.BuildingStory()
o_level_associatedfloorplan = Orchid.RevitProject.Datums.Level.AssociatedFloorPlan(level=o_level_buildingstory)
watch = Watch(o_level_associatedfloorplan)
o_level_allassociatedplans = Orchid.RevitProject.Datums.Level.AllAssociatedPlans(level=o_level_buildingstory)
watch_2 = Watch(o_level_allassociatedplans)
o_level_indocument = Orchid.RevitProject.Datums.Level.InDocument()
o_view_onsheet = Orchid.RevitProject.Views.View.OnSheet(view=o_level_allassociatedplans)
filterByBoolMask = List.FilterByBoolMask(list=o_level_allassociatedplans, mask=o_view_onsheet)

# group: View
# note: File: defaultProject
o_view_plan = Orchid.RevitProject.Views.View.Plan()
o_view_associatedlevel = Orchid.RevitProject.Views.View.AssociatedLevel(view=o_view_plan)
watch_3 = Watch(o_view_associatedlevel)

# group: Associated view, viewport, and sheet
o_view_associated = Orchid.RevitProject.Views.View.Associated(view=filterByBoolMask.in)
o_list_clean = Orchid.Common.List.Clean(list=o_view_associated.Viewport)
o_viewport_associated = Orchid.RevitProject.Views.Viewport.Associated(viewport=o_list_clean)
watch_4 = Watch(o_viewport_associated.View)
o_list_clean_2 = Orchid.Common.List.Clean(list=o_view_associated.Sheet)
watch_5 = Watch(o_list_clean_2)
watch_6 = Watch(o_list_clean)
o_sheet_associated = Orchid.RevitProject.Views.Sheet.Associated(sheet=o_list_clean_2)
watch_7 = Watch(o_sheet_associated.View)
watch_8 = Watch(o_viewport_associated.Sheet)
watch_9 = Watch(o_sheet_associated.Viewport)

# group: Sheet
code_block = CodeBlock { "A.101"; "Level 1 (door)"; }
o_sheet_getbynameandnumber = Orchid.RevitProject.Views.Sheet.GetByNameAndNumber(number=code_block.out0, name=code_block.out1)
watch_10 = Watch(o_sheet_getbynameandnumber)

# group: Viewport label
o_viewport_getlabel = Orchid.RevitProject.Views.Viewport.GetLabel(viewport=o_list_clean)
watch_11 = Watch(o_viewport_getlabel)
o_viewport_label = Orchid.RevitProject.Views.Viewport.Label()
watch_12 = Watch(o_viewport_label)
string = StringInput("Title")
o_viewport_labelbyname = Orchid.RevitProject.Views.Viewport.LabelByName(name=string)
o_viewport_setlabel = Orchid.RevitProject.Views.Viewport.SetLabel(viewport=o_list_clean, label=o_viewport_labelbyname)
name = Element.Name(element=o_viewport_label)
watch_13 = Watch(name)
