# Dynamo graph LinkRepath_R21.dyn (Dynamo 2.6.2.15705)
# packages: Orchid 206.6.0.5794

# note: File: defaultProject
string = StringInput("%userprofile%\Programming\Testing\Data\2021_Data\")  # graph input
string_2 = StringInput("LinkedProject")  # graph input
code_block = CodeBlock(a=string, b=string_2) { a+b+".rvt"; }
o_file_frompath = Orchid.Common.File.FromPath(path=code_block)
o_document_backgroundopen = Orchid.RevitProject.Common.Document.BackgroundOpen(file=o_file_frompath)
o_link_getrevitlink = Orchid.RevitProject.Common.Link.GetRevitLink(document=o_document_backgroundopen)
string_3 = StringInput("%userprofile%\Programming\Testing\Data\2021_Data\")  # graph input
string_4 = StringInput("defaultBuilding")  # graph input
code_block_2 = CodeBlock(a=string_3, b=string_4) { a+b+".rvt"; }
o_file_frompath_2 = Orchid.Common.File.FromPath(path=code_block_2)
o_link_repath = Orchid.RevitProject.Common.Link.Repath(link=o_link_getrevitlink, file=o_file_frompath_2)
o_datastream_await = Orchid.Common.DataStream.Await(pass=o_document_backgroundopen, waitFor=o_link_repath)
boolean = BoolSelector(false)  # graph input
o_document_close = Orchid.RevitProject.Common.Document.Close(document=o_datastream_await, save=boolean)
