# Dynamo graph Location-Level-ReferencePlane_R22.dyn (Dynamo 2.12.1.8246)
# packages: Orchid 212.4.0.5794, Orchid 212.4.0.5828

# group: Project Position -> Survey point
code_block = CodeBlock { 0; 2000; -2000; 10; }
o_location_setprojectposition = Orchid.RevitProject.Common.Location.SetProjectPosition(northSouth=code_block.out1, eastWest=code_block.out1, elevation=code_block.out1, angle=code_block.out3)  # frozen
select_model_element = DSModelElementSelection()  # 1 picked in the model; graph input
o_location_setprojectposition_2 = Orchid.RevitProject.Common.Location.SetProjectPosition(element=select_model_element, northSouth=code_block.out0, eastWest=code_block.out0, elevation=code_block.out0, angle=code_block.out0)
o_location_getprojectposition = Orchid.RevitProject.Common.Location.GetProjectPosition(element=select_model_element)
watch = Watch(o_location_getprojectposition.Angle)
watch_2 = Watch(o_location_getprojectposition.Elevation)
watch_3 = Watch(o_location_getprojectposition.EastWest)
watch_4 = Watch(o_location_getprojectposition.NorthSouth)

# group: All levels -> Structural and/or Building Story
o_level_indocument = Orchid.RevitProject.Datums.Level.InDocument()
o_level_isstructural = Orchid.RevitProject.Datums.Level.IsStructural(level=o_level_indocument)
filterByBoolMask = List.FilterByBoolMask(list=o_level_indocument, mask=o_level_isstructural)
watch_5 = Watch(filterByBoolMask.in)
o_level_isbuildingstory = Orchid.RevitProject.Datums.Level.IsBuildingStory(level=o_level_indocument)
filterByBoolMask_2 = List.FilterByBoolMask(list=o_level_indocument, mask=o_level_isbuildingstory)
watch_6 = Watch(filterByBoolMask_2.in)
o_level_structural = Orchid.RevitProject.Datums.Level.Structural()
watch_7 = Watch(o_level_structural)
o_level_buildingstory = Orchid.RevitProject.Datums.Level.BuildingStory()
watch_8 = Watch(o_level_buildingstory)

# group: Get/Set Elevation
o_level_indocument_2 = Orchid.RevitProject.Datums.Level.InDocument()
boolean = BoolSelector(false)
o_level_getelevation = Orchid.RevitProject.Datums.Level.GetElevation(level=o_level_indocument_2, origin=boolean)
watch_9 = Watch(o_level_getelevation)
code_block_2 = CodeBlock { [0,3200,6400]; [2000,5200,8400]; }
o_level_setelevation = Orchid.RevitProject.Datums.Level.SetElevation(level=o_level_indocument_2, value=code_block_2.out1)
watch_10 = Watch(o_level_setelevation)

# group: Level by name
code_block_3 = CodeBlock { "Level 1"; "Some dummy name"; }
o_level_byname = Orchid.RevitProject.Datums.Level.ByName(name=code_block_3.out0)
watch_11 = Watch(o_level_byname)

# group: Propagation View
# note: File: defaultProject_extended
o_level_indocument_3 = Orchid.RevitProject.Datums.Level.InDocument()
o_document_activeview = Orchid.RevitProject.Common.Document.ActiveView()
o_datum_isvisibleinview = Orchid.RevitProject.Datums.Datum.IsVisibleInView(element=o_level_indocument_3, view=o_document_activeview)
filterByBoolMask_3 = List.FilterByBoolMask(list=o_level_indocument_3, mask=o_datum_isvisibleinview)
o_datum_getpropagationview = Orchid.RevitProject.Datums.Datum.GetPropagationView(element=filterByBoolMask_3.in, view=o_document_activeview)
uniqueItems = List.UniqueItems(list=o_datum_getpropagationview)
o_datum_setpropagationview = Orchid.RevitProject.Datums.Datum.SetPropagationView(element=filterByBoolMask_3.in, view=o_document_activeview, target=uniqueItems)
o_element_isvisibleinview = Orchid.RevitProject.Elements.Element.IsVisibleInView(element=o_level_indocument_3, view=o_document_activeview)

# group: Site - World Coordinate
o_location_sitelocation = Orchid.RevitProject.Common.Location.SiteLocation()
watch_12 = Watch(o_location_sitelocation.Longitude)
watch_13 = Watch(o_location_sitelocation.Latitude)

# group: ReferencePlane by name
code_block_4 = CodeBlock()
# ---------- code_block_4.designscript (9 lines) ----------
// if a reference plane is named
// "Reference Plane", then its a
// generic name, there should fail
// when requested by that name
"Reference Plane";

// Valid name values
"Site";
"Some dummy name";
# ----------------------------------------
o_referenceplane_byname = Orchid.RevitProject.Datums.ReferencePlane.ByName(name=code_block_4.out1)
watch_14 = Watch(o_referenceplane_byname)

# group: All reference planes
o_referenceplane_indocument = Orchid.RevitProject.Datums.ReferencePlane.InDocument()
plane = ReferencePlane.Plane(referencePlane=o_referenceplane_indocument)
watch_15 = Watch(plane)
name = Element.Name(element=o_referenceplane_indocument)
watch_16 = Watch(name)
watch_17 = Watch(o_referenceplane_indocument)

# group: Obsolete warning
o_level_indocument_4 = Orchid.RevitProject.Datums.Level.InDocument()
watch_18 = Watch(o_level_indocument_4)

# group: Project location - Internal point
o_project_locations = ProjectLocation("Internal")
o_location_getvector = Orchid.RevitProject.Common.Location.GetVector(location=o_project_locations)
watch_19 = Watch(o_location_getvector)
o_location_getpoint = Orchid.RevitProject.Common.Location.GetPoint(location=o_project_locations)
watch_20 = Watch(o_location_getpoint)
o_location_set = Orchid.RevitProject.Common.Location.Set(location=o_project_locations)
watch_21 = Watch(o_location_set)
o_location_current = Orchid.RevitProject.Common.Location.Current()
watch_22 = Watch(o_location_current)
name_2 = Element.Name(element=o_location_current)
watch_23 = Watch(name_2)
