# Dynamo graph Location_R22.dyn (Dynamo 2.12.1.8246)
# packages: Orchid 212.4.0.5828

# group: Project location
o_project_locations = ProjectLocation("No types found.")
o_location_getvector = Orchid.RevitProject.Common.Location.GetVector(location=o_project_locations)
watch = Watch(o_location_getvector)
o_location_getpoint = Orchid.RevitProject.Common.Location.GetPoint(location=o_project_locations)
watch_2 = Watch(o_location_getpoint)
o_location_set = Orchid.RevitProject.Common.Location.Set(location=o_project_locations)
watch_3 = Watch(o_location_set)
o_location_current = Orchid.RevitProject.Common.Location.Current()
watch_4 = Watch(o_location_current)
name = Element.Name(element=o_location_current)
watch_5 = Watch(name)

# group: Project phase
# note: File: defaultProject
o_phases = Phase("New Construction")  # graph input
watch_6 = Watch(o_phases)
