# Dynamo graph ParameterAttachedCategories_R22.dyn "ParameterAttachedCategories" (Dynamo 2.12.1.8246)
# packages: Orchid 212.4.0.5794

code_block = CodeBlock { "Occupant"; "IfcExportAs[Type]"; }
o_projectparameter_byname = Orchid.RevitProject.Parameters.ProjectParameter.ByName(parameterName=code_block.out1)
o_projectparameter_getcategory = Orchid.RevitProject.Parameters.ProjectParameter.GetCategory(parameter=o_projectparameter_byname)
watch = Watch(o_projectparameter_getcategory)
o_definition_byname = Orchid.RevitProject.Parameters.Definition.ByName(name=code_block.out1)
o_definition_getcategory = Orchid.RevitProject.Parameters.Definition.GetCategory(definition=o_definition_byname)
watch_2 = Watch(o_definition_getcategory)
o_projectparameter_getcategory_2 = Orchid.RevitProject.Parameters.ProjectParameter.GetCategory(parameterName=code_block.out1)
watch_3 = Watch(o_projectparameter_getcategory_2)

# group: Add IFC parameters
code_block_2 = CodeBlock { ["Doors", "Walls"]; }  # frozen
byName = Category.ByName(name=code_block_2)
o_sharedparameter_addifc = Orchid.RevitProject.Parameters.SharedParameter.AddIFC(category=byName)
