# Dynamo graph ParameterHandling_R21.dyn (Dynamo 2.6.2.15705)
# packages: Orchid 206.6.0.5794

# group: Parameter definition (external)
code_block = CodeBlock()
# ---------- code_block.designscript (4 lines) ----------
//Parameter name
["Creator Name",
"Creator Organization",
"Creator Build"];
# ----------------------------------------
o_definition_getexternal = Orchid.RevitProject.Parameters.Definition.GetExternal(name=code_block)
watch = Watch(o_definition_getexternal)

# group: Project parameters in document
# note: File: defaultProject
o_document_projectparameters = Orchid.RevitProject.Common.Document.ProjectParameters()
name = Element.Name(element=o_document_projectparameters.ParameterElement)
watch_2 = Watch(o_document_projectparameters.Definition)
watch_3 = Watch(o_document_projectparameters.ParameterElement)
watch_4 = Watch(name)

# group: Parameter Definitions
o_parameter_definitions = ParameterDefinition("Occupant")
type = Object.Type(obj=o_parameter_definitions)
watch_5 = Watch(o_parameter_definitions)

# group: Shared parameters in document
o_document_sharedparameters = Orchid.RevitProject.Common.Document.SharedParameters()
watch_6 = Watch(o_document_sharedparameters.Guid)
watch_7 = Watch(o_document_sharedparameters.Definition)
name_2 = Element.Name(element=o_document_sharedparameters.ParameterElement)
watch_8 = Watch(o_document_sharedparameters.ParameterElement)
watch_9 = Watch(name_2)

# group: Parameter definition
o_definition_byname = Orchid.RevitProject.Parameters.Definition.ByName(name=name)
watch_10 = Watch(o_definition_byname)
o_definition_byparameter = Orchid.RevitProject.Parameters.Definition.ByParameter(parameter=o_document_sharedparameters.ParameterElement)
watch_11 = Watch(o_definition_byparameter)

# group: Shared Parameter Definitions
o_shared_parameter_definitions = SharedParameterDefinition("Creator Organization")
type_2 = Object.Type(obj=o_shared_parameter_definitions)
watch_12 = Watch(o_shared_parameter_definitions)

# group: Definitions
code_block_2 = CodeBlock { "Creator Name"; }
o_projectparameter_byname = Orchid.RevitProject.Parameters.ProjectParameter.ByName(parameterName=code_block_2)
o_definition_byparameter_2 = Orchid.RevitProject.Parameters.Definition.ByParameter(parameter=o_projectparameter_byname)
watch_13 = Watch(o_definition_byparameter_2)
o_definition_byname_2 = Orchid.RevitProject.Parameters.Definition.ByName(name=code_block_2)
watch_14 = Watch(o_definition_byname_2)
watch_15 = Watch(o_projectparameter_byname)
id = Element.Id(element=o_projectparameter_byname)
o_projectparameter_byid = Orchid.RevitProject.Parameters.ProjectParameter.ById(id=id)
watch_16 = Watch(o_projectparameter_byid)

# group: clean for unwanted parameters
string = StringInput("ParameterCopy")  # graph input
contains = String.Contains(str=name_2, searchFor=string)
filterByBoolMask = List.FilterByBoolMask(list=o_document_sharedparameters.ParameterElement, mask=contains)
watch_17 = Watch(filterByBoolMask.in)
o_element_delete = Orchid.RevitProject.Elements.Element.Delete(element=filterByBoolMask.in)  # frozen
name_3 = Element.Name(element=filterByBoolMask.in)
watch_18 = Watch(name_3)

# group: Parameters
o_project_parameters = ProjectParameter("Occupant")
watch_19 = Watch(o_project_parameters)
o_global_parameters = GlobalParameter("GlobalParamTest")
watch_20 = Watch(o_global_parameters)
o_shared_parameters = SharedParameter("Creator Name")
watch_21 = Watch(o_shared_parameters)

# group: Global parameters in document
o_document_globalparameters = Orchid.RevitProject.Common.Document.GlobalParameters()
watch_22 = Watch(o_document_globalparameters.ParameterElement)
name_4 = Element.Name(element=o_document_globalparameters.ParameterElement)
watch_23 = Watch(name_4)
watch_24 = Watch(o_document_globalparameters.Definition)
o_object_torevittype = Orchid.Common.Object.ToRevitType(object=o_document_globalparameters.ParameterElement)
watch_25 = Watch(o_object_torevittype)
o_object_todynamotype = Orchid.Common.Object.ToDynamoType(object=o_object_torevittype)
watch_26 = Watch(o_object_todynamotype)

# group: Associate --> global parameters
code_block_3 = CodeBlock { "Windows"; }
byName = Category.ByName(name=code_block_3)
all_elements_of_category = ElementsOfCategory(Category=byName)
code_block_4 = CodeBlock { "AssociateParameter"; }
o_globalparameter_associate = Orchid.RevitProject.Parameters.GlobalParameter.Associate(element=all_elements_of_category, parameterName=code_block_4, globalParameter=o_document_globalparameters.ParameterElement, lacing=Longest)
o_datastream_await = Orchid.Common.DataStream.Await(pass=all_elements_of_category, waitFor=o_globalparameter_associate)
o_globalparameter_getassociated = Orchid.RevitProject.Parameters.GlobalParameter.GetAssociated(element=o_datastream_await, parameterName=code_block_4)
watch_27 = Watch(o_globalparameter_getassociated)
o_globalparameter_hasassociated = Orchid.RevitProject.Parameters.GlobalParameter.HasAssociated(element=o_datastream_await, parameterName=code_block_4)
watch_28 = Watch(o_globalparameter_hasassociated)
