# Dynamo graph Purge Background_R22.dyn (Dynamo 2.12.1.8246)
# packages: Orchid 206.6.0.5794, Orchid 212.4.0.5803

# note: File: defaultProject
directory_path = StringInput("%userprofile%\Programming\Testing\Data\testSet")  # graph input
string = StringInput("*.rfa")  # graph input
boolean = BoolSelector(false)  # graph input
o_directory_contents = Orchid.Common.Directory.Contents(directory=directory_path, searchString=string, deepSearch=boolean)
o_document_backgroundopen = Orchid.RevitProject.Common.Document.BackgroundOpen(file=o_directory_contents)

# group: Purge
boolean_2 = BoolSelector(true)  # graph input
o_familydocument_purge = Orchid.RevitFamily.FamilyDocument.Purge(familyDocument=o_document_backgroundopen, completely=boolean_2)

o_datastream_await = Orchid.Common.DataStream.Await(pass=o_document_backgroundopen, waitFor=o_familydocument_purge)
boolean_3 = BoolSelector(true)  # graph input
o_document_close = Orchid.RevitProject.Common.Document.Close(document=o_datastream_await, save=boolean_3)

# group: Cleanup backup files
o_datastream_await_2 = Orchid.Common.DataStream.Await(pass=directory_path, waitFor=o_document_close)
string_2 = StringInput("*.0001.rfa")  # graph input
boolean_4 = BoolSelector(true)  # graph input
o_directory_contents_2 = Orchid.Common.Directory.Contents(directory=o_datastream_await_2, searchString=string_2, deepSearch=boolean_4)
deleteFile = FileSystem.DeleteFile(path=o_directory_contents_2)
