# Dynamo graph Purge_R22.dyn "Purge" (Dynamo 2.12.1.8246)
# packages: Orchid 212.4.0.5799

boolean = BoolSelector(true)  # graph input
o_document_purge = Orchid.RevitProject.Common.Document.Purge(completely=boolean)
o_viewtemplate_purge = Orchid.RevitProject.Views.ViewTemplate.Purge()  # frozen
o_linestyle_purge = Orchid.Geometry.LineStyle.Purge()  # frozen
o_linepattern_purge = Orchid.Geometry.LinePattern.Purge()  # frozen
o_material_purge = Orchid.RevitMaterial.Material.Purge()  # frozen
o_asset_purge = Orchid.RevitMaterial.Visual.Asset.Purge()  # frozen
o_projectparameter_purge = Orchid.RevitProject.Parameters.ProjectParameter.Purge()  # frozen
# note: All above is included in Document.Purge
o_parameterfilter_purge = Orchid.RevitProject.Filters.ParameterFilter.Purge()  # frozen

# group: Imported dwg files etc.
code_block = CodeBlock { "ImportInstance"; }  # frozen
o_class_byname = Orchid.RevitProject.Elements.Class.ByName(name=code_block)
o_element_ofclass = Orchid.RevitProject.Elements.Element.OfClass(class=o_class_byname)
o_element_delete = Orchid.RevitProject.Elements.Element.Delete(element=o_element_ofclass)
o_imports_purge = Orchid.RevitProject.Common.Imports.Purge()

boolean_2 = BoolSelector(true)  # graph input
o_familydocument_purge = Orchid.RevitFamily.FamilyDocument.Purge(completely=boolean_2)  # frozen

# group: Imported lines from dwg files etc.
code_block_2 = CodeBlock { "Imports in Families"; }  # frozen
byName = Category.ByName(name=code_block_2)
o_subcategory_bycategory = Orchid.RevitProject.Categories.SubCategory.ByCategory(category=byName)
o_subcategory_delete = Orchid.RevitProject.Categories.SubCategory.Delete(category=byName, subCategory=o_subcategory_bycategory)
o_category_deleteimported = Orchid.RevitProject.Categories.Category.DeleteImported()
o_category_imported = Orchid.RevitProject.Categories.Category.Imported()  # frozen
delete = Orchid.RevitProject.Elements.Element.Delete(element=o_category_imported)

o_sheet_purge = Orchid.RevitProject.Views.Sheet.Purge()

# group: PostCommand
boolean_3 = BoolSelector(false)  # graph input
o_postcommand_purge = Orchid.RevitProject.Common.PostCommand.Purge(activate=boolean_3)  # frozen
