# Dynamo graph Revisions_R22.dyn (Dynamo 2.12.1.8246)
# packages: Orchid 206.6.0.5794, Orchid 212.4.0.5794

# group: Delete RevisionCloud
o_revisioncloud_indocument = Orchid.RevitProject.Common.RevisionCloud.InDocument()  # frozen
o_revisioncloud_delete = Orchid.RevitProject.Common.RevisionCloud.Delete(revisionCloud=o_revisioncloud_indocument)
watch = Watch(o_revisioncloud_delete)
revision = RevisionCloud.Revision(revisionCloud=o_revisioncloud_indocument)

# group: Set -- in Revit 2021 and before
o_revisions = Revision("Seq. 1 - Revision 1")  # graph input
code_block = CodeBlock { "Date 5678"; "Some description"; true; "CCC"; "DDD"; }
select_revision_visibility = RevisionVisibility("TagVisible")  # graph input
select_revision_number_type = RevisionNumberType("Numeric")  # graph input
o_revision_set = Orchid.RevitProject.Common.Revision.Set(revision=o_revisions, revDate=code_block.out0, description=code_block.out1, issued=code_block.out2, issuedTo=code_block.out3, issuedBy=code_block.out4, visibility=select_revision_visibility, numbering=select_revision_number_type)  # frozen

# group: DeleteAll
o_revisioncloud_deleteall = Orchid.RevitProject.Common.RevisionCloud.DeleteAll()  # frozen
watch_2 = Watch(o_revisioncloud_deleteall)

# group: Get
o_revisions_2 = Revision("Seq. 1 - Revision 1")  # graph input
o_revision_get = Orchid.RevitProject.Common.Revision.Get(revision=o_revisions_2)
name = Element.Name(element=o_revisions_2)

# group: Add to Sheet / Remove from Sheet
o_sheet_views = SheetView("Level 1 (door)")  # graph input
o_revisions_3 = Revision("Seq. 1 - Revision 1")  # graph input
o_revision_addtosheet = Orchid.RevitProject.Common.Revision.AddToSheet(sheet=o_sheet_views, revision=o_revisions_3)
o_revision_removefromsheet = Orchid.RevitProject.Common.Revision.RemoveFromSheet(sheet=o_sheet_views, revision=o_revisions_3)

# group: InDocument
o_revision_indocument = Orchid.RevitProject.Common.Revision.InDocument()
lastItem = List.LastItem(list=o_revision_indocument)
o_revision_delete = Orchid.RevitProject.Common.Revision.Delete(revision=lastItem)  # frozen
watch_3 = Watch(o_revision_indocument)

# group: Create -- in Revit 2022 and beyond
# note: File: defaultProject
code_block_2 = CodeBlock { "Date 1234"; "New description"; true; "AAA"; "BBB"; }
select_revision_visibility_2 = RevisionVisibility("CloudAndTagVisible")  # graph input
o_revisionnumberings = RevisionNumbering("Numeric")
o_revision_create = Orchid.RevitProject.Common.Revision.Create(revDate=code_block_2.out0, description=code_block_2.out1, issued=code_block_2.out2, issuedTo=code_block_2.out3, issuedBy=code_block_2.out4, visibility=select_revision_visibility_2, numbering=o_revisionnumberings)

# group: Numbering
select_revision_numbering = RevisionNumbering("PerProject")  # graph input
o_revision_setnumbering = Orchid.RevitProject.Common.Revision.SetNumbering(numbering=select_revision_numbering)  # frozen
o_revision_getnumbering = Orchid.RevitProject.Common.Revision.GetNumbering()

# group: DeleteAll
o_revision_deleteall = Orchid.RevitProject.Common.Revision.DeleteAll()  # frozen
watch_4 = Watch(o_revision_deleteall)

# group: Create Revision Numbering -- in Revit 2022 and beyond
code_block_3 = CodeBlock { "Test"; }
select_revision_number_type_2 = RevisionNumberType("Alphanumeric")  # graph input
o_revisionnumbering_create = Orchid.RevitProject.Common.RevisionNumbering.Create(name=code_block_3, numberType=select_revision_number_type_2)

# group: InDocument -- in Revit 2022 and beyond
o_revisionnumbering_indocument = Orchid.RevitProject.Common.RevisionNumbering.InDocument()
watch_5 = Watch(o_revisionnumbering_indocument)
name_2 = Element.Name(element=o_revisionnumbering_indocument)

# group: Set -- in Revit 2022 and beyond
o_revisions_4 = Revision("Seq. 1 - Revision 1")  # graph input
code_block_4 = CodeBlock { "Date 5678"; "Some description"; true; "CCC"; "DDD"; }
select_revision_visibility_3 = RevisionVisibility("TagVisible")  # graph input
o_revisionnumberings_2 = RevisionNumbering("Numeric")
o_revision_set_2 = Orchid.RevitProject.Common.Revision.Set(revision=o_revisions_4, revDate=code_block_4.out0, description=code_block_4.out1, issued=code_block_4.out2, issuedTo=code_block_4.out3, issuedBy=code_block_4.out4, visibility=select_revision_visibility_3, numbering=o_revisionnumberings_2)

# group: Create -- in Revit 2021 and before
code_block_5 = CodeBlock { "Date 1234"; "Some description"; true; "AAA"; "BBB"; }
select_revision_visibility_4 = RevisionVisibility("CloudAndTagVisible")  # graph input
select_revision_number_type_3 = RevisionNumberType("Numeric")  # graph input
o_revision_create_2 = Orchid.RevitProject.Common.Revision.Create(revDate=code_block_5.out0, description=code_block_5.out1, issued=code_block_5.out2, issuedTo=code_block_5.out3, issuedBy=code_block_5.out4, visibility=select_revision_visibility_4, numbering=select_revision_number_type_3)  # frozen
