# Dynamo graph RotateByOrigin_R22.dyn (Dynamo 2.12.1.8246)
# packages: Orchid 212.4.0.5794

# group: Collect elements
code_block = CodeBlock { "--ModelElements--"; }
code_block_2 = CodeBlock()
# ---------- code_block_2.designscript (2 lines) ----------
// Category type elements
"Model";
# ----------------------------------------
o_element_bycategorytype = Orchid.RevitProject.Elements.Element.ByCategoryType(categoryType=code_block_2)
string_from_object = FromObject(object=o_element_bycategorytype.Category)
code_block_3 = CodeBlock()
# ---------- code_block_3.designscript (2 lines) ----------
// Filter for Curtain elements
"Curtain";
# ----------------------------------------
contains = String.Contains(string=string_from_object, searchFor=code_block_3)
filterByBoolMask = List.FilterByBoolMask(list=o_element_bycategorytype.Element, mask=contains)
o_wall_allstackedwall = Orchid.RevitProject.Elements.Wall.StackedWalls()
o_sweep_indocument = Orchid.RevitProject.Elements.Sweep.InDocument()
code_block_4 = CodeBlock { "MultistoryStairs"; }
o_class_byname = Orchid.RevitProject.Elements.Class.ByName(name=code_block_4)
all_elements_of_type = ElementsOfType(element_type=o_class_byname)
o_spatialelement = Orchid.RevitProject.Elements.SpatialElement.SeparationLines()  # "o|SpatialElement.AllSeparationLine"
join = List.Join(list0=filterByBoolMask.out, list1=o_wall_allstackedwall, list2=o_sweep_indocument, list3=all_elements_of_type, list4=o_spatialelement.Element)
flatten = List.Flatten(list=join)
o_group_create = Orchid.RevitProject.Elements.Group.Create(name=code_block, element=flatten)

# group: Collect special elements
o_referenceplane_indocument = Orchid.RevitProject.Datums.ReferencePlane.InDocument()
o_level_indocument = Orchid.RevitProject.Datums.Level.InDocument()
o_grid_indocument = Orchid.RevitProject.Datums.Grid.InDocument()
o_group_allmodel = Orchid.RevitProject.Elements.Group.Model()
join_2 = List.Join(list0=o_referenceplane_indocument, list1=o_level_indocument, list2=o_grid_indocument, list3=o_group_allmodel)

# group: Collect annotation elements
code_block_5 = CodeBlock()
# ---------- code_block_5.designscript (2 lines) ----------
// Category type elements
"Annotation";
# ----------------------------------------
o_element_bycategorytype_2 = Orchid.RevitProject.Elements.Element.ByCategoryType(categoryType=code_block_5)
code_block_6 = CodeBlock(category=o_element_bycategorytype_2.Category)
# ---------- code_block_6.designscript (3 lines) ----------
category.Name == "Section Boxes" ||
category.Name == "Revision Clouds"
? true : false;
# ----------------------------------------
filterByBoolMask_2 = List.FilterByBoolMask(list=o_element_bycategorytype_2.Element, mask=code_block_6)

# group: Collect additional elements that not can be grouped
o_group_alldetail = Orchid.RevitProject.Elements.Group.Detail()
o_element_ownerviewtype = Orchid.RevitProject.Elements.Element.OwnerViewType(element=o_group_alldetail)
code_block_7 = CodeBlock(t=o_element_ownerviewtype) { t != "Detail"? true : false; }
filterByBoolMask_3 = List.FilterByBoolMask(list=o_group_alldetail, mask=code_block_7)

# group: Collect linked instances
o_link_getcadlink = Orchid.RevitProject.Common.Link.GetCadLink()
o_link_getrevitlink = Orchid.RevitProject.Common.Link.GetRevitLink()
list_create = List.Create(item0=o_link_getcadlink, item1=o_link_getrevitlink)
flatten_2 = List.Flatten(list=list_create)
o_link_instance = Orchid.RevitProject.Common.Link.Instance(link=flatten_2)

# group: Project Origin
code_block_8 = CodeBlock { Autodesk.Point.ByCoordinates(0, 0, 0); -90; }

# group: join lists and unpin element
join_3 = List.Join(list0=o_group_create, list1=join_2, list2=filterByBoolMask_2.out, list3=filterByBoolMask_3.in, list4=o_link_instance)
flatten_3 = List.Flatten(list=join_3)
o_list_clean = Orchid.Common.List.Clean(list=flatten_3)
o_element_ispinned = Orchid.RevitProject.Elements.Element.IsPinned(element=o_list_clean)
filterByBoolMask_4 = List.FilterByBoolMask(list=o_list_clean, mask=o_element_ispinned)
o_element_unpin = Orchid.RevitProject.Elements.Element.UnPin(element=filterByBoolMask_4.in)
o_element_iscopymonitored = Orchid.RevitProject.Elements.Element.IsCopyMonitored(element=o_list_clean)
filterByBoolMask_5 = List.FilterByBoolMask(list=o_list_clean, mask=o_element_iscopymonitored)
o_datastream_await = Orchid.Common.DataStream.Await(pass=filterByBoolMask_5.out, waitFor=o_element_unpin)
o_element_rotate = Orchid.RevitProject.Elements.Element.Rotate(element=o_datastream_await, point=code_block_8.out0, angle=code_block_8.out1)

# group: re-pin elements
o_datastream_await_2 = Orchid.Common.DataStream.Await(pass=o_element_unpin, waitFor=o_element_rotate)
o_element_pin = Orchid.RevitProject.Elements.Element.Pin(element=o_datastream_await_2)

# group: Adjust view crop box
o_view_model = Orchid.RevitProject.Views.View.Model()
o_view_rotate = Orchid.RevitProject.Views.View.Rotate(view=o_view_model, point=code_block_8.out0, angle=code_block_8.out1)

# group: Adjust sectionsbox
o_view_threed = Orchid.RevitProject.Views.View.ThreeD()
o_view_rotatesectionbox = Orchid.RevitProject.Views.View.RotateSectionBox(view3D=o_view_threed, point=code_block_8.out0, angle=code_block_8.out1)

# group: Ungroup model elements
code_block_9 = CodeBlock { "--ModelElements--"; }
o_datastream_await_3 = Orchid.Common.DataStream.Await(pass=code_block_9, waitFor=o_element_rotate)
o_group_ungroup = Orchid.RevitProject.Elements.Group.UnGroup(name=o_datastream_await_3)

# group: dimensions
code_block_10 = CodeBlock()  # frozen
# ---------- code_block_10.designscript (4 lines) ----------
["Dimensions",
"SpotCoordinates",
"SpotElevations",
"SpotSlopes"];
# ----------------------------------------
byName = Category.ByName(name=code_block_10)
all_elements_of_category = ElementsOfCategory(Category=byName)
