# Dynamo graph Scheduling_R22.dyn (Dynamo 2.12.1.8246)
# packages: Orchid 2.12.5.6006

# group: Selection
# note: File: defaultProject
code_block = CodeBlock { "CategoryType"; "Model"; "Annotation"; "AnalyticalModel"; "Internal"; }
o_revit_enumbyname = Orchid.AdeskApp.Revit.EnumByName(enumType=code_block.out0, valueName=code_block.out1)
o_element_bycategorytype = Orchid.RevitProject.Elements.Element.ByCategoryType(categoryType=o_revit_enumbyname)
o_clipboard_copyto = Orchid.Common.Clipboard.CopyTo(object=o_element_bycategorytype.Category)
watch = Watch(o_element_bycategorytype.Category)

# group: Add shared parameter
code_block_2 = CodeBlock()
# ---------- code_block_2.designscript (6 lines) ----------
//Parameter name
"ProductID";
//SP Parameter group
"DTU_Facility";
//Parameter group
"PG_ADSK_MODEL_PROPERTIES";
# ----------------------------------------
o_sharedparameter_add = Orchid.RevitProject.Parameters.SharedParameter.Add(parameterName=code_block_2.out0, groupName=code_block_2.out1, group=code_block_2.out2)

# group: Create Schedules
code_block_3 = CodeBlock()
# ---------- code_block_3.designscript (7 lines) ----------
[
"Ceilings",
"Doors",
"Floors",
"Windows",
"Walls"
];
# ----------------------------------------
byName = Category.ByName(name=code_block_3)
code_block_4 = CodeBlock(category=byName) { t = category; t+" Shedule"; "RegularSchedule"; }
createSchedule = ScheduleView.CreateSchedule(category=code_block_4.t, name=code_block_4.out1, scheduleType=code_block_4.out2)
o_datastream_await = Orchid.Common.DataStream.Await(pass=createSchedule, waitFor=o_sharedparameter_add)
schedulableFields = ScheduleView.SchedulableFields(scheduleView=o_datastream_await)
code_block_5 = CodeBlock()
# ---------- code_block_5.designscript (9 lines) ----------
[
"ProductID",
"Type",
"Count",

// these are not avalible
// in all schedules!
"Level",
"Base Constraint"];
# ----------------------------------------
o_schedulablefield_byname = Orchid.RevitProject.Schedules.SchedulableField.ByName(schedulableField=schedulableFields@L2, name=code_block_5)
o_list_clean = Orchid.Common.List.Clean(list=o_schedulablefield_byname)
addFields = ScheduleView.AddFields(scheduleView=createSchedule@L1, fields=o_list_clean@L2)
schedule_type = ScheduleTypes("RegularSchedule")

# group: Format the field (column)
code_block_6 = CodeBlock { "Count"; }
o_schedulablefield_byname_2 = Orchid.RevitProject.Schedules.SchedulableField.ByName(schedulableField=o_list_clean, name=code_block_6, lacing=Longest)
o_schedulefield_getfield = Orchid.RevitProject.Schedules.ScheduleField.GetField(scheduleView=addFields, schedulableField=o_schedulablefield_byname_2)
code_block_7 = CodeBlock { "ScheduleHorizontalAlignment"; "Right"; "ScheduleFieldDisplayType"; "Totals"; }
o_revit_enumbyname_2 = Orchid.AdeskApp.Revit.EnumByName(enumType=code_block_7.out0, valueName=code_block_7.out1)
o_revit_enumbyname_3 = Orchid.AdeskApp.Revit.EnumByName(enumType=code_block_7.out2, valueName=code_block_7.out3)
o_schedulefield_format = Orchid.RevitProject.Schedules.ScheduleField.Format(scheduleField=o_schedulefield_getfield, horizontalAlignment=o_revit_enumbyname_2, calculate=o_revit_enumbyname_3)
o_schedule_field_display_types = ScheduleFieldDisplayType("Max")
o_schedule_heading_orientations = ScheduleHeadingOrientation("Vertical")
o_schedule_horizontal_alignments = ScheduleHorizontalAlignment("Center")

# group: Set the schedule
o_schedule_footer_type = ScheduleFooterType("Totals")
o_schedule_sort_order = ScheduleSortOrder("Ascending")
o_datastream_await_2 = Orchid.Common.DataStream.Await(pass=addFields, waitFor=o_schedulefield_format)
code_block_8 = CodeBlock()
# ---------- code_block_8.designscript (8 lines) ----------
["ProductID","Type"];
// footer
"ScheduleFooter";
["Totals","None"];
// blankLine
[true,false];
"Totals";
true;
# ----------------------------------------
o_orchid_enumbyname = Orchid.Common.Orchid.EnumByName(enumType=code_block_8.out1, valueName=code_block_8.out2)
o_orchid_enumbyname_2 = Orchid.Common.Orchid.EnumByName(enumType=code_block_8.out1, valueName=code_block_8.out4)
o_schedule_sortinggrouping = Orchid.RevitProject.Schedules.Schedule.SortingGrouping(scheduleView=o_datastream_await_2, name=code_block_8.out0, footer=o_orchid_enumbyname, blankLine=code_block_8.out3, grandTotals=o_orchid_enumbyname_2, itemize=code_block_8.out5)
