# Dynamo graph SharedParameter_R22.dyn (Dynamo 2.12.1.8246)
# packages: Orchid 212.4.0.5794, Orchid 2.12.5.5987

# group: Set the shared parameter file
string = StringInput("%userprofile%\Documents\Revit\Shared Parameters.txt")  # graph input
o_file_frompath = Orchid.Common.File.FromPath(path=string)
code_block = CodeBlock(data=o_file_frompath) { data; }
o_sharedparameter_setfile = Orchid.RevitProject.Parameters.SharedParameter.SetFile(file=code_block)
watch = Watch(o_sharedparameter_setfile)
string_2 = StringInput("..\COBie Extension Shared Parameters.txt")  # graph input
string_3 = StringInput("%userprofile%\Programming\Testing\Data\COBie Extension Shared Parameters.txt")  # graph input
o_file_frompath_2 = Orchid.Common.File.FromPath(path=string_3)

# group: Group by type and group name
o_sharedparameter = Orchid.RevitProject.Parameters.SharedParameter.GroupByTypeAndGroupName(file=o_sharedparameter_setfile)
watch_2 = Watch(o_sharedparameter.Guid)
watch_3 = Watch(o_sharedparameter.Definition)
watch_4 = Watch(o_sharedparameter.ParameterName)
watch_5 = Watch(o_sharedparameter.GroupName)
watch_6 = Watch(o_sharedparameter.ParameterType)

# group: Get shared parameters by file
o_sharedparameter_byfile = Orchid.RevitProject.Parameters.SharedParameter.ByFile(file=o_sharedparameter_setfile)
watch_7 = Watch(o_sharedparameter_byfile.ParameterName)
watch_8 = Watch(o_sharedparameter_byfile.ParameterType)
watch_9 = Watch(o_sharedparameter_byfile.Definition)
watch_10 = Watch(o_sharedparameter_byfile.Guid)
watch_11 = Watch(o_sharedparameter_byfile.GroupName)

# group: Group by group name and type
o_sharedparameter_2 = Orchid.RevitProject.Parameters.SharedParameter.GroupByGroupNameAndType(file=o_sharedparameter_setfile)
watch_12 = Watch(o_sharedparameter_2.Guid)
watch_13 = Watch(o_sharedparameter_2.ParameterName)
watch_14 = Watch(o_sharedparameter_2.Definition)
watch_15 = Watch(o_sharedparameter_2.ParameterType)
watch_16 = Watch(o_sharedparameter_2.GroupName)

# group: Get shared parameter file
o_sharedparameter_getfile = Orchid.RevitProject.Parameters.SharedParameter.GetFile()
watch_17 = Watch(o_sharedparameter_getfile)

# group: Select elements
code_block_2 = CodeBlock()
# ---------- code_block_2.designscript (4 lines) ----------
// Revit enumeration
"CategoryType";
// Category type elements
"Model";
# ----------------------------------------
o_revit_enumbyname = Orchid.AdeskApp.Revit.EnumByName(enumType=code_block_2.out0, valueName=code_block_2.out1)
o_element_bycategorytype = Orchid.RevitProject.Elements.Element.ByCategoryType(categoryType=o_revit_enumbyname)
watch_18 = Watch(o_element_bycategorytype.Category)

# group: Add IFC parameters
o_sharedparameter_addifc = Orchid.RevitProject.Parameters.SharedParameter.AddIFC(category=o_element_bycategorytype.Category)
name = Element.Name(element=o_sharedparameter_addifc)
watch_19 = Watch(name)

# group: Add shared parameters by groupName by provided file
string_4 = StringInput("%userprofile%\Programming\Testing\Data\COBie Extension Shared Parameters.txt")  # graph input
code_block_3 = CodeBlock()
# ---------- code_block_3.designscript (15 lines) ----------
//SP Parameter group
["Floor","Type"];
//Parameter group
["PG_ADSK_MODEL_PROPERTIES",
"PG_ADSK_MODEL_PROPERTIES"];
//Instance
[true,false];
//Vary pr group
//NOTE: this list must follow the order
//of true values in the "Instance" list.
//This list does not have to have same
//length as the above three lists!
[true,true];
//Categories
["Doors", "Windows", "Floors", "Walls"];
# ----------------------------------------
byName = Category.ByName(name=code_block_3.out4)
o_sharedparameter_addbyfile = Orchid.RevitProject.Parameters.SharedParameter.AddByFile(file=string_4, groupName=code_block_3.out0, group=code_block_3.out1, instance=code_block_3.out2, vary=code_block_3.out3, category=byName)
name_2 = Element.Name(element=o_sharedparameter_addbyfile.ParameterElement)
watch_20 = Watch(name_2)
watch_21 = Watch(o_sharedparameter_addbyfile.GroupName)

# group: Add shared parameters by groupName (current loaded)
code_block_4 = CodeBlock()
# ---------- code_block_4.designscript (15 lines) ----------
//SP Parameter group
["Energy","Dimensions"];
//Parameter group
["PG_ENERGY_ANALYSIS",
"PG_GEOMETRY"];
//Instance
[true,false];
//Vary pr group
//NOTE: this list must follow the order
//of true values in the "Instance" list.
//This list does not have to have same
//length as the above three lists!
[true,true];
//Categories
["Doors", "Windows", "Floors", "Walls"];
# ----------------------------------------
byName_2 = Category.ByName(name=code_block_4.out4)
o_sharedparameter_addbygroup = Orchid.RevitProject.Parameters.SharedParameter.AddByGroup(groupName=code_block_4.out0, group=code_block_4.out1, instance=code_block_4.out2, vary=code_block_4.out3, category=byName_2)
watch_22 = Watch(o_sharedparameter_addbygroup.GroupName)
name_3 = Element.Name(element=o_sharedparameter_addbygroup.ParameterElement)
watch_23 = Watch(name_3)
