# Dynamo graph StartingView_R21.dyn "StartingView" (Dynamo 2.3.1.11775)
# packages: Orchid 206.6.0.5794

views = Views("{3D}")  # graph input
o_document_setstartingview = Orchid.RevitProject.Common.Document.SetStartingView(view=views)
watch = Watch(o_document_setstartingview)
