# Dynamo graph View-Cropbox_R21.dyn (Dynamo 2.6.2.15705)
# packages: Orchid 206.6.0.5794

# group: Adjust view crop box
o_view_model = Orchid.RevitProject.Views.View.Model()
o_view_getcropbox = Orchid.RevitProject.Views.View.GetCropBox(view=o_view_model)

# group: Proces by vector
select_model_element = DSModelElementSelection()  # 1 picked in the model; graph input
getLocation = Element.GetLocation(element=select_model_element)
asVector = Point.AsVector(point=getLocation)
reverse = Vector.Reverse(vector=asVector)

# group: ...by curve
startPoint = Curve.StartPoint(curve=o_view_getcropbox.Curve)
add = Point.Add(point=startPoint, vectorToAdd=reverse)
endPoint = Curve.EndPoint(curve=o_view_getcropbox.Curve)
add_2 = Point.Add(point=endPoint, vectorToAdd=reverse)
byStartPointEndPoint = Line.ByStartPointEndPoint(startPoint=add, endPoint=add_2)
o_view_setcropbox = Orchid.RevitProject.Views.View.SetCropBox(view=o_view_model, curve=byStartPointEndPoint)

# group: Adjust view crop box
o_view_model_2 = Orchid.RevitProject.Views.View.Model()
o_view_movecropbox = Orchid.RevitProject.Views.View.MoveCropBox(view=o_view_model_2, point=getLocation)

# group: Adjust sectionsbox
o_view_threed = Orchid.RevitProject.Views.View.ThreeD()
o_view_movesectionbox = Orchid.RevitProject.Views.View.MoveSectionBox(view3D=o_view_threed, point=getLocation)

# group: ...by bounding box
minPoint = BoundingBox.MinPoint(boundingBox=o_view_getcropbox.BoundingBox)
add_3 = Point.Add(point=minPoint, vectorToAdd=reverse)
maxPoint = BoundingBox.MaxPoint(boundingBox=o_view_getcropbox.BoundingBox)
add_4 = Point.Add(point=maxPoint, vectorToAdd=reverse)
byCorners = BoundingBox.ByCorners(min=add_3, max=add_4)
o_view_setcropbox_2 = Orchid.RevitProject.Views.View.SetCropBox(view=o_view_model, boundingBox=byCorners)

# group: Adjust view
o_view_model_3 = Orchid.RevitProject.Views.View.Model()
o_view_move = Orchid.RevitProject.Views.View.Move(view=o_view_model_3, point=getLocation)

# group: Model view
o_model_views = ModelView("Level 1 (door)")  # graph input
watch = Watch(o_model_views)

# group: Sheet view
o_sheet_views = SheetView("Level 1 (door)")  # graph input
watch_2 = Watch(o_sheet_views)

# group: Design option
o_design_options = DesignOption("No types found.")  # graph input
watch_3 = Watch(o_design_options)

# group: Scope box
# note: File: defaultProject_extended
o_scope_boxes = ScopeBox("No types found.")  # graph input
watch_4 = Watch(o_scope_boxes)

# group: Collect all view
o_view_indocument = Orchid.RevitProject.Views.View.InDocument()
watch_5 = Watch(o_view_indocument)
o_view_threed_2 = Orchid.RevitProject.Views.View.ThreeD()
watch_6 = Watch(o_view_threed_2)

# group: Collect sselected view by view family type
code_block = CodeBlock()
# ---------- code_block.designscript (3 lines) ----------
["Floor Plan",
"Section",
"3D View"];
# ----------------------------------------
o_viewfamilytype_byname = Orchid.RevitProject.Views.ViewFamilyType.ByName(name=code_block)
o_view_byfamilytype = Orchid.RevitProject.Views.View.ByFamilyType(viewType=o_viewfamilytype_byname)
watch_7 = Watch(o_view_byfamilytype)
o_view_family_types = ViewFamilyType("Floor Plan")

# group: Collect sselected view by view family type
code_block_2 = CodeBlock()
# ---------- code_block_2.designscript (3 lines) ----------
["FloorPlan",
"Section",
"ThreeD"];
# ----------------------------------------
o_viewtype_byname = Orchid.RevitProject.Views.ViewType.ByName(name=code_block_2)
o_view_bytype = Orchid.RevitProject.Views.View.ByType(viewType=o_viewtype_byname)
watch_8 = Watch(o_view_bytype)
o_view_type = ViewType("FloorPlan")

# group: Adjust viewport on sheet
o_viewport_indocument = Orchid.RevitProject.Views.Viewport.InDocument()
o_viewport_move = Orchid.RevitProject.Views.Viewport.Move(viewport=o_viewport_indocument, point=getLocation)
