# Dynamo graph ViewDuplicate-ViewTemplate_R21.dyn (Dynamo 2.6.2.15705)
# packages: Orchid 206.6.0.5794

# group: Duplicate view
# note: File: defaultProject
o_level_indocument = Orchid.RevitProject.Datums.Level.InDocument()
byLevel = FloorPlanView.ByLevel(level=o_level_indocument)
concat = String.Concat()  # unwired: string0, string1
code_block = CodeBlock()
# ---------- code_block.designscript (4 lines) ----------
//Text to add
["DTU_Export DWG - ",
"DTU_Upload - ",
"DTU_Check - "];
# ----------------------------------------
name = Element.Name(element=o_level_indocument)
cartesianProduct = List.CartesianProduct(comb=concat, list1=code_block, list2=name)
transpose = List.Transpose(lists=cartesianProduct)
o_view_duplicate_options = ViewDuplicateOption("Duplicate")  # graph input
o_view_duplicate = Orchid.RevitProject.Views.View.Duplicate(view=byLevel, name=transpose, option=o_view_duplicate_options)
transpose_2 = List.Transpose(lists=o_view_duplicate)
o_datastream_await = Orchid.Common.DataStream.Await(pass=byLevel, waitFor=o_view_duplicate)
o_element_delete = Orchid.RevitProject.Elements.Element.Delete(element=o_datastream_await)
o_level_buildingstory = Orchid.RevitProject.Datums.Level.BuildingStory()

# group: Find view template in model
o_viewtemplate_indocument = Orchid.RevitProject.Views.ViewTemplate.InDocument()
code_block_2 = CodeBlock()
# ---------- code_block_2.designscript (4 lines) ----------
// ViewTemplate to use
["DTU_Export DWG",
"DTU_FM Upload",
"DTU_FM Check"];
# ----------------------------------------
name_2 = Element.Name(element=o_viewtemplate_indocument)
contains = List.Contains(list=code_block_2, item=name_2@L1)
filterByBoolMask = List.FilterByBoolMask(list=o_viewtemplate_indocument, mask=contains)

# group: Set view template
name_3 = Element.Name(element=filterByBoolMask.in)
byKeysValues = DesignScript.Builtin.Dictionary.ByKeysValues(keys=name_3, values=filterByBoolMask.in)
valueAtKey = DesignScript.Builtin.Dictionary.ValueAtKey(dictionary=byKeysValues, key=code_block_2)
o_viewtemplate_set = Orchid.RevitProject.Views.ViewTemplate.Set(view=transpose_2, viewTemplate=valueAtKey)

watch = Watch(o_viewtemplate_set)
