# Dynamo graph ViewHandling_R22.dyn (Dynamo 2.12.1.8246)
# packages: Orchid 212.4.0.5985

# group: Get views
o_document_activeview = Orchid.RevitProject.Common.Document.ActiveView()
o_sheet_indocument = Orchid.RevitProject.Views.Sheet.InDocument()
o_sheet_view = Orchid.RevitProject.Views.Sheet.View(sheet=o_sheet_indocument)
flatten = List.Flatten(list=o_sheet_view)

# group: Get link visibility
o_link_getrevitlink = Orchid.RevitProject.Common.Link.GetRevitLink()
o_view_getlinkvisibility = Orchid.RevitProject.Views.View.GetLinkVisibility(view=flatten, link=o_link_getrevitlink)
watch = Watch(o_view_getlinkvisibility)

# group: Set link visibility
# note: File: LinkedProject
code_block = CodeBlock { "Level 1 (door)"; }
o_view_byname = Orchid.RevitProject.Views.View.ByName(name=code_block)
o_link_getrevitlink_2 = Orchid.RevitProject.Common.Link.GetRevitLink()
boolean = BoolSelector(false)
o_view_setlinkvisibility = Orchid.RevitProject.Views.View.SetLinkVisibility(view=o_view_byname, link=o_link_getrevitlink_2, visible=boolean)

# group: Get link visibility
o_view_getlinkvisibility_2 = Orchid.RevitProject.Views.View.GetLinkVisibility(view=o_view_setlinkvisibility)
watch_2 = Watch(o_view_getlinkvisibility_2.Link)
watch_3 = Watch(o_view_getlinkvisibility_2.boolean)

# group: Has view a view template attached
o_view_hasviewtemplate = Orchid.RevitProject.Views.View.HasViewTemplate(view=flatten)
watch_4 = Watch(o_view_hasviewtemplate)
