# Dynamo graph Workset_R22.dyn (Dynamo 2.12.1.8246)
# packages: Orchid 212.4.0.5985

o_workset_userworkset = Orchid.RevitProject.Common.Workset.UserWorkset()
o_workset_name = Orchid.RevitProject.Common.Workset.Name(workset=o_workset_userworkset)
o_workset_byname = Orchid.RevitProject.Common.Workset.ByName(name=o_workset_name)
watch = Watch(o_workset_byname)
watch_2 = Watch(o_workset_name)
o_workset_id = Orchid.RevitProject.Common.Workset.Id(workset=o_workset_userworkset)
o_workset_byid = Orchid.RevitProject.Common.Workset.ById(id=o_workset_id)
watch_3 = Watch(o_workset_byid)
watch_4 = Watch(o_workset_userworkset)
watch_5 = Watch(o_workset_id)
o_workset_uniqueid = Orchid.RevitProject.Common.Workset.UniqueId(workset=o_workset_userworkset)
watch_6 = Watch(o_workset_uniqueid)
o_workset_indocument = Orchid.RevitProject.Common.Workset.InDocument()

# group: Selection
o_category_materialhostable = Orchid.RevitProject.Categories.Category.MaterialHostable()
o_element_bycategory = Orchid.RevitProject.Elements.Element.ByCategory(category=o_category_materialhostable)
code_block = CodeBlock { "WorksetToFilter"; }
o_element_getworkset = Orchid.RevitProject.Elements.Element.GetWorkset(element=o_element_bycategory.Element)
o_workset_name_2 = Orchid.RevitProject.Common.Workset.Name(workset=o_element_getworkset)
setParameterByName = Element.SetParameterByName(element=o_element_bycategory.Element, parameterName=code_block, value=o_workset_name_2)

# group: Worksets
o_worksets = Workset("View \"3D View: {3D}\"")  # graph input
watch_7 = Watch(o_worksets)
o_userworksets = UserWorkset("Test")
watch_8 = Watch(o_userworksets)

# group: SetOwner and Relinquish
boolean = BoolSelector(true)
o_element_relinquish = Orchid.RevitProject.Elements.Element.Relinquish(waitFor=boolean)
watch_9 = Watch(o_element_relinquish)
o_workset_userworkset_2 = Orchid.RevitProject.Common.Workset.UserWorkset()
o_workset_setowner = Orchid.RevitProject.Common.Workset.SetOwner(workset=o_workset_userworkset_2)
o_workset_relinquish = Orchid.RevitProject.Common.Workset.Relinquish(waitFor=o_workset_setowner)
watch_10 = Watch(o_workset_relinquish)

code_block_2 = CodeBlock { "Walls"; }
byName = Category.ByName(name=code_block_2)
all_elements_of_category = ElementsOfCategory(Category=byName)
o_element_getworkset_2 = Orchid.RevitProject.Elements.Element.GetWorkset(element=all_elements_of_category)
watch_11 = Watch(o_element_getworkset_2)
code_block_3 = CodeBlock { "something"; }
o_workset_create = Orchid.RevitProject.Common.Workset.Create(name=code_block_3)
o_datastream_await = Orchid.Common.DataStream.Await(pass=code_block_3, waitFor=o_workset_create)
o_workset_byname_2 = Orchid.RevitProject.Common.Workset.ByName(name=o_datastream_await)
o_element_setworkset = Orchid.RevitProject.Elements.Element.SetWorkset(element=all_elements_of_category, workset=o_workset_byname_2)

# group: Selection
# note: File: worksharing_locale
code_block_4 = CodeBlock()
# ---------- code_block_4.designscript (11 lines) ----------
"CategoryType";

"Model";
"Annotation";
"AnalyticalModel";
"Internal";

["Model",
"Annotation",
"AnalyticalModel",
"Internal"];
# ----------------------------------------
o_revit_enumbyname = Orchid.AdeskApp.Revit.EnumByName(enumType=code_block_4.out0, valueName=code_block_4.out1)
o_element_bycategorytype = Orchid.RevitProject.Elements.Element.ByCategoryType(categoryType=o_revit_enumbyname)
code_block_5 = CodeBlock { "WorksetToFilter"; }
o_element_getworkset_3 = Orchid.RevitProject.Elements.Element.GetWorkset(element=o_element_bycategorytype.Element)
o_workset_name_3 = Orchid.RevitProject.Common.Workset.Name(workset=o_element_getworkset_3)
setParameterByName_2 = Element.SetParameterByName(element=o_element_bycategorytype.Element, parameterName=code_block_5, value=o_workset_name_3)

# group: Selection
o_element_hasmaterial = Orchid.RevitProject.Elements.Element.HasMaterial()
code_block_6 = CodeBlock { "WorksetToFilter"; }
o_element_getworkset_4 = Orchid.RevitProject.Elements.Element.GetWorkset(element=o_element_hasmaterial.Element)
o_workset_name_4 = Orchid.RevitProject.Common.Workset.Name(workset=o_element_getworkset_4)
setParameterByName_3 = Element.SetParameterByName(element=o_element_hasmaterial.Element, parameterName=code_block_6, value=o_workset_name_4)

# group: Category by name
natural_category_name = CodeBlock()
# ---------- natural_category_name.designscript (26 lines) ----------
[
"Casework",
"Ceilings",
"Columns",
"Curtain Wall Mullions",
"Curtain Panels",
"Curtain Systems",
"Doors",
"Entourage",
"Floors",
"Furniture",
"Furniture Systems",
"Generic Models",
"Plumbing Fixtures",
"Ramps",
"Roofs",
"Specialty Equipment",
"Stairs",
"Structural Columns",
"Structural Foundations",
"Structural Framing",
"Structural Beam Systems",
"Structural Stiffeners",
"Walls",
"Windows"
];
# ----------------------------------------
byName_2 = Category.ByName(name=natural_category_name)
built_in_categories = CodeBlock()
# ---------- built_in_categories.designscript (26 lines) ----------
[
"OST_Casework",
"OST_Ceilings",
"OST_Columns",
"OST_CurtainWallMullions",
"OST_CurtainWallPanels",
"OST_CurtaSystem",
"OST_Doors",
"OST_Entourage",
"OST_Floors",
"OST_Furniture",
"OST_FurnitureSystems",
"OST_GenericModel",
"OST_PlumbingFixtures",
"OST_Ramps",
"OST_Roofs",
"OST_SpecialityEquipment",
"OST_Stairs",
"OST_StructuralColumns",
"OST_StructuralFoundation",
"OST_StructuralFraming",
"OST_StructuralFramingSystem",
"OST_StructuralStiffener",
"OST_Walls",
"OST_Windows"
];
# ----------------------------------------

# group: Convert to Orchid type
o_workset_userworkset_3 = Orchid.RevitProject.Common.Workset.UserWorkset()
o_object_torevittype = Orchid.Common.Object.ToRevitType(object=o_workset_userworkset_3)
o_object_toorchidtype = Orchid.Common.Object.ToOrchidType(object=o_object_torevittype)
o_workset_name_5 = Orchid.RevitProject.Common.Workset.Name(workset=o_object_toorchidtype)
watch_12 = Watch(o_workset_name_5)

# group: Set global visibility
code_block_7 = CodeBlock { "Test"; }
o_workset_byname_3 = Orchid.RevitProject.Common.Workset.ByName(name=code_block_7)
boolean_2 = BoolSelector(false)
o_workset_setglobalvisibility = Orchid.RevitProject.Common.Workset.SetGlobalVisibility(workset=o_workset_byname_3, visibility=boolean_2)

# group: Get global visibility
o_workset_getglobalvisibility = Orchid.RevitProject.Common.Workset.GetGlobalVisibility()
watch_13 = Watch(o_workset_getglobalvisibility.Workset)
watch_14 = Watch(o_workset_getglobalvisibility.boolean)

# group: Get view visibility
o_document_activeview = Orchid.RevitProject.Common.Document.ActiveView()
o_view_getworksetvisibility = Orchid.RevitProject.Views.View.GetWorksetVisibility(view=o_document_activeview)
watch_15 = Watch(o_view_getworksetvisibility.Workset)
watch_16 = Watch(o_view_getworksetvisibility.Enum)
code_block_8 = CodeBlock { "Test"; }
o_workset_byname_4 = Orchid.RevitProject.Common.Workset.ByName(name=code_block_8)
o_view_getworksetvisibility_2 = Orchid.RevitProject.Views.View.GetWorksetVisibility(view=o_document_activeview, workset=o_workset_byname_4)
watch_17 = Watch(o_view_getworksetvisibility_2)

# group: Set view visibility
o_document_activeview_2 = Orchid.RevitProject.Common.Document.ActiveView()
# note: open "Level 1 (door)"
code_block_9 = CodeBlock { "Test"; }
o_workset_byname_5 = Orchid.RevitProject.Common.Workset.ByName(name=code_block_9)
o_view_workset_visibility = WorksetVisibility("Hidden")
o_view_setworksetvisibility = Orchid.RevitProject.Views.View.SetWorksetVisibility(view=o_document_activeview_2, workset=o_workset_byname_5, visibility=o_view_workset_visibility)
