# Dynamo graph Worksharing_R21.dyn "Worksharing" (Dynamo 2.3.1.11775)
# packages: Orchid 206.6.0.5794

string = StringInput("C:\Users\Public\Temp\Worksharing\")  # graph input
string_2 = StringInput("2020_Central")  # graph input
code_block = CodeBlock(a=string, b=string_2) { a+b+".rvt"; }
o_file_frompath = Orchid.Common.File.FromPath(path=code_block)
boolean = BoolSelector(true)  # graph input
boolean_2 = BoolSelector(true)  # graph input
boolean_3 = BoolSelector(false)  # graph input
o_document_backgroundopen = Orchid.RevitProject.Common.Document.BackgroundOpen(file=o_file_frompath, detachFromCentral=boolean, discardWorksets=boolean_2, audit=boolean_3)
string_3 = StringInput("new")  # graph input
code_block_2 = CodeBlock(a=string, b=string_3) { a+b+".rvt"; }
boolean_4 = BoolSelector(false)  # graph input
o_document_saveas = Orchid.RevitProject.Common.Document.SaveAs(document=o_document_backgroundopen, name=code_block_2, overwrite=boolean_4)
o_document_close = Orchid.RevitProject.Common.Document.Close(document=o_document_saveas)
boolean_5 = BoolSelector(false)  # graph input
