# Dynamo graph moveToOrigin_Worksets_R22.dyn (Dynamo 2.12.1.8246)
# packages: Orchid 212.4.0.5986, Orchid 2.12.5.5987

# group: new origin -> as vector
select_model_element = DSModelElementSelection()  # 1 picked in the model; graph input
getLocation = Element.GetLocation(element=select_model_element)
o_point_reverse = Orchid.Geometry.Point.Reverse(point=getLocation)

# group: Write coordinate to txt file and copy coordinate to clipboard
o_document_current = Orchid.RevitProject.Common.Document.Current()
boolean = BoolSelector(false)
o_document_path = Orchid.RevitProject.Common.Document.Path(document=o_document_current, withExtension=boolean)
code_block = CodeBlock(file=o_document_path) { file+".txt"; }
string_from_object = FromObject(obj=o_point_reverse)
writeText = FileSystem.WriteText(filePath=code_block, text=string_from_object)
o_clipboard_copyto = Orchid.Common.Clipboard.CopyTo(object=o_point_reverse)

# group: Adjust view crop box
o_view_model = Orchid.RevitProject.Views.View.Model()
o_view_move = Orchid.RevitProject.Views.View.Move(view=o_view_model, point=o_point_reverse)

# group: Adjust sectionsbox
o_view_threed = Orchid.RevitProject.Views.View.ThreeD()
o_view_movesectionbox = Orchid.RevitProject.Views.View.MoveSectionBox(view3D=o_view_threed, point=o_point_reverse)

# group: Set workset ownership
o_workset_indocument = Orchid.RevitProject.Common.Workset.InDocument()
o_workset_setowner = Orchid.RevitProject.Common.Workset.SetOwner(workset=o_workset_indocument)

# group: Collect elements
code_block_2 = CodeBlock()
# ---------- code_block_2.designscript (4 lines) ----------
// Revit enumeration
"CategoryType";
// Category type elements
"Model";
# ----------------------------------------
o_revit_enumbyname = Orchid.AdeskApp.Revit.EnumByName(enumType=code_block_2.out0, valueName=code_block_2.out1)
o_datastream_await = Orchid.Common.DataStream.Await(pass=o_revit_enumbyname, waitFor=o_workset_setowner)
o_element_bycategorytype = Orchid.RevitProject.Elements.Element.ByCategoryType(categoryType=o_datastream_await)
string_from_object_2 = FromObject(obj=o_element_bycategorytype.Category)
code_block_3 = CodeBlock()
# ---------- code_block_3.designscript (2 lines) ----------
// Filter for Curtain elements
"Curtain";
# ----------------------------------------
contains = String.Contains(string=string_from_object_2, searchFor=code_block_3)
filterByBoolMask = List.FilterByBoolMask(list=o_element_bycategorytype.Element, mask=contains)
o_wall_stackedwalls = Orchid.RevitProject.Elements.Wall.StackedWalls()
o_sweep_indocument = Orchid.RevitProject.Elements.Sweep.InDocument()
o_spatialelement_separationlines = Orchid.RevitProject.Elements.SpatialElement.SeparationLines()
flatten = List.Flatten(list=o_spatialelement_separationlines.Element)
join = List.Join(list0=filterByBoolMask.out, list1=o_wall_stackedwalls, list2=o_sweep_indocument, list3=flatten)

# group: Collect special elements
code_block_4 = CodeBlock { "MultistoryStairs"; }
o_class_byname = Orchid.RevitProject.Elements.Class.ByName(name=code_block_4)
all_elements_of_type = ElementsOfType(element_type=o_class_byname)
o_referenceplane_indocument = Orchid.RevitProject.Datums.ReferencePlane.InDocument()
o_level_indocument = Orchid.RevitProject.Datums.Level.InDocument()
o_grid_indocument = Orchid.RevitProject.Datums.Grid.InDocument()
o_group_model = Orchid.RevitProject.Elements.Group.Model()
join_2 = List.Join(list0=all_elements_of_type, list1=o_referenceplane_indocument, list2=o_level_indocument, list3=o_grid_indocument, list4=o_group_model)

# group: Collect elements
code_block_5 = CodeBlock()
# ---------- code_block_5.designscript (4 lines) ----------
// Revit enumeration
"CategoryType";
// Category type elements
"Annotation";
# ----------------------------------------
o_revit_enumbyname_2 = Orchid.AdeskApp.Revit.EnumByName(enumType=code_block_5.out0, valueName=code_block_5.out1)
o_element_bycategorytype_2 = Orchid.RevitProject.Elements.Element.ByCategoryType(categoryType=o_revit_enumbyname_2)
code_block_6 = CodeBlock(category=o_element_bycategorytype_2.Category)
# ---------- code_block_6.designscript (3 lines) ----------
category.Name == "Section Boxes" ||
category.Name == "Revision Clouds"
? true : false;
# ----------------------------------------
filterByBoolMask_2 = List.FilterByBoolMask(list=o_element_bycategorytype_2.Element, mask=code_block_6)

# group: Collect additional elements that not can be grouped
o_group_detail = Orchid.RevitProject.Elements.Group.Detail()
o_element_ownerviewtype = Orchid.RevitProject.Elements.Element.OwnerViewType(element=o_group_detail)
code_block_7 = CodeBlock(t=o_element_ownerviewtype) { t != "Detail"? true : false; }
filterByBoolMask_3 = List.FilterByBoolMask(list=o_group_detail, mask=code_block_7)

# group: Collect linked instances
o_link_getcadlink = Orchid.RevitProject.Common.Link.GetCadLink()
o_link_getrevitlink = Orchid.RevitProject.Common.Link.GetRevitLink()
list_create = List.Create(item0=o_link_getcadlink, item1=o_link_getrevitlink)
o_link_instance = Orchid.RevitProject.Common.Link.Instance(link=list_create)

# group: join lists and unpin element
join_3 = List.Join(list0=join, list1=join_2, list2=filterByBoolMask_2.out, list3=filterByBoolMask_3.in, list4=o_link_instance)
flatten_2 = List.Flatten(list=join_3)
o_list_clean = Orchid.Common.List.Clean(list=flatten_2)
o_element_ispinned = Orchid.RevitProject.Elements.Element.IsPinned(element=o_list_clean)
filterByBoolMask_4 = List.FilterByBoolMask(list=o_list_clean, mask=o_element_ispinned)
o_element_unpin = Orchid.RevitProject.Elements.Element.UnPin(element=filterByBoolMask_4.in)
o_element_iscopymonitored = Orchid.RevitProject.Elements.Element.IsCopyMonitored(element=o_list_clean)
filterByBoolMask_5 = List.FilterByBoolMask(list=o_list_clean, mask=o_element_iscopymonitored)
o_datastream_await_2 = Orchid.Common.DataStream.Await(pass=filterByBoolMask_5.out, waitFor=o_element_unpin)
o_element_move = Orchid.RevitProject.Elements.Element.Move(element=o_datastream_await_2, point=o_point_reverse)

# group: re-pin elements
o_datastream_await_3 = Orchid.Common.DataStream.Await(pass=o_element_unpin, waitFor=o_element_move)
o_element_pin = Orchid.RevitProject.Elements.Element.Pin(element=o_datastream_await_3)

# group: Relinquish workset
o_workset_relinquish = Orchid.RevitProject.Common.Workset.Relinquish(waitFor=o_element_move)

# group: Revisions -> delete or add
# note: If revisions is deleted, then remember to
# remove they are added to the "move" list
o_revision_deleteall = Orchid.RevitProject.Common.Revision.DeleteAll()  # frozen
o_revisioncloud_indocument = Orchid.RevitProject.Common.RevisionCloud.InDocument()  # frozen
o_revisioncloud_deleteall = Orchid.RevitProject.Common.RevisionCloud.DeleteAll()  # frozen

# group: Adjust sectionsbox
code_block_8 = CodeBlock { "ViewType"; "ThreeD"; }  # frozen
o_revit_enumbyname_3 = Orchid.AdeskApp.Revit.EnumByName(enumType=code_block_8.out0, valueName=code_block_8.out1)
o_view_byviewtype = Orchid.RevitProject.Views.View.ByViewType(viewType=o_revit_enumbyname_3)
watch = Watch(o_view_byviewtype)
