# Dynamo graph Connector_Piping_R21.dyn "Connector_Piping" (Dynamo 2.3.1.11775)
# packages: Orchid 206.6.0.5794

code_block = CodeBlock { "Cooling Supply"; }
o_mepsystem_byname = Orchid.RevitProject.Systems.MEPSystem.ByName(name=code_block)

# group: Component
o_piping_component = Orchid.RevitProject.Systems.Piping.Component(pipingSystem=o_mepsystem_byname)
o_piping_accessory = Orchid.RevitProject.Systems.Piping.Accessory(pipingSystem=o_mepsystem_byname)
o_piping_fitting = Orchid.RevitProject.Systems.Piping.Fitting(pipingSystem=o_mepsystem_byname)
o_piping_equipment = Orchid.RevitProject.Systems.Piping.Equipment(pipingSystem=o_mepsystem_byname)
o_familyinstance_connector = Orchid.RevitProject.Systems.FamilyInstance.Connector(familyInstance=o_piping_equipment)

o_mep_systems = MEPSystem("Cooling Supply")  # graph input
watch = Watch(o_familyinstance_connector)
code_block_2 = CodeBlock(data=o_familyinstance_connector) { data; }
o_connector_host = Orchid.RevitProject.Systems.Connector.Host(connector=code_block_2)
watch_2 = Watch(o_connector_host)

# group: Network
o_piping_pipe = Orchid.RevitProject.Systems.Piping.Pipe(pipingSystem=o_mepsystem_byname)
o_element_connector = Orchid.RevitProject.Systems.Element.Connector(element=o_piping_pipe)
o_piping_network = Orchid.RevitProject.Systems.Piping.Network(pipingSystem=o_mepsystem_byname)

o_connector_isprimary = Orchid.RevitProject.Systems.Connector.IsPrimary(connector=code_block_2)
watch_3 = Watch(o_connector_isprimary)
o_connector_direction = Orchid.RevitProject.Systems.Connector.Direction(connector=code_block_2)
watch_4 = Watch(o_connector_direction)
o_connector_connection = Orchid.RevitProject.Systems.Connector.Connection(connector=code_block_2)
watch_5 = Watch(o_connector_connection)
o_connector_vector = Orchid.RevitProject.Systems.Connector.Vector(connector=code_block_2)
watch_6 = Watch(o_connector_vector)
o_connector_shape = Orchid.RevitProject.Systems.Connector.Shape(connector=code_block_2)
watch_7 = Watch(o_connector_shape.Shape)
o_connector_location = Orchid.RevitProject.Systems.Connector.Location(connector=code_block_2)
watch_8 = Watch(o_connector_location)
watch_9 = Watch(o_connector_shape.Dimension)
o_connector_isconnected = Orchid.RevitProject.Systems.Connector.IsConnected(connector=code_block_2)
watch_10 = Watch(o_connector_isconnected)
